# Grasshopper definition 2022-09-12_OfficeBuilding_H-Shape.gh (Grasshopper 1.0.7)
# plug-ins: Pufferfish, MetaHopper, Human, HVACEarlyDesignGraphRewritting

constructiontypes = HBConstructionTypes({"SteelFramed", "WoodFramed", "Mass", "Metal Building"}, selected="Mass")
climatezones = HBClimateZones({"1 - Very Hot": "1", "2 - Hot": "2", "3 - Warm": "3", "4 - Mixed": "4", "5 - Cool": "5", "6 - Cold": "6", "7 - Very Cold": "7", "8 - Subarctic": "8"}, selected="5 - Cool")
bldgvintages = HBBuildingVintages({"ASHRAE 90.1 2019  |  IECC 2021": "2019", "ASHRAE 90.1 2016  |  IECC 2018": "2016", "ASHRAE 90.1 2013  |  IECC 2015": "2013", "ASHRAE 90.1 2010  |  IECC 2012": "2010", "ASHRAE 90.1 2007  |  IECC 2009": "2007", "ASHRAE 90.1 2004  |  IECC 2006": "2004", "1980-2004 (CBECS)": "1980_2004", "Pre-1980 (CBECS)": "pre_1980"}, selected="ASHRAE 90.1 2019  |  IECC 2021")
bldgprograms = HBBuildingPrograms({"LargeOffice", "MediumOffice", "SmallOffice", "MidriseApartment", "HighriseApartment", "Retail", "StripMall", "PrimarySchool", "SecondarySchool", "SmallHotel", "LargeHotel", "Hospital", "Outpatient", "Laboratory", "Warehouse", "SuperMarket", "FullServiceRestaurant", "QuickServiceRestaurant", "Courthouse", "LargeDataCenterHighITE", "LargeDataCenterLowITE", "SmallDataCenterHighITE", "SmallDataCenterLowITE"}, selected="LargeOffice")
toggle = BooleanToggle(False)
constrsetclimate = HBConstructionSetByClimate(climate_zone=climatezones, constr_type=constructiontypes)  # -> constr_set; plug-in component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
panel = Panel("Framed walls")
number_slider = Slider(1.5, range=0..10)
panel_2 = Panel("Massive")
decnstrconstrset = HBDeconstructConstructionSet(constr_set=constrsetclimate)  # -> exterior_wall, exterior_roof, exposed_floor, ground_wall, ground_roof, ground_floor, window, skylight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; plug-in component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
searchconstrset = HBSearchConstructionSets()  # -> constr_sets; plug-in component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
panel_3 = Panel(searchconstrset)
decnstrconstr = HBDeconstructConstruction(constr=decnstrconstrset.exterior_wall)  # -> materials, layers, r_val_si, r_val_ip, u_fac_si, u_fac_ip, shgc, t_sol, t_vis; plug-in component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
panel_4 = Panel("E:\Nextcloud\UserData\Documents\Arbeit\Papers\Multi-objective_Machine-Assistance\Data-Generation\Databases\ExpertDB\Required-U-Values.csv")
decnstrmat = HBDeconstructMaterial()  # -> values, attr_names, r_val_si, r_val_ip; plug-in component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
panel_5 = Panel("E:\Nextcloud\Public\FOR2363\TP4\LUH\HVAC-Systems\BatchCurrent")
panel_6 = Panel("E:\Nextcloud\Archive\Vorlagen\Backgrounds\Weiss_1080x1080.png")
searchmats = HBSearchMaterials()  # -> opaque_mats, window_mats; plug-in component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
panel_7 = Panel("C:\EnergyPlusV9-5-0\energyplus.exe")
panel_8 = Panel("C:\EnergyPlusV9-5-0\WeatherData\DEU_Berlin.103840_IWEC.epw")
panel_9 = Panel(searchmats.opaque_mats)
heatcool = HBHeatCoolHVACTemplates({"Baseboard electric": "ElectricBaseboard", "Baseboard gas boiler": "BoilerBaseboard", "Baseboard central air source heat pump": "ASHPBaseboard", "Baseboard district hot water": "DHWBaseboard", "Direct evap coolers with baseboard electric": "EvapCoolers_ElectricBaseboard", "Direct evap coolers with baseboard gas boiler": "EvapCoolers_BoilerBaseboard"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}, selected=["Fan coil chiller with boiler": "FCU_Chiller_Boiler", "Water source heat pumps with ground source heat pump": "WSHP_GSHP"])
invertedbutton = Button(ExpressionNormal="True", ExpressionPressed="False")
required_u_values_path = FilePath(panel_4)
wallpaperpath = FilePath("E:\Dokumente\1000x750_Transparent.png")
folder_base_path = FilePath(panel_5)
weather_file_path = Text("C:\EnergyPlusV9-5-0\WeatherData\DEU_Munich.108660_IWEC.epw")
read_parameters = Boolean(invertedbutton)
reset_write = Boolean(Button())
dynamic_fassade = ValueList({"Horizontal-Windows": 0, "Vertical-Windows": 1, "Ribbon-Windows": 2}, selected="Horizontal-Windows")

dynamic_hc_system = ValueList({"Baseboard electric": "ElectricBaseboard", "Baseboard gas boiler": "BoilerBaseboard", "Baseboard central air source heat pump": "ASHPBaseboard", "Baseboard district hot water": "DHWBaseboard", "Direct evap coolers with baseboard electric": "EvapCoolers_ElectricBaseboard", "Direct evap coolers with baseboard gas boiler": "EvapCoolers_BoilerBaseboard"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}, selected="Baseboard gas boiler")
dynamic_orientation = Slider(0, range=0..90)
dynamic_rasterlength = Slider(2.83333333, range=2.5..3.5)
dynamic_rasterlength_y = Slider(3.5, range=2.5..3.5)
dynamic_floorheight = Slider(3, range=3..4)
dynamic_courtyard_segmentcount_rasterlen = Slider(7, range=7..12)  # "DYNAMIC_Courtyard_SegmentCount_RasterLength-Y"
dynamic_energystandard = ValueList({"GEG", "NZEB", "Passive"}, selected="GEG")
dynamic_shading = ValueList({"External-Shading": 0, "Low-HGC-Value": 1}, selected="External-Shading")
dynamic_orientation_2 = Number(dynamic_orientation)
dynamic_rasterlength_y_2 = Number(dynamic_rasterlength_y)
dynamic_rasterlength_2 = Number(dynamic_rasterlength)
dynamic_floorheight_2 = Number(dynamic_floorheight)
dynamic_courtyard_segmentcount_rasterlen_2 = Number(dynamic_courtyard_segmentcount_rasterlen)  # "DYNAMIC_Courtyard_SegmentCount_RasterLength-Y"
dynamic_fassade_2 = Text(dynamic_fassade)
dynamic_hc_system_2 = Text(dynamic_hc_system)
dynamic_shading_2 = Text(dynamic_shading)

unleashthehounds = BooleanToggle(False)
panel_10 = Panel(searchmats.window_mats)
button = Button()
heatcool_2 = HBHeatCoolHVACTemplates({"Baseboard electric": "ElectricBaseboard", "Baseboard gas boiler": "BoilerBaseboard", "Baseboard central air source heat pump": "ASHPBaseboard", "Baseboard district hot water": "DHWBaseboard", "Direct evap coolers with baseboard electric": "EvapCoolers_ElectricBaseboard", "Direct evap coolers with baseboard gas boiler": "EvapCoolers_BoilerBaseboard"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}, selected="Baseboard gas boiler")
run_simulation = Boolean(Toggle(False))
normal_messi_planes = Boolean(invert(Toggle(True)))
run_write = Boolean(Toggle(False))
run_solver = Boolean(unleashthehounds)

panel_11 = Panel("E:\Nextcloud\UserData\Documents\Arbeit\Papers\Multi-objective_Machine-Assistance\Data-Generation\Parameters.xlsx")
read_parameters_2 = Boolean(read_parameters)
docinfo = DocumentInfo(AutoUpdate=invert(read_parameters_2), Recursive=False)  # -> DocumentName, DocumentFilePath, Components, Params, _3rdPartyAssemblies
readparameters = ReadParameters(parameterspath=panel_11, read=read_parameters_2)  # -> continuous_parameters_3, values_2, discrete_parameters_3, discrete_values_2
trim = TrimTree(Tree=docinfo.Params, Depth=1)
concat = Concatenate(FragmentC="DYNAMIC", FragmentA="_", FragmentB=readparameters.discrete_parameters_3)
concat_2 = Concatenate(FragmentC="DYNAMIC", FragmentA="_", FragmentB=readparameters.continuous_parameters_3)
list = ItemSelector(
    readparameters.continuous_parameters_3,
    {"Orientation", "RasterLength", "FloorHeight", "Courtyard_SegmentCount_RasterLength-Y"}, selected=[])
continuous_parameters_selected = Text(list)
concat_3 = Concatenate(FragmentC="DYNAMIC", FragmentA="_", FragmentB=continuous_parameters_selected)
list_2 = ItemSelector(readparameters.discrete_parameters_3, {"EnergyStandard", "Shading", "Fassade"}, selected=[])
discrete_parameters_selected = Text(list_2)
concat_4 = Concatenate(FragmentC="DYNAMIC", FragmentA="_", FragmentB=discrete_parameters_selected)
filterselectedparameters = FilterSelectedParameters(
    parameters=trim,
    discrete_parameters=concat,
    discrete_values=readparameters.discrete_values_2,
    discrete_parameters_selected=concat_4,
    continuous_parameters=concat_2,
    values=readparameters.values_2,
    continuous_parameters_selected=concat_3,
    run=read_parameters_2)  # -> conntinuous_parameters_sorting_keys_2, sliders_iteration_sorted_2, sliders_path_2, conntinuous_parameters_range_sorted_2, conntinuous_parameters_iterations_sorted_2, discrete_parameters_sorting_keys_2, valuelists_iteration_sorted_2, valuelists_path_2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
run_solver_2 = Boolean(run_solver)
and = GateAnd(A=filterselectedparameters.run_no_errors_2, B=run_solver_2)
bfsolver = BruteForceSolver(
    MI=filterselectedparameters.iterations_count_parameters_2,
    S=filterselectedparameters.sliders_iteration_sorted_2,
    SI=filterselectedparameters.conntinuous_parameters_iterations_sorted_2,
    SR=filterselectedparameters.conntinuous_parameters_range_sorted_2,
    VL=filterselectedparameters.valuelists_iteration_sorted_2,
    VLN=filterselectedparameters.discrete_parameters_values_sorted_2,
    R=and)  # -> S, P, V, I; inputs MI: Int32, S: tree, SI: tree, SR: tree, VL: tree, VLN: tree, R: Boolean; disabled
# ---------- bfsolver: Python ----------
import scriptcontext as sc
#Component Information
#--------------------------------------------------------------------------------------------
if ghenv.Component.RunCount<2:
    #General
    #--------------------------------------------------------------------------------------------
    __author__ = "Ueli Saluz"
    __version__ = "2022.01.17"
    
    ghenv.Component.Name = "BruteForceSolver"
    ghenv.Component.NickName = "BFSolver"
    ghenv.Component.Description = "This is a meta-script which will incrementally update all sliders and value lists until all combinations ran."
    ghenv.Component.Message = "VER 1.0"
    ghenv.Component.Category = "Params"
    ghenv.Component.SubCategory = "Util"
    # Level: 7
    
    #Inputs
    #--------------------------------------------------------------------------------------------
    inputIndex=0
    
    ghenv.Component.Params.Input[inputIndex].Name = "MaximumIterations"
    ghenv.Component.Params.Input[inputIndex].NickName = "MI"
    ghenv.Component.Params.Input[inputIndex].Description = "Maximum iterations. Can be less then maximium count of possibility."
    ghenv.Component.Params.Input[inputIndex].Optional = False
    inputIndex+=1
    
    ghenv.Component.Params.Input[inputIndex].Name = "Sliders"
    ghenv.Component.Params.Input[inputIndex].NickName = "S"
    ghenv.Component.Params.Input[inputIndex].Description = "Sliders to iterate over."
    ghenv.Component.Params.Input[inputIndex].Optional = False
    inputIndex+=1
    
    ghenv.Component.Params.Input[inputIndex].Name = "SliderIterations"
    ghenv.Component.Params.Input[inputIndex].NickName = "SI"
    ghenv.Component.Params.Input[inputIndex].Description = "Iteration count for each slider."
    ghenv.Component.Params.Input[inputIndex].Optional = False
    inputIndex+=1
    
    ghenv.Component.Params.Input[inputIndex].Name = "SliderRange"
    ghenv.Component.Params.Input[inputIndex].NickName = "SR"
    ghenv.Component.Params.Input[inputIndex].Description = "Optionally you can provide a range for each slider that will override the existing one."
    ghenv.Component.Params.Input[inputIndex].Optional = True
    inputIndex+=1
    
    ghenv.Component.Params.Input[inputIndex].Name = "ValueLists"
    ghenv.Component.Params.Input[inputIndex].NickName = "VL"
    ghenv.Component.Params.Input[inputIndex].Description = "Value Lists to iterate over."
    ghenv.Component.Params.Input[inputIndex].Optional = False
    inputIndex+=1
    
    ghenv.Component.Params.Input[inputIndex].Name = "ValueListNames"
    ghenv.Component.Params.Input[inputIndex].NickName = "VLN"
    ghenv.Component.Params.Input[inputIndex].Description = "Names that should be explored."
    ghenv.Component.Params.Input[inputIndex].Optional = False
    inputIndex+=1
    
    ghenv.Component.Params.Input[inputIndex].Name = "Run"
    ghenv.Component.Params.Input[inputIndex].NickName = "R"
    ghenv.Component.Params.Input[inputIndex].Description = "Unleash the hounds and run the script. There is no way back from here." +\
                                                "It might be usefull to check the total iteration counter as the iterations explode quickly."
    ghenv.Component.Params.Input[inputIndex].Optional = False
    inputIndex+=1
    
    #Outputs
    #--------------------------------------------------------------------------------------------
    outputIndex=0
    
    ghenv.Component.Params.Output[outputIndex].Name = "State"
    ghenv.Component.Params.Output[outputIndex].NickName = "S"
    ghenv.Component.Params.Output[outputIndex].Description = "The actual state of the solver."
    outputIndex+=1
    
    ghenv.Component.Params.Output[outputIndex].Name = "Parameters"
    ghenv.Component.Params.Output[outputIndex].NickName = "P"
    ghenv.Component.Params.Output[outputIndex].Description = "The name of the parameters."
    outputIndex+=1
    
    ghenv.Component.Params.Output[outputIndex].Name = "Values"
    ghenv.Component.Params.Output[outputIndex].NickName = "V"
    ghenv.Component.Params.Output[outputIndex].Description = "The value of the parameters."
    outputIndex+=1
    
    ghenv.Component.Params.Output[outputIndex].Name = "Iterations"
    ghenv.Component.Params.Output[outputIndex].NickName = "I"
    ghenv.Component.Params.Output[outputIndex].Description = "All iterations of the current run that have been tested."
    outputIndex+=1
    
    

#Imports
#--------------------------------------------------------------------------------------------
from System import Object
from Grasshopper import DataTree
from Rhino.Geometry import Interval

# Componentwide variables
#Spacing for printing
S_NUM = 4
S_TXT_S = 15
S_TXT_M = 25
S_TXT_L = 35
#Padding
S_PD = "  "    
#Assign
S_A = ":" + S_PD 

 #Initialization of sticky variables
#--------------------------------------------------------------------------------------------
if not sc.sticky.has_key("bruteForceSolver_isInitialized"):
    sc.sticky["bruteForceSolver_isInitialized"] = False

#Componentwide methods
#--------------------------------------------------------------------------------------------

def initialize(dynamicParameters=None):
    """
    Initalizes the brute force solver with global variables.
    Inputs:
       dynamicParameters: The paramaters to iterate over.
    """
    sc.sticky["bruteForceSolver_dynamicParameters"] = dynamicParameters
    sc.sticky["bruteForceSolver_currentIterationIndex"] = 0
    sc.sticky["bruteForceSolver_parameterIndex"] = len(sc.sticky["bruteForceSolver_dynamicParameters"])
    sc.sticky["bruteForceSolver_saturation"] = [False]*len(sc.sticky["bruteForceSolver_dynamicParameters"])
    sc.sticky["bruteForceSolver_isInitialized"] = True
    

#Componentwide classes
class DynamicParameter:
    def __init__(self, ghComponent, totalIterations = 2):
       if totalIterations<2:
          raise Exception("At least 2 iterations must exists. Otherwise remove the static parameter.")
       self.ghComponent = ghComponent
       #total iteration count
       self.totalIterations = totalIterations
       #iteration index
       self.iteration = 0
       
    def expire(self,log = False):
       if log == True:
          self.logInitialitation()
       self.ghComponent.ExpireSolution(True)
    
    def nextIteration(self, log  = False):
       if self.iteration==self.totalIterations:
          raise Exception("This was already the last iteration. Iteration index must have been wrongly modified.")
       self.iteration+=1
       self.expire()
       if log == True:
          self.logIteration()
       #Check if last iteration and restart counter
       if self.iteration==(self.totalIterations-1):
          self.iteration=0
          return True
       return False
       
    def logIteration(self):
       iterationText = ("Iteration" + S_A + str(sc.sticky["bruteForceSolver_currentIterationIndex"]+1).ljust(S_NUM, " ")).ljust(S_TXT_M, " ") +\
          "DynamicParameter" + S_A + sc.sticky["bruteForceSolver_dynamicParameters"][sc.sticky["bruteForceSolver_parameterIndex"]].ghComponent.NickName.ljust(S_TXT_M, " ") +\
          "Sub-Iteration"+ S_A + str(self.iteration+1).ljust(S_NUM, " ") + "from"  + S_PD + str(self.totalIterations).ljust(S_NUM, " ") + \
          ("Value" + S_A).ljust(S_TXT_S, " ") + str(self).ljust(S_TXT_L, " ")
       sc.sticky["bruteForceSolver_iterations"].Add(iterationText)
    
    def logInitialitation(self):
       iterationText = ("(Re)Initialization" + S_A).ljust(S_TXT_M, " ")  +\
          "DynamicParameter" + S_A + self.ghComponent.NickName.ljust(S_TXT_M, " ") +\
          "Sub-Iteration"+ S_A + str(self.iteration).ljust(S_NUM, " ") + "from"  + S_PD + str(self.totalIterations).ljust(S_NUM, " ") + \
          ("Value" + S_A).ljust(S_TXT_S, " ") + str(self).ljust(S_TXT_L, " ")
       sc.sticky["bruteForceSolver_iterations"].Add(iterationText)

class DynamicSlider(DynamicParameter):
    
    def __init__(self, ghSlider, totalIterations = 2, sliderRange = None):
       if not sliderRange.IsValid:
           raise Exception("Range is invalid. Start can't be bigger than End.")
       if sliderRange is None:
          sliderRange = Interval(ghSlider.Slider.Minimum,ghSlider.Slider.Maximum)
       self.sliderRange = sliderRange
       ghSlider.Slider.Minimum = self.sliderRange.T0
       ghSlider.Slider.Maximum = self.sliderRange.T1
       self.stepSize = self.sliderRange.Length/(totalIterations-1)
       ghSlider.Slider.DecimalPlaces = DynamicSlider.countDecimal(self.stepSize)
       DynamicParameter.__init__(self,ghSlider,totalIterations)
       self.reset()
       
    def reset(self):
       self.ghComponent.Slider.Value = self.ghComponent.Slider.Minimum
       self.expire()
       
    def next(self):
       #iteration is an index
       self.ghComponent.Slider.Value = self.ghComponent.Slider.Minimum + (self.iteration+1)*self.stepSize
       #The overriden way doesn't work for some reason.
       #return DynamicParameter.next(self)
       #return super().next()
       return self.nextIteration(True)
    
    @staticmethod
    def countDecimal(number):
       string= str(number)
       return string[::-1].find('.')
    
    def __str__(self):
       return str(self.ghComponent.Slider.Value)
       
class DynamicValueList(DynamicParameter):
    
    def __init__(self, ghValueList, itemNames):
       #Check if provided names are valid values in the value list
       for itemName in itemNames:
          flag = True
          for itemInsideList in ghValueList.ListItems:
             if itemInsideList.Name == itemName:
                flag = False
          if flag == True:
             raise Exception("At least one of the itemNames is not inside value list. Make sure it is inside the enumeration.")
       #Initialize parent
       DynamicParameter.__init__(self,ghValueList,len(itemNames))
       self.itemNames = itemNames
       #Reset old value to proper start value
       self.reset()
       
    def reset(self):
       itemName = self.itemNames[0]
       #Find index i of next item
       i = 0
       for itemInsideList in self.ghComponent.ListItems:
          if itemInsideList.Name == itemName:
             break
          i+=1
       self.ghComponent.SelectItem(i)
       #Remove the first item from the next iterations
       self.expire()
       
    def next(self):
       itemName = self.itemNames[self.iteration+1]
       #Find index i of next item
       i = 0
       for itemInsideList in self.ghComponent.ListItems:
          if itemInsideList.Name == itemName:
             break
          i+=1
       self.ghComponent.SelectItem(i)
       #The overriden way doesn't work for some reason.
       #return DynamicParameter.next(self)
       return self.nextIteration(True)
    
    """Return first selected item of value list."""
    def __str__(self):
       return str(self.ghComponent.FirstSelectedItem.Name)
       


#Solver - Run with trees to enhance performance drastically
#--------------------------------------------------------------------------------------------
if __name__ == "__main__":
    
    #Initialize trees
    #--------------------------------------------------------------------------------------------
    
    #Data matching
    #--------------------------------------------------------------------------------------------
    #Run otherwise reset variables
    if R == True:
       
       #Check if it the first run
       if sc.sticky["bruteForceSolver_isInitialized"] == False:
          sc.sticky["bruteForceSolver_iterations"] = []
          #Parse dynamicParameters from inputs and store them in sticky variables
          dynamicParameters = []
          for valueListPath in VL.Paths:
             valueList = VL.Branch(valueListPath)[0]
             valueListNames = VLN.Branch(valueListPath)
             dynamicParameters.Add(DynamicValueList(valueList,valueListNames))
          for sliderPath in S.Paths:
             slider = S.Branch(sliderPath)[0]
             sliderIterations = SI.Branch(sliderPath)[0]
             sliderRange = SR.Branch(sliderPath)[0]
             dynamicParameters.Add(DynamicSlider(slider,sliderIterations,sliderRange))
          initialize(dynamicParameters)
          sc.sticky["bruteForceSolver_iterations"].Add(("Iteration" + S_A + "1").ljust(S_TXT_M, " ") + \
          str(len(sc.sticky["bruteForceSolver_dynamicParameters"])) + " Parameters have been successfully initiated!")
          ghenv.Component.ExpireSolution(True)
       else:
          
          #Threshhold for brute force
          maxIterations = MI
          parametersCount = len(sc.sticky["bruteForceSolver_dynamicParameters"])
          
          #Check if not finished when one parameter is not yet saturated
          saturated = True
          for saturation in sc.sticky["bruteForceSolver_saturation"]:
             saturated = saturated and saturation
             if saturated == False:
                break
                
          #Main
          if not saturated and sc.sticky["bruteForceSolver_currentIterationIndex"] < maxIterations:
             
             #Find last index of the last unsaturated parameter
             for indexLastZero in range(0,parametersCount):
                if sc.sticky["bruteForceSolver_saturation"][indexLastZero]==False:
                    sc.sticky["bruteForceSolver_parameterIndex"]=indexLastZero
             
             #Set all saturated dynamicParameters behind the last unsaturated parameter to unsaturated
             for parameterIndexBehind in range(sc.sticky["bruteForceSolver_parameterIndex"]+1,parametersCount):
                sc.sticky["bruteForceSolver_dynamicParameters"][parameterIndexBehind].reset()
                sc.sticky["bruteForceSolver_saturation"][parameterIndexBehind]=False
             
             #Iterate next step and see if saturated
             sc.sticky["bruteForceSolver_saturation"][sc.sticky["bruteForceSolver_parameterIndex"]] = sc.sticky["bruteForceSolver_dynamicParameters"][sc.sticky["bruteForceSolver_parameterIndex"]].next()
             
             #Expire this component
             ghenv.Component.ExpireSolution(True)
             
       #Increase iteration counter. Note: First iteration also counts as all starting values are triggered.
       sc.sticky["bruteForceSolver_currentIterationIndex"]+=1
       I = sc.sticky["bruteForceSolver_iterations"]
    else:
       if sc.sticky["bruteForceSolver_isInitialized"] == True:
          sc.sticky["bruteForceSolver_isInitialized"] = False
    
    #Log states of all dynamic parameters
    actualState = "DynamicParameter".ljust(S_TXT_M, " ")+ "Sub-iteration".ljust(S_TXT_M, " ") \
    + "Total sub-iterations".ljust(S_TXT_M, " ")   + "Actual value".ljust(S_TXT_M, " ")  + "\n"
    parameters=[]
    values=[]
    for i,p in enumerate(sc.sticky["bruteForceSolver_dynamicParameters"]):
        #Write state
       actualState += p.ghComponent.NickName.ljust(S_TXT_M, " ") + \
       (str(p.iteration+1).ljust(S_TXT_M, " ") if sc.sticky["bruteForceSolver_saturation"][i]==False else str(p.totalIterations).ljust(S_TXT_M, " ")) +\
       str(p.totalIterations).ljust(S_TXT_M, " ") + str(p).ljust(S_TXT_M, " ")  + "\n"
       #Write parameter state
       parameters.Add(p.ghComponent.NickName)
       values.Add(str(p))
       
    
    #Assign (trees to) output
    #--------------------------------------------------------------------------------------------
    S = actualState
    P = parameters
    V = values
    I = sc.sticky["bruteForceSolver_iterations"]
# ---------- end bfsolver ----------
panel_12 = Panel(bfsolver.I)
panel_13 = Panel(bfsolver.S)
lng = ListLength(List=bfsolver.I)
panel_14 = Panel(filterselectedparameters.iterations_count_parameters_2)
iteration = Integer(lng)

log_writing_files = Text(bfsolver.S)
item = ListItem(List=flatten(log_writing_files), Index=0, Wrap=True)
expression = Expression(x=item, Expression="True")
and_2 = GateAnd(A=expression, B=run_solver)
locksolver = PromptLockSolver(R=and_2, T=Slider(1, range=0..1))  # -> K
# ---------- locksolver: Python ----------
#Component Information
#--------------------------------------------------------------------------------------------
if ghenv.Component.RunCount<2:
    #General
    #--------------------------------------------------------------------------------------------
    __author__ = "Ueli Saluz"
    __version__ = "2022.02.02"
    
    ghenv.Component.Name = "PromptLockSolver"
    ghenv.Component.NickName = "LockSolver?"
    ghenv.Component.Description = "Prompt to ask if solver should be locked. This is useful for aborting recursive scripts when UI is blocked."
    ghenv.Component.Message = "VER 1.0"
    ghenv.Component.Category = "Params"
    ghenv.Component.SubCategory = "Util"
    
     #Inputs
    #--------------------------------------------------------------------------------------------
    inputIndex=0
    
    ghenv.Component.Params.Input[inputIndex].Name = "Run"
    ghenv.Component.Params.Input[inputIndex].NickName = "R"
    ghenv.Component.Params.Input[inputIndex].Description = "Ask for propmt to lock"
    ghenv.Component.Params.Input[inputIndex].Optional = False
    inputIndex+=1
    
    ghenv.Component.Params.Input[inputIndex].Name = "WaitingTime"
    ghenv.Component.Params.Input[inputIndex].NickName = "T"
    ghenv.Component.Params.Input[inputIndex].Description = "Specify time that user has time to answer. If expired it will keep on. If waiting time = 0 then the prompt will not expire."
    ghenv.Component.Params.Input[inputIndex].Optional = False
    inputIndex+=1
    
    #Outputs
    #--------------------------------------------------------------------------------------------
    outputIndex=0
    
    ghenv.Component.Params.Output[outputIndex].Name = "KeepOn"
    ghenv.Component.Params.Output[outputIndex].NickName = "K"
    ghenv.Component.Params.Output[outputIndex].Description = "True if script should keep on running. False otherwise and Solver is going to be locked"
    outputIndex+=1


# Imports
import Rhino
import scriptcontext
import System
import Rhino.UI
import Eto.Drawing as drawing
import Eto.Forms as forms
from Grasshopper.Kernel import GH_Document

# SampleEtoRoomNumber dialog class
class LockSolverDialog(forms.Dialog[bool]):

    # Dialog box Class initializer
    def __init__(self,waitingTime=3):
        # Initialize dialog box
        self.Title = 'Do you want to lock the solver?'
        self.Padding = drawing.Padding(10)
        self.Resizable = False
        
        self.lockSolver = False
        self.secondsElapsed = 0
        self.waitingTime = waitingTime

        self.t_label = forms.Label(Text = "You have {sec} second(s) left to decide.".format(sec = self.waitingTime) if waitingTime!=0 else "Choose one option.")

        self.KeepOnButton = forms.Button(Text = 'KeepOn')
        self.KeepOnButton.Click += self.OnKeepOnButtonClick

        self.LockSolverButton = forms.Button(Text = 'LockSolver')
        self.LockSolverButton.Click += self.OnLockSolverButtonClick

        self.Timer = forms.UITimer(Interval = 1)
        self.Timer.Elapsed += self.OnTimerElased
        
        # Create a table layout and add all the controls
        layout = forms.DynamicLayout()
        layout.Spacing = drawing.Size(5, 5)
        layout.AddRow(self.t_label)
        layout.AddRow(None) # spacer
        layout.AddRow(self.KeepOnButton,self.LockSolverButton)

        # Set the dialog content
        self.Content = layout
        
        if self.waitingTime!=0:
            self.Timer.Start()

    def OnKeepOnButtonClick(self, sender, e):
        self.Close()

    def OnLockSolverButtonClick(self, sender, e):
        self.lockSolver = True
        self.Close()

    def OnTimerElased(self, sender, e):
        self.secondsElapsed +=1
        if self.secondsElapsed == self.waitingTime:
            self.Close()
        self.t_label.Text = "You have {sec} second(s) left to decide.".format(sec = self.waitingTime-self.secondsElapsed)
        self.Timer.Start()

if __name__ == "__main__":
    if R== True:
        dialog = LockSolverDialog(T);
        dialog.ShowModal(Rhino.UI.RhinoEtoApp.MainWindow)
        if dialog.lockSolver == True:
            K = False
            GH_Document.EnableSolutions = False
        else:
            K=True
    else:
        K = True
# ---------- end locksolver ----------
panel_15 = Panel(log_writing_files)
panel_16 = Panel(iteration)
dynamic_courtyard = ValueList({"No-Roof": 0, "Roof": 1}, selected="No-Roof")
unleashthehounds_2 = BooleanToggle(False)
dynamic_energystandard_2 = Text(dynamic_energystandard)
all_air = HBAllAirHVACTemplates({"VAV chiller with gas boiler reheat": "VAV_Chiller_Boiler", "VAV chiller with central air source heat pump reheat": "VAV_Chiller_ASHP", "VAV chiller with district hot water reheat": "VAV_Chiller_DHW", "VAV chiller with PFP boxes": "VAV_Chiller_PFP", "VAV chiller with gas coil reheat": "VAV_Chiller_GasCoil", "VAV air-cooled chiller with gas boiler reheat": "VAV_ACChiller_Boiler", "VAV air-cooled chiller with central air source heat pump reheat": "VAV_ACChiller_ASHP", "VAV air-cooled chiller with district hot water reheat": "VAV_ACChiller_DHW", "VAV air-cooled chiller with PFP boxes": "VAV_ACChiller_PFP", "VAV air-cooled chiller with gas coil reheat": "VAV_ACChiller_GasCoil"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}, selected="VAV chiller with gas boiler reheat")
searchconstrs = HBSearchConstructions()  # -> opaque_constrs, window_constrs, shade_constrs; plug-in component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
fassade = ValueList({"Horizontal-Windows": 0, "Vertical-Windows": 1, "Ribbon-Windows": 2}, selected="Horizontal-Windows")
shading = ValueList({"External-Shading": 0, "Low-HGC-Value": 1}, selected="External-Shading")
number_slider_2 = Slider(3, range=0..10)
number_slider_3 = Slider(7, range=0..10)
dynamic_courtyard_2 = Integer(dynamic_courtyard)
list_3 = ValueList({"GEG", "NZEB", "Passive"}, selected="GEG")
run_solver_3 = Boolean(unleashthehounds_2)
panel_17 = Panel(searchconstrs.opaque_constrs)
filter = StreamFilter(Gate=run_solver_3, Stream0=Toggle(False), Stream1=dynamic_courtyard_2)
filter_2 = StreamFilter(Gate=run_solver_3, Stream0=list_3, Stream1=dynamic_energystandard_2)
filter_3 = StreamFilter(Gate=run_solver_3, Stream0=Slider(60, range=0..360), Stream1=dynamic_orientation_2)
filter_4 = StreamFilter(Gate=run_solver_3, Stream0=Slider(2.5, range=0..10), Stream1=dynamic_rasterlength_2)
filter_5 = StreamFilter(Gate=run_solver_3, Stream0=Slider(4, range=0..10), Stream1=dynamic_rasterlength_y_2)
filter_6 = StreamFilter(Gate=run_solver_3, Stream0=Slider(3.61, range=0..10), Stream1=dynamic_floorheight_2)
filter_7 = StreamFilter(Gate=run_solver_3, Stream0=Slider(13, range=0..30), Stream1=dynamic_courtyard_segmentcount_rasterlen_2)
filter_8 = StreamFilter(Gate=run_solver_3, Stream0=heatcool_2, Stream1=dynamic_hc_system_2)
filter_9 = StreamFilter(Gate=run_solver_3, Stream0=fassade, Stream1=dynamic_fassade_2)
filter_10 = StreamFilter(Gate=run_solver_3, Stream0=shading, Stream1=dynamic_shading_2)
zoom_factor = Number(Slider(0.9, range=0..1))
courtyard_has_roof = Boolean(filter)
energystandard = Text(filter_2)
orientation = Number(filter_3)
rasterlength_x = Number(filter_4)
rasterlength_y = Number(filter_4)
floorheight = Number(filter_6)
courtyard_segmentcount_rasterlength_y = Number(filter_7)
hc_system = Text(filter_8)
fassade_2 = Text(filter_9)
shading_2 = Text(filter_10)
panel_18 = Panel(searchconstrs.window_constrs)
number_slider_4 = Slider(1.5, range=0..10)
number_slider_5 = Slider(0.5, range=0..1)
list_4 = ValueList({"Windows": 0, "WindowBand": 1, "GlassFassade": 2}, selected="WindowBand")
list_5 = ValueList({"Windows": 0, "WindowBand": 1, "GlassFassade": 2}, selected="Windows")
doas = HBDOASHVACTemplates({"DOAS with fan coil chiller with boiler": "DOAS_FCU_Chiller_Boiler", "DOAS with fan coil chiller with central air source heat pump": "DOAS_FCU_Chiller_ASHP", "DOAS with fan coil chiller with district hot water": "DOAS_FCU_Chiller_DHW", "DOAS with fan coil chiller with baseboard electric": "DOAS_FCU_Chiller_ElectricBaseboard", "DOAS with fan coil chiller with gas unit heaters": "DOAS_FCU_Chiller_GasHeaters", "DOAS with fan coil chiller with no heat": "DOAS_FCU_Chiller", "DOAS with fan coil air-cooled chiller with boiler": "DOAS_FCU_ACChiller_Boiler", "DOAS with fan coil air-cooled chiller with central air source heat pump": "DOAS_FCU_ACChiller_ASHP", "DOAS with fan coil air-cooled chiller with district hot water": "DOAS_FCU_ACChiller_DHW", "DOAS with fan coil air-cooled chiller with baseboard electric": "DOAS_FCU_ACChiller_ElectricBaseboard", "DOAS with fan coil air-cooled chiller with gas unit heaters": "DOAS_FCU_ACChiller_GasHeaters", "DOAS with fan coil air-cooled chiller with no heat": "DOAS_FCU_ACChiller", "DOAS with fan coil district chilled water with boiler": "DOAS_FCU_DCW_Boiler", "DOAS with fan coil district chilled water with central air source heat pump": "DOAS_FCU_DCW_ASHP", "DOAS with fan coil district chilled water with district hot water": "DOAS_FCU_DCW_DHW", "DOAS with fan coil district chilled water with baseboard electric": "DOAS_FCU_DCW_ElectricBaseboard", "DOAS with fan coil district chilled water with gas unit heaters": "DOAS_FCU_DCW_GasHeaters", "DOAS with fan coil district chilled water with no heat": "DOAS_FCU_DCW", "DOAS with VRF": "DOAS_VRF", "DOAS with water source heat pumps fluid cooler with boiler": "DOAS_WSHP_FluidCooler_Boiler", "DOAS with water source heat pumps cooling tower with boiler": "DOAS_WSHP_CoolingTower_Boiler", "DOAS with water source heat pumps with ground source heat pump": "DOAS_WSHP_GSHP", "DOAS with water source heat pumps district chilled water with district hot water": "DOAS_WSHP_DCW_DHW"}, selected="DOAS with fan coil chiller with boiler")
fassade_3 = Text(fassade_2)
fassade_4 = Text(fassade_2)
number_slider_6 = Slider(0.9, range=0..2)
fassade_5 = Text(fassade_2)
number_slider_7 = Slider(0.5, range=0..1)
filter_11 = StreamFilter(Gate=fassade_3, Stream0=list_5, Stream1=list_5, Stream2=list_4)
filter_12 = StreamFilter(Gate=fassade_4, Stream0=Slider(0.9, range=0..1), Stream1=number_slider_5, Stream2=number_slider_5)
filter_13 = StreamFilter(Gate=fassade_5, Stream0=Slider(3, range=0..10), Stream1=number_slider_4, Stream2=number_slider_4)
searchschs = HBSearchSchedules()  # -> schedules, type_limits; plug-in component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
building_windowtype = Integer(filter_11)
fassade_6 = Text(fassade_2)
fassade_7 = Text(fassade_2)
insulation_conductivity = Number(Slider(0.035, range=0..0.1))
building_windowwidth = Number(filter_13)
slab_heat_capacity = Number(Slider(900, range=0..1500))
building_offsettosides = Number(Slider(1, range=0..10))

graftedmessi = BooleanToggle(True)
genes = GenePool(Decimals=0, Maximum=800, Minimum=0, Value=[400, 644.88, 800, 400])
genes_2 = GenePool(Decimals=0, Maximum=300, Minimum=0, Value=[150, 241.83, 300, 150])
genes_3 = GenePool(Decimals=0, Maximum=300, Minimum=0, Value=[150, 241.83, 300, 150])
genes_4 = GenePool(Decimals=0, Maximum=360, Minimum=0, Value=[68, 167, 259, 180])
genes_5 = GenePool(Decimals=0, Maximum=360, Minimum=0, Value=[165, 322, 66, 180])
pt = Point(Point(0, 0, 0))
pl = ConstructPlane(Origin=pt, XAxis=Vector(1, 0, 0), YAxis=Vector(0, 1, 0))
messibaseplanes = MessiBasePlanes(
    baseplane=pl,
    movingx=genes,
    movingy=genes_2,
    movingz=genes_3,
    anglex=genes_4,
    angley=genes_5,
    normalmessi=normal_messi_planes,
    graftedmessi=graftedmessi)
worldoriginplane = Plane(pl)
filter_14 = StreamFilter(Gate=normal_messi_planes, Stream0=worldoriginplane, Stream1=messibaseplanes)

building_windowtowall_perimeter = Number(filter_12)
filter_15 = StreamFilter(Gate=fassade_7, Stream0=Slider(0.7, range=0..1), Stream1=number_slider_7, Stream2=number_slider_7)
filter_16 = StreamFilter(Gate=fassade_6, Stream0=number_slider_6, Stream1=number_slider_6, Stream2=number_slider_7)
numberoffloors = Number(Slider(4, range=0..10))
floorheight_2 = Number(floorheight)
panel_19 = Panel(searchschs.schedules)
building_window_distancetoceiling = Number(filter_15)
building_parapetheight = Number(filter_16)
parameterjson = GetString(AtLeast=1, AtMost=1, TreeAccess=False)
subtraction = Subtraction(A=floorheight_2, B=building_parapetheight, C=building_window_distancetoceiling)

number_slider_8 = Slider(5, range=0..10)
number_slider_9 = Slider(4, range=0..10)
number_slider_10 = Slider(15, range=0..30)
number_slider_11 = Slider(2.5, range=0..10)

building_windowheight = Number(subtraction)
list_6 = ValueList({"Building-Fassades-Individual": 0, "Building-Fassades-Together": 1}, selected="Building-Fassades-Together")
orientation_2 = Number(orientation)
prot = RotatePlane(Plane=filter_14, Angle=degrees(orientation_2))
baseplane = Plane(prot)

rasterlength_x_2 = Number(rasterlength_x)
rasterlength_y_2 = Number(rasterlength_y)

# ----
# V 1.0.0
deplane = DeconstructPlane(Plane=baseplane)  # -> Origin, XAxis, YAxis, ZAxis
pflip = FlipPlane(Plane=baseplane, ReverseX=False, ReverseY=False, SwapAxes=True)
revxvec = Vector(expr("-x", deplane.XAxis))
revzvec = Vector(expr("-x", deplane.ZAxis))
revyvec = Vector(expr("-x", deplane.YAxis))
origin = Point(deplane.Origin)
xvec = Vector(deplane.XAxis)
yvec = Vector(deplane.YAxis)
zvec = Vector(deplane.ZAxis)
amp = Amplitude(Vector=xvec, Amplitude=1)
amp_2 = Amplitude(Vector=yvec, Amplitude=1)
amp_3 = Amplitude(Vector=zvec, Amplitude=1)
amp_4 = Amplitude(Vector=revxvec, Amplitude=1)
amp_5 = Amplitude(Vector=revyvec, Amplitude=1)
amp_6 = Amplitude(Vector=revzvec, Amplitude=1)

list_7 = ValueList({"Windows": 0, "WindowBand": 1, "GlassFassade": 2}, selected="Windows")

list_8 = ValueList({"Arms-Fassades-Each": 0, "Arms-Fassades-Together": 1}, selected="Arms-Fassades-Each")
parapetheight = Number(Slider(1.2, range=0..2))
windowheight = Number(Slider(1.5, range=0..10))
windowwidth = Number(Slider(1.25, range=0..10))
windowtowall_perimeter = Number(Slider(0.7, range=0..1))
offsettosides = Number(Slider(1, range=0..10))
windowtype = Integer(list_7)
filter_17 = StreamFilter(Gate=list_6, Stream0=windowtype, Stream1=building_windowtype)
filter_18 = StreamFilter(Gate=list_6, Stream0=windowtowall_perimeter, Stream1=building_windowtowall_perimeter)
filter_19 = StreamFilter(Gate=list_6, Stream0=windowwidth, Stream1=building_windowwidth)
filter_20 = StreamFilter(Gate=list_6, Stream0=parapetheight, Stream1=building_parapetheight)
filter_21 = StreamFilter(Gate=list_6, Stream0=windowheight, Stream1=building_windowheight)
filter_22 = StreamFilter(Gate=list_6, Stream0=offsettosides, Stream1=building_offsettosides)
filter_23 = StreamFilter(Gate=list_6, Stream0=list_8, Stream1="1")

list_9 = ValueList({"Center-Fassades-Each": 0, "Center-Fassades-Together": 1}, selected="Center-Fassades-Each")
list_10 = ValueList({"Windows": 0, "WindowBand": 1, "GlassFassade": 2}, selected="Windows")
parapetheight_2 = Number(Slider(1.2, range=0..2))
windowheight_2 = Number(Slider(1.7, range=0..10))
windowwidth_2 = Number(Slider(1.25, range=0..10))
windowtowall_perimeter_2 = Number(Slider(0.7, range=0..1))
offsettosides_2 = Number(Slider(1, range=0..10))
windowtype_2 = Integer(list_10)
filter_24 = StreamFilter(Gate=list_6, Stream0=windowtowall_perimeter_2, Stream1=building_windowtowall_perimeter)
filter_25 = StreamFilter(Gate=list_6, Stream0=windowwidth_2, Stream1=building_windowwidth)
filter_26 = StreamFilter(Gate=list_6, Stream0=parapetheight_2, Stream1=building_parapetheight)
filter_27 = StreamFilter(Gate=list_6, Stream0=windowheight_2, Stream1=building_windowheight)
filter_28 = StreamFilter(Gate=list_6, Stream0=offsettosides_2, Stream1=building_offsettosides)
filter_29 = StreamFilter(Gate=list_6, Stream0=windowtype_2, Stream1=building_windowtype)
filter_30 = StreamFilter(Gate=list_6, Stream0=list_9, Stream1="1")

lng_2 = ListLength(List=flatten(baseplane))
series = Series(Start="1", Step=1, Count=lng_2)
panel_20 = Panel("""North
East
South
West""")
concat_5 = Concatenate(FragmentA="OfficeBuilding", FragmentC=series)  # -> graft(Result)
panel_21 = Panel("""Upper
Right
Lower
Left""")
match = MatchTree(Tree=concat_5, Guide=baseplane)

namingschema_delimiter_parameter_seconda = Text("-")  # "NamingSchema-Delimiter-Parameter-Secondary"
namingschema_window_name = Text("Window")

namingschema_delimiter_parameter_primary = Text("_")
namingschema_delimiter_assign = Text("=")
namingschema_delimiter_decimal = Text(",")
namingschema_true_name = Text("T")
namingschema_false_name = Text("F")

total_iterations = Integer(filterselectedparameters.iterations_count_parameters_2)
iteration_2 = Integer(iteration)
python = GhPythonScript(x=iteration_2, l=total_iterations)  # -> a
# ---------- python: Python ----------
a = x.rjust(len(l),'0')
# ---------- end python ----------
concat_6 = Concatenate(
    FragmentA="Generic-Office-Building_H-Shape",
    FragmentB=namingschema_delimiter_parameter_primary,
    FragmentD="Iteration",
    FragmentE=namingschema_delimiter_parameter_seconda,
    FragmentC=python)
iteration_name = Text(concat_6)

list_11 = ValueList({"Windows": 0, "WindowBand": 1, "GlassFassade": 2}, selected="Windows")

list_12 = ValueList({"Center-Fassade-Upper-Lower-Each": 0, "Center-Fassade-Upper-Lower-Together": 1}, selected="Center-Fassade-Upper-Lower-Each")
list_13 = ValueList({"Windows": 0, "WindowBand": 1, "GlassFassade": 2}, selected="Windows")
windowheight_3 = Number(Slider(1.8, range=0..10))
parapetheight_3 = Number(Slider(1.2, range=0..2))
windowwidth_3 = Number(Slider(1.25, range=0..10))
windowtowall_perimeter_3 = Number(Slider(0.6, range=0..1))
offsettosides_3 = Number(Slider(1, range=0..10))
windowtype_3 = Integer(list_13)
filter_31 = StreamFilter(Gate=filter_30, Stream0=list_12, Stream1="1")
filter_32 = StreamFilter(Gate=list_6, Stream0=windowtype_3, Stream1=filter_29)
filter_33 = StreamFilter(Gate=filter_30, Stream0=windowtowall_perimeter_3, Stream1=filter_24)
filter_34 = StreamFilter(Gate=filter_30, Stream0=windowwidth_3, Stream1=filter_25)
filter_35 = StreamFilter(Gate=filter_30, Stream0=parapetheight_3, Stream1=filter_26)
filter_36 = StreamFilter(Gate=filter_30, Stream0=windowheight_3, Stream1=filter_27)
filter_37 = StreamFilter(Gate=filter_30, Stream0=offsettosides_3, Stream1=filter_28)

list_14 = ValueList({"Arms-Fassades-Lower-Upper-Each": 0, "Arms-Fassades-Lower-Upper-Together": 1}, selected="Arms-Fassades-Lower-Upper-Each")
list_15 = ValueList({"Windows": 0, "WindowBand": 1, "GlassFassade": 2}, selected="WindowBand")
windowtowall_perimeter_4 = Number(Slider(0.7, range=0..1))
parapetheight_4 = Number(Slider(1.2, range=0..2))
windowheight_4 = Number(Slider(1.3, range=0..10))
windowwidth_4 = Number(Slider(1.25, range=0..10))
windowtype_4 = Integer(list_15)
offsettosides_4 = Number(Slider(1, range=0..10))
filter_38 = StreamFilter(Gate=filter_23, Stream0=windowtype_4, Stream1=filter_17)
filter_39 = StreamFilter(Gate=filter_23, Stream0=windowtowall_perimeter_4, Stream1=filter_18)
filter_40 = StreamFilter(Gate=filter_23, Stream0=windowwidth_4, Stream1=filter_19)
filter_41 = StreamFilter(Gate=filter_23, Stream0=parapetheight_4, Stream1=filter_20)
filter_42 = StreamFilter(Gate=filter_23, Stream0=windowheight_4, Stream1=filter_21)
filter_43 = StreamFilter(Gate=filter_23, Stream0=offsettosides_4, Stream1=filter_22)
filter_44 = StreamFilter(Gate=filter_23, Stream0=list_14, Stream1="1")

list_16 = ValueList({"Windows": 0, "WindowBand": 1, "GlassFassade": 2}, selected="Windows")
list_17 = ValueList({"Arms-Fassades-Right-Left-Each": 0, "Arms-Fassades-Right-Left-Together": 1}, selected="Arms-Fassades-Right-Left-Together")
windowtowall_perimeter_5 = Number(Slider(0.47, range=0..1))
windowheight_5 = Number(Slider(2.5, range=0..10))
windowwidth_5 = Number(Slider(1.25, range=0..10))
parapetheight_5 = Number(Slider(0.5, range=0..2))
offsettosides_5 = Number(Slider(1, range=0..10))
windowtype_5 = Integer(list_16)
filter_45 = StreamFilter(Gate=filter_23, Stream0=windowtowall_perimeter_5, Stream1=filter_18)
filter_46 = StreamFilter(Gate=filter_23, Stream0=windowwidth_5, Stream1=filter_19)
filter_47 = StreamFilter(Gate=filter_23, Stream0=parapetheight_5, Stream1=filter_20)
filter_48 = StreamFilter(Gate=filter_23, Stream0=windowheight_5, Stream1=filter_21)
filter_49 = StreamFilter(Gate=filter_23, Stream0=offsettosides_5, Stream1=filter_22)
filter_50 = StreamFilter(Gate=filter_23, Stream0=list_17, Stream1="1")
filter_51 = StreamFilter(Gate=filter_23, Stream0=windowtype_5, Stream1=filter_17)

windowtype_6 = Integer(list_11)

list_18 = ValueList({"Center-Fassade-Right-Left-Each": 0, "Center-Fassade-Right-Left-Together": 1}, selected="Center-Fassade-Right-Left-Together")
parapetheight_6 = Number(Slider(1.2, range=0..2))
windowheight_6 = Number(Slider(1.7, range=0..10))
windowwidth_6 = Number(Slider(3.5, range=0..10))
offsettosides_6 = Number(Slider(1, range=0..10))
windowtowall_perimeter_6 = Number(Slider(0.7, range=0..1))
filter_52 = StreamFilter(Gate=filter_30, Stream0=windowwidth_6, Stream1=filter_25)
filter_53 = StreamFilter(Gate=filter_30, Stream0=parapetheight_6, Stream1=filter_26)
filter_54 = StreamFilter(Gate=filter_30, Stream0=windowheight_6, Stream1=filter_27)
filter_55 = StreamFilter(Gate=filter_30, Stream0=offsettosides_6, Stream1=filter_28)
filter_56 = StreamFilter(Gate=filter_30, Stream0=list_18, Stream1="1")
filter_57 = StreamFilter(Gate=filter_30, Stream0=windowtowall_perimeter_6, Stream1=filter_24)
filter_58 = StreamFilter(Gate=filter_30, Stream0=windowtype_6, Stream1=filter_29)

list_19 = ValueList({"Windows": 0, "WindowBand": 1, "GlassFassade": 2}, selected="Windows")
list_20 = ValueList({"Fully inside Wall": 0, "Polygonal Aproximation": 1, "Exact Opening Mesurements": 2}, selected="Fully inside Wall")
namingschema_delimiter = Text("_")
baseplane_2 = Plane(baseplane)
windowtype_7 = Integer(list_19)

# ----
# SELECT
# 	E.name AS EnergyStandardName,
# 	N.name AS CostGroup,
# 	CASE WHEN N.Category = "Wall" THEN
# 		CASE WHEN N.IsExterior = 1 THEN
# 			CASE WHEN N.LoadBearing = 1 THEN
# 				CASE WHEN N.AboveGround = 1 THEN "Wall_Exterior_Bearing_AboveGround" ELSE "Wall_Exterior_Bearing_BelowGround"	END
# 			ELSE "Wall_Exterior_NonBearing"
# 			END
# 		ELSE
# 			CASE WHEN N.LoadBearing = 1 THEN "Wall_Internal_Bearing" ELSE "Wall_Internal_NonBearing" END
# 		END
# 	ELSE
# 		CASE WHEN N.Category = "Base Plate" THEN "BasePlate"
# 		ELSE
# 			CASE WHEN N.Category = "Roof" THEN
# 				CASE WHEN N.Sloped = 1 THEN "Roof_Sloped" ELSE "Roof_Flat" END
# 			ELSE
# 				CASE WHEN N.Category = "Window" THEN "Window"
# 				ELSE "Undefined"
# 				END
# 			END
# 		END
# 	END AS Category,
# 	U.RequiredU AS RequiredUValue
# FROM KG3x0Name_EnergyStandardNames U
# INNER JOIN KG3x0Names N on N.Id=U.Id1
# INNER JOIN EnergyStandardNames E on E.Id=U.Id2
# ORDER BY EnergyStandardName, Category
panel_22 = Panel("E:\Nextcloud\UserData\Documents\Arbeit\Papers\Multi-objective_Machine-Assistance\Data-Generation\Databases\ExpertDB\ExpertDB.db")
rep = ReplaceText(Text="Databases\ExpertDB\ExpertDB.db", Find="\", Replace="/", RecursiveReplace=False)
rep_2 = ReplaceText(Text=panel_22, Find="\", Replace="\\", RecursiveReplace=False)
nickname = NAME(p=rep_2, sql="SELECT * FROM ConstructionTypeNames")  # -> O1; disabled
# ---------- nickname: Python ----------
import sqlite3

conn = sqlite3.connect(p)
c = conn.cursor()
c.execute(sql)
for row in c:
    print row
c.close()
# ---------- end nickname ----------

swatch = ColourSwatch(SwatchColor=RGB(235, 52, 79))
swatch_2 = ColourSwatch(SwatchColor=RGB(240, 117, 24))
swatch_3 = ColourSwatch(SwatchColor=RGB(234, 207, 51))
swatch_4 = ColourSwatch(SwatchColor=RGB(51, 79, 234))
swatch_5 = ColourSwatch(SwatchColor=RGB(157, 0, 165))
swatch_6 = ColourSwatch(SwatchColor=RGB(75, 85, 100))
swatch_7 = ColourSwatch(SwatchColor=RGB(37, 42, 50))

folder_base_path_2 = FilePath(folder_base_path)
folder_base_path_3 = FilePath(folder_base_path_2)
concat_7 = Concatenate(FragmentA=folder_base_path_3, FragmentB="\", FragmentC="DataSource")
folder_data_source_path = FilePath(concat_7)
concat_8 = Concatenate(FragmentA=folder_data_source_path, FragmentB="\", FragmentC="Simulation-Files")
concat_9 = Concatenate(FragmentA=folder_data_source_path, FragmentB="\", FragmentC="Visualization")
folder_base_path_honeybee = FilePath(concat_8)
folder_base_path_images = FilePath(concat_9)

panel_23 = Panel("""private void GenerateConstructionMunich()
        {
            double uWall = Parameters.Construction.UWall,
                uGFloor = Parameters.Construction.UGFloor,
                uIFloor = Parameters.Construction.UIFloor,
                uRoof = Parameters.Construction.URoof,
                uIWall = Parameters.Construction.UIWall,
                uWindow = Parameters.Construction.UWindow,
                gWindow = Parameters.Construction.GWindow,
                hcSlab = Parameters.Construction.HCSlab;

            var lambda_insulation = 0.035;

            //wall plaster layer
            var wall_plasterlayer = new Material("wall_plasterlayer", "Smooth", 0.02, 0.7, 1400, 1000, 0.9, 0.4, 0.7);

            //wall0 layers
            var wall_structure = new Material("wall_structure", "Smooth", 0.18, 2.3, 2300, 1100, 0.9, 0.7, 0.7);
            var wall_insulation = new Material("wall_insulation", "Smooth", 0.18, lambda_insulation, 25, 1000, 0.9, 0.7, 0.7);

            //wall1 layers
            var wall1_structure = new Material("wall1_structure", "Smooth", 0.3, 0.09, 650, 1100, 0.9, 0.7, 0.7);
            var wall1_insulation = new Material("wall1_insulation", "Smooth", 0.06, lambda_insulation, 25, 1000, 0.9, 0.7, 0.7);

            //wall2 layers
            var wall2_structure = new Material("wall2_structure", "Smooth", 0.175, 1.4, 2000, 1100, 0.9, 0.7, 0.7);
            var wall2_insulation = new Material("wall2_insulation", "Smooth", 0.18, lambda_insulation, 25, 1000, 0.9, 0.7, 0.7);

            //internal wall layers
            var plasterboard = new Material("plasterboard", "Rough", 0.05, 0.16, 800, 800, 0.9, 0.6, 0.6);
            var iwall_insulation = new Material("iwall_insulation", "Rough", 0.025, lambda_insulation, 20, 1000, 0.9, 0.7, 0.7);

            //gFloor & iFloor layers
            var pInsulation = new Material("pInsulation", "Smooth", 0.05, lambda_insulation, 20, 1000, 0.9, 0.7, 0.7);
            var floor_structure = new Material("floor_structure", "Smooth", 0.2, 2.3, 2300, hcSlab, 0.9, 0.7, 0.7);
            var gfloor_insulation = new Material("gfloor_insulation", "Smooth", 0.053, lambda_insulation, 20, 1000, 0.9,  0.7, 0.7);
            var floor_cementscreed = new Material("floor_cementscreed", "Smooth", 0.08, 1.4, 2000, 1000, 0.9, 0.7, 0.7);

            var ifloor_insulation = new Material("ifloor_insulation", "Smooth", 0.025, lambda_insulation, 20, 1000, 0.9,  0.7, 0.7);

            //Roof layers
            var roof_insulation = new Material("roof_insulation", "Smooth", 0.23, lambda_insulation, 20, 1000, 0.9, 0.7,  0.7);
            var roof_structure = new Material("roof_structure", "Smooth", 0.25, 2.3, 2300, hcSlab, 0.9, 0.7, 0.7);
            var roof_plaster = new Material("roof_plaster", "Smooth", 0.02, 0.7, 1400, 1000, 0.9, 0.7, 0.7);

            var layerListRoof = new List<Material> {pInsulation, roof_insulation, roof_structure, roof_plaster};
            Parameters.Construction.hcRoof = layerListRoof.Select(l => l.thickness * l.sHC * l.density).Sum();
            var construction_Roof = new Construction.Construction("Roof", layerListRoof);

            var layerListWall = new List<Material> {wall_plasterlayer, wall_insulation, wall_structure, wall_plasterlayer};
            var construction_Wall = new Construction.Construction("ExternalWall", layerListWall);
            Parameters.Construction.hcWall = layerListWall.Select(l => l.thickness * l.sHC * l.density).Sum();

            var layerListInternallWall = new List<Material> {plasterboard, iwall_insulation, plasterboard};
            var construction_internalWall = new Construction.Construction("InternalWall", layerListInternallWall);
            Parameters.Construction.hcIWall = layerListInternallWall.Select(l => l.thickness * l.sHC * l.density).Sum();

            var layerListGfloor = new List<Material> {pInsulation, floor_structure, gfloor_insulation, floor_cementscreed};
            var construction_gFloor = new Construction.Construction("GroundFloor", layerListGfloor);
            Parameters.Construction.hcGFloor = layerListGfloor.Select(l => l.thickness * l.sHC * l.density).Sum();

            var layerListIFloor = new List<Material> {floor_structure, ifloor_insulation, floor_cementscreed};
            var construction_ifloor = new Construction.Construction("Floor_Ceiling", layerListIFloor);
            Parameters.Construction.hcIFloor = layerListIFloor.Select(l => l.thickness * l.sHC * l.density).Sum();

            var InternalMaterial = new Material("InternalMaterial", "Smooth", 0.12, 2.3, 500, 1000, 0.85, 0.85, 0.7);
            var InternalMass = new Construction.Construction("InternalMass", new List<Material> {InternalMaterial});
            Parameters.Construction.hcInternalMass = new List<Material> {InternalMaterial} .Select(l => l.thickness * l.sHC * l.density).Sum();

            construction_Roof.AdjustInsulation(uRoof, roof_insulation);
            construction_Wall.AdjustInsulation(uWall, wall_insulation);
            construction_gFloor.AdjustInsulation(uGFloor, gfloor_insulation);
            construction_ifloor.AdjustInsulation(uIFloor, ifloor_insulation);
            construction_internalWall.AdjustInsulation(uIWall, iwall_insulation);

            constructions = new List<Construction.Construction> {InternalMass, construction_Roof, construction_Wall, construction_gFloor, construction_ifloor, construction_internalWall};
            materials = constructions.SelectMany(c => c.layers).Select(l => l.Name).Distinct() .Select(n => constructions.SelectMany(c => c.layers).First(l => l.Name == n)).ToList();

            //window construction
            var windowLayer = new WindowMaterial("Glazing Material", uWindow, gWindow, 0.1);
            windowMaterials = new List<WindowMaterial> {windowLayer};
            var window = new Construction.Construction("Glazing", new List<WindowMaterial> {windowLayer});
            constructions.Add(window);

            //window shades
            windowMaterialShades = new List<WindowMaterialShade> {new WindowMaterialShade()};
        }""")

required_u_values = FilePath(required_u_values_path)
energystandard_2 = Text(energystandard)
read_u_values = Read_UValues(path=required_u_values, energystandard_selected=energystandard_2)  # -> cost_groups_3, categories_3, required_u_values_3
number_slider_12 = Slider(6, range=0..10)
required_u_values_2 = Number(read_u_values.required_u_values_3)
categories = Text(read_u_values.categories_3)
cost_groups = Text(read_u_values.cost_groups_3)
panel_24 = Panel("""0
1
3
4""")
item_2 = ListItem(List=categories, Index=panel_24, Wrap=True)
item_3 = ListItem(List=required_u_values_2, Index=panel_24, Wrap=True)
item_4 = ListItem(List=categories, Index=number_slider_12, Wrap=True)
item_5 = ListItem(List=required_u_values_2, Index=number_slider_12, Wrap=True)
merge = Merge(Data1=flatten(item_2), Data2=flatten(item_4))
merge_2 = Merge(Data1=flatten(item_3), Data2=flatten(item_5))

insulation_conductivity_2 = Number(insulation_conductivity)
manavc__construction = Text(panel_23)
slab_heat_capacity_2 = Number(slab_heat_capacity)
manav_hb_mat = ManavHB_Mat(
    manavc__construction=manavc__construction,
    slab_heat_capacity=slab_heat_capacity_2,
    insulation_conductivity=insulation_conductivity_2)  # -> hb_materials_non_insulation_3, hb_materials_name_non_insulation_2, hb_materials_insulation_3, materialnames_insulation_3, hb_opaque_construction_3, hb_opaque_construction_name_2, layers_materials_3, layers_materialnames_4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
hb_opaque_construction_name = Text(manav_hb_mat.hb_opaque_construction_name_2)
hb_opaque_construction = Data(manav_hb_mat.hb_opaque_construction_3)
list_21 = ValueList({"Wall": 0, "Wall 1": 1, "Wall 2": 2}, selected="Wall")
filter_59 = StreamFilter(Gate=list_21)
tstat = TreeStatistics(Tree=hb_opaque_construction_name)  # -> Paths, Length, Count
item_6 = ListItem(List=tstat.Paths, Index=0, Wrap=True)  # -> Item, Item1, Item2, Item3, Item4, Item5, Item6, Item7
merge_3 = Merge(Data1=item_6.Item3, Data2=item_6.Item, Data3=item_6.Item1, Data4=item_6.Item1)
required_u_values_3 = Number(item_3)
categories_2 = Text(item_2)
branch = TreeBranch(Tree=manav_hb_mat.insulation_layer_index_3, Path=merge_3, MaintainPaths=False)
branch_2 = TreeBranch(Tree=hb_opaque_construction, Path=merge_3, MaintainPaths=False)
dsptchpths = DispatchBranchesWithPaths(Data=hb_opaque_construction, Paths=merge_3)  # -> SelectedData, OtherData, SelectedPaths, AdditionalGen; inputs Data: tree, Paths: list, Ancestor: Boolean; same code as dsptchpths
match_2 = MatchTree(Tree=graft(categories_2), Guide=branch_2)
match_3 = MatchTree(Tree=graft(required_u_values_3), Guide=branch_2)
adjust_u_value = Adjust_UValue(
    hb_opaque_construction=branch_2,
    hb_opaque_construction_name_new=match_2,
    opaque_construction_u_value=match_3,
    insulation_layer_index=branch,
    target_u_value_include_airfilms=Toggle(True))  # -> hb_opaque_construction_adjusted_2, insulation_thickness_old_2, insulation_thickness_new_3
item_7 = ListItem(List=flatten(adjust_u_value.hb_opaque_construction_adjusted_2), Index=0, Wrap=True)  # -> Item, Item1, Item2, Item3, Item4
item_8 = ListItem(List=flatten(dsptchpths.OtherData), Index=0, Wrap=True)  # -> Item, Item1, Item2, Item3, Item4
interiorsubset = HBInteriorConstructionSubset(interior_wall=item_8.Item, interior_floor=item_8.Item1)  # -> interior_set; plug-in component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
exteriorsubset = HBExteriorConstructionSubset(exterior_wall=item_7.Item2, exterior_roof=item_7.Item1)  # -> exterior_set; plug-in component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
groundsubset = HBGroundConstructionSubset(ground_wall=item_7.Item3, ground_floor=item_7.Item)  # -> ground_set; plug-in component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
constructionset = HBConstructionSet(
    name="Typical-Building-Munich",
    exterior_subset=exteriorsubset,
    ground_subset=groundsubset,
    interior_subset=interiorsubset)  # -> flatten(constr_set); plug-in component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
hb_constructionset = Data(constructionset)

hb_constructionset_2 = Data(hb_constructionset)
decnstrconstrset_2 = HBDeconstructConstructionSet(constr_set=hb_constructionset_2)  # -> exterior_wall, exterior_roof, exposed_floor, ground_wall, ground_roof, ground_floor, window, skylight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; plug-in component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
decnstrconstr_2 = HBDeconstructConstruction(constr=decnstrconstrset_2.exterior_wall)  # -> materials, layers, r_val_si, r_val_ip, u_fac_si, u_fac_ip, shgc, t_sol, t_vis; plug-in component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
decnstrconstr_3 = HBDeconstructConstruction(constr=decnstrconstrset_2.exterior_wall)  # -> materials, layers, r_val_si, r_val_ip, u_fac_si, u_fac_ip, shgc, t_sol, t_vis; plug-in component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
panel_25 = Panel(decnstrconstr_2.materials)
panel_26 = Panel(decnstrconstr_3.materials)
number_slider_13 = Slider(0.65, range=0..1)
number_slider_14 = Slider(0.3, range=0..1)
number_slider_15 = Slider(2000, range=0..10000)
shademat = HBShadeMaterial(thickness=Slider(0.07, range=0..0.1))  # -> mat; plug-in component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

folder_base_path_4 = FilePath(folder_base_path_2)
concat_10 = Concatenate(FragmentA=folder_base_path_4, FragmentB="\", FragmentC="Data_Training")
folder_write_path = FilePath(concat_10)
concat_11 = Concatenate(FragmentA=folder_write_path, FragmentB="\", FragmentC="Buildings")
namingschema_delimiter_parameter = Text(namingschema_delimiter_parameter_primary)
file_name_base = Text(concat_11)
iteration_name_2 = Text(iteration_name)

panel_27 = Panel("""        private void GenerateConstructionTausendpfund()
        {
            double uWall = Parameters.Construction.UWall,
                uGFloor = Parameters.Construction.UGFloor,
                uIFloor = Parameters.Construction.UIFloor,
                uRoof = Parameters.Construction.URoof,
                uIWall = Parameters.Construction.UIWall,
                uWindow = Parameters.Construction.UWindow,
                gWindow = Parameters.Construction.GWindow,
                hcSlab = Parameters.Construction.HCSlab;

            var lambda_insulation = 0.035;

            //wall plaster layer
            var wall_plasterlayer = new Material("wall_plasterlayer", "Smooth", 0.02, 0.7, 1400, 900, 0.9, 0.4, 0.7);

            //wall0 layers
            var wall_structure = new Material("wall_structure", "Smooth", 0.18, 2.3, 2300, 1100, 0.9, 0.7, 0.7);
            var wall_insulation = new Material("wall_insulation", "Smooth", 0.18, lambda_insulation, 25, 1000, 0.9, 0.7,   0.7);

            //wall1 layers
            var wall1_structure = new Material("wall1_structure", "Smooth", 0.3, 0.09, 650, 1100, 0.9, 0.7, 0.7);
            var wall1_insulation = new Material("wall1_insulation", "Smooth", 0.06, lambda_insulation, 25, 1000, 0.9, 0.7, 0.7);

            //wall2 layers
            var wall2_structure = new Material("wall2_structure", "Smooth", 0.175, 1.4, 2000, 1100, 0.9, 0.7, 0.7);
            var wall2_insulation = new Material("wall2_insulation", "Smooth", 0.18, lambda_insulation, 25, 1000, 0.9, 0.7, 0.7);

            //internal wall layers
            var plasterboard = new Material("plasterboard", "Rough", 0.05, 0.16, 800, 800, 0.9, 0.6, 0.6);
            var iwall_insulation = new Material("iwall_insulation", "Rough", 0.025, lambda_insulation, 20, 1000, 0.9, 0.7, 0.7);

            //gFloor & iFloor layers
            var pInsulation = new Material("pInsulation", "Smooth", 0.12, lambda_insulation, 20, 1000, 0.9, 0.7, 0.7);
            var floor_structure = new Material("floor_structure", "Smooth", 0.2, 2.3, 2300, hcSlab, 0.9, 0.7, 0.7);
            var gfloor_insulation = new Material("gfloor_insulation", "Smooth", 0.053, lambda_insulation, 20, 1000, 0.9, 0.7, 0.7);
            var floor_cementscreed = new Material("floor_cementscreed", "Smooth", 0.08, 1.4, 2000, 2500, 0.9, 0.7, 0.7);

            var ifloor_insulation = new Material("ifloor_insulation", "Smooth", 0.025, lambda_insulation, 20, 1000, 0.9, 0.7, 0.7);

            //Roof layers
            var roof_insulation = new Material("roof_insulation", "Smooth", 0.23, lambda_insulation, 20, 1000, 0.9, 0.7,0.7);
            var roof_structure = new Material("roof_structure", "Smooth", 0.25, 2.3, 2300, hcSlab, 0.9, 0.7, 0.7);
            var roof_plaster = new Material("roof_plaster", "Smooth", 0.02, 0.7, 1400, 2500, 0.9, 0.7, 0.7);

            var layerListRoof = new List<Material> {pInsulation, roof_insulation, roof_structure, roof_plaster};
            Parameters.Construction.hcRoof = layerListRoof.Select(l => l.thickness * l.sHC * l.density).Sum();
            var construction_Roof = new Construction.Construction("Up Roof Concrete", layerListRoof);

            var layerListWall = new List<Material> {wall_plasterlayer, wall_insulation, wall_structure, wall_plasterlayer};
            var construction_Wall = new Construction.Construction("Wall ConcreteBlock", layerListWall);
            Parameters.Construction.hcWall = layerListWall.Select(l => l.thickness * l.sHC * l.density).Sum();

            var layerListWall1 = new List<Material> {wall_plasterlayer, wall1_insulation, wall1_structure, wall_plasterlayer};
            var construction_Wall1 = new Construction.Construction("Wall ConcreteBlock1", layerListWall);
            Parameters.Construction.hcWall = layerListWall.Select(l => l.thickness * l.sHC * l.density).Sum();

            var layerListWall2 = new List<Material>  {wall_plasterlayer, wall2_insulation, wall1_structure, wall_plasterlayer};
            var construction_Wall2 = new Construction.Construction("Wall ConcreteBlock2", layerListWall);
            Parameters.Construction.hcWall = layerListWall.Select(l => l.thickness * l.sHC * l.density).Sum();

            var layerListInternallWall = new List<Material> {plasterboard, iwall_insulation, plasterboard};
            var construction_internalWall = new Construction.Construction("InternalWall", layerListInternallWall);
            Parameters.Construction.hcIWall = layerListInternallWall.Select(l => l.thickness * l.sHC * l.density).Sum();

            var layerListGfloor = new List<Material>  {pInsulation, floor_structure, gfloor_insulation, floor_cementscreed};
            var construction_gFloor = new Construction.Construction("Slab_Floor", layerListGfloor);
            Parameters.Construction.hcGFloor = layerListGfloor.Select(l => l.thickness * l.sHC * l.density).Sum();

            var layerListIFloor = new List<Material> {floor_structure, ifloor_insulation, floor_cementscreed};
            var construction_ifloor = new Construction.Construction("General_Floor_Ceiling", layerListIFloor);
            Parameters.Construction.hcIFloor = layerListIFloor.Select(l => l.thickness * l.sHC * l.density).Sum();

            var InternalMaterial = new Material("InternalMaterial", "Smooth", 0.12, 2.3, 500, 1000, 0.85, 0.85, 0.7);
            var InternalMass = new Construction.Construction("InternalMass", new List<Material> {InternalMaterial});
            Parameters.Construction.hcInternalMass = new List<Material> {InternalMaterial}.Select(l => l.thickness * l.sHC * l.density).Sum();

            construction_Roof.AdjustInsulation(uRoof, roof_insulation);
            construction_Wall.AdjustInsulation(uWall, wall_insulation);
            construction_gFloor.AdjustInsulation(uGFloor, gfloor_insulation);
            construction_ifloor.AdjustInsulation(uIFloor, ifloor_insulation);
            construction_internalWall.AdjustInsulation(uIWall, iwall_insulation);

            constructions = new List<Construction.Construction> {InternalMass, construction_Roof, construction_Wall, construction_Wall1, construction_Wall2,construction_gFloor, construction_ifloor, construction_internalWall};
            materials = constructions.SelectMany(c => c.layers).Select(l => l.Name).Distinct().Select(n => constructions.SelectMany(c => c.layers).First(l => l.Name == n)).ToList();

            //window construction
            var windowLayer = new WindowMaterial("Glazing Material", uWindow, gWindow, 0.1);
            windowMaterials = new List<WindowMaterial> {windowLayer};
            var window = new Construction.Construction("Glazing", new List<WindowMaterial> {windowLayer});
            constructions.Add(window);

            //window shades
            windowMaterialShades = new List<WindowMaterialShade> {new WindowMaterialShade()};
        }""")
shading_3 = Text(shading_2)
panel_28 = Panel(""" public void GenerateConstructionBelgium()
        {
            double uWall = Parameters.Construction.UWall,
                uCWall = Parameters.Construction.UCWall,
                uGFloor = Parameters.Construction.UGFloor,
                uIFloor = Parameters.Construction.UIFloor,
                uRoof = Parameters.Construction.URoof,
                uIWall = Parameters.Construction.UIWall,
                uWindow = Parameters.Construction.UWindow,
                gWindow = Parameters.Construction.GWindow,
                hcSlab = Parameters.Construction.HCSlab;
            //InternalMass
            var InternalMaterial = new Material("InternalMaterial", "Smooth", 0.12, 2.3, 2300, 1000, 0.85, 0.85, 0.7);
            var InternalMass = new Construction.Construction("InternalMass", new List<Material> {InternalMaterial});
            Parameters.Construction.hcInternalMass = new List<Material> {InternalMaterial}.Select(l => l.thickness * l.sHC * l.density).Sum();
            //Roof
            var Bitumen = new Material("Bitumen", "Smooth", 0.01, 0.230, 1100, 1000, 0.9, 0.9, 0.7);
            var PUR_Roof = new Material("PUR_Roof", "Smooth", 0.06, 0.026, 35, 1400, 0.85, 0.85, 0.7);
            var Screed = new Material("Screed", "Smooth", 0.06, 1.3, 1600, 1000, 0.85, 0.85, 0.7);
            var RConcrete1 = new Material("RConcrete1", "Smooth", 0.12, 2.3, 2300, 1000, 0.85, 0.85, 0.7);
            var Gypsum1 = new Material("Gypsum1", "Smooth", 0.01, 0.4, 800, 1000, 0.85, 0.4, 0.7);
            var Roof = new Construction.Construction("Roof", new List<Material>{Bitumen, PUR_Roof, Screed, RConcrete1, Gypsum1});

            //Exterior Wall
            var Brick = new Material("Brick", "Smooth", 0.1, 0.75, 1400, 840, 0.88, 0.55, 0.7);
            var Cavity = new Material("Cavity", "Smooth", 0.03, 0.0258, 1.2, 1006, 0.9, 0.9, 0.7);
            var MWool_ExWall = new Material("MWool_ExWall", "Smooth", 0.05, 0.05, 100, 1030, 0.9, 0.7, 0.7);
            var Brickwork1 = new Material("Brickwork1", "Smooth", 0.14, 0.32, 840, 1300, 0.88, 0.55, 0.7);
            var Gypsum2 = new Material("Gypsum2", "Smooth", 0.02, 0.4, 800, 1000, 0.85, 0.4, 0.7);
            var ExWall = new Construction.Construction("ExternalWall", new List<Material> {Brick, Cavity, MWool_ExWall, Brickwork1, Gypsum2});

            //InWall
            var MWool_InWall = new Material("MWool_InWall", "Smooth", 0.05, 0.05, 100, 1030, 0.9, 0.7, 0.7);
            var Brickwork2 = new Material("Brickwork2", "Smooth", 0.14, 0.27, 850, 840, 0.85, 0.55, 0.7);
            var InWall = new Construction.Construction("InternalWall", new List<Material> {Gypsum1, MWool_InWall, Brickwork2, Gypsum1});

            //GFloor
            var FloorTiles = new Material("FloorTiles", "Smooth", 0.04, 0.44, 1500, 733, 0.85, 0.55, 0.6);
            var PUR_GFloor = new Material("PUR_GFloor", "Smooth", 0.06, 0.026, 35, 1400, 0.85, 0.85, 0.7);
            var RConcrete2 = new Material("RConcrete2", "Smooth", 0.15, 2.3, 2300, 1000, 0.85, 0.85, 0.7);
            var GFloor = new Construction.Construction("GroundFloor", new List<Material> {FloorTiles, Screed, PUR_GFloor, RConcrete2});


            //Ceiling
            var PUR_Ceiling = new Material("PUR_Ceiling", "Smooth", 0.06, 0.026, 35, 1400, 0.85, 0.85, 0.7);
            var Ceiling = new Construction.Construction("Floor_Ceiling", new List<Material>{FloorTiles, Screed, PUR_Ceiling, RConcrete1, Gypsum1});

            //CommonWall
            var EPS_CommonWall = new Material("EPS", "Smooth", 0.02, 0.035, 20, 1450, 0.85, 0.85, 0.7);
            var CommonWall = new Construction.Construction("CommonWall", new List<Material> { Gypsum2, Brickwork2, EPS_CommonWall, Brickwork2, Gypsum2});

            Roof.AdjustInsulation(uRoof, PUR_Roof);
            ExWall.AdjustInsulation(uWall, MWool_ExWall);
            InWall.AdjustInsulation(uIWall, MWool_InWall);
            GFloor.AdjustInsulation(uGFloor, PUR_GFloor);
            Ceiling.AdjustInsulation(uIFloor, PUR_Ceiling);
            CommonWall.AdjustInsulation(uCWall, EPS_CommonWall);


            constructions.AddRange(new List<Construction.Construction>{InternalMass, Roof, ExWall, InWall, GFloor, Ceiling, CommonWall});
            materials.AddRange(constructions.SelectMany(c => c.layers).Select(l => l.Name).Distinct().Select(n => constructions.SelectMany(c => c.layers).First(l => l.Name == n)));
            //window construction
            var windowLayer = new WindowMaterial("Glazing Material", uWindow, gWindow, 0.1);
            windowMaterials = new List<WindowMaterial> {windowLayer};
            var window = new Construction.Construction("Glazing", new List<WindowMaterial> {windowLayer});
            constructions.Add(window);

            //window shades
            windowMaterialShades = new List<WindowMaterialShade> {new WindowMaterialShade()};
        }""")
insulation_conductivity_3 = Number(insulation_conductivity)
manavc__construction_2 = Text(panel_28)
manavc__construction_3 = Text(panel_27)
slab_heat_capacity_3 = Number(slab_heat_capacity)
slab_heat_capacity_4 = Number(slab_heat_capacity)
insulation_conductivity_4 = Number(insulation_conductivity)
manav_hb_mat_2 = ManavHB_Mat(
    manavc__construction=manavc__construction_3,
    slab_heat_capacity=slab_heat_capacity_4,
    insulation_conductivity=insulation_conductivity_3)  # -> hb_materials_non_insulation_3, hb_materials_name_non_insulation_2, hb_materials_insulation_3, materialnames_insulation_3, hb_opaque_construction_3, hb_opaque_construction_name_2, layers_materials_3, layers_materialnames_4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
manav_hb_mat_3 = ManavHB_Mat(
    manavc__construction=manavc__construction_2,
    slab_heat_capacity=slab_heat_capacity_3,
    insulation_conductivity=insulation_conductivity_4)  # -> hb_materials_non_insulation_3, hb_materials_name_non_insulation_2, hb_materials_insulation_3, materialnames_insulation_3, hb_opaque_construction_3, hb_opaque_construction_name_2, layers_materials_3, layers_materialnames_4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
all_air_2 = HBAllAirHVACTemplates({"VAV chiller with gas boiler reheat": "VAV_Chiller_Boiler", "VAV chiller with central air source heat pump reheat": "VAV_Chiller_ASHP", "VAV chiller with district hot water reheat": "VAV_Chiller_DHW", "VAV chiller with PFP boxes": "VAV_Chiller_PFP", "VAV chiller with gas coil reheat": "VAV_Chiller_GasCoil", "VAV air-cooled chiller with gas boiler reheat": "VAV_ACChiller_Boiler", "VAV air-cooled chiller with central air source heat pump reheat": "VAV_ACChiller_ASHP", "VAV air-cooled chiller with district hot water reheat": "VAV_ACChiller_DHW", "VAV air-cooled chiller with PFP boxes": "VAV_ACChiller_PFP", "VAV air-cooled chiller with gas coil reheat": "VAV_ACChiller_GasCoil"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}, selected="PTHP")
number_slider_16 = Slider(0.5, range=0.5..0.8)
heatcool_3 = HBHeatCoolHVACTemplates({"Baseboard electric": "ElectricBaseboard", "Baseboard gas boiler": "BoilerBaseboard", "Baseboard central air source heat pump": "ASHPBaseboard", "Baseboard district hot water": "DHWBaseboard", "Direct evap coolers with baseboard electric": "EvapCoolers_ElectricBaseboard", "Direct evap coolers with baseboard gas boiler": "EvapCoolers_BoilerBaseboard"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}, selected=["Direct evap coolers with baseboard central air source heat pump": "EvapCoolers_ASHPBaseboard", "Fan coil chiller with central air source heat pump": "FCU_Chiller_ASHP"])
doas_2 = HBDOASHVACTemplates({"DOAS with fan coil chiller with boiler": "DOAS_FCU_Chiller_Boiler", "DOAS with fan coil chiller with central air source heat pump": "DOAS_FCU_Chiller_ASHP", "DOAS with fan coil chiller with district hot water": "DOAS_FCU_Chiller_DHW", "DOAS with fan coil chiller with baseboard electric": "DOAS_FCU_Chiller_ElectricBaseboard", "DOAS with fan coil chiller with gas unit heaters": "DOAS_FCU_Chiller_GasHeaters", "DOAS with fan coil chiller with no heat": "DOAS_FCU_Chiller", "DOAS with fan coil air-cooled chiller with boiler": "DOAS_FCU_ACChiller_Boiler", "DOAS with fan coil air-cooled chiller with central air source heat pump": "DOAS_FCU_ACChiller_ASHP", "DOAS with fan coil air-cooled chiller with district hot water": "DOAS_FCU_ACChiller_DHW", "DOAS with fan coil air-cooled chiller with baseboard electric": "DOAS_FCU_ACChiller_ElectricBaseboard", "DOAS with fan coil air-cooled chiller with gas unit heaters": "DOAS_FCU_ACChiller_GasHeaters", "DOAS with fan coil air-cooled chiller with no heat": "DOAS_FCU_ACChiller", "DOAS with fan coil district chilled water with boiler": "DOAS_FCU_DCW_Boiler", "DOAS with fan coil district chilled water with central air source heat pump": "DOAS_FCU_DCW_ASHP", "DOAS with fan coil district chilled water with district hot water": "DOAS_FCU_DCW_DHW", "DOAS with fan coil district chilled water with baseboard electric": "DOAS_FCU_DCW_ElectricBaseboard", "DOAS with fan coil district chilled water with gas unit heaters": "DOAS_FCU_DCW_GasHeaters", "DOAS with fan coil district chilled water with no heat": "DOAS_FCU_DCW", "DOAS with VRF": "DOAS_VRF", "DOAS with water source heat pumps fluid cooler with boiler": "DOAS_WSHP_FluidCooler_Boiler", "DOAS with water source heat pumps cooling tower with boiler": "DOAS_WSHP_CoolingTower_Boiler", "DOAS with water source heat pumps with ground source heat pump": "DOAS_WSHP_GSHP", "DOAS with water source heat pumps district chilled water with district hot water": "DOAS_WSHP_DCW_DHW"}, selected="DOAS with fan coil chiller with boiler")
all_air_3 = HBAllAirHVACTemplates({"VAV chiller with gas boiler reheat": "VAV_Chiller_Boiler", "VAV chiller with central air source heat pump reheat": "VAV_Chiller_ASHP", "VAV chiller with district hot water reheat": "VAV_Chiller_DHW", "VAV chiller with PFP boxes": "VAV_Chiller_PFP", "VAV chiller with gas coil reheat": "VAV_Chiller_GasCoil", "VAV air-cooled chiller with gas boiler reheat": "VAV_ACChiller_Boiler", "VAV air-cooled chiller with central air source heat pump reheat": "VAV_ACChiller_ASHP", "VAV air-cooled chiller with district hot water reheat": "VAV_ACChiller_DHW", "VAV air-cooled chiller with PFP boxes": "VAV_ACChiller_PFP", "VAV air-cooled chiller with gas coil reheat": "VAV_ACChiller_GasCoil"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}, selected=["VAV chiller with gas boiler reheat", "PTHP"])
zonenode = ZoneNode(Name="HVAC-Zone", AreaHVAC=Slider(10, range=0..10))
graph = Graph()  # -> Graph, Actions, ProcessingEnvironment
panel_29 = Panel("BoilerPlacement")
panel_30 = Panel("RadiatorPlacement")
showgraph = ShowGraph()
addnode = AddNode()
rewrite = Rewrite(RewriteSequence="RadiatorPlacement*")

courtyard_segmentcount_rasterlength_y_2 = Number(courtyard_segmentcount_rasterlength_y)

basebody_inside_latditudinal_numberofseg = Number(Slider(3, range=0..10))  # "BaseBody-Inside-Latditudinal-NumberOfSegments"
arm_lower_left_longitudinal_numberofsegm = Number(number_slider_9)  # "Arm-Lower-Left-Longitudinal-NumberOfSegments"
arm_lower_lef_latitudinal_numberofsegmen = Number(number_slider_8)  # "Arm-Lower-Lef-Latitudinal-NumberOfSegments"
arm_upper_left_longitudinal_numberofsegm = Number(number_slider_9)  # "Arm-Upper-Left-Longitudinal-NumberOfSegments"
arm_upper_right_longitudinal_numberofseg = Number(number_slider_9)  # "Arm-Upper-Right-Longitudinal-NumberOfSegments"
arm_upper_right_latitudinal_numberofsegm = Number(number_slider_8)  # "Arm-Upper-Right-Latitudinal-NumberOfSegments"
arm_lower_right_longitudinal_numberofseg = Number(number_slider_9)  # "Arm-Lower-Right-Longitudinal-NumberOfSegments"
arm_lower_right_latitudinal_numberofsegm = Number(number_slider_8)  # "Arm-Lower-Right-Latitudinal-NumberOfSegments"
arm_upper_left_latitudinal_numberofsegme = Number(number_slider_8)  # "Arm-Upper-Left-Latitudinal-NumberOfSegments"

addition = Addition(
    A=courtyard_segmentcount_rasterlength_y_2,
    B=arm_lower_right_longitudinal_numberofseg,
    C=arm_lower_left_longitudinal_numberofsegm)

basebody_longitudinal_numberofsegments = Number(addition)

# ----
# Data tree schema:
# {...,Building,Zone}
# Zone:
# 0:Core
# 1:Center-Lower
# 2:Center-Upper
# 3:Center-Right
# 4:Center-Left
# 5:Arm-Lower-Right
# 6:Arm-Lower-Left
# 7:Arm-Upper-Left
# 8:Arm-Upper-Right
generic_officebuilding_h_shape_rectangle = Generic_OfficeBuilding_HShape_RectangleGrid(
    baseplane=baseplane,
    rasterlength_x=rasterlength_x_2,
    rasterlength_y=rasterlength_y_2,
    building_longitudinal_numberofsegments=basebody_longitudinal_numberofsegments,
    basebody_inside_latditudinal_numberofseg=basebody_inside_latditudinal_numberofseg,
    arm_lower_right_longitudinal_numberofseg=arm_lower_right_longitudinal_numberofseg,
    arm_lower_right_latitudinal_numberofsegm=arm_lower_right_latitudinal_numberofsegm,
    arm_lower_left_longitudinal_numberofsegm=arm_lower_left_longitudinal_numberofsegm,
    arm_lower_lef_latitudinal_numberofsegmen=arm_lower_lef_latitudinal_numberofsegmen,
    arm_upper_left_longitudinal_numberofsegm=arm_upper_left_longitudinal_numberofsegm,
    arm_upper_left_latitudinal_numberofsegme=arm_upper_left_latitudinal_numberofsegme,
    arm_upper_right_longitudinal_numberofseg=arm_upper_right_longitudinal_numberofseg,
    arm_upper_right_latitudinal_numberofsegm=arm_upper_right_latitudinal_numberofsegm,
    namingschema_directions=panel_21,
    namingschema_delimiter="_",
    namingschema_building_name=match,
    namingschema_wing_name="Wing",
    namingschema_center_name="Center",
    namingschema_core_name="Core",
    namingschema_arm_name="Arm",
    namingschema_fassade_name="Fassade")  # -> boundary_2, courtyard_upper_3, courtyard_lower_3, wings_boundary_2, wings_name_2, basebody_center_boundary_2, basebody_center_name_2, basebody_center_zones_boundary_2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; "Generic_OfficeBuilding_H-Shape_RectangleGrid"
basebody_center_zones_name = Text(generic_officebuilding_h_shape_rectangle.basebody_center_zones_name_2)
wings_boundary = Curve(generic_officebuilding_h_shape_rectangle.wings_boundary_2)
wings_name = Text(generic_officebuilding_h_shape_rectangle.wings_name_2)
basebody_center_boundary = Curve(generic_officebuilding_h_shape_rectangle.basebody_center_boundary_2)
basebody_center_name = Text(generic_officebuilding_h_shape_rectangle.basebody_center_name_2)
basebody_center_zones_boundary = Curve(generic_officebuilding_h_shape_rectangle.basebody_center_zones_boundary_2)
basebody_core_boundary = Curve(generic_officebuilding_h_shape_rectangle.basebody_core_boundary_2)
basebody_core_name = Text(generic_officebuilding_h_shape_rectangle.basebody_core_name_2)
basebody_zone_wings_boundary = Curve(generic_officebuilding_h_shape_rectangle.basebody_zone_wings_boundary_2)
basebody_zone_wings_name = Text(generic_officebuilding_h_shape_rectangle.basebody_zone_wings_name_2)
arms_boundary = Curve(generic_officebuilding_h_shape_rectangle.arms_boundary_2)
arms_name = Text(generic_officebuilding_h_shape_rectangle.arms_name_2)
basebody_fassade_lower_line = Curve(generic_officebuilding_h_shape_rectangle.basebody_fassade_lower_line_2)
basebody_fassade_lower_name = Text(generic_officebuilding_h_shape_rectangle.basebody_fassade_lower_name_2)
basebody_fassade_upper_line = Curve(generic_officebuilding_h_shape_rectangle.basebody_fassade_upper_line_2)
basebody_fassade_upper_name = Text(generic_officebuilding_h_shape_rectangle.basebody_fassade_upper_name_2)
basebody_fassade_right_line = Curve(generic_officebuilding_h_shape_rectangle.basebody_fassade_right_line_2)
basebody_fassade_right_name = Text(generic_officebuilding_h_shape_rectangle.basebody_fassade_right_name_2)
basebody_fassade_left_line = Curve(generic_officebuilding_h_shape_rectangle.basebody_fassade_left_line_2)
basebody_fassade_left_name = Text(generic_officebuilding_h_shape_rectangle.basebody_fassade_left_name_2)
arms_fassade_left_line = Curve(generic_officebuilding_h_shape_rectangle.arms_fassade_left_line_2)
arms_fassade_left_name = Text(generic_officebuilding_h_shape_rectangle.arms_fassade_left_name_2)
arms_fassade_right_line = Curve(generic_officebuilding_h_shape_rectangle.arms_fassade_right_line_2)
arms_fassade_right_name = Text(generic_officebuilding_h_shape_rectangle.arms_fassade_right_name_2)
arms_fassade_lower_line = Curve(generic_officebuilding_h_shape_rectangle.arms_fassade_lower_line_2)
arms_fassade_lower_name = Text(generic_officebuilding_h_shape_rectangle.arms_fassade_lower_name_2)
arms_fassade_upper_line = Curve(generic_officebuilding_h_shape_rectangle.arms_fassade_upper_line_2)
arms_fassade_upper_name = Text(generic_officebuilding_h_shape_rectangle.arms_fassade_upper_name_2)
courtyard_lower = Surface(generic_officebuilding_h_shape_rectangle.courtyard_lower_3)
boundary = Curve(generic_officebuilding_h_shape_rectangle.boundary_2)
courtyard_upper = Surface(generic_officebuilding_h_shape_rectangle.courtyard_upper_3)

list_22 = ValueList({"Windows": 0, "WindowBand": 1, "GlassFassade": 2}, selected="Windows")
basebody_wings_fassade_line = Curve(basebody_fassade_left_line)
basebody_wings_fassade_name = Text(basebody_fassade_right_name)
windowheight_7 = Number(Slider(2, range=0..10))
parapetheight_7 = Number(Slider(1.2, range=0..2))
windowwidth_7 = Number(Slider(2, range=0..10))
windowtowall_perimeter_7 = Number(Slider(0.79, range=0..1))
offsettosides_7 = Number(Slider(1, range=0..10))
windowtype_8 = Integer(list_22)
filter_60 = StreamFilter(Gate=filter_56, Stream0=windowwidth_7, Stream1=filter_52)
filter_61 = StreamFilter(Gate=filter_56, Stream0=parapetheight_7, Stream1=filter_53)
filter_62 = StreamFilter(Gate=filter_56, Stream0=windowheight_7, Stream1=filter_54)
filter_63 = StreamFilter(Gate=filter_56, Stream0=offsettosides_7, Stream1=filter_55)
filter_64 = StreamFilter(Gate=filter_56, Stream0=windowtowall_perimeter_7, Stream1=filter_57)
filter_65 = StreamFilter(Gate=filter_56, Stream0=windowtype_8, Stream1=filter_58)
windows = Windows(
    baseplane=baseplane_2,
    walls=basebody_wings_fassade_line,
    floorheight=floorheight_2,
    parapetheight=filter_61,
    windowheight=filter_62,
    windowwidth=filter_60,
    offsettosides=filter_63,
    constructionmethod=list_20,
    windowtowall_perimeter=filter_64,
    windowtype=filter_65)  # -> wall_2, windows_2, windowtowallratio_2, windowspointsonreferencecurve_2
trim_2 = TrimTree(Tree=windows.windows_2, Depth=1)
basebody_fassade_left_fassade_windows_re = Curve(trim_2)  # "BaseBody-Fassade-Left-Fassade-Windows-Rectangle"
basebody_wings_left_fassade_windowtowall = Number(windows.windowtowallratio_2)  # "BaseBody-Wings-Left-Fassade-WindowToWallRatio"

list_23 = ValueList({"Windows": 0, "WindowBand": 1, "GlassFassade": 2}, selected="Windows")
arms_fassade_left_name_2 = Text(arms_fassade_left_name)
arms_fassade_left_line_2 = Curve(arms_fassade_left_line)
windowheight_8 = Number(Slider(1.5, range=0..10))
parapetheight_8 = Number(Slider(0.9, range=0..2))
windowwidth_8 = Number(Slider(1.25, range=0..10))
windowtowall_perimeter_8 = Number(Slider(0.5, range=0..1))
offsettosides_8 = Number(Slider(1, range=0..10))
windowtype_9 = Integer(list_23)
filter_66 = StreamFilter(Gate=filter_50, Stream0=windowwidth_8, Stream1=filter_46)
filter_67 = StreamFilter(Gate=filter_50, Stream0=parapetheight_8, Stream1=filter_47)
filter_68 = StreamFilter(Gate=filter_50, Stream0=windowheight_8, Stream1=filter_48)
filter_69 = StreamFilter(Gate=filter_50, Stream0=offsettosides_8, Stream1=filter_49)
filter_70 = StreamFilter(Gate=filter_50, Stream0=windowtowall_perimeter_8, Stream1=filter_45)
filter_71 = StreamFilter(Gate=filter_50, Stream0=windowtype_9, Stream1=filter_51)
windows_2 = Windows(
    baseplane=baseplane_2,
    walls=arms_fassade_left_line_2,
    floorheight=floorheight_2,
    parapetheight=filter_67,
    windowheight=filter_68,
    windowwidth=filter_66,
    offsettosides=filter_69,
    constructionmethod=list_20,
    windowtowall_perimeter=filter_70,
    windowtype=filter_71)  # -> wall_2, windows_2, windowtowallratio_2, windowspointsonreferencecurve_2
trim_3 = TrimTree(Tree=windows_2.windows_2, Depth=1)
arms_fassade_left_windows_rectangle = Curve(trim_3)
arms_fassade_left_windowtowallratio = Number(windows_2.windowtowallratio_2)

basebody_fassade_lower_line_2 = Curve(basebody_fassade_lower_line)
basebody_fassade_lower_name_2 = Text(basebody_fassade_lower_name)
windowheight_9 = Number(Slider(1.5, range=0..10))
parapetheight_9 = Number(Slider(0.9, range=0..2))
windowwidth_9 = Number(Slider(1.5, range=0..10))
windowtowall_perimeter_9 = Number(Slider(0.4, range=0..1))
offsettosides_9 = Number(Slider(1, range=0..10))
filter_72 = StreamFilter(Gate=filter_31, Stream0=windowwidth_9, Stream1=filter_34)
filter_73 = StreamFilter(Gate=filter_31, Stream0=windowheight_9, Stream1=filter_36)
filter_74 = StreamFilter(Gate=filter_31, Stream0=parapetheight_9, Stream1=filter_35)
filter_75 = StreamFilter(Gate=filter_31, Stream0=windowtype_7, Stream1=filter_32)
filter_76 = StreamFilter(Gate=filter_31, Stream0=windowtowall_perimeter_9, Stream1=filter_33)
filter_77 = StreamFilter(Gate=filter_31, Stream0=offsettosides_9, Stream1=filter_37)
windows_3 = Windows(
    baseplane=baseplane_2,
    walls=basebody_fassade_lower_line_2,
    floorheight=floorheight_2,
    parapetheight=filter_74,
    windowheight=filter_73,
    windowwidth=filter_72,
    offsettosides=filter_77,
    constructionmethod=list_20,
    windowtowall_perimeter=filter_76,
    windowtype=filter_75)  # -> wall_2, windows_2, windowtowallratio_2, windowspointsonreferencecurve_2
trim_4 = TrimTree(Tree=windows_3.windows_2, Depth=1)
basebody_fassade_lower_windowtowallratio = Number(windows_3.windowtowallratio_2)
basebody_fassade_lower_windows_rectangle = Curve(trim_4)

list_24 = ValueList({"Windows": 0, "WindowBand": 1, "GlassFassade": 2}, selected="Windows")
basebody_fassade_upper_name_2 = Text(basebody_fassade_upper_name)
basebody_fassade_upper_line_2 = Curve(basebody_fassade_upper_line)
windowheight_10 = Number(Slider(2.3, range=0..10))
parapetheight_10 = Number(Slider(0.9, range=0..2))
windowwidth_10 = Number(Slider(2, range=0..10))
windowtowall_perimeter_10 = Number(Slider(0.68, range=0..1))
offsettosides_10 = Number(Slider(1, range=0..10))
windowtype_10 = Integer(list_24)
filter_78 = StreamFilter(Gate=filter_31, Stream0=windowwidth_10, Stream1=filter_34)
filter_79 = StreamFilter(Gate=filter_31, Stream0=parapetheight_10, Stream1=filter_35)
filter_80 = StreamFilter(Gate=filter_31, Stream0=windowheight_10, Stream1=filter_36)
filter_81 = StreamFilter(Gate=filter_31, Stream0=windowtowall_perimeter_10, Stream1=filter_33)
filter_82 = StreamFilter(Gate=filter_31, Stream0=offsettosides_10, Stream1=filter_37)
filter_83 = StreamFilter(Gate=filter_31, Stream0=windowtype_10, Stream1=filter_32)
windows_4 = Windows(
    baseplane=baseplane_2,
    walls=basebody_fassade_upper_line_2,
    floorheight=floorheight_2,
    parapetheight=filter_79,
    windowheight=filter_80,
    windowwidth=filter_78,
    offsettosides=filter_82,
    constructionmethod=list_20,
    windowtowall_perimeter=filter_81,
    windowtype=filter_83)  # -> wall_2, windows_2, windowtowallratio_2, windowspointsonreferencecurve_2
trim_5 = TrimTree(Tree=windows_4.windows_2, Depth=1)
basebody_fassade_upper_windows_rectangle = Curve(trim_5)
basebody_fassade_upper_windowtowallratio = Number(windows_4.windowtowallratio_2)

list_25 = ValueList({"Windows": 0, "WindowBand": 1, "GlassFassade": 2}, selected="Windows")
basebody_wings_fassade_line_2 = Curve(basebody_fassade_right_line)
basebody_wings_fassade_name_2 = Text(basebody_fassade_right_name)
windowheight_11 = Number(Slider(1.5, range=0..10))
parapetheight_11 = Number(Slider(0.9, range=0..2))
windowwidth_11 = Number(Slider(1.25, range=0..10))
windowtowall_perimeter_11 = Number(Slider(0.5, range=0..1))
offsettosides_11 = Number(Slider(1, range=0..10))
windowtype_11 = Integer(list_25)
filter_84 = StreamFilter(Gate=filter_56, Stream0=windowwidth_11, Stream1=filter_52)
filter_85 = StreamFilter(Gate=filter_56, Stream0=parapetheight_11, Stream1=filter_53)
filter_86 = StreamFilter(Gate=filter_56, Stream0=windowheight_11, Stream1=filter_54)
filter_87 = StreamFilter(Gate=filter_56, Stream0=windowtowall_perimeter_11, Stream1=filter_57)
filter_88 = StreamFilter(Gate=filter_56, Stream0=offsettosides_11, Stream1=filter_55)
filter_89 = StreamFilter(Gate=filter_56, Stream0=windowtype_11, Stream1=filter_58)
windows_5 = Windows(
    baseplane=baseplane_2,
    walls=basebody_wings_fassade_line_2,
    floorheight=floorheight_2,
    parapetheight=filter_85,
    windowheight=filter_86,
    windowwidth=filter_84,
    offsettosides=filter_88,
    constructionmethod=list_20,
    windowtowall_perimeter=filter_87,
    windowtype=filter_89)  # -> wall_2, windows_2, windowtowallratio_2, windowspointsonreferencecurve_2
trim_6 = TrimTree(Tree=windows_5.windows_2, Depth=1)
basebody_fassade_right_windows_rectangle = Curve(trim_6)
basebody_fassade_right_windowtowallratio = Number(windows_5.windowtowallratio_2)

list_26 = ValueList({"Windows": 0, "WindowBand": 1, "GlassFassade": 2}, selected="WindowBand")
arms_fassade_upper_name_2 = Text(arms_fassade_upper_name)
arms_fassade_upper_line_2 = Curve(arms_fassade_upper_line)
windowheight_12 = Number(Slider(2, range=0..10))
parapetheight_12 = Number(Slider(1.2, range=0..2))
windowwidth_12 = Number(Slider(2, range=0..10))
windowtowall_perimeter_12 = Number(Slider(0.68, range=0..1))
offsettosides_12 = Number(Slider(1, range=0..10))
windowtype_12 = Integer(list_26)
filter_90 = StreamFilter(Gate=filter_44, Stream0=parapetheight_12, Stream1=filter_41)
filter_91 = StreamFilter(Gate=filter_44, Stream0=windowheight_12, Stream1=filter_42)
filter_92 = StreamFilter(Gate=filter_44, Stream0=windowwidth_12, Stream1=filter_40)
filter_93 = StreamFilter(Gate=filter_44, Stream0=offsettosides_12, Stream1=filter_43)
filter_94 = StreamFilter(Gate=filter_44, Stream0=windowtowall_perimeter_12, Stream1=filter_39)
filter_95 = StreamFilter(Gate=filter_44, Stream0=windowtype_12, Stream1=filter_38)
windows_6 = Windows(
    baseplane=baseplane_2,
    walls=arms_fassade_upper_line_2,
    floorheight=floorheight_2,
    parapetheight=filter_90,
    windowheight=filter_91,
    windowwidth=filter_92,
    offsettosides=filter_93,
    constructionmethod=list_20,
    windowtowall_perimeter=filter_94,
    windowtype=filter_95)  # -> wall_2, windows_2, windowtowallratio_2, windowspointsonreferencecurve_2
trim_7 = TrimTree(Tree=windows_6.windows_2, Depth=1)
arms_fassade_upper_windows_rectangle = Curve(trim_7)
arms_fassade_upper_windowtowallratio = Number(windows_6.windowtowallratio_2)

list_27 = ValueList({"Windows": 0, "WindowBand": 1, "GlassFassade": 2}, selected="Windows")
arms_fassade_lower_name_2 = Text(arms_fassade_lower_name)
arms_fassade_lower_line_2 = Curve(arms_fassade_lower_line)
windowtowall_perimeter_13 = Number(Slider(0.54, range=0..1))
windowheight_13 = Number(Slider(1.5, range=0..10))
parapetheight_13 = Number(Slider(1.5, range=0..2))
windowwidth_13 = Number(Slider(1.25, range=0..10))
offsettosides_13 = Number(Slider(1, range=0..10))
windowtype_13 = Integer(list_27)
filter_96 = StreamFilter(Gate=filter_44, Stream0=windowwidth_13, Stream1=filter_40)
filter_97 = StreamFilter(Gate=filter_44, Stream0=parapetheight_13, Stream1=filter_41)
filter_98 = StreamFilter(Gate=filter_44, Stream0=windowheight_13, Stream1=filter_42)
filter_99 = StreamFilter(Gate=filter_44, Stream0=windowtowall_perimeter_13, Stream1=filter_39)
filter_100 = StreamFilter(Gate=filter_44, Stream0=offsettosides_13, Stream1=filter_43)
filter_101 = StreamFilter(Gate=filter_44, Stream0=windowtype_13, Stream1=filter_38)
windows_7 = Windows(
    baseplane=baseplane_2,
    walls=arms_fassade_lower_line_2,
    floorheight=floorheight_2,
    parapetheight=filter_97,
    windowheight=filter_98,
    windowwidth=filter_96,
    offsettosides=filter_100,
    constructionmethod=list_20,
    windowtowall_perimeter=filter_99,
    windowtype=filter_101)  # -> wall_2, windows_2, windowtowallratio_2, windowspointsonreferencecurve_2
trim_8 = TrimTree(Tree=windows_7.windows_2, Depth=1)
arms_fassade_lower_windows_rectangle = Curve(trim_8)
arms_fassade_lower_windowtowallratio = Number(windows_7.windowtowallratio_2)

trim_9 = TrimTree(Tree=basebody_zone_wings_boundary, Depth=1)
trim_10 = TrimTree(Tree=arms_boundary, Depth=1)
trim_11 = TrimTree(Tree=basebody_center_zones_boundary, Depth=1)
amp_7 = Amplitude(Vector=zvec, Amplitude=floorheight_2)
trim_12 = TrimTree(Tree=trim_10, Depth=1)
boundary_2 = BoundarySurfaces(Edges=trim_9)
item_9 = ListItem(List=trim_9, Index=0, Wrap=True)  # -> Item, Item1
item_10 = ListItem(List=trim_12, Index=0, Wrap=True)  # -> Item, Item1, Item2, Item3
item_11 = ListItem(List=trim_11, Index=0, Wrap=True)  # -> Item, Item1
mrg_a = MergeSeperatlyAppend(
    x=basebody_core_boundary,
    v=item_11.Item,
    y=item_11.Item1,
    z=item_9.Item,
    u=item_9.Item1,
    w=item_10.Item,
    s=item_10.Item1,
    t=item_10.Item3,
    xx=item_10.Item2)  # -> Mrgd; inputs x: tree, v: tree, y: tree, z: tree, u: tree, w: tree, s: tree, t: tree, xx: tree; same code as mrg_a
boundary_3 = BoundarySurfaces(Edges=mrg_a)
trim_13 = TrimTree(Tree=boundary_3, Depth=1)
extr = Extrude(Base=trim_13, Direction=amp_7)  # -> graft(Extrusion)
zones_boundary = Curve(mrg_a)
zones_volume = Brep(extr)

trim_14 = TrimTree(Tree=arms_name, Depth=1)
trim_15 = TrimTree(Tree=basebody_zone_wings_name, Depth=1)
trim_16 = TrimTree(Tree=trim_14, Depth=1)
trim_17 = TrimTree(Tree=basebody_center_zones_name, Depth=1)
item_12 = ListItem(List=trim_16, Index=0, Wrap=True)  # -> Item, Item1, Item2, Item3
item_13 = ListItem(List=trim_17, Index=0, Wrap=True)  # -> Item, Item1
item_14 = ListItem(List=trim_15, Index=0, Wrap=True)  # -> Item, Item1
trim_18 = TrimTree(Tree=basebody_core_name, Depth=1)
mrg_a_2 = MergeSeperatlyAppend(
    x=trim_18,
    v=item_13.Item,
    y=item_13.Item1,
    z=item_14.Item,
    u=item_14.Item1,
    w=item_12.Item,
    s=item_12.Item1,
    t=item_12.Item3,
    xx=item_12.Item2)  # -> Mrgd; inputs x: tree, v: tree, y: tree, z: tree, u: tree, w: tree, s: tree, t: tree, xx: tree; same code as mrg_a
zones_name = Text(mrg_a_2)

merge_4 = Merge(
    Data1=generic_officebuilding_h_shape_rectangle.basebody_center_internal_walls_2,
    Data2=generic_officebuilding_h_shape_rectangle.arm_lower_intneral_walls_3)
internal_walls = Curve(merge_4)

tstat_2 = TreeStatistics(Tree=trim_2)  # -> Paths, Length, Count
series_2 = Series(Start="1", Step=1, Count=tstat_2.Length)
concat_12 = Concatenate(
    FragmentC=basebody_wings_fassade_name,
    FragmentA=namingschema_delimiter,
    FragmentD=namingschema_window_name,
    FragmentE=namingschema_delimiter,
    FragmentB=series_2)
match_4 = MatchTree(Tree=concat_12, Guide=trim_2)
basebody_wings_left_fassade_windows_name = Text(match_4)

tstat_3 = TreeStatistics(Tree=trim_6)  # -> Paths, Length, Count
series_3 = Series(Start="1", Step=1, Count=tstat_3.Length)
concat_13 = Concatenate(
    FragmentC=basebody_wings_fassade_name_2,
    FragmentA=namingschema_delimiter,
    FragmentD=namingschema_window_name,
    FragmentE=namingschema_delimiter,
    FragmentB=series_3)
match_5 = MatchTree(Tree=concat_13, Guide=trim_6)
basebody_fassade_right_windows_name = Text(match_5)

tstat_4 = TreeStatistics(Tree=trim_7)  # -> Paths, Length, Count
series_4 = Series(Start="1", Step=1, Count=tstat_4.Length)
concat_14 = Concatenate(
    FragmentC=arms_fassade_upper_name_2,
    FragmentA=namingschema_delimiter,
    FragmentD=namingschema_window_name,
    FragmentE=namingschema_delimiter,
    FragmentB=series_4)
match_6 = MatchTree(Tree=concat_14, Guide=trim_7)
arms_fassade_upper_windows_name = Text(match_6)

tstat_5 = TreeStatistics(Tree=trim_8)  # -> Paths, Length, Count
series_5 = Series(Start="1", Step=1, Count=tstat_5.Length)
concat_15 = Concatenate(
    FragmentC=arms_fassade_lower_name_2,
    FragmentA=namingschema_delimiter,
    FragmentD=namingschema_window_name,
    FragmentE=namingschema_delimiter,
    FragmentB=series_5)
match_7 = MatchTree(Tree=concat_15, Guide=trim_8)
arms_fassade_lower_windows_name = Text(match_7)

tstat_6 = TreeStatistics(Tree=trim_5)  # -> Paths, Length, Count
series_6 = Series(Start="1", Step=1, Count=tstat_6.Length)
concat_16 = Concatenate(
    FragmentC=basebody_fassade_upper_name_2,
    FragmentA=namingschema_delimiter,
    FragmentD=namingschema_window_name,
    FragmentE=namingschema_delimiter,
    FragmentB=series_6)
match_8 = MatchTree(Tree=concat_16, Guide=trim_5)
basebody_fassade_upper_windows_name = Text(match_8)

tstat_7 = TreeStatistics(Tree=trim_4)  # -> Paths, Length, Count
series_7 = Series(Start="1", Step=1, Count=tstat_7.Length)
concat_17 = Concatenate(
    FragmentC=basebody_fassade_lower_name_2,
    FragmentA=namingschema_delimiter,
    FragmentD=namingschema_window_name,
    FragmentE=namingschema_delimiter,
    FragmentB=series_7)
match_9 = MatchTree(Tree=concat_17, Guide=trim_4)
basebody_fassade_lower_windows_name = Text(match_9)

list_28 = ValueList({"Windows": 0, "WindowBand": 1, "GlassFassade": 2}, selected="Windows")
arms_fassade_right_line_2 = Curve(arms_fassade_right_line)
arms_fassade_right_name_2 = Text(arms_fassade_right_name)
windowheight_14 = Number(Slider(2, range=0..10))
windowtype_14 = Integer(list_28)
parapetheight_14 = Number(Slider(1.2, range=0..2))
windowtowall_perimeter_14 = Number(Slider(0.68, range=0..1))
windowwidth_14 = Number(Slider(2, range=0..10))
offsettosides_14 = Number(Slider(1, range=0..10))
filter_102 = StreamFilter(Gate=filter_50, Stream0=windowheight_14, Stream1=filter_48)
filter_103 = StreamFilter(Gate=filter_50, Stream0=windowwidth_14, Stream1=filter_46)
filter_104 = StreamFilter(Gate=filter_50, Stream0=offsettosides_14, Stream1=filter_49)
filter_105 = StreamFilter(Gate=filter_50, Stream0=windowtowall_perimeter_14, Stream1=filter_45)
filter_106 = StreamFilter(Gate=filter_50, Stream0=windowtype_14, Stream1=filter_51)

filter_107 = StreamFilter(Gate=filter_50, Stream0=parapetheight_14, Stream1=filter_47)

windows_8 = Windows(
    baseplane=baseplane_2,
    walls=arms_fassade_right_line_2,
    floorheight=floorheight_2,
    parapetheight=filter_107,
    windowheight=filter_102,
    windowwidth=filter_103,
    offsettosides=filter_104,
    constructionmethod=list_20,
    windowtowall_perimeter=filter_105,
    windowtype=filter_106)  # -> wall_2, windows_2, windowtowallratio_2, windowspointsonreferencecurve_2
trim_19 = TrimTree(Tree=windows_8.windows_2, Depth=1)
arms_fassade_right_windows_rectangle = Curve(trim_19)
arms_fassade_right_windowtowallratio = Number(windows_8.windowtowallratio_2)

tstat_8 = TreeStatistics(Tree=trim_19)  # -> Paths, Length, Count
series_8 = Series(Start="1", Step=1, Count=tstat_8.Length)
concat_18 = Concatenate(
    FragmentC=arms_fassade_right_name_2,
    FragmentA=namingschema_delimiter,
    FragmentD=namingschema_window_name,
    FragmentE=namingschema_delimiter,
    FragmentB=series_8)
match_10 = MatchTree(Tree=concat_18, Guide=trim_19)
arms_fassade_right_windows_name = Text(match_10)

tstat_9 = TreeStatistics(Tree=trim_3)  # -> Paths, Length, Count
series_9 = Series(Start="1", Step=1, Count=tstat_9.Length)

match_11 = MatchTree(Tree=series_9, Guide=trim_3)

concat_19 = Concatenate(
    FragmentC=arms_fassade_left_name_2,
    FragmentA=namingschema_delimiter,
    FragmentD=namingschema_window_name,
    FragmentE=namingschema_delimiter,
    FragmentB=match_11)
match_12 = MatchTree(Tree=concat_19, Guide=trim_3)
arms_fassade_left_windows_name = Text(match_12)

trim_20 = TrimTree(Tree=basebody_fassade_lower_windowtowallratio, Depth=1)
trim_21 = TrimTree(Tree=basebody_fassade_lower_windows_name, Depth=1)
trim_22 = TrimTree(Tree=basebody_fassade_lower_windows_rectangle, Depth=1)
trim_23 = TrimTree(Tree=basebody_fassade_right_windowtowallratio, Depth=1)
trim_24 = TrimTree(Tree=basebody_fassade_upper_windowtowallratio, Depth=1)
trim_25 = TrimTree(Tree=basebody_fassade_upper_windows_rectangle, Depth=1)
trim_26 = TrimTree(Tree=basebody_fassade_upper_windows_name, Depth=1)
trim_27 = TrimTree(Tree=basebody_fassade_right_windows_rectangle, Depth=1)
trim_28 = TrimTree(Tree=basebody_fassade_right_windows_name, Depth=1)
trim_29 = TrimTree(Tree=basebody_wings_left_fassade_windowtowall, Depth=1)
trim_30 = TrimTree(Tree=basebody_fassade_left_fassade_windows_re, Depth=1)
trim_31 = TrimTree(Tree=basebody_wings_left_fassade_windows_name, Depth=1)
merge_5 = Merge(Data1=arms_fassade_lower_windows_rectangle, Data2=arms_fassade_upper_windows_rectangle)
merge_6 = Merge(Data1=arms_fassade_lower_windowtowallratio, Data2=arms_fassade_upper_windowtowallratio)
merge_7 = Merge(Data1=arms_fassade_lower_windows_name, Data2=arms_fassade_upper_windows_name)
merge_8 = Merge(Data1=arms_fassade_right_windowtowallratio, Data2=merge_6, Data3=arms_fassade_left_windowtowallratio)
merge_9 = Merge(Data1=arms_fassade_right_windows_rectangle, Data2=merge_5, Data3=arms_fassade_left_windows_rectangle)
merge_10 = Merge(Data1=arms_fassade_right_windows_name, Data2=merge_7, Data3=arms_fassade_left_windows_name)
mrg_a_3 = MergeSeperatlyAppend(y=trim_22, z=trim_25, u=trim_27, v=trim_30)  # -> Mrgd; inputs x: tree, y: tree, z: tree, u: tree, v: tree, w: tree, s: tree, t: tree, xx: tree, xy: tree; same code as mrg_a
mrg_a_4 = MergeSeperatlyAppend(y=trim_20, z=trim_24, u=trim_23, v=trim_29)  # -> Mrgd; inputs x: tree, y: tree, z: tree, u: tree, v: tree, w: tree, s: tree, t: tree, xx: tree, xy: tree; same code as mrg_a
mrg_a_5 = MergeSeperatlyAppend(y=trim_21, z=trim_26, u=trim_28, v=trim_31)  # -> Mrgd; inputs x: tree, y: tree, z: tree, u: tree, v: tree, w: tree, s: tree, t: tree, xx: tree, xy: tree; same code as mrg_a
adjusttree = AdjustTree(arm_data=merge_8)
adjusttree_2 = AdjustTree(arm_data=merge_10)
adjusttree_3 = AdjustTree(arm_data=merge_9)
arms_fassades_windows_rectangle = Curve(adjusttree_3)
arms_fassades_windows_name = Text(adjusttree_2)
arms_fassade_windowtowallratio = Number(adjusttree)
merge_11 = Merge(Data1=mrg_a_4, Data2=arms_fassade_windowtowallratio)
merge_12 = Merge(Data1=mrg_a_3, Data2=arms_fassades_windows_rectangle)
merge_13 = Merge(Data1=mrg_a_5, Data2=arms_fassades_windows_name)
arms_fassade_windowtowallratio_2 = Number(merge_11)
zones_windows_rectangle = Curve(merge_12)
zones_windows_name = Text(merge_13)

floor_count_underground = Number(Slider(1, range=0..10))
numberoffloors_2 = Number(numberoffloors)
courtyard_lower_2 = Surface(courtyard_lower)
courtyard_upper_2 = Surface(courtyard_upper)
floorplantobuilding = FloorPlanToBuilding(
    baseplane=baseplane,
    numberoffloors=numberoffloors_2,
    floor_count_underground=floor_count_underground,
    floorheight=floorheight_2,
    courtyard_upper=courtyard_upper_2,
    courtyard_lower=courtyard_lower_2,
    zones_box=zones_volume,
    zones_name=zones_name,
    windows_rectangle=zones_windows_rectangle,
    windows_name=zones_windows_name,
    namingschema_floor_name="Floor",
    namingschema_underground_name="Underground",
    namingschema_fassade_name="Fassade",
    namingschema_roof_name="Roof",
    namingschema_delimiter=namingschema_delimiter)  # -> zones_allflors_2, zones_allflors_name_2, windows_allfloors_rectangle_2, windows_allfloors_name_2, zones_underground_2, zones_underground_name_2, courtyard_upper_volume_2, courtyard_lower_volume_2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
windows_name = Text(floorplantobuilding.windows_allfloors_name_2)
courtyard_upper_volume = Brep(floorplantobuilding.courtyard_upper_volume_2)
zones_name_2 = Text(floorplantobuilding.zones_allflors_name_2)
windows_9 = Brep(floorplantobuilding.windows_allfloors_rectangle_2)
zones_underground = Brep(floorplantobuilding.zones_underground_2)
zones_underground_name = Text(floorplantobuilding.zones_underground_name_2)
courtyard_lower_volume = Brep(floorplantobuilding.courtyard_lower_volume_2)
courtyard_upper_fassade = Surface(floorplantobuilding.courtyard_upper_fassade_2)
courtyard_lower_fassade = Surface(floorplantobuilding.courtyard_lower_fassade_2)
courtyard_upper_roof = Surface(floorplantobuilding.courtyard_upper_roof_2)
courtyard_lower_roof = Surface(floorplantobuilding.courtyard_lower_roof_2)
zones = Brep(floorplantobuilding.zones_allflors_2)

trim_32 = TrimTree(Tree=arms_fassade_lower_windowtowallratio, Depth=1)
trim_33 = TrimTree(Tree=arms_fassade_right_windowtowallratio, Depth=1)
trim_34 = TrimTree(Tree=arms_fassade_left_windowtowallratio, Depth=1)
trim_35 = TrimTree(Tree=arms_fassade_upper_windowtowallratio, Depth=1)
trim_36 = TrimTree(Tree=trim_32, Depth=1)
trim_37 = TrimTree(Tree=trim_33, Depth=1)
trim_38 = TrimTree(Tree=trim_34, Depth=1)
trim_39 = TrimTree(Tree=trim_35, Depth=1)
number_slider_17 = Slider(2, range=0..10)
merge_14 = Merge(Data1=trim_20, Data2=trim_36)
merge_15 = Merge(Data1=trim_23, Data2=trim_37)
merge_16 = Merge(Data1=trim_29, Data2=trim_38)
merge_17 = Merge(Data1=trim_24, Data2=trim_39)
trim_40 = TrimTree(Tree=arms_fassade_windowtowallratio_2, Depth=1)
avr = Average(Input=trim_40)
avr_2 = Average(Input=merge_14)
avr_3 = Average(Input=merge_15)
avr_4 = Average(Input=merge_16)
avr_5 = Average(Input=merge_17)
building_fassade_upper_windowtowallratio = Number(avr_5)
building_fassade_windowtowallratio = Number(avr)
building_fassade_lower_windowtowallratio = Number(avr_2)
building_fassade_right_windowtowallratio = Number(avr_3)
building_fassade_left_windowtowallratio = Number(avr_4)
roundd = RoundToDecimalPlace(NumberX=avr_5, DecimalPlace=number_slider_17, RoundType=0)  # -> Rounded, Difference
roundd_2 = RoundToDecimalPlace(NumberX=avr, DecimalPlace=number_slider_17, RoundType=0)  # -> Rounded, Difference
roundd_3 = RoundToDecimalPlace(NumberX=avr_2, DecimalPlace=number_slider_17, RoundType=0)  # -> Rounded, Difference
roundd_4 = RoundToDecimalPlace(NumberX=avr_3, DecimalPlace=number_slider_17, RoundType=0)  # -> Rounded, Difference
roundd_5 = RoundToDecimalPlace(NumberX=avr_4, DecimalPlace=number_slider_17, RoundType=0)  # -> Rounded, Difference
building_fassade_upper_windowtowallratio_2 = Number(roundd.Rounded)
building_fassade_windowtowallratio_2 = Number(roundd_2.Rounded)
building_fassade_lower_windowtowallratio_2 = Number(roundd_3.Rounded)
building_fassade_right_windowtowallratio_2 = Number(roundd_4.Rounded)
building_fassade_left_windowtowallratio_2 = Number(roundd_5.Rounded)

building_fassade_left_windowtowallratio_3 = Panel(building_fassade_left_windowtowallratio_2)
building_fassade_windowtowallratio_3 = Panel(building_fassade_windowtowallratio_2)
building_fassade_upper_windowtowallratio_3 = Panel(building_fassade_upper_windowtowallratio_2)
building_fassade_lower_windowtowallratio_3 = Panel(building_fassade_lower_windowtowallratio_2)
building_fassade_right_windowtowallratio_3 = Panel(building_fassade_right_windowtowallratio_2)

context_bake = ContextBake(Geometry=zones)
context_bake_2 = ContextBake(ZonesName=zones_name_2)
context_bake_3 = ContextBake(Geometry=windows_9)
context_bake_4 = ContextBake(WindowsName=windows_name)
context_bake_5 = ContextBake(Zones_Underground=zones_underground)
context_bake_6 = ContextBake(ZonesUndergroundName=zones_underground_name)
context_bake_7 = ContextBake(Courtyard_Upper_Volume=courtyard_upper_volume)
context_bake_8 = ContextBake(Courtyard_Lower_Volume=courtyard_lower_volume)
context_bake_9 = ContextBake(Courtyard_Upper_Fassade=courtyard_upper_fassade)
context_bake_10 = ContextBake(Courtyard_Upper_Fassade=courtyard_lower_fassade)
context_bake_11 = ContextBake(Courtyard_Upper_Roof=courtyard_upper_roof)
context_bake_12 = ContextBake(Courtyard_Lower_Roof=courtyard_lower_roof)
windows_10 = Brep(windows_9)
courtyard_upper_fassade_2 = Surface(courtyard_upper_fassade)
courtyard_lower_roof_2 = Surface(courtyard_lower_roof)
zones_name_3 = Text(zones_name_2)
windows_name_2 = Text(windows_name)
zones_underground_2 = Brep(zones_underground)
zones_underground_name_2 = Text(zones_underground_name)
courtyard_lower_volume_2 = Brep(courtyard_upper_volume)
courtyard_lower_volume_3 = Brep(courtyard_lower_volume)
courtyard_lower_fassade_2 = Surface(courtyard_lower_fassade)
courtyard_upper_roof_2 = Surface(courtyard_upper_roof)
zones_2 = Brep(zones)

viewer = ParamViewer(zones_2)
viewer_2 = ParamViewer(zones_2)
viewer_3 = ParamViewer(zones_2)

expression_2 = Expression(x=numberoffloors_2, y=match, Expression="x")
merge_18 = Merge(Data1="NoF", Data2="WWR-N", Data3="WWR-E", Data4="WWR-S", Data5="WWR-W")
merge_19 = Merge(Data1="Prog", Data2="Constr", Data3="Schedules")
merge_20 = Merge()
merge_21 = Merge(
    Data1=expression_2,
    Data2=building_fassade_upper_windowtowallratio_2,
    Data3=building_fassade_right_windowtowallratio_2,
    Data4=building_fassade_lower_windowtowallratio_2,
    Data5=building_fassade_left_windowtowallratio_2)
expression_3 = Expression(x=merge_18, y=match, Expression="x")
expression_4 = Expression(x=merge_20, y=match, Expression="x")
expression_5 = Expression(x=merge_19, y=match, Expression="x")
cluster = Cluster(
    prefix=match,
    variable_number_name=expression_3,
    variable_number_value=merge_21,
    variable_bool_name=expression_5,
    variable_bool_value=expression_4,
    namingschema_delimiter_parameter=namingschema_delimiter_parameter_primary,
    namingschema_delimiter_assign=namingschema_delimiter_assign,
    namingschema_delimiter_decimal=namingschema_delimiter_decimal,
    namingschema_true_name=namingschema_true_name,
    namingschema_false_name=namingschema_false_name)  # -> joinedtext_2, variables_value_bool_2, variables_value_2, variables_bool_3
model_name = Text(cluster.joinedtext_2)

model_name_2 = Text(model_name)
zones_3 = Brep(zones_2)
zones_name_4 = Text(zones_name_3)
windows_11 = Brep(windows_10)
windows_name_3 = Text(windows_name_2)
zones_underground_3 = Brep(zones_underground_2)
zones_underground_name_3 = Text(zones_underground_name_2)
courtyard_lower_volume_4 = Brep(courtyard_lower_volume_2)
courtyard_lower_volume_5 = Brep(courtyard_lower_volume_3)
courtyard_upper_fassade_3 = Surface(courtyard_upper_fassade_2)
courtyard_lower_fassade_3 = Surface(courtyard_lower_fassade_2)
courtyard_upper_roof_3 = Surface(courtyard_upper_roof_2)
courtyard_lower_roof_3 = Surface(courtyard_lower_roof_2)

panel_31 = Panel("office")
searchprog = HBSearchPrograms(bldg_prog="MediumOffice", vintage="2019")  # -> room_prog; plug-in component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
item_15 = ListItem(List=searchprog, Index=Slider(11, range=0..20), Wrap=True)
item_16 = ListItem(List=searchprog, Index=Slider(10, range=0..20), Wrap=True)
item_17 = ListItem(List=searchprog, Index=Slider(6, range=0..20), Wrap=True)
mrg_a_6 = MergeSeperatlyAppend(x=item_16, y=item_15, z=item_15, u=item_17, v=item_15)  # -> Mrgd; inputs x: tree, y: tree, z: tree, u: tree, v: tree; same code as mrg_a
trim_41 = TrimTree(Tree=zones_underground_name_3, Depth=1)
match_13 = MatchTree(Tree=mrg_a_6, Guide=trim_41)
expression_6 = Expression(x=match_13, y=trim_41, Expression="x")
programs_name_underground = Text(expression_6)
zones_name_underground = Text(trim_41)

searchprog_2 = HBSearchPrograms(bldg_prog="MediumOffice", vintage="2019")  # -> room_prog; plug-in component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
item_18 = ListItem(List=searchprog_2, Index=Slider(8, range=0..20), Wrap=True)
item_19 = ListItem(List=searchprog_2, Index=Slider(3, range=0..20), Wrap=True)
item_20 = ListItem(List=searchprog_2, Index=Slider(10, range=0..20), Wrap=True)
mrg_a_7 = MergeSeperatlyAppend(x=item_20, y=item_18, z=item_18, u=item_18, v=item_18, w=item_19, s=item_18, t=item_19, xx=item_18)  # -> Mrgd; inputs x: tree, y: tree, z: tree, u: tree, v: tree, w: tree, s: tree, t: tree, xx: tree; same code as mrg_a
trim_42 = TrimTree(Tree=zones_name_4, Depth=1)
match_14 = MatchTree(Tree=mrg_a_7, Guide=trim_42)
expression_7 = Expression(x=match_14, y=trim_42, Expression="x")
zones_name_5 = Text(trim_42)
programs_name = Text(expression_7)

deconstrprogram = HBDeconstructProgramType(program=item_15)  # -> people, lighting, electric_equip, gas_equip, hot_water, infiltration, ventilation, setpoint; plug-in component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
panel_33 = Panel(deconstrprogram.people)
zones_name_6 = Text(zones_name_3)
panel_34 = Panel(zones_name_6)
item_21 = ListItem(List=flatten(model_name), Index=0, Wrap=True)
name = Panel(cluster.variables_value_bool_2)
name_2 = Panel(item_21)
zonenode_2 = ZoneNode(Name=zones_name_6, AreaHVAC=Slider(0, range=0..100))
merge_22 = Merge(Data1=zonenode_2, Data2=zonenode)  # -> flatten(Result)

zones_4 = Brep(zones_2)
zones_name_7 = Text(zones_name_3)
windows_12 = Brep(windows_10)
windows_name_4 = Text(windows_name_2)
zones_underground_4 = Brep(zones_underground_2)
zones_underground_name_4 = Text(zones_underground_name_2)
courtyard_lower_volume_6 = Brep(courtyard_lower_volume_2)
courtyard_lower_volume_7 = Brep(courtyard_lower_volume_3)
courtyard_upper_fassade_4 = Surface(courtyard_upper_fassade_2)
courtyard_lower_fassade_4 = Surface(courtyard_lower_fassade_2)
courtyard_upper_roof_4 = Surface(courtyard_upper_roof_2)
courtyard_lower_roof_4 = Surface(courtyard_lower_roof_2)
boundary_4 = Curve(generic_officebuilding_h_shape_rectangle.boundary_2)
courtyard_lower_3 = Surface(generic_officebuilding_h_shape_rectangle.courtyard_lower_3)
courtyard_upper_3 = Surface(generic_officebuilding_h_shape_rectangle.courtyard_upper_3)
bbox = BoundingBox(Content=zones_4, Plane=PlaneXY(0, 0, 0), UnionBox=True)  # -> Box, Box_2
genes_6 = GenePool(Decimals=1, Maximum=10, Minimum=0, Value=[1.8, 3.7])
merge_23 = Merge(Data1=courtyard_upper_3, Data2=courtyard_lower_3)
wires = BrepWireframe(Brep=zones_4, Density=-1)  # disabled
wires_2 = BrepWireframe(Brep=windows_12, Density=-1)  # disabled
wires_3 = BrepWireframe(Brep=zones_underground_4, Density=-1)  # disabled
volume = Volume(Geometry=flatten(bbox.Box))  # -> Volume, Centroid
scale = Scale(Geometry=flatten(windows_12), Center=volume.Centroid, Factor=Slider(0.999, range=0..10))  # -> Geometry, Transform
scale_2 = Scale(Geometry=flatten(windows_12), Center=volume.Centroid, Factor=Slider(1.001, range=0..10))  # -> Geometry, Transform
dash = DashPattern(Curve=wires_3, Pattern=genes_6)  # -> Dashes, Gaps; disabled
merge_24 = Merge(Data1=scale_2.Geometry, Data2=scale.Geometry)
preview = CustomPreview(Geometry=flatten(wires), Material=ColourSwatch(SwatchColor=RGB(191, 216, 255)))
preview_2 = CustomPreview(Geometry=flatten(merge_24), Material=ColourSwatch(SwatchColor=RGB(0, 166, 157)))
preview_3 = CustomPreview(Geometry=flatten(zones_4), Material=swatch_2)
preview_4 = CustomPreview(Geometry=flatten(merge_23), Material=swatch_2)
preview_5 = CustomPreview(Geometry=flatten(zones_underground_4), Material=ColourSwatch(SwatchColor=RGBA(240, 117, 24, 12)))

# ---- group: Viewort and Background
merge_25 = Merge(Data1=zones_4, Data2=zones_underground_4)
xy = XYPlane(Origin=Point(0, 0, 0))
geo = Geometry(merge_25)
wallpaperpath_2 = FilePath(wallpaperpath)
bbox_2 = BoundingBox(Content=flatten(geo), Plane=xy, UnionBox=True)  # -> Box, Box_2
newviewportwallpaper = PythonScript(Active=Toggle(True), Name="WallPaper", WallPaperPath=wallpaperpath_2)  # -> Complete
# ---------- newviewportwallpaper: Python ----------
import System as sy
import Rhino as rc
import scriptcontext as sc

def newViewportWallPaper(name,wallPaperPath):
    vp = rc.RhinoDoc.ActiveDoc.Views.Find(name, False)
    if vp:
        vp.Close()
    bmp = sy.Drawing.Bitmap.FromFile(wallPaperPath)
    resWidth = bmp.Width
    resHeight = bmp.Height
    newView = rc.RhinoDoc.ActiveDoc.Views.Add(name,rc.Display.DefinedViewportProjection.Perspective,sy.Drawing.Rectangle(0,0,resWidth+16,resHeight+39),True)
    #The width has by default resWidth+16,resHeight+39 wrong. Why?
    newView.ActiveViewport.SetWallpaper(wallPaperPath,False)
    return True

if Active == True:
    Complete = newViewportWallPaper(Name,WallPaperPath)
if Active == False:
    vp = rc.RhinoDoc.ActiveDoc.Views.Find(Name, False)
    if vp:
        vp.Close()
# ---------- end newviewportwallpaper ----------
number_slider_18 = Slider(2, range=0..2)
Z = UnitZ(Factor=Slider(1, range=-10..10))  # -> expr("-x", UnitVector)
zoom_factor_2 = Number(zoom_factor)
volume_2 = Volume(Geometry=bbox_2.Box)  # -> Volume, Centroid
X = UnitX(Factor=Slider(2, range=0..10))
Y = UnitY(Factor=Slider(4, range=0..10))
scale_3 = Scale(Geometry=bbox_2.Box, Center=volume_2.Centroid, Factor=zoom_factor_2)  # -> Geometry, Transform
addition_2 = Addition(A=X, B=Y, C=Z)
set_view_to_bounding_box = PythonScript(
    Run=newviewportwallpaper,
    VpName="WallPaper",
    camera_dir=addition_2,
    lens_length=Slider(48, range=0..100),
    BoundingBox=scale_3.Geometry,
    Plane=xy,
    Art=number_slider_18)  # -> Complete
# ---------- set_view_to_bounding_box: Python ----------
import scriptcontext as sc
import Rhino as rc
import time

sc.doc.Views.ActiveView.ActiveViewport
def setViewToBB(viewMode,boundingBox,vpName="Perspective",cameraDir =rc.Geometry.Vector3d(1,1,-1),lensLength = float(55),worldPlane =rc.Geometry.Plane(1,1,0,0)):
    view = rc.RhinoDoc.ActiveDoc.Views.Find(vpName, False)
    vp = view.ActiveViewport
    vp.WorldAxesVisible = False
    vp.ConstructionAxesVisible = False
    vp.ConstructionGridVisible = False
    if viewMode == 0: #viewMode=0 is plan view,1=parallel view,2=perspektive view
        vp.SetToPlanView(boundingBox.Center,worldPlane.XAxis,worldPlane.YAxis,False)
    elif viewMode == 1:
        vp.ChangeToParallelProjection(True)
        vp.SetCameraDirection(cameraDir,False)
    elif viewMode == 2:
        vp.ChangeToPerspectiveProjection(True,lensLength)
        vp.SetCameraDirection(cameraDir,False)
        vp.Camera35mmLensLength = lensLength
    vp.ZoomBoundingBox(boundingBox.BoundingBox)
    return True

if Run == True:
    #time.sleep(0.5)
    if VpName:
        Complete = setViewToBB(Art,BoundingBox,VpName,camera_dir,lens_length,Plane)
    else:
        Complete = setViewToBB(Art,BoundingBox,cameraDir=camera_dir,lensLength=lens_length,worldPlane=Plane)
# ---------- end set_view_to_bounding_box ----------

# ----
item_22 = ListItem(List=flatten(merge_24), Index=0, Wrap=True)
expression_8 = Expression(x=item_22, Expression="True")
concat_20 = Concatenate(FragmentA=folder_base_path_images, FragmentB="\", FragmentC=iteration_name, FragmentD=".png")
and_3 = GateAnd(A=number_slider_18, B=expression_8)
path = FilePath(folder_base_path_images)
path_2 = FilePath(concat_20)
python_2 = PythonScript(Run=and_3, FilePath=path, FileName=path_2, Sleep=Slider(0, range=0..1000), ScaleFactor=Slider(3, range=0..10))  # -> out, a
# ---------- python_2: Python ----------
import scriptcontext as sc
import Rhino as rc
import System as sy
import time

def viewCaptureToFile(filePath,fileName, viewportName="Perspective",scaleFactor=1):
    RhinoDocument = rc.RhinoDoc.ActiveDoc
    view = RhinoDocument.Views.Find(viewportName, False)
    vp = view.MainViewport
    if view:
        size = sy.Drawing.Size(vp.Size.Width*scaleFactor,vp.Size.Height*scaleFactor)
        #folder = sy.Environment.SpecialFolder.Desktop
        #path = sy.Environment.GetFolderPath(folder)
        #filename = sy.IO.Path.Combine(path, "SampleViewCaptureToFile.png")
        bitmap =view.CaptureToBitmap(size,False,False,False)
        bitmap.Save(fileName, sy.Drawing.Imaging.ImageFormat.Png)


if Run == True:
    time.sleep(Sleep/1000)
    viewCaptureToFile(FilePath,FileName,"WallPaper",ScaleFactor)
# ---------- end python_2 ----------

toggle_2 = BooleanToggle(False)
simoutput = HBSimulationOutput(
    zone_energy_use=toggle_2,
    hvac_energy_use=toggle_2,
    gains_and_losses=toggle_2,
    comfort_metrics=toggle_2,
    surface_temperature=toggle_2,
    surface_energy_flow=toggle_2,
    load_type=toggle_2)  # -> report, sim_output; plug-in component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
toggle_3 = BooleanToggle(False)
merge_26 = Merge(Data1="Annual Thermal Resilience Summary")
simcontrol = HBSimulationControl(
    do_zone_sizing=toggle_3,
    do_system_sizing=toggle_3,
    do_plant_sizing=toggle_3,
    for_sizing_period=toggle_3,
    for_run_period=Toggle(True))  # -> sim_control; plug-in component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
shadowcalc = HBShadowCalculation(solar_dist=Slider(0, range=0..100), update_method="Timestep", frequency=Slider(1, range=0..1))  # -> shadow_calc; plug-in component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
customoutput = HBCustomSimulationOutput(base_sim_output=simoutput.sim_output, summary_reports=merge_26)  # -> report, sim_output; plug-in component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
simpar = HBSimulationParameter(output=customoutput.sim_output, timestep=Slider(1, range=0..1), sim_control=simcontrol, shadow_calc=shadowcalc)  # -> sim_par; plug-in component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
run_simulation_2 = Boolean(run_simulation)
weather_file_path_2 = Text(weather_file_path)
and_4 = GateAnd(A=run_simulation_2, B=run_solver)

expression_9 = Expression(x=and_4, Expression="If(x=True,3,0)")

shading_4 = Text(shading_2)
filter_108 = StreamFilter(Gate=shading_4, Stream0=Slider(0.5, range=0..1), Stream1=Slider(0.25, range=0..1))
windows_name_5 = Text(windows_name_2)
windows_13 = Brep(windows_10)
window_solarheatgaincoefficient = Number(filter_108)
window_u_value = Number(item_5)
windowmat = HBWindowMaterial(name="Theoretical-WindowMaterial_EnergyStandardCompliant", u_factor=window_u_value, shgc=window_solarheatgaincoefficient)  # -> mat; plug-in component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
windowconstr = HBWindowConstruction(name="Theoretical-Window_EnergyStandardCompliant", materials=windowmat)  # -> constr; plug-in component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
windows_operable = Boolean(Toggle(True))

windowconstrshd = HBWindowConstructionShade(
    name="Shaded-Window",
    win_constr=windowconstr,
    shd_material=shademat,
    shd_location="Exterior",
    control_type=Slider(4, range=0..10),
    setpoint=Slider(25, range=0..100))  # -> constr; plug-in component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
filter_109 = StreamFilter(Gate=shading_3, Stream0=windowconstrshd, Stream1=windowconstr)

aperture = HBAperture(geo=windows_13, name=windows_name_5, operable=windows_operable, ep_constr=filter_109)  # -> report, apertures; plug-in component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
hb_windows = Data(aperture.apertures)

panel_35 = Panel("E:\Nextcloud\Public\CBML\Multi-Objective_Machine_Assistance\FirstBatch_1.0\Data_Source\Simulation-Files")
panel_36 = Panel("E:\Nextcloud\UserData\Documents\Arbeit\Papers\Zone-Cluster-HVAC-System-Design\Use-Case\Honeybee\GrasshopperModel\openstudio\run\eplusout.sql")
concat_21 = Concatenate(
    FragmentA=panel_35,
    FragmentB="\",
    FragmentC="Generic-Office-Building_H-Shape_Iteration-034",
    FragmentD="\openstudio\run\eplusout.sql")

parameters_names = Text(bfsolver.P)
split = TextSplit(Text=parameters_names, Separators="_")
lito3p = ListInto3Parts(ListToSlice=split, EndIndex=Slider(1, range=0..10))  # -> flatten(FilteredList), ItemsBefore, ItemsAfter; inputs ListToSlice: tree, StartIndex: tree of Int32, EndIndex: tree of Int32; same code as lito3p
parameters_values = Data(flatten(bfsolver.V))
join = TextJoin(Text=lito3p.ItemsAfter, Join="_")  # -> flatten(Result)
merge_27 = Merge(Data1=flatten(iteration_name_2), Data2=flatten(parameters_values))
merge_28 = Merge(Data1=flatten("Building-Name"), Data2=flatten(join))
concat_22 = Concatenate(FragmentA=file_name_base, FragmentB=namingschema_delimiter_parameter, FragmentC="Parameters", FragmentD=".csv")

panel_37 = Panel(":")  # disabled
number_slider_19 = Slider(21, range=0..100)  # disabled
concat_23 = Concatenate(FragmentA=merge_28, FragmentB=panel_37)  # disabled
nickname_2 = NAME(x=concat_23, y=number_slider_19)  # -> a; disabled
# ---------- nickname_2: Python ----------
a = str(x).ljust(y)
# ---------- end nickname_2 ----------
nickname_3 = NAME(x=merge_27, y=number_slider_19)  # -> a; disabled; same code as nickname_2
merge_29 = Merge(Data1=graft(nickname_2), Data2=graft(nickname_3))  # disabled
md_slider = MDSlider(
    SliderMode=0,
    slider_value=Point(0.05328294708, 0.921425424, 0.5),
    x_domain=Domain(0, 1000),
    y_domain=Domain(0, 1000),
    z_domain=Domain(0, 1))  # disabled
panel_38 = Panel("")  # disabled
number_slider_20 = Slider(20, range=0..100)  # disabled
join_2 = TextJoin(Text=merge_29, Join=panel_38)  # disabled
panel_39 = Panel("")  # disabled
join_3 = TextJoin(Text=flatten(join_2), Join=panel_39)  # disabled
texttoscreen = RenderTextToScreen(Text=join_3, Location=md_slider, Size=number_slider_20, Color=RGB(0, 0, 0), m_scWithvp=False)  # disabled

zones_name_underground_2 = Text(zones_name_underground)  # disabled
programs_name_underground_2 = Text(programs_name_underground)  # disabled
programs_name_2 = Text(programs_name)  # disabled
zones_name_8 = Text(zones_name_5)  # disabled
merge_30 = Merge(Data1=flatten(zones_name_8), Data2=flatten(zones_name_underground_2))  # disabled
merge_31 = Merge(Data1=flatten(programs_name_2), Data2=flatten(programs_name_underground_2))  # disabled
panel_40 = Panel("Uses")  # disabled
panel_41 = Panel(".csv")  # disabled
concat_24 = Concatenate(FragmentA=file_name_base, FragmentB=namingschema_delimiter_parameter, FragmentC=panel_40, FragmentD=panel_41)  # disabled

required_u_values_4 = Number(merge_2)
categories_3 = Text(merge)
concat_25 = Concatenate(FragmentA=file_name_base, FragmentB=namingschema_delimiter_parameter, FragmentC="U-Values", FragmentD=".csv")
merge_32 = Merge(Data1=flatten(iteration_name_2), Data2=flatten(required_u_values_4))
merge_33 = Merge(Data1=flatten("Building-Name"), Data2=flatten(categories_3))

internal_walls_2 = Curve(flatten(internal_walls))
floorheight_3 = Number(floorheight_2)
windows_14 = Brep(windows_10)
boundary_5 = Curve(boundary)
floor_count_underground_2 = Number(floor_count_underground)
area = Area(Geometry=windows_14)  # -> Area, Centroid
area_2 = Area(Geometry=boundary_5)  # -> Area, Centroid
len = Length(Curve=boundary_5)
numberoffloors_3 = Number(numberoffloors_2)
trim_43 = TrimTree(Tree=area.Area, Depth=Slider(2, range=0..10))
baseplate_area = Number(area_2.Area)
len_2 = Length(Curve=internal_walls_2)
ma = MassAddition(Input=trim_43)  # -> Result, PartialResults
multiplication = Multiplication(A=len, B=numberoffloors_3, C=floorheight_3)
categories_4 = Text(merge)
multiplication_2 = Multiplication(A=len, B=floor_count_underground_2, C=floorheight_3)
subtraction_2 = Subtraction(A=multiplication, B=ma.Result)
ma_2 = MassAddition(Input=len_2)  # -> Result, PartialResults
multiplication_3 = Multiplication(A=ma_2.Result, B=numberoffloors_3, C=floorheight_3)
concat_26 = Concatenate(FragmentA=file_name_base, FragmentB=namingschema_delimiter_parameter, FragmentC="Areas", FragmentD=".csv")
merge_34 = Merge(Data1=flatten(categories_4), Data2=flatten("Walls_Internal"))
merge_35 = Merge(Data1=flatten("Building-Name"), Data2=flatten(merge_34))

panel_42 = Panel(merge_35)

run_write_2 = Boolean(run_write)
reset_write_2 = Boolean(reset_write)
run_solver_4 = Boolean(run_solver)

zones_5 = Brep(zones_2)
volume_3 = Volume(Geometry=zones_5)  # -> Volume, Centroid
trim_44 = TrimTree(Tree=volume_3.Volume, Depth=Slider(2, range=0..10))
zones_name_9 = Text(flatten(zones_name_3))
ma_3 = MassAddition(Input=trim_44)  # -> Result, PartialResults
merge_36 = Merge(Data1=flatten(ma_3.Result), Data2=flatten(volume_3.Volume))
concat_27 = Concatenate(FragmentA=file_name_base, FragmentB=namingschema_delimiter_parameter, FragmentC="Volumes", FragmentD=".csv")
merge_37 = Merge(Data1="Total", Data2=zones_name_9)
merge_38 = Merge(Data1=flatten("Building-Name"), Data2=flatten("Total"))
merge_39 = Merge(Data1=flatten(iteration_name_2), Data2=flatten(ma_3.Result))

panel_43 = Panel(merge_38)
panel_45 = Panel(merge_39)

building_fassade_windowtowallratio_4 = Number(building_fassade_windowtowallratio)
building_fassade_lower_windowtowallratio_4 = Number(building_fassade_lower_windowtowallratio)
building_fassade_right_windowtowallratio_4 = Number(building_fassade_left_windowtowallratio)
building_fassade_left_windowtowallratio_4 = Number(avr_4)
building_fassade_upper_windowtowallratio_4 = Number(building_fassade_upper_windowtowallratio)
directions = Text(panel_21)
merge_40 = Merge(Data1=flatten("Total"), Data2=flatten(directions))
merge_41 = Merge(
    Data1=flatten(building_fassade_windowtowallratio_4),
    Data2=flatten(building_fassade_upper_windowtowallratio_4),
    Data3=flatten(building_fassade_lower_windowtowallratio_4),
    Data4=flatten(building_fassade_right_windowtowallratio_4),
    Data5=flatten(building_fassade_left_windowtowallratio_4))
concat_28 = Concatenate(FragmentA=file_name_base, FragmentB=namingschema_delimiter_parameter, FragmentC="WindowToWallRatios", FragmentD=".csv")
merge_42 = Merge(Data1=flatten("Building-Name"), Data2=flatten(merge_40))
merge_43 = Merge(Data1=flatten(iteration_name_2), Data2=flatten(merge_41))

panel_46 = Panel(merge_42)
panel_47 = Panel(merge_43)

concat_29 = Concatenate(FragmentA=file_name_base, FragmentB=namingschema_delimiter_parameter, FragmentC="EnergyDemand", FragmentD=".csv")

genes_7 = GenePool(Decimals=0, Maximum=10, Minimum=0, Value=[2, 3])
number_slider_21 = Slider(38, range=0..100)

genes_8 = GenePool(Decimals=0, Maximum=10, Minimum=0, Value=[2, 3])
number_slider_22 = Slider(38, range=0..100)

# ---- group: Occupancy
number_slider_23 = Slider(20, range=0..100)
number_slider_24 = Slider(16, range=0..100)
number_slider_25 = Slider(18, range=0..100)
number_slider_26 = Slider(18, range=0..100)
core_peoplecount = Integer(Slider(6, range=0..10))
zones_boundary_2 = Curve(zones_boundary)
trim_45 = TrimTree(Tree=zones_boundary_2, Depth=1)
area_3 = Area(Geometry=trim_45)  # -> Area, Centroid

arm_upper_right_peoplecount = Integer(number_slider_24)
arm_lower_right_peoplecount = Integer(number_slider_25)
arm_lower_left_peoplecount = Integer(number_slider_24)
arm_upper_left_peoplecount = Integer(number_slider_25)

central_lower_peoplecount = Integer(number_slider_23)
central_upper_peoplecount = Integer(number_slider_23)
central_right_peoplecount = Integer(number_slider_26)
central_leftpeoplecount = Integer(number_slider_26)

merge_44 = Merge(
    Data1=core_peoplecount,
    Data2=central_lower_peoplecount,
    Data3=central_upper_peoplecount,
    Data4=central_right_peoplecount,
    Data5=central_leftpeoplecount,
    Data6=arm_lower_right_peoplecount,
    Data7=arm_lower_left_peoplecount,
    Data8=arm_upper_left_peoplecount,
    Data9=arm_upper_right_peoplecount)
expression_10 = Expression(x=merge_44, y=area_3.Area, Expression="x/y")

# ----
zone_area_brutto = Panel(merge_44)
zone_area_brutto_2 = Panel(area_3.Area)
occupancy_density_people_m_2 = Panel(expression_10)

toggle_4 = BooleanToggle(True)
roomsolid = HBRoomFromSolid(geo=zones_3, name=zones_name_3, constr_set=hb_constructionset, program=expression_6, conditioned=toggle_4)  # -> report, rooms; plug-in component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
merge_45 = Merge(Data1=courtyard_upper_roof_3, Data2=courtyard_lower_roof_3)
merge_46 = Merge(Data1=courtyard_upper_fassade_3, Data2=courtyard_lower_fassade_3)
hc_system_2 = Text(hc_system)

filter_110 = StreamFilter(Gate=courtyard_has_roof, Stream1=merge_45)
courtyard_roofd = Surface(filter_110)
preview_6 = CustomPreview(Geometry=flatten(courtyard_roofd), Material=swatch_2)

roomsolid_2 = HBRoomFromSolid(geo=zones_3, name=zones_name_3, constr_set=hb_constructionset, program=expression_7, conditioned=toggle_4)  # -> report, rooms; plug-in component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
trim_46 = TrimTree(Tree=roomsolid_2.rooms, Depth=1)
addsubface = HBAddSubface(hb_obj=flatten(trim_46), sub_faces=flatten(hb_windows))  # -> hb_obj; plug-in component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

shade = HBShade(geo=merge_45, name="ShadingRoof")  # -> report, shades; plug-in component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
filter_111 = StreamFilter(Gate=courtyard_has_roof, Stream1=shade.shades)

area_4 = Area(Geometry=merge_45)  # -> Area, Centroid
ma_4 = MassAddition(Input=area_4.Area)  # -> Result, PartialResults
couryards_roof_area = Number(ma_4.Result)
addition_3 = Addition(A=baseplate_area, B=couryards_roof_area)
filter_112 = StreamFilter(Gate=courtyard_has_roof, Stream0=baseplate_area, Stream1=addition_3)
merge_47 = Merge(
    Data1=flatten(baseplate_area),
    Data2=flatten(filter_112),
    Data3=flatten(subtraction_2),
    Data4=flatten(multiplication_2),
    Data5=flatten(ma.Result))
merge_48 = Merge(Data1=flatten(merge_47), Data2=flatten(multiplication_3))
merge_49 = Merge(Data1=flatten(iteration_name_2), Data2=flatten(merge_48))

panel_48 = Panel(merge_49)

concat_30 = Concatenate(FragmentA=file_name_base, FragmentB=namingschema_delimiter_parameter, FragmentC="Comfort", FragmentD=".csv")

merge_50 = Merge(Data1=flatten(addsubface), Data2=flatten(roomsolid.report))
heatcoolhvac = HBHeatCoolHVAC(rooms=flatten(merge_50), system_type=hc_system_2)  # -> report, rooms; plug-in component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

allairhvac = HBAllAirHVAC(rooms=flatten(merge_50), system_type=all_air_2)  # -> report, rooms; plug-in component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

model = HBModel(rooms=flatten(allairhvac.rooms), name=iteration_name)  # -> report, model; plug-in component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
hb_model = Data(model.model)

hb_model_2 = Data(hb_model)
modeltoosm = HBModelToOSM(
    model=hb_model_2,
    epw_file=weather_file_path_2,
    sim_par=simpar,
    folder=folder_base_path_honeybee,
    write=and_4,
    run=expression_9)  # -> report, jsons, osw, osm, idf, sql, zsz, rdd, html; plug-in component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
sql_file_path = Text(modeltoosm.sql)

filter_113 = StreamFilter(Gate=reset_write, Stream0=sql_file_path, Stream1=panel_36)
sql_file_path_2 = Text(filter_113)

item_23 = ListItem(List=sql_file_path_2, Index=0, Wrap=True)
expression_11 = Expression(x=item_23, Expression="True")
simulation_completed = Boolean(expression_11)
and_5 = GateAnd(A=simulation_completed, B=run_write_2)
run_write_3 = Boolean(and_5)
and_6 = GateAnd(A=run_write_3, B=run_solver_4)
filter_114 = StreamFilter(Gate=reset_write_2, Stream0=and_6, Stream1=Slider(3, range=0..10))
run_mode_writer = Integer(filter_114)

csv_writer = CSVWriter(P=concat_25, H=merge_33, C=merge_32, M=run_mode_writer)  # -> L; inputs H: list, C: tree, M: Int32
#   port M: Operating mode: 0 = Nothing 1 = Append data 2 = Overwrite existing 3 = Only leave headers
# ---------- csv_writer: Python ----------
#Component Information
#--------------------------------------------------------------------------------------------
if ghenv.Component.RunCount<2:
    #General
    #--------------------------------------------------------------------------------------------
    __author__ = "Ueli Saluz"
    __version__ = "2022.01.25"
    
    ghenv.Component.Name = "CSV-Writer"
    ghenv.Component.NickName = "CSV-Writer"
    ghenv.Component.Description = "Write or append to existing or new csv file."
    ghenv.Component.Message = "VER 1.0"
    ghenv.Component.Category = "Data"
    ghenv.Component.SubCategory = "CSV"
    
     #Inputs
    #--------------------------------------------------------------------------------------------
    inputIndex=0
    
    ghenv.Component.Params.Input[inputIndex].Name = "FilePath"
    ghenv.Component.Params.Input[inputIndex].NickName = "P"
    ghenv.Component.Params.Input[inputIndex].Description = "File path of the csv file that will be created or appended to."
    ghenv.Component.Params.Input[inputIndex].Optional = False
    inputIndex+=1
    
    ghenv.Component.Params.Input[inputIndex].Name = "Headers"
    ghenv.Component.Params.Input[inputIndex].NickName = "H"
    ghenv.Component.Params.Input[inputIndex].Description = "All headers as a list."
    ghenv.Component.Params.Input[inputIndex].Optional = False
    inputIndex+=1
    
    ghenv.Component.Params.Input[inputIndex].Name = "Columns"
    ghenv.Component.Params.Input[inputIndex].NickName = "C"
    ghenv.Component.Params.Input[inputIndex].Description = "Data tree where every branch is a column."
    ghenv.Component.Params.Input[inputIndex].Optional = False
    inputIndex+=1
    
    ghenv.Component.Params.Input[inputIndex].Name = "Mode"
    ghenv.Component.Params.Input[inputIndex].NickName = "M"
    ghenv.Component.Params.Input[inputIndex].Description = \
    "Operating mode:\n 0 = Nothing \n 1 = Append data\n 2 = Overwrite existing\n 3 = Only leave headers"
    ghenv.Component.Params.Input[inputIndex].Optional = False
    inputIndex+=1
    
    #Outputs
    #--------------------------------------------------------------------------------------------
    outputIndex=0
    
    ghenv.Component.Params.Output[outputIndex].Name = "Log"
    ghenv.Component.Params.Output[outputIndex].NickName = "L"
    ghenv.Component.Params.Output[outputIndex].Description = "The action that was completed"
    outputIndex+=1


#Imports
#--------------------------------------------------------------------------------------------
from System import Object
from Grasshopper import DataTree
import csv
import os

#Solver - Run with trees to enhance performance drastically
#--------------------------------------------------------------------------------------------
if __name__ == "__main__":
    
    log = []
    
    if M>0:
        if os.path.exists(P) and M>1:
            os.remove(P)
            log.Add("The old file {filePath} was successfully deleted.".format(filePath=P))
        if not os.path.exists(P):
            with open(P, 'wb') as csvfile:
                # creating a csv writer object 
                csvwriter = csv.writer(csvfile) 
                # writing the headers
                csvwriter.writerow(H) 
                log.Add("The new file {filePath} was successfully created.".format(filePath=P))
        if M != 3:
            # writing to csv file 
            with open(P, 'ab') as csvfile: 
                # creating a csv writer object 
                csvwriter = csv.writer(csvfile) 
                # writing the data rows 
                csvwriter.writerows(C.Branches)
                log.Add("{rowCount} rows have been added to the file.".format(rowCount=C.Branches.Count))
                
    else:
        log.Add("Nothing was performed.")
    L=log
# ---------- end csv_writer ----------

csv_writer_2 = CSVWriter(P=concat_22, H=merge_28, C=merge_27, M=run_mode_writer)  # -> L; inputs H: list, C: tree, M: Int32; same code as csv_writer

csv_writer_3 = CSVWriter(P=concat_24, H=merge_30, C=merge_31, M=run_mode_writer)  # -> L; inputs H: list, C: tree, M: Int32; disabled; same code as csv_writer

csv_writer_4 = CSVWriter(P=concat_28, H=merge_42, C=merge_43, M=run_mode_writer)  # -> L; inputs H: list, C: tree, M: Int32; same code as csv_writer

csv_writer_5 = CSVWriter(P=concat_27, H=merge_38, C=merge_39, M=run_mode_writer)  # -> L; inputs H: list, C: tree, M: Int32; same code as csv_writer

csv_writer_6 = CSVWriter(P=concat_26, H=merge_35, C=merge_49, M=run_mode_writer)  # -> L; inputs H: list, C: tree, M: Int32; same code as csv_writer

eui = HBEndUseIntensity(sql=sql_file_path_2)  # -> eui, eui_end_use, end_uses, gross_floor; plug-in component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
merge_51 = Merge(Data1=flatten("Total"), Data2=flatten(eui.end_uses))
merge_52 = Merge(Data1=flatten(eui.eui), Data2=flatten(eui.eui_end_use))
merge_53 = Merge(Data1=flatten("Building-Name"), Data2=flatten(merge_51))
merge_54 = Merge(Data1=flatten(iteration_name_2), Data2=flatten(merge_52))
csv_writer_7 = CSVWriter(P=concat_29, H=merge_53, C=merge_54, M=run_mode_writer)  # -> L; inputs H: list, C: tree, M: Int32; same code as csv_writer

readtable = HBReadTabularData(sql=sql_file_path_2, table_name="Heat Index Hours")  # -> values, col_names, row_names; plug-in component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
tstat_10 = TreeStatistics(Tree=readtable.values)  # -> Paths, Length, Count
item_24 = ListItem(List=readtable.col_names, Index=genes_7, Wrap=True)
item_25 = ListItem(List=tstat_10.Paths, Index=number_slider_21, Wrap=True)
item_26 = ListItem(List=readtable.row_names, Index=number_slider_21, Wrap=True)
concat_31 = Concatenate(FragmentA=item_24, FragmentB=namingschema_delimiter_parameter, FragmentC=item_26)
branch_3 = TreeBranch(Tree=readtable.values, Path=item_25, MaintainPaths=True)
item_27 = ListItem(List=branch_3, Index=genes_7, Wrap=True)

readtable_2 = HBReadTabularData(sql=sql_file_path_2, table_name="Humidex Hours")  # -> values, col_names, row_names; plug-in component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
tstat_11 = TreeStatistics(Tree=readtable_2.values)  # -> Paths, Length, Count
item_28 = ListItem(List=readtable_2.col_names, Index=genes_8, Wrap=True)
item_29 = ListItem(List=tstat_11.Paths, Index=number_slider_22, Wrap=True)
item_30 = ListItem(List=readtable_2.row_names, Index=number_slider_22, Wrap=True)
branch_4 = TreeBranch(Tree=readtable_2.values, Path=item_29, MaintainPaths=True)
concat_32 = Concatenate(FragmentA=item_28, FragmentB=namingschema_delimiter_parameter, FragmentC=item_30)
item_31 = ListItem(List=branch_4, Index=genes_8, Wrap=True)

panel_49 = Panel(merge_54)

merge_55 = Merge(Data1=concat_31, Data2=concat_32)
merge_56 = Merge(Data1=item_27, Data2=item_31)
uft_8 = NAME(x=merge_55)  # -> a
# ---------- uft_8: Python ----------
a= x.encode('utf-8')
# ---------- end uft_8 ----------
merge_57 = Merge(Data1=flatten("Building-Name"), Data2=flatten(uft_8))
merge_58 = Merge(Data1=flatten(iteration_name_2), Data2=flatten(merge_56))

csv_writer_8 = CSVWriter(P=concat_30, H=merge_57, C=merge_58, M=run_mode_writer)  # -> L; inputs H: list, C: tree, M: Int32; same code as csv_writer

mrg_a_8 = MergeSeperatlyAppend(
    x=csv_writer,
    y=csv_writer_6,
    z=csv_writer_5,
    u=csv_writer_2,
    v=csv_writer_7,
    w=csv_writer_4,
    s=csv_writer_8,
    t=csv_writer_3)  # -> Mrgd; inputs x: tree, y: tree, z: tree, u: tree, v: tree, w: tree, s: tree, t: tree; same code as mrg_a
log_writing_files_2 = Text(mrg_a_8)

# ==== cluster ManavHB_Mat
manavc__construction = ClusterInput()
slab_heat_capacity = ClusterInput()
insulation_conductivity = ClusterInput()

manavc__construction_2 = Text(manavc__construction)
insulation_conductivity_2 = Number(insulation_conductivity)
slab_heat_capacity_2 = Number(slab_heat_capacity)
regex = MatchRegularExpression(T=manavc__construction_2, rp="var.*new Material(.*);", ic=Toggle(True))  # -> M, msi, mg, mgsi
regex_2 = MatchRegularExpression(T=regex.M, rp="\".*\\d", ic=Toggle(True))  # -> M, msi, mg, mgsi
split = TextSplit(Text=regex_2.M, Separators=",")
rep = ReplaceText(Text=split, Find="\"", RecursiveReplace=False)
rep_2 = ReplaceText(Text=rep, Find=" ", RecursiveReplace=False)
item = ListItem(List=rep_2, Index=0, Wrap=True)  # -> flatten(Item)
rep_3 = ReplaceText(Text=rep_2, Find="hcSlab", Replace=slab_heat_capacity_2, RecursiveReplace=False)
rep_4 = ReplaceText(Text=rep_3, Find="lambda_insulation", Replace=insulation_conductivity_2, RecursiveReplace=False)
item_2 = ListItem(List=rep_4, Index=0, Wrap=True)  # -> Item, Item1, Item2, Item3, Item4, Item5, Item6, Item7, Item8
opaquemat = HBOpaqueMaterial(
    name=item_2.Item,
    thickness=item_2.Item2,
    conductivity=item_2.Item3,
    density=item_2.Item4,
    spec_heat=item_2.Item5,
    roughness=item_2.Item1,
    therm_absp=item_2.Item6,
    sol_absp=item_2.Item7,
    vis_absp=item_2.Item8)  # -> mat; plug-in component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
hb_materials = Data(opaquemat)
materialnames = Text(item_2.Item)

manavc__construction_3 = Text(manavc__construction_2)
toggle = BooleanToggle(True)
regex_3 = MatchRegularExpression(T=manavc__construction_3, rp="var.*new List<Material>.*{.*}.*;", ic=Toggle(True))  # -> M, msi, mg, mgsi
regex_4 = MatchRegularExpression(T=regex_3.M, rp="var.*\n?.*=", ic=toggle)  # -> M, msi, mg, mgsi
split_2 = TextSplit(Text=regex_3.M, Separators="=")
empty = Panel("")
item_3 = ListItem(List=split_2, Index=0, Wrap=True)  # -> Item, flatten(Item1)
split_3 = TextSplit(Text=regex_4.M, Separators=empty)
item_4 = ListItem(List=split_3, Index=0, Wrap=True)  # -> Item, Item1
regex_5 = MatchRegularExpression(T=item_3.Item1, rp="{.*}", ic=toggle)  # -> M, msi, mg, mgsi
empty_2 = Panel("")
rep_5 = ReplaceText(Text=regex_5.M, Find="{", Replace=empty_2, RecursiveReplace=False)
rep_6 = ReplaceText(Text=rep_5, Find="}", Replace=empty_2, RecursiveReplace=False)
empty_3 = Panel("")
split_4 = TextSplit(Text=rep_6, Separators=",")
whitespace = Panel(" ")
rep_7 = ReplaceText(Text=split_4, Find=whitespace, Replace=empty_3, RecursiveReplace=False)
layers_materialnames = Text(rep_7)
layers_name = Text(item_4.Item1)

layers_materialnames_2 = Text(rep_7)
manavc__construction_4 = Text(manavc__construction_2)
regex_6 = MatchRegularExpression(T=manavc__construction_4, rp="AdjustInsulation.*;", ic=Toggle(True))  # -> M, msi, mg, mgsi
regex_7 = MatchRegularExpression(T=regex_6.M, rp="[(].*[)]", ic=Toggle(True))  # -> M, msi, mg, mgsi
split_5 = TextSplit(Text=regex_7.M, Separators=",")
empty_4 = Panel("")
item_5 = ListItem(List=split_5, Index=0, Wrap=True)  # -> Item, flatten(Item1)
rep_8 = ReplaceText(Text=item_5.Item1, Find=")", Replace=empty_4, RecursiveReplace=False)
empty_5 = Panel("")
whitespace_2 = Panel(" ")
rep_9 = ReplaceText(Text=rep_8, Find=whitespace_2, Replace=empty_5, RecursiveReplace=False)
insulation_layer_name = Text(rep_9)
tmatch = MatchText(Text=graft(layers_materialnames_2), Pattern=insulation_layer_name, Case=True)
listdexs = ListIndices(List=layers_materialnames_2)
ma = MassAddition(Input=tmatch)  # -> Result, PartialResults
trim = TrimTree(Tree=ma.Result, Depth=1)
cull = CullPattern(List=listdexs, CullPattern=trim)
ma_2 = MassAddition(Input=trim)  # -> Result, PartialResults
insulation_layer_index = Integer(cull)
contains_insulation = Boolean(ma_2.Result)

tmatch_2 = MatchText(Text=graft(layers_materialnames), Pattern=flatten(materialnames), Case=True)
cull_2 = CullPattern(List=flatten(hb_materials), CullPattern=tmatch_2)
trim_2 = TrimTree(Tree=cull_2, Depth=1)
layers_materials = Data(trim_2)

regex_8 = MatchRegularExpression_2(T=materialnames, rp=".*(MW)|(Ins).*", ic=Toggle(True))  # -> M, msi, mg, mgsi
tstat = TreeStatistics(Tree=regex_8.M)  # -> Paths, Length, Count
dsptchpths = DispatchBranchesWithPaths(Data=materialnames, Paths=tstat.Paths)  # -> flatten(SelectedData), flatten(OtherData), SelectedPaths, AdditionalGen; inputs Data: tree, Paths: list, Ancestor: Boolean
# ---------- dsptchpths: Python ----------
__author__ = "Ueli Saluz"
__version__ = "2020.05.29"

ghenv.Component.Name = "DispatchBranchesWithPaths"
ghenv.Component.NickName = "DsptchPths"
ghenv.Component.Description = "Select paths from a data tree and dispatch automatically. Optionally check if path is ancestor."
ghenv.Component.Message = "VER 1.0"

ghenv.Component.Params.Input[3].Optional = True

from Grasshopper import DataTree
from System import Object
from Grasshopper.Kernel.Data import GH_Path

if __name__ == "__main__":
    SelectedData = DataTree[Object]()
    OtherData = DataTree[Object]()
    SelectedPaths = []
    AdditionalGen = []
    
    dummy = 0
    for pathToCheck in Data.Paths:
        isInside = False;
        for path in Paths:
            checkAncestor = pathToCheck.IsAncestor(path,dummy)
            if Generations!=None:
                if Generations>checkAncestor[1]:
                    continue
            elif pathToCheck==path or (Ancestor and checkAncestor[0]):
                AdditionalGen.append(checkAncestor[1])
                SelectedData.AddRange(Data.Branch(pathToCheck),pathToCheck)
                SelectedPaths.append(pathToCheck)
                isInside=True
                break
        if not isInside:
            OtherData.AddRange(Data.Branch(pathToCheck),pathToCheck)
# ---------- end dsptchpths ----------
dsptchpths_2 = DispatchBranchesWithPaths(Data=hb_materials, Paths=tstat.Paths)  # -> flatten(SelectedData), flatten(OtherData), SelectedPaths, AdditionalGen; inputs Data: tree, Paths: list, Ancestor: Boolean; same code as dsptchpths
materialnames_non_insulation = Text(dsptchpths.OtherData)
hb_materials_non_insulation = Data(dsptchpths_2.OtherData)
materialnames_insulation = Text(dsptchpths.SelectedData)
hb_materials_insulation = Data(dsptchpths_2.SelectedData)

panel = Panel(regex.M)
panel_2 = Panel(regex_2.M)
panel_3 = Panel(rep_3)
panel_4 = Panel(hb_materials_non_insulation)
panel_5 = Panel(materialnames_non_insulation)

opaqueconstr = HBOpaqueConstruction(name=layers_name, materials=layers_materials)  # -> constr; plug-in component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
hb_opaque_construction = Data(opaqueconstr)

panel_6 = Panel(regex_3.M)
panel_7 = Panel(item_3.Item1)
panel_8 = Panel(item_4.Item1)
panel_9 = Panel(rep_7)
panel_10 = Panel(hb_opaque_construction)

hb_materials_non_insulation_2 = Data(hb_materials_non_insulation)
hb_materials_name_non_insulation = Text(materialnames_non_insulation)
hb_materials_insulation_2 = Data(hb_materials_insulation)
materialnames_insulation_2 = Text(dsptchpths.SelectedData)
hb_opaque_construction_2 = Data(hb_opaque_construction)
hb_opaque_construction_name = Text(layers_name)
layers_materials_2 = Data(trim_2)
layers_materialnames_3 = Text(layers_materialnames)
layers_contain_insulation = Boolean(contains_insulation)
insulation_layer_name_2 = Text(insulation_layer_name)
insulation_layer_index_2 = Integer(insulation_layer_index)
hb_materials_non_insulation_3 = ClusterOutput(hb_materials_non_insulation_2)
hb_materials_name_non_insulation_2 = ClusterOutput(hb_materials_name_non_insulation)
hb_materials_insulation_3 = ClusterOutput(hb_materials_insulation_2)
materialnames_insulation_3 = ClusterOutput(materialnames_insulation_2)
hb_opaque_construction_3 = ClusterOutput(hb_opaque_construction_2)
hb_opaque_construction_name_2 = ClusterOutput(hb_opaque_construction_name)
layers_materials_3 = ClusterOutput(layers_materials_2)
layers_materialnames_4 = ClusterOutput(layers_materialnames_3)
layers_contain_insulation_2 = ClusterOutput(layers_contain_insulation)
insulation_layer_name_3 = ClusterOutput(insulation_layer_name_2)
insulation_layer_index_3 = ClusterOutput(insulation_layer_index_2)

# ==== cluster MessiBasePlanes
normalmessi = ClusterInput()
baseplane = ClusterInput()
movingx = ClusterInput()
movingy = ClusterInput()
movingz = ClusterInput()
graftedmessi = ClusterInput()
anglex = ClusterInput()
angley = ClusterInput()
baseplane_2 = Plane(baseplane)
normalmessi_2 = Boolean(normalmessi)
graftedmessi_2 = Boolean(graftedmessi)
moverotateplane = MoveRotatePlane(baseplane=baseplane_2, movingx=movingx, movingy=movingy, movingz=movingz, anglex=anglex, angley=angley)
neg = Negative(Value=Slider(1, range=0..1))
merge = Merge(Data1=baseplane_2, Data2=moverotateplane)
lito3p = ListInto3Parts(ListToSlice=merge, StartIndex=Slider(2, range=0..10), EndIndex=neg)  # -> FilteredList, ItemsBefore, ItemsAfter; inputs ListToSlice: tree, StartIndex: tree of Int32, EndIndex: tree of Int32
# ---------- lito3p: Python ----------
if ghenv.Component.RunCount<2:
    __author__ = "Ueli Saluz"
    __version__ = "2020.05.28"
    
    ghenv.Component.Name = "ListInto3Parts"
    ghenv.Component.NickName = "LiTo3P"
    ghenv.Component.Description = "Slice list into 3 parts. All lists are sliced with the same indices."
    ghenv.Component.Message = "VER 1.5"

from System import Object
from Grasshopper import DataTree

def filterList(listToFilter,startIndex,endIndex):
    if (((startIndex == 0) or (startIndex is None)) and ((endIndex == 0)or (endIndex is None))) or (endIndex <= startIndex and endIndex > 0):
        return (None,None,listToFilter)
    elif (startIndex == 0) or (startIndex is None):
        return (listToFilter[:endIndex],None,listToFilter[endIndex:])
    else:
        return (listToFilter[startIndex:endIndex],listToFilter[:startIndex],listToFilter[endIndex:])

if __name__ == "__main__":
    FilteredList = DataTree[Object]()
    ItemsBefore = DataTree[Object]()
    ItemsAfter = DataTree[Object]()
    
    for path in ListToSlice.Paths:
        listBranch = ListToSlice.Branch(path)
        pyList = list(listBranch)   #Convert .Net List to Python
        try: #terrible way of writing code but if I set the list to list access the performance decreases massivly due to many calls
            startIndex = StartIndex.Branch(path)
            startIndex = startIndex[0]
        except Exception:
            try:
                startIndex = StartIndex.Branch(0)
                startIndex = startIndex[0]
            except Exception:
                startIndex = 0
        try:
            endIndex = EndIndex.Branch(path)
            endIndex = endIndex[0]
        except Exception:
            try:
                endIndex = EndIndex.Branch(0)
                endIndex = endIndex[0]
            except Exception:
                endIndex = len(pyList)
        filtList=filterList(pyList,startIndex,endIndex)
        if filtList[0]:
            FilteredList.AddRange(filtList[0],path)
        if filtList[1]:
            ItemsBefore.AddRange(filtList[1],path)
        if filtList[2]:
            ItemsAfter.AddRange(filtList[2],path)
# ---------- end lito3p ----------
mrg_p = MergeSeperatlyPrepend(y=lito3p.ItemsBefore)  # -> Mrgd; inputs x: tree, z: tree, u: tree, y: tree
# ---------- mrg_p: Python ----------
if ghenv.Component.RunCount<2:
    __author__ = "Ueli Saluz"
    __version__ = "2020.05.28"
    
    ghenv.Component.Name = "MergeSeperatly(Prepend)"
    ghenv.Component.NickName = "Mrg(P)"
    ghenv.Component.Description = "Merge inputs seperatly on a new path. Prepend index of input parameter for distincting."
    ghenv.Component.Message = "VER 1.0"

from System import Object
from Grasshopper import DataTree
from Grasshopper.Kernel import GH_ParamAccess as Access

if __name__ == "__main__":
    Mrgd = DataTree[Object]()
    access = Access()
    
    for input in ghenv.Component.Params.Input:  #set all Inputaccess to Tree Access
        input.Access = access.tree
    
    for i,input in enumerate(ghenv.Component.Params.Input):
        for j,source in enumerate(input.Sources):
            for path in source.VolatileData.Paths:
                Mrgd.AddRange(source.VolatileData[path],path.PrependElement(i))
# ---------- end mrg_p ----------
mrg_a = MergeSeperatlyAppend(z=lito3p.ItemsAfter)  # -> graft(Mrgd); inputs x: tree, y: tree, z: tree
# ---------- mrg_a: Python ----------
if ghenv.Component.RunCount<2:
    __author__ = "Ueli Saluz"
    __version__ = "2020.05.28"
    
    ghenv.Component.Name = "MergeSeperatly(Append)"
    ghenv.Component.NickName = "Mrg(A)"
    ghenv.Component.Description = "Merge inputs seperatly on a new path. Append index of input parameter for distincting."
    ghenv.Component.Message = "VER 1.0"

from System import Object
from Grasshopper import DataTree
from Grasshopper.Kernel import GH_ParamAccess as Access

if __name__ == "__main__":
    Mrgd = DataTree[Object]()
    access = Access()
    
    for input in ghenv.Component.Params.Input:  #set all Inputaccess to Tree Access
        input.Access = access.tree
    
    for i,input in enumerate(ghenv.Component.Params.Input):
        for j,source in enumerate(input.Sources):
            for path in source.VolatileData.Paths:
                Mrgd.AddRange(source.VolatileData[path],path.AppendElement(i))
# ---------- end mrg_a ----------
merge_2 = Merge(Data1=mrg_p, Data2=simplify(graft(lito3p.FilteredList)), Data3=mrg_a)
xy = XYPlane(Origin=Point(0, 0, 0))  # -> flatten(Plane)
filter = StreamFilter(Gate=graftedmessi_2, Stream0=merge_2, Stream1=graft(merge_2))
filter_2 = StreamFilter(Gate=normalmessi_2, Stream0=xy, Stream1=filter)
baseplanes = Plane(filter_2)
baseplanes_2 = ClusterOutput(baseplanes)

# ==== cluster Generic_OfficeBuilding_HShape_RectangleGrid
arm_upper_left_latitudinal_numberofsegme = ClusterInput()  # "Arm-Upper-Left-Latitudinal-NumberOfSegments"
arm_lower_left_longitudinal_numberofsegm = ClusterInput()  # "Arm-Lower-Left-Longitudinal-NumberOfSegments"
arm_lower_lef_latitudinal_numberofsegmen = ClusterInput()  # "Arm-Lower-Lef-Latitudinal-NumberOfSegments"
arm_upper_left_longitudinal_numberofsegm = ClusterInput()  # "Arm-Upper-Left-Longitudinal-NumberOfSegments"
arm_upper_right_longitudinal_numberofseg = ClusterInput()  # "Arm-Upper-Right-Longitudinal-NumberOfSegments"
arm_upper_right_latitudinal_numberofsegm = ClusterInput()  # "Arm-Upper-Right-Latitudinal-NumberOfSegments"
namingschema_center_name = ClusterInput()
namingschema_core_name = ClusterInput()
basebody_inside_latditudinal_numberofseg = ClusterInput()  # "BaseBody-Inside-Latditudinal-NumberOfSegments"
namingschema_arm_name = ClusterInput()
namingschema_fassade_name = ClusterInput()
building_longitudinal_numberofsegments = ClusterInput()
arm_lower_right_longitudinal_numberofseg = ClusterInput()  # "Arm-Lower-Right-Longitudinal-NumberOfSegments"
arm_lower_right_latitudinal_numberofsegm = ClusterInput()  # "Arm-Lower-Right-Latitudinal-NumberOfSegments"
namingschema_wing_name = ClusterInput()
namingschema_building_name = ClusterInput()
namingschema_delimiter = ClusterInput()
namingschema_directions = ClusterInput()
rasterlength_x = ClusterInput()
rasterlength_y = ClusterInput()
baseplane = ClusterInput()

namingschema_delimiter_2 = Text(namingschema_delimiter)
namingschema_wing_name_2 = Text(namingschema_wing_name)
namingschema_center_name_2 = Text(namingschema_center_name)
namingschema_building_name_2 = Text(namingschema_building_name)
namingschema_core_name_2 = Text(namingschema_core_name)
namingschema_arm_name_2 = Text(namingschema_arm_name)
namingschema_fassade_name_2 = Text(namingschema_fassade_name)
namingschema_directions_2 = Text(namingschema_directions)
item = ListItem(List=namingschema_directions_2, Index=0, Wrap=True)  # -> Item, Item1, Item2, Item3

rasterlength_x_2 = Number(rasterlength_x)
rasterlength_y_2 = Number(rasterlength_y)

arm_lower_left_longitudinal_numberofsegm_2 = Number(arm_lower_left_longitudinal_numberofsegm)  # "Arm-Lower-Left-Longitudinal-NumberOfSegments"
arm_lower_lef_latitudinal_numberofsegmen_2 = Number(arm_lower_lef_latitudinal_numberofsegmen)  # "Arm-Lower-Lef-Latitudinal-NumberOfSegments"
expression = Expression(x=arm_lower_left_longitudinal_numberofsegm_2, y=rasterlength_x_2, Expression="x*y")
expression_2 = Expression(x=arm_lower_lef_latitudinal_numberofsegmen_2, y=rasterlength_y_2, Expression="x*y")
arm_lower_left_latitudinal_totallength = Number(expression_2)
arm_lower_left_longitudinal_totallength = Number(expression)

arm_upper_left_latitudinal_numberofsegme_2 = Number(arm_upper_left_latitudinal_numberofsegme)  # "Arm-Upper-Left-Latitudinal-NumberOfSegments"
arm_upper_left_longitudinal_numberofsegm_2 = Number(arm_upper_left_longitudinal_numberofsegm)  # "Arm-Upper-Left-Longitudinal-NumberOfSegments"
expression_3 = Expression(x=arm_upper_left_longitudinal_numberofsegm_2, y=rasterlength_x_2, Expression="x*y")
expression_4 = Expression(x=arm_upper_left_latitudinal_numberofsegme_2, y=rasterlength_y_2, Expression="x*y")
arm_upper_left_longitudinal_totallength = Number(expression_3)
arm_upper_left_latitudinal_totallength = Number(expression_4)

arm_upper_right_longitudinal_numberofseg_2 = Number(arm_upper_right_longitudinal_numberofseg)  # "Arm-Upper-Right-Longitudinal-NumberOfSegments"
arm_upper_right_latitudinal_numberofsegm_2 = Number(arm_upper_right_latitudinal_numberofsegm)  # "Arm-Upper-Right-Latitudinal-NumberOfSegments"
expression_5 = Expression(x=arm_upper_right_longitudinal_numberofseg_2, y=rasterlength_x_2, Expression="x*y")
expression_6 = Expression(x=arm_upper_right_latitudinal_numberofsegm_2, y=rasterlength_y_2, Expression="x*y")
arm_upper_right_latitudinal_totallength = Number(expression_6)
arm_upper_right_longitudinal_totallength = Number(expression_5)

arm_lower_right_longitudinal_numberofseg_2 = Number(arm_lower_right_longitudinal_numberofseg)  # "Arm-Lower-Right-Longitudinal-NumberOfSegments"
arm_lower_right_latitudinal_numberofsegm_2 = Number(arm_lower_right_latitudinal_numberofsegm)  # "Arm-Lower-Right-Latitudinal-NumberOfSegments"
expression_7 = Expression(x=arm_lower_right_longitudinal_numberofseg_2, y=rasterlength_x_2, Expression="x*y")
expression_8 = Expression(x=arm_lower_right_latitudinal_numberofsegm_2, y=rasterlength_y_2, Expression="x*y")
arm_lower_right_longitudinal_totallength = Number(expression_7)
arm_lower_right_latitudinal_totallength = Number(expression_8)

baseplane_2 = Plane(baseplane)
deplane = DeconstructPlane(Plane=baseplane_2)  # -> Origin, XAxis, YAxis, ZAxis
revxvec = Vector(expr("-x", deplane.XAxis))
revzvec = Vector(expr("-x", deplane.ZAxis))
revyvec = Vector(expr("-x", deplane.YAxis))
pflip = FlipPlane(Plane=baseplane_2, ReverseX=False, ReverseY=False, SwapAxes=True)
origin = Point(deplane.Origin)
xvec = Vector(deplane.XAxis)
yvec = Vector(deplane.YAxis)
zvec = Vector(deplane.ZAxis)

amp = Amplitude(Vector=xvec, Amplitude=1)
amp_2 = Amplitude(Vector=yvec, Amplitude=1)
amp_3 = Amplitude(Vector=zvec, Amplitude=1)
amp_4 = Amplitude(Vector=revxvec, Amplitude=1)
amp_5 = Amplitude(Vector=revyvec, Amplitude=1)
amp_6 = Amplitude(Vector=revzvec, Amplitude=1)
merge = Merge(Data1=item.Item1, Data2=item.Item3)
merge_2 = Merge(Data1=item.Item2, Data2=item.Item)
panel = Panel(merge_2)
panel_2 = Panel(merge)

merge_3 = Merge(Data1=item.Item2, Data2=item.Item)
concat = Concatenate(
    FragmentE=namingschema_building_name_2,
    FragmentD=namingschema_delimiter_2,
    FragmentA=namingschema_center_name_2,
    FragmentC=namingschema_delimiter_2,
    FragmentB=merge_3)  # -> graft(Result)
basebody_center_zones_name = Text(concat)

concat_2 = Concatenate(
    FragmentD=namingschema_building_name_2,
    FragmentE=namingschema_delimiter_2,
    FragmentA=namingschema_arm_name_2,
    FragmentC=namingschema_delimiter_2,
    FragmentB=item.Item2)  # -> graft(Result)
merge_4 = Merge(Data1=item.Item1, Data2=item.Item3)
concat_3 = Concatenate(
    FragmentD=namingschema_building_name_2,
    FragmentE=namingschema_delimiter_2,
    FragmentA=namingschema_arm_name_2,
    FragmentC=namingschema_delimiter_2,
    FragmentB=item.Item)
merge_5 = Merge(Data1=item.Item3, Data2=item.Item1)
mrg_a = MergeSeperatlyAppend(y=concat_3)  # -> Mrgd; inputs x: tree, y: tree; same code as mrg_a
concat_4 = Concatenate(FragmentA=concat_2, FragmentC=namingschema_delimiter_2, FragmentB=merge_4)
concat_5 = Concatenate(FragmentA=mrg_a, FragmentC=namingschema_delimiter_2, FragmentB=merge_5)
merge_6 = Merge(Data1=concat_4, Data2=concat_5)
concat_6 = Concatenate(
    FragmentA=merge_6,
    FragmentD=namingschema_delimiter_2,
    FragmentE=namingschema_fassade_name_2,
    FragmentB=namingschema_delimiter_2,
    FragmentC=item.Item1)  # -> graft(Result)
arms_fassade_right_name = Text(concat_6)

concat_7 = Concatenate(
    FragmentD=namingschema_building_name_2,
    FragmentE=namingschema_delimiter_2,
    FragmentA=namingschema_arm_name_2,
    FragmentC=namingschema_delimiter_2,
    FragmentB=item.Item2)  # -> graft(Result)
merge_7 = Merge(Data1=item.Item1, Data2=item.Item3)
concat_8 = Concatenate(
    FragmentD=namingschema_building_name_2,
    FragmentE=namingschema_delimiter_2,
    FragmentA=namingschema_arm_name_2,
    FragmentC=namingschema_delimiter_2,
    FragmentB=item.Item)
merge_8 = Merge(Data1=item.Item3, Data2=item.Item1)
mrg_a_2 = MergeSeperatlyAppend(y=concat_8)  # -> Mrgd; inputs x: tree, y: tree; same code as mrg_a
concat_9 = Concatenate(FragmentA=concat_7, FragmentC=namingschema_delimiter_2, FragmentB=merge_7)
concat_10 = Concatenate(FragmentA=mrg_a_2, FragmentC=namingschema_delimiter_2, FragmentB=merge_8)
merge_9 = Merge(Data1=concat_9, Data2=concat_10)
concat_11 = Concatenate(
    FragmentA=merge_9,
    FragmentD=namingschema_delimiter_2,
    FragmentE=namingschema_fassade_name_2,
    FragmentB=namingschema_delimiter_2,
    FragmentC=item.Item3)  # -> graft(Result)
arms_fassade_left_name = Text(concat_11)

concat_12 = Concatenate(
    FragmentD=namingschema_building_name_2,
    FragmentE=namingschema_delimiter_2,
    FragmentA=namingschema_arm_name_2,
    FragmentC=namingschema_delimiter_2,
    FragmentB=item.Item2)  # -> graft(Result)
merge_10 = Merge(Data1=item.Item1, Data2=item.Item3)
concat_13 = Concatenate(FragmentA=concat_12, FragmentC=namingschema_delimiter_2, FragmentB=merge_10)
concat_14 = Concatenate(
    FragmentA=concat_13,
    FragmentD=namingschema_delimiter_2,
    FragmentE=namingschema_fassade_name_2,
    FragmentB=namingschema_delimiter_2,
    FragmentC=item.Item2)  # -> graft(Result)
arms_fassade_lower_name = Text(concat_14)

merge_11 = Merge(Data1=item.Item2, Data2=item.Item)
concat_15 = Concatenate(
    FragmentD=namingschema_building_name_2,
    FragmentE=namingschema_delimiter_2,
    FragmentA=namingschema_arm_name_2,
    FragmentC=namingschema_delimiter_2,
    FragmentB=merge_11)  # -> graft(Result)
merge_12 = Merge(Data1=item.Item1, Data2=item.Item3)
concat_16 = Concatenate(FragmentA=concat_15, FragmentC=namingschema_delimiter_2, FragmentB=merge_12)  # -> graft(Result)
arms_name = Text(concat_16)

merge_13 = Merge(Data1=item.Item1, Data2=item.Item3)
concat_17 = Concatenate(
    FragmentE=namingschema_building_name_2,
    FragmentD=namingschema_delimiter_2,
    FragmentA=namingschema_center_name_2,
    FragmentC=namingschema_delimiter_2,
    FragmentB=merge_13)  # -> graft(Result)
basebody_zone_wings_name = Text(concat_17)

concat_18 = Concatenate(
    FragmentE=namingschema_building_name_2,
    FragmentD=namingschema_delimiter_2,
    FragmentA=namingschema_center_name_2,
    FragmentC=namingschema_delimiter_2,
    FragmentG=namingschema_fassade_name_2,
    FragmentF=namingschema_delimiter_2,
    FragmentB=item.Item)
mrg_a_3 = MergeSeperatlyAppend(y=concat_18)  # -> Mrgd; inputs x: tree, y: tree; same code as mrg_a
basebody_fassade_upper_name = Text(mrg_a_3)

concat_19 = Concatenate(
    FragmentE=namingschema_building_name_2,
    FragmentD=namingschema_delimiter_2,
    FragmentA=namingschema_center_name_2,
    FragmentC=namingschema_delimiter_2,
    FragmentG=namingschema_fassade_name_2,
    FragmentF=namingschema_delimiter_2,
    FragmentB=item.Item3)
mrg_a_4 = MergeSeperatlyAppend(y=concat_19)  # -> Mrgd; inputs x: tree, y: tree; same code as mrg_a
basebody_fassade_left_name = Text(mrg_a_4)

merge_14 = Merge(Data1=item.Item1, Data2=item.Item3)

concat_20 = Concatenate(
    FragmentE=namingschema_building_name_2,
    FragmentD=namingschema_delimiter_2,
    FragmentA=namingschema_center_name_2,
    FragmentC=namingschema_delimiter_2,
    FragmentG=namingschema_fassade_name_2,
    FragmentF=namingschema_delimiter_2,
    FragmentB=item.Item2)  # -> graft(Result)
basebody_fassade_lower_name = Text(concat_20)

concat_21 = Concatenate(
    FragmentE=namingschema_building_name_2,
    FragmentD=namingschema_delimiter_2,
    FragmentA=namingschema_center_name_2,
    FragmentC=namingschema_delimiter_2,
    FragmentG=namingschema_fassade_name_2,
    FragmentF=namingschema_delimiter_2,
    FragmentB=item.Item1)  # -> graft(Result)
basebody_fassade_right_name = Text(concat_21)

concat_22 = Concatenate(FragmentE=namingschema_building_name_2, FragmentD=namingschema_delimiter_2, FragmentA=namingschema_core_name_2)  # -> graft(Result)
basebody_core_name = Text(concat_22)

concat_23 = Concatenate(FragmentE=namingschema_building_name_2, FragmentD=namingschema_delimiter_2, FragmentA=namingschema_center_name_2)  # -> graft(Result)
basebody_center_name = Text(concat_23)

concat_24 = Concatenate(
    FragmentE=namingschema_building_name_2,
    FragmentD=namingschema_delimiter_2,
    FragmentA=namingschema_wing_name_2,
    FragmentC=namingschema_delimiter_2,
    FragmentB=merge_14)  # -> graft(Result)
wings_name = Text(concat_24)

wings_name_2 = ClusterOutput(wings_name)
basebody_core_name_2 = ClusterOutput(basebody_core_name)
basebody_zone_wings_name_2 = ClusterOutput(basebody_zone_wings_name)
arms_name_2 = ClusterOutput(arms_name)
basebody_fassade_lower_name_2 = ClusterOutput(basebody_fassade_lower_name)
basebody_fassade_upper_name_2 = ClusterOutput(basebody_fassade_upper_name)
basebody_fassade_right_name_2 = ClusterOutput(basebody_fassade_right_name)
basebody_fassade_left_name_2 = ClusterOutput(basebody_fassade_left_name)
arms_fassade_left_name_2 = ClusterOutput(arms_fassade_left_name)
arms_fassade_right_name_2 = ClusterOutput(arms_fassade_right_name)
arms_fassade_lower_name_2 = ClusterOutput(arms_fassade_lower_name)
basebody_center_zones_name_2 = ClusterOutput(basebody_center_zones_name)
basebody_center_name_2 = ClusterOutput(basebody_center_name)

basebody_inside_latditudinal_numberofseg_2 = Number(basebody_inside_latditudinal_numberofseg)  # "BaseBody-Inside-Latditudinal-NumberOfSegments"
building_longitudinal_numberofsegments_2 = Number(building_longitudinal_numberofsegments)
expression_9 = Expression(x=basebody_inside_latditudinal_numberofseg_2, y=rasterlength_y_2, Expression="(2*x+1)*y")
expression_10 = Expression(x=building_longitudinal_numberofsegments_2, y=rasterlength_x_2, Expression="x*y")
building_totallength = Number(expression_10)
basebody_totalwidth = Number(expression_9)

expression_11 = Expression(x=basebody_inside_latditudinal_numberofseg_2, y=rasterlength_y_2, Expression="x*y")

basebody_zonewidth = Number(expression_11)

amp_7 = Amplitude(Vector=xvec, Amplitude=building_totallength)
amp_8 = Amplitude(Vector=yvec, Amplitude=basebody_totalwidth)
addition = Addition(A=amp_7, B=amp_8)
move = Move(Geometry=origin, Motion=addition)  # -> Geometry, Transform
move_2 = Move(Geometry=origin, Motion=amp_7)  # -> Geometry, Transform
move_3 = Move(Geometry=origin, Motion=amp_8)  # -> Geometry, Transform
basebody_corner_lower_left = Point(origin)
basebody_corner_upper_right = Point(move.Geometry)
basebody_corner_lower_right = Point(move_2.Geometry)
basebody_corner_upper_left = Point(move_3.Geometry)

dom = ConstructDomain(DomainStart=0, DomainEnd=basebody_totalwidth)
dom_2 = ConstructDomain(DomainStart=0, DomainEnd=building_totallength)
rectangle = Rectangle(Plane=baseplane_2, XSize=dom_2, YSize=dom, Radius=0)  # -> Rectangle, Length
basebody_rectangle = Rectangle(rectangle.Rectangle)

amp_9 = Amplitude(Vector=yvec, Amplitude=arm_upper_right_latitudinal_totallength)
amp_10 = Amplitude(Vector=revxvec, Amplitude=arm_upper_right_longitudinal_totallength)
addition_2 = Addition(A=amp_10, B=amp_9)
move_4 = Move(Geometry=basebody_corner_upper_right, Motion=amp_10)  # -> Geometry, Transform
move_5 = Move(Geometry=basebody_corner_upper_right, Motion=amp_9)  # -> Geometry, Transform
move_6 = Move(Geometry=basebody_corner_upper_right, Motion=addition_2)  # -> Geometry, Transform
arm_upper_right_corner_upper_right = Point(graft(move_5.Geometry))
arm_upper_right_corner_lower_right = Point(graft(basebody_corner_upper_right))
arm_upper_right_corner_lower_left = Point(graft(move_4.Geometry))
arm_upper_right_corner_upper_left = Point(graft(move_6.Geometry))
merge_15 = Merge(
    Data1=arm_upper_right_corner_lower_left,
    Data2=arm_upper_right_corner_upper_left,
    Data3=arm_upper_right_corner_upper_right,
    Data4=arm_upper_right_corner_lower_right)
merge_16 = Merge(Data1=arm_upper_right_corner_lower_left, Data2=arm_upper_right_corner_lower_right)
trim = TrimTree(Tree=merge_15, Depth=1)
trim_2 = TrimTree(Tree=merge_16, Depth=1)
pline = PolyLine(Vertices=trim, Closed=Toggle(True))
pline_2 = PolyLine(Vertices=trim_2, Closed=False)
arm_upper_left_intneral_wall = Curve(pline_2)
arm_upper_right_boundary = Curve(pline)

amp_11 = Amplitude(Vector=yvec, Amplitude=arm_upper_left_latitudinal_totallength)
amp_12 = Amplitude(Vector=xvec, Amplitude=arm_upper_left_longitudinal_totallength)
addition_3 = Addition(A=amp_12, B=amp_11)
move_7 = Move(Geometry=basebody_corner_upper_left, Motion=amp_12)  # -> Geometry, Transform
move_8 = Move(Geometry=basebody_corner_upper_left, Motion=amp_11)  # -> Geometry, Transform
move_9 = Move(Geometry=basebody_corner_upper_left, Motion=addition_3)  # -> Geometry, Transform
arm_upper_left_corner_lower_left = Point(graft(basebody_corner_upper_left))
arm_upper_left_corner_upper_right = Point(graft(move_9.Geometry))
arm_upper_left_corner_lower_right = Point(graft(move_7.Geometry))
arm_upper_left_corner_upper_left = Point(graft(move_8.Geometry))
merge_17 = Merge(
    Data1=arm_upper_left_corner_lower_left,
    Data2=arm_upper_left_corner_upper_left,
    Data3=arm_upper_left_corner_upper_right,
    Data4=arm_upper_left_corner_lower_right)
merge_18 = Merge(Data1=arm_upper_left_corner_lower_right, Data2=arm_upper_left_corner_lower_left)
trim_3 = TrimTree(Tree=merge_17, Depth=1)
trim_4 = TrimTree(Tree=merge_18, Depth=1)
pline_3 = PolyLine(Vertices=trim_3, Closed=Toggle(True))
pline_4 = PolyLine(Vertices=trim_4, Closed=False)
arm_upper_right_intneral_wall = Curve(pline_4)
arm_upper_left_boundary = Curve(pline_3)

amp_13 = Amplitude(Vector=revyvec, Amplitude=basebody_zonewidth)
amp_14 = Amplitude(Vector=revyvec, Amplitude=basebody_zonewidth)
move_10 = Move(Geometry=arm_upper_left_corner_lower_right, Motion=amp_13)  # -> Geometry, Transform
move_11 = Move(Geometry=arm_upper_right_corner_lower_left, Motion=amp_14)  # -> Geometry, Transform
basebody_zone_upper_corner_lower_right = Point(move_11.Geometry)
basebody_zone_upper_corner_lower_left = Point(move_10.Geometry)
merge_19 = Merge(
    Data1=basebody_zone_upper_corner_lower_right,
    Data2=basebody_zone_upper_corner_lower_left,
    Data3=arm_upper_left_corner_lower_right,
    Data4=arm_upper_right_corner_lower_left)
trim_5 = TrimTree(Tree=merge_19, Depth=1)
pline_5 = PolyLine(Vertices=trim_5, Closed=Toggle(True))
basebody_zone_upper_boundary = Curve(pline_5)

amp_15 = Amplitude(Vector=revyvec, Amplitude=arm_lower_left_latitudinal_totallength)
amp_16 = Amplitude(Vector=xvec, Amplitude=arm_lower_left_longitudinal_totallength)
addition_4 = Addition(A=amp_16, B=amp_15)
move_12 = Move(Geometry=basebody_corner_lower_left, Motion=amp_16)  # -> Geometry, Transform
move_13 = Move(Geometry=basebody_corner_lower_left, Motion=amp_15)  # -> Geometry, Transform
move_14 = Move(Geometry=basebody_corner_lower_left, Motion=addition_4)  # -> Geometry, Transform
arm_lower_left_corner_upper_right = Point(graft(move_12.Geometry))
arm_lower_left_corner_lower_left = Point(graft(move_13.Geometry))
arm_lower_left_corner_upper_left = Point(graft(basebody_corner_lower_left))
arm_lower_left_corner_lower_right = Point(graft(move_14.Geometry))
merge_20 = Merge(
    Data1=arm_lower_left_corner_upper_right,
    Data2=arm_lower_left_corner_lower_right,
    Data3=arm_lower_left_corner_lower_left,
    Data4=arm_lower_left_corner_upper_left)
merge_21 = Merge(Data1=arm_lower_left_corner_upper_right, Data2=arm_lower_left_corner_upper_left)
trim_6 = TrimTree(Tree=merge_20, Depth=1)
trim_7 = TrimTree(Tree=merge_21, Depth=1)
pline_6 = PolyLine(Vertices=trim_6, Closed=Toggle(True))
pline_7 = PolyLine(Vertices=trim_7, Closed=False)
arm_lower_left_intneral_wall = Curve(pline_7)
arm_lower_left_boundary = Curve(pline_6)

amp_17 = Amplitude(Vector=revyvec, Amplitude=arm_lower_right_latitudinal_totallength)
amp_18 = Amplitude(Vector=revxvec, Amplitude=arm_lower_right_longitudinal_totallength)
addition_5 = Addition(A=amp_18, B=amp_17)
move_15 = Move(Geometry=basebody_corner_lower_right, Motion=amp_18)  # -> Geometry, Transform
move_16 = Move(Geometry=basebody_corner_lower_right, Motion=amp_17)  # -> Geometry, Transform
move_17 = Move(Geometry=basebody_corner_lower_right, Motion=addition_5)  # -> Geometry, Transform
arm_lower_right_corner_upper_right = Point(graft(basebody_corner_lower_right))
arm_lower_right_corner_lower_right = Point(graft(move_16.Geometry))
arm_lower_right_corner_lower_left = Point(graft(move_17.Geometry))
arm_lower_right_corner_upper_left = Point(graft(move_15.Geometry))
merge_22 = Merge(
    Data1=arm_lower_right_corner_upper_right,
    Data2=arm_lower_right_corner_lower_right,
    Data3=arm_lower_right_corner_lower_left,
    Data4=arm_lower_right_corner_upper_left)
merge_23 = Merge(Data1=arm_lower_right_corner_upper_left, Data2=arm_lower_right_corner_upper_right)
trim_8 = TrimTree(Tree=merge_22, Depth=1)
trim_9 = TrimTree(Tree=merge_23, Depth=1)
pline_8 = PolyLine(Vertices=trim_8, Closed=Toggle(True))
pline_9 = PolyLine(Vertices=trim_9, Closed=False)
arm_lower_right_boundary = Curve(pline_8)
arm_lower_right_intneral_wall = Curve(pline_9)

amp_19 = Amplitude(Vector=yvec, Amplitude=basebody_zonewidth)
amp_20 = Amplitude(Vector=yvec, Amplitude=basebody_zonewidth)
trim_10 = TrimTree(Tree=arm_lower_right_corner_upper_left, Depth=1)
trim_11 = TrimTree(Tree=arm_lower_left_corner_upper_right, Depth=1)
move_18 = Move(Geometry=trim_11, Motion=amp_19)  # -> Geometry, Transform
move_19 = Move(Geometry=trim_10, Motion=amp_20)  # -> Geometry, Transform
basebody_zone_lower_corner_lower_right = Point(graft(move_19.Geometry))
basebody_zone_lower_corner_lower_left = Point(graft(move_18.Geometry))
merge_24 = Merge(
    Data1=arm_lower_right_corner_upper_left,
    Data2=arm_lower_left_corner_upper_right,
    Data3=basebody_zone_lower_corner_lower_left,
    Data4=basebody_zone_lower_corner_lower_right)
trim_12 = TrimTree(Tree=merge_24, Depth=1)
pline_10 = PolyLine(Vertices=trim_12, Closed=Toggle(True))
basebody_zone_lower_boundary = Curve(pline_10)
merge_25 = Merge(Data1=basebody_zone_lower_boundary, Data2=basebody_zone_upper_boundary)  # -> graft(Result)
basebody_center_zones_boundary = Curve(merge_25)

merge_26 = Merge(Data1=arm_lower_right_corner_lower_left, Data2=arm_lower_right_corner_upper_left)
merge_27 = Merge(Data1=arm_lower_right_corner_upper_right, Data2=arm_lower_right_corner_lower_right)
merge_28 = Merge(Data1=arm_lower_right_corner_lower_right, Data2=arm_lower_right_corner_lower_left)
trim_13 = TrimTree(Tree=merge_27, Depth=1)
trim_14 = TrimTree(Tree=merge_28, Depth=1)
trim_15 = TrimTree(Tree=merge_26, Depth=1)
pline_11 = PolyLine(Vertices=trim_13, Closed=False)
pline_12 = PolyLine(Vertices=trim_14, Closed=False)
pline_13 = PolyLine(Vertices=trim_15, Closed=False)
arm_lower_right_fassade_lower = Curve(pline_12)
arm_lower_right_fassade_left = Curve(pline_13)
arm_lower_right_fassade_right = Curve(pline_11)

merge_29 = Merge(Data1=arm_upper_right_corner_upper_right, Data2=arm_upper_right_corner_lower_right)
merge_30 = Merge(Data1=arm_upper_right_corner_upper_left, Data2=arm_upper_right_corner_upper_right)
merge_31 = Merge(Data1=arm_upper_right_corner_lower_left, Data2=arm_upper_right_corner_upper_left)
trim_16 = TrimTree(Tree=merge_29, Depth=1)
trim_17 = TrimTree(Tree=merge_30, Depth=1)
trim_18 = TrimTree(Tree=merge_31, Depth=1)
pline_14 = PolyLine(Vertices=trim_16, Closed=False)
pline_15 = PolyLine(Vertices=trim_17, Closed=False)
pline_16 = PolyLine(Vertices=trim_18, Closed=False)
arm_upper_right_fassade_left = Curve(pline_16)
arm_upper_right_fassade_right = Curve(pline_14)
arm_upper_right_fassade_upper = Curve(pline_15)

merge_32 = Merge(Data1=arm_lower_left_corner_lower_right, Data2=arm_lower_left_corner_lower_left)
merge_33 = Merge(Data1=arm_lower_left_corner_upper_right, Data2=arm_lower_left_corner_lower_right)
merge_34 = Merge(Data1=arm_lower_left_corner_lower_left, Data2=arm_lower_left_corner_upper_left)
trim_19 = TrimTree(Tree=merge_33, Depth=1)
trim_20 = TrimTree(Tree=merge_32, Depth=1)
trim_21 = TrimTree(Tree=merge_34, Depth=1)
pline_17 = PolyLine(Vertices=trim_19, Closed=False)
pline_18 = PolyLine(Vertices=trim_20, Closed=False)
pline_19 = PolyLine(Vertices=trim_21, Closed=False)
arm_lower_left_fassade_right = Curve(pline_17)
arm_lower_left_fassade_lower = Curve(pline_18)
arm_lower_left_fassade_left = Curve(pline_19)

merge_35 = Merge(Data1=arm_upper_left_corner_lower_left, Data2=arm_upper_left_corner_upper_left)
merge_36 = Merge(Data1=arm_upper_left_corner_upper_left, Data2=arm_upper_left_corner_upper_right)
merge_37 = Merge(Data1=arm_upper_left_corner_upper_right, Data2=arm_upper_left_corner_lower_right)
trim_22 = TrimTree(Tree=merge_35, Depth=1)
trim_23 = TrimTree(Tree=merge_36, Depth=1)
trim_24 = TrimTree(Tree=merge_37, Depth=1)
pline_20 = PolyLine(Vertices=trim_22, Closed=False)
pline_21 = PolyLine(Vertices=trim_23, Closed=False)
pline_22 = PolyLine(Vertices=trim_24, Closed=False)
arm_upper_left_fassade_left = Curve(pline_20)
arm_upper_left_fassade_upper = Curve(pline_21)
arm_upper_fassade_right = Curve(pline_22)

merge_38 = Merge(
    Data1=arm_lower_right_corner_upper_right,
    Data2=arm_lower_right_corner_upper_left,
    Data3=arm_upper_right_corner_lower_left,
    Data4=arm_upper_right_corner_lower_right)
trim_25 = TrimTree(Tree=merge_38, Depth=1)
pline_23 = PolyLine(Vertices=trim_25, Closed=Toggle(True))
basebody_right_boundary = Curve(pline_23)

merge_39 = Merge(
    Data1=arm_lower_left_corner_upper_right,
    Data2=arm_lower_left_corner_upper_left,
    Data3=arm_upper_left_corner_lower_left,
    Data4=arm_upper_left_corner_lower_right)
trim_26 = TrimTree(Tree=merge_39, Depth=1)
pline_24 = PolyLine(Vertices=trim_26, Closed=Toggle(True))
basebody_left_boundary = Curve(pline_24)

srf4pt = _4PointSurface(
    CornerA=arm_lower_left_corner_upper_right,
    CornerB=arm_lower_right_corner_upper_left,
    CornerC=arm_lower_right_corner_lower_left,
    CornerD=arm_lower_left_corner_lower_right)
srf4pt_2 = _4PointSurface(
    CornerA=arm_upper_left_corner_upper_right,
    CornerB=arm_upper_left_corner_lower_right,
    CornerC=arm_upper_right_corner_lower_left,
    CornerD=arm_upper_right_corner_upper_left)
courtyard_upper = Surface(srf4pt_2)
courtyard_lower = Surface(srf4pt)

merge_40 = Merge(
    Data1=arm_lower_right_corner_lower_right,
    Data2=arm_lower_right_corner_lower_left,
    Data3=arm_upper_right_corner_upper_left,
    Data4=arm_upper_right_corner_upper_right)
trim_27 = TrimTree(Tree=merge_40, Depth=1)
pline_25 = PolyLine(Vertices=trim_27, Closed=Toggle(True))
wing_left_boundary = Curve(pline_25)

merge_41 = Merge(
    Data1=arm_lower_left_corner_lower_right,
    Data2=arm_lower_left_corner_lower_left,
    Data3=arm_upper_left_corner_upper_left,
    Data4=arm_upper_left_corner_upper_right)
trim_28 = TrimTree(Tree=merge_41, Depth=1)
pline_26 = PolyLine(Vertices=trim_28, Closed=Toggle(True))
wing_right_boundary = Curve(pline_26)

merge_42 = Merge(
    Data1=arm_lower_right_intneral_wall,
    Data2=arm_lower_left_intneral_wall,
    Data3=arm_upper_right_intneral_wall,
    Data4=arm_upper_left_intneral_wall)  # -> graft(Result)

merge_43 = Merge(Data1=arm_upper_left_corner_lower_right, Data2=arm_upper_right_corner_lower_left)
trim_29 = TrimTree(Tree=merge_43, Depth=1)
pline_27 = PolyLine(Vertices=trim_29, Closed=False)
mrg_a_5 = MergeSeperatlyAppend(y=pline_27)  # -> Mrgd; inputs x: tree, y: tree; same code as mrg_a
basebody_fassade_upper_line = Curve(mrg_a_5)

arm_lower_intneral_walls = Curve(merge_42)

merge_44 = Merge(Data1=arm_lower_left_corner_upper_left, Data2=arm_upper_left_corner_lower_left)
trim_30 = TrimTree(Tree=merge_44, Depth=1)
pline_28 = PolyLine(Vertices=trim_30, Closed=False)
mrg_a_6 = MergeSeperatlyAppend(y=pline_28)  # -> Mrgd; inputs x: tree, y: tree; same code as mrg_a
basebody_fassade_left_line = Curve(mrg_a_6)

merge_45 = Merge(Data1=arm_lower_right_corner_upper_left, Data2=arm_lower_left_corner_upper_right)
trim_31 = TrimTree(Tree=merge_45, Depth=1)
pline_29 = PolyLine(Vertices=trim_31, Closed=False)  # -> graft(Polyline)
basebody_fassade_lower_line = Curve(pline_29)

merge_46 = Merge(
    Data1=basebody_zone_lower_corner_lower_right,
    Data2=basebody_zone_lower_corner_lower_left,
    Data3=basebody_zone_upper_corner_lower_left,
    Data4=basebody_zone_upper_corner_lower_right)
trim_32 = TrimTree(Tree=merge_46, Depth=1)
pline_30 = PolyLine(Vertices=trim_32, Closed=Toggle(True))
basebody_core_boundary = Curve(pline_30)

merge_47 = Merge(Data1=arm_lower_right_corner_upper_right, Data2=arm_upper_right_corner_lower_right)
trim_33 = TrimTree(Tree=merge_47, Depth=1)
pline_31 = PolyLine(Vertices=trim_33, Closed=False)  # -> graft(Polyline)
basebody_fassade_right_line = Curve(pline_31)

toggle = BooleanToggle(True)
merge_48 = Merge(
    Data1=arm_lower_right_corner_upper_left,
    Data2=arm_lower_left_corner_upper_right,
    Data3=arm_upper_left_corner_lower_right,
    Data4=arm_upper_right_corner_lower_left)
pline_32 = PolyLine(Vertices=merge_48, Closed=toggle)
basebody_center_boundary = Curve(pline_32)

merge_49 = Merge(Data1=arm_lower_left_corner_upper_right, Data2=basebody_zone_lower_corner_lower_left)
merge_50 = Merge(Data1=arm_upper_right_corner_lower_left, Data2=basebody_zone_upper_corner_lower_right)
merge_51 = Merge(Data1=arm_lower_right_corner_upper_left, Data2=basebody_zone_lower_corner_lower_right)
merge_52 = Merge(Data1=arm_upper_left_corner_lower_right, Data2=basebody_zone_upper_corner_lower_left)
pline_33 = PolyLine(Vertices=merge_49, Closed=toggle)
pline_34 = PolyLine(Vertices=merge_50, Closed=toggle)
pline_35 = PolyLine(Vertices=merge_51, Closed=toggle)
pline_36 = PolyLine(Vertices=merge_52, Closed=toggle)
merge_53 = Merge(Data1=pline_33, Data2=pline_36, Data3=pline_34, Data4=pline_35)  # -> graft(Result)
basebody_center_internal_walls = Curve(merge_53)

mrg_a_7 = MergeSeperatlyAppend(y=arm_upper_left_fassade_upper)  # -> Mrgd; inputs x: tree, y: tree; same code as mrg_a
mrg_a_8 = MergeSeperatlyAppend(y=arm_upper_right_fassade_upper)  # -> Mrgd; inputs x: tree, y: tree; same code as mrg_a
merge_54 = Merge(Data1=mrg_a_7, Data2=mrg_a_8)  # -> graft(Result)
arms_fassade_upper_line = Curve(merge_54)

mrg_a_9 = MergeSeperatlyAppend(y=arm_upper_right_fassade_left)  # -> Mrgd; inputs x: tree, y: tree; same code as mrg_a
mrg_a_10 = MergeSeperatlyAppend(y=arm_upper_left_fassade_left)  # -> Mrgd; inputs x: tree, y: tree; same code as mrg_a
merge_55 = Merge(Data1=graft(arm_lower_right_fassade_left), Data2=graft(arm_lower_left_fassade_left), Data3=mrg_a_10, Data4=mrg_a_9)  # -> graft(Result)
arms_fassade_left_line = Curve(merge_55)

mrg_a_11 = MergeSeperatlyAppend(y=arm_upper_right_fassade_right)  # -> Mrgd; inputs x: tree, y: tree; same code as mrg_a
mrg_a_12 = MergeSeperatlyAppend(y=arm_upper_fassade_right)  # -> Mrgd; inputs x: tree, y: tree; same code as mrg_a
merge_56 = Merge(Data1=graft(arm_lower_right_fassade_right), Data2=graft(arm_lower_left_fassade_right), Data3=mrg_a_12, Data4=mrg_a_11)  # -> graft(Result)
arms_fassade_right_line = Curve(merge_56)

merge_57 = Merge(Data1=basebody_right_boundary, Data2=basebody_left_boundary)  # -> graft(Result)
basebody_zone_wings_boundary = Curve(merge_57)

merge_58 = Merge(Data1=graft(arm_lower_right_fassade_lower), Data2=graft(arm_lower_left_fassade_lower))  # -> graft(Result)
arms_fassade_lower_line = Curve(merge_58)

merge_59 = Merge(Data1=wing_right_boundary, Data2=wing_left_boundary)  # -> graft(Result)
wings_boundary = Curve(merge_59)

arm_lower_intneral_walls_2 = Curve(arm_lower_intneral_walls)
courtyard_upper_2 = Surface(courtyard_upper)
courtyard_lower_2 = Surface(courtyard_lower)
wings_boundary_2 = ClusterOutput(wings_boundary)
basebody_core_boundary_2 = ClusterOutput(basebody_core_boundary)
basebody_zone_wings_boundary_2 = ClusterOutput(basebody_zone_wings_boundary)
basebody_fassade_lower_line_2 = ClusterOutput(basebody_fassade_lower_line)
basebody_fassade_upper_line_2 = ClusterOutput(basebody_fassade_upper_line)
basebody_fassade_right_line_2 = ClusterOutput(basebody_fassade_right_line)
basebody_fassade_left_line_2 = ClusterOutput(basebody_fassade_left_line)
arms_fassade_left_line_2 = ClusterOutput(arms_fassade_left_line)
arms_fassade_right_line_2 = ClusterOutput(arms_fassade_right_line)
arms_fassade_lower_line_2 = ClusterOutput(arms_fassade_lower_line)
basebody_center_zones_boundary_2 = ClusterOutput(basebody_center_zones_boundary)
basebody_center_internal_walls_2 = ClusterOutput(basebody_center_internal_walls)
courtyard_upper_3 = ClusterOutput(courtyard_upper_2)
basebody_center_boundary_2 = ClusterOutput(basebody_center_boundary)
arm_lower_intneral_walls_3 = ClusterOutput(arm_lower_intneral_walls_2)
courtyard_lower_3 = ClusterOutput(courtyard_lower_2)
arms_fassade_upper_line_2 = ClusterOutput(arms_fassade_upper_line)

merge_60 = Merge(Data1=graft(arm_lower_right_boundary), Data2=graft(arm_lower_left_boundary))  # -> graft(Result)
mrg_a_13 = MergeSeperatlyAppend(y=arm_upper_right_boundary)  # -> Mrgd; inputs x: tree, y: tree; same code as mrg_a
mrg_a_14 = MergeSeperatlyAppend(y=arm_upper_left_boundary)  # -> Mrgd; inputs x: tree, y: tree; same code as mrg_a
merge_61 = Merge(Data1=mrg_a_13, Data2=mrg_a_14)  # -> graft(Result)
arms_upper_boundary = Curve(merge_61)

arms_lower_boundary = Curve(merge_60)

merge_62 = Merge(Data1=arms_lower_boundary, Data2=arms_upper_boundary)
arms_boundary = Curve(merge_62)

arms_boundary_2 = ClusterOutput(arms_boundary)

merge_63 = Merge(Data1=item.Item3, Data2=item.Item1)
concat_25 = Concatenate(
    FragmentD=namingschema_building_name_2,
    FragmentE=namingschema_delimiter_2,
    FragmentA=namingschema_arm_name_2,
    FragmentC=namingschema_delimiter_2,
    FragmentB=item.Item)

mrg_a_15 = MergeSeperatlyAppend(y=concat_25)  # -> Mrgd; inputs x: tree, y: tree; same code as mrg_a

concat_26 = Concatenate(FragmentA=mrg_a_15, FragmentC=namingschema_delimiter_2, FragmentB=merge_63)  # -> graft(Result)
concat_27 = Concatenate(
    FragmentA=concat_26,
    FragmentD=namingschema_delimiter_2,
    FragmentE=namingschema_fassade_name_2,
    FragmentB=namingschema_delimiter_2,
    FragmentC=item.Item)
arms_fassade_upper_name = Text(concat_27)

arms_fassade_upper_name_2 = ClusterOutput(arms_fassade_upper_name)

merge_64 = Merge(
    Data1=arm_lower_left_corner_lower_left,
    Data2=arm_lower_left_corner_upper_left,
    Data3=merge_17,
    Data4=merge_15,
    Data5=merge_22,
    Data6=arm_lower_left_corner_upper_right,
    Data7=arm_lower_left_corner_lower_right)

trim_34 = TrimTree(Tree=merge_64, Depth=1)

pline_37 = PolyLine(Vertices=trim_34, Closed=Toggle(True))
boundary = Curve(pline_37)

boundary_2 = ClusterOutput(boundary)

# ==== cluster Windows
baseplane = ClusterInput()
walls = ClusterInput()
floorheight = ClusterInput()
parapetheight = ClusterInput()
windowheight = ClusterInput()
windowwidth = ClusterInput()
offsettosides = ClusterInput()
constructionmethod = ClusterInput()
windowtowall_perimeter = ClusterInput()
windowtype = ClusterInput()
baseplane_2 = Plane(baseplane)
walls_2 = Curve(walls)
floorheight_2 = Number(floorheight)
parapetheight_2 = Number(parapetheight)
windowheight_2 = Number(windowheight)
windowwidth_2 = Number(windowwidth)
offsettosides_2 = Number(offsettosides)
constructionmethod_2 = Integer(constructionmethod)
windowtowall_perimeter_2 = Number(windowtowall_perimeter)
windowtype_2 = Integer(windowtype)
mtchanc = MatchAncestor(AT=baseplane_2, CT=walls_2)  # -> MAT; inputs AT: tree, CT: tree
# ---------- mtchanc: Python ----------
if ghenv.Component.RunCount<2:
    __author__ = "Ueli Saluz"
    __version__ = "2000.00.00"
    
    ghenv.Component.Name = "Match Ancestor"
    ghenv.Component.NickName = "MtchAnc"
    ghenv.Component.Description = "Duplicates all elements of an ancestor tree to match the amount of elements in the child tree. If the ancestor branch and the child branch are from the same generation simply the ancestor stays unmodified. "
    
    ghenv.Component.Message = "VER 1.0"
    
    ghenv.Component.Params.Input[0].Name = "AncestorTree"
    ghenv.Component.Params.Input[0].NickName = "AT"
    ghenv.Component.Params.Input[0].Description = "Ancestor tree that data will the duplicated until it matches the child tree"
    ghenv.Component.Params.Input[0].Optional = False
    
    ghenv.Component.Params.Input[1].Name = "ChildTree"
    ghenv.Component.Params.Input[1].NickName = "CT"
    ghenv.Component.Params.Input[1].Description = "Child tree that branches will the guide to duplicat the data of the ancestor tree"
    ghenv.Component.Params.Input[0].Optional = False
    
    ghenv.Component.Params.Output[0].Name = "MatchedAncestorTree"
    ghenv.Component.Params.Output[0].NickName = "MAT"
    ghenv.Component.Params.Output[0].Description = "Matched ancestor tree with the amount of items and the branch paths of the child tree"

from System import Object
from Grasshopper import DataTree

"""Returns a new tree with the ancestor data being duplicated along all child branches which where child paths of that ancestor. If the ancestor branch and the child branch are from the same generation simply the ancestor stays unmodified. 
    Inputs:
        ancestorTree: Ancestor tree that data will the duplicated until it matches the child tree
        childTree: Child tree that branches will the guide to duplicat the data of the ancestor tree
    Output:
        matchedAncestorTree: Matched ancestor tree with the amount of items and the branch paths of the child tree"""
def MatchAncestorTreeToChildTree (ancestorTree, childTree):
    
    matchedAncestorTree = DataTree[Object]()
    dummy = 0
    for i,pathAncestor in enumerate(ancestorTree.Paths):
        branch = ancestorTree.Branch(pathAncestor)
        if len(branch)!=1:
            raise Exception("Ancestor must be grafted and containing one item per branch")
        #The item to be duplicated
        item = branch[0]
        for j,pathChild in enumerate(childTree.Paths):
            #Returns a tuple and not like in the documentation described a bool with a pointer to the int to store the generations
            checkAncestor = pathChild.IsAncestor(pathAncestor,dummy)
            if(pathChild==pathAncestor or checkAncestor[0]):
                matchedAncestorTree.Add(item,pathChild)
    return matchedAncestorTree

if __name__ == "__main__":
    MAT = MatchAncestorTreeToChildTree (AT,CT)
# ---------- end mtchanc ----------
len = Length(Curve=walls_2)
expression = Expression(x=len, u=offsettosides_2, Expression="x-2*u")
expression_2 = Expression(x=expression, y=windowwidth_2, z=windowtowall_perimeter_2, Expression="Floor((x*z)/y)")
weightedsubdomains = WeightedSubdomains(Divisor=expression_2)  # -> SubdomainValues, Subdomains; inputs Divisor: tree of Int32, Multiplier: tree, Domain: tree, Fill: Boolean, FillMultiplier: tree, FillEnds: Boolean, AbsoluteFill: Boolean; same code as weightedsubdomains
domnprop = DomainProperties(Domain=weightedsubdomains.Subdomains)  # -> AMean, AMean_2
# ---------- domnprop: Python ----------
if ghenv.Component.RunCount<2:
    __author__ = "Ueli Saluz"
    __version__ = "2021.11.13"
    
    ghenv.Component.Name = "DomainProperties"
    ghenv.Component.NickName = "DomnProp"
    ghenv.Component.Description = "Returns the properties of a domain."
    ghenv.Component.Message = "VER 1.0"
    
    ghenv.Component.Params.Input[0].NickName = "Domain"
    ghenv.Component.Params.Input[0].Description = "Domain to evaluate properties"
    
    ghenv.Component.Params.Output[0].NickName = "Length"
    ghenv.Component.Params.Output[0].Description = "Length of domain"
    
    ghenv.Component.Params.Output[0].NickName = "AMean"
    ghenv.Component.Params.Output[0].Description = "Arithmetic mean of the domain"


Length = Domain.Length
AMean = (Domain.T0+Domain.T1)/2
# ---------- end domnprop ----------
createwallswithopenings = CreateWallsWithOpenings(
    baseplane=mtchanc,
    referencecurvewall=walls_2,
    wallheigth=floorheight_2,
    openingheight=windowheight_2,
    openingwidth=windowwidth_2,
    parapet_height=parapetheight_2,
    offsettosides=offsettosides_2,
    placement=domnprop.AMean_2,
    constructionmethod=constructionmethod_2)  # -> referencecurvewall_4, displayboundary_2, windows_2, doors_2, windowspointsonreferencecurve_2, doorspointsonreferencecurve_2
window_band = WindowBand(
    baseplane=mtchanc,
    walls=walls_2,
    parapetheight=parapetheight_2,
    windowheight=windowheight_2,
    spacingtocorner=offsettosides_2)

trim = TrimTree(Tree=createwallswithopenings.windows_2, Depth=1)
null = NullItem(Item=createwallswithopenings.windows_2)  # -> NullFlags, InvalidFlags, Description
area = Area(Geometry=trim)  # -> Area, Centroid
area_2 = Area(Geometry=createwallswithopenings.displayboundary_2)  # -> Area, Centroid
ma = MassAddition(Input=area.Area)  # -> Result, PartialResults
tstat = TreeStatistics(Tree=trim)  # -> Paths, graft(Length), Count
expression_3 = Expression(x=ma.Result, y=area_2.Area, Expression="x/y")
mtchanc_2 = MatchAncestor(AT="0", CT=createwallswithopenings.displayboundary_2)  # -> MAT; inputs AT: tree, CT: tree; same code as mtchanc
match = MatchTree(Tree=tstat.Length, Guide=expression_3)
expression_4 = Expression(x=match, y=expression_3, z=mtchanc_2, Expression="If(x≠0,y,z)")

area_3 = Area(Geometry=window_band)  # -> Area, Centroid
expression_5 = Expression(x=area_3.Area, y=area_2.Area, Expression="x/y")
filter = StreamFilter(Gate=windowtype_2, Stream0=createwallswithopenings.windows_2, Stream1=graft(window_band))
filter_2 = StreamFilter(Gate=windowtype_2, Stream0=expression_4, Stream1=expression_5)
windowtowallratio = Number(filter_2)
wall = Curve(createwallswithopenings.displayboundary_2)
windows = Curve(filter)
windowspointsonreferencecurve = Point(createwallswithopenings.windowspointsonreferencecurve_2)
wall_2 = ClusterOutput(wall)
windows_2 = ClusterOutput(windows)
windowtowallratio_2 = ClusterOutput(windowtowallratio)
windowspointsonreferencecurve_2 = ClusterOutput(windowspointsonreferencecurve)

# ==== cluster AdjustTree
arm_data = ClusterInput()
arm_data_2 = Data(arm_data)
tstat = TreeStatistics(Tree=arm_data_2)  # -> Paths, Length, Count
dpath = DeconstructPath(Branch=tstat.Paths)
lito3p = ListInto3Parts(ListToSlice=dpath, EndIndex="-2")  # -> FilteredList, ItemsBefore, ItemsAfter; inputs ListToSlice: tree, StartIndex: tree of Int32, EndIndex: tree of Int32; same code as lito3p
item = ListItem(List=lito3p.ItemsAfter, Index=0, Wrap=True)  # -> Item, Item1
concat = Concatenate(FragmentA=item.Item, FragmentB=item.Item1)
b2d = BinaryToDecimal(Binary=concat)  # -> Decimal
# ---------- b2d: Python ----------
if ghenv.Component.RunCount<2:
    __author__ = "Ueli Saluz"
    __version__ = "2021.11.14"
    
    ghenv.Component.Name = "BinaryToDecimal"
    ghenv.Component.NickName = "B2D"
    ghenv.Component.Description = "Converts a number in binary representation to a number in decimal representation."
    ghenv.Component.Message = "VER 1.0"
    
    ghenv.Component.Params.Input[0].NickName = "Binary"
    
    ghenv.Component.Params.Input[0].Description = "Binary representation of a number."
    
    ghenv.Component.Params.Output[0].NickName = "Decimal"
    
    ghenv.Component.Params.Output[0].Description = "Converted decimal representation of the same number."

if __name__ == "__main__":
    Decimal = int(Binary,2)
# ---------- end b2d ----------
expression = Expression(x=b2d, Expression="x+5")
merge = Merge(Data1=lito3p.FilteredList, Data2=expression)
path = ConstructPath(Indices=merge)  # -> flatten(Branch)
relblbrch = RelabelBranches(TreeToMatch=arm_data_2, ListOfPaths=path)  # -> RelabeledTree; inputs TreeToMatch: tree, ListOfPaths: list
# ---------- relblbrch: Python ----------
if ghenv.Component.RunCount<2:
    __author__ = "Your name"
    __version__ = "2000.00.00"
    
    ghenv.Component.Name = "RelabelBranches"
    ghenv.Component.NickName = "ReLblBrch"
    ghenv.Component.Description = "Relabel all the paths of the branches with a list of new paths. The amount of branches must match with the size of the list of pahts"
    ghenv.Component.Message = "VER 1.0"
    
    ghenv.Component.Params.Input[0].NickName = "TreeToMatch"
    ghenv.Component.Params.Input[1].NickName = "ListOfPaths"
    
    ghenv.Component.Params.Input[0].Description = "Tree that should be relabeled."
    ghenv.Component.Params.Input[1].Description = "List of paths to use for new branch paths."
    
    ghenv.Component.Params.Output[0].NickName = "RelabeledTree"
    ghenv.Component.Params.Output[0].Description = "Relabeled tree where all the paths of the branches have been replaced with new paths."

from System import Object
from Grasshopper import DataTree

def relabelBranchesWithLstOfPths (tree, paths):
    newTree = DataTree[Object]()
    for i,path in enumerate(tree.Paths):
        items = tree.Branch(path)
        for data in items:
            newTree.Add(data,paths[i])
    return newTree

if __name__ == "__main__":
    RelabeledTree = relabelBranchesWithLstOfPths(TreeToMatch,ListOfPaths)
# ---------- end relblbrch ----------
arm_data_withmergedpaths = Data(relblbrch)
arm_data_withmergedpaths_2 = ClusterOutput(arm_data_withmergedpaths)

# ==== cluster FloorPlanToBuilding
namingschema_underground_name = ClusterInput()
namingschema_fassade_name = ClusterInput()
namingschema_roof_name = ClusterInput()
baseplane = ClusterInput()
numberoffloors = ClusterInput()
floor_count_underground = ClusterInput()
floorheight = ClusterInput()
courtyard_upper = ClusterInput()
courtyard_lower = ClusterInput()
zones_box = ClusterInput()
zones_name = ClusterInput()
windows_rectangle = ClusterInput()
windows_name = ClusterInput()
namingschema_floor_name = ClusterInput()
namingschema_delimiter = ClusterInput()
baseplane_2 = Plane(baseplane)
numberoffloors_2 = Number(numberoffloors)
floor_count_underground_2 = Number(floor_count_underground)
floorheight_2 = Number(floorheight)
courtyard_upper_2 = Surface(courtyard_upper)
courtyard_lower_2 = Surface(courtyard_lower)
zones_box_2 = Brep(zones_box)
tstat = TreeStatistics(Tree=zones_box_2)  # -> Paths, Length, Count
zones_name_2 = Text(zones_name)
windows_rectangle_2 = Curve(windows_rectangle)
windows_name_2 = Text(windows_name)
namingschema_floor_name_2 = Text(namingschema_floor_name)
namingschema_underground_name_2 = Text(namingschema_underground_name)
namingschema_fassade_name_2 = Text(namingschema_fassade_name)
namingschema_roof_name_2 = Text(namingschema_roof_name)
namingschema_delimiter_2 = Text(namingschema_delimiter)
lito3p = ListInto3Parts(ListToSlice=tstat.Paths, EndIndex="-4")  # -> FilteredList, ItemsBefore, ItemsAfter; inputs ListToSlice: tree, StartIndex: tree of Int32, EndIndex: tree of Int32; same code as lito3p
expression = Expression(x=numberoffloors_2, y=floorheight_2, Expression="x*y")
branch = TreeBranch(Tree=zones_box_2, Path=lito3p.FilteredList, MaintainPaths=True)
branch_2 = TreeBranch(Tree=zones_name_2, Path=lito3p.FilteredList, MaintainPaths=True)
total_height = Number(expression)

mtchanc = MatchAncestor(AT=baseplane_2, CT=branch)  # -> MAT; inputs AT: tree, CT: tree
# ---------- mtchanc: Python ----------
if ghenv.Component.RunCount<2:
    __author__ = "Ueli Saluz"
    __version__ = "2000.00.00"
    
    ghenv.Component.Name = "Match Ancestor"
    ghenv.Component.NickName = "MtchAnc"
    ghenv.Component.Description = "Duplicates all elements of an ancestor tree to match the amount of elements in the child tree."
    ghenv.Component.Message = "VER 1.0"
    
    ghenv.Component.Params.Input[0].Name = "AncestorTree"
    ghenv.Component.Params.Input[0].NickName = "AT"
    ghenv.Component.Params.Input[0].Description = "Ancestor tree that data will the duplicated until it matches the child tree"
    ghenv.Component.Params.Input[0].Optional = False
    
    ghenv.Component.Params.Input[1].Name = "ChildTree"
    ghenv.Component.Params.Input[1].NickName = "CT"
    ghenv.Component.Params.Input[1].Description = "Child tree that branches will the guide to duplicat the data of the ancestor tree"
    ghenv.Component.Params.Input[0].Optional = False
    
    ghenv.Component.Params.Output[0].Name = "MatchedAncestorTree"
    ghenv.Component.Params.Output[0].NickName = "MAT"
    ghenv.Component.Params.Output[0].Description = "Matched ancestor tree with the amount of items and the branch paths of the child tree"

from System import Object
from Grasshopper import DataTree

"""Returns a new tree with the ancestor data being duplicated along all child branches which where child paths of that ancestor.
    Inputs:
        ancestorTree: Ancestor tree that data will the duplicated until it matches the child tree
        childTree: Child tree that branches will the guide to duplicat the data of the ancestor tree
    Output:
        matchedAncestorTree: Matched ancestor tree with the amount of items and the branch paths of the child tree"""
def MatchAncestorTreeToChildTree (ancestorTree, childTree):
    
    matchedAncestorTree = DataTree[Object]()
    dummy = 0
    for i,pathAncestor in enumerate(ancestorTree.Paths):
        branch = ancestorTree.Branch(pathAncestor)
        if len(branch)!=1:
            raise Exception("Ancestor must be grafted and containing one item per branch")
        #The item to be duplicated
        item = branch[0]
        for j,pathChild in enumerate(childTree.Paths):
            #Returns a tuple and not like in the documentation described a bool with a pointer to the int to store the generations
            checkAncestor = pathChild.IsAncestor(pathAncestor,dummy)
            if(checkAncestor[0]):
                matchedAncestorTree.Add(item,pathChild)
    return matchedAncestorTree

if __name__ == "__main__":
    MAT = MatchAncestorTreeToChildTree (AT,CT)
# ---------- end mtchanc ----------
deplane = DeconstructPlane(Plane=mtchanc)  # -> Origin, XAxis, YAxis, ZAxis
pflip = FlipPlane(Plane=mtchanc, ReverseX=False, ReverseY=False, SwapAxes=True)
revxvec = Vector(expr("-x", deplane.XAxis))
revzvec = Vector(expr("-x", deplane.ZAxis))
revyvec = Vector(expr("-x", deplane.YAxis))
origin = Point(deplane.Origin)
xvec = Vector(deplane.XAxis)
yvec = Vector(deplane.YAxis)
zvec = Vector(deplane.ZAxis)

mtchanc_2 = MatchAncestor(AT=baseplane_2, CT=zones_box_2)  # -> MAT; inputs AT: tree, CT: tree; same code as mtchanc
deplane_2 = DeconstructPlane(Plane=mtchanc_2)  # -> Origin, XAxis, YAxis, ZAxis
pflip_2 = FlipPlane(Plane=mtchanc_2, ReverseX=False, ReverseY=False, SwapAxes=True)
revxvec_2 = Vector(expr("-x", deplane_2.XAxis))
revzvec_2 = Vector(expr("-x", deplane_2.ZAxis))
revyvec_2 = Vector(expr("-x", deplane_2.YAxis))
origin_2 = Point(deplane_2.Origin)
xvec_2 = Vector(deplane_2.XAxis)
yvec_2 = Vector(deplane_2.YAxis)
zvec_2 = Vector(deplane_2.ZAxis)

mtchanc_3 = MatchAncestor(AT=baseplane_2, CT=windows_rectangle_2)  # -> MAT; inputs AT: tree, CT: tree; same code as mtchanc
deplane_3 = DeconstructPlane(Plane=mtchanc_3)  # -> Origin, XAxis, YAxis, ZAxis
pflip_3 = FlipPlane(Plane=mtchanc_3, ReverseX=False, ReverseY=False, SwapAxes=True)
revxvec_3 = Vector(expr("-x", deplane_3.XAxis))
revzvec_3 = Vector(expr("-x", deplane_3.ZAxis))
revyvec_3 = Vector(expr("-x", deplane_3.YAxis))
origin_3 = Point(deplane_3.Origin)
xvec_3 = Vector(deplane_3.XAxis)
yvec_3 = Vector(deplane_3.YAxis)
zvec_3 = Vector(deplane_3.ZAxis)

mtchanc_4 = MatchAncestor(AT=baseplane_2, CT=courtyard_upper_2)  # -> MAT; inputs AT: tree, CT: tree; same code as mtchanc
deplane_4 = DeconstructPlane(Plane=mtchanc_4)  # -> Origin, XAxis, YAxis, ZAxis
pflip_4 = FlipPlane(Plane=mtchanc_4, ReverseX=False, ReverseY=False, SwapAxes=True)
revxvec_4 = Vector(expr("-x", deplane_4.XAxis))
revzvec_4 = Vector(expr("-x", deplane_4.ZAxis))
revyvec_4 = Vector(expr("-x", deplane_4.YAxis))
xvec_4 = Vector(deplane_4.XAxis)
yvec_4 = Vector(deplane_4.YAxis)
origin_4 = Point(deplane_4.Origin)
zvec_4 = Vector(deplane_4.ZAxis)

amp = Amplitude(Vector=revxvec, Amplitude=1)
amp_2 = Amplitude(Vector=revyvec, Amplitude=1)
amp_3 = Amplitude(Vector=revzvec, Amplitude=1)
amp_4 = Amplitude(Vector=xvec_2, Amplitude=1)
amp_5 = Amplitude(Vector=yvec_2, Amplitude=1)
amp_6 = Amplitude(Vector=zvec_2, Amplitude=1)
amp_7 = Amplitude(Vector=revxvec_2, Amplitude=1)
amp_8 = Amplitude(Vector=revyvec_2, Amplitude=1)
amp_9 = Amplitude(Vector=xvec, Amplitude=1)
amp_10 = Amplitude(Vector=yvec, Amplitude=1)
amp_11 = Amplitude(Vector=zvec, Amplitude=1)
amp_12 = Amplitude(Vector=xvec_3, Amplitude=1)
amp_13 = Amplitude(Vector=yvec_3, Amplitude=1)
amp_14 = Amplitude(Vector=zvec_3, Amplitude=1)
amp_15 = Amplitude(Vector=revxvec_3, Amplitude=1)
amp_16 = Amplitude(Vector=revyvec_3, Amplitude=1)
amp_17 = Amplitude(Vector=revzvec_3, Amplitude=1)
amp_18 = Amplitude(Vector=xvec_4, Amplitude=1)
amp_19 = Amplitude(Vector=yvec_4, Amplitude=1)
amp_20 = Amplitude(Vector=zvec_4, Amplitude=1)
amp_21 = Amplitude(Vector=revxvec_4, Amplitude=1)
amp_22 = Amplitude(Vector=revyvec_4, Amplitude=1)
amp_23 = Amplitude(Vector=revzvec_4, Amplitude=1)

amp_24 = Amplitude(Vector=revzvec, Amplitude=floorheight_2)
move = Move(Geometry=branch, Motion=amp_24)  # -> Geometry, Transform
arrlinear = LinearArray(Geometry=move.Geometry, Direction=amp_24, Count=floor_count_underground_2)  # -> Geometry, Transform
trim = TrimTree(Tree=arrlinear.Geometry, Depth=1)  # -> graft(Tree)
zones_underground = Brep(trim)

amp_25 = Amplitude(Vector=zvec_4, Amplitude=total_height)
extr = Extrude(Base=courtyard_upper_2, Direction=amp_25)
extr_2 = Extrude(Base=courtyard_lower_2, Direction=amp_25)
move_2 = Move(Geometry=courtyard_upper_2, Motion=amp_25)  # -> Geometry, Transform
move_3 = Move(Geometry=courtyard_lower_2, Motion=amp_25)  # -> Geometry, Transform
debrep = DeconstructBrep(Brep=extr)  # -> Faces, Edges, Vertices
debrep_2 = DeconstructBrep(Brep=extr_2)  # -> Faces, Edges, Vertices
item = ListItem(List=debrep.Faces, Index=0, Wrap=True)  # -> Item, Item1, Item2, Item3, Item4
item_2 = ListItem(List=debrep_2.Faces, Index=0, Wrap=True)  # -> Item, Item1, Item2, Item3, Item4
courtyard_lower_fassade = Surface(item_2.Item3)
courtyard_upper_fassade = Surface(item.Item4)
courtyard_lower_roof = Surface(move_3.Geometry)
courtyard_upper_volume = Brep(extr)
courtyard_lower_volume = Brep(extr_2)
courtyard_upper_roof = Surface(move_2.Geometry)

amp_26 = Amplitude(Vector=zvec_2, Amplitude=floorheight_2)
arrlinear_2 = LinearArray(Geometry=zones_box_2, Direction=amp_26, Count=numberoffloors_2)  # -> Geometry, Transform
trim_2 = TrimTree(Tree=arrlinear_2.Geometry, Depth=1)  # -> graft(Tree)
zones_allflors = Brep(trim_2)

panel = Panel("1")  # disabled
series = Series(Start=panel, Step=1, Count=numberoffloors_2)  # disabled
concat = Concatenate(
    FragmentC=graft(windows_name_2),
    FragmentA=namingschema_delimiter_2,
    FragmentB=namingschema_floor_name_2,
    FragmentE=namingschema_delimiter_2,
    FragmentD=series)  # disabled
trim_3 = TrimTree(Tree=trim_2, Depth=1)  # disabled
tstat_2 = TreeStatistics(Tree=trim_3)  # -> Paths, Length, Count; disabled
windows_allfloors_name = Text(concat)  # disabled
partition = PartitionList(List=flatten(concat), Size=tstat_2.Length)  # disabled
match = MatchTree(Tree=trim_3)  # disabled

amp_27 = Amplitude(Vector=zvec_3, Amplitude=floorheight_2)
arrlinear_3 = LinearArray(Geometry=windows_rectangle_2, Direction=amp_27, Count=numberoffloors_2)  # -> Geometry, Transform
trim_4 = TrimTree(Tree=arrlinear_3.Geometry, Depth=1)  # -> graft(Tree)
windows_allfloors_rectangle = Curve(trim_4)

series_2 = Series(Start="-1", Step="-1", Count=floor_count_underground_2)
concat_2 = Concatenate(
    FragmentC=branch_2,
    FragmentA=namingschema_delimiter_2,
    FragmentB=namingschema_floor_name_2,
    FragmentE=namingschema_delimiter_2,
    FragmentD=series_2)  # -> graft(Result)
match_2 = MatchTree(Tree=concat_2, Guide=trim)
zones_underground_name = Text(match_2)

series_3 = Series(Start="1", Step=1, Count=numberoffloors_2)
concat_3 = Concatenate(
    FragmentC=zones_name_2,
    FragmentA=namingschema_delimiter_2,
    FragmentB=namingschema_floor_name_2,
    FragmentE=namingschema_delimiter_2,
    FragmentD=series_3)  # -> graft(Result)
match_3 = MatchTree(Tree=concat_3, Guide=trim_2)
zones_allflors_name = Text(concat_3)

zones_allflors_2 = ClusterOutput(zones_allflors)
zones_allflors_name_2 = ClusterOutput(zones_allflors_name)
windows_allfloors_rectangle_2 = ClusterOutput(windows_allfloors_rectangle)
courtyard_upper_volume_2 = ClusterOutput(courtyard_upper_volume)
courtyard_lower_volume_2 = ClusterOutput(courtyard_lower_volume)
courtyard_upper_fassade_2 = ClusterOutput(courtyard_upper_fassade)
courtyard_lower_fassade_2 = ClusterOutput(courtyard_lower_fassade)
courtyard_upper_roof_2 = ClusterOutput(courtyard_upper_roof)
courtyard_lower_roof_2 = ClusterOutput(courtyard_lower_roof)
zones_underground_2 = ClusterOutput(zones_underground)
zones_underground_name_2 = ClusterOutput(zones_underground_name)
windows_allfloors_name_2 = ClusterOutput(windows_allfloors_name)
panel_2 = Panel(windows_allfloors_name)

# ==== cluster Cluster
namingschema_delimiter_parameter = ClusterInput()
prefix = ClusterInput()
variable_number_name = ClusterInput()
variable_number_value = ClusterInput()
variable_bool_name = ClusterInput()
variable_bool_value = ClusterInput()
namingschema_delimiter_assign = ClusterInput()
namingschema_delimiter_decimal = ClusterInput()
namingschema_true_name = ClusterInput()
namingschema_false_name = ClusterInput()
variable_number_name_2 = Text(graft(variable_number_name))
variable_number_value_2 = Text(graft(variable_number_value))
variable_bool_name_2 = Text(graft(variable_bool_name))
variable_bool_value_2 = Boolean(graft(variable_bool_value))
namingschema_delimiter_assign_2 = Text(namingschema_delimiter_assign)
namingschema_delimiter_parameter_2 = Text(namingschema_delimiter_parameter)
namingschema_delimiter_decimal_2 = Text(namingschema_delimiter_decimal)
namingschema_true_name_2 = Text(namingschema_true_name)
namingschema_false_name_2 = Text(namingschema_false_name)
prefix_2 = Text(prefix)
expression = Expression(x=variable_bool_value_2, y=namingschema_true_name_2, z=namingschema_false_name_2, Expression="If(x=True,y,z)")
rep = ReplaceText(Text=variable_number_value_2, Find=".", Replace=namingschema_delimiter_decimal_2, RecursiveReplace=False)
concat = Concatenate(FragmentB=variable_number_name_2, FragmentH=namingschema_delimiter_assign_2, FragmentI=rep)
concat_2 = Concatenate(FragmentA=variable_bool_name_2, FragmentB=namingschema_delimiter_assign_2, FragmentC=expression)
trim = TrimTree(Tree=concat, Depth=1)
join = TextJoin(Text=trim, Join=namingschema_delimiter_parameter_2)
trim_2 = TrimTree(Tree=concat_2, Depth=1)
join_2 = TextJoin(Text=trim_2, Join=namingschema_delimiter_parameter_2)
variables = Text(join)
variables_bool = Text(join_2)
merge = Merge(Data1=variables, Data2=variables_bool)
join_3 = TextJoin(Text=merge, Join=namingschema_delimiter_parameter_2)
concat_3 = Concatenate(FragmentB=prefix_2, FragmentH=namingschema_delimiter_parameter_2, FragmentI=join_3)
variables_value_bool = Text(join_3)
variables_value = Text(variables)
joinedtext = Text(concat_3)
variables_bool_2 = Text(variables_bool)
joinedtext_2 = ClusterOutput(joinedtext)
variables_bool_3 = ClusterOutput(variables_bool_2)
variables_value_2 = ClusterOutput(variables_value)
variables_value_bool_2 = ClusterOutput(variables_value_bool)

# ==== cluster Read_UValues
energystandard_selected = ClusterInput()
path = ClusterInput()
refresh = ClusterInput()
energystandard_selected_2 = Text(energystandard_selected)
path_2 = Text(path)
refresh_2 = Data(refresh)
expression = Expression(x=path_2, y=refresh_2, Expression="x")
file = ReadFile(File=expression, PerLineParse=True)
csv = ReadCSV(CSVString=file, Delimiter=",")  # -> Headers, Values
tstat = TreeStatistics(Tree=csv.Values)  # -> Paths, Length, Count
item = ListItem(List=tstat.Paths, Index=0, Wrap=True)  # -> Item, Item1, Item2, Item3
branch = TreeBranch(Tree=csv.Values, Path=item.Item, MaintainPaths=True)
branch_2 = TreeBranch(Tree=csv.Values, Path=item.Item1, MaintainPaths=True)
branch_3 = TreeBranch(Tree=csv.Values, Path=item.Item2, MaintainPaths=True)
branch_4 = TreeBranch(Tree=csv.Values, Path=item.Item3, MaintainPaths=True)
cost_groups = Text(branch_2)
energystandards = Text(branch)
required_u_values = Number(branch_4)
categories = Text(branch_3)
tmatch = MatchText(Text=energystandards, Pattern=graft(energystandard_selected_2), Case=True)
listdexs = ListIndices(List=energystandards)
cull = CullPattern(List=listdexs, CullPattern=tmatch)  # -> flatten(List)
item_2 = ListItem(List=required_u_values, Index=cull, Wrap=True)
item_3 = ListItem(List=cost_groups, Index=cull, Wrap=True)
item_4 = ListItem(List=categories, Index=cull, Wrap=True)
cost_groups_2 = Text(item_3)
categories_2 = Text(item_4)
required_u_values_2 = Number(item_2)
cost_groups_3 = ClusterOutput(cost_groups_2)
categories_3 = ClusterOutput(categories_2)
required_u_values_3 = ClusterOutput(required_u_values_2)

# ==== cluster ReadParameters
parameterspath = ClusterInput()
read = ClusterInput()

parameterspath_2 = Text(parameterspath)
read_2 = Boolean(read)
excelread = ExcelReader(ReadExcelData=read_2, WorkbookPath=parameterspath_2, WorksheetName="Continuous-Parameters")  # -> Exceptions, ExcelData
null = NullifyEmptyString(T=excelread.ExcelData)  # -> NT; inputs T: tree
# ---------- null: Python ----------
#Component Information
#--------------------------------------------------------------------------------------------
if ghenv.Component.RunCount<2:
    #General
    #--------------------------------------------------------------------------------------------
    __author__ = "Ueli Saluz"
    __version__ = "2022.01.16"
    
    ghenv.Component.Name = "NullifyEmptyString"
    ghenv.Component.NickName = "\"\"->Null"
    ghenv.Component.Description = "Replaces emtpy strings with Null."
    ghenv.Component.Message = "VER 1.0"
    ghenv.Component.Category = "Sets"
    ghenv.Component.SubCategory = "Text"
    # Panel section: 3
    
     #Inputs
    #--------------------------------------------------------------------------------------------
    inputIndex=0
    
    ghenv.Component.Params.Input[inputIndex].Name = "String"
    ghenv.Component.Params.Input[inputIndex].NickName = "T"
    ghenv.Component.Params.Input[inputIndex].Description = "String that are potentially empty strings."
    ghenv.Component.Params.Input[inputIndex].Optional = False
    inputIndex+=1
    
    #Outputs
    #--------------------------------------------------------------------------------------------
    outputIndex=0
    
    ghenv.Component.Params.Output[outputIndex].Name = "NullifiedString"
    ghenv.Component.Params.Output[outputIndex].NickName = "NT"
    ghenv.Component.Params.Output[outputIndex].Description = "Old string if not empty. Null else."
    outputIndex+=1


#Imports
#--------------------------------------------------------------------------------------------
from System import Object
from Grasshopper import DataTree

#Solver - Run with trees to enhance performance drastically
#--------------------------------------------------------------------------------------------
if __name__ == "__main__":
    
    #Initialize trees
    #--------------------------------------------------------------------------------------------
    NullifiedStringTree = DataTree[Object]()
    
    #Data matching
    #--------------------------------------------------------------------------------------------
    for path in T.Paths:
        stringBranch = T.Branch(path)
        for i,string in enumerate(stringBranch):
            nullifiedString = string if string!="" else None
            NullifiedStringTree.Add(nullifiedString, path)
     #Assign trees to output
    #--------------------------------------------------------------------------------------------
    NT = NullifiedStringTree
# ---------- end null ----------
clean = CleanTree(RemoveNulls=True, RemoveInvalid=True, RemoveEmpty=True, Tree=null)
slito3 = SliceListInto3Parts(ListToSlice=clean, StartIndex="1")  # -> FilteredList, ItemsBefore, ItemsAfter; inputs ListToSlice: tree, StartIndex: tree of Int32, EndIndex: tree of Int32
# ---------- slito3: Python ----------
if ghenv.Component.RunCount<2:
    __author__ = "Ueli Saluz"
    __version__ = "2020.05.28"
    
    ghenv.Component.Name = "SliceListInto3Parts"
    ghenv.Component.NickName = "SLiTo3"
    ghenv.Component.Description = "Slice list into 3 parts. All lists are sliced with the same indices."
    ghenv.Component.Message = "VER 1.5"

from System import Object
from Grasshopper import DataTree

def filterList(listToFilter,startIndex,endIndex):
    if (((startIndex == 0) or (startIndex is None)) and ((endIndex == 0)or (endIndex is None))) or (endIndex <= startIndex and endIndex > 0):
        return (None,None,listToFilter)
    elif (startIndex == 0) or (startIndex is None):
        return (listToFilter[:endIndex],None,listToFilter[endIndex:])
    else:
        return (listToFilter[startIndex:endIndex],listToFilter[:startIndex],listToFilter[endIndex:])

if __name__ == "__main__":
    FilteredList = DataTree[Object]()
    ItemsBefore = DataTree[Object]()
    ItemsAfter = DataTree[Object]()
    
    for path in ListToSlice.Paths:
        listBranch = ListToSlice.Branch(path)
        pyList = list(listBranch)   #Convert .Net List to Python
        try: #terrible way of writing code but if I set the list to list access the performance decreases massivly due to many calls
            startIndex = StartIndex.Branch(path)
            startIndex = startIndex[0]
        except Exception:
            try:
                startIndex = StartIndex.Branch(0)
                startIndex = startIndex[0]
            except Exception:
                startIndex = 0
        try:
            endIndex = EndIndex.Branch(path)
            endIndex = endIndex[0]
        except Exception:
            try:
                endIndex = EndIndex.Branch(0)
                endIndex = endIndex[0]
            except Exception:
                endIndex = len(pyList)
        filtList=filterList(pyList,startIndex,endIndex)
        if filtList[0]:
            FilteredList.AddRange(filtList[0],path)
        if filtList[1]:
            ItemsBefore.AddRange(filtList[1],path)
        if filtList[2]:
            ItemsAfter.AddRange(filtList[2],path)
# ---------- end slito3 ----------
continuous_parameters = Data(slito3.FilteredList)
tstat = TreeStatistics(Tree=continuous_parameters)  # -> Paths, Length, Count
slito3_2 = SliceListInto3Parts(ListToSlice=tstat.Paths, StartIndex="1")  # -> FilteredList, ItemsBefore, ItemsAfter; inputs ListToSlice: tree, StartIndex: tree of Int32, EndIndex: tree of Int32; same code as slito3
dsptchpths = DispatchBranchesWithPaths(Data=continuous_parameters, Paths=slito3_2.FilteredList)  # -> SelectedData, OtherData, SelectedPaths, AdditionalGen; inputs Data: tree, Paths: list, Ancestor: Boolean; same code as dsptchpths
continuous_parameters_2 = Text(dsptchpths.OtherData)
values = Number(dsptchpths.SelectedData)

excelread_2 = ExcelReader(ReadExcelData=read_2, WorkbookPath=parameterspath_2, WorksheetName="Discrete-Parameters")  # -> Exceptions, ExcelData
slito3_3 = SliceListInto3Parts(ListToSlice=excelread_2.ExcelData, StartIndex="1")  # -> FilteredList, ItemsBefore, ItemsAfter; inputs ListToSlice: tree, StartIndex: tree of Int32, EndIndex: tree of Int32; same code as slito3
discrete_parameters = Data(slito3_3.FilteredList)
tstat_2 = TreeStatistics(Tree=discrete_parameters)  # -> Paths, Length, Count
slito3_4 = SliceListInto3Parts(ListToSlice=tstat_2.Paths, StartIndex="1")  # -> FilteredList, ItemsBefore, ItemsAfter; inputs ListToSlice: tree, StartIndex: tree of Int32, EndIndex: tree of Int32; same code as slito3
dsptchpths_2 = DispatchBranchesWithPaths(Data=discrete_parameters, Paths=slito3_4.FilteredList)  # -> SelectedData, OtherData, SelectedPaths, AdditionalGen; inputs Data: tree, Paths: list, Ancestor: Boolean; same code as dsptchpths
discrete_values = Text(dsptchpths_2.SelectedData)
discrete_parameters_2 = Text(dsptchpths_2.OtherData)

discrete_values_2 = ClusterOutput(discrete_values)
discrete_parameters_3 = ClusterOutput(discrete_parameters_2)
values_2 = ClusterOutput(values)
continuous_parameters_3 = ClusterOutput(continuous_parameters_2)

# ==== cluster FilterSelectedParameters
parameters = ClusterInput()
discrete_parameters = ClusterInput()
discrete_values = ClusterInput()
discrete_parameters_selected = ClusterInput()
continuous_parameters = ClusterInput()
values = ClusterInput()
continuous_parameters_selected = ClusterInput()
run = ClusterInput()
parameters_2 = Data(parameters)
discrete_parameters_selected_2 = Text(discrete_parameters_selected)
continuous_parameters_selected_2 = Text(continuous_parameters_selected)
run_2 = Boolean(run)

discrete_parameters_selected_3 = Text(discrete_parameters_selected_2)
discrete_parameters_2 = Text(discrete_parameters)
discrete_values_2 = Text(discrete_values)
tstat = TreeStatistics(Tree=discrete_values_2)  # -> Paths, Length, Count
neg = Negative(Value="1")
slito3 = SliceListInto3Parts(ListToSlice=tstat.Paths, EndIndex=neg)  # -> FilteredList, ItemsBefore, ItemsAfter; inputs ListToSlice: tree, StartIndex: tree of Int32, EndIndex: tree of Int32; same code as slito3
dsptchpths = DispatchBranchesWithPaths(Data=discrete_values_2, Paths=slito3.FilteredList)  # -> SelectedData, OtherData, SelectedPaths, AdditionalGen; inputs Data: tree, Paths: list, Ancestor: Boolean; same code as dsptchpths
tstat_2 = TreeStatistics(Tree=dsptchpths.SelectedData)  # -> Paths, Length, Count
item = ListItem(List=dsptchpths.SelectedData, Index=0, Wrap=True)
item_2 = ListItem(List=tstat_2.Length, Index=0, Wrap=True)
lng = ListLength(List=tstat_2.Paths)
expression = Expression(x=lng, y=item_2, z=item, Expression="x-y")
dup = DuplicateData(Number=expression, Order=True)
trim = TrimTree(Tree=dup, Depth=1)
merge = Merge(Data1=dsptchpths.SelectedData, Data2=trim)
flip = FlipMatrix(Data=merge)
null = NullifyEmptyString(T=flip)  # -> NT; inputs T: tree; same code as null
tmatch = MatchText(Text=discrete_parameters_2, Pattern=graft(discrete_parameters_selected_3), Case=True)
clean = CleanTree(RemoveNulls=True, RemoveInvalid=True, RemoveEmpty=True, Tree=null)
listdexs = ListIndices(List=discrete_parameters_2)
cull = CullPattern(List=listdexs, CullPattern=tmatch)  # -> flatten(List)
tstat_3 = TreeStatistics(Tree=clean)  # -> Paths, Length, Count
item_3 = ListItem(List=tstat_3.Paths, Index=cull, Wrap=True)
item_4 = ListItem(List=dsptchpths.OtherData, Index=cull, Wrap=True)
branch = TreeBranch(Tree=clean, Path=item_3, MaintainPaths=True)
discrete_parameters_values = Text(branch)
match = MatchTree(Tree=graft(item_4), Guide=discrete_parameters_values)
discrete_parameters_values_iterations = Text(match)

param_info = ParamInfo(Param=parameters_2)  # -> Name, NickName, DataType, Pivot, Bounds, Sources, Recipients, Kind

continuous_parameters_selected_3 = Text(continuous_parameters_selected_2)
continuous_parameters_2 = Text(continuous_parameters)
values_2 = Number(values)
tstat_4 = TreeStatistics(Tree=values_2)  # -> Paths, Length, Count
tmatch_2 = MatchText(Text=continuous_parameters_2, Pattern=graft(continuous_parameters_selected_3), Case=True)
listdexs_2 = ListIndices(List=continuous_parameters_2)
item_5 = ListItem(List=tstat_4.Paths, Index=0, Wrap=True)  # -> Item, Item1, Item2, Item3
cull_2 = CullPattern(List=listdexs_2, CullPattern=tmatch_2)  # -> flatten(List)
branch_2 = TreeBranch(Tree=values_2, Path=item_5.Item, MaintainPaths=True)
branch_3 = TreeBranch(Tree=values_2, Path=item_5.Item1, MaintainPaths=True)
branch_4 = TreeBranch(Tree=values_2, Path=item_5.Item2, MaintainPaths=True)
branch_5 = TreeBranch(Tree=values_2, Path=item_5.Item3, MaintainPaths=True)
item_6 = ListItem(List=branch_3, Index=cull_2, Wrap=True)
item_7 = ListItem(List=branch_2, Index=cull_2, Wrap=True)
item_8 = ListItem(List=branch_4, Index=cull_2, Wrap=True)
item_9 = ListItem(List=branch_5, Index=cull_2, Wrap=True)
rangestart = Number(item_7)
rangeend = Number(item_6)
dom = ConstructDomain(DomainStart=rangestart, DomainEnd=rangeend)
conntinuous_parameters_stepsize = Number(item_9)
conntinuous_parameters_iterations = Integer(item_8)
conntinuous_parameters_range = Domain(dom)

conntinuous_parameters_stepsize_2 = Number(conntinuous_parameters_stepsize)
conntinuous_parameters_iterations_2 = Integer(conntinuous_parameters_iterations)
continuous_parameters_selected_4 = Text(continuous_parameters_selected_2)
conntinuous_parameters_range_2 = Domain(conntinuous_parameters_range)
tmatch_3 = MatchText(Text=param_info.Name, Pattern="Number Slider", Case=True)
dispatch = Dispatch(List=parameters_2, DispatchPattern=tmatch_3)  # -> graft(ListA), ListB
param_info_2 = ParamInfo(Param=dispatch.ListA)  # -> Name, NickName, DataType, Pivot, Bounds, Sources, Recipients, Kind
tmatch_4 = MatchText(Text=param_info_2.NickName, Pattern=continuous_parameters_selected_2, Case=True)
trim_2 = TrimTree(Tree=param_info_2.Recipients, Depth=1)
param_info_3 = ParamInfo(Param=trim_2)  # -> Name, NickName, DataType, Pivot, Bounds, Sources, Recipients, Kind
tmatch_5 = MatchText(Text=param_info_3.NickName, Pattern=continuous_parameters_selected_4, Case=True)
merge_2 = Merge(Data1=tmatch_4, Data2=tmatch_5)
ma = MassAddition(Input=merge_2)  # -> Result, PartialResults
dispatch_2 = Dispatch(List=param_info_3.NickName, DispatchPattern=ma.Result)  # -> ListA, ListB
clean_2 = CleanTree(RemoveNulls=True, RemoveInvalid=True, RemoveEmpty="True", Tree=dispatch_2.ListA)
tstat_5 = TreeStatistics(Tree=clean_2)  # -> Paths, Length, Count
tsort = SortText(Keys=continuous_parameters_selected_4, Values=flatten(conntinuous_parameters_stepsize_2), Culture=127)  # -> Keys, Values
tsort_2 = SortText(Keys=flatten(clean_2), Values=flatten(tstat_5.Paths), Culture=127)  # -> Keys, Values
tsort_3 = SortText(Keys=continuous_parameters_selected_4, Values=flatten(conntinuous_parameters_range_2), Culture=127)  # -> Keys, Values
tsort_4 = SortText(Keys=continuous_parameters_selected_4, Values=flatten(conntinuous_parameters_iterations_2), Culture=127)  # -> Keys, Values
trim_3 = TrimTree(Tree=tsort_3.Values, Depth=1)  # -> simplify(graft(Tree))
trim_4 = TrimTree(Tree=tsort.Values, Depth=1)  # -> simplify(graft(Tree))
trim_5 = TrimTree(Tree=tsort_4.Values, Depth=1)  # -> simplify(graft(Tree))
trim_6 = TrimTree(Tree=tsort_2.Keys, Depth=1)  # -> simplify(graft(Tree))
branch_6 = TreeBranch(Tree=dispatch.ListA, Path=tsort_2.Values, MaintainPaths=False)
conntinuous_parameters_iterations_sorted = Integer(trim_5)
conntinuous_parameters_stepsize_sorted = Number(trim_4)
conntinuous_parameters_sorting_keys = Text(trim_6)
sliders_iteration_sorted = Data(branch_6)
sliders_path = DataPath(tsort_2.Values)
conntinuous_parameters_range_sorted = Domain(trim_3)

mm = MassMultiplication(Input=flatten(discrete_parameters_values_iterations))  # -> Result, PartialResults
mm_2 = MassMultiplication(Input=conntinuous_parameters_iterations_2)  # -> Result, PartialResults
iterations_count_continous_parameters = Integer(mm_2.Result)
iterations_count_discrete_parameters = Integer(mm.Result)
multiplication = Multiplication(A=iterations_count_continous_parameters, B=iterations_count_discrete_parameters)
iterations_count_parameters = Integer(multiplication)

conntinuous_parameters_sorting_keys_2 = ClusterOutput(conntinuous_parameters_sorting_keys)
sliders_iteration_sorted_2 = ClusterOutput(sliders_iteration_sorted)
iterations_count_parameters_2 = ClusterOutput(iterations_count_parameters)
conntinuous_parameters_range_sorted_2 = ClusterOutput(conntinuous_parameters_range_sorted)
conntinuous_parameters_iterations_sorted_2 = ClusterOutput(conntinuous_parameters_iterations_sorted)
sliders_path_2 = ClusterOutput(sliders_path)
panel = Panel(trim_6)

discrete_parameters_selected_4 = Text(discrete_parameters_selected_2)
discrete_parameters_values_2 = Text(discrete_parameters_values)
tmatch_6 = MatchText(Text=param_info.Name, Pattern="Value List", Case=True)
dispatch_3 = Dispatch(List=parameters_2, DispatchPattern=tmatch_6)  # -> graft(ListA), ListB
param_info_4 = ParamInfo(Param=dispatch_3.ListA)  # -> Name, NickName, DataType, Pivot, Bounds, Sources, Recipients, Kind
trim_7 = TrimTree(Tree=param_info_4.Recipients, Depth=1)
tmatch_7 = MatchText(Text=param_info_4.NickName, Pattern=discrete_parameters_selected_2, Case=True)
param_info_5 = ParamInfo(Param=trim_7)  # -> Name, NickName, DataType, Pivot, Bounds, Sources, Recipients, Kind
tmatch_8 = MatchText(Text=param_info_5.NickName, Pattern=discrete_parameters_selected_2, Case=True)
merge_3 = Merge(Data1=tmatch_8, Data2=tmatch_7)
ma_2 = MassAddition(Input=merge_3)  # -> Result, PartialResults
dispatch_4 = Dispatch(List=param_info_5.NickName, DispatchPattern=ma_2.Result)  # -> ListA, ListB
clean_3 = CleanTree(RemoveNulls=True, RemoveInvalid=True, RemoveEmpty="True", Tree=dispatch_4.ListA)
tstat_6 = TreeStatistics(Tree=clean_3)  # -> Paths, Length, Count
tstat_7 = TreeStatistics(Tree=discrete_parameters_values_2)  # -> Paths, Length, Count
tsort_5 = SortText(Keys=flatten(discrete_parameters_selected_4), Values=flatten(tstat_7.Paths), Culture=127)  # -> Keys, Values
tsort_6 = SortText(Keys=flatten(clean_3), Values=flatten(tstat_6.Paths), Culture=127)  # -> Keys, Values
trim_8 = TrimTree(Tree=tsort_6.Keys, Depth=1)  # -> simplify(graft(Tree))
branch_7 = TreeBranch(Tree=discrete_parameters_values_2, Path=tsort_5.Values, MaintainPaths=False)
branch_8 = TreeBranch(Tree=dispatch_3.ListA, Path=tsort_6.Values, MaintainPaths=False)
valuelists_path = DataPath(tsort_6.Values)
discrete_parameters_sorting_keys = Text(trim_8)
valuelists_iteration_sorted = Data(branch_8)
discrete_parameters_values_sorted = Text(branch_7)

panel_2 = Panel(param_info_5.NickName)

lng_2 = ListLength(List=flatten(clean_2))
lng_3 = ListLength(List=flatten(clean_3))
lng_4 = ListLength(List=continuous_parameters_selected_4)
lng_5 = ListLength(List=discrete_parameters_selected_4)
equals = Equality(FirstNumber=lng_2, SecondNumber=lng_4)  # -> Equality, Inequality
equals_2 = Equality(FirstNumber=lng_3, SecondNumber=lng_5)  # -> Equality, Inequality
and = GateAnd(A=equals.Equality, B=equals_2.Equality, C=run_2)
run_no_errors = Boolean(and)

setnickname = SetNickName(C=branch_6, NN=trim_6, R=run_no_errors)  # -> ON; inputs R: Boolean
# ---------- setnickname: Python ----------
#Component Information
#--------------------------------------------------------------------------------------------
if ghenv.Component.RunCount<2:
    #General
    #--------------------------------------------------------------------------------------------
    __author__ = "Ueli Saluz"
    __version__ = "2021.01.21"
    
    ghenv.Component.Name = "SetNickName"
    ghenv.Component.NickName = "SetNickName"
    ghenv.Component.Description = "Set the NickName of a component."
    ghenv.Component.Message = "VER 1.0"
    ghenv.Component.Category = "Params"
    ghenv.Component.SubCategory = "Util"
    #Exposure Level 7
    
     #Inputs
    #--------------------------------------------------------------------------------------------
    inputIndex=0
    
    ghenv.Component.Params.Input[inputIndex].Name = "Component"
    ghenv.Component.Params.Input[inputIndex].NickName = "C"
    ghenv.Component.Params.Input[inputIndex].Description = "Component to change NickName."
    ghenv.Component.Params.Input[inputIndex].Optional = False
    inputIndex+=1
    
    ghenv.Component.Params.Input[inputIndex].Name = "NickName"
    ghenv.Component.Params.Input[inputIndex].NickName = "NN"
    ghenv.Component.Params.Input[inputIndex].Description = "NickName to set component to."
    ghenv.Component.Params.Input[inputIndex].Optional = False
    inputIndex+=1
    
    ghenv.Component.Params.Input[inputIndex].Name = "Run"
    ghenv.Component.Params.Input[inputIndex].NickName = "R"
    ghenv.Component.Params.Input[inputIndex].Description = "Run the name change."
    ghenv.Component.Params.Input[inputIndex].Optional = False
    inputIndex+=1
    
    #Outputs
    #--------------------------------------------------------------------------------------------
    outputIndex=0
    
    ghenv.Component.Params.Output[outputIndex].Name = "OldName"
    ghenv.Component.Params.Output[outputIndex].NickName = "ON"
    ghenv.Component.Params.Output[outputIndex].Description = "Old name."
    outputIndex+=1

#Solver - Run with trees to enhance performance drastically
#--------------------------------------------------------------------------------------------
if __name__ == "__main__":
    if R == True:
        ON = C.NickName
        C.NickName = NN
        C.ExpirePreview(True)
# ---------- end setnickname ----------

setnickname_2 = SetNickName(C=branch_8, NN=trim_8, R=run_no_errors)  # -> ON; inputs R: Boolean; same code as setnickname

discrete_parameters_sorting_keys_2 = ClusterOutput(discrete_parameters_sorting_keys)
valuelists_iteration_sorted_2 = ClusterOutput(valuelists_iteration_sorted)
discrete_parameters_values_sorted_2 = ClusterOutput(discrete_parameters_values_sorted)
run_no_errors_2 = ClusterOutput(run_no_errors)
valuelists_path_2 = ClusterOutput(valuelists_path)

# ==== cluster Adjust_UValue
opaque_construction_u_value = ClusterInput()
insulation_layer_index = ClusterInput()
target_u_value_include_airfilms = ClusterInput()
hb_opaque_construction = ClusterInput()
hb_opaque_construction_name_new = ClusterInput()

hb_opaque_construction_2 = Data(hb_opaque_construction)
opaque_construction_u_value_2 = Number(opaque_construction_u_value)
target_u_value_include_airfilms_2 = Integer(target_u_value_include_airfilms)
hb_opaque_construction_name_new_2 = Text(hb_opaque_construction_name_new)
insulation_layer_index_2 = Integer(insulation_layer_index)
decnstrconstr = HBDeconstructConstruction(constr=hb_opaque_construction_2)  # -> materials, layers, r_val_si, r_val_ip, u_fac_si, u_fac_ip, shgc, t_sol, t_vis; plug-in component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
trim = TrimTree(Tree=decnstrconstr.materials, Depth=1)
dispdexs = DispatchIndices(List=trim, Indices=insulation_layer_index_2)  # -> AtI, NotI
expression = Expression(x=decnstrconstr.u_fac_si, Expression="1/x")
decnstrmat = HBDeconstructMaterial(mat=dispdexs.AtI)  # -> values, attr_names, r_val_si, r_val_ip; plug-in component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
filter = StreamFilter(Gate=target_u_value_include_airfilms_2, Stream0=decnstrconstr.r_val_si, Stream1=expression)
# R_insulation = R_total - Sum_{layer \in layers\{insulation}}(R_layer)
trim_2 = TrimTree(Tree=decnstrmat.values, Depth=1)
item = ListItem(List=trim_2, Index=0, Wrap=True)  # -> Item, Item1, Item2, Item3, Item4, Item5, Item6, Item7, Item8
expression_2 = Expression(x=item.Item2, y=opaque_construction_u_value_2, z=filter, u=decnstrmat.r_val_si, Expression="x*((1/y)-(z-u))")
insulation_thickness_new = Number(expression_2)
opaquemat = HBOpaqueMaterial(
    name=item.Item,
    thickness=insulation_thickness_new,
    conductivity=item.Item2,
    density=item.Item3,
    spec_heat=item.Item4,
    roughness=item.Item5,
    therm_absp=item.Item6,
    sol_absp=item.Item7,
    vis_absp=item.Item8)  # -> mat; plug-in component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
ins = InsertItems(List=dispdexs.NotI, Item=opaquemat, Indices=insulation_layer_index_2, Wrap=True)
trim_3 = TrimTree(Tree=ins, Depth=1)
opaqueconstr = HBOpaqueConstruction(name=hb_opaque_construction_name_new_2, materials=trim_3)  # -> constr; plug-in component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
hb_opaque_construction_adjusted = Data(opaqueconstr)
insulation_thickness_old = Number(item.Item1)
insulation_thickness_new_2 = Number(insulation_thickness_new)

panel = Panel("thickness(insulation) = conductivity(insulation) * (R(layers) - Sum_{layer \in layers\{insulation}}(R(layer))")
hb_opaque_construction_adjusted_2 = ClusterOutput(hb_opaque_construction_adjusted)
insulation_thickness_old_2 = ClusterOutput(insulation_thickness_old)
insulation_thickness_new_3 = ClusterOutput(insulation_thickness_new_2)

# ==== cluster MatchRegularExpression: This component matches regex expression to text input.
ic = ClusterInput()
T = ClusterInput()
rp = ClusterInput()
ic_2 = IgnoreCase(ic)
rp_2 = RegexPattern(rp)
T_2 = Text(T)
expression = Expression(x=ic_2, y=T_2, Expression="x")
expression_2 = Expression(x=rp_2, y=T_2, Expression="x")
regex = MatchRegularExpressions(T=T_2, RP=expression_2, IC=expression)  # -> M, MSI, MG, MGSI, D; inputs T: tree of String, RP: tree of String, IC: tree of Boolean
# ---------- regex: C# usings ----------
//Imports
//--------------------------------------------------------------------------------------------
using System.Text.RegularExpressions;
# ---------- regex: C# ----------
    //General
    //--------------------------------------------------------------------------------------------
    //Authors: YOUR NAME
    //Last modified: DATE
    //Contact: E-MAIL

    if (Component.RunCount < 2)
    {
      Component.Name = "MatchRegularExpressions";
      Component.NickName = "Regex";
      Component.Description = "This component matches regex expression to text input.";
      Component.Message = "VER 1.0";
      Component.Category = "Sets";
      Component.SubCategory = "Text";
      //Exposure level = 3

      //Inputs
      //--------------------------------------------------------------------------------------------
      int inputIndex = 0;

      Component.Params.Input[inputIndex].Name = "Text";
      Component.Params.Input[inputIndex].NickName = "T";
      Component.Params.Input[inputIndex].Description = "This is the string that should be matched against the regex pattern.";
      Component.Params.Input[inputIndex].Optional = false;
      inputIndex += 1;

      Component.Params.Input[inputIndex].Name = "RegexPattern";
      Component.Params.Input[inputIndex].NickName = "RP";
      Component.Params.Input[inputIndex].Description = "The regex pattern used to match";
      Component.Params.Input[inputIndex].Optional = false;
      inputIndex += 1;

      Component.Params.Input[inputIndex].Name = "IgnoreCase";
      Component.Params.Input[inputIndex].NickName = "IC";
      Component.Params.Input[inputIndex].Description = "Ignore case for the matching";
      Component.Params.Input[inputIndex].Optional = false;
      inputIndex += 1;

      //Outputs
      //--------------------------------------------------------------------------------------------
      int outputIndex = 0;

      Component.Params.Output[outputIndex].Name = "Matches";
      Component.Params.Output[outputIndex].NickName = "M";
      Component.Params.Output[outputIndex].Description = "The matches for the specified text string.";
      outputIndex += 1;

      Component.Params.Output[outputIndex].Name = "MatchStartIndices";
      Component.Params.Output[outputIndex].NickName = "MSI";
      Component.Params.Output[outputIndex].Description = "The start indices of the matches for the specified text string.";
      outputIndex += 1;

      Component.Params.Output[outputIndex].Name = "MatchGroups";
      Component.Params.Output[outputIndex].NickName = "MG";
      Component.Params.Output[outputIndex].Description = "The match groups of the matches for the specified text string.";
      outputIndex += 1;

      Component.Params.Output[outputIndex].Name = "MatchGroupStartIndices";
      Component.Params.Output[outputIndex].NickName = "MGSI";
      Component.Params.Output[outputIndex].Description = "The start indices of the match group of the matches for the specified text string.";
      outputIndex += 1;

      Component.Params.Output[outputIndex].Name = "Debug";
      Component.Params.Output[outputIndex].NickName = "D";
      Component.Params.Output[outputIndex].Description = "Debugging purpose.";
      outputIndex += 1;

    }

    //Initialize trees
    //--------------------------------------------------------------------------------------------
    DataTree<string> MatchesTree = new DataTree<string>();
    DataTree<int> MatchStartIndicesTree = new DataTree<int>();
    DataTree<string> MatchGroupsTree = new DataTree<string>();
    DataTree<int> MatchGroupStartIndicesTree = new DataTree<int>();

    DataTree<string> DebugTree = new DataTree<string>();

    //Data matching
    //--------------------------------------------------------------------------------------------
    foreach (GH_Path path in T.Paths)
    {
      DebugTree.Add("Debuggin panel", path);
      var textBranch = T.Branch(path);
      var regexPatternStringBranch = RP.Branch(path);
      var ignoreCaseBranch = IC.Branch(path);

      for (int i = 0; i < textBranch.Count;i++)
      {
        var text = textBranch[i];
        var regexPatternString = regexPatternStringBranch[i];
        var ignoreCase = ignoreCaseBranch[i];

        var regexSearchOptions = RegexOptions.Compiled;
        if (ignoreCase)
        {
          regexSearchOptions = regexSearchOptions | RegexOptions.IgnoreCase;
        }

        Regex regexPattern = new Regex(regexPatternString, regexSearchOptions);
        MatchCollection matches = regexPattern.Matches(text);
        foreach (Match match in matches)
        {
          MatchesTree.Add(match.Value, path);
          MatchStartIndicesTree.Add(match.Index, path);
          //Match groups. More information about match groups under:
          //https://docs.microsoft.com/de-de/dotnet/api/system.text.regularexpressions.group?view=net-6.0
          GroupCollection matchGroups = match.Groups;
          int j = 0;
          foreach (Group matchGroup in matchGroups)
          {
            var graftedPath = path.AppendElement(j);
            MatchGroupsTree.Add(matchGroup.Value, graftedPath);
            MatchGroupStartIndicesTree.Add(matchGroup.Index, graftedPath);
            j++;
          }
        }
      }
    }

    //Assign trees to output
    //--------------------------------------------------------------------------------------------
    M = MatchesTree;
    MSI = MatchStartIndicesTree;
    MG = MatchGroupsTree;
    MGSI = MatchGroupStartIndicesTree;
    //Commit this out if done
    D = DebugTree;
# ---------- end regex ----------
panel = Panel(regex.D)
M = ClusterOutput(regex.M)
msi = ClusterOutput(regex.MSI)
mgsi = ClusterOutput(regex.MGSI)
mg = ClusterOutput(regex.MG)

# ==== cluster MatchRegularExpression_2: This component matches regex expression to text input.
ic = ClusterInput()
T = ClusterInput()
rp = ClusterInput()
ic_2 = IgnoreCase(ic)
rp_2 = RegexPattern(rp)
T_2 = Text(T)
expression = Expression(x=rp_2, y=T_2, Expression="x")
expression_2 = Expression(x=T_2, y=expression, Expression="x")
expression_3 = Expression(x=ic_2, y=expression, Expression="x")
regex = MatchRegularExpressions(T=expression_2, RP=expression, IC=expression_3)  # -> M, MSI, MG, MGSI, D; inputs T: tree of String, RP: tree of String, IC: tree of Boolean
# ---------- regex: C# usings ----------
//Imports
//--------------------------------------------------------------------------------------------
using System.Text.RegularExpressions;
# ---------- regex: C# ----------
    //General
    //--------------------------------------------------------------------------------------------
    //Authors: YOUR NAME
    //Last modified: DATE
    //Contact: E-MAIL

    if (Component.RunCount < 2)
    {
      Component.Name = "MatchRegularExpressions";
      Component.NickName = "Regex";
      Component.Description = "This component matches regex expression to text input.";
      Component.Message = "VER 1.0";
      Component.Category = "Sets";
      Component.SubCategory = "Text";
      //Exposure level = 3

      //Inputs
      //--------------------------------------------------------------------------------------------
      int inputIndex = 0;

      Component.Params.Input[inputIndex].Name = "Text";
      Component.Params.Input[inputIndex].NickName = "T";
      Component.Params.Input[inputIndex].Description = "This is the string that should be matched against the regex pattern.";
      Component.Params.Input[inputIndex].Optional = false;
      inputIndex += 1;

      Component.Params.Input[inputIndex].Name = "RegexPattern";
      Component.Params.Input[inputIndex].NickName = "RP";
      Component.Params.Input[inputIndex].Description = "The regex pattern used to match";
      Component.Params.Input[inputIndex].Optional = false;
      inputIndex += 1;

      Component.Params.Input[inputIndex].Name = "IgnoreCase";
      Component.Params.Input[inputIndex].NickName = "IC";
      Component.Params.Input[inputIndex].Description = "Ignore case for the matching";
      Component.Params.Input[inputIndex].Optional = false;
      inputIndex += 1;

      //Outputs
      //--------------------------------------------------------------------------------------------
      int outputIndex = 0;

      Component.Params.Output[outputIndex].Name = "Matches";
      Component.Params.Output[outputIndex].NickName = "M";
      Component.Params.Output[outputIndex].Description = "The matches for the specified text string.";
      outputIndex += 1;

      Component.Params.Output[outputIndex].Name = "MatchStartIndices";
      Component.Params.Output[outputIndex].NickName = "MSI";
      Component.Params.Output[outputIndex].Description = "The start indices of the matches for the specified text string.";
      outputIndex += 1;

      Component.Params.Output[outputIndex].Name = "MatchGroups";
      Component.Params.Output[outputIndex].NickName = "MG";
      Component.Params.Output[outputIndex].Description = "The match groups of the matches for the specified text string.";
      outputIndex += 1;

      Component.Params.Output[outputIndex].Name = "MatchGroupStartIndices";
      Component.Params.Output[outputIndex].NickName = "MGSI";
      Component.Params.Output[outputIndex].Description = "The start indices of the match group of the matches for the specified text string.";
      outputIndex += 1;

      Component.Params.Output[outputIndex].Name = "Debug";
      Component.Params.Output[outputIndex].NickName = "D";
      Component.Params.Output[outputIndex].Description = "Debugging purpose.";
      outputIndex += 1;

    }

    //Initialize trees
    //--------------------------------------------------------------------------------------------
    DataTree<string> MatchesTree = new DataTree<string>();
    DataTree<int> MatchStartIndicesTree = new DataTree<int>();
    DataTree<string> MatchGroupsTree = new DataTree<string>();
    DataTree<int> MatchGroupStartIndicesTree = new DataTree<int>();

    DataTree<string> DebugTree = new DataTree<string>();

    //Data matching
    //--------------------------------------------------------------------------------------------
    foreach (GH_Path path in T.Paths)
    {
      DebugTree.Add("Debuggin panel", path);
      var textBranch = T.Branch(path);
      var regexPatternStringBranch = RP.Branch(path);
      var ignoreCaseBranch = IC.Branch(path);

      for (int i = 0; i < textBranch.Count;i++)
      {
        var text = textBranch[i];
        var regexPatternString = regexPatternStringBranch[i];
        var ignoreCase = ignoreCaseBranch[i];

        var regexSearchOptions = RegexOptions.Compiled;
        if (ignoreCase)
        {
          regexSearchOptions = regexSearchOptions | RegexOptions.IgnoreCase;
        }

        Regex regexPattern = new Regex(regexPatternString, regexSearchOptions);
        MatchCollection matches = regexPattern.Matches(text);
        foreach (Match match in matches)
        {
          MatchesTree.Add(match.Value, path);
          MatchStartIndicesTree.Add(match.Index, path);
          //Match groups. More information about match groups under:
          //https://docs.microsoft.com/de-de/dotnet/api/system.text.regularexpressions.group?view=net-6.0
          GroupCollection matchGroups = match.Groups;
          int j = 0;
          foreach (Group matchGroup in matchGroups)
          {
            var graftedPath = path.AppendElement(j);
            MatchGroupsTree.Add(matchGroup.Value, graftedPath);
            MatchGroupStartIndicesTree.Add(matchGroup.Index, graftedPath);
            j++;
          }
        }
      }
    }

    //Assign trees to output
    //--------------------------------------------------------------------------------------------
    M = MatchesTree;
    MSI = MatchStartIndicesTree;
    MG = MatchGroupsTree;
    MGSI = MatchGroupStartIndicesTree;
    D = DebugTree;
# ---------- end regex ----------
panel = Panel(regex.D)
M = ClusterOutput(regex.M)
msi = ClusterOutput(regex.MSI)
mgsi = ClusterOutput(regex.MGSI)
mg = ClusterOutput(regex.MG)

# ==== cluster MoveRotatePlane
baseplane = ClusterInput()
movingx = ClusterInput()
movingy = ClusterInput()
movingz = ClusterInput()
anglex = ClusterInput()
angley = ClusterInput()
baseplane_2 = Plane(baseplane)
movingx_2 = Number(movingx)
movingy_2 = Number(movingy)
movingz_2 = Number(movingz)
anglex_2 = Number(anglex)
angley_2 = Number(angley)
deplane = DeconstructPlane(Plane=baseplane_2)  # -> Origin, XAxis, YAxis, ZAxis
revxvec = Vector(expr("-x", deplane.XAxis))
revzvec = Vector(expr("-x", deplane.ZAxis))
revyvec = Vector(expr("-x", deplane.YAxis))
origin = Point(deplane.Origin)
xvec = Vector(deplane.XAxis)
yvec = Vector(deplane.YAxis)
zvec = Vector(deplane.ZAxis)
amp = Amplitude(Vector=xvec, Amplitude=movingx_2)
amp_2 = Amplitude(Vector=yvec, Amplitude=movingy_2)
amp_3 = Amplitude(Vector=zvec, Amplitude=movingz_2)
amp_4 = Amplitude(Vector=revxvec, Amplitude=1)
amp_5 = Amplitude(Vector=revyvec, Amplitude=1)
amp_6 = Amplitude(Vector=revzvec, Amplitude=1)
addition = Addition(A=amp, B=amp_2, C=amp_3)
vrot = Rotate(Vector=xvec, Axis=yvec, Angle=degrees(anglex_2))
vrot_2 = Rotate(Vector=xvec, Axis=zvec, Angle=degrees(angley_2))
vrot_3 = Rotate(Vector=yvec, Axis=xvec, Angle=degrees(anglex_2))
vrot_4 = Rotate(Vector=yvec, Axis=zvec, Angle=degrees(angley_2))
move = Move(Geometry=origin, Motion=addition)  # -> Geometry, Transform
merge = Merge(Data1=graft(vrot), Data2=graft(vrot_2))
merge_2 = Merge(Data1=graft(vrot_3), Data2=graft(vrot_4))
avgp = AveragePoint(P=merge)  # -> AvP; inputs P: list of Point3d, M: list of Double
# ---------- avgp: C# usings ----------
using System.Linq;
# ---------- avgp: C# ----------
    //Author: Ueli Saluz
    //Last modified: 29.05.2020
    //Contact: usaluz@outlook.de

    if (Component.RunCount < 2)
    {
      Component.Name = "AveragePoint";
      Component.NickName = "AvgP";
      Component.Description = "Get the average point from a set of planes. Provide multiplier to weight some planes more.";
      Component.Params.Input[0].Name = "Points";
      Component.Params.Input[0].Description = "Points to take average from.";
      Component.Params.Input[1].Name = "Multipliers";
      Component.Params.Input[1].Description = "Multipliers act like weights towards a point.";

      Component.Params.Output[0].Name = "AveragePoint";
      Component.Params.Output[0].Description = "Resulting average point.";

      Component.Message = "VER 1.0";
    }
    if(P != null)
      AvP = GetAveragePoint(P.ToArray(), M.ToArray());
# ---------- avgp: C# additional code ----------
  public Point3d GetAveragePoint(Point3d[] points, double[] multipliers)
  {
    if (multipliers.Length < points.Length)
      multipliers = multipliers.Concat(Enumerable.Repeat(1d, points.Length - multipliers.Length)).ToArray();
    else if (multipliers.Length > points.Length)
      multipliers = multipliers.Take(points.Length).ToArray();

    if (multipliers.Sum() == 0)
      multipliers = Enumerable.Repeat(1d, points.Length).ToArray();

    var sum = multipliers.Sum();
    multipliers = multipliers.Select(x => x / sum).ToArray();

    for (int i = 0; i < points.Length; i++)
      points[i].Transform(new Transform(multipliers[i]));

    return points.Aggregate((a,b) => a + b);;
  }
# ---------- end avgp ----------
avgp_2 = AveragePoint(P=merge_2)  # -> AvP; inputs P: list of Point3d, M: list of Double; same code as avgp
trim = TrimTree(Tree=avgp, Depth=1)
trim_2 = TrimTree(Tree=avgp_2, Depth=1)
pl = ConstructPlane(Origin=move.Geometry, XAxis=trim, YAxis=trim_2)
movedbaseplanes = Plane(pl)
movedbaseplanes_2 = ClusterOutput(movedbaseplanes)

# ==== cluster WindowBand
baseplane = ClusterInput()
walls = ClusterInput()
parapetheight = ClusterInput()
windowheight = ClusterInput()
spacingtocorner = ClusterInput()

baseplane_2 = Plane(baseplane)
deplane = DeconstructPlane(Plane=baseplane_2)  # -> Origin, XAxis, YAxis, ZAxis
revxvec = Vector(expr("-x", deplane.XAxis))
revzvec = Vector(expr("-x", deplane.ZAxis))
pflip = FlipPlane(Plane=baseplane_2, ReverseX=False, ReverseY=False, SwapAxes=True)
revyvec = Vector(expr("-x", deplane.YAxis))
origin = Point(deplane.Origin)
xvec = Vector(deplane.XAxis)
yvec = Vector(deplane.YAxis)
zvec = Vector(deplane.ZAxis)
amp = Amplitude(Vector=xvec, Amplitude=1)
amp_2 = Amplitude(Vector=yvec, Amplitude=1)
amp_3 = Amplitude(Vector=zvec, Amplitude=1)
amp_4 = Amplitude(Vector=revxvec, Amplitude=1)
amp_5 = Amplitude(Vector=revyvec, Amplitude=1)
amp_6 = Amplitude(Vector=revzvec, Amplitude=1)

windowheight_2 = Number(windowheight)
parapetheight_2 = Number(parapetheight)
spacingtocorner_2 = Number(spacingtocorner)
walls_2 = Curve(walls)
toggle = BooleanToggle(True)
len = Length(Curve=walls_2)
dom = ConstructDomain(DomainStart=0, DomainEnd=len)
weightedsubdomains = WeightedSubdomains(Divisor="1", Domain=dom, Fill=toggle, FillMultiplier=spacingtocorner_2, FillEnds=toggle, AbsoluteFill=toggle)  # -> SubdomainValues, Subdomains; inputs Divisor: tree of Int32, Multiplier: tree, Domain: tree, Fill: Boolean, FillMultiplier: tree, FillEnds: Boolean, AbsoluteFill: Boolean
# ---------- weightedsubdomains: Python ----------
if ghenv.Component.RunCount<2:
    __author__ = "Ueli Saluz"
    __version__ = "2020.05.28"
    
    ghenv.Component.Name = "WeightedSubdomains"
    ghenv.Component.NickName = "WeightedSubdomains"
    ghenv.Component.Description = "Weighted subdomains on a given domain and add a domain with a certain multiplier in between all the domains. If domain not provided it uses default of 0-1."
    ghenv.Component.Message = "VER 1.6"
    
    ghenv.Component.Params.Input[0].Description = "Amount of sub domains"
    ghenv.Component.Params.Input[1].Description = "Multiplier for domains. Ignore if you want equal domains"
    ghenv.Component.Params.Input[2].Description = "Domain to slice into sub domains"
    ghenv.Component.Params.Input[3].Description = "If you wish to add domains in between all other domains set this to true."
    ghenv.Component.Params.Input[4].Description = "The multiplier to use for the inserted domain."
    ghenv.Component.Params.Input[5].Description = "If you wish to add the fill domain to the start and end set this to true."
    ghenv.Component.Params.Input[6].Description = "If you want the fill domain to be excatly the length of the fill multiplier set this to true."
    
    ghenv.Component.Params.Output[0].Description = "Sub domain values"
    ghenv.Component.Params.Output[1].Description = "Sub domains"

from Rhino.Geometry import Interval 
from System import Object
from Grasshopper import DataTree
from Grasshopper.Kernel.Data import GH_Path

def weightedSubdomain(domain=Interval(0, 1),divisor=1, multiplier=[]):
    if divisor<1:
        return
    else:
        length = domain.Length
        a=[]
        x = length/divisor  #equal parts which get multiplied
        if not multiplier:
            a = [x*i+domain.T0 for i in range(int(divisor)+1)]
            return a
        else:
            multiplier = [0] + multiplier
            a.append(0) #first value set to 0 otherwise if domainstart used it destroys the ratios
            for i in range(1,int(divisor)+1):
                try:
                    a.append(a[i-1]+x*multiplier[i])
                except Exception:
                    a.append(a[i-1]+x*i)
        r = length/a[-1]    #multipliers just give proportions and it needs to be remaped to original length
        for i in range(int(divisor)+1):
            a[i]=a[i]*r+domain.T0
        return a

def weightedSubdomainWithFill(domain=Interval(0, 1),divisor=1, multiplier=[],fillMultiplier=1,fillEnds=True,absoluteFill=False):
    if divisor<1:
        return
    length = domain.Length
    if not multiplier:
           multiplier = [1]*divisor
    if fillEnds:
        if absoluteFill: #convert the absolute fill width to a relative fill multiplier
            if fillMultiplier*(divisor+1)==length: #if the fills already fill everything the multipliers need to be put on 0.
                multiplier = [0]*len(multiplier)
            else:
                fillMultiplier = (fillMultiplier*sum(multiplier))/(length-fillMultiplier*(divisor+1))
        divisor = 2*divisor+1
        for i in range(int(divisor)+1):
            if i%2==0:
                multiplier.insert(i,fillMultiplier)
    else:
        if absoluteFill: #convert the absolute fill width to a relative fill multiplier
            if fillMultiplier*(divisor-1)==length:
                multiplier = [0]*len(multiplier)
            else:
                fillMultiplier = (fillMultiplier*sum(multiplier))/(length-fillMultiplier*(divisor-1))
        divisor = 2*divisor-1
        if not multiplier:
            for i in range(1,int(divisor)):
                if i%2==1:
                    multiplier.append(fillMultiplier)
                else:
                    multiplier.append(1)
        else:
            for i in range(1,int(divisor)):
                if i%2==1:
                    multiplier.insert(i,fillMultiplier)
    x = length/divisor  #equal parts which get multiplied
    multiplier = [0] + multiplier
    a=[]
    a.append(0) #first value set to 0 otherwise if domainstart used, it destroys the ratios
    for i in range(1,int(divisor)+1):
        try:
            a.append(a[i-1]+x*multiplier[i])
        except Exception:
            a.append(a[i-1]+x*i)
    r = length/a[-1]    #multipliers just give proportions and it needs to be remaped to original length
    for i in range(int(divisor)+1):
        a[i]=a[i]*r+domain.T0
    return a

def createDomains(numbers):
    a = []
    for i,num in enumerate(numbers[1:]):
        a.append(Interval(numbers[i], num))
    return a

if __name__ == "__main__":
    SubdomainValues = DataTree[Object]()
    Subdomains = DataTree[Object]()
    
    if Divisor.Paths.Count<Domain.Paths.Count:
        paths = Domain.Paths
    else:
        paths = Divisor.Paths
    for path in paths:
        try: #terrible way of writing code but if I set the list to list access the performance decreases massivly due to many calls
            domain = Domain.Branch(path)
            domain = domain[0]
        except Exception:
            try:
                domain = Domain.Branch(0)
                domain = domain[0]
            except Exception:
                domain = Interval(0, 1)
        divisor = Divisor.Branch(path)
        if not divisor:
            divisor = Divisor.Branch(0)
        divisor = divisor[0]
        if divisor > 0:
            multiplier = Multiplier.Branch(path)
            if not multiplier:
                try:
                    multiplier=Multiplier.Branch(0)
                except Exception:
                    multiplier = []
            multiplier = list(multiplier)
            if Fill:
                fillMultiplier = FillMultiplier.Branch(path)
                if not fillMultiplier:
                    fillMultiplier=FillMultiplier.Branch(0)
                fillMultiplier = fillMultiplier[0]
                subdivisions=weightedSubdomainWithFill(domain,divisor,multiplier,fillMultiplier,FillEnds,AbsoluteFill)
            else:
                subdivisions=weightedSubdomain(domain,divisor,multiplier)
            SubdomainValues.AddRange(subdivisions,path)
            if len(subdivisions)>2:
                subdivisionsDomains = createDomains(subdivisions)
                Subdomains.AddRange(subdivisionsDomains,path)
            else:
                Subdomains.Add(domain,path)
        else:
            SubdomainValues.EnsurePath(path)
            Subdomains.EnsurePath(path)
# ---------- end weightedsubdomains ----------
reprmcrv = ReparametrizeCurve(C=walls_2)  # -> RC, I, IL; inputs C: tree, T0: tree, T1: tree
# ---------- reprmcrv: Python ----------
#Component Information
#--------------------------------------------------------------------------------------------
if ghenv.Component.RunCount<2:
    #General
    #--------------------------------------------------------------------------------------------
    __author__ = "Ueli Saluz"
    __version__ = "2021.11.15"
    #--------------------------------------------------------------------------------------------
    ghenv.Component.Name = "ReparametrizeCurve"
    ghenv.Component.NickName = "RePrmCrv"
    ghenv.Component.Description = "Reparametrize the domain of a curve to the interval from 0 to the length of the curve."
    ghenv.Component.Message = "VER 1.0"
    
    ghenv.Component.Category = "Curve"
    ghenv.Component.SubCategory = "Util"
    
    #Inputs
    #--------------------------------------------------------------------------------------------
    inputIndex=0
    
    ghenv.Component.Params.Input[inputIndex].Name = "Curve"
    ghenv.Component.Params.Input[inputIndex].NickName = "C"
    ghenv.Component.Params.Input[inputIndex].Description = "Curve to reparametrize domain to interval [0,length]"
    ghenv.Component.Params.Input[inputIndex].Optional = True
    inputIndex+=1
    
    ghenv.Component.Params.Input[inputIndex].Name = "DomainStart"
    ghenv.Component.Params.Input[inputIndex].NickName = "T0"
    ghenv.Component.Params.Input[inputIndex].Description = "Starting value of domain that will be used to reparametrized. Default is 0."
    ghenv.Component.Params.Input[inputIndex].Optional = True
    inputIndex+=1
    
    ghenv.Component.Params.Input[inputIndex].Name = "DomainEnd"
    ghenv.Component.Params.Input[inputIndex].NickName = "T1"
    ghenv.Component.Params.Input[inputIndex].Description = "End value of domain that will be used to reparametrized. Default is length."
    ghenv.Component.Params.Input[inputIndex].Optional = True
    inputIndex+=1
    
    #Outputs
    #--------------------------------------------------------------------------------------------
    outputIndex=0
    
    ghenv.Component.Params.Output[outputIndex].Name = "ReparametrizedCurve"
    ghenv.Component.Params.Output[outputIndex].NickName = "RC"
    ghenv.Component.Params.Output[outputIndex].Description = "Reparametrized curve"
    outputIndex+=1
    
    ghenv.Component.Params.Output[outputIndex].Name = "Domain"
    ghenv.Component.Params.Output[outputIndex].NickName = "I"
    ghenv.Component.Params.Output[outputIndex].Description = "Domain of the reparametrized curve"
    outputIndex+=1
    
    ghenv.Component.Params.Output[outputIndex].Name = "DomainLength"
    ghenv.Component.Params.Output[outputIndex].NickName = "IL"
    ghenv.Component.Params.Output[outputIndex].Description = "Length of the domain of the reparametrized curve"
    outputIndex+=1


#Imports
#--------------------------------------------------------------------------------------------
from Rhino.Geometry import Interval, Curve
from System import Object
from Grasshopper import DataTree


#The Component function - Buisness logic only (e.g. working without trees)
#--------------------------------------------------------------------------------------------
"""Reparametrize the domain of a curve to the interval from 0 to the length of the curve.
    Inputs:
        crv: curve to reparametrize domain to interval [0,length]
        t0: Starting value of domain that will be used to reparametrized. Default is 0.
        t1: End value of domain that will be used to reparametrized. Default is length.
    Output:
        rc: Reparametrized curve"""
def reparametrizeCurve (crv,t0=None,t1=None):
    if(t0 is None):
        t0=0
    if(t1 is None):
        t1=crv.GetLength()
    crv.Domain = Interval(t0,t1)
    return crv

#Solver - Run with trees to enhance performance drastically
#--------------------------------------------------------------------------------------------
if __name__ == "__main__":
    
    #Initialize trees
    #--------------------------------------------------------------------------------------------
    ReparametrizedCurveTree = DataTree[Object]()
    DomainTree = DataTree[Object]()
    DomainLengthTree = DataTree[Object]()
    
    #Data matching
    #--------------------------------------------------------------------------------------------
    for path in C.Paths:
        curveBranch = C.Branch(path)
        for i,curve in enumerate(curveBranch):
            reparametrizedCurve = reparametrizeCurve(curve)
            ReparametrizedCurveTree.Add(reparametrizedCurve,path)
            DomainTree.Add(reparametrizedCurve.Domain,path)
            DomainLengthTree.Add(reparametrizedCurve.Domain.Length, path)
            
    #Assign trees to output
    #--------------------------------------------------------------------------------------------
    RC=ReparametrizedCurveTree
    I=DomainTree
    IL=DomainLengthTree
# ---------- end reprmcrv ----------
subcrv = SubCurve(BaseCurve=reprmcrv.RC, Domain=weightedsubdomains.Subdomains)
lito3p = ListInto3Parts(ListToSlice=subcrv, StartIndex="1", EndIndex="-1")  # -> FilteredList, ItemsBefore, ItemsAfter; inputs ListToSlice: tree, StartIndex: tree of Int32, EndIndex: tree of Int32; same code as lito3p
amp_7 = Amplitude(Vector=zvec, Amplitude=windowheight_2)
amp_8 = Amplitude(Vector=zvec, Amplitude=parapetheight_2)
move = Move(Geometry=lito3p.FilteredList, Motion=amp_8)  # -> Geometry, Transform
extr = Extrude(Base=move.Geometry, Direction=amp_7)

window_band = Curve(extr)
window_band_2 = ClusterOutput(window_band)

# ==== cluster CreateWallsWithOpenings
constructionmethod = ClusterInput()
openingheight = ClusterInput()
openingwidth = ClusterInput()
parapet_height = ClusterInput()
offsettosides = ClusterInput()
placement = ClusterInput()
baseplane = ClusterInput()
referencecurvewall = ClusterInput()
wallheigth = ClusterInput()
referencecurvewall_2 = Curve(referencecurvewall)
offsettosides_2 = Number(offsettosides)
baseplane_2 = Plane(baseplane)
openingheight_2 = Number(openingheight)
parapet_height_2 = Number(parapet_height)
openingwidth_2 = Number(openingwidth)
constructionmethod_2 = Integer(constructionmethod)
placement_2 = Number(placement)
wallheigth_2 = Number(wallheigth)

len = Length(Curve=referencecurvewall_2)
deplane = DeconstructPlane(Plane=baseplane_2)  # -> Origin, XAxis, YAxis, ZAxis
expression = Expression(
    x=placement_2,
    y=openingwidth_2,
    z=len,
    u=offsettosides_2,
    Expression="if((x*(z-2*u))<(y/2),y/2+u,if((x*(z-2*u))>((z-2*u)-y/2),z-y/2-u,x*z))")
expression_2 = Expression(x=expression, y=openingwidth_2, Expression="x-y/2")
expression_3 = Expression(x=expression, y=openingwidth_2, Expression="x+y/2")
dom = ConstructDomain(DomainStart=0, DomainEnd=len)
remap = RemapNumbers(Value=expression, Source=dom, Target=Domain(0, 1))  # -> Mapped, Clipped
remap_2 = RemapNumbers(Value=expression_2, Source=dom, Target=Domain(0, 1))  # -> Mapped, Clipped
remap_3 = RemapNumbers(Value=expression_3, Source=dom, Target=Domain(0, 1))  # -> Mapped, Clipped
eval = EvaluateLength(Curve=referencecurvewall_2, Length=remap.Mapped, Normalized=True)  # -> graft(Point), Tangent, Parameter
eval_2 = EvaluateLength(Curve=referencecurvewall_2, Length=remap_2.Mapped, Normalized=True)  # -> graft(Point), Tangent, Parameter
eval_3 = EvaluateLength(Curve=referencecurvewall_2, Length=remap_3.Mapped, Normalized=True)  # -> graft(Point), Tangent, Parameter
amp = Amplitude(Vector=eval.Tangent, Amplitude=openingheight_2)  # -> graft(Vector)
merge = Merge(Data1=eval_2.Point, Data2=eval_3.Point)

amp_2 = Amplitude(Vector=deplane.ZAxis, Amplitude=parapet_height_2)
amp_3 = Amplitude(Vector=deplane.ZAxis, Amplitude=openingheight_2)

expression_4 = Expression(x=parapet_height_2, Expression="if(x>0,True,False)")
tstat = TreeStatistics(Tree=graft(placement_2))  # -> Paths, Length, Count
dispatch = Dispatch(List=flatten(tstat.Paths), DispatchPattern=flatten(expression_4))  # -> ListA, ListB

amp_4 = Amplitude(Vector=deplane.ZAxis, Amplitude=wallheigth_2)
move = Move(Geometry=referencecurvewall_2, Motion=amp_4)  # -> Geometry, Transform
end = EndPoints(Curve=referencecurvewall_2)  # -> Start, End
end_2 = EndPoints(Curve=move.Geometry)  # -> Start, End
ln = Line(StartPoint=end_2.End, EndPoint=end.End)
ln_2 = Line(StartPoint=end_2.Start, EndPoint=end.Start)
merge_2 = Merge(Data1=referencecurvewall_2, Data2=ln_2, Data3=move.Geometry, Data4=ln)
join = JoinCurves(Curves=merge_2, Preserve=False)
trim = TrimTree(Tree=join, Depth=1)

branch = TreeBranch(Tree=merge, Path=dispatch.ListA, MaintainPaths=True)
branch_2 = TreeBranch(Tree=merge, Path=dispatch.ListB, MaintainPaths=True)
referencecurvewall_3 = Curve(referencecurvewall_2)
displayboundary = Curve(trim)
windowspointsonreferencecurve = Point(branch)
doorspointsonreferencecurve = Point(branch_2)
referencecurvewall_4 = ClusterOutput(referencecurvewall_3)
windowspointsonreferencecurve_2 = ClusterOutput(windowspointsonreferencecurve)
displayboundary_2 = ClusterOutput(displayboundary)
doorspointsonreferencecurve_2 = ClusterOutput(doorspointsonreferencecurve)

move_2 = Move(Geometry=eval.Point, Motion=expr("x/2", amp))  # -> Geometry, Transform
move_3 = Move(Geometry=eval.Point, Motion=expr("-x/2", amp))  # -> Geometry, Transform
merge_3 = Merge(Data1=move_2.Geometry, Data2=move_3.Geometry)

filter = StreamFilter(Gate=constructionmethod_2, Stream0=merge, Stream1=merge, Stream2=merge_3)

trim_2 = TrimTree(Tree=filter, Depth=1)
move_4 = Move(Geometry=trim_2, Motion=amp_2)  # -> Geometry, Transform
tstat_2 = TreeStatistics(Tree=filter)  # -> Paths, Length, Count
move_5 = Move(Geometry=move_4.Geometry, Motion=amp_3)  # -> Geometry, Transform
partition = PartitionList(List=flatten(move_4.Geometry), Size=tstat_2.Length)
tstat_3 = TreeStatistics(Tree=filter)  # -> Paths, Length, Count
match = MatchTree(Tree=partition, Guide=filter)
partition_2 = PartitionList(List=flatten(move_5.Geometry), Size=tstat_3.Length)
match_2 = MatchTree(Tree=partition_2, Guide=filter)
rev = ReverseList(List=match_2)
merge_4 = Merge(Data1=match, Data2=rev)
shift = ShiftList(List=merge_4, Shift=1, Wrap=True)
trim_3 = TrimTree(Tree=shift, Depth=1)
ln_3 = Line(StartPoint=merge_4, EndPoint=trim_3)
join_2 = JoinCurves(Curves=ln_3, Preserve=False)
trim_4 = TrimTree(Tree=join_2, Depth=1)

dom_2 = ConstructDomain(DomainStart=eval_2.Parameter, DomainEnd=eval_3.Parameter)
subcrv = SubCurve(BaseCurve=referencecurvewall_2, Domain=dom_2)
move_6 = Move(Geometry=subcrv, Motion=amp_2)  # -> Geometry, Transform
move_7 = Move(Geometry=move_6.Geometry, Motion=amp_3)  # -> Geometry, Transform
ln_4 = Line(StartPoint=match, EndPoint=match_2)
merge_5 = Merge(Data1=graft(move_6.Geometry), Data2=ln_4, Data3=graft(move_7.Geometry))
join_3 = JoinCurves(Curves=merge_5, Preserve=False)
trim_5 = TrimTree(Tree=join_3, Depth=1)

filter_2 = StreamFilter(Gate=constructionmethod_2, Stream0=trim_5, Stream1=trim_4, Stream2=trim_4)

branch_3 = TreeBranch(Tree=filter_2, Path=dispatch.ListB, MaintainPaths=True)
branch_4 = TreeBranch(Tree=filter_2, Path=dispatch.ListA, MaintainPaths=True)
windows = Curve(branch_4)
doors = Curve(branch_3)
windows_2 = ClusterOutput(windows)
doors_2 = ClusterOutput(doors)
