# Grasshopper definition Director.ghx (Grasshopper 1.0.7)
# plug-ins: Hops, Pancake

hvac_system_template = ValueList({"ElectricBaseboard", "BoilerBaseboard", "ASHPBaseboard", "DHWBaseboard", "EvapCoolers_ElectricBaseboard", "EvapCoolers_BoilerBaseboard", "EvapCoolers_ASHPBaseboard", "EvapCoolers_DHWBaseboard", "EvapCoolers_Furnace", "EvapCoolers_UnitHeaters"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}, selected="ASHPBaseboard")
panel = Panel("E:\Nextcloud\Public\FOR2363\TP4\LUH\HVAC-Systems\BatchCurrent\Data_Source\Simulation-Files")
fassade = ValueList({"Horizontal-Windows", "Vertical-Windows", "Ribbon-Windows"}, selected="Vertical-Windows")
fassade_2 = ValueList({"Horizontal-Windows": 0, "Vertical-Windows": 1, "Ribbon-Windows": 2}, selected="Horizontal-Windows")  # disabled
number_slider = Slider(2.5, range=0..10)
panel_2 = Panel("C:\Git\Work\FOR2363\Parametric-H-Shape-Office-Building-Model\src")
orientation = GetNumber(Slider(60, range=0..360), AtLeast=1, AtMost=1, Maximum=1.797693135e+308, Minimum=-1.797693135e+308, TreeAccess=False)
numberoffloors = GetNumber(Slider(5, range=0..10), AtLeast=1, AtMost=1, Maximum=1.797693135e+308, Minimum=-1.797693135e+308, TreeAccess=False)
floorheight = GetNumber(Slider(3, range=0..10), AtLeast=1, AtMost=1, Maximum=1.797693135e+308, Minimum=-1.797693135e+308, TreeAccess=False)
fassade_3 = GetString(fassade, AtLeast=1, AtMost=1, TreeAccess=False)
rasterlength_x = GetNumber(number_slider, AtLeast=1, AtMost=1, Maximum=1.797693135e+308, Minimum=-1.797693135e+308, TreeAccess=False)
rasterlength_y = GetNumber(number_slider, AtLeast=1, AtMost=1, Maximum=1.797693135e+308, Minimum=-1.797693135e+308, TreeAccess=False)
arm_latitudinal_numberofsegments = GetInteger(Slider(5, range=0..10), AtLeast=1, AtMost=1, Maximum=2147483647, Minimum=-2147483648, TreeAccess=False)
arm_longitudinal_numberofsegments = GetInteger(Slider(4, range=0..10), AtLeast=1, AtMost=1, Maximum=2147483647, Minimum=-2147483648, TreeAccess=False)
basebody_inside_latditudinal_numberofseg = GetInteger(Slider(3, range=0..10), AtLeast=1, AtMost=1, Maximum=2147483647, Minimum=-2147483648, TreeAccess=False)  # "BaseBody-Inside-Latditudinal-NumberOfSegments"
courtyard_segmentcount_rasterlength_y = GetNumber(Slider(13, range=0..30), AtLeast=1, AtMost=1, Maximum=1.797693135e+308, Minimum=-1.797693135e+308, TreeAccess=False)
has_courtyard_roof = GetBoolean(Toggle(False), AtLeast=1, AtMost=1, FalseValue="False", TreeAccess=False, TrueValue="True")
hvac_system_template_2 = GetString(hvac_system_template, AtLeast=1, AtMost=1, TreeAccess=False)
output_directory = GetFilePath(panel, AtLeast=1, AtMost=1, TreeAccess=False)

# ---- group: RH_IN:Orientation
orientation_2 = Number(orientation)

# ---- group: RH_IN:NumberOfFloors
numberoffloors_2 = Number(numberoffloors)

# ---- group: RH_IN:FloorHeight
floorheight_2 = Number(floorheight)

# ---- group: RH_IN:Fassade
fassade_4 = Text(fassade_3)

# ---- group: RH_IN:RasterLength-X
rasterlength_x_2 = Number(rasterlength_x)

# ---- group: RH_IN:RasterLength-Y
rasterlength_y_2 = Number(rasterlength_y)

# ---- group: RH_IN:Arm-Latitudinal-NumberOfSegments
arm_latitudinal_numberofsegments_2 = Number(arm_latitudinal_numberofsegments)

# ---- group: RH_IN:Arm-Longitudinal-NumberOfSegments
arm_longitudinal_numberofsegments_2 = Number(arm_longitudinal_numberofsegments)

# ---- group: RH_IN:BaseBody-Inside-Latditudinal-NumberOfSegments
basebody_inside_latditudinal_numberofseg_2 = Number(basebody_inside_latditudinal_numberofseg)  # "BaseBody-Inside-Latditudinal-NumberOfSegments"

# ---- group: RH_IN:Courtyard_SegmentCount_RasterLength-Y
courtyard_segmentcount_rasterlength_y_2 = Number(courtyard_segmentcount_rasterlength_y)

# ---- group: RH_IN:HVAC-System_Template
hvac_system_template_3 = Text(hvac_system_template_2)

# ---- group: RH_IN:Has_Courtyard-Roof
has_courtyard_roof_2 = Boolean(has_courtyard_roof)

# ---- group: RH_IN:Output-Directory
output_directory_2 = FilePath(output_directory)

# ----
working_directory = FilePath(panel_2)
pcghfilepath = DefinitionPath(LastSaveLocalization="neutral,N")  # -> Directory, Name, DirectorySeparator
concat = Concatenate(FragmentA=working_directory, FragmentB=pcghfilepath.DirectorySeparator, FragmentC="Model.ghx")
modelhops = Hops(
    _Path=concat,
    Orientation=orientation_2,
    NumberOfFloors=numberoffloors_2,
    FloorHeight=floorheight_2,
    Fassade=fassade_4,
    RasterLengthX=rasterlength_x_2,
    RasterLengthY=rasterlength_y_2,
    ArmLatitudinalNumberOfSegments=arm_latitudinal_numberofsegments_2,
    ArmLongitudinalNumberOfSegments=arm_longitudinal_numberofsegments_2,
    BaseBodyInsideLatditudinalNumberOfSegments=basebody_inside_latditudinal_numberofseg_2,
    Courtyard_SegmentCount_RasterLengthY=courtyard_segmentcount_rasterlength_y_2,
    CacheResultsInMemory=False,
    CacheSolveResults=False,
    RemoteDefinitionLocation="C:\Git\Work\FOR2363\Parametric-H-Shape-Office-Building-Model\src\Model.ghx",
    RemoteSolveVersion=(0, 1, 0),
    ShowInput_Enabled=False,
    ShowInput_Path=True,
    SynchronousSolve=True)  # -> Zones, ZonesName, Windows, WindowsName, Zones_Underground, ZonesUndergroundName, Courtyard_Upper_Volume, Courtyard_Lower_Volume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
panel_3 = Panel("C:\Git\Work\FOR2363\Model-Runner\src\model.hbjson")
building_fassade_left_windowtowallratio = Number(modelhops.FassadeLeftWindowToWallRatio)
windows_name = Text(modelhops.WindowsName)
building_fassade_upper_windowtowallratio = Number(modelhops.FassadeUpperWindowToWallRatio)
windows = Brep(modelhops.Windows)
zones_underground_name = Text(modelhops.ZonesUndergroundName)
courtyard_upper_volume = Brep(modelhops.Courtyard_Upper_Volume)
courtyard_upper_fassade = Surface(modelhops.Courtyard_Upper_Fassade)
courtyard_lower_roof = Surface(modelhops.Courtyard_Lower_Roof)
zones_name = Text(modelhops.ZonesName)
zones_underground = Brep(modelhops.Zones_Underground)
courtyard_lower_volume = Brep(modelhops.Courtyard_Lower_Volume)
courtyard_lower_fassade = Surface(modelhops.Courtyard_Lower_Fassade)
courtyard_upper_roof = Surface(modelhops.Courtyard_Upper_Roof)
building_fassade_windowtowallratio = Number(modelhops.FassadeTotalWindowToWallRatio)
building_fassade_lower_windowtowallratio = Number(modelhops.FassadeLowerWindowToWallRatio)
building_fassade_right_windowtowallratio = Number(modelhops.FassadeRightWindowToWallRatio)
zones = Brep(modelhops.Zones)
merge = Merge(Data1=courtyard_upper_roof, Data2=courtyard_lower_roof)
concat_2 = Concatenate(FragmentA=working_directory, FragmentB=pcghfilepath.DirectorySeparator, FragmentC="EnergyModel.ghx")
context_bake = ContextBake(Geometry=zones)
context_bake_2 = ContextBake(Geometry=windows)
context_bake_3 = ContextBake(Zones_Underground=zones_underground)
energymodelhops = Hops(
    _Path=concat_2,
    Zones=zones,
    ZonesName=zones_name,
    Windows=windows,
    WindowsName=windows_name,
    Zones_Underground=zones_underground,
    ZonesUndergroundName=zones_underground_name,
    CourtyardsRoof=merge,
    OutputDirectory=output_directory_2,
    Has_CourtyardRoof=has_courtyard_roof_2,
    HVACSystem_Template=hvac_system_template_3,
    CacheResultsInMemory=False,
    CacheSolveResults=False,
    RemoteDefinitionLocation="C:\Git\Work\FOR2363\Parametric-H-Shape-Office-Building-Model\src\EnergyModel.ghx",
    RemoteSolveVersion=(0, 1, 0),
    ShowInput_Enabled=False,
    ShowInput_Path=True,
    SynchronousSolve=True)  # -> HoneybeeJSON, HoneybeeFilePath
strtoobj = HBStringToObject(hb_str=energymodelhops.HoneybeeJSON)  # -> hb_obj; plug-in component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
context_print = ContextPrint(HoneybeeFilePath=energymodelhops.HoneybeeFilePath)
run = Boolean(Toggle(False))
filter = StreamFilter(Gate=run, Stream1=energymodelhops.HoneybeeJSON)
concat_3 = Concatenate(FragmentA=working_directory, FragmentB=pcghfilepath.DirectorySeparator, FragmentC="Simulation.ghx")
vizbytype = HBVisualizeByType(hb_objs=strtoobj)  # -> walls, interior_walls, roofs, ceilings, exterior_floors, interior_floors, air_walls, apertures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; plug-in component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
hops = Hops(
    _Path=concat_3,
    HoneybeeJSON=filter,
    EPWFilePath="C:\EnergyPlusV9-5-0\WeatherData\DEU_Munich.108660_IWEC.epw",
    OutputDirectory="E:\Nextcloud\Public\FOR2363\TP4\LUH\HVAC-Systems\BatchCurrent\Data_Source\Simulation-Files",
    CacheResultsInMemory=True,
    CacheSolveResults=True,
    RemoteDefinitionLocation="C:\Git\Work\FOR2363\Parametric-H-Shape-Office-Building-Model\src\Simulation.ghx",
    RemoteSolveVersion=(0, 1, 0),
    ShowInput_Enabled=False,
    ShowInput_Path=True,
    SynchronousSolve=True)
context_print_2 = ContextPrint(SQLFilePath=hops)
