# Grasshopper definition Director.ghx (Grasshopper 1.0.7)
# plug-ins: Hops, Pancake, BH.UI.Grasshopper

panel = Panel("E:\Nextcloud\Public\FOR2363\TP4\LUH\HVAC-Systems\BatchCurrent\Data_Source\Simulation-Files")
hvac_system_template = ValueList({"IdealAirSystem", "ElectricBaseboard", "BoilerBaseboard", "ASHPBaseboard", "DHWBaseboard", "EvapCoolers_ElectricBaseboard", "EvapCoolers_BoilerBaseboard", "EvapCoolers_ASHPBaseboard", "EvapCoolers_DHWBaseboard", "EvapCoolers_Furnace"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}, selected="ResidentialHP")
# Fan Coil Heating Rate
panel_2 = Panel("Heating Coil Heating Rate")
fassade = ValueList({"Horizontal-Windows", "Vertical-Windows", "Ribbon-Windows"}, selected="Horizontal-Windows")
fassade_2 = ValueList({"Horizontal-Windows": 0, "Vertical-Windows": 1, "Ribbon-Windows": 2}, selected="Horizontal-Windows")  # disabled
number_slider = Slider(2.5, range=0..10)
merge = Merge(Data1="AllSummaryMonthlyAndSizingPeriod")
list = ValueList({"Ocean", "Country", "Suburbs", "Urban", "City"}, selected="City")
merge_2 = Merge(Data2=panel_2, Data3="Heating Coil Electricity Rate")
panel_3 = Panel("C:\Git\Work\FOR2363\Parametric-H-Shape-Office-Building-Model\src")
orientation = GetNumber(Slider(29.9, range=0..360), AtLeast=1, AtMost=1, Maximum=1.797693135e+308, Minimum=-1.797693135e+308, TreeAccess=False)
numberoffloors = GetNumber(Slider(8, range=0..10), AtLeast=1, AtMost=1, Maximum=1.797693135e+308, Minimum=-1.797693135e+308, TreeAccess=False)
floorheight = GetNumber(Slider(3, range=0..10), AtLeast=1, AtMost=1, Maximum=1.797693135e+308, Minimum=-1.797693135e+308, TreeAccess=False)
fassade_3 = GetString(fassade, AtLeast=1, AtMost=1, TreeAccess=False)
rasterlength_x = GetNumber(number_slider, AtLeast=1, AtMost=1, Maximum=1.797693135e+308, Minimum=-1.797693135e+308, TreeAccess=False)
rasterlength_y = GetNumber(number_slider, AtLeast=1, AtMost=1, Maximum=1.797693135e+308, Minimum=-1.797693135e+308, TreeAccess=False)
arm_latitudinal_numberofsegments = GetInteger(Slider(5, range=0..10), AtLeast=1, AtMost=1, Maximum=2147483647, Minimum=-2147483648, TreeAccess=False)
arm_longitudinal_numberofsegments = GetInteger(Slider(4, range=0..10), AtLeast=1, AtMost=1, Maximum=2147483647, Minimum=-2147483648, TreeAccess=False)
basebody_inside_latditudinal_numberofseg = GetInteger(Slider(3, range=0..10), AtLeast=1, AtMost=1, Maximum=2147483647, Minimum=-2147483648, TreeAccess=False)  # "BaseBody-Inside-Latditudinal-NumberOfSegments"
courtyard_segmentcount_rasterlength_y = GetNumber(Slider(13, range=0..30), AtLeast=1, AtMost=1, Maximum=1.797693135e+308, Minimum=-1.797693135e+308, TreeAccess=False)
has_courtyard_roof = GetBoolean(Toggle(False), AtLeast=1, AtMost=1, FalseValue="False", TreeAccess=False, TrueValue="True")
hvac_system_template_2 = GetString(hvac_system_template, AtLeast=1, AtMost=1, TreeAccess=False)
output_names = GetString(merge_2, AtLeast=1, AtMost=1, TreeAccess=True)
report_names = GetString(merge, AtLeast=1, AtMost=1, TreeAccess=True)
output_directory = GetFilePath(panel, AtLeast=1, AtMost=1, TreeAccess=False)
terrain = GetString(list, AtLeast=1, AtMost=1, TreeAccess=False)
panel_4 = Panel("E:\Nextcloud\Public\FOR2363\TP4\LUH\HVAC-Systems\BatchCurrent\Data_Source\Simulation-Files\EnergyModel\openstudio\run\in.idf")

# ---- group: RH_IN:Orientation
orientation_2 = Number(orientation)

# ---- group: RH_IN:NumberOfFloors
numberoffloors_2 = Number(numberoffloors)

# ---- group: RH_IN:FloorHeight
floorheight_2 = Number(floorheight)

# ---- group: RH_IN:Fassade
fassade_4 = Text(fassade_3)

# ---- group: RH_IN:RasterLength-X
rasterlength_x_2 = Number(rasterlength_x)

# ---- group: RH_IN:RasterLength-Y
rasterlength_y_2 = Number(rasterlength_y)

# ---- group: RH_IN:Arm-Latitudinal-NumberOfSegments
arm_latitudinal_numberofsegments_2 = Number(arm_latitudinal_numberofsegments)

# ---- group: RH_IN:Arm-Longitudinal-NumberOfSegments
arm_longitudinal_numberofsegments_2 = Number(arm_longitudinal_numberofsegments)

# ---- group: RH_IN:BaseBody-Inside-Latditudinal-NumberOfSegments
basebody_inside_latditudinal_numberofseg_2 = Number(basebody_inside_latditudinal_numberofseg)  # "BaseBody-Inside-Latditudinal-NumberOfSegments"

# ---- group: RH_IN:Courtyard_SegmentCount_RasterLength-Y
courtyard_segmentcount_rasterlength_y_2 = Number(courtyard_segmentcount_rasterlength_y)

# ---- group: RH_IN:Terrain
terrain_2 = Text(terrain)

# ---- group: RH_IN:HVAC-System_Template
hvac_system_template_3 = Text(hvac_system_template_2)

# ---- group: RH_IN:Has_Courtyard-Roof
has_courtyard_roof_2 = Boolean(has_courtyard_roof)

# ----
output_directory_2 = FilePath(output_directory)
output_names_2 = Text(output_names)
report_names_2 = Text(report_names)
working_directory = FilePath(panel_3)
pcghfilepath = DefinitionPath(LastSaveLocalization="neutral,N")  # -> Directory, Name, DirectorySeparator
concat = Concatenate(FragmentA=working_directory, FragmentB=pcghfilepath.DirectorySeparator, FragmentC="Model.ghx")
modelhops = Hops(
    _Path=concat,
    Orientation=orientation_2,
    NumberOfFloors=numberoffloors_2,
    FloorHeight=floorheight_2,
    Fassade=fassade_4,
    RasterLengthX=rasterlength_x_2,
    RasterLengthY=rasterlength_y_2,
    ArmLatitudinalNumberOfSegments=arm_latitudinal_numberofsegments_2,
    ArmLongitudinalNumberOfSegments=arm_longitudinal_numberofsegments_2,
    BaseBodyInsideLatditudinalNumberOfSegments=basebody_inside_latditudinal_numberofseg_2,
    Courtyard_SegmentCount_RasterLengthY=courtyard_segmentcount_rasterlength_y_2,
    CacheResultsInMemory=False,
    CacheSolveResults=False,
    RemoteDefinitionLocation="C:\Git\Work\FOR2363\Parametric-H-Shape-Office-Building-Model\src\Model.ghx",
    RemoteSolveVersion=(0, 1, 0),
    ShowInput_Enabled=False,
    ShowInput_Path=True,
    SynchronousSolve=True)  # -> Zones, ZonesName, Windows, WindowsName, Zones_Underground, ZonesUndergroundName, Courtyard_Upper_Volume, Courtyard_Lower_Volume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
cluster = Cluster(num=Slider(4.6, range=0..10))
pt = Point(cluster)
epsimulationfile = EPSimulationFile(
    AdvancedConstructionSurfaceZoneConcepts_Objects="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",
    AirDistribution_Objects="{ \"_t\" : \"BH.oM.Adapters.EnergyPlus.AirDistribution_Objects\", \"BHoM_Guid\" : \"fb878eae-3ff6-41cb-8673-e4fc33cd5e51\", \"Name\" : \"\", \"Fragments\" : [], \"Tags\" : [], \"CustomData\" : { }, \"_bhomVersion\" : \"5.0\" }",
    AirflowNetwork_Objects="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",
    Coils_Objects="{ \"_t\" : \"BH.oM.Adapters.EnergyPlus.Coils_Objects\", \"BHoM_Guid\" : \"375a2185-c558-4ea1-9cd3-1908f9167cf3\", \"Name\" : \"\", \"Fragments\" : [], \"Tags\" : [], \"CustomData\" : { }, \"_bhomVersion\" : \"5.0\" }",
    ComplianceObjects_Objects="{ \"_t\" : \"BH.oM.Adapters.EnergyPlus.ComplianceObjects_Objects\", \"BHoM_Guid\" : \"ee167ae9-195d-4344-a6cc-442a1077bdca\", \"Name\" : \"\", \"Fragments\" : [], \"Tags\" : [], \"CustomData\" : { }, \"Compliance_Building\" : null, \"_bhomVersion\" : \"5.0\" }",
    CondenserEquipmentandHeatExchangers_Objects="{ \"_t\" : \"BH.oM.Adapters.EnergyPlus.CondenserEquipmentandHeatExchangers_Objects\", \"BHoM_Guid\" : \"2fb497f5-4834-4740-9c79-1eb2cc2d8bcc\", \"Name\" : \"\", \"Fragments\" : [], \"Tags\" : [], \"CustomData\" : { }, \"_bhomVersion\" : \"5.0\" }",
    Controllers_Objects="{ \"_t\" : \"BH.oM.Adapters.EnergyPlus.Controllers_Objects\", \"BHoM_Guid\" : \"565dc71e-0cc6-419d-b811-b60d91bc0c90\", \"Name\" : \"\", \"Fragments\" : [], \"Tags\" : [], \"CustomData\" : { }, \"_bhomVersion\" : \"5.0\" }",
    Daylighting_Objects="{ \"_t\" : \"BH.oM.Adapters.EnergyPlus.Daylighting_Objects\", \"BHoM_Guid\" : \"253709c0-91d1-4b46-9a2d-6ad0679cda76\", \"Name\" : \"\", \"Fragments\" : [], \"Tags\" : [], \"CustomData\" : { }, \"OutputControl_IlluminanceMap_Style\" : null, \"_bhomVersion\" : \"5.0\" }",
    DemandLimitingControls_Objects="{ \"_t\" : \"BH.oM.Adapters.EnergyPlus.DemandLimitingControls_Objects\", \"BHoM_Guid\" : \"caa7c153-3b84-47ac-8fc2-e01d48421342\", \"Name\" : \"\", \"Fragments\" : [], \"Tags\" : [], \"CustomData\" : { }, \"_bhomVersion\" : \"5.0\" }",
    DetailedGroundHeatTransfer_Objects="{ \"_t\" : \"BH.oM.Adapters.EnergyPlus.DetailedGroundHeatTransfer_Objects\", \"BHoM_Guid\" : \"6215edec-c05d-414f-91a4-d9c85f9f9ad6\", \"Name\" : \"\", \"Fragments\" : [], \"Tags\" : [], \"CustomData\" : { }, \"_bhomVersion\" : \"5.0\" }",
    Economics_Objects="{ \"_t\" : \"BH.oM.Adapters.EnergyPlus.Economics_Objects\", \"BHoM_Guid\" : \"be73cb8e-3dd8-41b6-8b12-f24e5296062f\", \"Name\" : \"\", \"Fragments\" : [], \"Tags\" : [], \"CustomData\" : { }, \"CurrencyType\" : null, \"LifeCycleCost_Parameters\" : null, \"_bhomVersion\" : \"5.0\" }",
    ElectricLoadCenterGeneratorSpecifications_Objects="{ \"_t\" : \"BH.oM.Adapters.EnergyPlus.ElectricLoadCenterGeneratorSpecifications_Objects\", \"BHoM_Guid\" : \"23d5ce43-b130-443a-ad11-1b589ff5fc4a\", \"Name\" : \"\", \"Fragments\" : [], \"Tags\" : [], \"CustomData\" : { }, \"_bhomVersion\" : \"5.0\" }",
    EnergyManagementSystemEMS_Objects="{ \"_t\" : \"BH.oM.Adapters.EnergyPlus.EnergyManagementSystemEMS_Objects\", \"BHoM_Guid\" : \"2a59a904-1ea9-4efc-870c-65c65c689f99\", \"Name\" : \"\", \"Fragments\" : [], \"Tags\" : [], \"CustomData\" : { }, \"_bhomVersion\" : \"5.0\" }",
    EvaporativeCoolers_Objects="{ \"_t\" : \"BH.oM.Adapters.EnergyPlus.EvaporativeCoolers_Objects\", \"BHoM_Guid\" : \"cccd9269-e94a-4e80-be6f-a62934a8b84f\", \"Name\" : \"\", \"Fragments\" : [], \"Tags\" : [], \"CustomData\" : { }, \"_bhomVersion\" : \"5.0\" }",
    ExteriorEquipment_Objects="{ \"_t\" : \"BH.oM.Adapters.EnergyPlus.ExteriorEquipment_Objects\", \"BHoM_Guid\" : \"aed90875-3988-4c46-8eb4-7238336e96ff\", \"Name\" : \"\", \"Fragments\" : [], \"Tags\" : [], \"CustomData\" : { }, \"_bhomVersion\" : \"5.0\" }",
    ExternalInterface_Objects="{ \"_t\" : \"BH.oM.Adapters.EnergyPlus.ExternalInterface_Objects\", \"BHoM_Guid\" : \"4112801b-70ba-424e-b827-38467c129413\", \"Name\" : \"\", \"Fragments\" : [], \"Tags\" : [], \"CustomData\" : { }, \"_bhomVersion\" : \"5.0\" }",
    Fans_Objects="{ \"_t\" : \"BH.oM.Adapters.EnergyPlus.Fans_Objects\", \"BHoM_Guid\" : \"e75646c7-0bed-4592-93cd-e7653fe3182b\", \"Name\" : \"\", \"Fragments\" : [], \"Tags\" : [], \"CustomData\" : { }, \"_bhomVersion\" : \"5.0\" }",
    FluidProperties_Objects="{ \"_t\" : \"BH.oM.Adapters.EnergyPlus.FluidProperties_Objects\", \"BHoM_Guid\" : \"e8bb232a-4340-4f48-8901-a0468acb9cd7\", \"Name\" : \"\", \"Fragments\" : [], \"Tags\" : [], \"CustomData\" : { }, \"_bhomVersion\" : \"5.0\" }",
    GeneralDataEntry_Objects="{ \"_t\" : \"BH.oM.Adapters.EnergyPlus.GeneralDataEntry_Objects\", \"BHoM_Guid\" : \"ed7a42ab-447c-4cf4-ac09-c7f9a13a1665\", \"Name\" : \"\", \"Fragments\" : [], \"Tags\" : [], \"CustomData\" : { }, \"_bhomVersion\" : \"5.0\" }",
    HeatRecovery_Objects="{ \"_t\" : \"BH.oM.Adapters.EnergyPlus.HeatRecovery_Objects\", \"BHoM_Guid\" : \"ee0ae22d-6fea-44fb-b494-b274011be03a\", \"Name\" : \"\", \"Fragments\" : [], \"Tags\" : [], \"CustomData\" : { }, \"_bhomVersion\" : \"5.0\" }",
    HumidifiersandDehumidifiers_Objects="{ \"_t\" : \"BH.oM.Adapters.EnergyPlus.HumidifiersandDehumidifiers_Objects\", \"BHoM_Guid\" : \"0f1e2950-b956-41c5-a99e-230c2a5a3069\", \"Name\" : \"\", \"Fragments\" : [], \"Tags\" : [], \"CustomData\" : { }, \"_bhomVersion\" : \"5.0\" }",
    HVACDesignObjects_Objects="{ \"_t\" : \"BH.oM.Adapters.EnergyPlus.HVACDesignObjects_Objects\", \"BHoM_Guid\" : \"30637ca1-b298-47cf-b3ba-a7708edb9913\", \"Name\" : \"\", \"Fragments\" : [], \"Tags\" : [], \"CustomData\" : { }, \"Sizing_Parameters\" : null, \"OutputControl_Sizing_Style\" : null, \"_bhomVersion\" : \"5.0\" }",
    HVACTemplates_Objects="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",
    HybridModel_Objects="{ \"_t\" : \"BH.oM.Adapters.EnergyPlus.HybridModel_Objects\", \"BHoM_Guid\" : \"c266d2fd-03e4-4446-b752-fedaff1ee3bf\", \"Name\" : \"\", \"Fragments\" : [], \"Tags\" : [], \"CustomData\" : { }, \"_bhomVersion\" : \"5.0\" }",
    InternalGains_Objects="{ \"_t\" : \"BH.oM.Adapters.EnergyPlus.InternalGains_Objects\", \"BHoM_Guid\" : \"68b5abf0-3e78-4846-a01e-822ee9b23a57\", \"Name\" : \"\", \"Fragments\" : [], \"Tags\" : [], \"CustomData\" : { }, \"_bhomVersion\" : \"5.0\" }",
    LocationandClimate_Objects="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",
    NodeBranchManagement_Objects="{ \"_t\" : \"BH.oM.Adapters.EnergyPlus.NodeBranchManagement_Objects\", \"BHoM_Guid\" : \"8904f1cd-c3b8-4ce4-b1bd-29d8ab7366f4\", \"Name\" : \"\", \"Fragments\" : [], \"Tags\" : [], \"CustomData\" : { }, \"_bhomVersion\" : \"5.0\" }",
    NonZoneEquipment_Objects="{ \"_t\" : \"BH.oM.Adapters.EnergyPlus.NonZoneEquipment_Objects\", \"BHoM_Guid\" : \"150824e3-278a-4525-9b36-a55195b12abc\", \"Name\" : \"\", \"Fragments\" : [], \"Tags\" : [], \"CustomData\" : { }, \"_bhomVersion\" : \"5.0\" }",
    OperationalFaults_Objects="{ \"_t\" : \"BH.oM.Adapters.EnergyPlus.OperationalFaults_Objects\", \"BHoM_Guid\" : \"5848ecbe-488c-4397-ba5d-e2abd619773f\", \"Name\" : \"\", \"Fragments\" : [], \"Tags\" : [], \"CustomData\" : { }, \"_bhomVersion\" : \"5.0\" }",
    OutputReporting_Objects="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",
    Parametrics_Objects="{ \"_t\" : \"BH.oM.Adapters.EnergyPlus.Parametrics_Objects\", \"BHoM_Guid\" : \"cda932d3-9a01-4080-8048-b0bf104346d4\", \"Name\" : \"\", \"Fragments\" : [], \"Tags\" : [], \"CustomData\" : { }, \"Parametric_Logic\" : null, \"Parametric_RunControl\" : null, \"Parametric_FileNameSuffix\" : null, \"_bhomVersion\" : \"5.0\" }",
    PerformanceCurves_Objects="{ \"_t\" : \"BH.oM.Adapters.EnergyPlus.PerformanceCurves_Objects\", \"BHoM_Guid\" : \"8a33bd2a-61ff-46d7-93ad-9390904e4c9b\", \"Name\" : \"\", \"Fragments\" : [], \"Tags\" : [], \"CustomData\" : { }, \"_bhomVersion\" : \"5.0\" }",
    PerformanceTables_Objects="{ \"_t\" : \"BH.oM.Adapters.EnergyPlus.PerformanceTables_Objects\", \"BHoM_Guid\" : \"35bdba67-ada6-45d6-848a-e31861da547e\", \"Name\" : \"\", \"Fragments\" : [], \"Tags\" : [], \"CustomData\" : { }, \"_bhomVersion\" : \"5.0\" }",
    PlantHeatingandCoolingEquipment_Objects="{ \"_t\" : \"BH.oM.Adapters.EnergyPlus.PlantHeatingandCoolingEquipment_Objects\", \"BHoM_Guid\" : \"81fdd452-3921-4dcf-a82a-35a87cc1123a\", \"Name\" : \"\", \"Fragments\" : [], \"Tags\" : [], \"CustomData\" : { }, \"_bhomVersion\" : \"5.0\" }",
    PlantCondenserControl_Objects="{ \"_t\" : \"BH.oM.Adapters.EnergyPlus.PlantCondenserControl_Objects\", \"BHoM_Guid\" : \"1ddfdd16-bd51-492d-bd3d-c1ad5d9a08c4\", \"Name\" : \"\", \"Fragments\" : [], \"Tags\" : [], \"CustomData\" : { }, \"_bhomVersion\" : \"5.0\" }",
    PlantCondenserFlowControl_Objects="{ \"_t\" : \"BH.oM.Adapters.EnergyPlus.PlantCondenserFlowControl_Objects\", \"BHoM_Guid\" : \"798c565d-2350-4ee0-b7ce-c367264174fb\", \"Name\" : \"\", \"Fragments\" : [], \"Tags\" : [], \"CustomData\" : { }, \"_bhomVersion\" : \"5.0\" }",
    PlantCondenserLoops_Objects="{ \"_t\" : \"BH.oM.Adapters.EnergyPlus.PlantCondenserLoops_Objects\", \"BHoM_Guid\" : \"8ed8d8dc-0961-4771-98db-d9aaa51df486\", \"Name\" : \"\", \"Fragments\" : [], \"Tags\" : [], \"CustomData\" : { }, \"_bhomVersion\" : \"5.0\" }",
    Pumps_Objects="{ \"_t\" : \"BH.oM.Adapters.EnergyPlus.Pumps_Objects\", \"BHoM_Guid\" : \"abda9a67-071c-425f-88f2-1d6115e60aeb\", \"Name\" : \"\", \"Fragments\" : [], \"Tags\" : [], \"CustomData\" : { }, \"_bhomVersion\" : \"5.0\" }",
    PythonPluginSystem_Objects="{ \"_t\" : \"BH.oM.Adapters.EnergyPlus.PythonPluginSystem_Objects\", \"BHoM_Guid\" : \"8382d09e-f5bd-4aea-b85e-62fc4f5d48f5\", \"Name\" : \"\", \"Fragments\" : [], \"Tags\" : [], \"CustomData\" : { }, \"PythonPlugin_SearchPaths\" : null, \"PythonPlugin_Variables\" : null, \"_bhomVersion\" : \"5.0\" }",
    Refrigeration_Objects="{ \"_t\" : \"BH.oM.Adapters.EnergyPlus.Refrigeration_Objects\", \"BHoM_Guid\" : \"a2c15e2e-0bd8-430f-94b0-0a3be5e1e967\", \"Name\" : \"\", \"Fragments\" : [], \"Tags\" : [], \"CustomData\" : { }, \"_bhomVersion\" : \"5.0\" }",
    RoomAirModels_Objects="{ \"_t\" : \"BH.oM.Adapters.EnergyPlus.RoomAirModels_Objects\", \"BHoM_Guid\" : \"74824568-2079-411a-95ea-e1b82046734b\", \"Name\" : \"\", \"Fragments\" : [], \"Tags\" : [], \"CustomData\" : { }, \"_bhomVersion\" : \"5.0\" }",
    Schedules_Objects="{ \"_t\" : \"BH.oM.Adapters.EnergyPlus.Schedules_Objects\", \"BHoM_Guid\" : \"3d4b97a9-5fab-4063-b21c-d8fe13fa2142\", \"Name\" : \"\", \"Fragments\" : [], \"Tags\" : [], \"CustomData\" : { }, \"Schedule_File_Shading\" : null, \"_bhomVersion\" : \"5.0\" }",
    SetpointManagers_Objects="{ \"_t\" : \"BH.oM.Adapters.EnergyPlus.SetpointManagers_Objects\", \"BHoM_Guid\" : \"383f132e-5f70-4d46-8ded-0c677487045f\", \"Name\" : \"\", \"Fragments\" : [], \"Tags\" : [], \"CustomData\" : { }, \"_bhomVersion\" : \"5.0\" }",
    SimulationParameters_Objects="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",
    SolarCollectors_Objects="{ \"_t\" : \"BH.oM.Adapters.EnergyPlus.SolarCollectors_Objects\", \"BHoM_Guid\" : \"4eb45d19-adc8-4c8a-8a17-80a598add596\", \"Name\" : \"\", \"Fragments\" : [], \"Tags\" : [], \"CustomData\" : { }, \"_bhomVersion\" : \"5.0\" }",
    SurfaceConstructionElements_Objects="{ \"_t\" : \"BH.oM.Adapters.EnergyPlus.SurfaceConstructionElements_Objects\", \"BHoM_Guid\" : \"a04302a4-249f-4593-b278-413ddb4c98f9\", \"Name\" : \"\", \"Fragments\" : [], \"Tags\" : [], \"CustomData\" : { }, \"_bhomVersion\" : \"5.0\" }",
    SystemAvailabilityManagers_Objects="{ \"_t\" : \"BH.oM.Adapters.EnergyPlus.SystemAvailabilityManagers_Objects\", \"BHoM_Guid\" : \"0b6a0852-b554-4b78-bfb0-294bf24dde14\", \"Name\" : \"\", \"Fragments\" : [], \"Tags\" : [], \"CustomData\" : { }, \"_bhomVersion\" : \"5.0\" }",
    ThermalZonesandSurfaces_Objects="{ \"_t\" : \"BH.oM.Adapters.EnergyPlus.ThermalZonesandSurfaces_Objects\", \"BHoM_Guid\" : \"51623f29-bd53-4afa-827e-1e83ffcd8365\", \"Name\" : \"\", \"Fragments\" : [], \"Tags\" : [], \"CustomData\" : { }, \"GlobalGeometryRules\" : null, \"GeometryTransform\" : null, \"_bhomVersion\" : \"5.0\" }",
    UnitaryEquipment_Objects="{ \"_t\" : \"BH.oM.Adapters.EnergyPlus.UnitaryEquipment_Objects\", \"BHoM_Guid\" : \"83692080-c40d-434d-b790-7babf76df554\", \"Name\" : \"\", \"Fragments\" : [], \"Tags\" : [], \"CustomData\" : { }, \"_bhomVersion\" : \"5.0\" }",
    UserDefinedHVACandPlantComponentModels_Objects="{ \"_t\" : \"BH.oM.Adapters.EnergyPlus.UserDefinedHVACandPlantComponentModels_Objects\", \"BHoM_Guid\" : \"b1a585d6-8c84-439e-a000-3e313ff4a96f\", \"Name\" : \"\", \"Fragments\" : [], \"Tags\" : [], \"CustomData\" : { }, \"_bhomVersion\" : \"5.0\" }",
    VariableRefrigerantFlowEquipment_Objects="{ \"_t\" : \"BH.oM.Adapters.EnergyPlus.VariableRefrigerantFlowEquipment_Objects\", \"BHoM_Guid\" : \"2d209827-4fcc-4e31-8e14-23c9f5fe24cc\", \"Name\" : \"\", \"Fragments\" : [], \"Tags\" : [], \"CustomData\" : { }, \"_bhomVersion\" : \"5.0\" }",
    WaterHeatersandThermalStorage_Objects="{ \"_t\" : \"BH.oM.Adapters.EnergyPlus.WaterHeatersandThermalStorage_Objects\", \"BHoM_Guid\" : \"34d2fa44-f246-4dbc-a613-5e2baf02344b\", \"Name\" : \"\", \"Fragments\" : [], \"Tags\" : [], \"CustomData\" : { }, \"_bhomVersion\" : \"5.0\" }",
    WaterSystems_Objects="{ \"_t\" : \"BH.oM.Adapters.EnergyPlus.WaterSystems_Objects\", \"BHoM_Guid\" : \"295646bf-9b45-4500-8caa-529b3e5cb11d\", \"Name\" : \"\", \"Fragments\" : [], \"Tags\" : [], \"CustomData\" : { }, \"_bhomVersion\" : \"5.0\" }",
    ZoneAirflow_Objects="{ \"_t\" : \"BH.oM.Adapters.EnergyPlus.ZoneAirflow_Objects\", \"BHoM_Guid\" : \"45baa7e6-0c08-4039-aa11-f5a810134a12\", \"Name\" : \"\", \"Fragments\" : [], \"Tags\" : [], \"CustomData\" : { }, \"_bhomVersion\" : \"5.0\" }",
    ZoneHVACAirLoopTerminalUnits_Objects="{ \"_t\" : \"BH.oM.Adapters.EnergyPlus.ZoneHVACAirLoopTerminalUnits_Objects\", \"BHoM_Guid\" : \"d35b46a2-85dd-4e29-86c0-242d95854155\", \"Name\" : \"\", \"Fragments\" : [], \"Tags\" : [], \"CustomData\" : { }, \"_bhomVersion\" : \"5.0\" }",
    ZoneHVACControlsandThermostats_Objects="{ \"_t\" : \"BH.oM.Adapters.EnergyPlus.ZoneHVACControlsandThermostats_Objects\", \"BHoM_Guid\" : \"90b2700f-4644-47ae-95c6-dd6f8b3407c7\", \"Name\" : \"\", \"Fragments\" : [], \"Tags\" : [], \"CustomData\" : { }, \"_bhomVersion\" : \"5.0\" }",
    ZoneHVACEquipmentConnections_Objects="{ \"_t\" : \"BH.oM.Adapters.EnergyPlus.ZoneHVACEquipmentConnections_Objects\", \"BHoM_Guid\" : \"84bddb86-27de-4408-a7c6-35b7558b3e81\", \"Name\" : \"\", \"Fragments\" : [], \"Tags\" : [], \"CustomData\" : { }, \"_bhomVersion\" : \"5.0\" }",
    ZoneHVACForcedAirUnits_Objects="{ \"_t\" : \"BH.oM.Adapters.EnergyPlus.ZoneHVACForcedAirUnits_Objects\", \"BHoM_Guid\" : \"151ecd7a-ddcd-4e46-aa82-7f13d85b4c2d\", \"Name\" : \"\", \"Fragments\" : [], \"Tags\" : [], \"CustomData\" : { }, \"_bhomVersion\" : \"5.0\" }",
    ZoneHVACRadiativeConvectiveUnits_Objects="{ \"_t\" : \"BH.oM.Adapters.EnergyPlus.ZoneHVACRadiativeConvectiveUnits_Objects\", \"BHoM_Guid\" : \"ac1948b3-c0f0-4251-a9e4-33f40a8d8abd\", \"Name\" : \"\", \"Fragments\" : [], \"Tags\" : [], \"CustomData\" : { }, \"_bhomVersion\" : \"5.0\" }",
    Component="BH.oM.Adapters.EnergyPlus.EPSimulationFile")
file = ReadFile(File=panel_4, PerLineParse=False)
panel_5 = Panel("C:\Git\Work\FOR2363\Model-Runner\src\model.hbjson")
building_fassade_left_windowtowallratio = Number(modelhops.FassadeLeftWindowToWallRatio)
windows_name = Text(modelhops.WindowsName)
building_fassade_upper_windowtowallratio = Number(modelhops.FassadeUpperWindowToWallRatio)
windows = Brep(modelhops.Windows)
zones_underground_name = Text(modelhops.ZonesUndergroundName)
courtyard_upper_volume = Brep(modelhops.Courtyard_Upper_Volume)
courtyard_upper_fassade = Surface(modelhops.Courtyard_Upper_Fassade)
courtyard_lower_roof = Surface(modelhops.Courtyard_Lower_Roof)
zones_name = Text(modelhops.ZonesName)
zones_underground = Brep(modelhops.Zones_Underground)
courtyard_lower_volume = Brep(modelhops.Courtyard_Lower_Volume)
courtyard_lower_fassade = Surface(modelhops.Courtyard_Lower_Fassade)
courtyard_upper_roof = Surface(modelhops.Courtyard_Upper_Roof)
building_fassade_windowtowallratio = Number(modelhops.FassadeTotalWindowToWallRatio)
building_fassade_lower_windowtowallratio = Number(modelhops.FassadeLowerWindowToWallRatio)
building_fassade_right_windowtowallratio = Number(modelhops.FassadeRightWindowToWallRatio)
zones = Brep(modelhops.Zones)
convertepsimulationfile = ConvertEPSimulationFile(
    EnergyPlusExeFilePath="C:\EnergyPlusV9-5-0\energyplus.exe",
    Input=file,
    ExpandIDF=True,
    IsSilent=True,
    Component="{ .ConvertEPSimulationFile")
merge_3 = Merge(Data1=courtyard_upper_roof, Data2=courtyard_lower_roof)
concat_2 = Concatenate(FragmentA=working_directory, FragmentB=pcghfilepath.DirectorySeparator, FragmentC="EnergyModel.ghx")
fromjson = FromJson(Json=convertepsimulationfile, Component="{ .FromJson")
context_bake = ContextBake(Geometry=zones)
context_bake_2 = ContextBake(Geometry=windows)
context_bake_3 = ContextBake(Zones_Underground=zones_underground)
energymodelhops = Hops(
    _Path=concat_2,
    Zones=zones,
    ZonesName=zones_name,
    Windows=windows,
    WindowsName=windows_name,
    Zones_Underground=zones_underground,
    ZonesUndergroundName=zones_underground_name,
    CourtyardsRoof=merge_3,
    OutputDirectory=output_directory_2,
    Has_CourtyardRoof=has_courtyard_roof_2,
    HVACSystem_Template=hvac_system_template_3,
    CacheResultsInMemory=False,
    CacheSolveResults=False,
    RemoteDefinitionLocation="C:\Git\Work\FOR2363\Parametric-H-Shape-Office-Building-Model\src\EnergyModel.ghx",
    RemoteSolveVersion=(0, 1, 0),
    ShowInput_Enabled=False,
    ShowInput_Path=True,
    SynchronousSolve=True)  # -> HoneybeeJSON, HoneybeeFilePath
explode = Explode(Object=fromjson, Component="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")  # -> AirLoopHVAC, AirLoopHVACReturnPath, AirLoopHVACSupplyPath, AirLoopHVACUnitarySystem, AirLoopHVACZoneMixer, AirLoopHVACZoneSplitter, AirTerminalSingleDuctConstantVolumeNoReheat, AvailabilityManagerScheduled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
strtoobj = HBStringToObject(hb_str=energymodelhops.HoneybeeJSON)  # -> hb_obj; plug-in component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
panel_6 = Panel("E:\Nextcloud\Public\FOR2363\TP4\LUH\HVAC-Systems\BatchCurrent\Data_Source\Simulation-Files\EnergyModel\openstudio\run\eplusout.sql")
txt = Text(energymodelhops.HoneybeeJSON)
run = Boolean(Toggle(True))
context_print = ContextPrint(HoneybeeFilePath=energymodelhops.HoneybeeFilePath)
vizbytype = HBVisualizeByType(hb_objs=strtoobj)  # -> walls, interior_walls, roofs, ceilings, exterior_floors, interior_floors, air_walls, apertures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; plug-in component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
filter = StreamFilter(Gate=run, Stream1=energymodelhops.HoneybeeJSON)
concat_3 = Concatenate(FragmentA=working_directory, FragmentB=pcghfilepath.DirectorySeparator, FragmentC="Simulation.ghx")
explode_2 = Explode(Object=explode.People, Component="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")  # -> _2019MediumOfficeConference_People, _2019MediumOfficeOpenOffice_People, Name, Tags, BHoM_Guid
txt_2 = Text("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")
hops = Hops(
    _Path=concat_3,
    HoneybeeJSON=filter,
    Terrain=terrain_2,
    EPWFilePath="C:\EnergyPlusV9-5-0\WeatherData\DEU_Munich.108660_IWEC.epw",
    OutputDirectory=output_directory_2,
    OutputNames=output_names_2,
    ReportNames=report_names_2,
    CacheResultsInMemory=True,
    CacheSolveResults=True,
    RemoteDefinitionLocation="C:\Git\Work\FOR2363\Parametric-H-Shape-Office-Building-Model\src\Simulation.ghx",
    RemoteSolveVersion=(0, 1, 0),
    ShowInput_Enabled=False,
    ShowInput_Path=True,
    SynchronousSolve=True)  # -> SimulationParametersFilePath, IDFFilePath, SQLFilePath, ZoneSizingFilePath, ReportDataDictionaryFilePath, ReportsFilePath
convert = Convert(Component="{ \"SelectedItem\" : null, \"InputParams\" : [], \"OutputParams\" : [], \"BHoM_Guid\" : \"56016c23-ac6c-4d21-bbf1-c62e183217f5\", \"_bhomVersion\" : \"5.0\" }")
getepjsonstring = GetEPJsonString(Component="{ .GetEPJsonString")
people_numberofpeoplecalculationmethod = People_NumberOfPeopleCalculationMethod(
    {"Empty": 0, "AreaPerson": 1, "People": 2, "PeopleArea": 3}, selected="Empty",
    Component="BH.oM.Adapters.EnergyPlus.InternalGains.People_NumberOfPeopleCalculationMethod",
    Selection=0)
explode_3 = Explode(Object=explode_2._2019MediumOfficeConference_People, Component="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")  # -> Activity_level_schedule_name, Fraction_radiant, Number_of_people_calculation_method, Number_of_people_schedule_name, People_per_zone_floor_area, Zone_or_zonelist_name, Name, Tags, BHoM_Guid
customresult = HBReadCustomResult(sql=hops.SQLFilePath, output_names=output_names_2)  # -> results; plug-in component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
readrdd = HBReadResultDictionary(rdd=hops.ReportDataDictionaryFilePath)  # -> outputs; plug-in component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
readzsz = HBReadZoneSizing(zsz=hops.ZoneSizingFilePath)  # -> cooling_load, heating_load; plug-in component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
readhvac = HBReadHVACSizing(sql=hops.SQLFilePath)  # -> zone_names, zone_peak_cool, zone_peak_heat, comp_types, comp_properties, comp_values; plug-in component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
explode_4 = Explode(Component="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")
context_print_2 = ContextPrint(SQLFilePath=hops.SQLFilePath)
bang = ExplodeTree(Data=customresult)  # -> Branch0, Branch1, Branch2, Branch3
bang_2 = ExplodeTree(Data=customresult)  # -> Branch0, Branch1, Branch2, Branch3
readtable = HBReadTabularData()  # -> values, col_names, row_names; plug-in component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
explode_5 = Explode(Component="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")
xdata = LBDeconstructData(data=bang.Branch2)  # -> header, values; plug-in component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
xdata_2 = LBDeconstructData(data=bang.Branch3)  # -> header, values; plug-in component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
item = ListItem(List=flatten(customresult), Index=0, Wrap=True)  # -> Item2, Item1, Item
panel_7 = Panel(readhvac.comp_properties)
readtable_2 = HBReadTabularData(sql=panel_6, table_name="DX Cooling Coils")  # -> values, col_names, row_names; plug-in component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
panel_8 = Panel(readhvac.comp_values)
customresult_2 = HBReadCustomResult(sql=panel_6, output_names=output_names_2)  # -> results; plug-in component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
hourlyplot = LBHourlyPlot(data=item.Item2)  # -> report, mesh, legend, borders, labels, title; plug-in component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
normbyflr = HBNormalizeByFloorArea(data=item.Item1, model=strtoobj)  # -> total_data, room_data; plug-in component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
panel_9 = Panel(xdata.header)
division = Division(A=xdata.values, B=xdata_2.values)
panel_10 = Panel(readtable_2.col_names)
panel_11 = Panel(readtable_2.values)
clean = CleanTree(RemoveNulls=True, RemoveInvalid=True, RemoveEmpty=invert(False), Tree=division)
bang_3 = ExplodeTree(Data=customresult_2)  # -> Branch0, Branch1, Branch2, Branch3
xdata_3 = LBDeconstructData(data=customresult_2)  # -> header, values; plug-in component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
item_2 = ListItem(List=bang_3.Branch0, Index=Slider(800, range=0..1000), Wrap=True)  # -> Item2, Item1, Item
panel_12 = Panel(clean)
hourlyplot_2 = LBHourlyPlot(data=item_2.Item)  # -> report, mesh, legend, borders, labels, title; plug-in component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
panel_13 = Panel(xdata_3.header)

# ==== cluster Cluster
num = ClusterInput()
num_2 = Number(num)
pt = ConstructPoint(XCoordinate=num_2, YCoordinate=0, ZCoordinate=num_2)
pt_2 = ClusterOutput(pt)
