# Grasshopper definition Director.ghx (Grasshopper 1.0.7)
# plug-ins: Hops, Pancake, MetaHopper

panel = Panel("C:\Git\Work\FOR2363\Parametric-H-Shape-Office-Building-Model\src")
panel_2 = Panel("E:\Nextcloud\Public\FOR2363\TP4\LUH\HVAC-Systems\BatchCurrent\Data_Source\Simulation-Files")
pcghfilepath = DefinitionPath(LastSaveLocalization="neutral,N")  # -> Directory, Name, DirectorySeparator
hvac_system_template = ValueList({"IdealAirSystem", "ElectricBaseboard", "BoilerBaseboard", "ASHPBaseboard", "DHWBaseboard", "EvapCoolers_ElectricBaseboard", "EvapCoolers_BoilerBaseboard", "EvapCoolers_ASHPBaseboard", "EvapCoolers_DHWBaseboard", "EvapCoolers_Furnace"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}, selected="ResidentialHP")
# Fan Coil Heating Rate
panel_3 = Panel("Heating Coil Heating Rate")
scripts_directory = FilePath(panel)
fassade = ValueList({"Horizontal-Windows", "Vertical-Windows", "Ribbon-Windows"}, selected="Horizontal-Windows")
fassade_2 = ValueList({"Horizontal-Windows": 0, "Vertical-Windows": 1, "Ribbon-Windows": 2}, selected="Horizontal-Windows")  # disabled
number_slider = Slider(2.5, range=0..10)
shading = ValueList({"External-Shading", "Low-SHGC-Value"}, selected="Low-SHGC-Value")
list = ValueList({"TranslationOnly": 0, "Simulation": 1}, selected="TranslationOnly")
list_2 = ValueList({"GEG", "NZEB", "Passive"}, selected="GEG")
concat = Concatenate(FragmentA=scripts_directory, FragmentB=pcghfilepath.DirectorySeparator, FragmentC="Required-U-Values.csv")
concat_2 = Concatenate(FragmentA=scripts_directory, FragmentB=pcghfilepath.DirectorySeparator, FragmentC="DEU_Munich.108660_IWEC.epw")
list_3 = ValueList({"Ocean", "Country", "Suburbs", "Urban", "City"}, selected="City")
merge = Merge(Data1="AllSummaryMonthlyAndSizingPeriod")
debugmode = Boolean(Toggle(True))
merge_2 = Merge(Data2=panel_3, Data3="Heating Coil Electricity Rate")
run = Boolean(Toggle(False))
int = Integer(list)
terrain = GetString(list_3, AtLeast=1, AtMost=1, TreeAccess=False)
orientation = GetNumber(Slider(29.9, range=0..360), AtLeast=1, AtMost=1, Maximum=1.797693135e+308, Minimum=-1.797693135e+308, TreeAccess=False)
numberoffloors = GetNumber(Slider(4, range=0..10), AtLeast=1, AtMost=1, Maximum=1.797693135e+308, Minimum=-1.797693135e+308, TreeAccess=False)
floorheight = GetNumber(Slider(3, range=0..10), AtLeast=1, AtMost=1, Maximum=1.797693135e+308, Minimum=-1.797693135e+308, TreeAccess=False)
fassade_3 = GetString(fassade, AtLeast=1, AtMost=1, TreeAccess=False)
rasterlength_x = GetNumber(number_slider, AtLeast=1, AtMost=1, Maximum=1.797693135e+308, Minimum=-1.797693135e+308, TreeAccess=False)
rasterlength_y = GetNumber(number_slider, AtLeast=1, AtMost=1, Maximum=1.797693135e+308, Minimum=-1.797693135e+308, TreeAccess=False)
arm_latitudinal_numberofsegments = GetInteger(Slider(5, range=0..10), AtLeast=1, AtMost=1, Maximum=2147483647, Minimum=-2147483648, TreeAccess=False)
arm_longitudinal_numberofsegments = GetInteger(Slider(4, range=0..10), AtLeast=1, AtMost=1, Maximum=2147483647, Minimum=-2147483648, TreeAccess=False)
basebody_inside_latditudinal_numberofseg = GetInteger(Slider(3, range=0..10), AtLeast=1, AtMost=1, Maximum=2147483647, Minimum=-2147483648, TreeAccess=False)  # "BaseBody-Inside-Latditudinal-NumberOfSegments"
courtyard_segmentcount_rasterlength_y = GetNumber(Slider(13, range=0..30), AtLeast=1, AtMost=1, Maximum=1.797693135e+308, Minimum=-1.797693135e+308, TreeAccess=False)
has_courtyard_roof = GetBoolean(Toggle(False), AtLeast=1, AtMost=1, FalseValue="False", TreeAccess=False, TrueValue="True")
energystandard = GetString(list_2, AtLeast=1, AtMost=1, TreeAccess=True)
shading_2 = GetString(shading, AtLeast=1, AtMost=1, TreeAccess=True)
hvac_system_template_2 = GetString(hvac_system_template, AtLeast=1, AtMost=1, TreeAccess=False)
required_u_values_path = GetFilePath(concat, AtLeast=1, AtMost=1, TreeAccess=False)
output_names = GetString(merge_2, AtLeast=1, AtMost=1, TreeAccess=True)
report_names = GetString(merge, AtLeast=1, AtMost=1, TreeAccess=True)
epw_filepath = GetFilePath(concat_2, AtLeast=1, AtMost=1, TreeAccess=False)
output_directory = GetFilePath(panel_2, AtLeast=1, AtMost=1, TreeAccess=False)
onoff = EnableDisableObject(Enabled=debugmode, AllObjects_Object=[vizbytype, strtoobj])
simulationmode = GetInteger(int, AtLeast=1, AtMost=1, Maximum=2147483647, Minimum=-2147483648, TreeAccess=False)

# ---- group: RH_IN:Terrain
terrain_2 = Text(terrain)

# ---- group: RH_IN:Orientation
orientation_2 = Number(orientation)

# ---- group: RH_IN:NumberOfFloors
numberoffloors_2 = Number(numberoffloors)

# ---- group: RH_IN:FloorHeight
floorheight_2 = Number(floorheight)

# ---- group: RH_IN:Fassade
fassade_4 = Text(fassade_3)

# ---- group: RH_IN:RasterLength-X
rasterlength_x_2 = Number(rasterlength_x)

# ---- group: RH_IN:RasterLength-Y
rasterlength_y_2 = Number(rasterlength_y)

# ---- group: RH_IN:Arm-Latitudinal-NumberOfSegments
arm_latitudinal_numberofsegments_2 = Number(arm_latitudinal_numberofsegments)

# ---- group: RH_IN:Arm-Longitudinal-NumberOfSegments
arm_longitudinal_numberofsegments_2 = Number(arm_longitudinal_numberofsegments)

# ---- group: RH_IN:BaseBody-Inside-Latditudinal-NumberOfSegments
basebody_inside_latditudinal_numberofseg_2 = Number(basebody_inside_latditudinal_numberofseg)  # "BaseBody-Inside-Latditudinal-NumberOfSegments"

# ---- group: RH_IN:Courtyard_SegmentCount_RasterLength-Y
courtyard_segmentcount_rasterlength_y_2 = Number(courtyard_segmentcount_rasterlength_y)

# ---- group: RH_IN:Has_Courtyard-Roof
has_courtyard_roof_2 = Boolean(has_courtyard_roof)

# ---- group: RH_IN:EnergyStandard
energystandard_2 = Text(energystandard)

# ---- group: RH_IN:HVAC-System_Template
hvac_system_template_3 = Text(hvac_system_template_2)

# ---- group: RH_IN:Shading
shading_3 = Text(shading_2)

# ---- group: RH_IN:Output-Names
output_names_2 = Text(output_names)

# ---- group: RH_IN:Report-Names
report_names_2 = Text(report_names)

# ---- group: RH_IN:Required-U-Values_Path
required_u_values_path_2 = FilePath(required_u_values_path)

# ---- group: RH_IN:EPW-FilePath
epw_filepath_2 = FilePath(epw_filepath)

# ---- group: RH_IN:Output-Directory
output_directory_2 = FilePath(output_directory)

# ---- group: RH_IN:SimulationMode
simulationmode_2 = Integer(simulationmode)

# ----
concat_3 = Concatenate(FragmentA=scripts_directory, FragmentB=pcghfilepath.DirectorySeparator, FragmentC="Model.ghx")
modelhops = Hops(
    _Path=concat_3,
    Orientation=orientation_2,
    NumberOfFloors=numberoffloors_2,
    FloorHeight=floorheight_2,
    Fassade=fassade_4,
    RasterLengthX=rasterlength_x_2,
    RasterLengthY=rasterlength_y_2,
    ArmLatitudinalNumberOfSegments=arm_latitudinal_numberofsegments_2,
    ArmLongitudinalNumberOfSegments=arm_longitudinal_numberofsegments_2,
    BaseBodyInsideLatditudinalNumberOfSegments=basebody_inside_latditudinal_numberofseg_2,
    Courtyard_SegmentCount_RasterLengthY=courtyard_segmentcount_rasterlength_y_2,
    CacheResultsInMemory=False,
    CacheSolveResults=False,
    RemoteDefinitionLocation="C:\Git\Work\FOR2363\Parametric-H-Shape-Office-Building-Model\src\Model.ghx",
    RemoteSolveVersion=(0, 1, 0),
    ShowInput_Enabled=False,
    ShowInput_Path=True,
    SynchronousSolve=True)  # -> Zones, ZonesName, Windows, WindowsName, Zones_Underground, ZonesUndergroundName, Courtyard_Upper_Volume, Courtyard_Lower_Volume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
building_fassade_left_windowtowallratio = Number(modelhops.FassadeLeftWindowToWallRatio)
windows_name = Text(modelhops.WindowsName)
building_fassade_upper_windowtowallratio = Number(modelhops.FassadeUpperWindowToWallRatio)
windows = Brep(modelhops.Windows)
zones_underground_name = Text(modelhops.ZonesUndergroundName)
courtyard_upper_volume = Brep(modelhops.Courtyard_Upper_Volume)
courtyard_upper_fassade = Surface(modelhops.Courtyard_Upper_Fassade)
courtyard_lower_roof = Surface(modelhops.Courtyard_Lower_Roof)
zones_name = Text(modelhops.ZonesName)
zones_underground = Brep(modelhops.Zones_Underground)
courtyard_lower_volume = Brep(modelhops.Courtyard_Lower_Volume)
courtyard_lower_fassade = Surface(modelhops.Courtyard_Lower_Fassade)
courtyard_upper_roof = Surface(modelhops.Courtyard_Upper_Roof)
building_fassade_windowtowallratio = Number(modelhops.FassadeTotalWindowToWallRatio)
building_fassade_lower_windowtowallratio = Number(modelhops.FassadeLowerWindowToWallRatio)
building_fassade_right_windowtowallratio = Number(modelhops.FassadeRightWindowToWallRatio)
zones = Brep(modelhops.Zones)
merge_3 = Merge(Data1=courtyard_upper_roof, Data2=courtyard_lower_roof)
concat_4 = Concatenate(FragmentA=scripts_directory, FragmentB=pcghfilepath.DirectorySeparator, FragmentC="EnergyModel.ghx")
energymodelhops = Hops(
    _Path=concat_4,
    Zones=zones,
    ZonesName=zones_name,
    Windows=windows,
    WindowsName=windows_name,
    Zones_Underground=zones_underground,
    ZonesUndergroundName=zones_underground_name,
    CourtyardsRoof=merge_3,
    OutputDirectory=output_directory_2,
    Has_CourtyardRoof=has_courtyard_roof_2,
    RequiredUValues_Path=required_u_values_path_2,
    EnergyStandard=energystandard_2,
    Shading=shading_3,
    HVACSystem_Template=hvac_system_template_3,
    CacheResultsInMemory=False,
    CacheSolveResults=False,
    RemoteDefinitionLocation="C:\Git\Work\FOR2363\Parametric-H-Shape-Office-Building-Model\src\EnergyModel.ghx",
    RemoteSolveVersion=(0, 1, 0),
    ShowInput_Enabled=False,
    ShowInput_Path=True,
    SynchronousSolve=True)  # -> HoneybeeJSON, HoneybeeFilePath
context_bake = ContextBake(Geometry=zones)
context_bake_2 = ContextBake(Geometry=windows)
context_bake_3 = ContextBake(Zones_Underground=zones_underground)
filter = StreamFilter(Gate=run, Stream1=energymodelhops.HoneybeeJSON)
strtoobj = HBStringToObject(hb_str=energymodelhops.HoneybeeJSON)  # -> hb_obj; plug-in component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
concat_5 = Concatenate(FragmentA=scripts_directory, FragmentB=pcghfilepath.DirectorySeparator, FragmentC="Simulation.ghx")
context_print = ContextPrint(HoneybeeFilePath=energymodelhops.HoneybeeFilePath)
hops = Hops(
    _Path=concat_5,
    HoneybeeJSON=filter,
    Terrain=terrain_2,
    EPWFilePath=epw_filepath_2,
    OutputDirectory=output_directory_2,
    OutputNames=output_names_2,
    ReportNames=report_names_2,
    SimulationMode=simulationmode_2,
    CacheResultsInMemory=True,
    CacheSolveResults=True,
    RemoteDefinitionLocation="C:\Git\Work\FOR2363\Parametric-H-Shape-Office-Building-Model\src\Simulation.ghx",
    RemoteSolveVersion=(0, 1, 0),
    ShowInput_Enabled=False,
    ShowInput_Path=True,
    SynchronousSolve=True)  # -> SimulationParametersFilePath, IDFFilePath, SQLFilePath, ZoneSizingFilePath, ReportDataDictionaryFilePath, ReportsFilePath; disabled
vizbytype = HBVisualizeByType(hb_objs=strtoobj)  # -> walls, interior_walls, roofs, ceilings, exterior_floors, interior_floors, air_walls, apertures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; plug-in component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
concat_6 = Concatenate(FragmentA=scripts_directory, FragmentB=pcghfilepath.DirectorySeparator, FragmentC="Reporting.ghx")
hops_2 = Hops(
    _Path=concat_6,
    SimulationParametersFilePath=hops.SimulationParametersFilePath,
    IDFFilePath=hops.IDFFilePath,
    SQLFilePath=hops.SQLFilePath,
    ZoneSizingFilePath=hops.ZoneSizingFilePath,
    ReportDataDictionaryFilePath=hops.ReportDataDictionaryFilePath,
    ReportsFilePath=hops.ReportsFilePath,
    CacheResultsInMemory=True,
    CacheSolveResults=True,
    RemoteDefinitionLocation="C:\Git\Work\FOR2363\Parametric-H-Shape-Office-Building-Model\src\Reporting.ghx",
    RemoteSolveVersion=(0, 1, 0),
    ShowInput_Enabled=False,
    ShowInput_Path=True,
    SynchronousSolve=True)  # disabled
context_print_2 = ContextPrint(SimulationParametersFilePath=hops.SimulationParametersFilePath)
context_print_3 = ContextPrint(IDFFilePath=hops.IDFFilePath)
context_print_4 = ContextPrint(SQLFilePath=hops.SQLFilePath)
context_print_5 = ContextPrint(ZoneSizingFilePath=hops.ZoneSizingFilePath)
context_print_6 = ContextPrint(ReportDataDictionaryFilePath=hops.ReportDataDictionaryFilePath)
context_print_7 = ContextPrint(ReportsFilePath=hops.ReportsFilePath)
