# Grasshopper definition Reporting.ghx (Grasshopper 1.0.7)

simulationparameters_filepath = GetFilePath(AtLeast=1, AtMost=1, TreeAccess=False)
idf_filepath = GetFilePath(AtLeast=1, AtMost=1, TreeAccess=False)
sql_filepath = GetFilePath(AtLeast=1, AtMost=1, TreeAccess=False)
zonesizing_filepath = GetFilePath(AtLeast=1, AtMost=1, TreeAccess=False)
reportdatadictionary_filepath = GetFilePath(AtLeast=1, AtMost=1, TreeAccess=False)
reports_filepath = GetFilePath(AtLeast=1, AtMost=1, TreeAccess=False)
customresult = HBReadCustomResult(sql=sql_filepath)  # -> results; plug-in component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
readrdd = HBReadResultDictionary()  # -> outputs; plug-in component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
readzsz = HBReadZoneSizing()  # -> cooling_load, heating_load; plug-in component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
readhvac = HBReadHVACSizing()  # -> zone_names, zone_peak_cool, zone_peak_heat, comp_types, comp_properties, comp_values; plug-in component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
bang = ExplodeTree(Data=customresult)  # -> Branch0, Branch1, Branch2, Branch3
bang_2 = ExplodeTree(Data=customresult)  # -> Branch0, Branch1, Branch2, Branch3
xdata = LBDeconstructData(data=bang.Branch2)  # -> header, values; plug-in component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
xdata_2 = LBDeconstructData(data=bang.Branch3)  # -> header, values; plug-in component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
item = ListItem(List=flatten(customresult), Index=0, Wrap=True)  # -> Item2, Item1, Item
panel = Panel(readhvac.comp_properties)
panel_2 = Panel(readhvac.comp_values)
hourlyplot = LBHourlyPlot(data=item.Item2)  # -> report, mesh, legend, borders, labels, title; plug-in component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
normbyflr = HBNormalizeByFloorArea(data=item.Item1)  # -> total_data, room_data; plug-in component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
division = Division(A=xdata.values, B=xdata_2.values)
clean = CleanTree(RemoveNulls=True, RemoveInvalid=True, RemoveEmpty=invert(False), Tree=division)
panel_3 = Panel(clean)
