# Grasshopper definition Director.ghx (Grasshopper 1.0.7)
# plug-ins: Hops, Pancake, MetaHopper

panel = Panel("C:\Git\Work\FOR2363\Parametric-H-Shape-Office-Building-Model\src")
panel_2 = Panel("""EnergyManagementSystem:OutputVariable,
  Central Air Source Heat Pump Capacity, ! Name
  Cap, ! EMS Variable Name
  Averaged, ! Type of Data in Variable
  SystemTimestep, ! Update Frequency
  Hot_Water_Loop_Central_Air_Source_Heat_Pump_Init_Pgrm,           ! EMS Program or Subroutine Name
  W;""")  # disabled
panel_3 = Panel("E:\Nextcloud\Public\FOR2363\TP4\LUH\HVAC-Systems\BatchCurrent\Data_Source\Simulation-Files")
pcghfilepath = DefinitionPath(LastSaveLocalization="neutral,N")  # -> Directory, Name, DirectorySeparator
panel_4 = Panel("\")  # disabled
panel_5 = Panel("Central Air Source Heat Pump Capacity")  # disabled
hvac_system_template = ValueList({"IdealAirSystem", "ElectricBaseboard", "BoilerBaseboard", "ASHPBaseboard", "DHWBaseboard", "EvapCoolers_ElectricBaseboard", "EvapCoolers_BoilerBaseboard", "EvapCoolers_ASHPBaseboard", "EvapCoolers_DHWBaseboard", "EvapCoolers_Furnace"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}, selected="ASHPBaseboard")  # disabled
panel_6 = Panel("AllSummaryMonthlyAndSizingPeriod")  # disabled
panel_7 = Panel("Heating Coil Electricity Rate")  # disabled
bldgvintages = HBBuildingVintages({"ASHRAE 90.1 2019  |  IECC 2021": "2019", "ASHRAE 90.1 2016  |  IECC 2018": "2016", "ASHRAE 90.1 2013  |  IECC 2015": "2013", "ASHRAE 90.1 2010  |  IECC 2012": "2010", "ASHRAE 90.1 2007  |  IECC 2009": "2007", "ASHRAE 90.1 2004  |  IECC 2006": "2004", "1980-2004 (CBECS)": "1980_2004", "Pre-1980 (CBECS)": "pre_1980"}, selected="ASHRAE 90.1 2019  |  IECC 2021")  # disabled
# Fan Coil Heating Rate
panel_8 = Panel("Heating Coil Heating Rate")  # disabled
scripts_directory = FilePath(panel)
fassade = ValueList({"Horizontal-Windows", "Vertical-Windows", "Ribbon-Windows"}, selected="Horizontal-Windows")  # disabled
number_slider = Slider(4, range=0..10)  # disabled
shw = HBSHWTemplates({"Gas Water Heater": "Gas_WaterHeater", "Electric Water Heater": "Electric_WaterHeater", "Heat Pump Water Heater": "HeatPump_WaterHeater", "Gas Tankless Heater": "Gas_TanklessHeater", "Electric Tankless Heater": "Electric_TanklessHeater"}, selected="Gas Water Heater")  # disabled
number_slider_2 = Slider(3, range=0..10)  # disabled
number_slider_3 = Slider(2.5, range=0..10)  # disabled
number_slider_4 = Slider(5, range=0..10)  # disabled
number_slider_5 = Slider(4, range=0..10)  # disabled
number_slider_6 = Slider(3, range=0..10)  # disabled
number_slider_7 = Slider(29.9, range=0..360)  # disabled
number_slider_8 = Slider(13, range=0..30)  # disabled
shading = ValueList({"External-Shading", "Low-SHGC-Value"}, selected="Low-SHGC-Value")  # disabled
list = ValueList({"TranslationOnly": 0, "Simulation": 1}, selected="TranslationOnly")  # disabled
list_2 = ValueList({"GEG", "NZEB", "Passive"}, selected="GEG")  # disabled
toggle = BooleanToggle(False)  # disabled
# File paths do somehow not work in Compute yet...
concat = Concatenate(FragmentA=scripts_directory, FragmentB=pcghfilepath.DirectorySeparator, FragmentC="Required-U-Values.csv")
concat_2 = Concatenate(FragmentA=scripts_directory, FragmentB=pcghfilepath.DirectorySeparator, FragmentC="DEU_Munich.108660_IWEC.epw")
panel_9 = Panel("EnergyModel")  # disabled
list_3 = ValueList({"Ocean", "Country", "Suburbs", "Urban", "City"}, selected="City")  # disabled
debugmode = Boolean(Toggle(False))
run = Boolean(Toggle(True))
merge = Merge(Data1=panel_6)  # disabled
merge_2 = Merge(Data1=panel_5, Data2=panel_8, Data3=panel_7)  # disabled
int = Integer(list)  # disabled
terrain = GetString(list_3, AtLeast=1, AtMost=1, TreeAccess=False)
orientation = GetNumber(number_slider_7, AtLeast=1, AtMost=1, Maximum=1.797693135e+308, Minimum=-1.797693135e+308, TreeAccess=False)
numberoffloors = GetNumber(number_slider, AtLeast=1, AtMost=1, Maximum=1.797693135e+308, Minimum=-1.797693135e+308, TreeAccess=False)
floorheight = GetNumber(number_slider_2, AtLeast=1, AtMost=1, Maximum=1.797693135e+308, Minimum=-1.797693135e+308, TreeAccess=False)
fassade_2 = GetString(fassade, AtLeast=1, AtMost=1, TreeAccess=False)
rasterlength_x = GetNumber(number_slider_3, AtLeast=1, AtMost=1, Maximum=1.797693135e+308, Minimum=-1.797693135e+308, TreeAccess=False)
rasterlength_y = GetNumber(number_slider_3, AtLeast=1, AtMost=1, Maximum=1.797693135e+308, Minimum=-1.797693135e+308, TreeAccess=False)
arm_latitudinal_numberofsegments = GetInteger(number_slider_4, AtLeast=1, AtMost=1, Maximum=2147483647, Minimum=-2147483648, TreeAccess=False)
arm_longitudinal_numberofsegments = GetInteger(number_slider_5, AtLeast=1, AtMost=1, Maximum=2147483647, Minimum=-2147483648, TreeAccess=False)
basebody_inside_latditudinal_numberofseg = GetInteger(number_slider_6, AtLeast=1, AtMost=1, Maximum=2147483647, Minimum=-2147483648, TreeAccess=False)  # "BaseBody-Inside-Latditudinal-NumberOfSegments"
courtyard_segmentcount_rasterlength_y = GetNumber(number_slider_8, AtLeast=1, AtMost=1, Maximum=1.797693135e+308, Minimum=-1.797693135e+308, TreeAccess=False)
has_courtyard_roof = GetBoolean(toggle, AtLeast=1, AtMost=1, FalseValue="False", TreeAccess=False, TrueValue="True")
shading_2 = GetString(shading, AtLeast=1, AtMost=1, TreeAccess=True)
energystandard = GetString(list_2, AtLeast=1, AtMost=1, TreeAccess=True)
hvac_system = GetString(hvac_system_template, AtLeast=1, AtMost=1, TreeAccess=False)
servicehotwater = GetString(shw, AtLeast=1, AtMost=1, TreeAccess=True)
buildingvintage = GetString(bldgvintages, AtLeast=1, AtMost=1, TreeAccess=True)
output_names = GetString(merge_2, AtLeast=1, AtMost=1, TreeAccess=True)
report_names = GetString(merge, AtLeast=1, AtMost=1, TreeAccess=True)
simulationmode = GetInteger(int, AtLeast=1, AtMost=1, Maximum=2147483647, Minimum=-2147483648, TreeAccess=False)
modelname = GetString(panel_9, AtLeast=1, AtMost=1, TreeAccess=True)
additionalidf = GetString(panel_2, AtLeast=1, AtMost=1, TreeAccess=True)
onoff = EnableDisableObject(
    Enabled=debugmode,
    AllObjects_Object=[number_slider_4, number_slider_5, number_slider, number_slider_6, number_slider_7, number_slider_8, number_slider_2, number_slider_3, fassade, toggle, hvac_system_template, list_3, merge, panel_6, merge_2, , panel_8, panel_7, list_2, shading, list, int, panel_4, panel_9, shw, bldgvintages, panel_2, panel_5])
terrain_2 = Text(terrain)
orientation_2 = Number(orientation)
numberoffloors_2 = Number(numberoffloors)
floorheight_2 = Number(floorheight)
fassade_3 = Text(fassade_2)
rasterlength_x_2 = Number(rasterlength_x)
rasterlength_y_2 = Number(rasterlength_y)
arm_latitudinal_numberofsegments_2 = Number(arm_latitudinal_numberofsegments)
arm_longitudinal_numberofsegments_2 = Number(arm_longitudinal_numberofsegments)
basebody_inside_latditudinal_numberofseg_2 = Number(basebody_inside_latditudinal_numberofseg)  # "BaseBody-Inside-Latditudinal-NumberOfSegments"
courtyard_segmentcount_rasterlength_y_2 = Number(courtyard_segmentcount_rasterlength_y)
required_u_values_path = FilePath(concat)
has_courtyard_roof_2 = Boolean(has_courtyard_roof)
epw_filepath = FilePath(concat_2)
output_directory = FilePath(panel_3)
energystandard_2 = Text(energystandard)
shading_3 = Text(shading_2)
servicehotwater_2 = Text(servicehotwater)
additionalidf_2 = Text(additionalidf)
simulationmode_2 = Integer(simulationmode)
output_names_2 = Text(output_names)
report_names_2 = Text(report_names)
hvac_system_2 = Text(hvac_system)
buildingvintage_2 = Text(buildingvintage)
modelname_2 = Text(modelname)
concat_3 = Concatenate(FragmentA=scripts_directory, FragmentB=pcghfilepath.DirectorySeparator, FragmentC="Model.ghx")
modelhops = Hops(
    _Path=concat_3,
    Orientation=orientation_2,
    NumberOfFloors=numberoffloors_2,
    FloorHeight=floorheight_2,
    Fassade=fassade_3,
    RasterLengthX=rasterlength_x_2,
    RasterLengthY=rasterlength_y_2,
    ArmLatitudinalNumberOfSegments=arm_latitudinal_numberofsegments_2,
    ArmLongitudinalNumberOfSegments=arm_longitudinal_numberofsegments_2,
    BaseBodyInsideLatditudinalNumberOfSegments=basebody_inside_latditudinal_numberofseg_2,
    Courtyard_SegmentCount_RasterLengthY=courtyard_segmentcount_rasterlength_y_2,
    CacheResultsInMemory=False,
    CacheSolveResults=False,
    RemoteDefinitionLocation="C:\Git\Work\FOR2363\Parametric-H-Shape-Office-Building-Model\src\Model.ghx",
    RemoteSolveVersion=(0, 1, 0),
    ShowInput_Enabled=False,
    ShowInput_Path=True,
    SynchronousSolve=True)  # -> Zones, ZonesName, Windows, WindowsName, Zones_Underground, ZonesUndergroundName, Courtyard_Upper_Volume, Courtyard_Lower_Volume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
building_fassade_left_windowtowallratio = Number(modelhops.FassadeLeftWindowToWallRatio)
windows_name = Text(modelhops.WindowsName)
building_fassade_upper_windowtowallratio = Number(modelhops.FassadeUpperWindowToWallRatio)
windows = Brep(modelhops.Windows)
zones_underground_name = Text(modelhops.ZonesUndergroundName)
courtyard_upper_volume = Brep(modelhops.Courtyard_Upper_Volume)
courtyard_upper_fassade = Surface(modelhops.Courtyard_Upper_Fassade)
courtyard_lower_roof = Surface(modelhops.Courtyard_Lower_Roof)
zones_name = Text(modelhops.ZonesName)
zones_underground = Brep(modelhops.Zones_Underground)
courtyard_lower_volume = Brep(modelhops.Courtyard_Lower_Volume)
courtyard_lower_fassade = Surface(modelhops.Courtyard_Lower_Fassade)
courtyard_upper_roof = Surface(modelhops.Courtyard_Upper_Roof)
building_fassade_windowtowallratio = Number(modelhops.FassadeTotalWindowToWallRatio)
building_fassade_lower_windowtowallratio = Number(modelhops.FassadeLowerWindowToWallRatio)
building_fassade_right_windowtowallratio = Number(modelhops.FassadeRightWindowToWallRatio)
zones = Brep(modelhops.Zones)
merge_3 = Merge(Data1=courtyard_upper_roof, Data2=courtyard_lower_roof)
concat_4 = Concatenate(FragmentA=scripts_directory, FragmentB=pcghfilepath.DirectorySeparator, FragmentC="EnergyModel.ghx")
energymodelhops = Hops(
    _Path=concat_4,
    Zones=zones,
    ZonesName=zones_name,
    Windows=windows,
    WindowsName=windows_name,
    Zones_Underground=zones_underground,
    ZonesUndergroundName=zones_underground_name,
    CourtyardsRoof=merge_3,
    OutputDirectory=output_directory,
    Has_CourtyardRoof=has_courtyard_roof_2,
    RequiredUValues_Path=required_u_values_path,
    EnergyStandard=energystandard_2,
    Shading=shading_3,
    BuildingVintage=buildingvintage_2,
    HVACSystem=hvac_system_2,
    ServiceHotWater=servicehotwater_2,
    ModelName=modelname_2,
    CacheResultsInMemory=False,
    CacheSolveResults=False,
    RemoteDefinitionLocation="C:\Git\Work\FOR2363\Parametric-H-Shape-Office-Building-Model\src\EnergyModel.ghx",
    RemoteSolveVersion=(0, 1, 0),
    ShowInput_Enabled=False,
    ShowInput_Path=True,
    SynchronousSolve=True)
concat_5 = Concatenate(FragmentA=scripts_directory, FragmentB=pcghfilepath.DirectorySeparator, FragmentC="Simulation.ghx")
filter = StreamFilter(Gate=run, Stream1=energymodelhops)
hops = Hops(
    _Path=concat_5,
    HoneybeeFilePath=filter,
    Terrain=terrain_2,
    EPWFilePath=epw_filepath,
    OutputDirectory=output_directory,
    OutputNames=output_names_2,
    ReportNames=report_names_2,
    SimulationMode=simulationmode_2,
    AdditionalIDF=additionalidf_2,
    CacheResultsInMemory=True,
    CacheSolveResults=True,
    RemoteDefinitionLocation="C:\Git\Work\FOR2363\Parametric-H-Shape-Office-Building-Model\src\Simulation.ghx",
    RemoteSolveVersion=(0, 1, 0),
    ShowInput_Enabled=False,
    ShowInput_Path=True,
    SynchronousSolve=True)  # -> SimulationParametersFilePath, IDFFilePath, SQLFilePath, ZoneSizingFilePath, ReportDataDictionaryFilePath, ReportsFilePath
concat_6 = Concatenate(FragmentA=scripts_directory, FragmentB=pcghfilepath.DirectorySeparator, FragmentC="Reporting.ghx")
context_print = ContextPrint(IDFFilePath=hops.IDFFilePath)
expression = Expression(x=output_directory, y=hops.SimulationParametersFilePath, Expression="x")
hops_2 = Hops(
    _Path=concat_6,
    OutputDirectory=expression,
    ModelName=modelname_2,
    CacheResultsInMemory=True,
    CacheSolveResults=True,
    RemoteDefinitionLocation="C:\Git\Work\FOR2363\Parametric-H-Shape-Office-Building-Model\src\Reporting.ghx",
    RemoteSolveVersion=(0, 1, 0),
    ShowInput_Enabled=False,
    ShowInput_Path=True,
    SynchronousSolve=True)  # -> EUI_kWh_m²a, EUIHeating_kWh_m²a, EUICooling_kWh_m²a, EUIInteriorLighting_kWh_m²a, EUIInteriorEquipment_kWh_m²a, EUIPumps_kWh_m²a, GrossFloorArea_m², DHWDesignSizeNominalCapacity_kW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; disabled
