# Grasshopper definition Reporting.ghx (Grasshopper 1.0.7)
# plug-ins: MetaHopper

panel = Panel("E:\Nextcloud\Public\FOR2363\TP4\LUH\HVAC-Systems\BatchCurrent\Data_Source\Simulation-Files")  # disabled
panel_2 = Panel("E:\Nextcloud\Public\FOR2363\TP4\LUH\HVAC-Systems\BatchCurrent\Data_Source\Simulation-Files")
panel_3 = Panel("EnergyModel")  # disabled
panel_4 = Panel("Simulation000")  # disabled
output_directory = GetString(panel, AtLeast=1, AtMost=1, TreeAccess=False)
panel_5 = Panel("Simulation004")  # disabled
debugmode = Boolean(Toggle(False))
modelname = GetString(panel_4, AtLeast=1, AtMost=1, TreeAccess=False)
onoff = EnableDisableObject(Enabled=debugmode, AllObjects_Object=[panel_3, panel_5, panel_4])
rep = ReplaceText(Text=output_directory, Find="%", Replace="\", RecursiveReplace=False)
path = FilePath(rep)
concat = Concatenate(FragmentA=path, FragmentB="\", FragmentC=modelname)
write = NAME(path=panel_2, content=output_directory)  # disabled
# ---------- write: Python ----------
from os.path import join
if content:
    f = open(join(path,'DoubleCheck1.txt'), "w")
    f.write(content)
    f.close()
# ---------- end write ----------
concat_2 = Concatenate(FragmentA=concat, FragmentB="\", FragmentC="openstudio")
concat_3 = Concatenate(FragmentA=concat_2, FragmentB="\", FragmentC="run")
panel_6 = Panel("in")
concat_4 = Concatenate(FragmentA=concat_3, FragmentB="\", FragmentC="eplustbl.htm")
concat_5 = Concatenate(FragmentA=concat_3, FragmentB="\", FragmentC="eplusout")
concat_6 = Concatenate(FragmentA=concat_3, FragmentB="\", FragmentC="in")
concat_7 = Concatenate(FragmentA=concat_2, FragmentB="\", FragmentD=modelname, FragmentC=".json")
concat_8 = Concatenate(FragmentA=concat_5, FragmentC=".sql")
concat_9 = Concatenate(FragmentA=concat_6, FragmentB=".idf")
concat_10 = Concatenate(FragmentA=concat_6, FragmentB=".osm")
reports_filepath = FilePath(concat_4)
sql_filepath = FilePath(concat_8)

readtable = HBReadTabularData(sql=sql_filepath, table_name="Annual Heat Emissions Summary")  # -> values, col_names, row_names; plug-in component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
itemor0 = ItemOr0(values=readtable.values, header=readtable.col_names, item="Zone Exfiltration")
itemor0_2 = ItemOr0(values=readtable.values, header=readtable.col_names, item="Envelope Convection")
itemor0_3 = ItemOr0(values=readtable.values, header=readtable.col_names, item="Zone Exhaust Air")
itemor0_4 = ItemOr0(values=readtable.values, header=readtable.col_names, item="Total")
itemor0_5 = ItemOr0(values=readtable.values, header=readtable.col_names, item="HVAC Relief Air")
itemor0_6 = ItemOr0(values=readtable.values, header=readtable.col_names, item="HVAC Reject Heat")
expression = Expression(x=itemor0_3, Expression="x/1000")
expression_2 = Expression(x=itemor0_2, Expression="x/1000")
expression_3 = Expression(x=itemor0, Expression="x/1000")
expression_4 = Expression(x=itemor0_4, Expression="x/1000")
expression_5 = Expression(x=itemor0_5, Expression="x/1000")
expression_6 = Expression(x=itemor0_6, Expression="x/1000")
cp = ContextPrint(HeatEmissionsZoneHVACReliefAir_MWh_a=expression_5)
cp_2 = ContextPrint(HeatEmissionsZoneHVACRejectHeat_MWh_a=expression_6)
cp_3 = ContextPrint(HeatEmissionsZoneZoneExhaustAir_MWh_a=expression)
cp_4 = ContextPrint(HeatEmissionsEnvelopeConvection_MWh_a=expression_2)
cp_5 = ContextPrint(HeatEmissionsZoneExfiltration_MWh_a=expression_3)
cp_6 = ContextPrint(HeatEmissionsTotal_MWh_a=expression_4)

panel_7 = Panel("Central Air Source Heat Pump Capacity")
customresult = HBReadCustomResult(sql=sql_filepath, output_names=panel_7)  # -> results; plug-in component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
itemor0_7 = ItemOr0(values=customresult, header=panel_7, item=panel_7)
expression_7 = Expression(x=itemor0_7, Expression="x/1000")
cp_7 = ContextPrint(CentralAirSourceHeatPumpCapacity_kW=expression_7)

panel_8 = Panel("SERVICE HOT WATER DISTRICT HEAT-Design Size Nominal Capacity [W]")
readhvac = HBReadHVACSizing(sql=sql_filepath, comp_type="DistrictHeating")  # -> zone_names, zone_peak_cool, zone_peak_heat, comp_types, comp_properties, comp_values; plug-in component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
itemor0_8 = ItemOr0(values=readhvac.comp_values, header=readhvac.comp_properties, item=panel_8)
expression_8 = Expression(x=itemor0_8, Expression="x/1000")
cp_8 = ContextPrint(DHWDesignSizeNominalCapacity_kW=expression_8)

customresult_2 = HBReadCustomResult(sql=sql_filepath, output_names="Baseboard Total Heating Rate")  # -> results; plug-in component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
itemor0_9 = ItemOr0(values=customresult_2)
expression_9 = Expression(x=itemor0_9, Expression="x/1000")
cp_9 = ContextPrint(BaseboardTotalHeatingRate_kW=expression_9)

readhvac_2 = HBReadHVACSizing(sql=sql_filepath, comp_type="Boiler:HotWater")  # -> zone_names, zone_peak_cool, zone_peak_heat, comp_types, comp_properties, comp_values; plug-in component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
itemor0_10 = ItemOr0(values=readhvac_2.comp_values, header=readhvac_2.comp_properties, item="BOILER-Design Size Nominal Capacity [W]")
expression_10 = Expression(x=itemor0_10, Expression="x/1000")
cp_10 = ContextPrint(BoilerDesignSizeNominalCapacity_kW=expression_10)

idf_filepath = FilePath(concat_9)
readhvac_3 = HBReadHVACSizing(sql=sql_filepath)  # -> zone_names, zone_peak_cool, zone_peak_heat, comp_types, comp_properties, comp_values; plug-in component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

eui = HBEndUseIntensity(sql=sql_filepath)  # -> eui, eui_end_use, end_uses, gross_floor; plug-in component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
itemor0_11 = ItemOr0(values=eui.eui_end_use, header=eui.end_uses, item="Heating")
itemor0_12 = ItemOr0(values=eui.eui_end_use, header=eui.end_uses, item="Cooling")
itemor0_13 = ItemOr0(values=eui.eui_end_use, header=eui.end_uses, item="Interior Equipment")
itemor0_14 = ItemOr0(values=eui.eui_end_use, header=eui.end_uses, item="Pumps")
itemor0_15 = ItemOr0(values=eui.eui_end_use, header=eui.end_uses, item="Interior Lighting")
cp_11 = ContextPrint(EUI_kWh_m²a=eui.eui)
cp_12 = ContextPrint(EUIInteriorEquipment_kWh_m²a=itemor0_13)
cp_13 = ContextPrint(EUIHeating_kWh_m²a=itemor0_11)
cp_14 = ContextPrint(EUICooling_kWh_m²a=itemor0_12)
cp_15 = ContextPrint(EUIPumps_kWh_m²a=itemor0_14)
cp_16 = ContextPrint(GrossFloorArea_m²=eui.gross_floor)
cp_17 = ContextPrint(EUIInteriorLighting_kWh_m²a=itemor0_15)

panel_9 = Panel(readhvac_3.comp_types)

panel_10 = Panel("HYDRONIC BASEBOARD-Design Size Maximum Water Flow Rate [m3/s]")
panel_11 = Panel("HYDRONIC BASEBOARD-Design Size U-Factor Times Area Value [W/K]")
readhvac_4 = HBReadHVACSizing(sql=sql_filepath, comp_type="ZoneHVAC:Baseboard:Convective:Water")  # -> zone_names, zone_peak_cool, zone_peak_heat, comp_types, comp_properties, comp_values; plug-in component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
endswith = NAME(x=readhvac_4.comp_properties, y=panel_11)  # -> a
# ---------- endswith: Python ----------
a = x.endswith(y)
# ---------- end endswith ----------
endswith_2 = NAME(x=readhvac_4.comp_properties, y=panel_10)  # -> a; same code as endswith
dispatch = Dispatch(List=readhvac_4.comp_values, DispatchPattern=endswith)  # -> ListA, ListB
dispatch_2 = Dispatch(List=readhvac_4.comp_values, DispatchPattern=endswith_2)  # -> ListA, ListB
trim = TrimTree(Tree=dispatch.ListA, Depth=1)
trim_2 = TrimTree(Tree=dispatch_2.ListA, Depth=1)
avr = Average(Input=trim)
avr_2 = Average(Input=trim_2)
cp_18 = ContextPrint(AverageBaseboardDesignSizeUFactorTimesArea_W_K=avr)

expression_11 = Expression(x=avr_2, Expression="x*60000")

cp_19 = ContextPrint(AverageBaseboardsDesignSizeMaximumWaterFlowRate_l_min=expression_11)

readhvac_5 = HBReadHVACSizing(sql=sql_filepath, comp_type="Pump:ConstantSpeed")  # -> zone_names, zone_peak_cool, zone_peak_heat, comp_types, comp_properties, comp_values; plug-in component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
itemor0_16 = ItemOr0(values=readhvac_5.comp_values, header=readhvac_5.comp_properties, item="SERVICE HOT WATER PUMP-Design Flow Rate [m3/s]")
itemor0_17 = ItemOr0(
    values=readhvac_5.comp_values,
    header=readhvac_5.comp_properties,
    item="SERVICE HOT WATER PUMP-Design Power Consumption [W]")

expression_12 = Expression(x=itemor0_16, Expression="x*60000")
expression_13 = Expression(x=itemor0_17, Expression="x/1000")

cp_20 = ContextPrint(HotWaterPumpDesignFlowRate_l_min=expression_12)
cp_21 = ContextPrint(HotWaterPumpDesignPowerConsumption_kW=expression_13)

readhvac_6 = HBReadHVACSizing(sql=sql_filepath, comp_type="WaterHeater:Mixed")  # -> zone_names, zone_peak_cool, zone_peak_heat, comp_types, comp_properties, comp_values; plug-in component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
itemor0_18 = ItemOr0(
    values=readhvac_6.comp_values,
    header=readhvac_6.comp_properties,
    item="SHW WATERHEATER1-Use Side Design Flow Rate [m3/s]")

expression_14 = Expression(x=itemor0_18, Expression="x*60000")

cp_22 = ContextPrint(ServiceHotWaterHeaterDesignFlowRate_l_min=expression_14)

# ==== cluster ItemOr0
item = ClusterInput()
values = ClusterInput()
header = ClusterInput()
header_2 = Text(header)
item_2 = Text(item)
values_2 = Number(values)
itemindex = ItemIndex(L=header_2, I=item_2)  # -> i; inputs L: list
# ---------- itemindex: Python ----------
#Component Information
#--------------------------------------------------------------------------------------------
if ghenv.Component.RunCount<2:
    #General
    #--------------------------------------------------------------------------------------------
    __author__ = "Ueli Saluz"
    __version__ = "2022.11.18"
    
    ghenv.Component.Name = "ItemIndex"
    ghenv.Component.NickName = "ItemIndex"
    ghenv.Component.Description = "A better IdemIndex"
    ghenv.Component.Message = "VER 1.0"
    ghenv.Component.Category = "Set"
    ghenv.Component.SubCategory = "List"
    
     #Inputs
    #--------------------------------------------------------------------------------------------
    inputIndex=0
    
    ghenv.Component.Params.Input[inputIndex].Name = "List"
    ghenv.Component.Params.Input[inputIndex].NickName = "L"
    ghenv.Component.Params.Input[inputIndex].Description = "Input1 is..."
    ghenv.Component.Params.Input[inputIndex].Optional = False
    inputIndex+=1
    
    ghenv.Component.Params.Input[inputIndex].Name = "Item"
    ghenv.Component.Params.Input[inputIndex].NickName = "I"
    ghenv.Component.Params.Input[inputIndex].Description = "Input2 is..."
    ghenv.Component.Params.Input[inputIndex].Optional = False
    inputIndex+=1
    
    #Outputs
    #--------------------------------------------------------------------------------------------
    outputIndex=0
    
    ghenv.Component.Params.Output[outputIndex].Name = "Index"
    ghenv.Component.Params.Output[outputIndex].NickName = "i"
    ghenv.Component.Params.Output[outputIndex].Description = "Output1 is..."
    outputIndex+=1

i = L.index(I)
# ---------- end itemindex ----------
item_3 = ListItem(List=values_2, Index=itemindex, Wrap=True)
null = NullItem(Item=item_3)  # -> NullFlags, InvalidFlags, Description
filter = StreamFilter(Gate=null.NullFlags, Stream0=item_3, Stream1="0")
valueor0 = Number(filter)
valueor0_2 = ClusterOutput(valueor0)
