# Grasshopper definition Simulation.ghx (Grasshopper 1.0.7)
# plug-ins: MetaHopper

panel = Panel("E:\Nextcloud\Public\FOR2363\TP4\LUH\HVAC-Systems\BatchCurrent\Data_Source\Simulation-Files\EnergyModel.hbjson")  # disabled
# Somehow the summaries with empty spaces
# in the name do not work!
# Choose
panel_2 = Panel("""EnergyManagementSystem:OutputVariable,
  Central Air Source Heat Pump Capacity, ! Name
  Cap, ! EMS Variable Name
  Averaged, ! Type of Data in Variable
  SystemTimestep, ! Update Frequency
  Hot_Water_Loop_Central_Air_Source_Heat_Pump_Init_Pgrm,           ! EMS Program or Subroutine Name
  W;""")  # disabled
# Zone Water to Air Heat Pump Total Heating Rate
# Annual Thermal Resilience Summary
panel_3 = Panel("E:\Nextcloud\Public\FOR2363\TP4\LUH\HVAC-Systems\BatchCurrent\Data_Source\Simulation-Files")  # disabled
panel_4 = Panel("C:\EnergyPlusV9-5-0\WeatherData\DEU_Munich.108660_IWEC.epw")  # disabled
panel_5 = Panel("AnnualBuildingUtilityPerformanceSummary")  # disabled
panel_6 = Panel("Central Air Source Heat Pump Capacity")  # disabled
panel_7 = Panel("AnnualThermalResilienceSummary")  # disabled
panel_8 = Panel("AllSummaryMonthlyAndSizingPeriod")  # disabled
panel_9 = Panel("ShadingSummary")  # disabled
panel_10 = Panel("LEEDSummary")  # disabled
debugmode = Boolean(Toggle(False))
list = ValueList({"TranslationOnly": 0, "Simulation": 1}, selected="Simulation")  # disabled
onoff = EnableDisableObject(
    Enabled=debugmode,
    AllObjects_Object=[merge, panel, panel_3, panel_4, list_2, merge_2, panel_8, panel_5, panel_7, panel_10, panel_9, list, int, panel_6, panel_2])
merge = Merge(Data1=panel_5, Data2=panel_7, Data3=panel_10, Data4=panel_9)  # disabled
merge_2 = Merge(Data1=panel_6)  # disabled
list_2 = ValueList({"Ocean", "Country", "Suburbs", "Urban", "City"}, selected="City")  # disabled
int = Integer(list)  # disabled
honeybee_filepath = GetFilePath(panel, AtLeast=1, AtMost=1, TreeAccess=False)
terrain = GetString(list_2, AtLeast=1, AtMost=1, TreeAccess=False)
epw_filepath = GetFilePath(panel_4, AtLeast=1, AtMost=1, TreeAccess=False)
output_directory = GetFilePath(panel_3, AtLeast=1, AtMost=1, TreeAccess=False)
output_names = GetString(merge_2, AtLeast=1, AtMost=1, TreeAccess=True)
report_names = GetString(panel_8, AtLeast=1, AtMost=1, TreeAccess=True)
simulationmode = GetInteger(int, AtLeast=1, AtMost=1, Maximum=2147483647, Minimum=-2147483648, TreeAccess=False)
additionalidf = GetString(panel_2, AtLeast=1, AtMost=1, TreeAccess=True)
loadobjects = HBLoadObjects(hb_file=honeybee_filepath, load=Toggle(True))  # -> report, hb_objs; plug-in component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
output_names_2 = Text(output_names)
simulationmode_2 = Integer(simulationmode)
report_names_2 = Text(report_names)
epw_filepath_2 = FilePath(epw_filepath)
output_directory_2 = FilePath(output_directory)
additionalidf_2 = Text(additionalidf)
terrain_2 = Text(terrain)
hb_model = Data(loadobjects.hb_objs)
vizbytype = HBVisualizeByType(hb_objs=hb_model)  # -> walls, interior_walls, roofs, ceilings, exterior_floors, interior_floors, air_walls, apertures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; disabled; plug-in component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

toggle = BooleanToggle(False)
simoutput = HBSimulationOutput(
    zone_energy_use=toggle,
    hvac_energy_use=toggle,
    gains_and_losses=toggle,
    comfort_metrics=toggle,
    surface_temperature=toggle,
    surface_energy_flow=toggle)  # -> report, sim_output; plug-in component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
toggle_2 = BooleanToggle(True)
simcontrol = HBSimulationControl(
    do_zone_sizing=toggle_2,
    do_system_sizing=toggle_2,
    do_plant_sizing=toggle_2,
    for_sizing_period=toggle_2,
    for_run_period=Toggle(True))  # -> sim_control; plug-in component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
shadowcalc = HBShadowCalculation(solar_dist=Slider(0, range=0..100), update_method="Timestep", frequency=Slider(1, range=0..1))  # -> shadow_calc; plug-in component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
customoutput = HBCustomSimulationOutput(
    base_sim_output=simoutput.sim_output,
    output_names=output_names_2,
    report_frequency="Annual",
    summary_reports=report_names_2)  # -> report, sim_output; plug-in component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
simpar = HBSimulationParameter(
    output=customoutput.sim_output,
    timestep=Slider(1, range=0..1),
    terrain=terrain_2,
    sim_control=simcontrol,
    shadow_calc=shadowcalc)  # -> sim_par; plug-in component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
expression = Expression(x=simulationmode_2, Expression="2-x")
addition = Addition(B="1")
modeltoosm = HBModelToOSM(
    model=hb_model,
    epw_file=epw_filepath_2,
    sim_par=simpar,
    add_str=additionalidf_2,
    folder=output_directory_2,
    write=Toggle(True),
    run=expression)  # -> report, jsons, osw, osm, idf, sql, zsz, rdd, html; plug-in component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
sql_filepath = Text(modeltoosm.sql)

number_slider = Slider(1, range=0..10)
number_slider_2 = Slider(2, range=0..10)
reportdatadictionary_filepath = Text(modeltoosm.rdd)
reports_filepath = Text(modeltoosm.html)
zonesizing_filepath = Text(modeltoosm.zsz)
item = ListItem(List=modeltoosm.jsons, Index=0, Wrap=True)  # -> Item, Item1
idf_filepath = Text(modeltoosm.idf)
simulationparameters_filepath = Text(item.Item1)
context_print = ContextPrint(SimulationParametersFilePath=simulationparameters_filepath)
context_print_2 = ContextPrint(IDFFilePath=idf_filepath)
context_print_3 = ContextPrint(SQLFilePath=sql_filepath)
context_print_4 = ContextPrint(ZoneSizingFilePath=zonesizing_filepath)
context_print_5 = ContextPrint(ReportDataDictionaryFilePath=reportdatadictionary_filepath)
context_print_6 = ContextPrint(ReportsFilePath=reports_filepath)
