# Grasshopper definition Test.ghx (Grasshopper 1.0.7)
# plug-ins: Pancake

has_courtyard_roof = GetBoolean(Toggle(False), AtLeast=1, AtMost=1, FalseValue="False", TreeAccess=False, TrueValue="True")
modelname = GetString("C:\Git\Work\FOR2363\Model-Runner\src", AtLeast=1, AtMost=1, TreeAccess=False)
orientation = GetNumber(Slider(46.6, range=0..360), AtLeast=1, AtMost=1, Maximum=1.797693135e+308, Minimum=-1.797693135e+308, TreeAccess=False)
output_directory = GetFilePath("C:\Git\Work\FOR2363\Model-Runner\src", AtLeast=1, AtMost=1, TreeAccess=False)

# ---- group: RH_IN:Has_Courtyard-Roof
has_courtyard_roof_2 = Boolean(has_courtyard_roof)

# ---- group: RH_IN:Output-Directory
output_directory_2 = FilePath(output_directory)

# ---- group: RH_IN:Orientation
orientation_2 = Number(orientation)

# ---- group: RH_IN:ModelName
modelname_2 = Text(modelname)

# ----
pcghfilepath = DefinitionPath(LastSaveLocalization="neutral,N")  # -> Directory, Name, DirectorySeparator
expression = Expression(x=orientation_2, y=Slider(48, range=0..100), Expression="x*y")
concat = Concatenate(FragmentA="The orientation is: ", FragmentB=orientation_2)
concat_2 = Concatenate(FragmentA="The roof is: ", FragmentB=has_courtyard_roof_2)
concat_3 = Concatenate(FragmentA=output_directory_2, FragmentB=pcghfilepath.DirectorySeparator, FragmentC="Test", FragmentD=".csv")
filter = StreamFilter(Gate=has_courtyard_roof_2, Stream0=orientation_2, Stream1=expression)
concat_4 = Concatenate(FragmentA=concat, FragmentB=concat_2, FragmentC=modelname_2, FragmentD=output_directory_2)
random = Random(Range=Domain(0, 1), Number=filter, Seed=2)
random_2 = Random(Range=Domain(0, 1), Number=filter, Seed=Slider(1, range=0..1))
pt = ConstructPoint(XCoordinate=random, YCoordinate=random_2, ZCoordinate=0)
csv_writer = CSVWriter(P=concat_3, H="Test", R=output_directory_2, M=Slider(2, range=0..10))  # -> L; inputs H: list, R: tree, M: Int32
#   port M: Operating mode: 0 = Nothing 1 = Append data 2 = Overwrite existing 3 = Only leave headers
# ---------- csv_writer: Python ----------
#Component Information
#--------------------------------------------------------------------------------------------
if ghenv.Component.RunCount<2:
    #General
    #--------------------------------------------------------------------------------------------
    __author__ = "Ueli Saluz"
    __version__ = "2022.10.28"
    
    ghenv.Component.Name = "CSV-Writer"
    ghenv.Component.NickName = "CSV-Writer"
    ghenv.Component.Description = "Write or append to existing or new csv file."
    ghenv.Component.Message = "VER 1.1"
    ghenv.Component.Category = "Data"
    ghenv.Component.SubCategory = "CSV"
    
     #Inputs
    #--------------------------------------------------------------------------------------------
    inputIndex=0
    
    ghenv.Component.Params.Input[inputIndex].Name = "FilePath"
    ghenv.Component.Params.Input[inputIndex].NickName = "P"
    ghenv.Component.Params.Input[inputIndex].Description = "File path of the csv file that will be created or appended to."
    ghenv.Component.Params.Input[inputIndex].Optional = False
    inputIndex+=1
    
    ghenv.Component.Params.Input[inputIndex].Name = "Headers"
    ghenv.Component.Params.Input[inputIndex].NickName = "H"
    ghenv.Component.Params.Input[inputIndex].Description = "All headers as a list."
    ghenv.Component.Params.Input[inputIndex].Optional = False
    inputIndex+=1
    
    ghenv.Component.Params.Input[inputIndex].Name = "Rows"
    ghenv.Component.Params.Input[inputIndex].NickName = "R"
    ghenv.Component.Params.Input[inputIndex].Description = "Data tree where every branch is a row."
    ghenv.Component.Params.Input[inputIndex].Optional = False
    inputIndex+=1
    
    ghenv.Component.Params.Input[inputIndex].Name = "Mode"
    ghenv.Component.Params.Input[inputIndex].NickName = "M"
    ghenv.Component.Params.Input[inputIndex].Description = \
    "Operating mode:\n 0 = Nothing \n 1 = Append data\n 2 = Overwrite existing\n 3 = Only leave headers"
    ghenv.Component.Params.Input[inputIndex].Optional = False
    inputIndex+=1
    
    #Outputs
    #--------------------------------------------------------------------------------------------
    outputIndex=0
    
    ghenv.Component.Params.Output[outputIndex].Name = "Log"
    ghenv.Component.Params.Output[outputIndex].NickName = "L"
    ghenv.Component.Params.Output[outputIndex].Description = "The action that was completed"
    outputIndex+=1


#Imports
#--------------------------------------------------------------------------------------------
from System import Object
from Grasshopper import DataTree
import csv
import os

#Solver - Run with trees to enhance performance drastically
#--------------------------------------------------------------------------------------------
if __name__ == "__main__":
    
    log = []
    
    if M>0:
        if os.path.exists(P) and M>1:
            os.remove(P)
            log.Add("The old file {filePath} was successfully deleted.".format(filePath=P))
        if not os.path.exists(P):
            with open(P, 'wb') as csvfile:
                # creating a csv writer object 
                csvwriter = csv.writer(csvfile) 
                # writing the headers
                csvwriter.writerow(H) 
                log.Add("The new file {filePath} was successfully created.".format(filePath=P))
        if M != 3:
            # writing to csv file 
            with open(P, 'ab') as csvfile: 
                # creating a csv writer object 
                csvwriter = csv.writer(csvfile) 
                # writing the data rows 
                csvwriter.writerows(R.Branches)
                log.Add("{rowCount} rows have been added to the file.".format(rowCount=R.Branches.Count))
                
    else:
        log.Add("Nothing was performed.")
    L=log
# ---------- end csv_writer ----------
context_print = ContextPrint(HoneybeeFilePath=concat_4)
context_bake = ContextBake(Geometry=pt)
context_print_2 = ContextPrint(Text=csv_writer)
