# Grasshopper definition Test.gh (Grasshopper 1.0.7)
# plug-ins: MetaHopper

panel = Panel("'C:\\Git\\Work\\FOR2363\\Parametric-H-Shape-Office-Building-Model\\src\\DEU_Munich.108660_IWEC.epw'")
panel_2 = Panel("'E:\\Nextcloud\\Public\\FOR2363\\TP4\\LUH\\HVAC-Systems\\BatchCurrent\\Data_Source\\Simulation-Files\\Simulation002.hbjson'")
# Somehow the summaries with empty spaces
# in the name do not work!
# Choose
# EnergyManagementSystem:OutputVariable,
#   Central Air Source Heat Pump Capacity, ! Name
#   Cap, ! EMS Variable Name
#   Averaged, ! Type of Data in Variable
#   SystemTimestep, ! Update Frequency
#   Hot_Water_Loop_Central_Air_Source_Heat_Pump_Init_Pgrm,           ! EMS Program or Subroutine Name
#   W;
panel_3 = Panel("'E:\\Nextcloud\\Public\\FOR2363\\TP4\\LUH\\HVAC-Systems\\BatchCurrent\\Data_Source\\Simulation-Files'")
panel_4 = Panel("C:\EnergyPlusV22-2-0\WeatherData\DEU_Munich.108660_IWEC.epw")
# Annual Thermal Resilience Summary
panel_5 = Panel("AnnualBuildingUtilityPerformanceSummary")
panel_6 = Panel("AllSummaryMonthlyAndSizingPeriod")
list = ValueList({"TranslationOnly": 0, "Simulation": 1}, selected="TranslationOnly")
debugmode = Boolean(Toggle(True))
run = Boolean(Toggle(True))
merge = Merge(Data1=panel_5, Data2="AnnualThermalResilienceSummary", Data3="LEEDSummary", Data4="ShadingSummary")
merge_2 = Merge(Data1="Central Air Source Heat Pump Capacity", Data2="Baseboard Total Heating Rate", Data3="Boiler Heating Rate")
list_2 = ValueList({"Ocean", "Country", "Suburbs", "Urban", "City"}, selected="City")
int = Integer(list)
onoff = EnableDisableObject(Enabled=debugmode)
onoff_2 = EnableDisableObject(Enabled=run, AllObjects_Object=modeltoosm)
honeybee_filepath = GetString(panel_2, AtLeast=1, AtMost=1, TreeAccess=False)
simulationmode = GetInteger(int, AtLeast=1, AtMost=1, Maximum=2147483647, Minimum=-2147483648, TreeAccess=False)
additionalidf = GetString("'!-Dummy'", AtLeast=1, AtMost=1, TreeAccess=True)
output_directory = GetString(panel_3, AtLeast=1, AtMost=1, TreeAccess=False)
terrain = GetString(list_2, AtLeast=1, AtMost=1, TreeAccess=False)
epw_filepath = GetString(panel_4, AtLeast=1, AtMost=1, TreeAccess=False)
output_names = GetString(merge_2, AtLeast=1, AtMost=1, TreeAccess=True)
report_names = GetString("AllSummary", AtLeast=1, AtMost=1, TreeAccess=True)
correct = Correct(computetext=honeybee_filepath)
terrain_2 = Text(terrain)
correct_2 = Correct(computetext=output_directory)
correct_3 = Correct(computetext=epw_filepath)
honeybee_filepath_2 = FilePath(correct)
loadobjects = HBLoadObjects(hb_file=honeybee_filepath_2, load=Toggle(True))  # -> report, hb_objs; plug-in component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
output_names_2 = Text(output_names)
simulationmode_2 = Integer(simulationmode)
report_names_2 = Text(report_names)
epw_filepath_2 = FilePath(correct_3)
output_directory_2 = FilePath(correct_2)
additionalidf_2 = Text(additionalidf)
hb_model = Data(loadobjects.hb_objs)
vizbytype = HBVisualizeByType(hb_objs=hb_model)  # -> walls, interior_walls, roofs, ceilings, exterior_floors, interior_floors, air_walls, apertures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; disabled; plug-in component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

toggle = BooleanToggle(False)
simoutput = HBSimulationOutput(
    zone_energy_use=toggle,
    hvac_energy_use=toggle,
    gains_and_losses=toggle,
    comfort_metrics=toggle,
    surface_temperature=toggle,
    surface_energy_flow=toggle)  # -> report, sim_output; plug-in component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
toggle_2 = BooleanToggle(True)
simcontrol = HBSimulationControl(
    do_zone_sizing=toggle_2,
    do_system_sizing=toggle_2,
    do_plant_sizing=toggle_2,
    for_sizing_period=toggle_2,
    for_run_period=Toggle(True))  # -> sim_control; plug-in component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
shadowcalc = HBShadowCalculation(solar_dist=Slider(0, range=0..100), update_method="Timestep", frequency=Slider(1, range=0..1))  # -> shadow_calc; plug-in component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
customoutput = HBCustomSimulationOutput(
    base_sim_output=simoutput.sim_output,
    output_names=output_names_2,
    report_frequency="Annual",
    summary_reports=report_names_2)  # -> report, sim_output; plug-in component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
simpar = HBSimulationParameter(
    output=customoutput.sim_output,
    timestep=Slider(1, range=0..1),
    terrain=terrain_2,
    sim_control=simcontrol,
    shadow_calc=shadowcalc)  # -> sim_par; plug-in component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
expression = Expression(x=simulationmode_2, Expression="if(x=1,3,2)")
modeltoosm = HBModelToOSM(
    model=hb_model,
    epw_file=epw_filepath_2,
    sim_par=simpar,
    add_str=additionalidf_2,
    folder=output_directory_2,
    write=Toggle(True),
    run=expression)  # -> report, jsons, osw, osm, idf, sql, zsz, rdd, html; plug-in component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
sql_filepath = Text(modeltoosm.sql)

reportdatadictionary_filepath = Text(modeltoosm.rdd)
reports_filepath = Text(modeltoosm.html)
item = ListItem(List=modeltoosm.jsons, Index=0, Wrap=True)  # -> Item, Item1
zonesizing_filepath = Text(modeltoosm.zsz)
idf_filepath = Text(modeltoosm.idf)
simulationparameters_filepath = Text(item.Item1)
context_print = ContextPrint(Text=modeltoosm.idf)

# ==== cluster Correct
computetext = ClusterInput()
computetext_2 = Text(computetext)
strip = NAME(x=computetext_2, y="\"'")  # -> a
# ---------- strip: Python ----------
a = x.strip(y)
# ---------- end strip ----------
# Compute wrapps paths which turn into string literals.
# To undo this, unwrapping is neciassary.
# Assumption no recursion level deeper than 2.
# The wrong wrapping rises with 2^n
panel = Panel("\"E:\\\\\\\\\\\\\\\\Nextcloud\\\\\\\\\\\\\\\\Public\\\\\\\\\\\\\\\\FOR2363\\\\\\\\\\\\\\\\TP4\\\\\\\\\\\\\\\\LUH\\\\\\\\\\\\\\\\HVAC-Systems\\\\\\\\\\\\\\\\BatchCurrent\\\\\\\\\\\\\\\\Data_Source\\\\\\\\\\\\\\\\Simulation-Files\\\\\\\\\\\\\\\\Simulation000\\\\\\\\\\\\\\\\openstudio\\\\\\\\\\\\\\\\run\\\\\\\\\\\\\\\\in.idf\"")
rep = ReplaceText(Text=strip, Find="\\", Replace="\", RecursiveReplace=False)
rep_2 = ReplaceText(Text=rep, Find="\\", Replace="\", RecursiveReplace=False)
rep_3 = ReplaceText(Text=rep_2, Find="\\", Replace="\", RecursiveReplace=False)
rep_4 = ReplaceText(Text=rep_3, Find="\\", Replace="\", RecursiveReplace=False)
rep_5 = ReplaceText(Text=rep_4, Find="%", Replace="\", RecursiveReplace=False)
originaltext = Text(rep_5)
originaltext_2 = ClusterOutput(originaltext)
