# Grasshopper definition Director.gh (Grasshopper 1.0.7)
# plug-ins: Hops, MetaHopper

panel = Panel("E:\Nextcloud\Public\FOR2363\TP4\LUH\HVAC-Systems\BatchCurrent\Data_Source\Simulation-Files")
panel_2 = Panel("C:\Git\Work\FOR2363\Parametric-H-Shape-Office-Building-Model\src")
hvac_system_template = ValueList({"IdealAirSystem", "ElectricBaseboard", "BoilerBaseboard", "ASHPBaseboard", "DHWBaseboard", "EvapCoolers_ElectricBaseboard", "EvapCoolers_BoilerBaseboard", "EvapCoolers_ASHPBaseboard", "EvapCoolers_DHWBaseboard", "EvapCoolers_Furnace"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}, selected="ASHPBaseboard")
bldgvintages = HBBuildingVintages({"ASHRAE 90.1 2019  |  IECC 2021": "2019", "ASHRAE 90.1 2016  |  IECC 2018": "2016", "ASHRAE 90.1 2013  |  IECC 2015": "2013", "ASHRAE 90.1 2010  |  IECC 2012": "2010", "ASHRAE 90.1 2007  |  IECC 2009": "2007", "ASHRAE 90.1 2004  |  IECC 2006": "2004", "1980-2004 (CBECS)": "1980_2004", "Pre-1980 (CBECS)": "pre_1980"}, selected="ASHRAE 90.1 2019  |  IECC 2021")
fassade = ValueList({"Horizontal-Windows", "Vertical-Windows", "Ribbon-Windows"}, selected="Horizontal-Windows")
number_slider = Slider(4, range=0..10)
shw = HBSHWTemplates({"Gas Water Heater": "Gas_WaterHeater", "Electric Water Heater": "Electric_WaterHeater", "Heat Pump Water Heater": "HeatPump_WaterHeater", "Gas Tankless Heater": "Gas_TanklessHeater", "Electric Tankless Heater": "Electric_TanklessHeater"}, selected="Gas Water Heater")
number_slider_2 = Slider(3, range=0..10)
number_slider_3 = Slider(2.5, range=0..10)
number_slider_4 = Slider(5, range=0..10)
number_slider_5 = Slider(4, range=0..10)
number_slider_6 = Slider(3, range=0..10)
number_slider_7 = Slider(29.9, range=0..360)
number_slider_8 = Slider(13, range=0..30)
shading = ValueList({"External-Shading", "Low-SHGC-Value"}, selected="Low-SHGC-Value")
list = ValueList({"GEG", "NZEB", "Passive"}, selected="GEG")
toggle = BooleanToggle(False)
debugmode = Boolean(Toggle(True))
panel_3 = Panel("Required-U-Values.csv")
panel_4 = Panel("EnergyModel")
list_2 = ValueList({"Ocean", "Country", "Suburbs", "Urban", "City"}, selected="City")
onoff = EnableDisableObject(
    Enabled=debugmode,
    AllObjects_Object=[number_slider_4, number_slider_5, number_slider, number_slider_6, number_slider_7, number_slider_8, number_slider_2, number_slider_3, fassade, toggle, hvac_system_template, list_2, panel, panel_3, list, shading, panel_2, concat, panel_4, shw, bldgvintages])
orientation = GetNumber(number_slider_7, AtLeast=1, AtMost=1, Maximum=1.797693135e+308, Minimum=-1.797693135e+308, TreeAccess=False)
numberoffloors = GetNumber(number_slider, AtLeast=1, AtMost=1, Maximum=1.797693135e+308, Minimum=-1.797693135e+308, TreeAccess=False)
floorheight = GetNumber(number_slider_2, AtLeast=1, AtMost=1, Maximum=1.797693135e+308, Minimum=-1.797693135e+308, TreeAccess=False)
fassade_2 = GetString(fassade, AtLeast=1, AtMost=1, TreeAccess=False)
rasterlength_x = GetNumber(number_slider_3, AtLeast=1, AtMost=1, Maximum=1.797693135e+308, Minimum=-1.797693135e+308, TreeAccess=False)
rasterlength_y = GetNumber(number_slider_3, AtLeast=1, AtMost=1, Maximum=1.797693135e+308, Minimum=-1.797693135e+308, TreeAccess=False)
arm_latitudinal_numberofsegments = GetInteger(number_slider_4, AtLeast=1, AtMost=1, Maximum=2147483647, Minimum=-2147483648, TreeAccess=False)
arm_longitudinal_numberofsegments = GetInteger(number_slider_5, AtLeast=1, AtMost=1, Maximum=2147483647, Minimum=-2147483648, TreeAccess=False)
basebody_inside_latditudinal_numberofseg = GetInteger(number_slider_6, AtLeast=1, AtMost=1, Maximum=2147483647, Minimum=-2147483648, TreeAccess=False)  # "BaseBody-Inside-Latditudinal-NumberOfSegments"
courtyard_segmentcount_rasterlength_y = GetNumber(number_slider_8, AtLeast=1, AtMost=1, Maximum=1.797693135e+308, Minimum=-1.797693135e+308, TreeAccess=False)
has_courtyard_roof = GetBoolean(toggle, AtLeast=1, AtMost=1, FalseValue="False", TreeAccess=False, TrueValue="True")
shading_2 = GetString(shading, AtLeast=1, AtMost=1, TreeAccess=True)
energystandard = GetString(list, AtLeast=1, AtMost=1, TreeAccess=True)
hvac_system = GetString(hvac_system_template, AtLeast=1, AtMost=1, TreeAccess=False)
servicehotwater = GetString(shw, AtLeast=1, AtMost=1, TreeAccess=True)
buildingvintage = GetString(bldgvintages, AtLeast=1, AtMost=1, TreeAccess=True)
modelname = GetString(panel_4, AtLeast=1, AtMost=1, TreeAccess=True)
terrain = GetString(list_2, AtLeast=1, AtMost=1, TreeAccess=False)
correct = Correct(computetext=panel)
correct_2 = Correct(computetext=panel_2)
terrain_2 = Text(terrain)
orientation_2 = Number(orientation)
numberoffloors_2 = Number(numberoffloors)
floorheight_2 = Number(floorheight)
fassade_3 = Text(fassade_2)
rasterlength_x_2 = Number(rasterlength_x)
rasterlength_y_2 = Number(rasterlength_y)
arm_latitudinal_numberofsegments_2 = Number(arm_latitudinal_numberofsegments)
arm_longitudinal_numberofsegments_2 = Number(arm_longitudinal_numberofsegments)
basebody_inside_latditudinal_numberofseg_2 = Number(basebody_inside_latditudinal_numberofseg)  # "BaseBody-Inside-Latditudinal-NumberOfSegments"
courtyard_segmentcount_rasterlength_y_2 = Number(courtyard_segmentcount_rasterlength_y)
has_courtyard_roof_2 = Boolean(has_courtyard_roof)
energystandard_2 = Text(energystandard)
shading_3 = Text(shading_2)
servicehotwater_2 = Text(servicehotwater)
hvac_system_2 = Text(hvac_system)
buildingvintage_2 = Text(buildingvintage)
modelname_2 = Text(modelname)
output_directory = FilePath(correct)
scripts_directory = FilePath(correct_2)
concat = Concatenate(FragmentA=scripts_directory, FragmentB="\", FragmentD="simulation", FragmentE="\", FragmentC=panel_3)
correct_3 = Correct(computetext=concat)
required_u_values_path = FilePath(correct_3)
concat_2 = Concatenate(FragmentA=scripts_directory, FragmentB="\", FragmentC="Model.gh")
modelhops = Hops(
    _Path=concat_2,
    Orientation=orientation_2,
    NumberOfFloors=numberoffloors_2,
    FloorHeight=floorheight_2,
    Fassade=fassade_3,
    RasterLengthX=rasterlength_x_2,
    RasterLengthY=rasterlength_y_2,
    ArmLatitudinalNumberOfSegments=arm_latitudinal_numberofsegments_2,
    ArmLongitudinalNumberOfSegments=arm_longitudinal_numberofsegments_2,
    BaseBodyInsideLatditudinalNumberOfSegments=basebody_inside_latditudinal_numberofseg_2,
    Courtyard_SegmentCount_RasterLengthY=courtyard_segmentcount_rasterlength_y_2,
    CacheResultsInMemory=False,
    CacheSolveResults=False,
    RemoteDefinitionLocation="C:\Git\Work\FOR2363\Parametric-H-Shape-Office-Building-Model\src\Model.gh",
    RemoteSolveVersion=(0, 1, 0),
    ShowInput_Enabled=False,
    ShowInput_Path=True,
    SynchronousSolve=True)  # -> Zones, ZonesName, Windows, WindowsName, Zones_Underground, ZonesUndergroundName, Courtyard_Upper_Volume, Courtyard_Lower_Volume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
building_fassade_left_windowtowallratio = Number(modelhops.FassadeLeftWindowToWallRatio)
windows_name = Text(modelhops.WindowsName)
building_fassade_upper_windowtowallratio = Number(modelhops.FassadeUpperWindowToWallRatio)
windows = Brep(modelhops.Windows)
zones_underground_name = Text(modelhops.ZonesUndergroundName)
courtyard_upper_volume = Brep(modelhops.Courtyard_Upper_Volume)
courtyard_upper_fassade = Surface(modelhops.Courtyard_Upper_Fassade)
courtyard_lower_roof = Surface(modelhops.Courtyard_Lower_Roof)
zones_name = Text(modelhops.ZonesName)
zones_underground = Brep(modelhops.Zones_Underground)
courtyard_lower_volume = Brep(modelhops.Courtyard_Lower_Volume)
courtyard_lower_fassade = Surface(modelhops.Courtyard_Lower_Fassade)
courtyard_upper_roof = Surface(modelhops.Courtyard_Upper_Roof)
building_fassade_windowtowallratio = Number(modelhops.FassadeTotalWindowToWallRatio)
building_fassade_lower_windowtowallratio = Number(modelhops.FassadeLowerWindowToWallRatio)
building_fassade_right_windowtowallratio = Number(modelhops.FassadeRightWindowToWallRatio)
zones = Brep(modelhops.Zones)
concat_3 = Concatenate(FragmentA=scripts_directory, FragmentB="\", FragmentC="EnergyModel.gh")
merge = Merge(Data1=courtyard_upper_roof, Data2=courtyard_lower_roof)
energymodelhops = Hops(
    _Path=concat_3,
    Zones=zones,
    ZonesName=zones_name,
    Windows=windows,
    WindowsName=windows_name,
    Zones_Underground=zones_underground,
    ZonesUndergroundName=zones_underground_name,
    CourtyardsRoof=merge,
    Has_CourtyardRoof=has_courtyard_roof_2,
    RequiredUValuesPath=required_u_values_path,
    EnergyStandard=energystandard_2,
    Shading=shading_3,
    BuildingVintage=buildingvintage_2,
    HVACSystem=hvac_system_2,
    ServiceHotWater=servicehotwater_2,
    ModelName=modelname_2,
    OutputDirectory=output_directory,
    CacheResultsInMemory=False,
    CacheSolveResults=False,
    RemoteDefinitionLocation="C:\Git\Work\FOR2363\Parametric-H-Shape-Office-Building-Model\src\EnergyModel.gh",
    RemoteSolveVersion=(0, 1, 0),
    ShowInput_Enabled=False,
    ShowInput_Path=True,
    SynchronousSolve=True)
concat_4 = Concatenate(FragmentA=scripts_directory, FragmentB="\", FragmentC="Simulation.gh")
context_print = ContextPrint(EncryptedHoneybeeFilePath=energymodelhops)
concat_5 = Concatenate(FragmentA=scripts_directory, FragmentB="\", FragmentC="Reporting.gh")
expression = Expression(x=output_directory, Expression="x")

# ==== cluster Correct: Corrects an output file path from a compute component.
computetext = ClusterInput()
computetext_2 = Text(computetext)
strip = NAME(x=computetext_2, y="\"'")  # -> a
# ---------- strip: Python ----------
a = x.strip(y)
# ---------- end strip ----------
# Compute wrapps paths which turn into string literals.
# To undo this, unwrapping is neciassary.
# Assumption no recursion level deeper than 2.
# The wrong wrapping rises with 2^n
panel = Panel("\"E:\\\\\\\\\\\\\\\\Nextcloud\\\\\\\\\\\\\\\\Public\\\\\\\\\\\\\\\\FOR2363\\\\\\\\\\\\\\\\TP4\\\\\\\\\\\\\\\\LUH\\\\\\\\\\\\\\\\HVAC-Systems\\\\\\\\\\\\\\\\BatchCurrent\\\\\\\\\\\\\\\\Data_Source\\\\\\\\\\\\\\\\Simulation-Files\\\\\\\\\\\\\\\\Simulation000\\\\\\\\\\\\\\\\openstudio\\\\\\\\\\\\\\\\run\\\\\\\\\\\\\\\\in.idf\"")
rep = ReplaceText(Text=strip, Find="\\", Replace="\", RecursiveReplace=False)
rep_2 = ReplaceText(Text=rep, Find="\\", Replace="\", RecursiveReplace=False)
rep_3 = ReplaceText(Text=rep_2, Find="\\", Replace="\", RecursiveReplace=False)
rep_4 = ReplaceText(Text=rep_3, Find="\\", Replace="\", RecursiveReplace=False)
rep_5 = ReplaceText(Text=rep_4, Find="\\", Replace="\", RecursiveReplace=False)
rep_6 = ReplaceText(Text=rep_5, Find="\\", Replace="\", RecursiveReplace=False)
rep_7 = ReplaceText(Text=rep_6, Find="\\", Replace="\", RecursiveReplace=False)
rep_8 = ReplaceText(Text=rep_7, Find="\\", Replace="\", RecursiveReplace=False)
rep_9 = ReplaceText(Text=rep_8, Find="%", Replace="\", RecursiveReplace=False)
rep_10 = ReplaceText(Text=rep_9, Find="$", Replace=":", RecursiveReplace=False)
originaltext = Text(rep_10)
originaltext_2 = ClusterOutput(originaltext)
