# Grasshopper definition Reporting.gh (Grasshopper 1.0.7)
# plug-ins: MetaHopper

panel = Panel("E:\Nextcloud\Public\FOR2363\TP4\LUH\HVAC-Systems\BatchCurrent\Data_Source\Simulation-Files")
panel_2 = Panel("E:\Nextcloud\Public\FOR2363\TP4\LUH\HVAC-Systems\FirstBatch\Data_Source\Simulation-Files")
panel_3 = Panel("Simulation003")
panel_4 = Panel("EnergyModel")
output_directory = GetString(panel_2, AtLeast=1, AtMost=1, TreeAccess=False)
debugmode = Boolean(Toggle(True))
modelname = GetString(panel_3, AtLeast=1, AtMost=1, TreeAccess=False)
onoff = EnableDisableObject(Enabled=debugmode, AllObjects_Object=[panel, panel_4, panel_3])
correct = Correct(computetext=output_directory)
path = FilePath(correct)
concat = Concatenate(FragmentA=path, FragmentB="\", FragmentC=modelname)
write = NAME(path=panel, content=output_directory)  # disabled
# ---------- write: Python ----------
from os.path import join
if content:
    f = open(join(path,'DoubleCheck1.txt'), "w")
    f.write(content)
    f.close()
# ---------- end write ----------
concat_2 = Concatenate(FragmentA=concat, FragmentB="\", FragmentC="openstudio")
concat_3 = Concatenate(FragmentA=concat_2, FragmentB="\", FragmentC="run")
panel_5 = Panel("in")
concat_4 = Concatenate(FragmentA=concat_3, FragmentB="\", FragmentC="eplustbl.htm")
concat_5 = Concatenate(FragmentA=concat_3, FragmentB="\", FragmentC="eplusout")
concat_6 = Concatenate(FragmentA=concat_3, FragmentB="\", FragmentC="in")
concat_7 = Concatenate(FragmentA=concat_2, FragmentB="\", FragmentD=modelname, FragmentC=".hbjson")
concat_8 = Concatenate(FragmentA=concat_5, FragmentC=".sql")
concat_9 = Concatenate(FragmentA=concat_6, FragmentB=".idf")
concat_10 = Concatenate(FragmentA=concat_6, FragmentB=".osm")
reports_filepath = FilePath(concat_4)
sql_filepath = FilePath(concat_8)

panel_6 = Panel("HYDRONIC BASEBOARD-Design Size Maximum Water Flow Rate [m3/s]")
panel_7 = Panel("HYDRONIC BASEBOARD-Design Size U-Factor Times Area Value [W/K]")
readhvac = HBReadHVACSizing(sql=sql_filepath, comp_type="ZoneHVAC:Baseboard:Convective:Water")  # -> zone_names, zone_peak_cool, zone_peak_heat, comp_types, comp_properties, comp_values; plug-in component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
endswith = NAME(x=readhvac.comp_properties, y=panel_7)  # -> a
# ---------- endswith: Python ----------
a = x.endswith(y)
# ---------- end endswith ----------
endswith_2 = NAME(x=readhvac.comp_properties, y=panel_6)  # -> a; same code as endswith
dispatch = Dispatch(List=readhvac.comp_values, DispatchPattern=endswith)  # -> ListA, ListB
dispatch_2 = Dispatch(List=readhvac.comp_values, DispatchPattern=endswith_2)  # -> ListA, ListB
trim = TrimTree(Tree=dispatch.ListA, Depth=1)
trim_2 = TrimTree(Tree=dispatch_2.ListA, Depth=1)
avr = Average(Input=trim_2)
avr_2 = Average(Input=trim)
expression = Expression(x=avr, Expression="x*60000")
expression_2 = Expression(x=avr_2, Expression="x/1000")
cp = ContextPrint(BaseboardDesignSizeMaximumWaterFlowRateAverage_l_min=expression)
cp_2 = ContextPrint(BaseboardDesignSizeUFactorTimesAreaAverage_kW_K=expression_2)

panel_8 = Panel("Baseboard Total Heating Energy")
customresult = HBReadCustomResult(sql=sql_filepath, output_names=panel_8)  # -> results; plug-in component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
avr_3 = Average(Input=customresult)
ma = MassAddition(Input=customresult)  # -> Result, PartialResults
itemor0 = ItemOr0(values=ma.Result, header=panel_8, item=panel_8)
itemor0_2 = ItemOr0(values=avr_3, header=panel_8, item=panel_8)
expression_3 = Expression(x=itemor0, Expression="x/1000000")
expression_4 = Expression(x=itemor0_2, Expression="x/1000000")
cp_3 = ContextPrint(BaseboardTotalHeatingEnergySumAverage_MJ=expression_4)
cp_4 = ContextPrint(BaseboardTotalHeatingEnergySumSum_MJ=expression_3)

panel_9 = Panel("Baseboard Total Heating Rate")
customresult_2 = HBReadCustomResult(sql=sql_filepath, output_names=panel_9)  # -> results; plug-in component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
avr_4 = Average(Input=customresult_2)
ma_2 = MassAddition(Input=customresult_2)  # -> Result, PartialResults
itemor0_3 = ItemOr0(values=avr_4, header=panel_9, item=panel_9)
itemor0_4 = ItemOr0(values=ma_2.Result, header=panel_9, item=panel_9)
expression_5 = Expression(x=itemor0_4, Expression="x/1000")
expression_6 = Expression(x=itemor0_3, Expression="x/1000")
cp_5 = ContextPrint(BaseboardTotalHeatingRateAverageAverage_kW=expression_6)
cp_6 = ContextPrint(BaseboardTotalHeatingRateAverageSum_kW=expression_5)

panel_10 = Panel("Baseboard Hot Water Energy")
customresult_3 = HBReadCustomResult(sql=sql_filepath, output_names=panel_10)  # -> results; plug-in component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
avr_5 = Average(Input=customresult_3)
ma_3 = MassAddition(Input=customresult_3)  # -> Result, PartialResults
itemor0_5 = ItemOr0(values=avr_5, header=panel_10, item=panel_10)
itemor0_6 = ItemOr0(values=ma_3.Result, header=panel_10, item=panel_10)
expression_7 = Expression(x=itemor0_5, Expression="x/1000000")
expression_8 = Expression(x=itemor0_6, Expression="x/1000000")
cp_7 = ContextPrint(BaseboardHotWaterEnergySumAverage_MJ=expression_7)
cp_8 = ContextPrint(BaseboardHotWaterEnergySumSum_MJ=expression_8)

panel_11 = Panel("Baseboard Water Outlet Temperature")
customresult_4 = HBReadCustomResult(sql=sql_filepath, output_names=panel_11)  # -> results; plug-in component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
avr_6 = Average(Input=customresult_4)
ma_4 = MassAddition(Input=customresult_4)  # -> Result, PartialResults
itemor0_7 = ItemOr0(values=avr_6, header=panel_11, item=panel_11)
itemor0_8 = ItemOr0(values=ma_4.Result, header=panel_11, item=panel_11)
cp_9 = ContextPrint(BaseboardWaterOutletTemperatureAverageAverage_C=itemor0_7)
cp_10 = ContextPrint(BaseboardWaterOutletTemperatureAverageSum_C=itemor0_8)

panel_12 = Panel("Baseboard Water Inlet Temperature")
customresult_5 = HBReadCustomResult(sql=sql_filepath, output_names=panel_12)  # -> results; plug-in component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
avr_7 = Average(Input=customresult_5)
ma_5 = MassAddition(Input=customresult_5)  # -> Result, PartialResults
itemor0_9 = ItemOr0(values=avr_7, header=panel_12, item=panel_12)
itemor0_10 = ItemOr0(values=ma_5.Result, header=panel_12, item=panel_12)
cp_11 = ContextPrint(BaseboardWaterInletTemperatureAverageAverage_C=itemor0_9)
cp_12 = ContextPrint(BaseboardWaterInletTemperatureAverageSum_C=itemor0_10)

panel_13 = Panel("Baseboard Air Outlet Temperature")
customresult_6 = HBReadCustomResult(sql=sql_filepath, output_names=panel_13)  # -> results; plug-in component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
avr_8 = Average(Input=customresult_6)
ma_6 = MassAddition(Input=customresult_6)  # -> Result, PartialResults
itemor0_11 = ItemOr0(values=avr_8, header=panel_13, item=panel_13)
itemor0_12 = ItemOr0(values=ma_6.Result, header=panel_13, item=panel_13)
cp_13 = ContextPrint(BaseboardAirOutletTemperatureAverageSum_C=itemor0_12)
cp_14 = ContextPrint(BaseboardAirOutletTemperatureAverageAverage_C=itemor0_11)

panel_14 = Panel("Baseboard Air Inlet Temperature")
customresult_7 = HBReadCustomResult(sql=sql_filepath, output_names=panel_14)  # -> results; plug-in component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
avr_9 = Average(Input=customresult_7)
ma_7 = MassAddition(Input=customresult_7)  # -> Result, PartialResults
itemor0_13 = ItemOr0(values=avr_9, header=panel_14, item=panel_14)
itemor0_14 = ItemOr0(values=ma_7.Result, header=panel_14, item=panel_14)
cp_15 = ContextPrint(BaseboardAirInletTemperatureAverageSum_C=itemor0_14)
cp_16 = ContextPrint(BaseboardAirInletTemperatureAverageAverage_C=itemor0_13)

panel_15 = Panel("Baseboard Air Mass Flow Rate")
customresult_8 = HBReadCustomResult(sql=sql_filepath, output_names=panel_15)  # -> results; plug-in component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
avr_10 = Average(Input=customresult_8)
ma_8 = MassAddition(Input=customresult_8)  # -> Result, PartialResults
itemor0_15 = ItemOr0(values=avr_10, header=panel_15, item=panel_15)
itemor0_16 = ItemOr0(values=ma_8.Result, header=panel_15, item=panel_15)
cp_17 = ContextPrint(BaseboardAirMassFlowRateAverageAverage_kg_s=itemor0_15)
cp_18 = ContextPrint(BaseboardAirMassFlowRateAverageSum_kg_s=itemor0_16)

idf_filepath = FilePath(concat_9)

readtable = HBReadTabularData(sql=sql_filepath, table_name="Annual Heat Emissions Summary")  # -> values, col_names, row_names; plug-in component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
itemor0_17 = ItemOr0(values=readtable.values, header=readtable.col_names, item="Zone Exfiltration")
itemor0_18 = ItemOr0(values=readtable.values, header=readtable.col_names, item="Envelope Convection")
itemor0_19 = ItemOr0(values=readtable.values, header=readtable.col_names, item="Zone Exhaust Air")
itemor0_20 = ItemOr0(values=readtable.values, header=readtable.col_names, item="Total")
itemor0_21 = ItemOr0(values=readtable.values, header=readtable.col_names, item="HVAC Relief Air")
itemor0_22 = ItemOr0(values=readtable.values, header=readtable.col_names, item="HVAC Reject Heat")
expression_9 = Expression(x=itemor0_19, Expression="x/1000")
expression_10 = Expression(x=itemor0_18, Expression="x/1000")
expression_11 = Expression(x=itemor0_17, Expression="x/1000")
expression_12 = Expression(x=itemor0_20, Expression="x/1000")
expression_13 = Expression(x=itemor0_21, Expression="x/1000")
expression_14 = Expression(x=itemor0_22, Expression="x/1000")
cp_19 = ContextPrint(HeatEmissionsZoneHVACReliefAir_MWh_a=expression_13)
cp_20 = ContextPrint(HeatEmissionsZoneHVACRejectHeat_MWh_a=expression_14)
cp_21 = ContextPrint(HeatEmissionsZoneZoneExhaustAir_MWh_a=expression_9)
cp_22 = ContextPrint(HeatEmissionsEnvelopeConvection_MWh_a=expression_10)
cp_23 = ContextPrint(HeatEmissionsZoneExfiltration_MWh_a=expression_11)
cp_24 = ContextPrint(HeatEmissionsTotal_MWh_a=expression_12)

readtable_2 = HBReadTabularData(sql=sql_filepath, table_name="End Uses")  # -> values, col_names, row_names; plug-in component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
readtable_3 = HBReadTabularData(sql=sql_filepath, table_name="Site and Source Energy")  # -> values, col_names, row_names; plug-in component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
panel_16 = Panel("Total Source Energy")
loadobjects = HBLoadObjects(hb_file=concat_7, load=Toggle(True))  # -> report, hb_objs; plug-in component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
selectmatrixvalue = SelectMatrixValue(
    values=readtable_2.values,
    columnnames=readtable_2.col_names,
    rownames=readtable_2.row_names,
    columnitem="Electricity",
    rowitem="Heating")
geoprop = HBGeometryProperties(rooms=flatten(loadobjects.hb_objs))  # -> ext_wall_area, ext_win_area, volume, floor_area, floor_ep_constr; plug-in component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
selectmatrixvalue_2 = SelectMatrixValue(
    values=readtable_3.values,
    columnnames=readtable_3.col_names,
    rownames=readtable_3.row_names,
    columnitem="Energy Per Total Building Area",
    rowitem="Total Site Energy")
cp_25 = ContextPrint(Volume_m³=geoprop.volume)
division = Division(A=geoprop.ext_win_area, B=geoprop.ext_wall_area)
division_2 = Division(A=geoprop.floor_ep_constr, B=geoprop.floor_area)
expression_15 = Expression(x=division_2, Expression="1-x")
cp_26 = ContextPrint(WindowToWallRatio_=division)

customresult_9 = HBReadCustomResult(sql=sql_filepath, output_names="Boiler Gas Energy")  # -> results; plug-in component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
itemor0_23 = ItemOr0(values=customresult_9, header="Boiler Gas Energy", item="Boiler Gas Energy")
expression_16 = Expression(x=itemor0_23, Expression="x/1000000")
cp_27 = ContextPrint(BoilerGasEnergySum_MJ=expression_16)

panel_17 = Panel("Boiler Parasitic Electricity Rate")
customresult_10 = HBReadCustomResult(sql=sql_filepath, output_names=panel_17)  # -> results; plug-in component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
itemor0_24 = ItemOr0(values=customresult_10, header=panel_17, item=panel_17)
expression_17 = Expression(x=itemor0_24, Expression="x/1000")
cp_28 = ContextPrint(BoilerParasiticElectricityRateAverage_kW=expression_17)

panel_18 = Panel("Boiler Ancillary Electricity Energy")
customresult_11 = HBReadCustomResult(sql=sql_filepath, output_names=panel_18)  # -> results; plug-in component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
itemor0_25 = ItemOr0(values=customresult_11, header=panel_18, item=panel_18)
expression_18 = Expression(x=itemor0_25, Expression="x/1000000")
cp_29 = ContextPrint(BoilerAncillaryElectricityEnergySum_MJ=expression_18)

cp_30 = ContextPrint(ConstructionArea_=expression_15)

readtable_4 = HBReadTabularData(sql=sql_filepath, table_name="Boiler:HotWater")  # -> values, col_names, row_names; plug-in component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
itemor0_26 = ItemOr0(values=readtable_4.values, header=readtable_4.col_names, item="Design Size Nominal Capacity")
expression_19 = Expression(x=itemor0_26, Expression="x/1000")
cp_31 = ContextPrint(BoilerDesignSizeNominalCapacity_kW=expression_19)

panel_19 = Panel("Boiler Inlet Temperature")
customresult_12 = HBReadCustomResult(sql=sql_filepath, output_names=panel_19)  # -> results; plug-in component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
itemor0_27 = ItemOr0(values=customresult_12, header=panel_19, item=panel_19)
cp_32 = ContextPrint(BoilerInletTemperatureAverage_C=itemor0_27)

panel_20 = Panel("Boiler Outlet Temperature")
customresult_13 = HBReadCustomResult(sql=sql_filepath, output_names=panel_20)  # -> results; plug-in component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
itemor0_28 = ItemOr0(values=customresult_13, header=panel_20, item=panel_20)
cp_33 = ContextPrint(BoilerOutletTemperatureAverage_C=itemor0_28)

customresult_14 = HBReadCustomResult(sql=sql_filepath, output_names="Boiler Mass Flow Rate")  # -> results; plug-in component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
itemor0_29 = ItemOr0(values=customresult_14, header="Boiler Mass Flow Rate", item="Boiler Mass Flow Rate")
cp_34 = ContextPrint(BoilerMassFlowRateAverage_kg_s=itemor0_29)

customresult_15 = HBReadCustomResult(sql=sql_filepath, output_names="Boiler Efficiency")  # -> results; plug-in component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
itemor0_30 = ItemOr0(values=customresult_15, header="Boiler Efficiency", item="Boiler Efficiency")
cp_35 = ContextPrint(BoilerEfficiency=itemor0_30)

customresult_16 = HBReadCustomResult(sql=sql_filepath, output_names="Boiler Part Load Ratio")  # -> results; plug-in component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
itemor0_31 = ItemOr0(values=customresult_16, header="Boiler Part Load Ratio", item="Boiler Part Load Ratio")
cp_36 = ContextPrint(BoilerPartLoadRatioAverage=itemor0_31)

customresult_17 = HBReadCustomResult(sql=sql_filepath, output_names="Boiler Heating Energy")  # -> results; plug-in component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
itemor0_32 = ItemOr0(values=customresult_17, header="Boiler Heating Energy", item="Boiler Heating Energy")
expression_20 = Expression(x=itemor0_32, Expression="x/1000000")
cp_37 = ContextPrint(BoilerHeatingEnergyAverage_MJ=expression_20)

customresult_18 = HBReadCustomResult(sql=sql_filepath, output_names="Boiler Gas Rate")  # -> results; plug-in component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
itemor0_33 = ItemOr0(values=customresult_18, header="Boiler Gas Rate", item="Boiler Gas Rate")
expression_21 = Expression(x=itemor0_33, Expression="x/1000")
cp_38 = ContextPrint(BoilerGasRateAverage_kW=expression_21)

customresult_19 = HBReadCustomResult(sql=sql_filepath, output_names="Boiler Heating Rate")  # -> results; plug-in component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
itemor0_34 = ItemOr0(values=customresult_19, header="Boiler Heating Rate", item="Boiler Heating Rate")
expression_22 = Expression(x=itemor0_34, Expression="x/1000")
cp_39 = ContextPrint(BoilerHeatingRateAverage_kW=expression_22)

panel_21 = Panel("Boiler Heating Energy")  # disabled
number_slider = Slider(54.41, range=0..100)
getepsqlvalue = NAME(path=sql_filepath, outputVariableName=panel_21)  # -> query, value, unit; disabled
# ---------- getepsqlvalue: Python ----------
import sqlite3

query= ("SELECT KeyValue,MaxValue,MinValue Units "+ 
"FROM ReportVariableWithTime " + 
"WHERE Name = \"" + outputVariableName + "\" " + 
"AND TableName = \"" + tableName + "\" " + 
"AND ColumnName = \"" + columnName + "\" " + 
"AND Rowname = \"" + rowName + "\" ")
 #AND ReportForString='Entire Facility'
conn = sqlite3.connect(path)
c = conn.cursor()
c.execute(query)
results = list(c)
if len(results)!=1:
    print("There was more than 1 value.")
result = results[0]
value = result[0].strip()
unit = result[1]
c.close()
# ---------- end getepsqlvalue ----------
multiplication = Multiplication(B=277)
expression_23 = Expression(x="627.65", Expression="x*277.8")
expression_24 = Expression(x="627.65", Expression="x*0.2778")
readtable_5 = HBReadTabularData(sql=sql_filepath, table_name="End Uses")  # -> values, col_names, row_names; plug-in component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
valueor0 = ValueOr0(value=expression_23)
viewer = ParamViewer(readtable_5.values)
context_print = ContextPrint(EUIElectricityInteriorEquipment_kWh=valueor0)
panel_22 = Panel("AnnualBuildingUtilityPerformanceSummary")

eui = HBEndUseIntensity(sql=sql_filepath, ip=Toggle(False))  # -> eui, eui_end_use, end_uses, gross_floor; plug-in component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
itemor0_35 = ItemOr0(values=eui.eui_end_use, header=eui.end_uses, item="Heating")
itemor0_36 = ItemOr0(values=eui.eui_end_use, header=eui.end_uses, item="Cooling")
itemor0_37 = ItemOr0(values=eui.eui_end_use, header=eui.end_uses, item="Interior Equipment")
itemor0_38 = ItemOr0(values=eui.eui_end_use, header=eui.end_uses, item="Interior Lighting")
itemor0_39 = ItemOr0(values=eui.eui_end_use, header=eui.end_uses, item="Electric Equipment")
itemor0_40 = ItemOr0(values=eui.eui_end_use, header=eui.end_uses, item="Pumps")
cp_40 = ContextPrint(EUIInteriorEquipment_kWh_m²a=itemor0_37)
cp_41 = ContextPrint(EUIHeating_kWh_m²a=itemor0_35)
cp_42 = ContextPrint(EUICooling_kWh_m²a=itemor0_36)
cp_43 = ContextPrint(EUIInteriorLighting_kWh_m²a=itemor0_38)
cp_44 = ContextPrint(EUIElectricEquipment_kWh_m²a=itemor0_39)
cp_45 = ContextPrint(EUIPumps_kWh_m²a=itemor0_40)

panel_23 = Panel(itemor0_35)
division_3 = Division(A=expression_23, B=eui.gross_floor)

panel_24 = Panel("District Heating Outlet Temperature")
customresult_20 = HBReadCustomResult(sql=sql_filepath, output_names=panel_24)  # -> results; plug-in component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
itemor0_41 = ItemOr0(values=customresult_20, header=panel_24, item=panel_24)
cp_46 = ContextPrint(DistrictHeatingOutletTemperatureAverage_C=itemor0_41)

panel_25 = Panel("District Heating Mass Flow Rate")
customresult_21 = HBReadCustomResult(sql=sql_filepath, output_names=panel_25)  # -> results; plug-in component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
itemor0_42 = ItemOr0(values=customresult_21, header=panel_25, item=panel_25)
cp_47 = ContextPrint(DistrictHeatingMassFlowRateAverage_kg_s=itemor0_42)

panel_26 = Panel("District Heating Inlet Temperature")
customresult_22 = HBReadCustomResult(sql=sql_filepath, output_names=panel_26)  # -> results; plug-in component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
itemor0_43 = ItemOr0(values=customresult_22, header=panel_26, item=panel_26)
cp_48 = ContextPrint(DistrictHeatingInletTemperatureAverage_C=itemor0_43)

panel_27 = Panel("District Heating Hot Water Energy")
customresult_23 = HBReadCustomResult(sql=sql_filepath, output_names=panel_27)  # -> results; plug-in component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
itemor0_44 = ItemOr0(values=customresult_23, header=panel_27, item=panel_27)
expression_25 = Expression(x=itemor0_44, Expression="x/1000000")
cp_49 = ContextPrint(DistrictHeatingHotWaterEnergySum_MJ=expression_25)

panel_28 = Panel("AnnualBuildingUtilityPerformanceSummary")
getepsqlvalues = NAME(path=sql_filepath, reportName=panel_22, tableName="End Uses", rowName="Heating")  # -> query, columnNames, values, units
# ---------- getepsqlvalues: Python ----------
import sqlite3

query= ("SELECT ColumnName,Value,Units "+ 
"FROM TabularDataWithStrings " + 
"WHERE ReportName = \"" + reportName + "\" " + 
"AND TableName = \"" + tableName + "\" " + 
"AND Rowname = \"" + rowName + "\" ")
 #AND ReportForString='Entire Facility'
conn = sqlite3.connect(path)
c = conn.cursor()
c.execute(query)
results = list(c)
columnNames = []
values = []
units = []
for i,result in enumerate(results):
    columnNames.append(result[0].strip())
    values.append(result[1].strip())
    units.append(result[2].strip())
c.close()
# ---------- end getepsqlvalues ----------
getepsqlvalues_2 = NAME(path=sql_filepath, reportName=panel_22, tableName="End Uses", rowName="Cooling")  # -> query, columnNames, values, units; same code as getepsqlvalues

panel_29 = Panel("District Heating Hot Water Rate")
customresult_24 = HBReadCustomResult(sql=sql_filepath, output_names=panel_29)  # -> results; plug-in component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
itemor0_45 = ItemOr0(values=customresult_24, header=panel_29, item=panel_29)
expression_26 = Expression(x=itemor0_45, Expression="x/1000")
cp_50 = ContextPrint(DistrictHeatingRateAverage_kW=expression_26)

customresult_25 = HBReadCustomResult(sql=sql_filepath, output_names="District Heating Rate")  # -> results; plug-in component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
itemor0_46 = ItemOr0(values=customresult_25, header="District Heating Rate", item="District Heating Rate")
expression_27 = Expression(x=itemor0_46, Expression="x/1000")
cp_51 = ContextPrint(AverageDistrictHeatingRate_kW=expression_27)

lito3p = ListInto3Parts(ListToSlice=getepsqlvalues.values, StartIndex="0", EndIndex="-1")  # -> FilteredList, ItemsBefore, ItemsAfter; inputs ListToSlice: tree, StartIndex: tree of Int32, EndIndex: tree of Int32
# ---------- lito3p: Python ----------
if ghenv.Component.RunCount<2:
    __author__ = "Ueli Saluz"
    __version__ = "2020.05.28"
    
    ghenv.Component.Name = "ListInto3Parts"
    ghenv.Component.NickName = "LiTo3P"
    ghenv.Component.Description = "Slice list into 3 parts. All lists are sliced with the same indices. End index = 0 = length(list)."
    ghenv.Component.Message = "VER 1.6"

from System import Object
from Grasshopper import DataTree

def filterList(listToFilter,startIndex,endIndex):
    # Return: FilteredList, Before, After
    if (((startIndex == 0) or (startIndex is None)) and ((endIndex == 0) or (endIndex is None))) or (endIndex <= startIndex and endIndex > 0):
        return (listToFilter,None,None)
    elif (startIndex == 0) or (startIndex is None):
        return (listToFilter[:endIndex],None,listToFilter[endIndex:])
    elif (endIndex == 0) or (endIndex is None):
        print 1
        return (listToFilter[:startIndex],listToFilter[startIndex:],None)
    else:
        return (listToFilter[startIndex:endIndex],listToFilter[:startIndex],listToFilter[endIndex:])

if __name__ == "__main__":
    FilteredList = DataTree[Object]()
    ItemsBefore = DataTree[Object]()
    ItemsAfter = DataTree[Object]()
    
    for path in ListToSlice.Paths:
        listBranch = ListToSlice.Branch(path)
        pyList = list(listBranch)   #Convert .Net List to Python
        try: #terrible way of writing code but if I set the list to list access the performance decreases massivly due to many calls
            startIndex = StartIndex.Branch(path)
            startIndex = startIndex[0]
        except Exception:
            try:
                startIndex = StartIndex.Branch(0)
                startIndex = startIndex[0]
            except Exception:
                startIndex = 0
        try:
            endIndex = EndIndex.Branch(path)
            endIndex = endIndex[0]
        except Exception:
            try:
                endIndex = EndIndex.Branch(0)
                endIndex = endIndex[0]
            except Exception:
                endIndex = len(pyList)
        filtList=filterList(pyList,startIndex,endIndex)
        if filtList[0]:
            FilteredList.AddRange(filtList[0],path)
        if filtList[1]:
            ItemsBefore.AddRange(filtList[1],path)
        if filtList[2]:
            ItemsAfter.AddRange(filtList[2],path)
# ---------- end lito3p ----------
lito3p_2 = ListInto3Parts(ListToSlice=getepsqlvalues_2.values, StartIndex="0", EndIndex="-1")  # -> FilteredList, ItemsBefore, ItemsAfter; inputs ListToSlice: tree, StartIndex: tree of Int32, EndIndex: tree of Int32; same code as lito3p
getepsqlvalue_2 = NAME(
    path=sql_filepath,
    reportName="AnnualBuildingUtilityPerformanceSummary",
    tableName="Building Area",
    columnName="Area",
    rowName="Total Building Area")  # -> query, value, unit
# ---------- getepsqlvalue_2: Python ----------
import sqlite3

query= ("SELECT Value, Units "+ 
"FROM TabularDataWithStrings " + 
"WHERE ReportName = \"" + reportName + "\" " + 
"AND TableName = \"" + tableName + "\" " + 
"AND ColumnName = \"" + columnName + "\" " + 
"AND Rowname = \"" + rowName + "\" ")
 #AND ReportForString='Entire Facility'
conn = sqlite3.connect(path)
c = conn.cursor()
c.execute(query)
results = list(c)
if len(results)!=1:
    print("There was more than 1 value.")
result = results[0]
value = result[0].strip()
unit = result[1]
c.close()
# ---------- end getepsqlvalue_2 ----------
getepsqlvalue_3 = NAME(
    path=sql_filepath,
    reportName="AnnualBuildingUtilityPerformanceSummary",
    tableName="Site and Source Energy",
    columnName="Energy Per Total Building Area",
    rowName="Total Site Energy")  # -> query, value, unit; same code as getepsqlvalue_2
getepsqlvalue_4 = NAME(path=sql_filepath, reportName=panel_28, tableName="End Uses", columnName="Electricity", rowName="Heating")  # -> query, value, unit; same code as getepsqlvalue_2
getepsqlvalue_5 = NAME(path=sql_filepath, reportName=panel_28, tableName="End Uses", columnName="Natural Gas", rowName="Heating")  # -> query, value, unit; same code as getepsqlvalue_2
ma_9 = MassAddition(Input=lito3p.FilteredList)  # -> Result, PartialResults
ma_10 = MassAddition(Input=lito3p_2.FilteredList)  # -> Result, PartialResults

# ---- group: MJ to kWh
expression_28 = Expression(x=getepsqlvalue_3.value, Expression="x*0.2778")

# ----
valueor0_2 = ValueOr0(value=getepsqlvalue_2.value)

# ---- group: GJ to kWh
expression_29 = Expression(x=getepsqlvalue_4.value, Expression="x*277.8")

expression_30 = Expression(x=getepsqlvalue_5.value, Expression="x*277.8")

expression_31 = Expression(x=ma_10.Result, Expression="x*277.8")

expression_32 = Expression(x=ma_9.Result, Expression="x*277.8")

# ----
cp_52 = ContextPrint(GrossFloorArea_m²=valueor0_2)
valueor0_3 = ValueOr0(value=expression_28)
division_4 = Division(A=expression_29, B=valueor0_2)
division_5 = Division(A=expression_30, B=valueor0_2)
valueor0_4 = ValueOr0(value=division_5)
valueor0_5 = ValueOr0(value=division_4)
cp_53 = ContextPrint(EUI_kWh_m²a=valueor0_3)

# ---- group: GJ to kWh
expression_33 = Expression(x=getepsqlvalue_3.value, Expression="x*277.8")

# ----
cp_54 = ContextPrint(EUIHeatingNatrualGas_kWh_m²a=valueor0_4)
cp_55 = ContextPrint(EUIHeatingElectricity_kWh_m²a=valueor0_5)

panel_30 = Panel("Central Air Source Heat Pump Capacity")
customresult_26 = HBReadCustomResult(sql=sql_filepath, output_names=panel_30)  # -> results; plug-in component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
itemor0_47 = ItemOr0(values=customresult_26, header=panel_30, item=panel_30)
expression_34 = Expression(x=itemor0_47, Expression="x/1000")
cp_56 = ContextPrint(CentralAirSourceHeatPumpCapacity_kW=expression_34)

# ----
# SHW PUMP1-Design Flow Rate [m3/s]
# SHW PUMP1-Design Power Consumption [W]
# SERVICE HOT WATER PUMP-Design Flow Rate [m3/s]
# SERVICE HOT WATER PUMP-Design Power Consumption [W]
panel_31 = Panel("Pump:ConstantSpeed")
readhvac_2 = HBReadHVACSizing(sql=sql_filepath, comp_type=panel_31)  # -> zone_names, zone_peak_cool, zone_peak_heat, comp_types, comp_properties, comp_values; plug-in component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
endswith_3 = NAME(x=readhvac_2.comp_properties, y="Design Power Consumption [W]")  # -> a; same code as endswith
endswith_4 = NAME(x=readhvac_2.comp_properties, y="Design Flow Rate [m3/s]")  # -> a; same code as endswith
dispatch_3 = Dispatch(List=readhvac_2.comp_values, DispatchPattern=endswith_4)  # -> ListA, ListB
dispatch_4 = Dispatch(List=readhvac_2.comp_values, DispatchPattern=endswith_3)  # -> ListA, ListB
trim_3 = TrimTree(Tree=dispatch_4.ListA, Depth=1)
trim_4 = TrimTree(Tree=dispatch_3.ListA, Depth=1)
expression_35 = Expression(x=trim_4, Expression="x*60000")
expression_36 = Expression(x=trim_3, Expression="x/1000")
cp_57 = ContextPrint(HotWaterPumpDesignFlowRate_l_min=expression_35)
cp_58 = ContextPrint(HotWaterPumpDesignPowerConsumption_kW=expression_36)

panel_32 = Panel("Water Heater Source Side Heat Transfer Energy")
customresult_27 = HBReadCustomResult(sql=sql_filepath, output_names=panel_32)  # -> results; plug-in component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
itemor0_48 = ItemOr0(values=customresult_27, header=panel_32, item=panel_32)
expression_37 = Expression(x=itemor0_48, Expression="x/1000000")
cp_59 = ContextPrint(WaterHeaterSourceSideHeatTransferEnergySum_MJ=expression_37)

panel_33 = Panel("Water Heater Source Side Inlet Temperature")
customresult_28 = HBReadCustomResult(sql=sql_filepath, output_names=panel_33)  # -> results; plug-in component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
itemor0_49 = ItemOr0(values=customresult_28, header=panel_33, item=panel_33)
cp_60 = ContextPrint(WaterHeaterSourceSideInletTemperatureAverage_C=itemor0_49)

panel_34 = Panel("Water Heater Heating Rate")
customresult_29 = HBReadCustomResult(sql=sql_filepath, output_names=panel_34)  # -> results; plug-in component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
itemor0_50 = ItemOr0(values=customresult_29, header=panel_34, item=panel_34)
expression_38 = Expression(x=itemor0_50, Expression="x/1000")
cp_61 = ContextPrint(WaterHeaterHeatingRateAverage_kW=expression_38)

panel_35 = Panel("Water Heater Source Side Outlet Temperature")
customresult_30 = HBReadCustomResult(sql=sql_filepath, output_names=panel_35)  # -> results; plug-in component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
itemor0_51 = ItemOr0(values=customresult_30, header=panel_35, item=panel_35)
cp_62 = ContextPrint(WaterHeaterSourceSideOutletTemperatureAverage_C=itemor0_51)

panel_36 = Panel("Water Heater Total Demand Heat Transfer Rate")
customresult_31 = HBReadCustomResult(sql=sql_filepath, output_names=panel_36)  # -> results; plug-in component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
itemor0_52 = ItemOr0(values=customresult_31, header=panel_36, item=panel_36)
expression_39 = Expression(x=itemor0_52, Expression="x/1000")
cp_63 = ContextPrint(WaterHeaterTotalDemandHeatTransferRateAverage_kW=expression_39)

panel_37 = Panel("Water Heater Use Side Heat Transfer Energy")
customresult_32 = HBReadCustomResult(sql=sql_filepath, output_names=panel_37)  # -> results; plug-in component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
itemor0_53 = ItemOr0(values=customresult_32, header=panel_37, item=panel_37)
expression_40 = Expression(x=itemor0_53, Expression="x/1000000")
cp_64 = ContextPrint(WaterHeaterUseSideHeatTransferEnergySum_MJ=expression_40)

panel_38 = Panel("Water Heater Total Demand Energy")
customresult_33 = HBReadCustomResult(sql=sql_filepath, output_names=panel_38)  # -> results; plug-in component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
itemor0_54 = ItemOr0(values=customresult_33, header=panel_38, item=panel_38)
expression_41 = Expression(x=itemor0_54, Expression="x/1000000")
cp_65 = ContextPrint(WaterHeaterTotalDemandEnergySum_MJ=expression_41)

panel_39 = Panel("Water Heater Source Side Heat Transfer Rate")
customresult_34 = HBReadCustomResult(sql=sql_filepath, output_names=panel_39)  # -> results; plug-in component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
itemor0_55 = ItemOr0(values=customresult_34, header=panel_39, item=panel_39)
expression_42 = Expression(x=itemor0_55, Expression="x/1000")
cp_66 = ContextPrint(WaterHeaterSourceSideHeatTransferRateAverage_kW=expression_42)

panel_40 = Panel("Water Heater Electricity Rate")
customresult_35 = HBReadCustomResult(sql=sql_filepath, output_names=panel_40)  # -> results; plug-in component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
itemor0_56 = ItemOr0(values=customresult_35, header=panel_40, item=panel_40)
expression_43 = Expression(x=itemor0_56, Expression="x/1000")
cp_67 = ContextPrint(WaterHeaterElectricityRateAverage_kW=expression_43)

customresult_36 = HBReadCustomResult(sql=sql_filepath, output_names="Water Heater Gas Rate")  # -> results; plug-in component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
itemor0_57 = ItemOr0(values=customresult_36, header="Water Heater Gas Rate", item="Water Heater Gas Rate")
expression_44 = Expression(x=itemor0_57, Expression="x/1000")
cp_68 = ContextPrint(WaterHeaterGasRateAverage_kW=expression_44)

panel_41 = Panel("Water Heater Use Side Inlet Temperature")
customresult_37 = HBReadCustomResult(sql=sql_filepath, output_names=panel_41)  # -> results; plug-in component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
itemor0_58 = ItemOr0(values=customresult_37, header=panel_41, item=panel_41)
cp_69 = ContextPrint(WaterHeaterUseSideInletTemperatureAverage_C=itemor0_58)

panel_42 = Panel("Water Heater Use Side Outlet Temperature")
customresult_38 = HBReadCustomResult(sql=sql_filepath, output_names=panel_42)  # -> results; plug-in component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
itemor0_59 = ItemOr0(values=customresult_38, header=panel_42, item=panel_42)
cp_70 = ContextPrint(WaterHeaterUseSideOutletTemperatureAverage_C=itemor0_59)

panel_43 = Panel("Water Heater Use Source Mass Flow Rate")
customresult_39 = HBReadCustomResult(sql=sql_filepath, output_names=panel_43)  # -> results; plug-in component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
itemor0_60 = ItemOr0(values=customresult_39, header=panel_43, item=panel_43)
cp_71 = ContextPrint(WaterHeaterSourceSideMassFlowRateAverage_kg_s=itemor0_60)

panel_44 = Panel("Water Heater Use Side Heat Transfer Rate")
customresult_40 = HBReadCustomResult(sql=sql_filepath, output_names=panel_44)  # -> results; plug-in component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
itemor0_61 = ItemOr0(values=customresult_40, header=panel_44, item=panel_44)
expression_45 = Expression(x=itemor0_61, Expression="x/1000")
cp_72 = ContextPrint(WaterHeaterUseSideHeatTransferRateAverage_kW=expression_45)

panel_45 = Panel("Water Heater Use Side Mass Flow Rate")
customresult_41 = HBReadCustomResult(sql=sql_filepath, output_names=panel_45)  # -> results; plug-in component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
itemor0_62 = ItemOr0(values=customresult_41, header=panel_45, item=panel_45)
cp_73 = ContextPrint(WaterHeaterUseSideMassFlowRateAverage_kg_s=itemor0_62)

panel_46 = Panel("Water Heater Heat Loss Rate")
customresult_42 = HBReadCustomResult(sql=sql_filepath, output_names=panel_46)  # -> results; plug-in component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
itemor0_63 = ItemOr0(values=customresult_42, header=panel_46, item=panel_46)
expression_46 = Expression(x=itemor0_63, Expression="x/1000")
cp_74 = ContextPrint(WaterHeaterHeatLossRateAverage_kW=expression_46)

panel_47 = Panel("Water Heater Tank Temperature")
customresult_43 = HBReadCustomResult(sql=sql_filepath, output_names=panel_47)  # -> results; plug-in component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
itemor0_64 = ItemOr0(values=customresult_43, header=panel_47, item=panel_47)
cp_75 = ContextPrint(WaterHeaterTankTemperatureAverage_C=itemor0_64)

panel_48 = Panel("Baseboard Hot Water Mass Flow Rate")
customresult_44 = HBReadCustomResult(sql=sql_filepath, output_names=panel_48)  # -> results; plug-in component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

avr_11 = Average(Input=customresult_44)
ma_11 = MassAddition(Input=customresult_44)  # -> Result, PartialResults

itemor0_65 = ItemOr0(values=avr_11, header=panel_48, item=panel_48)
itemor0_66 = ItemOr0(values=ma_11.Result, header=panel_48, item=panel_48)
cp_76 = ContextPrint(BaseboardHotWaterMassFlowRateAverageAverage_kg_s=itemor0_65)
cp_77 = ContextPrint(BaseboardHotWaterMassFlowRateAverageSum_kg_s=itemor0_66)

readhvac_3 = HBReadHVACSizing(sql=sql_filepath, comp_type="WaterHeater:Mixed")  # -> zone_names, zone_peak_cool, zone_peak_heat, comp_types, comp_properties, comp_values; plug-in component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
endswith_5 = NAME(x=readhvac_3.comp_properties, y="Design Flow Rate [m3/s]")  # -> a; same code as endswith
dispatch_5 = Dispatch(List=readhvac_3.comp_values, DispatchPattern=endswith_5)  # -> ListA, ListB
trim_5 = TrimTree(Tree=dispatch_5.ListA, Depth=1)

valueor0_6 = ValueOr0(value=trim_5)

expression_47 = Expression(x=valueor0_6, Expression="x*60000")
cp_78 = ContextPrint(ServiceHotWaterHeaterDesignFlowRate_l_min=expression_47)

panel_49 = Panel("Water Heater Heat Loss Energy")
customresult_45 = HBReadCustomResult(sql=sql_filepath, output_names=panel_49)  # -> results; plug-in component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
itemor0_67 = ItemOr0(values=customresult_45, header=panel_49, item=panel_49)

expression_48 = Expression(x=itemor0_67, Expression="x/1000000")

cp_79 = ContextPrint(WaterHeaterHeatLossEnergySum_MJ=expression_48)

# ==== cluster ItemOr0
item = ClusterInput()
values = ClusterInput()
header = ClusterInput()
header_2 = Text(header)
item_2 = Text(item)
values_2 = Number(values)
itemindex = ItemIndex(L=header_2, I=item_2)  # -> i; inputs L: list
# ---------- itemindex: Python ----------
#Component Information
#--------------------------------------------------------------------------------------------
if ghenv.Component.RunCount<2:
    #General
    #--------------------------------------------------------------------------------------------
    __author__ = "Ueli Saluz"
    __version__ = "2022.11.18"
    
    ghenv.Component.Name = "ItemIndex"
    ghenv.Component.NickName = "ItemIndex"
    ghenv.Component.Description = "A better IdemIndex"
    ghenv.Component.Message = "VER 1.0"
    ghenv.Component.Category = "Set"
    ghenv.Component.SubCategory = "List"
    
     #Inputs
    #--------------------------------------------------------------------------------------------
    inputIndex=0
    
    ghenv.Component.Params.Input[inputIndex].Name = "List"
    ghenv.Component.Params.Input[inputIndex].NickName = "L"
    ghenv.Component.Params.Input[inputIndex].Description = "Input1 is..."
    ghenv.Component.Params.Input[inputIndex].Optional = False
    inputIndex+=1
    
    ghenv.Component.Params.Input[inputIndex].Name = "Item"
    ghenv.Component.Params.Input[inputIndex].NickName = "I"
    ghenv.Component.Params.Input[inputIndex].Description = "Input2 is..."
    ghenv.Component.Params.Input[inputIndex].Optional = False
    inputIndex+=1
    
    #Outputs
    #--------------------------------------------------------------------------------------------
    outputIndex=0
    
    ghenv.Component.Params.Output[outputIndex].Name = "Index"
    ghenv.Component.Params.Output[outputIndex].NickName = "i"
    ghenv.Component.Params.Output[outputIndex].Description = "Output1 is..."
    outputIndex+=1

i = L.index(I)
# ---------- end itemindex ----------
item_3 = ListItem(List=values_2, Index=itemindex, Wrap=True)
null = NullItem(Item=item_3)  # -> NullFlags, InvalidFlags, Description
filter = StreamFilter(Gate=null.NullFlags, Stream0=item_3, Stream1="0")
valueor0 = Number(filter)
valueor0_2 = ClusterOutput(valueor0)

# ==== cluster Correct: Corrects an output file path from a compute component.
computetext = ClusterInput()
computetext_2 = Text(computetext)
strip = NAME(x=computetext_2, y="\"'")  # -> a
# ---------- strip: Python ----------
a = x.strip(y)
# ---------- end strip ----------
# Compute wrapps paths which turn into string literals.
# To undo this, unwrapping is neciassary.
# Assumption no recursion level deeper than 2.
# The wrong wrapping rises with 2^n
panel = Panel("\"E:\\\\\\\\\\\\\\\\Nextcloud\\\\\\\\\\\\\\\\Public\\\\\\\\\\\\\\\\FOR2363\\\\\\\\\\\\\\\\TP4\\\\\\\\\\\\\\\\LUH\\\\\\\\\\\\\\\\HVAC-Systems\\\\\\\\\\\\\\\\BatchCurrent\\\\\\\\\\\\\\\\Data_Source\\\\\\\\\\\\\\\\Simulation-Files\\\\\\\\\\\\\\\\Simulation000\\\\\\\\\\\\\\\\openstudio\\\\\\\\\\\\\\\\run\\\\\\\\\\\\\\\\in.idf\"")
rep = ReplaceText(Text=strip, Find="\\", Replace="\", RecursiveReplace=False)
rep_2 = ReplaceText(Text=rep, Find="\\", Replace="\", RecursiveReplace=False)
rep_3 = ReplaceText(Text=rep_2, Find="\\", Replace="\", RecursiveReplace=False)
rep_4 = ReplaceText(Text=rep_3, Find="\\", Replace="\", RecursiveReplace=False)
rep_5 = ReplaceText(Text=rep_4, Find="\\", Replace="\", RecursiveReplace=False)
rep_6 = ReplaceText(Text=rep_5, Find="\\", Replace="\", RecursiveReplace=False)
rep_7 = ReplaceText(Text=rep_6, Find="\\", Replace="\", RecursiveReplace=False)
rep_8 = ReplaceText(Text=rep_7, Find="\\", Replace="\", RecursiveReplace=False)
rep_9 = ReplaceText(Text=rep_8, Find="%", Replace="\", RecursiveReplace=False)
rep_10 = ReplaceText(Text=rep_9, Find="$", Replace=":", RecursiveReplace=False)
originaltext = Text(rep_10)
originaltext_2 = ClusterOutput(originaltext)

# ==== cluster ValueOr0
value = ClusterInput()
value_2 = Number(value)
null = NullItem(Item=value_2)  # -> NullFlags, InvalidFlags, Description
filter = StreamFilter(Gate=null.NullFlags, Stream0=value_2, Stream1="0")
valueor0 = Number(filter)
valueor0_2 = ClusterOutput(valueor0)

# ==== cluster SelectMatrixValue
values = ClusterInput()
columnnames = ClusterInput()
rownames = ClusterInput()
columnitem = ClusterInput()
rowitem = ClusterInput()
columnnames_2 = Text(columnnames)
columnitem_2 = Text(columnitem)
rowitem_2 = Text(rowitem)
rownames_2 = Text(rownames)
values_2 = Text(values)
tstat = TreeStatistics(Tree=values_2)  # -> Paths, Length, Count
itemindex = ItemIndex(L=rownames_2, I=rowitem_2)  # -> i; inputs L: list; same code as itemindex
itemindex_2 = ItemIndex(L=columnnames_2, I=columnitem_2)  # -> i; inputs L: list; same code as itemindex
item = ListItem(List=tstat.Paths, Index=itemindex, Wrap=True)
panel = Panel(rownames_2)
branch = TreeBranch(Tree=values_2, Path=item, MaintainPaths=True)
item_2 = ListItem(List=branch, Index=itemindex_2, Wrap=True)
valueor0 = ValueOr0(value=item_2)
panel_2 = Panel(values_2)
value = Text(valueor0)
value_2 = ClusterOutput(value)
