# Grasshopper definition EnergyModel.ghx (Grasshopper 1.0.7)
# plug-ins: Hops, Pancake, MetaHopper

# ----
# SELECT
# 	E.name AS EnergyStandardName,
# 	N.name AS CostGroup,
# 	CASE WHEN N.Category = "Wall" THEN
# 		CASE WHEN N.IsExterior = 1 THEN
# 			CASE WHEN N.LoadBearing = 1 THEN
# 				CASE WHEN N.AboveGround = 1 THEN "Wall_Exterior_Bearing_AboveGround" ELSE "Wall_Exterior_Bearing_BelowGround"	END
# 			ELSE "Wall_Exterior_NonBearing"
# 			END
# 		ELSE
# 			CASE WHEN N.LoadBearing = 1 THEN "Wall_Internal_Bearing" ELSE "Wall_Internal_NonBearing" END
# 		END
# 	ELSE
# 		CASE WHEN N.Category = "Base Plate" THEN "BasePlate"
# 		ELSE
# 			CASE WHEN N.Category = "Roof" THEN
# 				CASE WHEN N.Sloped = 1 THEN "Roof_Sloped" ELSE "Roof_Flat" END
# 			ELSE
# 				CASE WHEN N.Category = "Window" THEN "Window"
# 				ELSE "Undefined"
# 				END
# 			END
# 		END
# 	END AS Category,
# 	U.RequiredU AS RequiredUValue
# FROM KG3x0Name_EnergyStandardNames U
# INNER JOIN KG3x0Names N on N.Id=U.Id1
# INNER JOIN EnergyStandardNames E on E.Id=U.Id2
# ORDER BY EnergyStandardName, Category
panel = Panel("E:\Nextcloud\UserData\Documents\Arbeit\Papers\Multi-objective_Machine-Assistance\Data-Generation\Databases\ExpertDB\ExpertDB.db")  # disabled
panel_2 = Panel("SELECT * FROM ConstructionTypeNames")  # disabled
panel_3 = Panel("Databases\ExpertDB\ExpertDB.db")  # disabled
panel_4 = Panel("\\")  # disabled
panel_5 = Panel("\")  # disabled
panel_6 = Panel("/")  # disabled
rep = ReplaceText(Text=panel_3, Find=panel_5, Replace=panel_6, RecursiveReplace=False)  # disabled
rep_2 = ReplaceText(Text=panel, Find=panel_5, Replace=panel_4, RecursiveReplace=False)  # disabled

number_slider = Slider(3, range=0..10)  # disabled
number_slider_2 = Slider(13, range=0..30)  # disabled
number_slider_3 = Slider(4, range=0..10)  # disabled
number_slider_4 = Slider(5, range=0..10)  # disabled
number_slider_5 = Slider(4, range=0..10)  # disabled
number_slider_6 = Slider(2.5, range=0..10)  # disabled
number_slider_7 = Slider(0, range=0..360)  # disabled
number_slider_8 = Slider(3, range=0..10)  # disabled
fassade = ValueList({"Horizontal-Windows": 0, "Vertical-Windows": 1, "Ribbon-Windows": 2}, selected="Horizontal-Windows")  # disabled
fassade_2 = ValueList({"Horizontal-Windows", "Vertical-Windows", "Ribbon-Windows"}, selected="Horizontal-Windows")  # disabled
panel_7 = Panel("Model.gh")  # disabled
pcghfilepath = DefinitionPath(LastSaveLocalization="neutral,N")  # -> Directory, Name, DirectorySeparator; disabled
concat = Concatenate(FragmentA=pcghfilepath.Directory, FragmentB=pcghfilepath.DirectorySeparator, FragmentC=panel_7)  # disabled
panel_8 = Panel("E:\Nextcloud\Public\FOR2363\TP4\LUH\HVAC-Systems\CurrentBatch\Data_Source\Simulation-Files")  # disabled
panel_9 = Panel("C:\Git\Work\FOR2363\Parametric-H-Shape-Office-Building-Model\src\simulation\Required-U-Values.csv")  # disabled
hops = Hops(
    _Path=concat,
    Orientation=number_slider_7,
    NumberOfFloors=number_slider_5,
    FloorHeight=number_slider_8,
    Fassade=fassade_2,
    RasterLengthX=number_slider_6,
    RasterLengthY=number_slider_6,
    ArmLatitudinalNumberOfSegments=number_slider_4,
    ArmLongitudinalNumberOfSegments=number_slider_3,
    BaseBodyInsideLatditudinalNumberOfSegments=number_slider,
    Courtyard_SegmentCount_RasterLengthY=number_slider_2,
    CacheResultsInMemory=False,
    CacheSolveResults=False,
    RemoteDefinitionLocation="C:\Git\Work\FOR2363\Parametric-H-Shape-Office-Building-Model\src\simulation\Model.gh",
    RemoteSolveVersion=(0, 1, 0),
    ShowInput_Enabled=False,
    ShowInput_Path=True,
    SynchronousSolve=True)  # -> Zones, ZonesName, Windows, WindowsName, Zones_Underground, ZonesUndergroundName, Courtyard_Upper_Volume, Courtyard_Lower_Volume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; disabled
hvac_system_template = ValueList({"IdealAirSystem", "ElectricBaseboard", "BoilerBaseboard", "ASHPBaseboard", "DHWBaseboard", "EvapCoolers_ElectricBaseboard", "EvapCoolers_BoilerBaseboard", "EvapCoolers_ASHPBaseboard", "EvapCoolers_DHWBaseboard", "EvapCoolers_Furnace"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}, selected="ASHPBaseboard")  # disabled
panel_10 = Panel("""ASHRAE 90.1 2019  |  IECC 2021 = "2019"
ASHRAE 90.1 2016  |  IECC 2018 = "2016"
ASHRAE 90.1 2013  |  IECC 2015 = "2013"
ASHRAE 90.1 2010  |  IECC 2012 = "2010"
ASHRAE 90.1 2007  |  IECC 2009 = "2007"
ASHRAE 90.1 2004  |  IECC 2006 = "2004"
1980-2004 (CBECS)              = "1980_2004"
Pre-1980 (CBECS)               = "pre_1980"
""")
bldgvintages = HBBuildingVintages({"ASHRAE 90.1 2019  |  IECC 2021": "2019", "ASHRAE 90.1 2016  |  IECC 2018": "2016", "ASHRAE 90.1 2013  |  IECC 2015": "2013", "ASHRAE 90.1 2010  |  IECC 2012": "2010", "ASHRAE 90.1 2007  |  IECC 2009": "2007", "ASHRAE 90.1 2004  |  IECC 2006": "2004", "1980-2004 (CBECS)": "1980_2004", "Pre-1980 (CBECS)": "pre_1980"}, selected="ASHRAE 90.1 2019  |  IECC 2021")  # disabled
shw = HBSHWTemplates({"Gas Water Heater": "Gas_WaterHeater", "Electric Water Heater": "Electric_WaterHeater", "Heat Pump Water Heater": "HeatPump_WaterHeater", "Gas Tankless Heater": "Gas_TanklessHeater", "Electric Tankless Heater": "Electric_TanklessHeater"}, selected="Gas Water Heater")  # disabled
shading = ValueList({"External-Shading", "Low-SHGC-Value"}, selected="Low-SHGC-Value")  # disabled
list = ValueList({"GEG", "NZEB", "Passive"}, selected="Passive")  # disabled
toggle = BooleanToggle(False)  # disabled
list_2 = ValueList({"Floor", "Ceiling", "FloorWithCarpet", "Ceiling": "CeilingMetalPanel", "FloorWithHardwood"}, selected="Floor")  # disabled
headless = BooleanToggle(False)
panel_11 = Panel("EnergyModel")  # disabled
doas_systems = Text(["DOAS_FCU_Chiller_Boiler", "DOAS_FCU_Chiller_ASHP", "DOAS_FCU_Chiller_DHW", "DOAS_FCU_Chiller_ElectricBaseboard", "DOAS_FCU_Chiller_GasHeaters", "DOAS_FCU_Chiller", "DOAS_FCU_ACChiller_Boiler", "DOAS_FCU_ACChiller_ASHP", "DOAS_FCU_ACChiller_DHW", "DOAS_FCU_ACChiller_ElectricBaseboard", "DOAS_FCU_ACChiller_GasHeaters", "DOAS_FCU_ACChiller", "DOAS_FCU_DCW_Boiler", "DOAS_FCU_DCW_ASHP", "DOAS_FCU_DCW_DHW", "DOAS_FCU_DCW_ElectricBaseboard", "DOAS_FCU_DCW_GasHeaters", "DOAS_FCU_DCW", "DOAS_VRF", "DOAS_WSHP_FluidCooler_Boiler", "DOAS_WSHP_CoolingTower_Boiler", "DOAS_WSHP_GSHP", "DOAS_WSHP_DCW_DHW", "DOAS_Radiant_Chiller_Boiler", "DOAS_Radiant_Chiller_ASHP", "DOAS_Radiant_Chiller_DHW", "DOAS_Radiant_ACChiller_Boiler", "DOAS_Radiant_ACChiller_DHW", "DOAS_Radiant_DCW_Boiler", "DOAS_Radiant_DCW_ASHP", "DOAS_Radiant_DCW_DHW"])
all_air_systems = Text(["VAV_Chiller_Boiler", "VAV_Chiller_ASHP", "VAV_Chiller_DHW", "VAV_Chiller_PFP", "VAV_Chiller_GasCoil", "VAV_ACChiller_Boiler", "VAV_ACChiller_ASHP", "VAV_ACChiller_DHW", "VAV_ACChiller_PFP", "VAV_ACChiller_GasCoil", "VAV_DCW_Boiler", "VAV_DCW_ASHP", "VAV_DCW_DHW", "VAV_DCW_PFP", "VAV_DCW_GasCoil", "PVAV_Boiler", "PVAV_ASHP", "PVAV_DHW", "PVAV_PFP", "PVAV_BoilerElectricReheat", "PSZAC_ElectricBaseboard", "PSZAC_BoilerBaseboard", "PSZAC_DHWBaseboard", "PSZAC_GasHeaters", "PSZAC_ElectricCoil", "PSZAC_GasCoil", "PSZAC_Boiler", "PSZAC_ASHP", "PSZAC_DHW", "PSZAC", "PSZAC_DCW_ElectricBaseboard", "PSZAC_DCW_BoilerBaseboard", "PSZAC_DCW_GasHeaters", "PSZAC_DCW_ElectricCoil", "PSZAC_DCW_GasCoil", "PSZAC_DCW_Boiler", "PSZAC_DCW_ASHP", "PSZAC_DCW_DHW", "PSZAC_DCW", "PSZHP", "PTAC_ElectricBaseboard", "PTAC_BoilerBaseboard", "PTAC_DHWBaseboard", "PTAC_GasHeaters", "PTAC_ElectricCoil", "PTAC_GasCoil", "PTAC_Boiler", "PTAC_ASHP", "PTAC_DHW", "PTAC", "PTHP", "Furnace"])
hc_systems = Text(["ElectricBaseboard", "BoilerBaseboard", "ASHPBaseboard", "DHWBaseboard", "EvapCoolers_ElectricBaseboard", "EvapCoolers_BoilerBaseboard", "EvapCoolers_ASHPBaseboard", "EvapCoolers_DHWBaseboard", "EvapCoolers_Furnace", "EvapCoolers_UnitHeaters", "EvapCoolers", "FCU_Chiller_Boiler", "FCU_Chiller_ASHP", "FCU_Chiller_DHW", "FCU_Chiller_ElectricBaseboard", "FCU_Chiller_GasHeaters", "FCU_Chiller", "FCU_ACChiller_Boiler", "FCU_ACChiller_ASHP", "FCU_ACChiller_DHW", "FCU_ACChiller_ElectricBaseboard", "FCU_ACChiller_GasHeaters", "FCU_ACChiller", "FCU_DCW_Boiler", "FCU_DCW_ASHP", "FCU_DCW_DHW", "FCU_DCW_ElectricBaseboard", "FCU_DCW_GasHeaters", "FCU_DCW", "GasHeaters", "ResidentialAC_ElectricBaseboard", "ResidentialAC_BoilerBaseboard", "ResidentialAC_ASHPBaseboard", "ResidentialAC_DHWBaseboard", "ResidentialAC_ResidentialFurnace", "ResidentialAC", "ResidentialHP", "ResidentialHPNoCool", "ResidentialFurnace", "VRF", "WSHP_FluidCooler_Boiler", "WSHP_CoolingTower_Boiler", "WSHP_GSHP", "WSHP_DCW_DHW", "WindowAC_ElectricBaseboard", "WindowAC_BoilerBaseboard", "WindowAC_ASHPBaseboard", "WindowAC_DHWBaseboard", "WindowAC_Furnace", "WindowAC_GasHeaters", "WindowAC", "Radiant_Chiller_Boiler", "Radiant_Chiller_ASHP", "Radiant_Chiller_DHW", "Radiant_ACChiller_Boiler", "Radiant_ACChiller_DHW", "Radiant_DCW_Boiler", "Radiant_DCW_ASHP", "Radiant_DCW_DHW"])
merge = Merge(Data1=hops.Courtyard_Upper_Roof, Data2=hops.Courtyard_Lower_Roof)  # disabled
panel_12 = Panel("{\"IsSet\": true, \"ModelAbsoluteTolerance\": 0.001, \"ModelAngleToleranceRadians\": 0.0174532925199433, \"ModelRelativeTolerance\": 0.01, \"ModelUnitSystem\": \"Meters\"}")
zones = GetGeometry(hops.Zones, AtLeast=1, AtMost=1, DeleteInput=False, Filter=1074004029, TreeAccess=True)
zones_name = GetString(hops.ZonesName, AtLeast=1, AtMost=1, TreeAccess=True)
windows = GetGeometry(hops.Windows, AtLeast=1, AtMost=1, DeleteInput=False, Filter=1074004029, TreeAccess=True)
windows_name = GetString(hops.WindowsName, AtLeast=1, AtMost=1, TreeAccess=True)
zones_underground = GetGeometry(hops.Zones_Underground, AtLeast=1, AtMost=1, DeleteInput=False, Filter=1074004029, TreeAccess=True)
zones_underground_name = GetString(hops.ZonesUndergroundName, AtLeast=1, AtMost=1, TreeAccess=True)
courtyards_roof = GetGeometry(merge, AtLeast=1, AtMost=1, DeleteInput=False, Filter=1074004029, TreeAccess=True)
has_courtyard_roof = GetBoolean(toggle, AtLeast=1, AtMost=1, FalseValue="False", TreeAccess=False, TrueValue="True")
required_u_values_path = GetString(panel_9, AtLeast=1, AtMost=1, TreeAccess=False)
debug_mode = Boolean(headless)
output_directory = GetString(panel_8, AtLeast=1, AtMost=1, TreeAccess=False)
buildingvintage = GetString(bldgvintages, AtLeast=1, AtMost=1, TreeAccess=True)
hvac_system = GetString(hvac_system_template, AtLeast=1, AtMost=1, TreeAccess=True)
servicehotwater = GetString(shw, AtLeast=1, AtMost=1, TreeAccess=True)
energystandard = GetString(list, AtLeast=1, AtMost=1, TreeAccess=True)
shading_2 = GetString(shading, AtLeast=1, AtMost=1, TreeAccess=True)
modelname = GetString(panel_11, AtLeast=1, AtMost=1, TreeAccess=False)
extractvalues = ExtractValues(valuelist=panel_10)  # -> keys_2, values_2
mrg_a = MergeSeperatlyAppend(x="IdealAirSystem", y=hc_systems, z=all_air_systems, u=doas_systems)  # -> Mrgd; inputs x: tree, y: tree, z: tree, u: tree
# ---------- mrg_a: Python ----------
if ghenv.Component.RunCount<2:
    __author__ = "Ueli Saluz"
    __version__ = "2020.05.28"
    
    ghenv.Component.Name = "MergeSeperatly(Append)"
    ghenv.Component.NickName = "Mrg(A)"
    ghenv.Component.Description = "Merge inputs seperatly on a new path. Append index of input parameter for distincting."
    ghenv.Component.Message = "VER 1.0"

from System import Object
from Grasshopper import DataTree
from Grasshopper.Kernel import GH_ParamAccess as Access

if __name__ == "__main__":
    Mrgd = DataTree[Object]()
    access = Access()
    
    for input in ghenv.Component.Params.Input:  #set all Inputaccess to Tree Access
        input.Access = access.tree
    
    for i,input in enumerate(ghenv.Component.Params.Input):
        for j,source in enumerate(input.Sources):
            for path in source.VolatileData.Paths:
                Mrgd.AddRange(source.VolatileData[path],path.AppendElement(i))
# ---------- end mrg_a ----------
onoff = EnableDisableObject(
    Enabled=debug_mode,
    AllObjects_Object=[panel_9, , panel_3, rep, panel_5, panel_6, panel_2, rep_2, panel_4, panel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])
trim = TrimTree(Tree=mrg_a, Depth=1)
tstat = TreeStatistics(Tree=mrg_a)  # -> Paths, Length, Count
lng = ListLength(List=mrg_a)
correct = Correct_2(computetext=output_directory)
pcsetdocenv = SetDocumentEnvironment(DocEnv=panel_12, LastSaveLocalization="neutral,N")
correct_2 = Correct(computetext=required_u_values_path)
windows_name_2 = Text(windows_name)
windows_2 = Brep(windows)
zones_underground_2 = Brep(zones_underground)
zones_name_2 = Text(zones_name)
energystandard_2 = Text(energystandard)
zones_2 = Brep(zones)
zones_underground_name_2 = Text(zones_underground_name)
shading_3 = Text(shading_2)
mapgen = MapGen(values=extractvalues.values_2)  # -> valuelistindexed_2, valuelist_2, pythondictionary_2
panel_13 = Panel(mapgen.pythondictionary_2)
trim_2 = TrimTree(Tree=lng, Depth=1)
series = Series(Start=0, Step=1, Count=tstat.Count)
servicehotwater_2 = Text(servicehotwater)
buildingvintage_2 = Text(buildingvintage)
hvac_system_2 = Text(hvac_system)
itemindex = ItemIndex(L=trim, I=hvac_system_2)  # -> i; inputs L: list
# ---------- itemindex: Python ----------
#Component Information
#--------------------------------------------------------------------------------------------
if ghenv.Component.RunCount<2:
    #General
    #--------------------------------------------------------------------------------------------
    __author__ = "Ueli Saluz"
    __version__ = "2022.11.18"
    
    ghenv.Component.Name = "ItemIndex"
    ghenv.Component.NickName = "ItemIndex"
    ghenv.Component.Description = "A better IdemIndex"
    ghenv.Component.Message = "VER 1.0"
    ghenv.Component.Category = "Set"
    ghenv.Component.SubCategory = "List"
    
     #Inputs
    #--------------------------------------------------------------------------------------------
    inputIndex=0
    
    ghenv.Component.Params.Input[inputIndex].Name = "List"
    ghenv.Component.Params.Input[inputIndex].NickName = "L"
    ghenv.Component.Params.Input[inputIndex].Description = "Input1 is..."
    ghenv.Component.Params.Input[inputIndex].Optional = False
    inputIndex+=1
    
    ghenv.Component.Params.Input[inputIndex].Name = "Item"
    ghenv.Component.Params.Input[inputIndex].NickName = "I"
    ghenv.Component.Params.Input[inputIndex].Description = "Input2 is..."
    ghenv.Component.Params.Input[inputIndex].Optional = False
    inputIndex+=1
    
    #Outputs
    #--------------------------------------------------------------------------------------------
    outputIndex=0
    
    ghenv.Component.Params.Output[outputIndex].Name = "Index"
    ghenv.Component.Params.Output[outputIndex].NickName = "i"
    ghenv.Component.Params.Output[outputIndex].Description = "Output1 is..."
    outputIndex+=1

i = L.index(I)
# ---------- end itemindex ----------
radianttype = Text(list_2)
ma = MassAddition(Input=trim_2)  # -> Result, PartialResults
panel_14 = Panel("""External-Shading
Low-SHGC-Value""")
output_directory_2 = FilePath(correct)
merge_2 = Merge(Data1="0", Data2=ma.PartialResults)
required_u_values_path_2 = FilePath(correct_2)
windows_3 = Brep(windows_2)
zones_underground_3 = Brep(zones_underground_2)
zones_3 = Brep(zones_2)
zones_underground_name_3 = Text(zones_underground_name_2)
zones_name_3 = Text(zones_name_2)
windows_name_3 = Text(windows_name_2)
panel_15 = Panel(mapgen.valuelistindexed_2)
shift = ShiftList(List=merge_2, Shift="-1", Wrap="False")
shift_2 = ShiftList(List=merge_2, Shift=1, Wrap="False")
shading_options = Text(panel_14)
insulation_conductivity = Number(Slider(0.035, range=0..0.1))
slab_heat_capacity = Number(Slider(900, range=0..1500))
dom = ConstructDomain(DomainStart=shift, DomainEnd=shift_2)
itemindex_2 = ItemIndex(L=shading_options, I=shading_3)  # -> i; inputs L: list; same code as itemindex
inc = Includes(Value=itemindex, Domain=dom)  # -> Includes, Deviation
int = Integer(itemindex_2)
dispatch = Dispatch(List=series, DispatchPattern=inc.Includes)  # -> ListA, ListB

required_u_values = FilePath(required_u_values_path_2)
energystandard_3 = Text(energystandard_2)
read_u_values = Read_UValues(path=required_u_values, energystandard_selected=energystandard_3)  # -> cost_groups_3, categories_3, required_u_values_3
number_slider_9 = Slider(6, range=0..10)
required_u_values_2 = Number(read_u_values.required_u_values_3)
categories = Text(read_u_values.categories_3)
cost_groups = Text(read_u_values.cost_groups_3)
panel_16 = Panel("""0
1
3
4""")
item = ListItem(List=categories, Index=panel_16, Wrap=True)
item_2 = ListItem(List=required_u_values_2, Index=panel_16, Wrap=True)
item_3 = ListItem(List=categories, Index=number_slider_9, Wrap=True)
item_4 = ListItem(List=required_u_values_2, Index=number_slider_9, Wrap=True)

panel_17 = Panel(mapgen.valuelist_2)
panel_18 = Panel("""private void GenerateConstructionMunich()
        {
            double uWall = Parameters.Construction.UWall,
                uGFloor = Parameters.Construction.UGFloor,
                uIFloor = Parameters.Construction.UIFloor,
                uRoof = Parameters.Construction.URoof,
                uIWall = Parameters.Construction.UIWall,
                uWindow = Parameters.Construction.UWindow,
                gWindow = Parameters.Construction.GWindow,
                hcSlab = Parameters.Construction.HCSlab;

            var lambda_insulation = 0.035;

            //wall plaster layer
            var wall_plasterlayer = new Material("wall_plasterlayer", "Smooth", 0.02, 0.7, 1400, 1000, 0.9, 0.4, 0.7);

            //wall0 layers
            var wall_structure = new Material("wall_structure", "Smooth", 0.18, 2.3, 2300, 1100, 0.9, 0.7, 0.7);
            var wall_insulation = new Material("wall_insulation", "Smooth", 0.18, lambda_insulation, 25, 1000, 0.9, 0.7, 0.7);

            //wall1 layers
            var wall1_structure = new Material("wall1_structure", "Smooth", 0.3, 0.09, 650, 1100, 0.9, 0.7, 0.7);
            var wall1_insulation = new Material("wall1_insulation", "Smooth", 0.06, lambda_insulation, 25, 1000, 0.9, 0.7, 0.7);

            //wall2 layers
            var wall2_structure = new Material("wall2_structure", "Smooth", 0.175, 1.4, 2000, 1100, 0.9, 0.7, 0.7);
            var wall2_insulation = new Material("wall2_insulation", "Smooth", 0.18, lambda_insulation, 25, 1000, 0.9, 0.7, 0.7);

            //internal wall layers
            var plasterboard = new Material("plasterboard", "Rough", 0.05, 0.16, 800, 800, 0.9, 0.6, 0.6);
            var iwall_insulation = new Material("iwall_insulation", "Rough", 0.025, lambda_insulation, 20, 1000, 0.9, 0.7, 0.7);

            //gFloor & iFloor layers
            var pInsulation = new Material("pInsulation", "Smooth", 0.05, lambda_insulation, 20, 1000, 0.9, 0.7, 0.7);
            var floor_structure = new Material("floor_structure", "Smooth", 0.2, 2.3, 2300, hcSlab, 0.9, 0.7, 0.7);
            var gfloor_insulation = new Material("gfloor_insulation", "Smooth", 0.053, lambda_insulation, 20, 1000, 0.9,  0.7, 0.7);
            var floor_cementscreed = new Material("floor_cementscreed", "Smooth", 0.08, 1.4, 2000, 1000, 0.9, 0.7, 0.7);

            var ifloor_insulation = new Material("ifloor_insulation", "Smooth", 0.025, lambda_insulation, 20, 1000, 0.9,  0.7, 0.7);

            //Roof layers
            var roof_insulation = new Material("roof_insulation", "Smooth", 0.23, lambda_insulation, 20, 1000, 0.9, 0.7,  0.7);
            var roof_structure = new Material("roof_structure", "Smooth", 0.25, 2.3, 2300, hcSlab, 0.9, 0.7, 0.7);
            var roof_plaster = new Material("roof_plaster", "Smooth", 0.02, 0.7, 1400, 1000, 0.9, 0.7, 0.7);

            var layerListRoof = new List<Material> {pInsulation, roof_insulation, roof_structure, roof_plaster};
            Parameters.Construction.hcRoof = layerListRoof.Select(l => l.thickness * l.sHC * l.density).Sum();
            var construction_Roof = new Construction.Construction("Roof", layerListRoof);

            var layerListWall = new List<Material> {wall_plasterlayer, wall_insulation, wall_structure, wall_plasterlayer};
            var construction_Wall = new Construction.Construction("ExternalWall", layerListWall);
            Parameters.Construction.hcWall = layerListWall.Select(l => l.thickness * l.sHC * l.density).Sum();

            var layerListInternallWall = new List<Material> {plasterboard, iwall_insulation, plasterboard};
            var construction_internalWall = new Construction.Construction("InternalWall", layerListInternallWall);
            Parameters.Construction.hcIWall = layerListInternallWall.Select(l => l.thickness * l.sHC * l.density).Sum();

            var layerListGfloor = new List<Material> {pInsulation, floor_structure, gfloor_insulation, floor_cementscreed};
            var construction_gFloor = new Construction.Construction("GroundFloor", layerListGfloor);
            Parameters.Construction.hcGFloor = layerListGfloor.Select(l => l.thickness * l.sHC * l.density).Sum();

            var layerListIFloor = new List<Material> {floor_structure, ifloor_insulation, floor_cementscreed};
            var construction_ifloor = new Construction.Construction("Floor_Ceiling", layerListIFloor);
            Parameters.Construction.hcIFloor = layerListIFloor.Select(l => l.thickness * l.sHC * l.density).Sum();

            var InternalMaterial = new Material("InternalMaterial", "Smooth", 0.12, 2.3, 500, 1000, 0.85, 0.85, 0.7);
            var InternalMass = new Construction.Construction("InternalMass", new List<Material> {InternalMaterial});
            Parameters.Construction.hcInternalMass = new List<Material> {InternalMaterial} .Select(l => l.thickness * l.sHC * l.density).Sum();

            construction_Roof.AdjustInsulation(uRoof, roof_insulation);
            construction_Wall.AdjustInsulation(uWall, wall_insulation);
            construction_gFloor.AdjustInsulation(uGFloor, gfloor_insulation);
            construction_ifloor.AdjustInsulation(uIFloor, ifloor_insulation);
            construction_internalWall.AdjustInsulation(uIWall, iwall_insulation);

            constructions = new List<Construction.Construction> {InternalMass, construction_Roof, construction_Wall, construction_gFloor, construction_ifloor, construction_internalWall};
            materials = constructions.SelectMany(c => c.layers).Select(l => l.Name).Distinct() .Select(n => constructions.SelectMany(c => c.layers).First(l => l.Name == n)).ToList();

            //window construction
            var windowLayer = new WindowMaterial("Glazing Material", uWindow, gWindow, 0.1);
            windowMaterials = new List<WindowMaterial> {windowLayer};
            var window = new Construction.Construction("Glazing", new List<WindowMaterial> {windowLayer});
            constructions.Add(window);

            //window shades
            windowMaterialShades = new List<WindowMaterialShade> {new WindowMaterialShade()};
        }""")
hvac_system_type = Integer(dispatch.ListA)
filter = StreamFilter(Gate=hvac_system_type, Stream1=hvac_system_2)
filter_2 = StreamFilter(Gate=hvac_system_type, Stream3=hvac_system_2)
filter_3 = StreamFilter(Gate=hvac_system_type, Stream2=hvac_system_2)

# ---- group: Only for Air-Systems
latent_heatrecovery = Number(Slider(0, range=0..0.8))
sensible_heatrecovery = Number(Slider(0, range=0..0.8))

# ----
doas_system = Text(filter_2)
hc_system = Text(filter)
all_air_system = Text(filter_3)
panel_19 = Panel("""        private void GenerateConstructionTausendpfund()
        {
            double uWall = Parameters.Construction.UWall,
                uGFloor = Parameters.Construction.UGFloor,
                uIFloor = Parameters.Construction.UIFloor,
                uRoof = Parameters.Construction.URoof,
                uIWall = Parameters.Construction.UIWall,
                uWindow = Parameters.Construction.UWindow,
                gWindow = Parameters.Construction.GWindow,
                hcSlab = Parameters.Construction.HCSlab;

            var lambda_insulation = 0.035;

            //wall plaster layer
            var wall_plasterlayer = new Material("wall_plasterlayer", "Smooth", 0.02, 0.7, 1400, 900, 0.9, 0.4, 0.7);

            //wall0 layers
            var wall_structure = new Material("wall_structure", "Smooth", 0.18, 2.3, 2300, 1100, 0.9, 0.7, 0.7);
            var wall_insulation = new Material("wall_insulation", "Smooth", 0.18, lambda_insulation, 25, 1000, 0.9, 0.7,   0.7);

            //wall1 layers
            var wall1_structure = new Material("wall1_structure", "Smooth", 0.3, 0.09, 650, 1100, 0.9, 0.7, 0.7);
            var wall1_insulation = new Material("wall1_insulation", "Smooth", 0.06, lambda_insulation, 25, 1000, 0.9, 0.7, 0.7);

            //wall2 layers
            var wall2_structure = new Material("wall2_structure", "Smooth", 0.175, 1.4, 2000, 1100, 0.9, 0.7, 0.7);
            var wall2_insulation = new Material("wall2_insulation", "Smooth", 0.18, lambda_insulation, 25, 1000, 0.9, 0.7, 0.7);

            //internal wall layers
            var plasterboard = new Material("plasterboard", "Rough", 0.05, 0.16, 800, 800, 0.9, 0.6, 0.6);
            var iwall_insulation = new Material("iwall_insulation", "Rough", 0.025, lambda_insulation, 20, 1000, 0.9, 0.7, 0.7);

            //gFloor & iFloor layers
            var pInsulation = new Material("pInsulation", "Smooth", 0.12, lambda_insulation, 20, 1000, 0.9, 0.7, 0.7);
            var floor_structure = new Material("floor_structure", "Smooth", 0.2, 2.3, 2300, hcSlab, 0.9, 0.7, 0.7);
            var gfloor_insulation = new Material("gfloor_insulation", "Smooth", 0.053, lambda_insulation, 20, 1000, 0.9, 0.7, 0.7);
            var floor_cementscreed = new Material("floor_cementscreed", "Smooth", 0.08, 1.4, 2000, 2500, 0.9, 0.7, 0.7);

            var ifloor_insulation = new Material("ifloor_insulation", "Smooth", 0.025, lambda_insulation, 20, 1000, 0.9, 0.7, 0.7);

            //Roof layers
            var roof_insulation = new Material("roof_insulation", "Smooth", 0.23, lambda_insulation, 20, 1000, 0.9, 0.7,0.7);
            var roof_structure = new Material("roof_structure", "Smooth", 0.25, 2.3, 2300, hcSlab, 0.9, 0.7, 0.7);
            var roof_plaster = new Material("roof_plaster", "Smooth", 0.02, 0.7, 1400, 2500, 0.9, 0.7, 0.7);

            var layerListRoof = new List<Material> {pInsulation, roof_insulation, roof_structure, roof_plaster};
            Parameters.Construction.hcRoof = layerListRoof.Select(l => l.thickness * l.sHC * l.density).Sum();
            var construction_Roof = new Construction.Construction("Up Roof Concrete", layerListRoof);

            var layerListWall = new List<Material> {wall_plasterlayer, wall_insulation, wall_structure, wall_plasterlayer};
            var construction_Wall = new Construction.Construction("Wall ConcreteBlock", layerListWall);
            Parameters.Construction.hcWall = layerListWall.Select(l => l.thickness * l.sHC * l.density).Sum();

            var layerListWall1 = new List<Material> {wall_plasterlayer, wall1_insulation, wall1_structure, wall_plasterlayer};
            var construction_Wall1 = new Construction.Construction("Wall ConcreteBlock1", layerListWall);
            Parameters.Construction.hcWall = layerListWall.Select(l => l.thickness * l.sHC * l.density).Sum();

            var layerListWall2 = new List<Material>  {wall_plasterlayer, wall2_insulation, wall1_structure, wall_plasterlayer};
            var construction_Wall2 = new Construction.Construction("Wall ConcreteBlock2", layerListWall);
            Parameters.Construction.hcWall = layerListWall.Select(l => l.thickness * l.sHC * l.density).Sum();

            var layerListInternallWall = new List<Material> {plasterboard, iwall_insulation, plasterboard};
            var construction_internalWall = new Construction.Construction("InternalWall", layerListInternallWall);
            Parameters.Construction.hcIWall = layerListInternallWall.Select(l => l.thickness * l.sHC * l.density).Sum();

            var layerListGfloor = new List<Material>  {pInsulation, floor_structure, gfloor_insulation, floor_cementscreed};
            var construction_gFloor = new Construction.Construction("Slab_Floor", layerListGfloor);
            Parameters.Construction.hcGFloor = layerListGfloor.Select(l => l.thickness * l.sHC * l.density).Sum();

            var layerListIFloor = new List<Material> {floor_structure, ifloor_insulation, floor_cementscreed};
            var construction_ifloor = new Construction.Construction("General_Floor_Ceiling", layerListIFloor);
            Parameters.Construction.hcIFloor = layerListIFloor.Select(l => l.thickness * l.sHC * l.density).Sum();

            var InternalMaterial = new Material("InternalMaterial", "Smooth", 0.12, 2.3, 500, 1000, 0.85, 0.85, 0.7);
            var InternalMass = new Construction.Construction("InternalMass", new List<Material> {InternalMaterial});
            Parameters.Construction.hcInternalMass = new List<Material> {InternalMaterial}.Select(l => l.thickness * l.sHC * l.density).Sum();

            construction_Roof.AdjustInsulation(uRoof, roof_insulation);
            construction_Wall.AdjustInsulation(uWall, wall_insulation);
            construction_gFloor.AdjustInsulation(uGFloor, gfloor_insulation);
            construction_ifloor.AdjustInsulation(uIFloor, ifloor_insulation);
            construction_internalWall.AdjustInsulation(uIWall, iwall_insulation);

            constructions = new List<Construction.Construction> {InternalMass, construction_Roof, construction_Wall, construction_Wall1, construction_Wall2,construction_gFloor, construction_ifloor, construction_internalWall};
            materials = constructions.SelectMany(c => c.layers).Select(l => l.Name).Distinct().Select(n => constructions.SelectMany(c => c.layers).First(l => l.Name == n)).ToList();

            //window construction
            var windowLayer = new WindowMaterial("Glazing Material", uWindow, gWindow, 0.1);
            windowMaterials = new List<WindowMaterial> {windowLayer};
            var window = new Construction.Construction("Glazing", new List<WindowMaterial> {windowLayer});
            constructions.Add(window);

            //window shades
            windowMaterialShades = new List<WindowMaterialShade> {new WindowMaterialShade()};
        }""")

panel_20 = Panel("office")
searchprog = HBSearchPrograms(bldg_prog="MediumOffice", vintage="2019")  # -> room_prog; plug-in component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
item_5 = ListItem(List=searchprog, Index=Slider(10, range=0..20), Wrap=True)
item_6 = ListItem(List=searchprog, Index=Slider(11, range=0..20), Wrap=True)
item_7 = ListItem(List=searchprog, Index=Slider(6, range=0..20), Wrap=True)
mrg_a_2 = MergeSeperatlyAppend(x=item_5, y=item_6, z=item_6, u=item_7, v=item_6)  # -> Mrgd; inputs x: tree, y: tree, z: tree, u: tree, v: tree; same code as mrg_a
trim_3 = TrimTree(Tree=zones_underground_name_3, Depth=1)
match = MatchTree(Tree=mrg_a_2, Guide=trim_3)
trim_4 = TrimTree(Tree=zones_underground_name_3, Depth=1)
expression = Expression(x=match, y=trim_3, Expression="x")
trim_5 = TrimTree(Tree=zones_underground_2, Depth=1)
programs_name_underground = Text(expression)
zones_name_underground = Text(trim_3)
zones_underground_4 = Brep(trim_5)

searchprog_2 = HBSearchPrograms(bldg_prog="MediumOffice", vintage="2019")  # -> room_prog; plug-in component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
item_8 = ListItem(List=searchprog_2, Index=Slider(8, range=0..20), Wrap=True)
item_9 = ListItem(List=searchprog_2, Index=Slider(3, range=0..20), Wrap=True)
item_10 = ListItem(List=searchprog_2, Index=Slider(10, range=0..20), Wrap=True)
mrg_a_3 = MergeSeperatlyAppend(x=item_10, y=item_8, z=item_8, u=item_8, v=item_8, w=item_9, s=item_8, t=item_9, xx=item_8)  # -> Mrgd; inputs x: tree, y: tree, z: tree, u: tree, v: tree, w: tree, s: tree, t: tree, xx: tree; same code as mrg_a
trim_6 = TrimTree(Tree=zones_name_3, Depth=1)
match_2 = MatchTree(Tree=mrg_a_3, Guide=trim_6)
expression_2 = Expression(x=match_2, y=trim_6, Expression="x")
trim_7 = TrimTree(Tree=zones_3, Depth=1)
programs_name = Text(expression_2)
zones_name_4 = Text(trim_6)
zones_4 = Brep(trim_7)

panel_22 = Panel(""" public void GenerateConstructionBelgium()
        {
            double uWall = Parameters.Construction.UWall,
                uCWall = Parameters.Construction.UCWall,
                uGFloor = Parameters.Construction.UGFloor,
                uIFloor = Parameters.Construction.UIFloor,
                uRoof = Parameters.Construction.URoof,
                uIWall = Parameters.Construction.UIWall,
                uWindow = Parameters.Construction.UWindow,
                gWindow = Parameters.Construction.GWindow,
                hcSlab = Parameters.Construction.HCSlab;
            //InternalMass
            var InternalMaterial = new Material("InternalMaterial", "Smooth", 0.12, 2.3, 2300, 1000, 0.85, 0.85, 0.7);
            var InternalMass = new Construction.Construction("InternalMass", new List<Material> {InternalMaterial});
            Parameters.Construction.hcInternalMass = new List<Material> {InternalMaterial}.Select(l => l.thickness * l.sHC * l.density).Sum();
            //Roof
            var Bitumen = new Material("Bitumen", "Smooth", 0.01, 0.230, 1100, 1000, 0.9, 0.9, 0.7);
            var PUR_Roof = new Material("PUR_Roof", "Smooth", 0.06, 0.026, 35, 1400, 0.85, 0.85, 0.7);
            var Screed = new Material("Screed", "Smooth", 0.06, 1.3, 1600, 1000, 0.85, 0.85, 0.7);
            var RConcrete1 = new Material("RConcrete1", "Smooth", 0.12, 2.3, 2300, 1000, 0.85, 0.85, 0.7);
            var Gypsum1 = new Material("Gypsum1", "Smooth", 0.01, 0.4, 800, 1000, 0.85, 0.4, 0.7);
            var Roof = new Construction.Construction("Roof", new List<Material>{Bitumen, PUR_Roof, Screed, RConcrete1, Gypsum1});

            //Exterior Wall
            var Brick = new Material("Brick", "Smooth", 0.1, 0.75, 1400, 840, 0.88, 0.55, 0.7);
            var Cavity = new Material("Cavity", "Smooth", 0.03, 0.0258, 1.2, 1006, 0.9, 0.9, 0.7);
            var MWool_ExWall = new Material("MWool_ExWall", "Smooth", 0.05, 0.05, 100, 1030, 0.9, 0.7, 0.7);
            var Brickwork1 = new Material("Brickwork1", "Smooth", 0.14, 0.32, 840, 1300, 0.88, 0.55, 0.7);
            var Gypsum2 = new Material("Gypsum2", "Smooth", 0.02, 0.4, 800, 1000, 0.85, 0.4, 0.7);
            var ExWall = new Construction.Construction("ExternalWall", new List<Material> {Brick, Cavity, MWool_ExWall, Brickwork1, Gypsum2});

            //InWall
            var MWool_InWall = new Material("MWool_InWall", "Smooth", 0.05, 0.05, 100, 1030, 0.9, 0.7, 0.7);
            var Brickwork2 = new Material("Brickwork2", "Smooth", 0.14, 0.27, 850, 840, 0.85, 0.55, 0.7);
            var InWall = new Construction.Construction("InternalWall", new List<Material> {Gypsum1, MWool_InWall, Brickwork2, Gypsum1});

            //GFloor
            var FloorTiles = new Material("FloorTiles", "Smooth", 0.04, 0.44, 1500, 733, 0.85, 0.55, 0.6);
            var PUR_GFloor = new Material("PUR_GFloor", "Smooth", 0.06, 0.026, 35, 1400, 0.85, 0.85, 0.7);
            var RConcrete2 = new Material("RConcrete2", "Smooth", 0.15, 2.3, 2300, 1000, 0.85, 0.85, 0.7);
            var GFloor = new Construction.Construction("GroundFloor", new List<Material> {FloorTiles, Screed, PUR_GFloor, RConcrete2});


            //Ceiling
            var PUR_Ceiling = new Material("PUR_Ceiling", "Smooth", 0.06, 0.026, 35, 1400, 0.85, 0.85, 0.7);
            var Ceiling = new Construction.Construction("Floor_Ceiling", new List<Material>{FloorTiles, Screed, PUR_Ceiling, RConcrete1, Gypsum1});

            //CommonWall
            var EPS_CommonWall = new Material("EPS", "Smooth", 0.02, 0.035, 20, 1450, 0.85, 0.85, 0.7);
            var CommonWall = new Construction.Construction("CommonWall", new List<Material> { Gypsum2, Brickwork2, EPS_CommonWall, Brickwork2, Gypsum2});

            Roof.AdjustInsulation(uRoof, PUR_Roof);
            ExWall.AdjustInsulation(uWall, MWool_ExWall);
            InWall.AdjustInsulation(uIWall, MWool_InWall);
            GFloor.AdjustInsulation(uGFloor, PUR_GFloor);
            Ceiling.AdjustInsulation(uIFloor, PUR_Ceiling);
            CommonWall.AdjustInsulation(uCWall, EPS_CommonWall);


            constructions.AddRange(new List<Construction.Construction>{InternalMass, Roof, ExWall, InWall, GFloor, Ceiling, CommonWall});
            materials.AddRange(constructions.SelectMany(c => c.layers).Select(l => l.Name).Distinct().Select(n => constructions.SelectMany(c => c.layers).First(l => l.Name == n)));
            //window construction
            var windowLayer = new WindowMaterial("Glazing Material", uWindow, gWindow, 0.1);
            windowMaterials = new List<WindowMaterial> {windowLayer};
            var window = new Construction.Construction("Glazing", new List<WindowMaterial> {windowLayer});
            constructions.Add(window);

            //window shades
            windowMaterialShades = new List<WindowMaterialShade> {new WindowMaterialShade()};
        }""")
deconstrprogram = HBDeconstructProgramType(program=searchprog)  # -> people, lighting, electric_equip, gas_equip, hot_water, infiltration, ventilation, setpoint; plug-in component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
panel_23 = Panel(deconstrprogram.setpoint)

shade = HBShade(geo=courtyards_roof, name="ShadingRoof")  # -> report, shades; plug-in component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
filter_4 = StreamFilter(Gate=has_courtyard_roof, Stream1=shade.shades)

insulation_conductivity_2 = Number(insulation_conductivity)
manavc__construction = Text(panel_18)
slab_heat_capacity_2 = Number(slab_heat_capacity)
manav_hb_mat = ManavHB_Mat(
    manavc__construction=manavc__construction,
    slab_heat_capacity=slab_heat_capacity_2,
    insulation_conductivity=insulation_conductivity_2)  # -> hb_materials_non_insulation_3, hb_materials_name_non_insulation_2, hb_materials_insulation_3, materialnames_insulation_3, hb_opaque_construction_3, hb_opaque_construction_name_2, layers_materials_3, layers_materialnames_4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
hb_opaque_construction_name = Text(manav_hb_mat.hb_opaque_construction_name_2)
hb_opaque_construction = Data(manav_hb_mat.hb_opaque_construction_3)
list_3 = ValueList({"Wall": 0, "Wall 1": 1, "Wall 2": 2}, selected="Wall")
filter_5 = StreamFilter(Gate=list_3)
tstat_2 = TreeStatistics(Tree=hb_opaque_construction_name)  # -> Paths, Length, Count
item_11 = ListItem(List=tstat_2.Paths, Index=0, Wrap=True)  # -> Item, Item1, Item2, Item3, Item4, Item5, Item6, Item7
merge_3 = Merge(Data1=item_11.Item3, Data2=item_11.Item, Data3=item_11.Item1, Data4=item_11.Item1)
required_u_values_3 = Number(item_2)
categories_2 = Text(item)
branch = TreeBranch(Tree=hb_opaque_construction, Path=merge_3, MaintainPaths=False)
branch_2 = TreeBranch(Tree=manav_hb_mat.insulation_layer_index_3, Path=merge_3, MaintainPaths=False)
dsptchpths = DispatchBranchesWithPaths(Data=hb_opaque_construction, Paths=merge_3)  # -> SelectedData, OtherData, SelectedPaths, AdditionalGen; inputs Data: tree, Paths: list, Ancestor: Boolean; same code as dsptchpths
match_3 = MatchTree(Tree=graft(required_u_values_3), Guide=branch)
match_4 = MatchTree(Tree=graft(categories_2), Guide=branch)
adjust_u_value = Adjust_UValue(
    hb_opaque_construction=branch,
    hb_opaque_construction_name_new=match_4,
    opaque_construction_u_value=match_3,
    insulation_layer_index=branch_2,
    target_u_value_include_airfilms=Toggle(True))  # -> hb_opaque_construction_adjusted_2, insulation_thickness_old_2, insulation_thickness_new_3
item_12 = ListItem(List=flatten(adjust_u_value.hb_opaque_construction_adjusted_2), Index=0, Wrap=True)  # -> Item, Item1, Item2, Item3, Item4
item_13 = ListItem(List=flatten(dsptchpths.OtherData), Index=0, Wrap=True)  # -> Item, Item1, Item2, Item3, Item4
interiorsubset = HBInteriorConstructionSubset(interior_wall=item_13.Item, interior_floor=item_13.Item1)  # -> interior_set; plug-in component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
exteriorsubset = HBExteriorConstructionSubset(exterior_wall=item_12.Item2, exterior_roof=item_12.Item1)  # -> exterior_set; plug-in component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
groundsubset = HBGroundConstructionSubset(ground_wall=item_12.Item3, ground_floor=item_12.Item)  # -> ground_set; plug-in component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

windows_name_4 = Text(windows_name_3)
windows_4 = Brep(windows_3)
window_u_value = Number(item_4)
windows_operable = Boolean(Toggle(True))

number_slider_10 = Slider(0.65, range=0..1)
number_slider_11 = Slider(0.3, range=0..1)
shademat = HBShadeMaterial(thickness=Slider(0.07, range=0..0.1))  # -> mat; plug-in component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
shading_4 = ValueList({"External-Shading": 0, "Low-SHGC-Value": 1}, selected="Low-SHGC-Value")
shading_5 = Text(int)

filter_6 = StreamFilter(Gate=shading_5, Stream0=Slider(0.5, range=0..1), Stream1=Slider(0.25, range=0..1))
window_solarheatgaincoefficient = Number(filter_6)
windowmat = HBWindowMaterial(name="Theoretical-WindowMaterial_EnergyStandardCompliant", u_factor=window_u_value, shgc=window_solarheatgaincoefficient)  # -> mat; plug-in component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
windowconstr = HBWindowConstruction(name="Theoretical-Window_EnergyStandardCompliant", materials=windowmat)  # -> constr; plug-in component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

windowconstrshd = HBWindowConstructionShade(
    name="Shaded-Window",
    win_constr=windowconstr,
    shd_material=shademat,
    shd_location="Exterior",
    control_type=Slider(4, range=0..10),
    setpoint=Slider(25, range=0..100))  # -> constr; plug-in component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
filter_7 = StreamFilter(Gate=shading_5, Stream0=windowconstrshd, Stream1=windowconstr)

aperture = HBAperture(geo=windows_4, name=windows_name_4, operable=windows_operable, ep_constr=filter_7)  # -> report, apertures; plug-in component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
hb_windows = Data(aperture.apertures)

subfacesubset = HBSubfaceSubset(window=filter_7)  # -> subface_set; plug-in component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
constructionset = HBConstructionSet(
    name="Typical-Building-Munich",
    exterior_subset=exteriorsubset,
    ground_subset=groundsubset,
    interior_subset=interiorsubset,
    subface_subset=subfacesubset)  # -> flatten(constr_set); plug-in component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
hb_constructionset = Data(constructionset)

toggle_2 = BooleanToggle(True)
roomsolid = HBRoomFromSolid(geo=zones_4, name=zones_name_4, constr_set=hb_constructionset, program=programs_name, conditioned=toggle_2)  # -> report, rooms; plug-in component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

roomsolid_2 = HBRoomFromSolid(
    geo=zones_underground_4,
    name=zones_name_underground,
    constr_set=hb_constructionset,
    program=programs_name_underground,
    conditioned=toggle_2)  # -> report, rooms; plug-in component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

trim_8 = TrimTree(Tree=roomsolid.rooms, Depth=1)
addsubface = HBAddSubface(hb_obj=flatten(trim_8), sub_faces=flatten(hb_windows))  # -> hb_obj; plug-in component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

merge_4 = Merge(Data1=flatten(addsubface), Data2=flatten(roomsolid_2.rooms))

solveadj = HBSolveAdjacency(rooms=flatten(merge_4), run=Toggle(True))  # -> report, adj_rooms; plug-in component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

all_air_system_2 = Text(all_air_system)
doas_system_2 = Text(doas_system)
hc_system_2 = Text(hc_system)
doashvac = HBDOASHVAC(
    rooms=flatten(solveadj.adj_rooms),
    system_type=doas_system_2,
    vintage=buildingvintage_2,
    sensible_hr=sensible_heatrecovery,
    latent_hr=latent_heatrecovery)  # -> report, rooms; plug-in component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
allairhvac = HBAllAirHVAC(
    rooms=flatten(solveadj.adj_rooms),
    system_type=all_air_system_2,
    vintage=buildingvintage_2,
    sensible_hr=sensible_heatrecovery,
    latent_hr=latent_heatrecovery)  # -> report, rooms; plug-in component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
idealair = HBIdealAir(rooms=flatten(solveadj.adj_rooms), sensible_hr=sensible_heatrecovery, latent_hr=latent_heatrecovery)  # -> report, rooms; plug-in component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
heatcoolhvac = HBHeatCoolHVAC(rooms=flatten(solveadj.adj_rooms), system_type=hc_system_2, vintage=buildingvintage_2)  # -> report, rooms; plug-in component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
hvac_system_type_2 = Integer(hvac_system_type)
filter_8 = StreamFilter(
    Gate=hvac_system_type_2,
    Stream0=idealair.rooms,
    Stream1=heatcoolhvac.rooms,
    Stream2=allairhvac.rooms,
    Stream3=doashvac.rooms)

shw_2 = HBSHWSystem(rooms=flatten(filter_8), system_type=servicehotwater_2)  # -> report, rooms; plug-in component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
model = HBModel(rooms=flatten(shw_2.rooms), shades=flatten(filter_4), name=modelname)  # -> report, model; plug-in component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
model_2 = HBModel(rooms=flatten(solveadj.adj_rooms), shades=flatten(filter_4), name=modelname)  # -> report, model; plug-in component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
hb_model = Data(model.model)
vizbytype = HBVisualizeByType(hb_objs=hb_model)  # -> walls, interior_walls, roofs, ceilings, exterior_floors, interior_floors, air_walls, apertures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; plug-in component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
dumpobjects = HBDumpObjects(hb_objs=flatten(hb_model), name=modelname, folder=output_directory_2, dump=Toggle(True))  # -> report, hb_file; plug-in component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
rep_3 = ReplaceText(Text=dumpobjects.hb_file, Find="\", Replace="%", RecursiveReplace=False)
rep_4 = ReplaceText(Text=rep_3, Find=":", Replace="$", RecursiveReplace=False)
cp = ContextPrint(EncryptedHoneybeeFilePath=rep_4)

# ==== cluster Read_UValues
energystandard_selected = ClusterInput()
path = ClusterInput()
refresh = ClusterInput()
energystandard_selected_2 = Text(energystandard_selected)
path_2 = Text(path)
refresh_2 = Data(refresh)
expression = Expression(x=path_2, y=refresh_2, Expression="x")
file = ReadFile(File=expression, PerLineParse=True)
csv = ReadCSV(CSVString=file, Delimiter=",")  # -> Headers, Values
tstat = TreeStatistics(Tree=csv.Values)  # -> Paths, Length, Count
item = ListItem(List=tstat.Paths, Index=0, Wrap=True)  # -> Item, Item1, Item2, Item3
branch = TreeBranch(Tree=csv.Values, Path=item.Item, MaintainPaths=True)
branch_2 = TreeBranch(Tree=csv.Values, Path=item.Item1, MaintainPaths=True)
branch_3 = TreeBranch(Tree=csv.Values, Path=item.Item2, MaintainPaths=True)
branch_4 = TreeBranch(Tree=csv.Values, Path=item.Item3, MaintainPaths=True)
cost_groups = Text(branch_2)
energystandards = Text(branch)
required_u_values = Number(branch_4)
categories = Text(branch_3)
tmatch = MatchText(Text=energystandards, Pattern=graft(energystandard_selected_2), Case=True)
listdexs = ListIndices(List=energystandards)
cull = CullPattern(List=listdexs, CullPattern=tmatch)  # -> flatten(List)
item_2 = ListItem(List=required_u_values, Index=cull, Wrap=True)
item_3 = ListItem(List=cost_groups, Index=cull, Wrap=True)
item_4 = ListItem(List=categories, Index=cull, Wrap=True)
cost_groups_2 = Text(item_3)
categories_2 = Text(item_4)
required_u_values_2 = Number(item_2)
cost_groups_3 = ClusterOutput(cost_groups_2)
categories_3 = ClusterOutput(categories_2)
required_u_values_3 = ClusterOutput(required_u_values_2)

# ==== cluster ManavHB_Mat
manavc__construction = ClusterInput()
slab_heat_capacity = ClusterInput()
insulation_conductivity = ClusterInput()

manavc__construction_2 = Text(manavc__construction)
insulation_conductivity_2 = Number(insulation_conductivity)
slab_heat_capacity_2 = Number(slab_heat_capacity)
regex = MatchRegularExpression(T=manavc__construction_2, rp="var.*new Material(.*);", ic=Toggle(True))  # -> M, msi, mg, mgsi
regex_2 = MatchRegularExpression(T=regex.M, rp="\".*\\d", ic=Toggle(True))  # -> M, msi, mg, mgsi
split = TextSplit(Text=regex_2.M, Separators=",")
rep = ReplaceText(Text=split, Find="\"", RecursiveReplace=False)
rep_2 = ReplaceText(Text=rep, Find=" ", RecursiveReplace=False)
item = ListItem(List=rep_2, Index=0, Wrap=True)  # -> flatten(Item)
rep_3 = ReplaceText(Text=rep_2, Find="hcSlab", Replace=slab_heat_capacity_2, RecursiveReplace=False)
rep_4 = ReplaceText(Text=rep_3, Find="lambda_insulation", Replace=insulation_conductivity_2, RecursiveReplace=False)
item_2 = ListItem(List=rep_4, Index=0, Wrap=True)  # -> Item, Item1, Item2, Item3, Item4, Item5, Item6, Item7, Item8
opaquemat = HBOpaqueMaterial(
    name=item_2.Item,
    thickness=item_2.Item2,
    conductivity=item_2.Item3,
    density=item_2.Item4,
    spec_heat=item_2.Item5,
    roughness=item_2.Item1,
    therm_absp=item_2.Item6,
    sol_absp=item_2.Item7,
    vis_absp=item_2.Item8)  # -> mat; plug-in component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
hb_materials = Data(opaquemat)
materialnames = Text(item_2.Item)

manavc__construction_3 = Text(manavc__construction_2)
toggle = BooleanToggle(True)
regex_3 = MatchRegularExpression(T=manavc__construction_3, rp="var.*new List<Material>.*{.*}.*;", ic=Toggle(True))  # -> M, msi, mg, mgsi
regex_4 = MatchRegularExpression(T=regex_3.M, rp="var.*\n?.*=", ic=toggle)  # -> M, msi, mg, mgsi
split_2 = TextSplit(Text=regex_3.M, Separators="=")
empty = Panel("")
item_3 = ListItem(List=split_2, Index=0, Wrap=True)  # -> Item, flatten(Item1)
split_3 = TextSplit(Text=regex_4.M, Separators=empty)
item_4 = ListItem(List=split_3, Index=0, Wrap=True)  # -> Item, Item1
regex_5 = MatchRegularExpression(T=item_3.Item1, rp="{.*}", ic=toggle)  # -> M, msi, mg, mgsi
empty_2 = Panel("")
rep_5 = ReplaceText(Text=regex_5.M, Find="{", Replace=empty_2, RecursiveReplace=False)
rep_6 = ReplaceText(Text=rep_5, Find="}", Replace=empty_2, RecursiveReplace=False)
empty_3 = Panel("")
split_4 = TextSplit(Text=rep_6, Separators=",")
whitespace = Panel(" ")
rep_7 = ReplaceText(Text=split_4, Find=whitespace, Replace=empty_3, RecursiveReplace=False)
layers_materialnames = Text(rep_7)
layers_name = Text(item_4.Item1)

layers_materialnames_2 = Text(rep_7)
manavc__construction_4 = Text(manavc__construction_2)
regex_6 = MatchRegularExpression(T=manavc__construction_4, rp="AdjustInsulation.*;", ic=Toggle(True))  # -> M, msi, mg, mgsi
regex_7 = MatchRegularExpression(T=regex_6.M, rp="[(].*[)]", ic=Toggle(True))  # -> M, msi, mg, mgsi
split_5 = TextSplit(Text=regex_7.M, Separators=",")
empty_4 = Panel("")
item_5 = ListItem(List=split_5, Index=0, Wrap=True)  # -> Item, flatten(Item1)
rep_8 = ReplaceText(Text=item_5.Item1, Find=")", Replace=empty_4, RecursiveReplace=False)
empty_5 = Panel("")
whitespace_2 = Panel(" ")
rep_9 = ReplaceText(Text=rep_8, Find=whitespace_2, Replace=empty_5, RecursiveReplace=False)
insulation_layer_name = Text(rep_9)
tmatch = MatchText(Text=graft(layers_materialnames_2), Pattern=insulation_layer_name, Case=True)
listdexs = ListIndices(List=layers_materialnames_2)
ma = MassAddition(Input=tmatch)  # -> Result, PartialResults
trim = TrimTree(Tree=ma.Result, Depth=1)
cull = CullPattern(List=listdexs, CullPattern=trim)
ma_2 = MassAddition(Input=trim)  # -> Result, PartialResults
insulation_layer_index = Integer(cull)
contains_insulation = Boolean(ma_2.Result)

tmatch_2 = MatchText(Text=graft(layers_materialnames), Pattern=flatten(materialnames), Case=True)
cull_2 = CullPattern(List=flatten(hb_materials), CullPattern=tmatch_2)
trim_2 = TrimTree(Tree=cull_2, Depth=1)
layers_materials = Data(trim_2)

regex_8 = MatchRegularExpression_2(T=materialnames, rp=".*(MW)|(Ins).*", ic=Toggle(True))  # -> M, msi, mg, mgsi
tstat = TreeStatistics(Tree=regex_8.M)  # -> Paths, Length, Count
dsptchpths = DispatchBranchesWithPaths(Data=materialnames, Paths=tstat.Paths)  # -> flatten(SelectedData), flatten(OtherData), SelectedPaths, AdditionalGen; inputs Data: tree, Paths: list, Ancestor: Boolean
# ---------- dsptchpths: Python ----------
__author__ = "Ueli Saluz"
__version__ = "2020.05.29"

ghenv.Component.Name = "DispatchBranchesWithPaths"
ghenv.Component.NickName = "DsptchPths"
ghenv.Component.Description = "Select paths from a data tree and dispatch automatically. Optionally check if path is ancestor."
ghenv.Component.Message = "VER 1.0"

ghenv.Component.Params.Input[3].Optional = True

from Grasshopper import DataTree
from System import Object
from Grasshopper.Kernel.Data import GH_Path

if __name__ == "__main__":
    SelectedData = DataTree[Object]()
    OtherData = DataTree[Object]()
    SelectedPaths = []
    AdditionalGen = []
    
    dummy = 0
    for pathToCheck in Data.Paths:
        isInside = False;
        for path in Paths:
            checkAncestor = pathToCheck.IsAncestor(path,dummy)
            if Generations!=None:
                if Generations>checkAncestor[1]:
                    continue
            elif pathToCheck==path or (Ancestor and checkAncestor[0]):
                AdditionalGen.append(checkAncestor[1])
                SelectedData.AddRange(Data.Branch(pathToCheck),pathToCheck)
                SelectedPaths.append(pathToCheck)
                isInside=True
                break
        if not isInside:
            OtherData.AddRange(Data.Branch(pathToCheck),pathToCheck)
# ---------- end dsptchpths ----------
dsptchpths_2 = DispatchBranchesWithPaths(Data=hb_materials, Paths=tstat.Paths)  # -> flatten(SelectedData), flatten(OtherData), SelectedPaths, AdditionalGen; inputs Data: tree, Paths: list, Ancestor: Boolean; same code as dsptchpths
materialnames_non_insulation = Text(dsptchpths.OtherData)
hb_materials_non_insulation = Data(dsptchpths_2.OtherData)
materialnames_insulation = Text(dsptchpths.SelectedData)
hb_materials_insulation = Data(dsptchpths_2.SelectedData)

panel = Panel(regex.M)
panel_2 = Panel(regex_2.M)
panel_3 = Panel(rep_3)
panel_4 = Panel(hb_materials_non_insulation)
panel_5 = Panel(materialnames_non_insulation)

opaqueconstr = HBOpaqueConstruction(name=layers_name, materials=layers_materials)  # -> constr; plug-in component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
hb_opaque_construction = Data(opaqueconstr)

panel_6 = Panel(regex_3.M)
panel_7 = Panel(item_3.Item1)
panel_8 = Panel(item_4.Item1)
panel_9 = Panel(rep_7)
panel_10 = Panel(hb_opaque_construction)

hb_materials_non_insulation_2 = Data(hb_materials_non_insulation)
hb_materials_name_non_insulation = Text(materialnames_non_insulation)
hb_materials_insulation_2 = Data(hb_materials_insulation)
materialnames_insulation_2 = Text(dsptchpths.SelectedData)
hb_opaque_construction_2 = Data(hb_opaque_construction)
hb_opaque_construction_name = Text(layers_name)
layers_materials_2 = Data(trim_2)
layers_materialnames_3 = Text(layers_materialnames)
layers_contain_insulation = Boolean(contains_insulation)
insulation_layer_name_2 = Text(insulation_layer_name)
insulation_layer_index_2 = Integer(insulation_layer_index)
hb_materials_non_insulation_3 = ClusterOutput(hb_materials_non_insulation_2)
hb_materials_name_non_insulation_2 = ClusterOutput(hb_materials_name_non_insulation)
hb_materials_insulation_3 = ClusterOutput(hb_materials_insulation_2)
materialnames_insulation_3 = ClusterOutput(materialnames_insulation_2)
hb_opaque_construction_3 = ClusterOutput(hb_opaque_construction_2)
hb_opaque_construction_name_2 = ClusterOutput(hb_opaque_construction_name)
layers_materials_3 = ClusterOutput(layers_materials_2)
layers_materialnames_4 = ClusterOutput(layers_materialnames_3)
layers_contain_insulation_2 = ClusterOutput(layers_contain_insulation)
insulation_layer_name_3 = ClusterOutput(insulation_layer_name_2)
insulation_layer_index_3 = ClusterOutput(insulation_layer_index_2)

# ==== cluster Adjust_UValue
opaque_construction_u_value = ClusterInput()
insulation_layer_index = ClusterInput()
target_u_value_include_airfilms = ClusterInput()
hb_opaque_construction = ClusterInput()
hb_opaque_construction_name_new = ClusterInput()

hb_opaque_construction_2 = Data(hb_opaque_construction)
opaque_construction_u_value_2 = Number(opaque_construction_u_value)
target_u_value_include_airfilms_2 = Integer(target_u_value_include_airfilms)
hb_opaque_construction_name_new_2 = Text(hb_opaque_construction_name_new)
insulation_layer_index_2 = Integer(insulation_layer_index)
decnstrconstr = HBDeconstructConstruction(constr=hb_opaque_construction_2)  # -> materials, layers, r_val_si, r_val_ip, u_fac_si, u_fac_ip, shgc, t_sol, t_vis; plug-in component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
trim = TrimTree(Tree=decnstrconstr.materials, Depth=1)
dispdexs = DispatchIndices(List=trim, Indices=insulation_layer_index_2)  # -> AtI, NotI
expression = Expression(x=decnstrconstr.u_fac_si, Expression="1/x")
decnstrmat = HBDeconstructMaterial(mat=dispdexs.AtI)  # -> values, attr_names, r_val_si, r_val_ip; plug-in component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
filter = StreamFilter(Gate=target_u_value_include_airfilms_2, Stream0=decnstrconstr.r_val_si, Stream1=expression)
# R_insulation = R_total - Sum_{layer \in layers\{insulation}}(R_layer)
trim_2 = TrimTree(Tree=decnstrmat.values, Depth=1)
item = ListItem(List=trim_2, Index=0, Wrap=True)  # -> Item, Item1, Item2, Item3, Item4, Item5, Item6, Item7, Item8
expression_2 = Expression(x=item.Item2, y=opaque_construction_u_value_2, z=filter, u=decnstrmat.r_val_si, Expression="x*((1/y)-(z-u))")
insulation_thickness_new = Number(expression_2)
opaquemat = HBOpaqueMaterial(
    name=item.Item,
    thickness=insulation_thickness_new,
    conductivity=item.Item2,
    density=item.Item3,
    spec_heat=item.Item4,
    roughness=item.Item5,
    therm_absp=item.Item6,
    sol_absp=item.Item7,
    vis_absp=item.Item8)  # -> mat; plug-in component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
ins = InsertItems(List=dispdexs.NotI, Item=opaquemat, Indices=insulation_layer_index_2, Wrap=True)
trim_3 = TrimTree(Tree=ins, Depth=1)
opaqueconstr = HBOpaqueConstruction(name=hb_opaque_construction_name_new_2, materials=trim_3)  # -> constr; plug-in component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
hb_opaque_construction_adjusted = Data(opaqueconstr)
insulation_thickness_old = Number(item.Item1)
insulation_thickness_new_2 = Number(insulation_thickness_new)

panel = Panel("thickness(insulation) = conductivity(insulation) * (R(layers) - Sum_{layer \in layers\{insulation}}(R(layer))")
hb_opaque_construction_adjusted_2 = ClusterOutput(hb_opaque_construction_adjusted)
insulation_thickness_old_2 = ClusterOutput(insulation_thickness_old)
insulation_thickness_new_3 = ClusterOutput(insulation_thickness_new_2)

# ==== cluster MapGen
values = ClusterInput()
values_2 = Text(values)
lng = ListLength(List=values_2)
series = Series(Start=0, Step=1, Count=lng)
concat = Concatenate(FragmentA=values_2, FragmentB="=", FragmentC="\"", FragmentD=values_2, FragmentE="\"")
concat_2 = Concatenate(
    FragmentF="'",
    FragmentA=series,
    FragmentB="'",
    FragmentC=":",
    FragmentD="'",
    FragmentE=values_2,
    FragmentG="'",
    FragmentH=",")
join = TextJoin(Text=concat_2)
concat_3 = Concatenate(FragmentA=values_2, FragmentB="=", FragmentC=series)
valuelistindexed = Text(concat_3)
valuelist = Text(concat)
concat_4 = Concatenate(FragmentA="{", FragmentB=join, FragmentC="}")
valuelist_2 = ClusterOutput(valuelist)
pythondictionary = Text(concat_4)
valuelistindexed_2 = ClusterOutput(valuelistindexed)
pythondictionary_2 = ClusterOutput(pythondictionary)

# ==== cluster ExtractValues
valuelist = ClusterInput()
valuelist_2 = Text(valuelist)
split = TextSplit(Text=valuelist_2, Separators="=")
item = ListItem(List=split, Index=0, Wrap=True)  # -> Item, Item1
trim = TrimTree(Tree=item.Item1, Depth=1)
trim_2 = TrimTree(Tree=item.Item, Depth=1)
trim_3 = TextTrim(Text=trim, Start=True, End=True)
trim_4 = TextTrim(Text=trim_2, Start=True, End=True)
keys = Text(trim_4)
rep = ReplaceText(Text=trim_3, Find="\"", RecursiveReplace=False)
values = Text(rep)
keys_2 = ClusterOutput(keys)
values_2 = ClusterOutput(values)

# ==== cluster Correct
computetext = ClusterInput()
computetext_2 = Text(computetext)
strip = NAME(x=computetext_2, y="\"")  # -> a
# ---------- strip: Python ----------
a = x.strip(y)
# ---------- end strip ----------
# Compute wrapps paths which turn into string literals.
# To undo this, unwrapping is neciassary.
# Assumption no recursion level deeper than 2.
# The wrong wrapping rises with 2^n
panel = Panel("\"E:\\\\\\\\\\\\\\\\Nextcloud\\\\\\\\\\\\\\\\Public\\\\\\\\\\\\\\\\FOR2363\\\\\\\\\\\\\\\\TP4\\\\\\\\\\\\\\\\LUH\\\\\\\\\\\\\\\\HVAC-Systems\\\\\\\\\\\\\\\\BatchCurrent\\\\\\\\\\\\\\\\Data_Source\\\\\\\\\\\\\\\\Simulation-Files\\\\\\\\\\\\\\\\Simulation000\\\\\\\\\\\\\\\\openstudio\\\\\\\\\\\\\\\\run\\\\\\\\\\\\\\\\in.idf\"")
rep = ReplaceText(Text=strip, Find="\\", Replace="\", RecursiveReplace=False)
rep_2 = ReplaceText(Text=rep, Find="\\", Replace="\", RecursiveReplace=False)
rep_3 = ReplaceText(Text=rep_2, Find="\\", Replace="\", RecursiveReplace=False)
rep_4 = ReplaceText(Text=rep_3, Find="\\", Replace="\", RecursiveReplace=False)
originaltext = Text(rep_4)
originaltext_2 = ClusterOutput(originaltext)

# ==== cluster Correct_2
computetext = ClusterInput()
computetext_2 = Text(computetext)
strip = NAME(x=computetext_2, y="\"")  # -> a; same code as strip
# Compute wrapps paths which turn into string literals.
# To undo this, unwrapping is neciassary.
# Assumption no recursion level deeper than 2.
# The wrong wrapping rises with 2^n
panel = Panel("\"E:\\\\\\\\\\\\\\\\Nextcloud\\\\\\\\\\\\\\\\Public\\\\\\\\\\\\\\\\FOR2363\\\\\\\\\\\\\\\\TP4\\\\\\\\\\\\\\\\LUH\\\\\\\\\\\\\\\\HVAC-Systems\\\\\\\\\\\\\\\\BatchCurrent\\\\\\\\\\\\\\\\Data_Source\\\\\\\\\\\\\\\\Simulation-Files\\\\\\\\\\\\\\\\Simulation000\\\\\\\\\\\\\\\\openstudio\\\\\\\\\\\\\\\\run\\\\\\\\\\\\\\\\in.idf\"")
rep = ReplaceText(Text=strip, Find="\\", Replace="\", RecursiveReplace=False)
rep_2 = ReplaceText(Text=rep, Find="\\", Replace="\", RecursiveReplace=False)
rep_3 = ReplaceText(Text=rep_2, Find="\\", Replace="\", RecursiveReplace=False)
rep_4 = ReplaceText(Text=rep_3, Find="\\", Replace="\", RecursiveReplace=False)
rep_5 = ReplaceText(Text=rep_4, Find="%", Replace="\", RecursiveReplace=False)
originaltext = Text(rep_5)
originaltext_2 = ClusterOutput(originaltext)

# ==== cluster MatchRegularExpression: This component matches regex expression to text input.
ic = ClusterInput()
T = ClusterInput()
rp = ClusterInput()
ic_2 = IgnoreCase(ic)
rp_2 = RegexPattern(rp)
T_2 = Text(T)
expression = Expression(x=ic_2, y=T_2, Expression="x")
expression_2 = Expression(x=rp_2, y=T_2, Expression="x")
regex = MatchRegularExpressions(T=T_2, RP=expression_2, IC=expression)  # -> M, MSI, MG, MGSI, D; inputs T: tree of String, RP: tree of String, IC: tree of Boolean
# ---------- regex: C# usings ----------
//Imports
//--------------------------------------------------------------------------------------------
using System.Text.RegularExpressions;
# ---------- regex: C# ----------
    //General
    //--------------------------------------------------------------------------------------------
    //Authors: YOUR NAME
    //Last modified: DATE
    //Contact: E-MAIL

    if (Component.RunCount < 2)
    {
      Component.Name = "MatchRegularExpressions";
      Component.NickName = "Regex";
      Component.Description = "This component matches regex expression to text input.";
      Component.Message = "VER 1.0";
      Component.Category = "Sets";
      Component.SubCategory = "Text";
      //Exposure level = 3

      //Inputs
      //--------------------------------------------------------------------------------------------
      int inputIndex = 0;

      Component.Params.Input[inputIndex].Name = "Text";
      Component.Params.Input[inputIndex].NickName = "T";
      Component.Params.Input[inputIndex].Description = "This is the string that should be matched against the regex pattern.";
      Component.Params.Input[inputIndex].Optional = false;
      inputIndex += 1;

      Component.Params.Input[inputIndex].Name = "RegexPattern";
      Component.Params.Input[inputIndex].NickName = "RP";
      Component.Params.Input[inputIndex].Description = "The regex pattern used to match";
      Component.Params.Input[inputIndex].Optional = false;
      inputIndex += 1;

      Component.Params.Input[inputIndex].Name = "IgnoreCase";
      Component.Params.Input[inputIndex].NickName = "IC";
      Component.Params.Input[inputIndex].Description = "Ignore case for the matching";
      Component.Params.Input[inputIndex].Optional = false;
      inputIndex += 1;

      //Outputs
      //--------------------------------------------------------------------------------------------
      int outputIndex = 0;

      Component.Params.Output[outputIndex].Name = "Matches";
      Component.Params.Output[outputIndex].NickName = "M";
      Component.Params.Output[outputIndex].Description = "The matches for the specified text string.";
      outputIndex += 1;

      Component.Params.Output[outputIndex].Name = "MatchStartIndices";
      Component.Params.Output[outputIndex].NickName = "MSI";
      Component.Params.Output[outputIndex].Description = "The start indices of the matches for the specified text string.";
      outputIndex += 1;

      Component.Params.Output[outputIndex].Name = "MatchGroups";
      Component.Params.Output[outputIndex].NickName = "MG";
      Component.Params.Output[outputIndex].Description = "The match groups of the matches for the specified text string.";
      outputIndex += 1;

      Component.Params.Output[outputIndex].Name = "MatchGroupStartIndices";
      Component.Params.Output[outputIndex].NickName = "MGSI";
      Component.Params.Output[outputIndex].Description = "The start indices of the match group of the matches for the specified text string.";
      outputIndex += 1;

      Component.Params.Output[outputIndex].Name = "Debug";
      Component.Params.Output[outputIndex].NickName = "D";
      Component.Params.Output[outputIndex].Description = "Debugging purpose.";
      outputIndex += 1;

    }

    //Initialize trees
    //--------------------------------------------------------------------------------------------
    DataTree<string> MatchesTree = new DataTree<string>();
    DataTree<int> MatchStartIndicesTree = new DataTree<int>();
    DataTree<string> MatchGroupsTree = new DataTree<string>();
    DataTree<int> MatchGroupStartIndicesTree = new DataTree<int>();

    DataTree<string> DebugTree = new DataTree<string>();

    //Data matching
    //--------------------------------------------------------------------------------------------
    foreach (GH_Path path in T.Paths)
    {
      DebugTree.Add("Debuggin panel", path);
      var textBranch = T.Branch(path);
      var regexPatternStringBranch = RP.Branch(path);
      var ignoreCaseBranch = IC.Branch(path);

      for (int i = 0; i < textBranch.Count;i++)
      {
        var text = textBranch[i];
        var regexPatternString = regexPatternStringBranch[i];
        var ignoreCase = ignoreCaseBranch[i];

        var regexSearchOptions = RegexOptions.Compiled;
        if (ignoreCase)
        {
          regexSearchOptions = regexSearchOptions | RegexOptions.IgnoreCase;
        }

        Regex regexPattern = new Regex(regexPatternString, regexSearchOptions);
        MatchCollection matches = regexPattern.Matches(text);
        foreach (Match match in matches)
        {
          MatchesTree.Add(match.Value, path);
          MatchStartIndicesTree.Add(match.Index, path);
          //Match groups. More information about match groups under:
          //https://docs.microsoft.com/de-de/dotnet/api/system.text.regularexpressions.group?view=net-6.0
          GroupCollection matchGroups = match.Groups;
          int j = 0;
          foreach (Group matchGroup in matchGroups)
          {
            var graftedPath = path.AppendElement(j);
            MatchGroupsTree.Add(matchGroup.Value, graftedPath);
            MatchGroupStartIndicesTree.Add(matchGroup.Index, graftedPath);
            j++;
          }
        }
      }
    }

    //Assign trees to output
    //--------------------------------------------------------------------------------------------
    M = MatchesTree;
    MSI = MatchStartIndicesTree;
    MG = MatchGroupsTree;
    MGSI = MatchGroupStartIndicesTree;
    //Commit this out if done
    D = DebugTree;
# ---------- end regex ----------
panel = Panel(regex.D)
M = ClusterOutput(regex.M)
msi = ClusterOutput(regex.MSI)
mgsi = ClusterOutput(regex.MGSI)
mg = ClusterOutput(regex.MG)

# ==== cluster MatchRegularExpression_2: This component matches regex expression to text input.
ic = ClusterInput()
T = ClusterInput()
rp = ClusterInput()
ic_2 = IgnoreCase(ic)
rp_2 = RegexPattern(rp)
T_2 = Text(T)
expression = Expression(x=rp_2, y=T_2, Expression="x")
expression_2 = Expression(x=T_2, y=expression, Expression="x")
expression_3 = Expression(x=ic_2, y=expression, Expression="x")
regex = MatchRegularExpressions(T=expression_2, RP=expression, IC=expression_3)  # -> M, MSI, MG, MGSI, D; inputs T: tree of String, RP: tree of String, IC: tree of Boolean
# ---------- regex: C# usings ----------
//Imports
//--------------------------------------------------------------------------------------------
using System.Text.RegularExpressions;
# ---------- regex: C# ----------
    //General
    //--------------------------------------------------------------------------------------------
    //Authors: YOUR NAME
    //Last modified: DATE
    //Contact: E-MAIL

    if (Component.RunCount < 2)
    {
      Component.Name = "MatchRegularExpressions";
      Component.NickName = "Regex";
      Component.Description = "This component matches regex expression to text input.";
      Component.Message = "VER 1.0";
      Component.Category = "Sets";
      Component.SubCategory = "Text";
      //Exposure level = 3

      //Inputs
      //--------------------------------------------------------------------------------------------
      int inputIndex = 0;

      Component.Params.Input[inputIndex].Name = "Text";
      Component.Params.Input[inputIndex].NickName = "T";
      Component.Params.Input[inputIndex].Description = "This is the string that should be matched against the regex pattern.";
      Component.Params.Input[inputIndex].Optional = false;
      inputIndex += 1;

      Component.Params.Input[inputIndex].Name = "RegexPattern";
      Component.Params.Input[inputIndex].NickName = "RP";
      Component.Params.Input[inputIndex].Description = "The regex pattern used to match";
      Component.Params.Input[inputIndex].Optional = false;
      inputIndex += 1;

      Component.Params.Input[inputIndex].Name = "IgnoreCase";
      Component.Params.Input[inputIndex].NickName = "IC";
      Component.Params.Input[inputIndex].Description = "Ignore case for the matching";
      Component.Params.Input[inputIndex].Optional = false;
      inputIndex += 1;

      //Outputs
      //--------------------------------------------------------------------------------------------
      int outputIndex = 0;

      Component.Params.Output[outputIndex].Name = "Matches";
      Component.Params.Output[outputIndex].NickName = "M";
      Component.Params.Output[outputIndex].Description = "The matches for the specified text string.";
      outputIndex += 1;

      Component.Params.Output[outputIndex].Name = "MatchStartIndices";
      Component.Params.Output[outputIndex].NickName = "MSI";
      Component.Params.Output[outputIndex].Description = "The start indices of the matches for the specified text string.";
      outputIndex += 1;

      Component.Params.Output[outputIndex].Name = "MatchGroups";
      Component.Params.Output[outputIndex].NickName = "MG";
      Component.Params.Output[outputIndex].Description = "The match groups of the matches for the specified text string.";
      outputIndex += 1;

      Component.Params.Output[outputIndex].Name = "MatchGroupStartIndices";
      Component.Params.Output[outputIndex].NickName = "MGSI";
      Component.Params.Output[outputIndex].Description = "The start indices of the match group of the matches for the specified text string.";
      outputIndex += 1;

      Component.Params.Output[outputIndex].Name = "Debug";
      Component.Params.Output[outputIndex].NickName = "D";
      Component.Params.Output[outputIndex].Description = "Debugging purpose.";
      outputIndex += 1;

    }

    //Initialize trees
    //--------------------------------------------------------------------------------------------
    DataTree<string> MatchesTree = new DataTree<string>();
    DataTree<int> MatchStartIndicesTree = new DataTree<int>();
    DataTree<string> MatchGroupsTree = new DataTree<string>();
    DataTree<int> MatchGroupStartIndicesTree = new DataTree<int>();

    DataTree<string> DebugTree = new DataTree<string>();

    //Data matching
    //--------------------------------------------------------------------------------------------
    foreach (GH_Path path in T.Paths)
    {
      DebugTree.Add("Debuggin panel", path);
      var textBranch = T.Branch(path);
      var regexPatternStringBranch = RP.Branch(path);
      var ignoreCaseBranch = IC.Branch(path);

      for (int i = 0; i < textBranch.Count;i++)
      {
        var text = textBranch[i];
        var regexPatternString = regexPatternStringBranch[i];
        var ignoreCase = ignoreCaseBranch[i];

        var regexSearchOptions = RegexOptions.Compiled;
        if (ignoreCase)
        {
          regexSearchOptions = regexSearchOptions | RegexOptions.IgnoreCase;
        }

        Regex regexPattern = new Regex(regexPatternString, regexSearchOptions);
        MatchCollection matches = regexPattern.Matches(text);
        foreach (Match match in matches)
        {
          MatchesTree.Add(match.Value, path);
          MatchStartIndicesTree.Add(match.Index, path);
          //Match groups. More information about match groups under:
          //https://docs.microsoft.com/de-de/dotnet/api/system.text.regularexpressions.group?view=net-6.0
          GroupCollection matchGroups = match.Groups;
          int j = 0;
          foreach (Group matchGroup in matchGroups)
          {
            var graftedPath = path.AppendElement(j);
            MatchGroupsTree.Add(matchGroup.Value, graftedPath);
            MatchGroupStartIndicesTree.Add(matchGroup.Index, graftedPath);
            j++;
          }
        }
      }
    }

    //Assign trees to output
    //--------------------------------------------------------------------------------------------
    M = MatchesTree;
    MSI = MatchStartIndicesTree;
    MG = MatchGroupsTree;
    MGSI = MatchGroupStartIndicesTree;
    D = DebugTree;
# ---------- end regex ----------
panel = Panel(regex.D)
M = ClusterOutput(regex.M)
msi = ClusterOutput(regex.MSI)
mgsi = ClusterOutput(regex.MGSI)
mg = ClusterOutput(regex.MG)
