# Grasshopper definition Model.gh (Grasshopper 1.0.7)
# plug-ins: Pufferfish, MetaHopper

number_slider = Slider(4, range=0..10)  # disabled
fassade = ValueList({"Horizontal-Windows", "Vertical-Windows", "Ribbon-Windows"}, selected="Horizontal-Windows")  # disabled
fassade_2 = ValueList({"Horizontal-Windows": 0, "Vertical-Windows": 1, "Ribbon-Windows": 2}, selected="Ribbon-Windows")  # disabled
number_slider_2 = Slider(4, range=0..10)  # disabled
number_slider_3 = Slider(2.5, range=0..10)  # disabled
number_slider_4 = Slider(5, range=0..10)  # disabled
number_slider_5 = Slider(4, range=0..10)  # disabled
number_slider_6 = Slider(3, range=0..10)  # disabled
number_slider_7 = Slider(13, range=0..30)  # disabled
number_slider_8 = Slider(0, range=0..360)  # disabled
debugmode = BooleanToggle(False)
_0_normal_1_messi_planes = Boolean(Toggle(False))
onoff = EnableDisableObject(
    Enabled=debugmode,
    AllObjects_Object=[number_slider_4, number_slider_5, number_slider, number_slider_6, number_slider_8, number_slider_7, fassade_2, number_slider_2, number_slider_3, fassade])
orientation = GetNumber(number_slider_8, AtLeast=1, AtMost=1, Maximum=1.797693135e+308, Minimum=-1.797693135e+308, TreeAccess=False)
numberoffloors = GetNumber(number_slider, AtLeast=1, AtMost=1, Maximum=1.797693135e+308, Minimum=-1.797693135e+308, TreeAccess=False)
floorheight = GetNumber(number_slider_2, AtLeast=1, AtMost=1, Maximum=1.797693135e+308, Minimum=-1.797693135e+308, TreeAccess=False)
rasterlength_x = GetNumber(number_slider_3, AtLeast=1, AtMost=1, Maximum=1.797693135e+308, Minimum=-1.797693135e+308, TreeAccess=False)
rasterlength_y = GetNumber(number_slider_3, AtLeast=1, AtMost=1, Maximum=1.797693135e+308, Minimum=-1.797693135e+308, TreeAccess=False)
arm_latitudinal_numberofsegments = GetInteger(number_slider_4, AtLeast=1, AtMost=1, Maximum=2147483647, Minimum=-2147483648, TreeAccess=False)
arm_longitudinal_numberofsegments = GetInteger(number_slider_5, AtLeast=1, AtMost=1, Maximum=2147483647, Minimum=-2147483648, TreeAccess=False)
basebody_inside_latditudinal_numberofseg = GetInteger(number_slider_6, AtLeast=1, AtMost=1, Maximum=2147483647, Minimum=-2147483648, TreeAccess=False)  # "BaseBody-Inside-Latditudinal-NumberOfSegments"
courtyard_segmentcount_rasterlength_y = GetNumber(number_slider_7, AtLeast=1, AtMost=1, Maximum=1.797693135e+308, Minimum=-1.797693135e+308, TreeAccess=False)
fassade_3 = GetString(fassade, AtLeast=1, AtMost=1, TreeAccess=False)

# ---- group: RH_IN:NumberOfFloors
numberoffloors_2 = Number(numberoffloors)

# ---- group: RH_IN:Orientation
orientation_2 = Number(orientation)

# ---- group: RH_IN:FloorHeight
floorheight_2 = Number(floorheight)

# ---- group: RH_IN:RasterLength-X
rasterlength_x_2 = Number(rasterlength_x)

# ---- group: RH_IN:RasterLength-Y
rasterlength_y_2 = Number(rasterlength_y)

# ---- group: RH_IN:Arm-Latitudinal-NumberOfSegments
arm_latitudinal_numberofsegments_2 = Number(arm_latitudinal_numberofsegments)

# ---- group: RH_IN:Arm-Longitudinal-NumberOfSegments
arm_longitudinal_numberofsegments_2 = Number(arm_longitudinal_numberofsegments)

# ---- group: RH_IN:BaseBody-Inside-Latditudinal-NumberOfSegments
basebody_inside_latditudinal_numberofseg_2 = Number(basebody_inside_latditudinal_numberofseg)  # "BaseBody-Inside-Latditudinal-NumberOfSegments"

# ---- group: RH_IN:Courtyard_SegmentCount_RasterLength-Y
courtyard_segmentcount_rasterlength_y_2 = Number(courtyard_segmentcount_rasterlength_y)

# ---- group: RH_IN:Fassade
fassade_4 = Text(fassade_3)

# ----
panel = Panel("""Horizontal-Windows
Vertical-Windows
Ribbon-Windows""")
tmatch = MatchText(Text=fassade_4, RegEx=panel, Case=True)
lng = ListLength(List=panel)
number_slider_9 = Slider(1.5, range=0..10)
series = Series(Start=0, Step=1, Count=lng)

genes = GenePool(Decimals=0, Maximum=800, Minimum=0, Value=[400, 644.88, 800, 400])
genes_2 = GenePool(Decimals=0, Maximum=300, Minimum=0, Value=[150, 241.83, 300, 150])
genes_3 = GenePool(Decimals=0, Maximum=300, Minimum=0, Value=[150, 241.83, 300, 150])
genes_4 = GenePool(Decimals=0, Maximum=360, Minimum=0, Value=[68, 167, 259, 180])
genes_5 = GenePool(Decimals=0, Maximum=360, Minimum=0, Value=[165, 322, 66, 180])
graftedmessi = BooleanToggle(True)
pt = Point(Point(0, 0, 0))
pl = ConstructPlane(Origin=pt, XAxis=Vector(1, 0, 0), YAxis=Vector(0, 1, 0))
messibaseplanes = MessiBasePlanes(
    baseplane=pl,
    movingx=genes,
    movingy=genes_2,
    movingz=genes_3,
    anglex=genes_4,
    angley=genes_5,
    normalmessi=_0_normal_1_messi_planes,
    graftedmessi=graftedmessi)
worldoriginplane = Plane(pl)
filter = StreamFilter(Gate=_0_normal_1_messi_planes, Stream0=worldoriginplane, Stream1=messibaseplanes)

dispatch = Dispatch(List=series, DispatchPattern=tmatch)  # -> ListA, ListB

arm_longitudinal_numberofsegments_3 = Number(arm_longitudinal_numberofsegments_2)
arm_latitudinal_numberofsegments_3 = Number(arm_latitudinal_numberofsegments_2)

number_slider_10 = Slider(0.5, range=0..1)
number_slider_11 = Slider(0.9, range=0..2)
fassade_5 = Text(dispatch.ListA)
number_slider_12 = Slider(0.5, range=0..1)
list = ValueList({"Windows": 0, "WindowBand": 1, "GlassFassade": 2}, selected="WindowBand")
list_2 = ValueList({"Windows": 0, "WindowBand": 1, "GlassFassade": 2}, selected="Windows")
filter_2 = StreamFilter(Gate=fassade_5, Stream0=Slider(3, range=0..10), Stream1=number_slider_9, Stream2=number_slider_9)
fassade_6 = Text(dispatch.ListA)
fassade_7 = Text(dispatch.ListA)
filter_3 = StreamFilter(Gate=fassade_7, Stream0=list_2, Stream1=list_2, Stream2=list)
filter_4 = StreamFilter(Gate=fassade_6, Stream0=Slider(0.9, range=0..1), Stream1=number_slider_10, Stream2=number_slider_10)
fassade_8 = Text(dispatch.ListA)

number_slider_13 = Slider(15, range=0..30)
number_slider_14 = Slider(2.5, range=0..10)
rasterlength_x_3 = Number(rasterlength_x_2)
rasterlength_y_3 = Number(rasterlength_y_2)

fassade_9 = Text(dispatch.ListA)
building_windowwidth = Number(filter_2)
filter_5 = StreamFilter(Gate=fassade_9, Stream0=Slider(0.7, range=0..1), Stream1=number_slider_12, Stream2=number_slider_12)
filter_6 = StreamFilter(Gate=fassade_8, Stream0=number_slider_11, Stream1=number_slider_11, Stream2=number_slider_12)
building_offsettosides = Number(Slider(1, range=0..10))
building_windowtowall_perimeter = Number(filter_4)
building_windowtype = Integer(filter_3)
building_window_distancetoceiling = Number(filter_5)
building_parapetheight = Number(filter_6)
orientation_3 = Number(orientation_2)
floorheight_3 = Number(floorheight_2)
prot = RotatePlane(Plane=filter, Angle=degrees(orientation_3))
subtraction = Subtraction(A=floorheight_3, B=building_parapetheight, C=building_window_distancetoceiling)
baseplane = Plane(prot)
building_windowheight = Number(subtraction)
deplane = DeconstructPlane(Plane=baseplane)  # -> Origin, XAxis, YAxis, ZAxis
pflip = FlipPlane(Plane=baseplane, ReverseX=False, ReverseY=False, SwapAxes=True)
list_3 = ValueList({"Building-Fassades-Individual": 0, "Building-Fassades-Together": 1}, selected="Building-Fassades-Together")
revxvec = Vector(expr("-x", deplane.XAxis))
revzvec = Vector(expr("-x", deplane.ZAxis))
revyvec = Vector(expr("-x", deplane.YAxis))
origin = Point(deplane.Origin)
xvec = Vector(deplane.XAxis)
yvec = Vector(deplane.YAxis)
zvec = Vector(deplane.ZAxis)

list_4 = ValueList({"Windows": 0, "WindowBand": 1, "GlassFassade": 2}, selected="Windows")

list_5 = ValueList({"Arms-Fassades-Each": 0, "Arms-Fassades-Together": 1}, selected="Arms-Fassades-Each")
parapetheight = Number(Slider(1.2, range=0..2))
windowheight = Number(Slider(1.5, range=0..10))
windowwidth = Number(Slider(1.25, range=0..10))
offsettosides = Number(Slider(1, range=0..10))
windowtowall_perimeter = Number(Slider(0.7, range=0..1))
windowtype = Integer(list_4)
filter_7 = StreamFilter(Gate=list_3, Stream0=windowtype, Stream1=building_windowtype)
filter_8 = StreamFilter(Gate=list_3, Stream0=windowtowall_perimeter, Stream1=building_windowtowall_perimeter)
filter_9 = StreamFilter(Gate=list_3, Stream0=windowwidth, Stream1=building_windowwidth)
filter_10 = StreamFilter(Gate=list_3, Stream0=parapetheight, Stream1=building_parapetheight)
filter_11 = StreamFilter(Gate=list_3, Stream0=windowheight, Stream1=building_windowheight)
filter_12 = StreamFilter(Gate=list_3, Stream0=offsettosides, Stream1=building_offsettosides)
filter_13 = StreamFilter(Gate=list_3, Stream0=list_5, Stream1="1")

list_6 = ValueList({"Center-Fassades-Each": 0, "Center-Fassades-Together": 1}, selected="Center-Fassades-Each")
list_7 = ValueList({"Windows": 0, "WindowBand": 1, "GlassFassade": 2}, selected="Windows")
parapetheight_2 = Number(Slider(1.2, range=0..2))
windowheight_2 = Number(Slider(1.7, range=0..10))
windowwidth_2 = Number(Slider(1.25, range=0..10))
windowtowall_perimeter_2 = Number(Slider(0.7, range=0..1))
offsettosides_2 = Number(Slider(1, range=0..10))
windowtype_2 = Integer(list_7)
filter_14 = StreamFilter(Gate=list_3, Stream0=windowtowall_perimeter_2, Stream1=building_windowtowall_perimeter)
filter_15 = StreamFilter(Gate=list_3, Stream0=windowwidth_2, Stream1=building_windowwidth)
filter_16 = StreamFilter(Gate=list_3, Stream0=parapetheight_2, Stream1=building_parapetheight)
filter_17 = StreamFilter(Gate=list_3, Stream0=windowheight_2, Stream1=building_windowheight)
filter_18 = StreamFilter(Gate=list_3, Stream0=offsettosides_2, Stream1=building_offsettosides)
filter_19 = StreamFilter(Gate=list_3, Stream0=windowtype_2, Stream1=building_windowtype)
filter_20 = StreamFilter(Gate=list_3, Stream0=list_6, Stream1="1")

lng_2 = ListLength(List=flatten(baseplane))
series_2 = Series(Start="1", Step=1, Count=lng_2)
panel_2 = Panel("""North
East
South
West""")
concat = Concatenate(FragmentA="OfficeBuilding", FragmentC=series_2)  # -> graft(Result)
panel_3 = Panel("""Upper
Right
Lower
Left""")
match = MatchTree(Tree=concat, Guide=baseplane)

amp = Amplitude(Vector=xvec, Amplitude=1)
amp_2 = Amplitude(Vector=yvec, Amplitude=1)
amp_3 = Amplitude(Vector=zvec, Amplitude=1)
amp_4 = Amplitude(Vector=revxvec, Amplitude=1)
amp_5 = Amplitude(Vector=revyvec, Amplitude=1)
amp_6 = Amplitude(Vector=revzvec, Amplitude=1)

namingschema_delimiter_parameter_seconda = Text("-")  # "NamingSchema-Delimiter-Parameter-Secondary"
namingschema_window_name = Text("Window")

namingschema_delimiter_parameter_primary = Text("_")
namingschema_delimiter_assign = Text("=")
namingschema_delimiter_decimal = Text(",")
namingschema_true_name = Text("T")
namingschema_false_name = Text("F")

list_8 = ValueList({"Windows": 0, "WindowBand": 1, "GlassFassade": 2}, selected="Windows")

list_9 = ValueList({"Center-Fassade-Upper-Lower-Each": 0, "Center-Fassade-Upper-Lower-Together": 1}, selected="Center-Fassade-Upper-Lower-Each")
list_10 = ValueList({"Windows": 0, "WindowBand": 1, "GlassFassade": 2}, selected="Windows")
windowheight_3 = Number(Slider(1.8, range=0..10))
parapetheight_3 = Number(Slider(1.2, range=0..2))
windowwidth_3 = Number(Slider(1.25, range=0..10))
windowtowall_perimeter_3 = Number(Slider(0.6, range=0..1))
offsettosides_3 = Number(Slider(1, range=0..10))
windowtype_3 = Integer(list_10)
filter_21 = StreamFilter(Gate=filter_20, Stream0=list_9, Stream1="1")
filter_22 = StreamFilter(Gate=list_3, Stream0=windowtype_3, Stream1=filter_19)
filter_23 = StreamFilter(Gate=filter_20, Stream0=windowtowall_perimeter_3, Stream1=filter_14)
filter_24 = StreamFilter(Gate=filter_20, Stream0=windowwidth_3, Stream1=filter_15)
filter_25 = StreamFilter(Gate=filter_20, Stream0=parapetheight_3, Stream1=filter_16)
filter_26 = StreamFilter(Gate=filter_20, Stream0=windowheight_3, Stream1=filter_17)
filter_27 = StreamFilter(Gate=filter_20, Stream0=offsettosides_3, Stream1=filter_18)

list_11 = ValueList({"Arms-Fassades-Lower-Upper-Each": 0, "Arms-Fassades-Lower-Upper-Together": 1}, selected="Arms-Fassades-Lower-Upper-Each")
list_12 = ValueList({"Windows": 0, "WindowBand": 1, "GlassFassade": 2}, selected="WindowBand")
windowtowall_perimeter_4 = Number(Slider(0.7, range=0..1))
parapetheight_4 = Number(Slider(1.2, range=0..2))
windowheight_4 = Number(Slider(1.3, range=0..10))
windowwidth_4 = Number(Slider(1.25, range=0..10))
windowtype_4 = Integer(list_12)
offsettosides_4 = Number(Slider(1, range=0..10))
filter_28 = StreamFilter(Gate=filter_13, Stream0=windowtype_4, Stream1=filter_7)
filter_29 = StreamFilter(Gate=filter_13, Stream0=windowtowall_perimeter_4, Stream1=filter_8)
filter_30 = StreamFilter(Gate=filter_13, Stream0=windowwidth_4, Stream1=filter_9)
filter_31 = StreamFilter(Gate=filter_13, Stream0=parapetheight_4, Stream1=filter_10)
filter_32 = StreamFilter(Gate=filter_13, Stream0=windowheight_4, Stream1=filter_11)
filter_33 = StreamFilter(Gate=filter_13, Stream0=offsettosides_4, Stream1=filter_12)
filter_34 = StreamFilter(Gate=filter_13, Stream0=list_11, Stream1="1")

list_13 = ValueList({"Windows": 0, "WindowBand": 1, "GlassFassade": 2}, selected="Windows")
list_14 = ValueList({"Arms-Fassades-Right-Left-Each": 0, "Arms-Fassades-Right-Left-Together": 1}, selected="Arms-Fassades-Right-Left-Together")
windowtowall_perimeter_5 = Number(Slider(0.47, range=0..1))
parapetheight_5 = Number(Slider(0.5, range=0..2))
windowheight_5 = Number(Slider(2.5, range=0..10))
windowwidth_5 = Number(Slider(1.25, range=0..10))
offsettosides_5 = Number(Slider(1, range=0..10))
windowtype_5 = Integer(list_13)
filter_35 = StreamFilter(Gate=filter_13, Stream0=windowtowall_perimeter_5, Stream1=filter_8)
filter_36 = StreamFilter(Gate=filter_13, Stream0=windowwidth_5, Stream1=filter_9)
filter_37 = StreamFilter(Gate=filter_13, Stream0=parapetheight_5, Stream1=filter_10)
filter_38 = StreamFilter(Gate=filter_13, Stream0=windowheight_5, Stream1=filter_11)
filter_39 = StreamFilter(Gate=filter_13, Stream0=offsettosides_5, Stream1=filter_12)
filter_40 = StreamFilter(Gate=filter_13, Stream0=list_14, Stream1="1")
filter_41 = StreamFilter(Gate=filter_13, Stream0=windowtype_5, Stream1=filter_7)

windowtype_6 = Integer(list_8)

list_15 = ValueList({"Center-Fassade-Right-Left-Each": 0, "Center-Fassade-Right-Left-Together": 1}, selected="Center-Fassade-Right-Left-Together")
parapetheight_6 = Number(Slider(1.2, range=0..2))
windowheight_6 = Number(Slider(1.7, range=0..10))
windowwidth_6 = Number(Slider(3.5, range=0..10))
windowtowall_perimeter_6 = Number(Slider(0.7, range=0..1))
offsettosides_6 = Number(Slider(1, range=0..10))
filter_42 = StreamFilter(Gate=filter_20, Stream0=windowwidth_6, Stream1=filter_15)
filter_43 = StreamFilter(Gate=filter_20, Stream0=parapetheight_6, Stream1=filter_16)
filter_44 = StreamFilter(Gate=filter_20, Stream0=windowheight_6, Stream1=filter_17)
filter_45 = StreamFilter(Gate=filter_20, Stream0=offsettosides_6, Stream1=filter_18)
filter_46 = StreamFilter(Gate=filter_20, Stream0=list_15, Stream1="1")
filter_47 = StreamFilter(Gate=filter_20, Stream0=windowtowall_perimeter_6, Stream1=filter_14)
filter_48 = StreamFilter(Gate=filter_20, Stream0=windowtype_6, Stream1=filter_19)

list_16 = ValueList({"Windows": 0, "WindowBand": 1, "GlassFassade": 2}, selected="Windows")
list_17 = ValueList({"Fully inside Wall": 0, "Polygonal Aproximation": 1, "Exact Opening Mesurements": 2}, selected="Fully inside Wall")
namingschema_delimiter = Text("_")
baseplane_2 = Plane(baseplane)
windowtype_7 = Integer(list_16)

swatch = ColourSwatch(SwatchColor=RGB(235, 52, 79))
swatch_2 = ColourSwatch(SwatchColor=RGB(240, 117, 24))
swatch_3 = ColourSwatch(SwatchColor=RGB(234, 207, 51))
swatch_4 = ColourSwatch(SwatchColor=RGB(51, 79, 234))
swatch_5 = ColourSwatch(SwatchColor=RGB(157, 0, 165))
swatch_6 = ColourSwatch(SwatchColor=RGB(75, 85, 100))
swatch_7 = ColourSwatch(SwatchColor=RGB(37, 42, 50))

courtyard_segmentcount_rasterlength_y_3 = Number(courtyard_segmentcount_rasterlength_y_2)

arm_lower_right_latitudinal_numberofsegm = Number(arm_latitudinal_numberofsegments_3)  # "Arm-Lower-Right-Latitudinal-NumberOfSegments"
arm_lower_left_longitudinal_numberofsegm = Number(arm_longitudinal_numberofsegments_3)  # "Arm-Lower-Left-Longitudinal-NumberOfSegments"
arm_lower_lef_latitudinal_numberofsegmen = Number(arm_latitudinal_numberofsegments_3)  # "Arm-Lower-Lef-Latitudinal-NumberOfSegments"
arm_upper_left_longitudinal_numberofsegm = Number(arm_longitudinal_numberofsegments_3)  # "Arm-Upper-Left-Longitudinal-NumberOfSegments"
arm_upper_right_longitudinal_numberofseg = Number(arm_longitudinal_numberofsegments_3)  # "Arm-Upper-Right-Longitudinal-NumberOfSegments"
arm_upper_right_latitudinal_numberofsegm = Number(arm_latitudinal_numberofsegments_3)  # "Arm-Upper-Right-Latitudinal-NumberOfSegments"
arm_upper_left_latitudinal_numberofsegme = Number(arm_latitudinal_numberofsegments_3)  # "Arm-Upper-Left-Latitudinal-NumberOfSegments"
arm_lower_right_longitudinal_numberofseg = Number(arm_longitudinal_numberofsegments_3)  # "Arm-Lower-Right-Longitudinal-NumberOfSegments"
basebody_inside_latditudinal_numberofseg_3 = Number(basebody_inside_latditudinal_numberofseg_2)  # "BaseBody-Inside-Latditudinal-NumberOfSegments"

addition = Addition(
    A=courtyard_segmentcount_rasterlength_y_3,
    B=arm_lower_right_longitudinal_numberofseg,
    C=arm_lower_left_longitudinal_numberofsegm)

basebody_longitudinal_numberofsegments = Number(addition)

# ----
# Data tree schema:
# {...,Building,Zone}
# Zone:
# 0:Core
# 1:Center-Lower
# 2:Center-Upper
# 3:Center-Right
# 4:Center-Left
# 5:Arm-Lower-Right
# 6:Arm-Lower-Left
# 7:Arm-Upper-Left
# 8:Arm-Upper-Right
generic_officebuilding_h_shape_rectangle = Generic_OfficeBuilding_HShape_RectangleGrid(
    baseplane=baseplane,
    rasterlength_x=rasterlength_x_3,
    rasterlength_y=rasterlength_y_3,
    building_longitudinal_numberofsegments=basebody_longitudinal_numberofsegments,
    basebody_inside_latditudinal_numberofseg=basebody_inside_latditudinal_numberofseg_3,
    arm_lower_right_longitudinal_numberofseg=arm_lower_right_longitudinal_numberofseg,
    arm_lower_right_latitudinal_numberofsegm=arm_lower_right_latitudinal_numberofsegm,
    arm_lower_left_longitudinal_numberofsegm=arm_lower_left_longitudinal_numberofsegm,
    arm_lower_lef_latitudinal_numberofsegmen=arm_lower_lef_latitudinal_numberofsegmen,
    arm_upper_left_longitudinal_numberofsegm=arm_upper_left_longitudinal_numberofsegm,
    arm_upper_left_latitudinal_numberofsegme=arm_upper_left_latitudinal_numberofsegme,
    arm_upper_right_longitudinal_numberofseg=arm_upper_right_longitudinal_numberofseg,
    arm_upper_right_latitudinal_numberofsegm=arm_upper_right_latitudinal_numberofsegm,
    namingschema_directions=panel_3,
    namingschema_delimiter="_",
    namingschema_building_name=match,
    namingschema_wing_name="Wing",
    namingschema_center_name="Center",
    namingschema_core_name="Core",
    namingschema_arm_name="Arm",
    namingschema_fassade_name="Fassade")  # -> boundary_2, courtyard_upper_3, courtyard_lower_3, wings_boundary_2, wings_name_2, basebody_center_boundary_2, basebody_center_name_2, basebody_center_zones_boundary_2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; "Generic_OfficeBuilding_H-Shape_RectangleGrid"
basebody_center_boundary = Curve(generic_officebuilding_h_shape_rectangle.basebody_center_boundary_2)
basebody_center_zones_boundary = Curve(generic_officebuilding_h_shape_rectangle.basebody_center_zones_boundary_2)
basebody_center_zones_name = Text(generic_officebuilding_h_shape_rectangle.basebody_center_zones_name_2)
basebody_core_name = Text(generic_officebuilding_h_shape_rectangle.basebody_core_name_2)
basebody_fassade_right_line = Curve(generic_officebuilding_h_shape_rectangle.basebody_fassade_right_line_2)
basebody_fassade_left_line = Curve(generic_officebuilding_h_shape_rectangle.basebody_fassade_left_line_2)
arms_fassade_right_line = Curve(generic_officebuilding_h_shape_rectangle.arms_fassade_right_line_2)
arms_fassade_lower_name = Text(generic_officebuilding_h_shape_rectangle.arms_fassade_lower_name_2)
courtyard_lower = Surface(generic_officebuilding_h_shape_rectangle.courtyard_lower_3)
wings_boundary = Curve(generic_officebuilding_h_shape_rectangle.wings_boundary_2)
wings_name = Text(generic_officebuilding_h_shape_rectangle.wings_name_2)
basebody_center_name = Text(generic_officebuilding_h_shape_rectangle.basebody_center_name_2)
basebody_core_boundary = Curve(generic_officebuilding_h_shape_rectangle.basebody_core_boundary_2)
basebody_zone_wings_boundary = Curve(generic_officebuilding_h_shape_rectangle.basebody_zone_wings_boundary_2)
basebody_zone_wings_name = Text(generic_officebuilding_h_shape_rectangle.basebody_zone_wings_name_2)
arms_boundary = Curve(generic_officebuilding_h_shape_rectangle.arms_boundary_2)
arms_name = Text(generic_officebuilding_h_shape_rectangle.arms_name_2)
basebody_fassade_lower_line = Curve(generic_officebuilding_h_shape_rectangle.basebody_fassade_lower_line_2)
basebody_fassade_lower_name = Text(generic_officebuilding_h_shape_rectangle.basebody_fassade_lower_name_2)
basebody_fassade_upper_line = Curve(generic_officebuilding_h_shape_rectangle.basebody_fassade_upper_line_2)
basebody_fassade_upper_name = Text(generic_officebuilding_h_shape_rectangle.basebody_fassade_upper_name_2)
basebody_fassade_right_name = Text(generic_officebuilding_h_shape_rectangle.basebody_fassade_right_name_2)
basebody_fassade_left_name = Text(generic_officebuilding_h_shape_rectangle.basebody_fassade_left_name_2)
arms_fassade_left_line = Curve(generic_officebuilding_h_shape_rectangle.arms_fassade_left_line_2)
arms_fassade_left_name = Text(generic_officebuilding_h_shape_rectangle.arms_fassade_left_name_2)
arms_fassade_right_name = Text(generic_officebuilding_h_shape_rectangle.arms_fassade_right_name_2)
arms_fassade_lower_line = Curve(generic_officebuilding_h_shape_rectangle.arms_fassade_lower_line_2)
arms_fassade_upper_line = Curve(generic_officebuilding_h_shape_rectangle.arms_fassade_upper_line_2)
arms_fassade_upper_name = Text(generic_officebuilding_h_shape_rectangle.arms_fassade_upper_name_2)
boundary = Curve(generic_officebuilding_h_shape_rectangle.boundary_2)
courtyard_upper = Surface(generic_officebuilding_h_shape_rectangle.courtyard_upper_3)

list_18 = ValueList({"Windows": 0, "WindowBand": 1, "GlassFassade": 2}, selected="Windows")
basebody_wings_fassade_line = Curve(basebody_fassade_left_line)
basebody_wings_fassade_name = Text(basebody_fassade_right_name)
windowheight_7 = Number(Slider(2, range=0..10))
parapetheight_7 = Number(Slider(1.2, range=0..2))
windowtowall_perimeter_7 = Number(Slider(0.79, range=0..1))
windowwidth_7 = Number(Slider(2, range=0..10))
offsettosides_7 = Number(Slider(1, range=0..10))
windowtype_8 = Integer(list_18)
filter_49 = StreamFilter(Gate=filter_46, Stream0=windowwidth_7, Stream1=filter_42)
filter_50 = StreamFilter(Gate=filter_46, Stream0=parapetheight_7, Stream1=filter_43)
filter_51 = StreamFilter(Gate=filter_46, Stream0=windowheight_7, Stream1=filter_44)
filter_52 = StreamFilter(Gate=filter_46, Stream0=offsettosides_7, Stream1=filter_45)
filter_53 = StreamFilter(Gate=filter_46, Stream0=windowtowall_perimeter_7, Stream1=filter_47)
filter_54 = StreamFilter(Gate=filter_46, Stream0=windowtype_8, Stream1=filter_48)
windows = Windows(
    baseplane=baseplane_2,
    walls=basebody_wings_fassade_line,
    floorheight=floorheight_3,
    parapetheight=filter_50,
    windowheight=filter_51,
    windowwidth=filter_49,
    offsettosides=filter_52,
    constructionmethod=list_17,
    windowtowall_perimeter=filter_53,
    windowtype=filter_54)  # -> wall_2, windows_2, windowtowallratio_2, windowspointsonreferencecurve_2
trim = TrimTree(Tree=windows.windows_2, Depth=1)
basebody_fassade_left_fassade_windows_re = Curve(trim)  # "BaseBody-Fassade-Left-Fassade-Windows-Rectangle"
basebody_wings_left_fassade_windowtowall = Number(windows.windowtowallratio_2)  # "BaseBody-Wings-Left-Fassade-WindowToWallRatio"

list_19 = ValueList({"Windows": 0, "WindowBand": 1, "GlassFassade": 2}, selected="Windows")
arms_fassade_left_line_2 = Curve(arms_fassade_left_line)
arms_fassade_left_name_2 = Text(arms_fassade_left_name)
windowheight_8 = Number(Slider(1.5, range=0..10))
parapetheight_8 = Number(Slider(0.9, range=0..2))
windowwidth_8 = Number(Slider(1.25, range=0..10))
windowtowall_perimeter_8 = Number(Slider(0.5, range=0..1))
offsettosides_8 = Number(Slider(1, range=0..10))
windowtype_9 = Integer(list_19)
filter_55 = StreamFilter(Gate=filter_40, Stream0=windowwidth_8, Stream1=filter_36)
filter_56 = StreamFilter(Gate=filter_40, Stream0=parapetheight_8, Stream1=filter_37)
filter_57 = StreamFilter(Gate=filter_40, Stream0=windowheight_8, Stream1=filter_38)
filter_58 = StreamFilter(Gate=filter_40, Stream0=offsettosides_8, Stream1=filter_39)
filter_59 = StreamFilter(Gate=filter_40, Stream0=windowtowall_perimeter_8, Stream1=filter_35)
filter_60 = StreamFilter(Gate=filter_40, Stream0=windowtype_9, Stream1=filter_41)
windows_2 = Windows(
    baseplane=baseplane_2,
    walls=arms_fassade_left_line_2,
    floorheight=floorheight_3,
    parapetheight=filter_56,
    windowheight=filter_57,
    windowwidth=filter_55,
    offsettosides=filter_58,
    constructionmethod=list_17,
    windowtowall_perimeter=filter_59,
    windowtype=filter_60)  # -> wall_2, windows_2, windowtowallratio_2, windowspointsonreferencecurve_2
trim_2 = TrimTree(Tree=windows_2.windows_2, Depth=1)
arms_fassade_left_windows_rectangle = Curve(trim_2)
arms_fassade_left_windowtowallratio = Number(windows_2.windowtowallratio_2)

basebody_fassade_lower_line_2 = Curve(basebody_fassade_lower_line)
basebody_fassade_lower_name_2 = Text(basebody_fassade_lower_name)
windowheight_9 = Number(Slider(1.5, range=0..10))
parapetheight_9 = Number(Slider(0.9, range=0..2))
windowwidth_9 = Number(Slider(1.5, range=0..10))
windowtowall_perimeter_9 = Number(Slider(0.4, range=0..1))
offsettosides_9 = Number(Slider(1, range=0..10))
filter_61 = StreamFilter(Gate=filter_21, Stream0=windowwidth_9, Stream1=filter_24)
filter_62 = StreamFilter(Gate=filter_21, Stream0=windowheight_9, Stream1=filter_26)
filter_63 = StreamFilter(Gate=filter_21, Stream0=parapetheight_9, Stream1=filter_25)
filter_64 = StreamFilter(Gate=filter_21, Stream0=windowtype_7, Stream1=filter_22)
filter_65 = StreamFilter(Gate=filter_21, Stream0=windowtowall_perimeter_9, Stream1=filter_23)
filter_66 = StreamFilter(Gate=filter_21, Stream0=offsettosides_9, Stream1=filter_27)
windows_3 = Windows(
    baseplane=baseplane_2,
    walls=basebody_fassade_lower_line_2,
    floorheight=floorheight_3,
    parapetheight=filter_63,
    windowheight=filter_62,
    windowwidth=filter_61,
    offsettosides=filter_66,
    constructionmethod=list_17,
    windowtowall_perimeter=filter_65,
    windowtype=filter_64)  # -> wall_2, windows_2, windowtowallratio_2, windowspointsonreferencecurve_2
trim_3 = TrimTree(Tree=windows_3.windows_2, Depth=1)
basebody_fassade_lower_windowtowallratio = Number(windows_3.windowtowallratio_2)
basebody_fassade_lower_windows_rectangle = Curve(trim_3)

list_20 = ValueList({"Windows": 0, "WindowBand": 1, "GlassFassade": 2}, selected="Windows")
basebody_fassade_upper_name_2 = Text(basebody_fassade_upper_name)
basebody_fassade_upper_line_2 = Curve(basebody_fassade_upper_line)
windowheight_10 = Number(Slider(2.3, range=0..10))
parapetheight_10 = Number(Slider(0.9, range=0..2))
windowtowall_perimeter_10 = Number(Slider(0.68, range=0..1))
windowwidth_10 = Number(Slider(2, range=0..10))
offsettosides_10 = Number(Slider(1, range=0..10))
windowtype_10 = Integer(list_20)
filter_67 = StreamFilter(Gate=filter_21, Stream0=windowwidth_10, Stream1=filter_24)
filter_68 = StreamFilter(Gate=filter_21, Stream0=parapetheight_10, Stream1=filter_25)
filter_69 = StreamFilter(Gate=filter_21, Stream0=windowheight_10, Stream1=filter_26)
filter_70 = StreamFilter(Gate=filter_21, Stream0=windowtowall_perimeter_10, Stream1=filter_23)
filter_71 = StreamFilter(Gate=filter_21, Stream0=offsettosides_10, Stream1=filter_27)
filter_72 = StreamFilter(Gate=filter_21, Stream0=windowtype_10, Stream1=filter_22)
windows_4 = Windows(
    baseplane=baseplane_2,
    walls=basebody_fassade_upper_line_2,
    floorheight=floorheight_3,
    parapetheight=filter_68,
    windowheight=filter_69,
    windowwidth=filter_67,
    offsettosides=filter_71,
    constructionmethod=list_17,
    windowtowall_perimeter=filter_70,
    windowtype=filter_72)  # -> wall_2, windows_2, windowtowallratio_2, windowspointsonreferencecurve_2
trim_4 = TrimTree(Tree=windows_4.windows_2, Depth=1)
basebody_fassade_upper_windows_rectangle = Curve(trim_4)
basebody_fassade_upper_windowtowallratio = Number(windows_4.windowtowallratio_2)

list_21 = ValueList({"Windows": 0, "WindowBand": 1, "GlassFassade": 2}, selected="Windows")
basebody_wings_fassade_name_2 = Text(basebody_fassade_right_name)
basebody_wings_fassade_line_2 = Curve(basebody_fassade_right_line)
windowheight_11 = Number(Slider(1.5, range=0..10))
parapetheight_11 = Number(Slider(0.9, range=0..2))
windowwidth_11 = Number(Slider(1.25, range=0..10))
windowtowall_perimeter_11 = Number(Slider(0.5, range=0..1))
offsettosides_11 = Number(Slider(1, range=0..10))
windowtype_11 = Integer(list_21)
filter_73 = StreamFilter(Gate=filter_46, Stream0=windowwidth_11, Stream1=filter_42)
filter_74 = StreamFilter(Gate=filter_46, Stream0=parapetheight_11, Stream1=filter_43)
filter_75 = StreamFilter(Gate=filter_46, Stream0=windowheight_11, Stream1=filter_44)
filter_76 = StreamFilter(Gate=filter_46, Stream0=windowtowall_perimeter_11, Stream1=filter_47)
filter_77 = StreamFilter(Gate=filter_46, Stream0=offsettosides_11, Stream1=filter_45)
filter_78 = StreamFilter(Gate=filter_46, Stream0=windowtype_11, Stream1=filter_48)
windows_5 = Windows(
    baseplane=baseplane_2,
    walls=basebody_wings_fassade_line_2,
    floorheight=floorheight_3,
    parapetheight=filter_74,
    windowheight=filter_75,
    windowwidth=filter_73,
    offsettosides=filter_77,
    constructionmethod=list_17,
    windowtowall_perimeter=filter_76,
    windowtype=filter_78)  # -> wall_2, windows_2, windowtowallratio_2, windowspointsonreferencecurve_2
trim_5 = TrimTree(Tree=windows_5.windows_2, Depth=1)
basebody_fassade_right_windows_rectangle = Curve(trim_5)
basebody_fassade_right_windowtowallratio = Number(windows_5.windowtowallratio_2)

list_22 = ValueList({"Windows": 0, "WindowBand": 1, "GlassFassade": 2}, selected="WindowBand")
arms_fassade_upper_line_2 = Curve(arms_fassade_upper_line)
arms_fassade_upper_name_2 = Text(arms_fassade_upper_name)
windowheight_12 = Number(Slider(2, range=0..10))
parapetheight_12 = Number(Slider(1.2, range=0..2))
windowwidth_12 = Number(Slider(2, range=0..10))
windowtowall_perimeter_12 = Number(Slider(0.68, range=0..1))
offsettosides_12 = Number(Slider(1, range=0..10))
windowtype_12 = Integer(list_22)
filter_79 = StreamFilter(Gate=filter_34, Stream0=parapetheight_12, Stream1=filter_31)
filter_80 = StreamFilter(Gate=filter_34, Stream0=windowheight_12, Stream1=filter_32)
filter_81 = StreamFilter(Gate=filter_34, Stream0=windowwidth_12, Stream1=filter_30)
filter_82 = StreamFilter(Gate=filter_34, Stream0=offsettosides_12, Stream1=filter_33)
filter_83 = StreamFilter(Gate=filter_34, Stream0=windowtowall_perimeter_12, Stream1=filter_29)
filter_84 = StreamFilter(Gate=filter_34, Stream0=windowtype_12, Stream1=filter_28)
windows_6 = Windows(
    baseplane=baseplane_2,
    walls=arms_fassade_upper_line_2,
    floorheight=floorheight_3,
    parapetheight=filter_79,
    windowheight=filter_80,
    windowwidth=filter_81,
    offsettosides=filter_82,
    constructionmethod=list_17,
    windowtowall_perimeter=filter_83,
    windowtype=filter_84)  # -> wall_2, windows_2, windowtowallratio_2, windowspointsonreferencecurve_2
trim_6 = TrimTree(Tree=windows_6.windows_2, Depth=1)
arms_fassade_upper_windows_rectangle = Curve(trim_6)
arms_fassade_upper_windowtowallratio = Number(windows_6.windowtowallratio_2)

list_23 = ValueList({"Windows": 0, "WindowBand": 1, "GlassFassade": 2}, selected="Windows")
arms_fassade_lower_line_2 = Curve(arms_fassade_lower_line)
arms_fassade_lower_name_2 = Text(arms_fassade_lower_name)
windowtowall_perimeter_13 = Number(Slider(0.54, range=0..1))
windowheight_13 = Number(Slider(1.5, range=0..10))
parapetheight_13 = Number(Slider(1.5, range=0..2))
windowwidth_13 = Number(Slider(1.25, range=0..10))
offsettosides_13 = Number(Slider(1, range=0..10))
windowtype_13 = Integer(list_23)
filter_85 = StreamFilter(Gate=filter_34, Stream0=windowwidth_13, Stream1=filter_30)
filter_86 = StreamFilter(Gate=filter_34, Stream0=parapetheight_13, Stream1=filter_31)
filter_87 = StreamFilter(Gate=filter_34, Stream0=windowheight_13, Stream1=filter_32)
filter_88 = StreamFilter(Gate=filter_34, Stream0=windowtowall_perimeter_13, Stream1=filter_29)
filter_89 = StreamFilter(Gate=filter_34, Stream0=offsettosides_13, Stream1=filter_33)
filter_90 = StreamFilter(Gate=filter_34, Stream0=windowtype_13, Stream1=filter_28)
windows_7 = Windows(
    baseplane=baseplane_2,
    walls=arms_fassade_lower_line_2,
    floorheight=floorheight_3,
    parapetheight=filter_86,
    windowheight=filter_87,
    windowwidth=filter_85,
    offsettosides=filter_89,
    constructionmethod=list_17,
    windowtowall_perimeter=filter_88,
    windowtype=filter_90)  # -> wall_2, windows_2, windowtowallratio_2, windowspointsonreferencecurve_2
trim_7 = TrimTree(Tree=windows_7.windows_2, Depth=1)
arms_fassade_lower_windows_rectangle = Curve(trim_7)
arms_fassade_lower_windowtowallratio = Number(windows_7.windowtowallratio_2)

trim_8 = TrimTree(Tree=basebody_zone_wings_boundary, Depth=1)
trim_9 = TrimTree(Tree=arms_boundary, Depth=1)
trim_10 = TrimTree(Tree=basebody_center_zones_boundary, Depth=1)
amp_7 = Amplitude(Vector=zvec, Amplitude=floorheight_3)
trim_11 = TrimTree(Tree=trim_9, Depth=1)
boundary_2 = BoundarySurfaces(Edges=trim_8)
item = ListItem(List=trim_8, Index=0, Wrap=True)  # -> Item, Item1
item_2 = ListItem(List=trim_11, Index=0, Wrap=True)  # -> Item, Item1, Item2, Item3
item_3 = ListItem(List=trim_10, Index=0, Wrap=True)  # -> Item, Item1
mrg_a = MergeSeperatlyAppend(
    x=basebody_core_boundary,
    v=item_3.Item,
    y=item_3.Item1,
    z=item.Item,
    u=item.Item1,
    w=item_2.Item,
    s=item_2.Item1,
    t=item_2.Item3,
    xx=item_2.Item2)  # -> Mrgd; inputs x: tree, v: tree, y: tree, z: tree, u: tree, w: tree, s: tree, t: tree, xx: tree; same code as mrg_a
boundary_3 = BoundarySurfaces(Edges=mrg_a)
trim_12 = TrimTree(Tree=boundary_3, Depth=1)
extr = Extrude(Base=trim_12, Direction=amp_7)  # -> graft(Extrusion)
zones_boundary = Curve(mrg_a)
zones_volume = Brep(extr)

trim_13 = TrimTree(Tree=arms_name, Depth=1)
trim_14 = TrimTree(Tree=basebody_zone_wings_name, Depth=1)
trim_15 = TrimTree(Tree=trim_13, Depth=1)
trim_16 = TrimTree(Tree=basebody_center_zones_name, Depth=1)
item_4 = ListItem(List=trim_15, Index=0, Wrap=True)  # -> Item, Item1, Item2, Item3
item_5 = ListItem(List=trim_16, Index=0, Wrap=True)  # -> Item, Item1
item_6 = ListItem(List=trim_14, Index=0, Wrap=True)  # -> Item, Item1
trim_17 = TrimTree(Tree=basebody_core_name, Depth=1)
mrg_a_2 = MergeSeperatlyAppend(
    x=trim_17,
    v=item_5.Item,
    y=item_5.Item1,
    z=item_6.Item,
    u=item_6.Item1,
    w=item_4.Item,
    s=item_4.Item1,
    t=item_4.Item3,
    xx=item_4.Item2)  # -> Mrgd; inputs x: tree, v: tree, y: tree, z: tree, u: tree, w: tree, s: tree, t: tree, xx: tree; same code as mrg_a
zones_name = Text(mrg_a_2)

merge = Merge(
    Data1=generic_officebuilding_h_shape_rectangle.basebody_center_internal_walls_2,
    Data2=generic_officebuilding_h_shape_rectangle.arm_lower_intneral_walls_3)
internal_walls = Curve(merge)

tstat = TreeStatistics(Tree=trim)  # -> Paths, Length, Count
series_3 = Series(Start="1", Step=1, Count=tstat.Length)
concat_2 = Concatenate(
    FragmentC=basebody_wings_fassade_name,
    FragmentA=namingschema_delimiter,
    FragmentD=namingschema_window_name,
    FragmentE=namingschema_delimiter,
    FragmentB=series_3)
match_2 = MatchTree(Tree=concat_2, Guide=trim)
basebody_wings_left_fassade_windows_name = Text(match_2)

tstat_2 = TreeStatistics(Tree=trim_5)  # -> Paths, Length, Count
series_4 = Series(Start="1", Step=1, Count=tstat_2.Length)
concat_3 = Concatenate(
    FragmentC=basebody_wings_fassade_name_2,
    FragmentA=namingschema_delimiter,
    FragmentD=namingschema_window_name,
    FragmentE=namingschema_delimiter,
    FragmentB=series_4)
match_3 = MatchTree(Tree=concat_3, Guide=trim_5)
basebody_fassade_right_windows_name = Text(match_3)

tstat_3 = TreeStatistics(Tree=trim_6)  # -> Paths, Length, Count
series_5 = Series(Start="1", Step=1, Count=tstat_3.Length)
concat_4 = Concatenate(
    FragmentC=arms_fassade_upper_name_2,
    FragmentA=namingschema_delimiter,
    FragmentD=namingschema_window_name,
    FragmentE=namingschema_delimiter,
    FragmentB=series_5)
match_4 = MatchTree(Tree=concat_4, Guide=trim_6)
arms_fassade_upper_windows_name = Text(match_4)

tstat_4 = TreeStatistics(Tree=trim_7)  # -> Paths, Length, Count
series_6 = Series(Start="1", Step=1, Count=tstat_4.Length)
concat_5 = Concatenate(
    FragmentC=arms_fassade_lower_name_2,
    FragmentA=namingschema_delimiter,
    FragmentD=namingschema_window_name,
    FragmentE=namingschema_delimiter,
    FragmentB=series_6)
match_5 = MatchTree(Tree=concat_5, Guide=trim_7)
arms_fassade_lower_windows_name = Text(match_5)

tstat_5 = TreeStatistics(Tree=trim_4)  # -> Paths, Length, Count
series_7 = Series(Start="1", Step=1, Count=tstat_5.Length)
concat_6 = Concatenate(
    FragmentC=basebody_fassade_upper_name_2,
    FragmentA=namingschema_delimiter,
    FragmentD=namingschema_window_name,
    FragmentE=namingschema_delimiter,
    FragmentB=series_7)
match_6 = MatchTree(Tree=concat_6, Guide=trim_4)
basebody_fassade_upper_windows_name = Text(match_6)

tstat_6 = TreeStatistics(Tree=trim_3)  # -> Paths, Length, Count
series_8 = Series(Start="1", Step=1, Count=tstat_6.Length)
concat_7 = Concatenate(
    FragmentC=basebody_fassade_lower_name_2,
    FragmentA=namingschema_delimiter,
    FragmentD=namingschema_window_name,
    FragmentE=namingschema_delimiter,
    FragmentB=series_8)
match_7 = MatchTree(Tree=concat_7, Guide=trim_3)
basebody_fassade_lower_windows_name = Text(match_7)

list_24 = ValueList({"Windows": 0, "WindowBand": 1, "GlassFassade": 2}, selected="Windows")
arms_fassade_right_line_2 = Curve(arms_fassade_right_line)
arms_fassade_right_name_2 = Text(arms_fassade_right_name)
windowtype_14 = Integer(list_24)
windowheight_14 = Number(Slider(2, range=0..10))
parapetheight_14 = Number(Slider(1.2, range=0..2))
windowwidth_14 = Number(Slider(2, range=0..10))
windowtowall_perimeter_14 = Number(Slider(0.68, range=0..1))
offsettosides_14 = Number(Slider(1, range=0..10))
filter_91 = StreamFilter(Gate=filter_40, Stream0=windowheight_14, Stream1=filter_38)
filter_92 = StreamFilter(Gate=filter_40, Stream0=windowwidth_14, Stream1=filter_36)
filter_93 = StreamFilter(Gate=filter_40, Stream0=offsettosides_14, Stream1=filter_39)
filter_94 = StreamFilter(Gate=filter_40, Stream0=windowtowall_perimeter_14, Stream1=filter_35)
filter_95 = StreamFilter(Gate=filter_40, Stream0=windowtype_14, Stream1=filter_41)

filter_96 = StreamFilter(Gate=filter_40, Stream0=parapetheight_14, Stream1=filter_37)

windows_8 = Windows(
    baseplane=baseplane_2,
    walls=arms_fassade_right_line_2,
    floorheight=floorheight_3,
    parapetheight=filter_96,
    windowheight=filter_91,
    windowwidth=filter_92,
    offsettosides=filter_93,
    constructionmethod=list_17,
    windowtowall_perimeter=filter_94,
    windowtype=filter_95)  # -> wall_2, windows_2, windowtowallratio_2, windowspointsonreferencecurve_2
trim_18 = TrimTree(Tree=windows_8.windows_2, Depth=1)
arms_fassade_right_windows_rectangle = Curve(trim_18)
arms_fassade_right_windowtowallratio = Number(windows_8.windowtowallratio_2)

tstat_7 = TreeStatistics(Tree=trim_18)  # -> Paths, Length, Count
series_9 = Series(Start="1", Step=1, Count=tstat_7.Length)
concat_8 = Concatenate(
    FragmentC=arms_fassade_right_name_2,
    FragmentA=namingschema_delimiter,
    FragmentD=namingschema_window_name,
    FragmentE=namingschema_delimiter,
    FragmentB=series_9)
match_8 = MatchTree(Tree=concat_8, Guide=trim_18)
arms_fassade_right_windows_name = Text(match_8)

tstat_8 = TreeStatistics(Tree=trim_2)  # -> Paths, Length, Count
series_10 = Series(Start="1", Step=1, Count=tstat_8.Length)

match_9 = MatchTree(Tree=series_10, Guide=trim_2)

concat_9 = Concatenate(
    FragmentC=arms_fassade_left_name_2,
    FragmentA=namingschema_delimiter,
    FragmentD=namingschema_window_name,
    FragmentE=namingschema_delimiter,
    FragmentB=match_9)
match_10 = MatchTree(Tree=concat_9, Guide=trim_2)
arms_fassade_left_windows_name = Text(match_10)

trim_19 = TrimTree(Tree=basebody_fassade_lower_windowtowallratio, Depth=1)
trim_20 = TrimTree(Tree=basebody_fassade_lower_windows_name, Depth=1)
trim_21 = TrimTree(Tree=basebody_fassade_lower_windows_rectangle, Depth=1)
trim_22 = TrimTree(Tree=basebody_fassade_right_windowtowallratio, Depth=1)
trim_23 = TrimTree(Tree=basebody_fassade_upper_windowtowallratio, Depth=1)
trim_24 = TrimTree(Tree=basebody_fassade_upper_windows_rectangle, Depth=1)
trim_25 = TrimTree(Tree=basebody_fassade_upper_windows_name, Depth=1)
trim_26 = TrimTree(Tree=basebody_fassade_right_windows_rectangle, Depth=1)
trim_27 = TrimTree(Tree=basebody_fassade_right_windows_name, Depth=1)
trim_28 = TrimTree(Tree=basebody_wings_left_fassade_windowtowall, Depth=1)
trim_29 = TrimTree(Tree=basebody_fassade_left_fassade_windows_re, Depth=1)
trim_30 = TrimTree(Tree=basebody_wings_left_fassade_windows_name, Depth=1)
merge_2 = Merge(Data1=arms_fassade_lower_windows_rectangle, Data2=arms_fassade_upper_windows_rectangle)
merge_3 = Merge(Data1=arms_fassade_lower_windowtowallratio, Data2=arms_fassade_upper_windowtowallratio)
merge_4 = Merge(Data1=arms_fassade_lower_windows_name, Data2=arms_fassade_upper_windows_name)
merge_5 = Merge(Data1=arms_fassade_right_windowtowallratio, Data2=merge_3, Data3=arms_fassade_left_windowtowallratio)
merge_6 = Merge(Data1=arms_fassade_right_windows_rectangle, Data2=merge_2, Data3=arms_fassade_left_windows_rectangle)
merge_7 = Merge(Data1=arms_fassade_right_windows_name, Data2=merge_4, Data3=arms_fassade_left_windows_name)
mrg_a_3 = MergeSeperatlyAppend(y=trim_21, z=trim_24, u=trim_26, v=trim_29)  # -> Mrgd; inputs x: tree, y: tree, z: tree, u: tree, v: tree, w: tree, s: tree, t: tree, xx: tree, xy: tree; same code as mrg_a
mrg_a_4 = MergeSeperatlyAppend(y=trim_19, z=trim_23, u=trim_22, v=trim_28)  # -> Mrgd; inputs x: tree, y: tree, z: tree, u: tree, v: tree, w: tree, s: tree, t: tree, xx: tree, xy: tree; same code as mrg_a
mrg_a_5 = MergeSeperatlyAppend(y=trim_20, z=trim_25, u=trim_27, v=trim_30)  # -> Mrgd; inputs x: tree, y: tree, z: tree, u: tree, v: tree, w: tree, s: tree, t: tree, xx: tree, xy: tree; same code as mrg_a
adjusttree = AdjustTree(arm_data=merge_5)
adjusttree_2 = AdjustTree(arm_data=merge_7)
adjusttree_3 = AdjustTree(arm_data=merge_6)
arms_fassades_windows_rectangle = Curve(adjusttree_3)
arms_fassades_windows_name = Text(adjusttree_2)
arms_fassade_windowtowallratio = Number(adjusttree)
merge_8 = Merge(Data1=mrg_a_4, Data2=arms_fassade_windowtowallratio)
merge_9 = Merge(Data1=mrg_a_3, Data2=arms_fassades_windows_rectangle)
merge_10 = Merge(Data1=mrg_a_5, Data2=arms_fassades_windows_name)
arms_fassade_windowtowallratio_2 = Number(merge_8)
zones_windows_rectangle = Curve(merge_9)
zones_windows_name = Text(merge_10)

trim_31 = TrimTree(Tree=arms_fassade_lower_windowtowallratio, Depth=1)
trim_32 = TrimTree(Tree=arms_fassade_right_windowtowallratio, Depth=1)
trim_33 = TrimTree(Tree=arms_fassade_left_windowtowallratio, Depth=1)
trim_34 = TrimTree(Tree=arms_fassade_upper_windowtowallratio, Depth=1)
trim_35 = TrimTree(Tree=trim_31, Depth=1)
trim_36 = TrimTree(Tree=trim_32, Depth=1)
trim_37 = TrimTree(Tree=trim_33, Depth=1)
trim_38 = TrimTree(Tree=trim_34, Depth=1)
number_slider_15 = Slider(2, range=0..10)
merge_11 = Merge(Data1=trim_19, Data2=trim_35)
merge_12 = Merge(Data1=trim_22, Data2=trim_36)
merge_13 = Merge(Data1=trim_28, Data2=trim_37)
merge_14 = Merge(Data1=trim_23, Data2=trim_38)
trim_39 = TrimTree(Tree=arms_fassade_windowtowallratio_2, Depth=1)
avr = Average(Input=trim_39)
avr_2 = Average(Input=merge_11)
avr_3 = Average(Input=merge_12)
avr_4 = Average(Input=merge_13)
avr_5 = Average(Input=merge_14)
building_fassade_windowtowallratio = Number(avr)
building_fassade_upper_windowtowallratio = Number(avr_5)
building_fassade_lower_windowtowallratio = Number(avr_2)
building_fassade_right_windowtowallratio = Number(avr_3)
building_fassade_left_windowtowallratio = Number(avr_4)
roundd = RoundToDecimalPlace(NumberX=avr_5, DecimalPlace=number_slider_15, RoundType=0)  # -> Rounded, Difference
roundd_2 = RoundToDecimalPlace(NumberX=avr, DecimalPlace=number_slider_15, RoundType=0)  # -> Rounded, Difference
roundd_3 = RoundToDecimalPlace(NumberX=avr_2, DecimalPlace=number_slider_15, RoundType=0)  # -> Rounded, Difference
roundd_4 = RoundToDecimalPlace(NumberX=avr_3, DecimalPlace=number_slider_15, RoundType=0)  # -> Rounded, Difference
roundd_5 = RoundToDecimalPlace(NumberX=avr_4, DecimalPlace=number_slider_15, RoundType=0)  # -> Rounded, Difference
building_fassade_upper_windowtowallratio_2 = Number(roundd.Rounded)
building_fassade_windowtowallratio_2 = Number(roundd_2.Rounded)
building_fassade_lower_windowtowallratio_2 = Number(roundd_3.Rounded)
building_fassade_right_windowtowallratio_2 = Number(roundd_4.Rounded)
building_fassade_left_windowtowallratio_2 = Number(roundd_5.Rounded)

fassade_left_windowtowallratio = Panel(building_fassade_left_windowtowallratio_2)
fassade_total_windowtowallratio = Panel(building_fassade_windowtowallratio_2)
fassade_lower_windowtowallratio = Panel(building_fassade_lower_windowtowallratio_2)
fassade_upper_windowtowallratio = Panel(building_fassade_upper_windowtowallratio_2)
fassade_right_windowtowallratio = Panel(building_fassade_right_windowtowallratio_2)

numberoffloors_underground = Number(Slider(1, range=0..10))
numberoffloors_3 = Number(numberoffloors_2)
courtyard_lower_2 = Surface(courtyard_lower)
courtyard_upper_2 = Surface(courtyard_upper)
floorplantobuilding = FloorPlanToBuilding(
    baseplane=baseplane,
    numberoffloors=numberoffloors_3,
    floor_count_underground=numberoffloors_underground,
    floorheight=floorheight_3,
    courtyard_upper=courtyard_upper_2,
    courtyard_lower=courtyard_lower_2,
    zones_box=zones_volume,
    zones_name=zones_name,
    windows_rectangle=zones_windows_rectangle,
    windows_name=zones_windows_name,
    namingschema_floor_name="Floor",
    namingschema_underground_name="Underground",
    namingschema_fassade_name="Fassade",
    namingschema_roof_name="Roof",
    namingschema_delimiter=namingschema_delimiter)  # -> zones_allflors_2, zones_allflors_name_2, windows_allfloors_rectangle_2, windows_allfloors_name_2, zones_underground_2, zones_underground_name_2, courtyard_upper_volume_2, courtyard_lower_volume_2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
windows_9 = Brep(floorplantobuilding.windows_allfloors_rectangle_2)
zones_underground = Brep(floorplantobuilding.zones_underground_2)
zones_underground_name = Text(floorplantobuilding.zones_underground_name_2)
courtyard_upper_volume = Brep(floorplantobuilding.courtyard_upper_volume_2)
courtyard_upper_fassade = Surface(floorplantobuilding.courtyard_upper_fassade_2)
courtyard_lower_roof = Surface(floorplantobuilding.courtyard_lower_roof_2)
zones = Brep(floorplantobuilding.zones_allflors_2)
zones_name_2 = Text(floorplantobuilding.zones_allflors_name_2)
courtyard_lower_volume = Brep(floorplantobuilding.courtyard_lower_volume_2)
courtyard_lower_fassade = Surface(floorplantobuilding.courtyard_lower_fassade_2)
courtyard_upper_roof = Surface(floorplantobuilding.courtyard_upper_roof_2)
windows_name = Text(floorplantobuilding.windows_allfloors_name_2)

context_bake = ContextBake(FassadeUpperWindowToWallRatio=building_fassade_upper_windowtowallratio_2)
context_bake_2 = ContextBake(FassadeTotalWindowToWallRatio=building_fassade_windowtowallratio_2)
context_bake_3 = ContextBake(FassadeLowerWindowToWallRatio=building_fassade_lower_windowtowallratio_2)
context_bake_4 = ContextBake(FassadeRightWindowToWallRatio=building_fassade_right_windowtowallratio_2)
context_bake_5 = ContextBake(FassadeLeftWindowToWallRatio=building_fassade_left_windowtowallratio_2)
context_print = ContextPrint(ZonesName=zones_name_2)
context_bake_6 = ContextBake(Geometry=zones)
context_bake_7 = ContextBake(Zones_Underground=zones_underground)
context_bake_8 = ContextBake(Courtyard_Upper_Volume=courtyard_upper_volume)
context_bake_9 = ContextBake(Courtyard_Lower_Volume=courtyard_lower_volume)
context_bake_10 = ContextBake(Courtyard_Upper_Fassade=courtyard_upper_fassade)
context_bake_11 = ContextBake(Courtyard_Lower_Fassade=courtyard_lower_fassade)
context_bake_12 = ContextBake(Courtyard_Upper_Roof=courtyard_upper_roof)
context_bake_13 = ContextBake(Courtyard_Lower_Roof=courtyard_lower_roof)
context_print_2 = ContextPrint(ZonesUndergroundName=zones_underground_name)
context_bake_14 = ContextBake(Geometry=windows_9)
context_print_3 = ContextPrint(WindowsName=windows_name)
windows_10 = Brep(windows_9)
windows_name_2 = Text(windows_name)
zones_underground_2 = Brep(zones_underground)
zones_underground_name_2 = Text(zones_underground_name)
courtyard_lower_volume_2 = Brep(courtyard_upper_volume)
courtyard_lower_volume_3 = Brep(courtyard_lower_volume)
courtyard_upper_fassade_2 = Surface(courtyard_upper_fassade)
courtyard_upper_roof_2 = Surface(courtyard_upper_roof)
courtyard_lower_roof_2 = Surface(courtyard_lower_roof)
zones_name_3 = Text(zones_name_2)
courtyard_lower_fassade_2 = Surface(courtyard_lower_fassade)
zones_2 = Brep(zones)

viewer = ParamViewer(zones_2)
viewer_2 = ParamViewer(zones_2)
viewer_3 = ParamViewer(zones_2)

number_slider_16 = Slider(2, range=0..10)
zones_3 = Brep(zones_2)
zones_name_4 = Text(zones_name_3)
windows_11 = Brep(windows_10)
windows_name_3 = Text(windows_name_2)
zones_underground_3 = Brep(zones_underground_2)
zones_underground_name_3 = Text(zones_underground_name_2)
courtyard_lower_volume_4 = Brep(courtyard_lower_volume_2)
courtyard_lower_volume_5 = Brep(courtyard_lower_volume_3)
courtyard_upper_fassade_3 = Surface(courtyard_upper_fassade_2)
courtyard_lower_fassade_3 = Surface(courtyard_lower_fassade_2)
courtyard_upper_roof_3 = Surface(courtyard_upper_roof_2)
courtyard_lower_roof_3 = Surface(courtyard_lower_roof_2)
boundary_4 = Curve(generic_officebuilding_h_shape_rectangle.boundary_2)
courtyard_lower_3 = Surface(generic_officebuilding_h_shape_rectangle.courtyard_lower_3)
courtyard_upper_3 = Surface(generic_officebuilding_h_shape_rectangle.courtyard_upper_3)
trim_40 = TrimTree(Tree=zones_3, Depth=number_slider_16)
merge_15 = Merge(Data1=courtyard_upper_3, Data2=courtyard_lower_3)
bbox = BoundingBox(Content=trim_40, Plane=PlaneXY(0, 0, 0), UnionBox=True)  # -> Box, Box_2
genes_6 = GenePool(Decimals=1, Maximum=10, Minimum=0, Value=[1.8, 3.7])
wires = BrepWireframe(Brep=zones_3, Density=-1)
wires_2 = BrepWireframe(Brep=windows_11, Density=-1)
wires_3 = BrepWireframe(Brep=zones_underground_3, Density=-1)
volume = Volume(Geometry=bbox.Box)  # -> Volume, Centroid
dash = DashPattern(Curve=wires_3, Pattern=genes_6)  # -> Dashes, Gaps
preview = CustomPreview(Geometry=flatten(wires), Material=ColourSwatch(SwatchColor=RGB(191, 216, 255)))
preview_2 = CustomPreview(Geometry=flatten(zones_3), Material=swatch_2)
preview_3 = CustomPreview(Geometry=flatten(merge_15), Material=swatch_2)
preview_4 = CustomPreview(Geometry=flatten(zones_underground_3), Material=ColourSwatch(SwatchColor=RGBA(240, 117, 24, 12)))

trim_41 = TrimTree(Tree=windows_11, Depth=number_slider_16)

scale = Scale(Geometry=trim_41, Center=volume.Centroid, Factor=Slider(1.001, range=0..10))  # -> Geometry, Transform
scale_2 = Scale(Geometry=trim_41, Center=volume.Centroid, Factor=Slider(0.999, range=0..10))  # -> Geometry, Transform
merge_16 = Merge(Data1=scale.Geometry, Data2=scale_2.Geometry)
preview_5 = CustomPreview(Geometry=flatten(merge_16), Material=ColourSwatch(SwatchColor=RGB(0, 166, 157)))

# ==== cluster MessiBasePlanes
normalmessi = ClusterInput()
baseplane = ClusterInput()
movingx = ClusterInput()
movingy = ClusterInput()
movingz = ClusterInput()
graftedmessi = ClusterInput()
anglex = ClusterInput()
angley = ClusterInput()
baseplane_2 = Plane(baseplane)
normalmessi_2 = Boolean(normalmessi)
graftedmessi_2 = Boolean(graftedmessi)
moverotateplane = MoveRotatePlane(baseplane=baseplane_2, movingx=movingx, movingy=movingy, movingz=movingz, anglex=anglex, angley=angley)
neg = Negative(Value=Slider(1, range=0..1))
merge = Merge(Data1=baseplane_2, Data2=moverotateplane)
lito3p = ListInto3Parts(ListToSlice=merge, StartIndex=Slider(2, range=0..10), EndIndex=neg)  # -> FilteredList, ItemsBefore, ItemsAfter; inputs ListToSlice: tree, StartIndex: tree of Int32, EndIndex: tree of Int32
# ---------- lito3p: Python ----------
if ghenv.Component.RunCount<2:
    __author__ = "Ueli Saluz"
    __version__ = "2020.05.28"
    
    ghenv.Component.Name = "ListInto3Parts"
    ghenv.Component.NickName = "LiTo3P"
    ghenv.Component.Description = "Slice list into 3 parts. All lists are sliced with the same indices."
    ghenv.Component.Message = "VER 1.5"

from System import Object
from Grasshopper import DataTree

def filterList(listToFilter,startIndex,endIndex):
    if (((startIndex == 0) or (startIndex is None)) and ((endIndex == 0)or (endIndex is None))) or (endIndex <= startIndex and endIndex > 0):
        return (None,None,listToFilter)
    elif (startIndex == 0) or (startIndex is None):
        return (listToFilter[:endIndex],None,listToFilter[endIndex:])
    else:
        return (listToFilter[startIndex:endIndex],listToFilter[:startIndex],listToFilter[endIndex:])

if __name__ == "__main__":
    FilteredList = DataTree[Object]()
    ItemsBefore = DataTree[Object]()
    ItemsAfter = DataTree[Object]()
    
    for path in ListToSlice.Paths:
        listBranch = ListToSlice.Branch(path)
        pyList = list(listBranch)   #Convert .Net List to Python
        try: #terrible way of writing code but if I set the list to list access the performance decreases massivly due to many calls
            startIndex = StartIndex.Branch(path)
            startIndex = startIndex[0]
        except Exception:
            try:
                startIndex = StartIndex.Branch(0)
                startIndex = startIndex[0]
            except Exception:
                startIndex = 0
        try:
            endIndex = EndIndex.Branch(path)
            endIndex = endIndex[0]
        except Exception:
            try:
                endIndex = EndIndex.Branch(0)
                endIndex = endIndex[0]
            except Exception:
                endIndex = len(pyList)
        filtList=filterList(pyList,startIndex,endIndex)
        if filtList[0]:
            FilteredList.AddRange(filtList[0],path)
        if filtList[1]:
            ItemsBefore.AddRange(filtList[1],path)
        if filtList[2]:
            ItemsAfter.AddRange(filtList[2],path)
# ---------- end lito3p ----------
mrg_p = MergeSeperatlyPrepend(y=lito3p.ItemsBefore)  # -> Mrgd; inputs x: tree, z: tree, u: tree, y: tree
# ---------- mrg_p: Python ----------
if ghenv.Component.RunCount<2:
    __author__ = "Ueli Saluz"
    __version__ = "2020.05.28"
    
    ghenv.Component.Name = "MergeSeperatly(Prepend)"
    ghenv.Component.NickName = "Mrg(P)"
    ghenv.Component.Description = "Merge inputs seperatly on a new path. Prepend index of input parameter for distincting."
    ghenv.Component.Message = "VER 1.0"

from System import Object
from Grasshopper import DataTree
from Grasshopper.Kernel import GH_ParamAccess as Access

if __name__ == "__main__":
    Mrgd = DataTree[Object]()
    access = Access()
    
    for input in ghenv.Component.Params.Input:  #set all Inputaccess to Tree Access
        input.Access = access.tree
    
    for i,input in enumerate(ghenv.Component.Params.Input):
        for j,source in enumerate(input.Sources):
            for path in source.VolatileData.Paths:
                Mrgd.AddRange(source.VolatileData[path],path.PrependElement(i))
# ---------- end mrg_p ----------
mrg_a = MergeSeperatlyAppend(z=lito3p.ItemsAfter)  # -> graft(Mrgd); inputs x: tree, y: tree, z: tree
# ---------- mrg_a: Python ----------
if ghenv.Component.RunCount<2:
    __author__ = "Ueli Saluz"
    __version__ = "2020.05.28"
    
    ghenv.Component.Name = "MergeSeperatly(Append)"
    ghenv.Component.NickName = "Mrg(A)"
    ghenv.Component.Description = "Merge inputs seperatly on a new path. Append index of input parameter for distincting."
    ghenv.Component.Message = "VER 1.0"

from System import Object
from Grasshopper import DataTree
from Grasshopper.Kernel import GH_ParamAccess as Access

if __name__ == "__main__":
    Mrgd = DataTree[Object]()
    access = Access()
    
    for input in ghenv.Component.Params.Input:  #set all Inputaccess to Tree Access
        input.Access = access.tree
    
    for i,input in enumerate(ghenv.Component.Params.Input):
        for j,source in enumerate(input.Sources):
            for path in source.VolatileData.Paths:
                Mrgd.AddRange(source.VolatileData[path],path.AppendElement(i))
# ---------- end mrg_a ----------
merge_2 = Merge(Data1=mrg_p, Data2=simplify(graft(lito3p.FilteredList)), Data3=mrg_a)
xy = XYPlane(Origin=Point(0, 0, 0))  # -> flatten(Plane)
filter = StreamFilter(Gate=graftedmessi_2, Stream0=merge_2, Stream1=graft(merge_2))
filter_2 = StreamFilter(Gate=normalmessi_2, Stream0=xy, Stream1=filter)
baseplanes = Plane(filter_2)
baseplanes_2 = ClusterOutput(baseplanes)

# ==== cluster Generic_OfficeBuilding_HShape_RectangleGrid
arm_upper_left_latitudinal_numberofsegme = ClusterInput()  # "Arm-Upper-Left-Latitudinal-NumberOfSegments"
arm_lower_left_longitudinal_numberofsegm = ClusterInput()  # "Arm-Lower-Left-Longitudinal-NumberOfSegments"
arm_lower_lef_latitudinal_numberofsegmen = ClusterInput()  # "Arm-Lower-Lef-Latitudinal-NumberOfSegments"
arm_upper_left_longitudinal_numberofsegm = ClusterInput()  # "Arm-Upper-Left-Longitudinal-NumberOfSegments"
arm_upper_right_longitudinal_numberofseg = ClusterInput()  # "Arm-Upper-Right-Longitudinal-NumberOfSegments"
arm_upper_right_latitudinal_numberofsegm = ClusterInput()  # "Arm-Upper-Right-Latitudinal-NumberOfSegments"
namingschema_center_name = ClusterInput()
namingschema_core_name = ClusterInput()
basebody_inside_latditudinal_numberofseg = ClusterInput()  # "BaseBody-Inside-Latditudinal-NumberOfSegments"
namingschema_arm_name = ClusterInput()
namingschema_fassade_name = ClusterInput()
building_longitudinal_numberofsegments = ClusterInput()
arm_lower_right_longitudinal_numberofseg = ClusterInput()  # "Arm-Lower-Right-Longitudinal-NumberOfSegments"
arm_lower_right_latitudinal_numberofsegm = ClusterInput()  # "Arm-Lower-Right-Latitudinal-NumberOfSegments"
namingschema_wing_name = ClusterInput()
namingschema_building_name = ClusterInput()
namingschema_delimiter = ClusterInput()
namingschema_directions = ClusterInput()
rasterlength_x = ClusterInput()
rasterlength_y = ClusterInput()
baseplane = ClusterInput()

namingschema_delimiter_2 = Text(namingschema_delimiter)
namingschema_wing_name_2 = Text(namingschema_wing_name)
namingschema_center_name_2 = Text(namingschema_center_name)
namingschema_building_name_2 = Text(namingschema_building_name)
namingschema_core_name_2 = Text(namingschema_core_name)
namingschema_arm_name_2 = Text(namingschema_arm_name)
namingschema_fassade_name_2 = Text(namingschema_fassade_name)
namingschema_directions_2 = Text(namingschema_directions)
item = ListItem(List=namingschema_directions_2, Index=0, Wrap=True)  # -> Item, Item1, Item2, Item3

rasterlength_x_2 = Number(rasterlength_x)
rasterlength_y_2 = Number(rasterlength_y)

arm_lower_left_longitudinal_numberofsegm_2 = Number(arm_lower_left_longitudinal_numberofsegm)  # "Arm-Lower-Left-Longitudinal-NumberOfSegments"
arm_lower_lef_latitudinal_numberofsegmen_2 = Number(arm_lower_lef_latitudinal_numberofsegmen)  # "Arm-Lower-Lef-Latitudinal-NumberOfSegments"
expression = Expression(x=arm_lower_left_longitudinal_numberofsegm_2, y=rasterlength_x_2, Expression="x*y")
expression_2 = Expression(x=arm_lower_lef_latitudinal_numberofsegmen_2, y=rasterlength_y_2, Expression="x*y")
arm_lower_left_latitudinal_totallength = Number(expression_2)
arm_lower_left_longitudinal_totallength = Number(expression)

arm_upper_left_latitudinal_numberofsegme_2 = Number(arm_upper_left_latitudinal_numberofsegme)  # "Arm-Upper-Left-Latitudinal-NumberOfSegments"
arm_upper_left_longitudinal_numberofsegm_2 = Number(arm_upper_left_longitudinal_numberofsegm)  # "Arm-Upper-Left-Longitudinal-NumberOfSegments"
expression_3 = Expression(x=arm_upper_left_longitudinal_numberofsegm_2, y=rasterlength_x_2, Expression="x*y")
expression_4 = Expression(x=arm_upper_left_latitudinal_numberofsegme_2, y=rasterlength_y_2, Expression="x*y")
arm_upper_left_longitudinal_totallength = Number(expression_3)
arm_upper_left_latitudinal_totallength = Number(expression_4)

arm_upper_right_longitudinal_numberofseg_2 = Number(arm_upper_right_longitudinal_numberofseg)  # "Arm-Upper-Right-Longitudinal-NumberOfSegments"
arm_upper_right_latitudinal_numberofsegm_2 = Number(arm_upper_right_latitudinal_numberofsegm)  # "Arm-Upper-Right-Latitudinal-NumberOfSegments"
expression_5 = Expression(x=arm_upper_right_longitudinal_numberofseg_2, y=rasterlength_x_2, Expression="x*y")
expression_6 = Expression(x=arm_upper_right_latitudinal_numberofsegm_2, y=rasterlength_y_2, Expression="x*y")
arm_upper_right_latitudinal_totallength = Number(expression_6)
arm_upper_right_longitudinal_totallength = Number(expression_5)

arm_lower_right_longitudinal_numberofseg_2 = Number(arm_lower_right_longitudinal_numberofseg)  # "Arm-Lower-Right-Longitudinal-NumberOfSegments"
arm_lower_right_latitudinal_numberofsegm_2 = Number(arm_lower_right_latitudinal_numberofsegm)  # "Arm-Lower-Right-Latitudinal-NumberOfSegments"
expression_7 = Expression(x=arm_lower_right_longitudinal_numberofseg_2, y=rasterlength_x_2, Expression="x*y")
expression_8 = Expression(x=arm_lower_right_latitudinal_numberofsegm_2, y=rasterlength_y_2, Expression="x*y")
arm_lower_right_longitudinal_totallength = Number(expression_7)
arm_lower_right_latitudinal_totallength = Number(expression_8)

baseplane_2 = Plane(baseplane)
deplane = DeconstructPlane(Plane=baseplane_2)  # -> Origin, XAxis, YAxis, ZAxis
revxvec = Vector(expr("-x", deplane.XAxis))
revzvec = Vector(expr("-x", deplane.ZAxis))
revyvec = Vector(expr("-x", deplane.YAxis))
pflip = FlipPlane(Plane=baseplane_2, ReverseX=False, ReverseY=False, SwapAxes=True)
origin = Point(deplane.Origin)
xvec = Vector(deplane.XAxis)
yvec = Vector(deplane.YAxis)
zvec = Vector(deplane.ZAxis)

amp = Amplitude(Vector=xvec, Amplitude=1)
amp_2 = Amplitude(Vector=yvec, Amplitude=1)
amp_3 = Amplitude(Vector=zvec, Amplitude=1)
amp_4 = Amplitude(Vector=revxvec, Amplitude=1)
amp_5 = Amplitude(Vector=revyvec, Amplitude=1)
amp_6 = Amplitude(Vector=revzvec, Amplitude=1)
merge = Merge(Data1=item.Item1, Data2=item.Item3)
merge_2 = Merge(Data1=item.Item2, Data2=item.Item)
panel = Panel(merge_2)
panel_2 = Panel(merge)

merge_3 = Merge(Data1=item.Item2, Data2=item.Item)
concat = Concatenate(
    FragmentE=namingschema_building_name_2,
    FragmentD=namingschema_delimiter_2,
    FragmentA=namingschema_center_name_2,
    FragmentC=namingschema_delimiter_2,
    FragmentB=merge_3)  # -> graft(Result)
basebody_center_zones_name = Text(concat)

concat_2 = Concatenate(
    FragmentD=namingschema_building_name_2,
    FragmentE=namingschema_delimiter_2,
    FragmentA=namingschema_arm_name_2,
    FragmentC=namingschema_delimiter_2,
    FragmentB=item.Item2)  # -> graft(Result)
merge_4 = Merge(Data1=item.Item1, Data2=item.Item3)
concat_3 = Concatenate(
    FragmentD=namingschema_building_name_2,
    FragmentE=namingschema_delimiter_2,
    FragmentA=namingschema_arm_name_2,
    FragmentC=namingschema_delimiter_2,
    FragmentB=item.Item)
merge_5 = Merge(Data1=item.Item3, Data2=item.Item1)
mrg_a = MergeSeperatlyAppend(y=concat_3)  # -> Mrgd; inputs x: tree, y: tree; same code as mrg_a
concat_4 = Concatenate(FragmentA=concat_2, FragmentC=namingschema_delimiter_2, FragmentB=merge_4)
concat_5 = Concatenate(FragmentA=mrg_a, FragmentC=namingschema_delimiter_2, FragmentB=merge_5)
merge_6 = Merge(Data1=concat_4, Data2=concat_5)
concat_6 = Concatenate(
    FragmentA=merge_6,
    FragmentD=namingschema_delimiter_2,
    FragmentE=namingschema_fassade_name_2,
    FragmentB=namingschema_delimiter_2,
    FragmentC=item.Item1)  # -> graft(Result)
arms_fassade_right_name = Text(concat_6)

concat_7 = Concatenate(
    FragmentD=namingschema_building_name_2,
    FragmentE=namingschema_delimiter_2,
    FragmentA=namingschema_arm_name_2,
    FragmentC=namingschema_delimiter_2,
    FragmentB=item.Item2)  # -> graft(Result)
merge_7 = Merge(Data1=item.Item1, Data2=item.Item3)
concat_8 = Concatenate(
    FragmentD=namingschema_building_name_2,
    FragmentE=namingschema_delimiter_2,
    FragmentA=namingschema_arm_name_2,
    FragmentC=namingschema_delimiter_2,
    FragmentB=item.Item)
merge_8 = Merge(Data1=item.Item3, Data2=item.Item1)
mrg_a_2 = MergeSeperatlyAppend(y=concat_8)  # -> Mrgd; inputs x: tree, y: tree; same code as mrg_a
concat_9 = Concatenate(FragmentA=concat_7, FragmentC=namingschema_delimiter_2, FragmentB=merge_7)
concat_10 = Concatenate(FragmentA=mrg_a_2, FragmentC=namingschema_delimiter_2, FragmentB=merge_8)
merge_9 = Merge(Data1=concat_9, Data2=concat_10)
concat_11 = Concatenate(
    FragmentA=merge_9,
    FragmentD=namingschema_delimiter_2,
    FragmentE=namingschema_fassade_name_2,
    FragmentB=namingschema_delimiter_2,
    FragmentC=item.Item3)  # -> graft(Result)
arms_fassade_left_name = Text(concat_11)

concat_12 = Concatenate(
    FragmentD=namingschema_building_name_2,
    FragmentE=namingschema_delimiter_2,
    FragmentA=namingschema_arm_name_2,
    FragmentC=namingschema_delimiter_2,
    FragmentB=item.Item2)  # -> graft(Result)
merge_10 = Merge(Data1=item.Item1, Data2=item.Item3)
concat_13 = Concatenate(FragmentA=concat_12, FragmentC=namingschema_delimiter_2, FragmentB=merge_10)
concat_14 = Concatenate(
    FragmentA=concat_13,
    FragmentD=namingschema_delimiter_2,
    FragmentE=namingschema_fassade_name_2,
    FragmentB=namingschema_delimiter_2,
    FragmentC=item.Item2)  # -> graft(Result)
arms_fassade_lower_name = Text(concat_14)

merge_11 = Merge(Data1=item.Item2, Data2=item.Item)
concat_15 = Concatenate(
    FragmentD=namingschema_building_name_2,
    FragmentE=namingschema_delimiter_2,
    FragmentA=namingschema_arm_name_2,
    FragmentC=namingschema_delimiter_2,
    FragmentB=merge_11)  # -> graft(Result)
merge_12 = Merge(Data1=item.Item1, Data2=item.Item3)
concat_16 = Concatenate(FragmentA=concat_15, FragmentC=namingschema_delimiter_2, FragmentB=merge_12)  # -> graft(Result)
arms_name = Text(concat_16)

merge_13 = Merge(Data1=item.Item1, Data2=item.Item3)
concat_17 = Concatenate(
    FragmentE=namingschema_building_name_2,
    FragmentD=namingschema_delimiter_2,
    FragmentA=namingschema_center_name_2,
    FragmentC=namingschema_delimiter_2,
    FragmentB=merge_13)  # -> graft(Result)
basebody_zone_wings_name = Text(concat_17)

concat_18 = Concatenate(
    FragmentE=namingschema_building_name_2,
    FragmentD=namingschema_delimiter_2,
    FragmentA=namingschema_center_name_2,
    FragmentC=namingschema_delimiter_2,
    FragmentG=namingschema_fassade_name_2,
    FragmentF=namingschema_delimiter_2,
    FragmentB=item.Item)
mrg_a_3 = MergeSeperatlyAppend(y=concat_18)  # -> Mrgd; inputs x: tree, y: tree; same code as mrg_a
basebody_fassade_upper_name = Text(mrg_a_3)

concat_19 = Concatenate(
    FragmentE=namingschema_building_name_2,
    FragmentD=namingschema_delimiter_2,
    FragmentA=namingschema_center_name_2,
    FragmentC=namingschema_delimiter_2,
    FragmentG=namingschema_fassade_name_2,
    FragmentF=namingschema_delimiter_2,
    FragmentB=item.Item3)
mrg_a_4 = MergeSeperatlyAppend(y=concat_19)  # -> Mrgd; inputs x: tree, y: tree; same code as mrg_a
basebody_fassade_left_name = Text(mrg_a_4)

merge_14 = Merge(Data1=item.Item1, Data2=item.Item3)

concat_20 = Concatenate(
    FragmentE=namingschema_building_name_2,
    FragmentD=namingschema_delimiter_2,
    FragmentA=namingschema_center_name_2,
    FragmentC=namingschema_delimiter_2,
    FragmentG=namingschema_fassade_name_2,
    FragmentF=namingschema_delimiter_2,
    FragmentB=item.Item2)  # -> graft(Result)
basebody_fassade_lower_name = Text(concat_20)

concat_21 = Concatenate(
    FragmentE=namingschema_building_name_2,
    FragmentD=namingschema_delimiter_2,
    FragmentA=namingschema_center_name_2,
    FragmentC=namingschema_delimiter_2,
    FragmentG=namingschema_fassade_name_2,
    FragmentF=namingschema_delimiter_2,
    FragmentB=item.Item1)  # -> graft(Result)
basebody_fassade_right_name = Text(concat_21)

concat_22 = Concatenate(FragmentE=namingschema_building_name_2, FragmentD=namingschema_delimiter_2, FragmentA=namingschema_core_name_2)  # -> graft(Result)
basebody_core_name = Text(concat_22)

concat_23 = Concatenate(FragmentE=namingschema_building_name_2, FragmentD=namingschema_delimiter_2, FragmentA=namingschema_center_name_2)  # -> graft(Result)
basebody_center_name = Text(concat_23)

concat_24 = Concatenate(
    FragmentE=namingschema_building_name_2,
    FragmentD=namingschema_delimiter_2,
    FragmentA=namingschema_wing_name_2,
    FragmentC=namingschema_delimiter_2,
    FragmentB=merge_14)  # -> graft(Result)
wings_name = Text(concat_24)

wings_name_2 = ClusterOutput(wings_name)
basebody_core_name_2 = ClusterOutput(basebody_core_name)
basebody_zone_wings_name_2 = ClusterOutput(basebody_zone_wings_name)
arms_name_2 = ClusterOutput(arms_name)
basebody_fassade_lower_name_2 = ClusterOutput(basebody_fassade_lower_name)
basebody_fassade_upper_name_2 = ClusterOutput(basebody_fassade_upper_name)
basebody_fassade_right_name_2 = ClusterOutput(basebody_fassade_right_name)
basebody_fassade_left_name_2 = ClusterOutput(basebody_fassade_left_name)
arms_fassade_left_name_2 = ClusterOutput(arms_fassade_left_name)
arms_fassade_right_name_2 = ClusterOutput(arms_fassade_right_name)
arms_fassade_lower_name_2 = ClusterOutput(arms_fassade_lower_name)
basebody_center_zones_name_2 = ClusterOutput(basebody_center_zones_name)
basebody_center_name_2 = ClusterOutput(basebody_center_name)

basebody_inside_latditudinal_numberofseg_2 = Number(basebody_inside_latditudinal_numberofseg)  # "BaseBody-Inside-Latditudinal-NumberOfSegments"
building_longitudinal_numberofsegments_2 = Number(building_longitudinal_numberofsegments)
expression_9 = Expression(x=basebody_inside_latditudinal_numberofseg_2, y=rasterlength_y_2, Expression="(2*x+1)*y")
expression_10 = Expression(x=building_longitudinal_numberofsegments_2, y=rasterlength_x_2, Expression="x*y")
building_totallength = Number(expression_10)
basebody_totalwidth = Number(expression_9)

expression_11 = Expression(x=basebody_inside_latditudinal_numberofseg_2, y=rasterlength_y_2, Expression="x*y")

basebody_zonewidth = Number(expression_11)

amp_7 = Amplitude(Vector=xvec, Amplitude=building_totallength)
amp_8 = Amplitude(Vector=yvec, Amplitude=basebody_totalwidth)
addition = Addition(A=amp_7, B=amp_8)
move = Move(Geometry=origin, Motion=addition)  # -> Geometry, Transform
move_2 = Move(Geometry=origin, Motion=amp_7)  # -> Geometry, Transform
move_3 = Move(Geometry=origin, Motion=amp_8)  # -> Geometry, Transform
basebody_corner_lower_left = Point(origin)
basebody_corner_upper_right = Point(move.Geometry)
basebody_corner_lower_right = Point(move_2.Geometry)
basebody_corner_upper_left = Point(move_3.Geometry)

dom = ConstructDomain(DomainStart=0, DomainEnd=basebody_totalwidth)
dom_2 = ConstructDomain(DomainStart=0, DomainEnd=building_totallength)
rectangle = Rectangle(Plane=baseplane_2, XSize=dom_2, YSize=dom, Radius=0)  # -> Rectangle, Length
basebody_rectangle = Rectangle(rectangle.Rectangle)

amp_9 = Amplitude(Vector=yvec, Amplitude=arm_upper_right_latitudinal_totallength)
amp_10 = Amplitude(Vector=revxvec, Amplitude=arm_upper_right_longitudinal_totallength)
addition_2 = Addition(A=amp_10, B=amp_9)
move_4 = Move(Geometry=basebody_corner_upper_right, Motion=amp_10)  # -> Geometry, Transform
move_5 = Move(Geometry=basebody_corner_upper_right, Motion=amp_9)  # -> Geometry, Transform
move_6 = Move(Geometry=basebody_corner_upper_right, Motion=addition_2)  # -> Geometry, Transform
arm_upper_right_corner_upper_right = Point(graft(move_5.Geometry))
arm_upper_right_corner_lower_right = Point(graft(basebody_corner_upper_right))
arm_upper_right_corner_lower_left = Point(graft(move_4.Geometry))
arm_upper_right_corner_upper_left = Point(graft(move_6.Geometry))
merge_15 = Merge(
    Data1=arm_upper_right_corner_lower_left,
    Data2=arm_upper_right_corner_upper_left,
    Data3=arm_upper_right_corner_upper_right,
    Data4=arm_upper_right_corner_lower_right)
merge_16 = Merge(Data1=arm_upper_right_corner_lower_left, Data2=arm_upper_right_corner_lower_right)
trim = TrimTree(Tree=merge_15, Depth=1)
trim_2 = TrimTree(Tree=merge_16, Depth=1)
pline = PolyLine(Vertices=trim, Closed=Toggle(True))
pline_2 = PolyLine(Vertices=trim_2, Closed=False)
arm_upper_left_intneral_wall = Curve(pline_2)
arm_upper_right_boundary = Curve(pline)

amp_11 = Amplitude(Vector=yvec, Amplitude=arm_upper_left_latitudinal_totallength)
amp_12 = Amplitude(Vector=xvec, Amplitude=arm_upper_left_longitudinal_totallength)
addition_3 = Addition(A=amp_12, B=amp_11)
move_7 = Move(Geometry=basebody_corner_upper_left, Motion=amp_12)  # -> Geometry, Transform
move_8 = Move(Geometry=basebody_corner_upper_left, Motion=amp_11)  # -> Geometry, Transform
move_9 = Move(Geometry=basebody_corner_upper_left, Motion=addition_3)  # -> Geometry, Transform
arm_upper_left_corner_lower_left = Point(graft(basebody_corner_upper_left))
arm_upper_left_corner_upper_right = Point(graft(move_9.Geometry))
arm_upper_left_corner_lower_right = Point(graft(move_7.Geometry))
arm_upper_left_corner_upper_left = Point(graft(move_8.Geometry))
merge_17 = Merge(
    Data1=arm_upper_left_corner_lower_left,
    Data2=arm_upper_left_corner_upper_left,
    Data3=arm_upper_left_corner_upper_right,
    Data4=arm_upper_left_corner_lower_right)
merge_18 = Merge(Data1=arm_upper_left_corner_lower_right, Data2=arm_upper_left_corner_lower_left)
trim_3 = TrimTree(Tree=merge_17, Depth=1)
trim_4 = TrimTree(Tree=merge_18, Depth=1)
pline_3 = PolyLine(Vertices=trim_3, Closed=Toggle(True))
pline_4 = PolyLine(Vertices=trim_4, Closed=False)
arm_upper_right_intneral_wall = Curve(pline_4)
arm_upper_left_boundary = Curve(pline_3)

amp_13 = Amplitude(Vector=revyvec, Amplitude=basebody_zonewidth)
amp_14 = Amplitude(Vector=revyvec, Amplitude=basebody_zonewidth)
move_10 = Move(Geometry=arm_upper_left_corner_lower_right, Motion=amp_13)  # -> Geometry, Transform
move_11 = Move(Geometry=arm_upper_right_corner_lower_left, Motion=amp_14)  # -> Geometry, Transform
basebody_zone_upper_corner_lower_right = Point(move_11.Geometry)
basebody_zone_upper_corner_lower_left = Point(move_10.Geometry)
merge_19 = Merge(
    Data1=basebody_zone_upper_corner_lower_right,
    Data2=basebody_zone_upper_corner_lower_left,
    Data3=arm_upper_left_corner_lower_right,
    Data4=arm_upper_right_corner_lower_left)
trim_5 = TrimTree(Tree=merge_19, Depth=1)
pline_5 = PolyLine(Vertices=trim_5, Closed=Toggle(True))
basebody_zone_upper_boundary = Curve(pline_5)

amp_15 = Amplitude(Vector=revyvec, Amplitude=arm_lower_left_latitudinal_totallength)
amp_16 = Amplitude(Vector=xvec, Amplitude=arm_lower_left_longitudinal_totallength)
addition_4 = Addition(A=amp_16, B=amp_15)
move_12 = Move(Geometry=basebody_corner_lower_left, Motion=amp_16)  # -> Geometry, Transform
move_13 = Move(Geometry=basebody_corner_lower_left, Motion=amp_15)  # -> Geometry, Transform
move_14 = Move(Geometry=basebody_corner_lower_left, Motion=addition_4)  # -> Geometry, Transform
arm_lower_left_corner_upper_right = Point(graft(move_12.Geometry))
arm_lower_left_corner_lower_left = Point(graft(move_13.Geometry))
arm_lower_left_corner_upper_left = Point(graft(basebody_corner_lower_left))
arm_lower_left_corner_lower_right = Point(graft(move_14.Geometry))
merge_20 = Merge(
    Data1=arm_lower_left_corner_upper_right,
    Data2=arm_lower_left_corner_lower_right,
    Data3=arm_lower_left_corner_lower_left,
    Data4=arm_lower_left_corner_upper_left)
merge_21 = Merge(Data1=arm_lower_left_corner_upper_right, Data2=arm_lower_left_corner_upper_left)
trim_6 = TrimTree(Tree=merge_20, Depth=1)
trim_7 = TrimTree(Tree=merge_21, Depth=1)
pline_6 = PolyLine(Vertices=trim_6, Closed=Toggle(True))
pline_7 = PolyLine(Vertices=trim_7, Closed=False)
arm_lower_left_intneral_wall = Curve(pline_7)
arm_lower_left_boundary = Curve(pline_6)

amp_17 = Amplitude(Vector=revyvec, Amplitude=arm_lower_right_latitudinal_totallength)
amp_18 = Amplitude(Vector=revxvec, Amplitude=arm_lower_right_longitudinal_totallength)
addition_5 = Addition(A=amp_18, B=amp_17)
move_15 = Move(Geometry=basebody_corner_lower_right, Motion=amp_18)  # -> Geometry, Transform
move_16 = Move(Geometry=basebody_corner_lower_right, Motion=amp_17)  # -> Geometry, Transform
move_17 = Move(Geometry=basebody_corner_lower_right, Motion=addition_5)  # -> Geometry, Transform
arm_lower_right_corner_upper_right = Point(graft(basebody_corner_lower_right))
arm_lower_right_corner_lower_right = Point(graft(move_16.Geometry))
arm_lower_right_corner_lower_left = Point(graft(move_17.Geometry))
arm_lower_right_corner_upper_left = Point(graft(move_15.Geometry))
merge_22 = Merge(
    Data1=arm_lower_right_corner_upper_right,
    Data2=arm_lower_right_corner_lower_right,
    Data3=arm_lower_right_corner_lower_left,
    Data4=arm_lower_right_corner_upper_left)
merge_23 = Merge(Data1=arm_lower_right_corner_upper_left, Data2=arm_lower_right_corner_upper_right)
trim_8 = TrimTree(Tree=merge_22, Depth=1)
trim_9 = TrimTree(Tree=merge_23, Depth=1)
pline_8 = PolyLine(Vertices=trim_8, Closed=Toggle(True))
pline_9 = PolyLine(Vertices=trim_9, Closed=False)
arm_lower_right_boundary = Curve(pline_8)
arm_lower_right_intneral_wall = Curve(pline_9)

amp_19 = Amplitude(Vector=yvec, Amplitude=basebody_zonewidth)
amp_20 = Amplitude(Vector=yvec, Amplitude=basebody_zonewidth)
trim_10 = TrimTree(Tree=arm_lower_right_corner_upper_left, Depth=1)
trim_11 = TrimTree(Tree=arm_lower_left_corner_upper_right, Depth=1)
move_18 = Move(Geometry=trim_11, Motion=amp_19)  # -> Geometry, Transform
move_19 = Move(Geometry=trim_10, Motion=amp_20)  # -> Geometry, Transform
basebody_zone_lower_corner_lower_right = Point(graft(move_19.Geometry))
basebody_zone_lower_corner_lower_left = Point(graft(move_18.Geometry))
merge_24 = Merge(
    Data1=arm_lower_right_corner_upper_left,
    Data2=arm_lower_left_corner_upper_right,
    Data3=basebody_zone_lower_corner_lower_left,
    Data4=basebody_zone_lower_corner_lower_right)
trim_12 = TrimTree(Tree=merge_24, Depth=1)
pline_10 = PolyLine(Vertices=trim_12, Closed=Toggle(True))
basebody_zone_lower_boundary = Curve(pline_10)
merge_25 = Merge(Data1=basebody_zone_lower_boundary, Data2=basebody_zone_upper_boundary)  # -> graft(Result)
basebody_center_zones_boundary = Curve(merge_25)

merge_26 = Merge(Data1=arm_lower_right_corner_lower_left, Data2=arm_lower_right_corner_upper_left)
merge_27 = Merge(Data1=arm_lower_right_corner_upper_right, Data2=arm_lower_right_corner_lower_right)
merge_28 = Merge(Data1=arm_lower_right_corner_lower_right, Data2=arm_lower_right_corner_lower_left)
trim_13 = TrimTree(Tree=merge_27, Depth=1)
trim_14 = TrimTree(Tree=merge_28, Depth=1)
trim_15 = TrimTree(Tree=merge_26, Depth=1)
pline_11 = PolyLine(Vertices=trim_13, Closed=False)
pline_12 = PolyLine(Vertices=trim_14, Closed=False)
pline_13 = PolyLine(Vertices=trim_15, Closed=False)
arm_lower_right_fassade_lower = Curve(pline_12)
arm_lower_right_fassade_left = Curve(pline_13)
arm_lower_right_fassade_right = Curve(pline_11)

merge_29 = Merge(Data1=arm_upper_right_corner_upper_right, Data2=arm_upper_right_corner_lower_right)
merge_30 = Merge(Data1=arm_upper_right_corner_upper_left, Data2=arm_upper_right_corner_upper_right)
merge_31 = Merge(Data1=arm_upper_right_corner_lower_left, Data2=arm_upper_right_corner_upper_left)
trim_16 = TrimTree(Tree=merge_29, Depth=1)
trim_17 = TrimTree(Tree=merge_30, Depth=1)
trim_18 = TrimTree(Tree=merge_31, Depth=1)
pline_14 = PolyLine(Vertices=trim_16, Closed=False)
pline_15 = PolyLine(Vertices=trim_17, Closed=False)
pline_16 = PolyLine(Vertices=trim_18, Closed=False)
arm_upper_right_fassade_left = Curve(pline_16)
arm_upper_right_fassade_right = Curve(pline_14)
arm_upper_right_fassade_upper = Curve(pline_15)

merge_32 = Merge(Data1=arm_lower_left_corner_lower_right, Data2=arm_lower_left_corner_lower_left)
merge_33 = Merge(Data1=arm_lower_left_corner_upper_right, Data2=arm_lower_left_corner_lower_right)
merge_34 = Merge(Data1=arm_lower_left_corner_lower_left, Data2=arm_lower_left_corner_upper_left)
trim_19 = TrimTree(Tree=merge_33, Depth=1)
trim_20 = TrimTree(Tree=merge_32, Depth=1)
trim_21 = TrimTree(Tree=merge_34, Depth=1)
pline_17 = PolyLine(Vertices=trim_19, Closed=False)
pline_18 = PolyLine(Vertices=trim_20, Closed=False)
pline_19 = PolyLine(Vertices=trim_21, Closed=False)
arm_lower_left_fassade_right = Curve(pline_17)
arm_lower_left_fassade_lower = Curve(pline_18)
arm_lower_left_fassade_left = Curve(pline_19)

merge_35 = Merge(Data1=arm_upper_left_corner_lower_left, Data2=arm_upper_left_corner_upper_left)
merge_36 = Merge(Data1=arm_upper_left_corner_upper_left, Data2=arm_upper_left_corner_upper_right)
merge_37 = Merge(Data1=arm_upper_left_corner_upper_right, Data2=arm_upper_left_corner_lower_right)
trim_22 = TrimTree(Tree=merge_35, Depth=1)
trim_23 = TrimTree(Tree=merge_36, Depth=1)
trim_24 = TrimTree(Tree=merge_37, Depth=1)
pline_20 = PolyLine(Vertices=trim_22, Closed=False)
pline_21 = PolyLine(Vertices=trim_23, Closed=False)
pline_22 = PolyLine(Vertices=trim_24, Closed=False)
arm_upper_left_fassade_left = Curve(pline_20)
arm_upper_left_fassade_upper = Curve(pline_21)
arm_upper_fassade_right = Curve(pline_22)

merge_38 = Merge(
    Data1=arm_lower_right_corner_upper_right,
    Data2=arm_lower_right_corner_upper_left,
    Data3=arm_upper_right_corner_lower_left,
    Data4=arm_upper_right_corner_lower_right)
trim_25 = TrimTree(Tree=merge_38, Depth=1)
pline_23 = PolyLine(Vertices=trim_25, Closed=Toggle(True))
basebody_right_boundary = Curve(pline_23)

merge_39 = Merge(
    Data1=arm_lower_left_corner_upper_right,
    Data2=arm_lower_left_corner_upper_left,
    Data3=arm_upper_left_corner_lower_left,
    Data4=arm_upper_left_corner_lower_right)
trim_26 = TrimTree(Tree=merge_39, Depth=1)
pline_24 = PolyLine(Vertices=trim_26, Closed=Toggle(True))
basebody_left_boundary = Curve(pline_24)

srf4pt = _4PointSurface(
    CornerA=arm_lower_left_corner_upper_right,
    CornerB=arm_lower_right_corner_upper_left,
    CornerC=arm_lower_right_corner_lower_left,
    CornerD=arm_lower_left_corner_lower_right)
srf4pt_2 = _4PointSurface(
    CornerA=arm_upper_left_corner_upper_right,
    CornerB=arm_upper_left_corner_lower_right,
    CornerC=arm_upper_right_corner_lower_left,
    CornerD=arm_upper_right_corner_upper_left)
courtyard_upper = Surface(srf4pt_2)
courtyard_lower = Surface(srf4pt)

merge_40 = Merge(
    Data1=arm_lower_right_corner_lower_right,
    Data2=arm_lower_right_corner_lower_left,
    Data3=arm_upper_right_corner_upper_left,
    Data4=arm_upper_right_corner_upper_right)
trim_27 = TrimTree(Tree=merge_40, Depth=1)
pline_25 = PolyLine(Vertices=trim_27, Closed=Toggle(True))
wing_left_boundary = Curve(pline_25)

merge_41 = Merge(
    Data1=arm_lower_left_corner_lower_right,
    Data2=arm_lower_left_corner_lower_left,
    Data3=arm_upper_left_corner_upper_left,
    Data4=arm_upper_left_corner_upper_right)
trim_28 = TrimTree(Tree=merge_41, Depth=1)
pline_26 = PolyLine(Vertices=trim_28, Closed=Toggle(True))
wing_right_boundary = Curve(pline_26)

merge_42 = Merge(
    Data1=arm_lower_right_intneral_wall,
    Data2=arm_lower_left_intneral_wall,
    Data3=arm_upper_right_intneral_wall,
    Data4=arm_upper_left_intneral_wall)  # -> graft(Result)

merge_43 = Merge(Data1=arm_upper_left_corner_lower_right, Data2=arm_upper_right_corner_lower_left)
trim_29 = TrimTree(Tree=merge_43, Depth=1)
pline_27 = PolyLine(Vertices=trim_29, Closed=False)
mrg_a_5 = MergeSeperatlyAppend(y=pline_27)  # -> Mrgd; inputs x: tree, y: tree; same code as mrg_a
basebody_fassade_upper_line = Curve(mrg_a_5)

arm_lower_intneral_walls = Curve(merge_42)

merge_44 = Merge(Data1=arm_lower_left_corner_upper_left, Data2=arm_upper_left_corner_lower_left)
trim_30 = TrimTree(Tree=merge_44, Depth=1)
pline_28 = PolyLine(Vertices=trim_30, Closed=False)
mrg_a_6 = MergeSeperatlyAppend(y=pline_28)  # -> Mrgd; inputs x: tree, y: tree; same code as mrg_a
basebody_fassade_left_line = Curve(mrg_a_6)

merge_45 = Merge(Data1=arm_lower_right_corner_upper_left, Data2=arm_lower_left_corner_upper_right)
trim_31 = TrimTree(Tree=merge_45, Depth=1)
pline_29 = PolyLine(Vertices=trim_31, Closed=False)  # -> graft(Polyline)
basebody_fassade_lower_line = Curve(pline_29)

merge_46 = Merge(
    Data1=basebody_zone_lower_corner_lower_right,
    Data2=basebody_zone_lower_corner_lower_left,
    Data3=basebody_zone_upper_corner_lower_left,
    Data4=basebody_zone_upper_corner_lower_right)
trim_32 = TrimTree(Tree=merge_46, Depth=1)
pline_30 = PolyLine(Vertices=trim_32, Closed=Toggle(True))
basebody_core_boundary = Curve(pline_30)

merge_47 = Merge(Data1=arm_lower_right_corner_upper_right, Data2=arm_upper_right_corner_lower_right)
trim_33 = TrimTree(Tree=merge_47, Depth=1)
pline_31 = PolyLine(Vertices=trim_33, Closed=False)  # -> graft(Polyline)
basebody_fassade_right_line = Curve(pline_31)

toggle = BooleanToggle(True)
merge_48 = Merge(
    Data1=arm_lower_right_corner_upper_left,
    Data2=arm_lower_left_corner_upper_right,
    Data3=arm_upper_left_corner_lower_right,
    Data4=arm_upper_right_corner_lower_left)
pline_32 = PolyLine(Vertices=merge_48, Closed=toggle)
basebody_center_boundary = Curve(pline_32)

merge_49 = Merge(Data1=arm_lower_left_corner_upper_right, Data2=basebody_zone_lower_corner_lower_left)
merge_50 = Merge(Data1=arm_upper_right_corner_lower_left, Data2=basebody_zone_upper_corner_lower_right)
merge_51 = Merge(Data1=arm_lower_right_corner_upper_left, Data2=basebody_zone_lower_corner_lower_right)
merge_52 = Merge(Data1=arm_upper_left_corner_lower_right, Data2=basebody_zone_upper_corner_lower_left)
pline_33 = PolyLine(Vertices=merge_49, Closed=toggle)
pline_34 = PolyLine(Vertices=merge_50, Closed=toggle)
pline_35 = PolyLine(Vertices=merge_51, Closed=toggle)
pline_36 = PolyLine(Vertices=merge_52, Closed=toggle)
merge_53 = Merge(Data1=pline_33, Data2=pline_36, Data3=pline_34, Data4=pline_35)  # -> graft(Result)
basebody_center_internal_walls = Curve(merge_53)

mrg_a_7 = MergeSeperatlyAppend(y=arm_upper_left_fassade_upper)  # -> Mrgd; inputs x: tree, y: tree; same code as mrg_a
mrg_a_8 = MergeSeperatlyAppend(y=arm_upper_right_fassade_upper)  # -> Mrgd; inputs x: tree, y: tree; same code as mrg_a
merge_54 = Merge(Data1=mrg_a_7, Data2=mrg_a_8)  # -> graft(Result)
arms_fassade_upper_line = Curve(merge_54)

mrg_a_9 = MergeSeperatlyAppend(y=arm_upper_right_fassade_left)  # -> Mrgd; inputs x: tree, y: tree; same code as mrg_a
mrg_a_10 = MergeSeperatlyAppend(y=arm_upper_left_fassade_left)  # -> Mrgd; inputs x: tree, y: tree; same code as mrg_a
merge_55 = Merge(Data1=graft(arm_lower_right_fassade_left), Data2=graft(arm_lower_left_fassade_left), Data3=mrg_a_10, Data4=mrg_a_9)  # -> graft(Result)
arms_fassade_left_line = Curve(merge_55)

mrg_a_11 = MergeSeperatlyAppend(y=arm_upper_right_fassade_right)  # -> Mrgd; inputs x: tree, y: tree; same code as mrg_a
mrg_a_12 = MergeSeperatlyAppend(y=arm_upper_fassade_right)  # -> Mrgd; inputs x: tree, y: tree; same code as mrg_a
merge_56 = Merge(Data1=graft(arm_lower_right_fassade_right), Data2=graft(arm_lower_left_fassade_right), Data3=mrg_a_12, Data4=mrg_a_11)  # -> graft(Result)
arms_fassade_right_line = Curve(merge_56)

merge_57 = Merge(Data1=basebody_right_boundary, Data2=basebody_left_boundary)  # -> graft(Result)
basebody_zone_wings_boundary = Curve(merge_57)

merge_58 = Merge(Data1=graft(arm_lower_right_fassade_lower), Data2=graft(arm_lower_left_fassade_lower))  # -> graft(Result)
arms_fassade_lower_line = Curve(merge_58)

merge_59 = Merge(Data1=wing_right_boundary, Data2=wing_left_boundary)  # -> graft(Result)
wings_boundary = Curve(merge_59)

arm_lower_intneral_walls_2 = Curve(arm_lower_intneral_walls)
courtyard_upper_2 = Surface(courtyard_upper)
courtyard_lower_2 = Surface(courtyard_lower)
wings_boundary_2 = ClusterOutput(wings_boundary)
basebody_core_boundary_2 = ClusterOutput(basebody_core_boundary)
basebody_zone_wings_boundary_2 = ClusterOutput(basebody_zone_wings_boundary)
basebody_fassade_lower_line_2 = ClusterOutput(basebody_fassade_lower_line)
basebody_fassade_upper_line_2 = ClusterOutput(basebody_fassade_upper_line)
basebody_fassade_right_line_2 = ClusterOutput(basebody_fassade_right_line)
basebody_fassade_left_line_2 = ClusterOutput(basebody_fassade_left_line)
arms_fassade_left_line_2 = ClusterOutput(arms_fassade_left_line)
arms_fassade_right_line_2 = ClusterOutput(arms_fassade_right_line)
arms_fassade_lower_line_2 = ClusterOutput(arms_fassade_lower_line)
basebody_center_zones_boundary_2 = ClusterOutput(basebody_center_zones_boundary)
basebody_center_internal_walls_2 = ClusterOutput(basebody_center_internal_walls)
courtyard_upper_3 = ClusterOutput(courtyard_upper_2)
basebody_center_boundary_2 = ClusterOutput(basebody_center_boundary)
arm_lower_intneral_walls_3 = ClusterOutput(arm_lower_intneral_walls_2)
courtyard_lower_3 = ClusterOutput(courtyard_lower_2)
arms_fassade_upper_line_2 = ClusterOutput(arms_fassade_upper_line)

merge_60 = Merge(Data1=graft(arm_lower_right_boundary), Data2=graft(arm_lower_left_boundary))  # -> graft(Result)
mrg_a_13 = MergeSeperatlyAppend(y=arm_upper_right_boundary)  # -> Mrgd; inputs x: tree, y: tree; same code as mrg_a
mrg_a_14 = MergeSeperatlyAppend(y=arm_upper_left_boundary)  # -> Mrgd; inputs x: tree, y: tree; same code as mrg_a
merge_61 = Merge(Data1=mrg_a_13, Data2=mrg_a_14)  # -> graft(Result)
arms_upper_boundary = Curve(merge_61)

arms_lower_boundary = Curve(merge_60)

merge_62 = Merge(Data1=arms_lower_boundary, Data2=arms_upper_boundary)
arms_boundary = Curve(merge_62)

arms_boundary_2 = ClusterOutput(arms_boundary)

merge_63 = Merge(Data1=item.Item3, Data2=item.Item1)
concat_25 = Concatenate(
    FragmentD=namingschema_building_name_2,
    FragmentE=namingschema_delimiter_2,
    FragmentA=namingschema_arm_name_2,
    FragmentC=namingschema_delimiter_2,
    FragmentB=item.Item)

mrg_a_15 = MergeSeperatlyAppend(y=concat_25)  # -> Mrgd; inputs x: tree, y: tree; same code as mrg_a

concat_26 = Concatenate(FragmentA=mrg_a_15, FragmentC=namingschema_delimiter_2, FragmentB=merge_63)  # -> graft(Result)
concat_27 = Concatenate(
    FragmentA=concat_26,
    FragmentD=namingschema_delimiter_2,
    FragmentE=namingschema_fassade_name_2,
    FragmentB=namingschema_delimiter_2,
    FragmentC=item.Item)
arms_fassade_upper_name = Text(concat_27)

arms_fassade_upper_name_2 = ClusterOutput(arms_fassade_upper_name)

merge_64 = Merge(
    Data1=arm_lower_left_corner_lower_left,
    Data2=arm_lower_left_corner_upper_left,
    Data3=merge_17,
    Data4=merge_15,
    Data5=merge_22,
    Data6=arm_lower_left_corner_upper_right,
    Data7=arm_lower_left_corner_lower_right)

trim_34 = TrimTree(Tree=merge_64, Depth=1)

pline_37 = PolyLine(Vertices=trim_34, Closed=Toggle(True))
boundary = Curve(pline_37)

boundary_2 = ClusterOutput(boundary)

# ==== cluster Windows
baseplane = ClusterInput()
walls = ClusterInput()
floorheight = ClusterInput()
parapetheight = ClusterInput()
windowheight = ClusterInput()
windowwidth = ClusterInput()
offsettosides = ClusterInput()
constructionmethod = ClusterInput()
windowtowall_perimeter = ClusterInput()
windowtype = ClusterInput()
baseplane_2 = Plane(baseplane)
walls_2 = Curve(walls)
floorheight_2 = Number(floorheight)
parapetheight_2 = Number(parapetheight)
windowheight_2 = Number(windowheight)
windowwidth_2 = Number(windowwidth)
offsettosides_2 = Number(offsettosides)
constructionmethod_2 = Integer(constructionmethod)
windowtowall_perimeter_2 = Number(windowtowall_perimeter)
windowtype_2 = Integer(windowtype)
mtchanc = MatchAncestor(AT=baseplane_2, CT=walls_2)  # -> MAT; inputs AT: tree, CT: tree
# ---------- mtchanc: Python ----------
if ghenv.Component.RunCount<2:
    __author__ = "Ueli Saluz"
    __version__ = "2000.00.00"
    
    ghenv.Component.Name = "Match Ancestor"
    ghenv.Component.NickName = "MtchAnc"
    ghenv.Component.Description = "Duplicates all elements of an ancestor tree to match the amount of elements in the child tree. If the ancestor branch and the child branch are from the same generation simply the ancestor stays unmodified. "
    
    ghenv.Component.Message = "VER 1.0"
    
    ghenv.Component.Params.Input[0].Name = "AncestorTree"
    ghenv.Component.Params.Input[0].NickName = "AT"
    ghenv.Component.Params.Input[0].Description = "Ancestor tree that data will the duplicated until it matches the child tree"
    ghenv.Component.Params.Input[0].Optional = False
    
    ghenv.Component.Params.Input[1].Name = "ChildTree"
    ghenv.Component.Params.Input[1].NickName = "CT"
    ghenv.Component.Params.Input[1].Description = "Child tree that branches will the guide to duplicat the data of the ancestor tree"
    ghenv.Component.Params.Input[0].Optional = False
    
    ghenv.Component.Params.Output[0].Name = "MatchedAncestorTree"
    ghenv.Component.Params.Output[0].NickName = "MAT"
    ghenv.Component.Params.Output[0].Description = "Matched ancestor tree with the amount of items and the branch paths of the child tree"

from System import Object
from Grasshopper import DataTree

"""Returns a new tree with the ancestor data being duplicated along all child branches which where child paths of that ancestor. If the ancestor branch and the child branch are from the same generation simply the ancestor stays unmodified. 
    Inputs:
        ancestorTree: Ancestor tree that data will the duplicated until it matches the child tree
        childTree: Child tree that branches will the guide to duplicat the data of the ancestor tree
    Output:
        matchedAncestorTree: Matched ancestor tree with the amount of items and the branch paths of the child tree"""
def MatchAncestorTreeToChildTree (ancestorTree, childTree):
    
    matchedAncestorTree = DataTree[Object]()
    dummy = 0
    for i,pathAncestor in enumerate(ancestorTree.Paths):
        branch = ancestorTree.Branch(pathAncestor)
        if len(branch)!=1:
            raise Exception("Ancestor must be grafted and containing one item per branch")
        #The item to be duplicated
        item = branch[0]
        for j,pathChild in enumerate(childTree.Paths):
            #Returns a tuple and not like in the documentation described a bool with a pointer to the int to store the generations
            checkAncestor = pathChild.IsAncestor(pathAncestor,dummy)
            if(pathChild==pathAncestor or checkAncestor[0]):
                matchedAncestorTree.Add(item,pathChild)
    return matchedAncestorTree

if __name__ == "__main__":
    MAT = MatchAncestorTreeToChildTree (AT,CT)
# ---------- end mtchanc ----------
len = Length(Curve=walls_2)
expression = Expression(x=len, u=offsettosides_2, Expression="x-2*u")
expression_2 = Expression(x=expression, y=windowwidth_2, z=windowtowall_perimeter_2, Expression="Floor((x*z)/y)")
weightedsubdomains = WeightedSubdomains(Divisor=expression_2)  # -> SubdomainValues, Subdomains; inputs Divisor: tree of Int32, Multiplier: tree, Domain: tree, Fill: Boolean, FillMultiplier: tree, FillEnds: Boolean, AbsoluteFill: Boolean; same code as weightedsubdomains
domnprop = DomainProperties(Domain=weightedsubdomains.Subdomains)  # -> AMean, AMean_2
# ---------- domnprop: Python ----------
if ghenv.Component.RunCount<2:
    __author__ = "Ueli Saluz"
    __version__ = "2021.11.13"
    
    ghenv.Component.Name = "DomainProperties"
    ghenv.Component.NickName = "DomnProp"
    ghenv.Component.Description = "Returns the properties of a domain."
    ghenv.Component.Message = "VER 1.0"
    
    ghenv.Component.Params.Input[0].NickName = "Domain"
    ghenv.Component.Params.Input[0].Description = "Domain to evaluate properties"
    
    ghenv.Component.Params.Output[0].NickName = "Length"
    ghenv.Component.Params.Output[0].Description = "Length of domain"
    
    ghenv.Component.Params.Output[0].NickName = "AMean"
    ghenv.Component.Params.Output[0].Description = "Arithmetic mean of the domain"


Length = Domain.Length
AMean = (Domain.T0+Domain.T1)/2
# ---------- end domnprop ----------
createwallswithopenings = CreateWallsWithOpenings(
    baseplane=mtchanc,
    referencecurvewall=walls_2,
    wallheigth=floorheight_2,
    openingheight=windowheight_2,
    openingwidth=windowwidth_2,
    parapet_height=parapetheight_2,
    offsettosides=offsettosides_2,
    placement=domnprop.AMean_2,
    constructionmethod=constructionmethod_2)  # -> referencecurvewall_4, displayboundary_2, windows_2, doors_2, windowspointsonreferencecurve_2, doorspointsonreferencecurve_2
window_band = WindowBand(
    baseplane=mtchanc,
    walls=walls_2,
    parapetheight=parapetheight_2,
    windowheight=windowheight_2,
    spacingtocorner=offsettosides_2)

trim = TrimTree(Tree=createwallswithopenings.windows_2, Depth=1)
null = NullItem(Item=createwallswithopenings.windows_2)  # -> NullFlags, InvalidFlags, Description
area = Area(Geometry=trim)  # -> Area, Centroid
area_2 = Area(Geometry=createwallswithopenings.displayboundary_2)  # -> Area, Centroid
ma = MassAddition(Input=area.Area)  # -> Result, PartialResults
tstat = TreeStatistics(Tree=trim)  # -> Paths, graft(Length), Count
expression_3 = Expression(x=ma.Result, y=area_2.Area, Expression="x/y")
mtchanc_2 = MatchAncestor(AT="0", CT=createwallswithopenings.displayboundary_2)  # -> MAT; inputs AT: tree, CT: tree; same code as mtchanc
match = MatchTree(Tree=tstat.Length, Guide=expression_3)
expression_4 = Expression(x=match, y=expression_3, z=mtchanc_2, Expression="If(x≠0,y,z)")

area_3 = Area(Geometry=window_band)  # -> Area, Centroid
expression_5 = Expression(x=area_3.Area, y=area_2.Area, Expression="x/y")
filter = StreamFilter(Gate=windowtype_2, Stream0=createwallswithopenings.windows_2, Stream1=graft(window_band))
filter_2 = StreamFilter(Gate=windowtype_2, Stream0=expression_4, Stream1=expression_5)
windowtowallratio = Number(filter_2)
wall = Curve(createwallswithopenings.displayboundary_2)
windows = Curve(filter)
windowspointsonreferencecurve = Point(createwallswithopenings.windowspointsonreferencecurve_2)
wall_2 = ClusterOutput(wall)
windows_2 = ClusterOutput(windows)
windowtowallratio_2 = ClusterOutput(windowtowallratio)
windowspointsonreferencecurve_2 = ClusterOutput(windowspointsonreferencecurve)

# ==== cluster AdjustTree
arm_data = ClusterInput()
arm_data_2 = Data(arm_data)
tstat = TreeStatistics(Tree=arm_data_2)  # -> Paths, Length, Count
dpath = DeconstructPath(Branch=tstat.Paths)
lito3p = ListInto3Parts(ListToSlice=dpath, EndIndex="-2")  # -> FilteredList, ItemsBefore, ItemsAfter; inputs ListToSlice: tree, StartIndex: tree of Int32, EndIndex: tree of Int32; same code as lito3p
item = ListItem(List=lito3p.ItemsAfter, Index=0, Wrap=True)  # -> Item, Item1
concat = Concatenate(FragmentA=item.Item, FragmentB=item.Item1)
b2d = BinaryToDecimal(Binary=concat)  # -> Decimal
# ---------- b2d: Python ----------
if ghenv.Component.RunCount<2:
    __author__ = "Ueli Saluz"
    __version__ = "2021.11.14"
    
    ghenv.Component.Name = "BinaryToDecimal"
    ghenv.Component.NickName = "B2D"
    ghenv.Component.Description = "Converts a number in binary representation to a number in decimal representation."
    ghenv.Component.Message = "VER 1.0"
    
    ghenv.Component.Params.Input[0].NickName = "Binary"
    
    ghenv.Component.Params.Input[0].Description = "Binary representation of a number."
    
    ghenv.Component.Params.Output[0].NickName = "Decimal"
    
    ghenv.Component.Params.Output[0].Description = "Converted decimal representation of the same number."

if __name__ == "__main__":
    Decimal = int(Binary,2)
# ---------- end b2d ----------
expression = Expression(x=b2d, Expression="x+5")
merge = Merge(Data1=lito3p.FilteredList, Data2=expression)
path = ConstructPath(Indices=merge)  # -> flatten(Branch)
relblbrch = RelabelBranches(TreeToMatch=arm_data_2, ListOfPaths=path)  # -> RelabeledTree; inputs TreeToMatch: tree, ListOfPaths: list
# ---------- relblbrch: Python ----------
if ghenv.Component.RunCount<2:
    __author__ = "Your name"
    __version__ = "2000.00.00"
    
    ghenv.Component.Name = "RelabelBranches"
    ghenv.Component.NickName = "ReLblBrch"
    ghenv.Component.Description = "Relabel all the paths of the branches with a list of new paths. The amount of branches must match with the size of the list of pahts"
    ghenv.Component.Message = "VER 1.0"
    
    ghenv.Component.Params.Input[0].NickName = "TreeToMatch"
    ghenv.Component.Params.Input[1].NickName = "ListOfPaths"
    
    ghenv.Component.Params.Input[0].Description = "Tree that should be relabeled."
    ghenv.Component.Params.Input[1].Description = "List of paths to use for new branch paths."
    
    ghenv.Component.Params.Output[0].NickName = "RelabeledTree"
    ghenv.Component.Params.Output[0].Description = "Relabeled tree where all the paths of the branches have been replaced with new paths."

from System import Object
from Grasshopper import DataTree

def relabelBranchesWithLstOfPths (tree, paths):
    newTree = DataTree[Object]()
    for i,path in enumerate(tree.Paths):
        items = tree.Branch(path)
        for data in items:
            newTree.Add(data,paths[i])
    return newTree

if __name__ == "__main__":
    RelabeledTree = relabelBranchesWithLstOfPths(TreeToMatch,ListOfPaths)
# ---------- end relblbrch ----------
arm_data_withmergedpaths = Data(relblbrch)
arm_data_withmergedpaths_2 = ClusterOutput(arm_data_withmergedpaths)

# ==== cluster FloorPlanToBuilding
namingschema_underground_name = ClusterInput()
namingschema_fassade_name = ClusterInput()
namingschema_roof_name = ClusterInput()
baseplane = ClusterInput()
numberoffloors = ClusterInput()
floor_count_underground = ClusterInput()
floorheight = ClusterInput()
courtyard_upper = ClusterInput()
courtyard_lower = ClusterInput()
zones_box = ClusterInput()
zones_name = ClusterInput()
windows_rectangle = ClusterInput()
windows_name = ClusterInput()
namingschema_floor_name = ClusterInput()
namingschema_delimiter = ClusterInput()
baseplane_2 = Plane(baseplane)
numberoffloors_2 = Number(numberoffloors)
floor_count_underground_2 = Number(floor_count_underground)
floorheight_2 = Number(floorheight)
courtyard_upper_2 = Surface(courtyard_upper)
courtyard_lower_2 = Surface(courtyard_lower)
zones_box_2 = Brep(zones_box)
tstat = TreeStatistics(Tree=zones_box_2)  # -> Paths, Length, Count
zones_name_2 = Text(zones_name)
windows_rectangle_2 = Curve(windows_rectangle)
windows_name_2 = Text(windows_name)
namingschema_floor_name_2 = Text(namingschema_floor_name)
namingschema_underground_name_2 = Text(namingschema_underground_name)
namingschema_fassade_name_2 = Text(namingschema_fassade_name)
namingschema_roof_name_2 = Text(namingschema_roof_name)
namingschema_delimiter_2 = Text(namingschema_delimiter)
lito3p = ListInto3Parts(ListToSlice=tstat.Paths, EndIndex="-4")  # -> FilteredList, ItemsBefore, ItemsAfter; inputs ListToSlice: tree, StartIndex: tree of Int32, EndIndex: tree of Int32; same code as lito3p
expression = Expression(x=numberoffloors_2, y=floorheight_2, Expression="x*y")
branch = TreeBranch(Tree=zones_box_2, Path=lito3p.FilteredList, MaintainPaths=True)
branch_2 = TreeBranch(Tree=zones_name_2, Path=lito3p.FilteredList, MaintainPaths=True)
total_height = Number(expression)

mtchanc = MatchAncestor(AT=baseplane_2, CT=branch)  # -> MAT; inputs AT: tree, CT: tree
# ---------- mtchanc: Python ----------
if ghenv.Component.RunCount<2:
    __author__ = "Ueli Saluz"
    __version__ = "2000.00.00"
    
    ghenv.Component.Name = "Match Ancestor"
    ghenv.Component.NickName = "MtchAnc"
    ghenv.Component.Description = "Duplicates all elements of an ancestor tree to match the amount of elements in the child tree."
    ghenv.Component.Message = "VER 1.0"
    
    ghenv.Component.Params.Input[0].Name = "AncestorTree"
    ghenv.Component.Params.Input[0].NickName = "AT"
    ghenv.Component.Params.Input[0].Description = "Ancestor tree that data will the duplicated until it matches the child tree"
    ghenv.Component.Params.Input[0].Optional = False
    
    ghenv.Component.Params.Input[1].Name = "ChildTree"
    ghenv.Component.Params.Input[1].NickName = "CT"
    ghenv.Component.Params.Input[1].Description = "Child tree that branches will the guide to duplicat the data of the ancestor tree"
    ghenv.Component.Params.Input[0].Optional = False
    
    ghenv.Component.Params.Output[0].Name = "MatchedAncestorTree"
    ghenv.Component.Params.Output[0].NickName = "MAT"
    ghenv.Component.Params.Output[0].Description = "Matched ancestor tree with the amount of items and the branch paths of the child tree"

from System import Object
from Grasshopper import DataTree

"""Returns a new tree with the ancestor data being duplicated along all child branches which where child paths of that ancestor.
    Inputs:
        ancestorTree: Ancestor tree that data will the duplicated until it matches the child tree
        childTree: Child tree that branches will the guide to duplicat the data of the ancestor tree
    Output:
        matchedAncestorTree: Matched ancestor tree with the amount of items and the branch paths of the child tree"""
def MatchAncestorTreeToChildTree (ancestorTree, childTree):
    
    matchedAncestorTree = DataTree[Object]()
    dummy = 0
    for i,pathAncestor in enumerate(ancestorTree.Paths):
        branch = ancestorTree.Branch(pathAncestor)
        if len(branch)!=1:
            raise Exception("Ancestor must be grafted and containing one item per branch")
        #The item to be duplicated
        item = branch[0]
        for j,pathChild in enumerate(childTree.Paths):
            #Returns a tuple and not like in the documentation described a bool with a pointer to the int to store the generations
            checkAncestor = pathChild.IsAncestor(pathAncestor,dummy)
            if(checkAncestor[0]):
                matchedAncestorTree.Add(item,pathChild)
    return matchedAncestorTree

if __name__ == "__main__":
    MAT = MatchAncestorTreeToChildTree (AT,CT)
# ---------- end mtchanc ----------
deplane = DeconstructPlane(Plane=mtchanc)  # -> Origin, XAxis, YAxis, ZAxis
pflip = FlipPlane(Plane=mtchanc, ReverseX=False, ReverseY=False, SwapAxes=True)
revxvec = Vector(expr("-x", deplane.XAxis))
revzvec = Vector(expr("-x", deplane.ZAxis))
revyvec = Vector(expr("-x", deplane.YAxis))
origin = Point(deplane.Origin)
xvec = Vector(deplane.XAxis)
yvec = Vector(deplane.YAxis)
zvec = Vector(deplane.ZAxis)

mtchanc_2 = MatchAncestor(AT=baseplane_2, CT=zones_box_2)  # -> MAT; inputs AT: tree, CT: tree; same code as mtchanc
deplane_2 = DeconstructPlane(Plane=mtchanc_2)  # -> Origin, XAxis, YAxis, ZAxis
pflip_2 = FlipPlane(Plane=mtchanc_2, ReverseX=False, ReverseY=False, SwapAxes=True)
revxvec_2 = Vector(expr("-x", deplane_2.XAxis))
revzvec_2 = Vector(expr("-x", deplane_2.ZAxis))
revyvec_2 = Vector(expr("-x", deplane_2.YAxis))
origin_2 = Point(deplane_2.Origin)
xvec_2 = Vector(deplane_2.XAxis)
yvec_2 = Vector(deplane_2.YAxis)
zvec_2 = Vector(deplane_2.ZAxis)

mtchanc_3 = MatchAncestor(AT=baseplane_2, CT=windows_rectangle_2)  # -> MAT; inputs AT: tree, CT: tree; same code as mtchanc
deplane_3 = DeconstructPlane(Plane=mtchanc_3)  # -> Origin, XAxis, YAxis, ZAxis
pflip_3 = FlipPlane(Plane=mtchanc_3, ReverseX=False, ReverseY=False, SwapAxes=True)
revxvec_3 = Vector(expr("-x", deplane_3.XAxis))
revzvec_3 = Vector(expr("-x", deplane_3.ZAxis))
revyvec_3 = Vector(expr("-x", deplane_3.YAxis))
origin_3 = Point(deplane_3.Origin)
xvec_3 = Vector(deplane_3.XAxis)
yvec_3 = Vector(deplane_3.YAxis)
zvec_3 = Vector(deplane_3.ZAxis)

mtchanc_4 = MatchAncestor(AT=baseplane_2, CT=courtyard_upper_2)  # -> MAT; inputs AT: tree, CT: tree; same code as mtchanc
deplane_4 = DeconstructPlane(Plane=mtchanc_4)  # -> Origin, XAxis, YAxis, ZAxis
pflip_4 = FlipPlane(Plane=mtchanc_4, ReverseX=False, ReverseY=False, SwapAxes=True)
revxvec_4 = Vector(expr("-x", deplane_4.XAxis))
revzvec_4 = Vector(expr("-x", deplane_4.ZAxis))
revyvec_4 = Vector(expr("-x", deplane_4.YAxis))
xvec_4 = Vector(deplane_4.XAxis)
yvec_4 = Vector(deplane_4.YAxis)
origin_4 = Point(deplane_4.Origin)
zvec_4 = Vector(deplane_4.ZAxis)

amp = Amplitude(Vector=revxvec, Amplitude=1)
amp_2 = Amplitude(Vector=revyvec, Amplitude=1)
amp_3 = Amplitude(Vector=revzvec, Amplitude=1)
amp_4 = Amplitude(Vector=xvec_2, Amplitude=1)
amp_5 = Amplitude(Vector=yvec_2, Amplitude=1)
amp_6 = Amplitude(Vector=zvec_2, Amplitude=1)
amp_7 = Amplitude(Vector=revxvec_2, Amplitude=1)
amp_8 = Amplitude(Vector=revyvec_2, Amplitude=1)
amp_9 = Amplitude(Vector=xvec, Amplitude=1)
amp_10 = Amplitude(Vector=yvec, Amplitude=1)
amp_11 = Amplitude(Vector=zvec, Amplitude=1)
amp_12 = Amplitude(Vector=xvec_3, Amplitude=1)
amp_13 = Amplitude(Vector=yvec_3, Amplitude=1)
amp_14 = Amplitude(Vector=zvec_3, Amplitude=1)
amp_15 = Amplitude(Vector=revxvec_3, Amplitude=1)
amp_16 = Amplitude(Vector=revyvec_3, Amplitude=1)
amp_17 = Amplitude(Vector=revzvec_3, Amplitude=1)
amp_18 = Amplitude(Vector=xvec_4, Amplitude=1)
amp_19 = Amplitude(Vector=yvec_4, Amplitude=1)
amp_20 = Amplitude(Vector=zvec_4, Amplitude=1)
amp_21 = Amplitude(Vector=revxvec_4, Amplitude=1)
amp_22 = Amplitude(Vector=revyvec_4, Amplitude=1)
amp_23 = Amplitude(Vector=revzvec_4, Amplitude=1)

amp_24 = Amplitude(Vector=revzvec, Amplitude=floorheight_2)
move = Move(Geometry=branch, Motion=amp_24)  # -> Geometry, Transform
arrlinear = LinearArray(Geometry=move.Geometry, Direction=amp_24, Count=floor_count_underground_2)  # -> Geometry, Transform
trim = TrimTree(Tree=arrlinear.Geometry, Depth=1)  # -> graft(Tree)
zones_underground = Brep(trim)

amp_25 = Amplitude(Vector=zvec_4, Amplitude=total_height)
extr = Extrude(Base=courtyard_upper_2, Direction=amp_25)
extr_2 = Extrude(Base=courtyard_lower_2, Direction=amp_25)
move_2 = Move(Geometry=courtyard_upper_2, Motion=amp_25)  # -> Geometry, Transform
move_3 = Move(Geometry=courtyard_lower_2, Motion=amp_25)  # -> Geometry, Transform
debrep = DeconstructBrep(Brep=extr)  # -> Faces, Edges, Vertices
debrep_2 = DeconstructBrep(Brep=extr_2)  # -> Faces, Edges, Vertices
item = ListItem(List=debrep.Faces, Index=0, Wrap=True)  # -> Item, Item1, Item2, Item3, Item4
item_2 = ListItem(List=debrep_2.Faces, Index=0, Wrap=True)  # -> Item, Item1, Item2, Item3, Item4
courtyard_lower_fassade = Surface(item_2.Item3)
courtyard_upper_fassade = Surface(item.Item4)
courtyard_lower_roof = Surface(move_3.Geometry)
courtyard_upper_volume = Brep(extr)
courtyard_lower_volume = Brep(extr_2)
courtyard_upper_roof = Surface(move_2.Geometry)

amp_26 = Amplitude(Vector=zvec_2, Amplitude=floorheight_2)
arrlinear_2 = LinearArray(Geometry=zones_box_2, Direction=amp_26, Count=numberoffloors_2)  # -> Geometry, Transform
trim_2 = TrimTree(Tree=arrlinear_2.Geometry, Depth=1)  # -> graft(Tree)
zones_allflors = Brep(trim_2)

series = Series(Start="1", Step=1, Count=numberoffloors_2)
concat = Concatenate(
    FragmentC=graft(windows_name_2),
    FragmentA=namingschema_delimiter_2,
    FragmentB=namingschema_floor_name_2,
    FragmentE=namingschema_delimiter_2,
    FragmentD=series)
trim_3 = TrimTree(Tree=trim_2, Depth=1)
tstat_2 = TreeStatistics(Tree=trim_3)  # -> Paths, Length, Count
windows_allfloors_name = Text(concat)
partition = PartitionList(List=flatten(concat), Size=tstat_2.Length)
match = MatchTree(Tree=trim_3, Guide=partition)

amp_27 = Amplitude(Vector=zvec_3, Amplitude=floorheight_2)
arrlinear_3 = LinearArray(Geometry=windows_rectangle_2, Direction=amp_27, Count=numberoffloors_2)  # -> Geometry, Transform
trim_4 = TrimTree(Tree=arrlinear_3.Geometry, Depth=1)  # -> graft(Tree)
windows_allfloors_rectangle = Curve(trim_4)

series_2 = Series(Start="-1", Step="-1", Count=floor_count_underground_2)
concat_2 = Concatenate(
    FragmentC=branch_2,
    FragmentA=namingschema_delimiter_2,
    FragmentB=namingschema_floor_name_2,
    FragmentE=namingschema_delimiter_2,
    FragmentD=series_2)  # -> graft(Result)
match_2 = MatchTree(Tree=concat_2, Guide=trim)
zones_underground_name = Text(match_2)

series_3 = Series(Start="1", Step=1, Count=numberoffloors_2)
concat_3 = Concatenate(
    FragmentC=zones_name_2,
    FragmentA=namingschema_delimiter_2,
    FragmentB=namingschema_floor_name_2,
    FragmentE=namingschema_delimiter_2,
    FragmentD=series_3)  # -> graft(Result)
match_3 = MatchTree(Tree=concat_3, Guide=trim_2)
zones_allflors_name = Text(concat_3)

zones_allflors_2 = ClusterOutput(zones_allflors)
zones_allflors_name_2 = ClusterOutput(zones_allflors_name)
windows_allfloors_rectangle_2 = ClusterOutput(windows_allfloors_rectangle)
courtyard_upper_volume_2 = ClusterOutput(courtyard_upper_volume)
courtyard_lower_volume_2 = ClusterOutput(courtyard_lower_volume)
courtyard_upper_fassade_2 = ClusterOutput(courtyard_upper_fassade)
courtyard_lower_fassade_2 = ClusterOutput(courtyard_lower_fassade)
courtyard_upper_roof_2 = ClusterOutput(courtyard_upper_roof)
courtyard_lower_roof_2 = ClusterOutput(courtyard_lower_roof)
zones_underground_2 = ClusterOutput(zones_underground)
zones_underground_name_2 = ClusterOutput(zones_underground_name)
windows_allfloors_name_2 = ClusterOutput(windows_allfloors_name)
panel = Panel(windows_allfloors_name)

# ==== cluster MoveRotatePlane
baseplane = ClusterInput()
movingx = ClusterInput()
movingy = ClusterInput()
movingz = ClusterInput()
anglex = ClusterInput()
angley = ClusterInput()
baseplane_2 = Plane(baseplane)
movingx_2 = Number(movingx)
movingy_2 = Number(movingy)
movingz_2 = Number(movingz)
anglex_2 = Number(anglex)
angley_2 = Number(angley)
deplane = DeconstructPlane(Plane=baseplane_2)  # -> Origin, XAxis, YAxis, ZAxis
revxvec = Vector(expr("-x", deplane.XAxis))
revzvec = Vector(expr("-x", deplane.ZAxis))
revyvec = Vector(expr("-x", deplane.YAxis))
origin = Point(deplane.Origin)
xvec = Vector(deplane.XAxis)
yvec = Vector(deplane.YAxis)
zvec = Vector(deplane.ZAxis)
amp = Amplitude(Vector=xvec, Amplitude=movingx_2)
amp_2 = Amplitude(Vector=yvec, Amplitude=movingy_2)
amp_3 = Amplitude(Vector=zvec, Amplitude=movingz_2)
amp_4 = Amplitude(Vector=revxvec, Amplitude=1)
amp_5 = Amplitude(Vector=revyvec, Amplitude=1)
amp_6 = Amplitude(Vector=revzvec, Amplitude=1)
addition = Addition(A=amp, B=amp_2, C=amp_3)
vrot = Rotate(Vector=xvec, Axis=yvec, Angle=degrees(anglex_2))
vrot_2 = Rotate(Vector=xvec, Axis=zvec, Angle=degrees(angley_2))
vrot_3 = Rotate(Vector=yvec, Axis=xvec, Angle=degrees(anglex_2))
vrot_4 = Rotate(Vector=yvec, Axis=zvec, Angle=degrees(angley_2))
move = Move(Geometry=origin, Motion=addition)  # -> Geometry, Transform
merge = Merge(Data1=graft(vrot), Data2=graft(vrot_2))
merge_2 = Merge(Data1=graft(vrot_3), Data2=graft(vrot_4))
avgp = AveragePoint(P=merge)  # -> AvP; inputs P: list of Point3d, M: list of Double
# ---------- avgp: C# usings ----------
using System.Linq;
# ---------- avgp: C# ----------
    //Author: Ueli Saluz
    //Last modified: 29.05.2020
    //Contact: usaluz@outlook.de

    if (Component.RunCount < 2)
    {
      Component.Name = "AveragePoint";
      Component.NickName = "AvgP";
      Component.Description = "Get the average point from a set of planes. Provide multiplier to weight some planes more.";
      Component.Params.Input[0].Name = "Points";
      Component.Params.Input[0].Description = "Points to take average from.";
      Component.Params.Input[1].Name = "Multipliers";
      Component.Params.Input[1].Description = "Multipliers act like weights towards a point.";

      Component.Params.Output[0].Name = "AveragePoint";
      Component.Params.Output[0].Description = "Resulting average point.";

      Component.Message = "VER 1.0";
    }
    if(P != null)
      AvP = GetAveragePoint(P.ToArray(), M.ToArray());
# ---------- avgp: C# additional code ----------
  public Point3d GetAveragePoint(Point3d[] points, double[] multipliers)
  {
    if (multipliers.Length < points.Length)
      multipliers = multipliers.Concat(Enumerable.Repeat(1d, points.Length - multipliers.Length)).ToArray();
    else if (multipliers.Length > points.Length)
      multipliers = multipliers.Take(points.Length).ToArray();

    if (multipliers.Sum() == 0)
      multipliers = Enumerable.Repeat(1d, points.Length).ToArray();

    var sum = multipliers.Sum();
    multipliers = multipliers.Select(x => x / sum).ToArray();

    for (int i = 0; i < points.Length; i++)
      points[i].Transform(new Transform(multipliers[i]));

    return points.Aggregate((a,b) => a + b);;
  }
# ---------- end avgp ----------
avgp_2 = AveragePoint(P=merge_2)  # -> AvP; inputs P: list of Point3d, M: list of Double; same code as avgp
trim = TrimTree(Tree=avgp, Depth=1)
trim_2 = TrimTree(Tree=avgp_2, Depth=1)
pl = ConstructPlane(Origin=move.Geometry, XAxis=trim, YAxis=trim_2)
movedbaseplanes = Plane(pl)
movedbaseplanes_2 = ClusterOutput(movedbaseplanes)

# ==== cluster WindowBand
baseplane = ClusterInput()
walls = ClusterInput()
parapetheight = ClusterInput()
windowheight = ClusterInput()
spacingtocorner = ClusterInput()

baseplane_2 = Plane(baseplane)
deplane = DeconstructPlane(Plane=baseplane_2)  # -> Origin, XAxis, YAxis, ZAxis
revxvec = Vector(expr("-x", deplane.XAxis))
revzvec = Vector(expr("-x", deplane.ZAxis))
pflip = FlipPlane(Plane=baseplane_2, ReverseX=False, ReverseY=False, SwapAxes=True)
revyvec = Vector(expr("-x", deplane.YAxis))
origin = Point(deplane.Origin)
xvec = Vector(deplane.XAxis)
yvec = Vector(deplane.YAxis)
zvec = Vector(deplane.ZAxis)
amp = Amplitude(Vector=xvec, Amplitude=1)
amp_2 = Amplitude(Vector=yvec, Amplitude=1)
amp_3 = Amplitude(Vector=zvec, Amplitude=1)
amp_4 = Amplitude(Vector=revxvec, Amplitude=1)
amp_5 = Amplitude(Vector=revyvec, Amplitude=1)
amp_6 = Amplitude(Vector=revzvec, Amplitude=1)

windowheight_2 = Number(windowheight)
parapetheight_2 = Number(parapetheight)
spacingtocorner_2 = Number(spacingtocorner)
walls_2 = Curve(walls)
toggle = BooleanToggle(True)
len = Length(Curve=walls_2)
dom = ConstructDomain(DomainStart=0, DomainEnd=len)
weightedsubdomains = WeightedSubdomains(Divisor="1", Domain=dom, Fill=toggle, FillMultiplier=spacingtocorner_2, FillEnds=toggle, AbsoluteFill=toggle)  # -> SubdomainValues, Subdomains; inputs Divisor: tree of Int32, Multiplier: tree, Domain: tree, Fill: Boolean, FillMultiplier: tree, FillEnds: Boolean, AbsoluteFill: Boolean
# ---------- weightedsubdomains: Python ----------
if ghenv.Component.RunCount<2:
    __author__ = "Ueli Saluz"
    __version__ = "2020.05.28"
    
    ghenv.Component.Name = "WeightedSubdomains"
    ghenv.Component.NickName = "WeightedSubdomains"
    ghenv.Component.Description = "Weighted subdomains on a given domain and add a domain with a certain multiplier in between all the domains. If domain not provided it uses default of 0-1."
    ghenv.Component.Message = "VER 1.6"
    
    ghenv.Component.Params.Input[0].Description = "Amount of sub domains"
    ghenv.Component.Params.Input[1].Description = "Multiplier for domains. Ignore if you want equal domains"
    ghenv.Component.Params.Input[2].Description = "Domain to slice into sub domains"
    ghenv.Component.Params.Input[3].Description = "If you wish to add domains in between all other domains set this to true."
    ghenv.Component.Params.Input[4].Description = "The multiplier to use for the inserted domain."
    ghenv.Component.Params.Input[5].Description = "If you wish to add the fill domain to the start and end set this to true."
    ghenv.Component.Params.Input[6].Description = "If you want the fill domain to be excatly the length of the fill multiplier set this to true."
    
    ghenv.Component.Params.Output[0].Description = "Sub domain values"
    ghenv.Component.Params.Output[1].Description = "Sub domains"

from Rhino.Geometry import Interval 
from System import Object
from Grasshopper import DataTree
from Grasshopper.Kernel.Data import GH_Path

def weightedSubdomain(domain=Interval(0, 1),divisor=1, multiplier=[]):
    if divisor<1:
        return
    else:
        length = domain.Length
        a=[]
        x = length/divisor  #equal parts which get multiplied
        if not multiplier:
            a = [x*i+domain.T0 for i in range(int(divisor)+1)]
            return a
        else:
            multiplier = [0] + multiplier
            a.append(0) #first value set to 0 otherwise if domainstart used it destroys the ratios
            for i in range(1,int(divisor)+1):
                try:
                    a.append(a[i-1]+x*multiplier[i])
                except Exception:
                    a.append(a[i-1]+x*i)
        r = length/a[-1]    #multipliers just give proportions and it needs to be remaped to original length
        for i in range(int(divisor)+1):
            a[i]=a[i]*r+domain.T0
        return a

def weightedSubdomainWithFill(domain=Interval(0, 1),divisor=1, multiplier=[],fillMultiplier=1,fillEnds=True,absoluteFill=False):
    if divisor<1:
        return
    length = domain.Length
    if not multiplier:
           multiplier = [1]*divisor
    if fillEnds:
        if absoluteFill: #convert the absolute fill width to a relative fill multiplier
            if fillMultiplier*(divisor+1)==length: #if the fills already fill everything the multipliers need to be put on 0.
                multiplier = [0]*len(multiplier)
            else:
                fillMultiplier = (fillMultiplier*sum(multiplier))/(length-fillMultiplier*(divisor+1))
        divisor = 2*divisor+1
        for i in range(int(divisor)+1):
            if i%2==0:
                multiplier.insert(i,fillMultiplier)
    else:
        if absoluteFill: #convert the absolute fill width to a relative fill multiplier
            if fillMultiplier*(divisor-1)==length:
                multiplier = [0]*len(multiplier)
            else:
                fillMultiplier = (fillMultiplier*sum(multiplier))/(length-fillMultiplier*(divisor-1))
        divisor = 2*divisor-1
        if not multiplier:
            for i in range(1,int(divisor)):
                if i%2==1:
                    multiplier.append(fillMultiplier)
                else:
                    multiplier.append(1)
        else:
            for i in range(1,int(divisor)):
                if i%2==1:
                    multiplier.insert(i,fillMultiplier)
    x = length/divisor  #equal parts which get multiplied
    multiplier = [0] + multiplier
    a=[]
    a.append(0) #first value set to 0 otherwise if domainstart used, it destroys the ratios
    for i in range(1,int(divisor)+1):
        try:
            a.append(a[i-1]+x*multiplier[i])
        except Exception:
            a.append(a[i-1]+x*i)
    r = length/a[-1]    #multipliers just give proportions and it needs to be remaped to original length
    for i in range(int(divisor)+1):
        a[i]=a[i]*r+domain.T0
    return a

def createDomains(numbers):
    a = []
    for i,num in enumerate(numbers[1:]):
        a.append(Interval(numbers[i], num))
    return a

if __name__ == "__main__":
    SubdomainValues = DataTree[Object]()
    Subdomains = DataTree[Object]()
    
    if Divisor.Paths.Count<Domain.Paths.Count:
        paths = Domain.Paths
    else:
        paths = Divisor.Paths
    for path in paths:
        try: #terrible way of writing code but if I set the list to list access the performance decreases massivly due to many calls
            domain = Domain.Branch(path)
            domain = domain[0]
        except Exception:
            try:
                domain = Domain.Branch(0)
                domain = domain[0]
            except Exception:
                domain = Interval(0, 1)
        divisor = Divisor.Branch(path)
        if not divisor:
            divisor = Divisor.Branch(0)
        divisor = divisor[0]
        if divisor > 0:
            multiplier = Multiplier.Branch(path)
            if not multiplier:
                try:
                    multiplier=Multiplier.Branch(0)
                except Exception:
                    multiplier = []
            multiplier = list(multiplier)
            if Fill:
                fillMultiplier = FillMultiplier.Branch(path)
                if not fillMultiplier:
                    fillMultiplier=FillMultiplier.Branch(0)
                fillMultiplier = fillMultiplier[0]
                subdivisions=weightedSubdomainWithFill(domain,divisor,multiplier,fillMultiplier,FillEnds,AbsoluteFill)
            else:
                subdivisions=weightedSubdomain(domain,divisor,multiplier)
            SubdomainValues.AddRange(subdivisions,path)
            if len(subdivisions)>2:
                subdivisionsDomains = createDomains(subdivisions)
                Subdomains.AddRange(subdivisionsDomains,path)
            else:
                Subdomains.Add(domain,path)
        else:
            SubdomainValues.EnsurePath(path)
            Subdomains.EnsurePath(path)
# ---------- end weightedsubdomains ----------
reprmcrv = ReparametrizeCurve(C=walls_2)  # -> RC, I, IL; inputs C: tree, T0: tree, T1: tree
# ---------- reprmcrv: Python ----------
#Component Information
#--------------------------------------------------------------------------------------------
if ghenv.Component.RunCount<2:
    #General
    #--------------------------------------------------------------------------------------------
    __author__ = "Ueli Saluz"
    __version__ = "2021.11.15"
    #--------------------------------------------------------------------------------------------
    ghenv.Component.Name = "ReparametrizeCurve"
    ghenv.Component.NickName = "RePrmCrv"
    ghenv.Component.Description = "Reparametrize the domain of a curve to the interval from 0 to the length of the curve."
    ghenv.Component.Message = "VER 1.0"
    
    ghenv.Component.Category = "Curve"
    ghenv.Component.SubCategory = "Util"
    
    #Inputs
    #--------------------------------------------------------------------------------------------
    inputIndex=0
    
    ghenv.Component.Params.Input[inputIndex].Name = "Curve"
    ghenv.Component.Params.Input[inputIndex].NickName = "C"
    ghenv.Component.Params.Input[inputIndex].Description = "Curve to reparametrize domain to interval [0,length]"
    ghenv.Component.Params.Input[inputIndex].Optional = True
    inputIndex+=1
    
    ghenv.Component.Params.Input[inputIndex].Name = "DomainStart"
    ghenv.Component.Params.Input[inputIndex].NickName = "T0"
    ghenv.Component.Params.Input[inputIndex].Description = "Starting value of domain that will be used to reparametrized. Default is 0."
    ghenv.Component.Params.Input[inputIndex].Optional = True
    inputIndex+=1
    
    ghenv.Component.Params.Input[inputIndex].Name = "DomainEnd"
    ghenv.Component.Params.Input[inputIndex].NickName = "T1"
    ghenv.Component.Params.Input[inputIndex].Description = "End value of domain that will be used to reparametrized. Default is length."
    ghenv.Component.Params.Input[inputIndex].Optional = True
    inputIndex+=1
    
    #Outputs
    #--------------------------------------------------------------------------------------------
    outputIndex=0
    
    ghenv.Component.Params.Output[outputIndex].Name = "ReparametrizedCurve"
    ghenv.Component.Params.Output[outputIndex].NickName = "RC"
    ghenv.Component.Params.Output[outputIndex].Description = "Reparametrized curve"
    outputIndex+=1
    
    ghenv.Component.Params.Output[outputIndex].Name = "Domain"
    ghenv.Component.Params.Output[outputIndex].NickName = "I"
    ghenv.Component.Params.Output[outputIndex].Description = "Domain of the reparametrized curve"
    outputIndex+=1
    
    ghenv.Component.Params.Output[outputIndex].Name = "DomainLength"
    ghenv.Component.Params.Output[outputIndex].NickName = "IL"
    ghenv.Component.Params.Output[outputIndex].Description = "Length of the domain of the reparametrized curve"
    outputIndex+=1


#Imports
#--------------------------------------------------------------------------------------------
from Rhino.Geometry import Interval, Curve
from System import Object
from Grasshopper import DataTree


#The Component function - Buisness logic only (e.g. working without trees)
#--------------------------------------------------------------------------------------------
"""Reparametrize the domain of a curve to the interval from 0 to the length of the curve.
    Inputs:
        crv: curve to reparametrize domain to interval [0,length]
        t0: Starting value of domain that will be used to reparametrized. Default is 0.
        t1: End value of domain that will be used to reparametrized. Default is length.
    Output:
        rc: Reparametrized curve"""
def reparametrizeCurve (crv,t0=None,t1=None):
    if(t0 is None):
        t0=0
    if(t1 is None):
        t1=crv.GetLength()
    crv.Domain = Interval(t0,t1)
    return crv

#Solver - Run with trees to enhance performance drastically
#--------------------------------------------------------------------------------------------
if __name__ == "__main__":
    
    #Initialize trees
    #--------------------------------------------------------------------------------------------
    ReparametrizedCurveTree = DataTree[Object]()
    DomainTree = DataTree[Object]()
    DomainLengthTree = DataTree[Object]()
    
    #Data matching
    #--------------------------------------------------------------------------------------------
    for path in C.Paths:
        curveBranch = C.Branch(path)
        for i,curve in enumerate(curveBranch):
            reparametrizedCurve = reparametrizeCurve(curve)
            ReparametrizedCurveTree.Add(reparametrizedCurve,path)
            DomainTree.Add(reparametrizedCurve.Domain,path)
            DomainLengthTree.Add(reparametrizedCurve.Domain.Length, path)
            
    #Assign trees to output
    #--------------------------------------------------------------------------------------------
    RC=ReparametrizedCurveTree
    I=DomainTree
    IL=DomainLengthTree
# ---------- end reprmcrv ----------
subcrv = SubCurve(BaseCurve=reprmcrv.RC, Domain=weightedsubdomains.Subdomains)
lito3p = ListInto3Parts(ListToSlice=subcrv, StartIndex="1", EndIndex="-1")  # -> FilteredList, ItemsBefore, ItemsAfter; inputs ListToSlice: tree, StartIndex: tree of Int32, EndIndex: tree of Int32; same code as lito3p
amp_7 = Amplitude(Vector=zvec, Amplitude=windowheight_2)
amp_8 = Amplitude(Vector=zvec, Amplitude=parapetheight_2)
move = Move(Geometry=lito3p.FilteredList, Motion=amp_8)  # -> Geometry, Transform
extr = Extrude(Base=move.Geometry, Direction=amp_7)

window_band = Curve(extr)
window_band_2 = ClusterOutput(window_band)

# ==== cluster CreateWallsWithOpenings
constructionmethod = ClusterInput()
openingheight = ClusterInput()
openingwidth = ClusterInput()
parapet_height = ClusterInput()
offsettosides = ClusterInput()
placement = ClusterInput()
baseplane = ClusterInput()
referencecurvewall = ClusterInput()
wallheigth = ClusterInput()
referencecurvewall_2 = Curve(referencecurvewall)
offsettosides_2 = Number(offsettosides)
baseplane_2 = Plane(baseplane)
openingheight_2 = Number(openingheight)
parapet_height_2 = Number(parapet_height)
openingwidth_2 = Number(openingwidth)
constructionmethod_2 = Integer(constructionmethod)
placement_2 = Number(placement)
wallheigth_2 = Number(wallheigth)

len = Length(Curve=referencecurvewall_2)
deplane = DeconstructPlane(Plane=baseplane_2)  # -> Origin, XAxis, YAxis, ZAxis
expression = Expression(
    x=placement_2,
    y=openingwidth_2,
    z=len,
    u=offsettosides_2,
    Expression="if((x*(z-2*u))<(y/2),y/2+u,if((x*(z-2*u))>((z-2*u)-y/2),z-y/2-u,x*z))")
expression_2 = Expression(x=expression, y=openingwidth_2, Expression="x-y/2")
expression_3 = Expression(x=expression, y=openingwidth_2, Expression="x+y/2")
dom = ConstructDomain(DomainStart=0, DomainEnd=len)
remap = RemapNumbers(Value=expression, Source=dom, Target=Domain(0, 1))  # -> Mapped, Clipped
remap_2 = RemapNumbers(Value=expression_2, Source=dom, Target=Domain(0, 1))  # -> Mapped, Clipped
remap_3 = RemapNumbers(Value=expression_3, Source=dom, Target=Domain(0, 1))  # -> Mapped, Clipped
eval = EvaluateLength(Curve=referencecurvewall_2, Length=remap.Mapped, Normalized=True)  # -> graft(Point), Tangent, Parameter
eval_2 = EvaluateLength(Curve=referencecurvewall_2, Length=remap_2.Mapped, Normalized=True)  # -> graft(Point), Tangent, Parameter
eval_3 = EvaluateLength(Curve=referencecurvewall_2, Length=remap_3.Mapped, Normalized=True)  # -> graft(Point), Tangent, Parameter
amp = Amplitude(Vector=eval.Tangent, Amplitude=openingheight_2)  # -> graft(Vector)
merge = Merge(Data1=eval_2.Point, Data2=eval_3.Point)

amp_2 = Amplitude(Vector=deplane.ZAxis, Amplitude=parapet_height_2)
amp_3 = Amplitude(Vector=deplane.ZAxis, Amplitude=openingheight_2)

expression_4 = Expression(x=parapet_height_2, Expression="if(x>0,True,False)")
tstat = TreeStatistics(Tree=graft(placement_2))  # -> Paths, Length, Count
dispatch = Dispatch(List=flatten(tstat.Paths), DispatchPattern=flatten(expression_4))  # -> ListA, ListB

amp_4 = Amplitude(Vector=deplane.ZAxis, Amplitude=wallheigth_2)
move = Move(Geometry=referencecurvewall_2, Motion=amp_4)  # -> Geometry, Transform
end = EndPoints(Curve=referencecurvewall_2)  # -> Start, End
end_2 = EndPoints(Curve=move.Geometry)  # -> Start, End
ln = Line(StartPoint=end_2.End, EndPoint=end.End)
ln_2 = Line(StartPoint=end_2.Start, EndPoint=end.Start)
merge_2 = Merge(Data1=referencecurvewall_2, Data2=ln_2, Data3=move.Geometry, Data4=ln)
join = JoinCurves(Curves=merge_2, Preserve=False)
trim = TrimTree(Tree=join, Depth=1)

branch = TreeBranch(Tree=merge, Path=dispatch.ListA, MaintainPaths=True)
branch_2 = TreeBranch(Tree=merge, Path=dispatch.ListB, MaintainPaths=True)
referencecurvewall_3 = Curve(referencecurvewall_2)
displayboundary = Curve(trim)
windowspointsonreferencecurve = Point(branch)
doorspointsonreferencecurve = Point(branch_2)
referencecurvewall_4 = ClusterOutput(referencecurvewall_3)
windowspointsonreferencecurve_2 = ClusterOutput(windowspointsonreferencecurve)
displayboundary_2 = ClusterOutput(displayboundary)
doorspointsonreferencecurve_2 = ClusterOutput(doorspointsonreferencecurve)

move_2 = Move(Geometry=eval.Point, Motion=expr("x/2", amp))  # -> Geometry, Transform
move_3 = Move(Geometry=eval.Point, Motion=expr("-x/2", amp))  # -> Geometry, Transform
merge_3 = Merge(Data1=move_2.Geometry, Data2=move_3.Geometry)

filter = StreamFilter(Gate=constructionmethod_2, Stream0=merge, Stream1=merge, Stream2=merge_3)

trim_2 = TrimTree(Tree=filter, Depth=1)
move_4 = Move(Geometry=trim_2, Motion=amp_2)  # -> Geometry, Transform
tstat_2 = TreeStatistics(Tree=filter)  # -> Paths, Length, Count
move_5 = Move(Geometry=move_4.Geometry, Motion=amp_3)  # -> Geometry, Transform
partition = PartitionList(List=flatten(move_4.Geometry), Size=tstat_2.Length)
tstat_3 = TreeStatistics(Tree=filter)  # -> Paths, Length, Count
match = MatchTree(Tree=partition, Guide=filter)
partition_2 = PartitionList(List=flatten(move_5.Geometry), Size=tstat_3.Length)
match_2 = MatchTree(Tree=partition_2, Guide=filter)
rev = ReverseList(List=match_2)
merge_4 = Merge(Data1=match, Data2=rev)
shift = ShiftList(List=merge_4, Shift=1, Wrap=True)
trim_3 = TrimTree(Tree=shift, Depth=1)
ln_3 = Line(StartPoint=merge_4, EndPoint=trim_3)
join_2 = JoinCurves(Curves=ln_3, Preserve=False)
trim_4 = TrimTree(Tree=join_2, Depth=1)

dom_2 = ConstructDomain(DomainStart=eval_2.Parameter, DomainEnd=eval_3.Parameter)
subcrv = SubCurve(BaseCurve=referencecurvewall_2, Domain=dom_2)
move_6 = Move(Geometry=subcrv, Motion=amp_2)  # -> Geometry, Transform
move_7 = Move(Geometry=move_6.Geometry, Motion=amp_3)  # -> Geometry, Transform
ln_4 = Line(StartPoint=match, EndPoint=match_2)
merge_5 = Merge(Data1=graft(move_6.Geometry), Data2=ln_4, Data3=graft(move_7.Geometry))
join_3 = JoinCurves(Curves=merge_5, Preserve=False)
trim_5 = TrimTree(Tree=join_3, Depth=1)

filter_2 = StreamFilter(Gate=constructionmethod_2, Stream0=trim_5, Stream1=trim_4, Stream2=trim_4)

branch_3 = TreeBranch(Tree=filter_2, Path=dispatch.ListB, MaintainPaths=True)
branch_4 = TreeBranch(Tree=filter_2, Path=dispatch.ListA, MaintainPaths=True)
windows = Curve(branch_4)
doors = Curve(branch_3)
windows_2 = ClusterOutput(windows)
doors_2 = ClusterOutput(doors)
