# Grasshopper definition Reporting-LCA.gh (Grasshopper 1.0.7)
# plug-ins: MetaHopper

panel = Panel("E:\Nextcloud\Public\FOR2363\TP4\LUH\HVAC-Systems\BatchCurrent\Data_Source\Simulation-Files")
panel_2 = Panel("E:\Nextcloud\Public\FOR2363\TP4\LUH\HVAC-Systems\FirstBatch\Data_Source\Simulation-Files")
panel_3 = Panel("Simulation003")
panel_4 = Panel("EnergyModel")
output_directory = GetString(panel_2, AtLeast=1, AtMost=1, TreeAccess=False)
debugmode = Boolean(Toggle(True))
modelname = GetString(panel_3, AtLeast=1, AtMost=1, TreeAccess=False)
onoff = EnableDisableObject(Enabled=debugmode, AllObjects_Object=[panel, panel_4, panel_3])
correct = Correct(computetext=output_directory)
path = FilePath(correct)
concat = Concatenate(FragmentA=path, FragmentB="\", FragmentC=modelname)
write = NAME(path=panel, content=output_directory)  # disabled
# ---------- write: Python ----------
from os.path import join
if content:
    f = open(join(path,'DoubleCheck1.txt'), "w")
    f.write(content)
    f.close()
# ---------- end write ----------
concat_2 = Concatenate(FragmentA=concat, FragmentB="\", FragmentC="openstudio")
concat_3 = Concatenate(FragmentA=concat_2, FragmentB="\", FragmentC="run")
panel_5 = Panel("in")
concat_4 = Concatenate(FragmentA=concat_3, FragmentB="\", FragmentC="eplustbl.htm")
concat_5 = Concatenate(FragmentA=concat_3, FragmentB="\", FragmentC="eplusout")
concat_6 = Concatenate(FragmentA=concat_3, FragmentB="\", FragmentC="in")
concat_7 = Concatenate(FragmentA=concat_2, FragmentB="\", FragmentD=modelname, FragmentC=".hbjson")
concat_8 = Concatenate(FragmentA=concat_5, FragmentC=".sql")
concat_9 = Concatenate(FragmentA=concat_6, FragmentB=".idf")
concat_10 = Concatenate(FragmentA=concat_6, FragmentB=".osm")
reports_filepath = FilePath(concat_4)
sql_filepath = FilePath(concat_8)

panel_6 = Panel("Baseboard Total Heating Energy")
customresult = HBReadCustomResult(sql=sql_filepath, output_names=panel_6)  # -> results; plug-in component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
avr = Average(Input=customresult)
ma = MassAddition(Input=customresult)  # -> Result, PartialResults
itemor0 = ItemOr0(values=ma.Result, header=panel_6, item=panel_6)
itemor0_2 = ItemOr0(values=avr, header=panel_6, item=panel_6)
expression = Expression(x=itemor0, Expression="x/1000000")
expression_2 = Expression(x=itemor0_2, Expression="x/1000000")
cp = ContextPrint(BaseboardTotalHeatingEnergySumAverage_MJ=expression_2)
cp_2 = ContextPrint(BaseboardTotalHeatingEnergySumSum_MJ=expression)

panel_7 = Panel("Baseboard Total Heating Rate")
customresult_2 = HBReadCustomResult(sql=sql_filepath, output_names=panel_7)  # -> results; plug-in component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
avr_2 = Average(Input=customresult_2)
ma_2 = MassAddition(Input=customresult_2)  # -> Result, PartialResults
itemor0_3 = ItemOr0(values=avr_2, header=panel_7, item=panel_7)
itemor0_4 = ItemOr0(values=ma_2.Result, header=panel_7, item=panel_7)
expression_3 = Expression(x=itemor0_4, Expression="x/1000")
expression_4 = Expression(x=itemor0_3, Expression="x/1000")
cp_3 = ContextPrint(BaseboardTotalHeatingRateAverageAverage_kW=expression_4)
cp_4 = ContextPrint(BaseboardTotalHeatingRateAverageSum_kW=expression_3)

panel_8 = Panel("Baseboard Hot Water Energy")
customresult_3 = HBReadCustomResult(sql=sql_filepath, output_names=panel_8)  # -> results; plug-in component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
avr_3 = Average(Input=customresult_3)
ma_3 = MassAddition(Input=customresult_3)  # -> Result, PartialResults
itemor0_5 = ItemOr0(values=avr_3, header=panel_8, item=panel_8)
itemor0_6 = ItemOr0(values=ma_3.Result, header=panel_8, item=panel_8)
expression_5 = Expression(x=itemor0_5, Expression="x/1000000")
expression_6 = Expression(x=itemor0_6, Expression="x/1000000")
cp_5 = ContextPrint(BaseboardHotWaterEnergySumAverage_MJ=expression_5)
cp_6 = ContextPrint(BaseboardHotWaterEnergySumSum_MJ=expression_6)

panel_9 = Panel("Baseboard Water Outlet Temperature")
customresult_4 = HBReadCustomResult(sql=sql_filepath, output_names=panel_9)  # -> results; plug-in component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
avr_4 = Average(Input=customresult_4)
itemor0_7 = ItemOr0(values=avr_4, header=panel_9, item=panel_9)
cp_7 = ContextPrint(BaseboardWaterOutletTemperatureAverageAverage_C=itemor0_7)

panel_10 = Panel("Baseboard Air Inlet Temperature")
customresult_5 = HBReadCustomResult(sql=sql_filepath, output_names=panel_10)  # -> results; plug-in component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
avr_5 = Average(Input=customresult_5)
ma_4 = MassAddition(Input=customresult_5)  # -> Result, PartialResults
itemor0_8 = ItemOr0(values=avr_5, header=panel_10, item=panel_10)
itemor0_9 = ItemOr0(values=ma_4.Result, header=panel_10, item=panel_10)
cp_8 = ContextPrint(BaseboardAirInletTemperatureAverageSum_C=itemor0_9)
cp_9 = ContextPrint(BaseboardAirInletTemperatureAverageAverage_C=itemor0_8)

panel_11 = Panel("Baseboard Air Mass Flow Rate")
customresult_6 = HBReadCustomResult(sql=sql_filepath, output_names=panel_11)  # -> results; plug-in component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
avr_6 = Average(Input=customresult_6)
ma_5 = MassAddition(Input=customresult_6)  # -> Result, PartialResults
itemor0_10 = ItemOr0(values=avr_6, header=panel_11, item=panel_11)
itemor0_11 = ItemOr0(values=ma_5.Result, header=panel_11, item=panel_11)
cp_10 = ContextPrint(BaseboardAirMassFlowRateAverageAverage_kg_s=itemor0_10)
cp_11 = ContextPrint(BaseboardAirMassFlowRateAverageSum_kg_s=itemor0_11)

idf_filepath = FilePath(concat_9)
readtable = HBReadTabularData(sql=sql_filepath, table_name="End Uses")  # -> values, col_names, row_names; plug-in component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
readtable_2 = HBReadTabularData(sql=sql_filepath, table_name="Site and Source Energy")  # -> values, col_names, row_names; plug-in component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
panel_12 = Panel("Total Source Energy")
loadobjects = HBLoadObjects(hb_file=concat_7, load=Toggle(True))  # -> report, hb_objs; plug-in component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

readtable_3 = HBReadTabularData(sql=sql_filepath, table_name="Annual Heat Emissions Summary")  # -> values, col_names, row_names; plug-in component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
itemor0_12 = ItemOr0(values=readtable_3.values, header=readtable_3.col_names, item="Zone Exfiltration")
itemor0_13 = ItemOr0(values=readtable_3.values, header=readtable_3.col_names, item="Envelope Convection")
itemor0_14 = ItemOr0(values=readtable_3.values, header=readtable_3.col_names, item="Zone Exhaust Air")
itemor0_15 = ItemOr0(values=readtable_3.values, header=readtable_3.col_names, item="Total")
itemor0_16 = ItemOr0(values=readtable_3.values, header=readtable_3.col_names, item="HVAC Relief Air")
itemor0_17 = ItemOr0(values=readtable_3.values, header=readtable_3.col_names, item="HVAC Reject Heat")
expression_7 = Expression(x=itemor0_14, Expression="x/1000")
expression_8 = Expression(x=itemor0_13, Expression="x/1000")
expression_9 = Expression(x=itemor0_12, Expression="x/1000")
expression_10 = Expression(x=itemor0_15, Expression="x/1000")
expression_11 = Expression(x=itemor0_16, Expression="x/1000")
expression_12 = Expression(x=itemor0_17, Expression="x/1000")
cp_12 = ContextPrint(HeatEmissionsZoneHVACReliefAir_MWh_a=expression_11)
cp_13 = ContextPrint(HeatEmissionsZoneHVACRejectHeat_MWh_a=expression_12)
cp_14 = ContextPrint(HeatEmissionsZoneZoneExhaustAir_MWh_a=expression_7)
cp_15 = ContextPrint(HeatEmissionsEnvelopeConvection_MWh_a=expression_8)
cp_16 = ContextPrint(HeatEmissionsZoneExfiltration_MWh_a=expression_9)
cp_17 = ContextPrint(HeatEmissionsTotal_MWh_a=expression_10)

selectmatrixvalue = SelectMatrixValue(
    values=readtable.values,
    columnnames=readtable.col_names,
    rownames=readtable.row_names,
    columnitem="Electricity",
    rowitem="Heating")
geoprop = HBGeometryProperties(rooms=flatten(loadobjects.hb_objs))  # -> ext_wall_area, ext_win_area, volume, floor_area, floor_ep_constr; plug-in component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
selectmatrixvalue_2 = SelectMatrixValue(
    values=readtable_2.values,
    columnnames=readtable_2.col_names,
    rownames=readtable_2.row_names,
    columnitem="Energy Per Total Building Area",
    rowitem="Total Site Energy")
cp_18 = ContextPrint(Volume_m³=geoprop.volume)
division = Division(A=geoprop.ext_win_area, B=geoprop.ext_wall_area)
division_2 = Division(A=geoprop.floor_ep_constr, B=geoprop.floor_area)
expression_13 = Expression(x=division_2, Expression="1-x")
cp_19 = ContextPrint(WindowToWallRatio_=division)

panel_13 = Panel("HYDRONIC BASEBOARD-Design Size U-Factor Times Area Value [W/K]")
readhvac = HBReadHVACSizing(sql=sql_filepath, comp_type="ZoneHVAC:Baseboard:Convective:Water")  # -> zone_names, zone_peak_cool, zone_peak_heat, comp_types, comp_properties, comp_values; plug-in component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
endswith = NAME(x=readhvac.comp_properties, y=panel_13)  # -> a
# ---------- endswith: Python ----------
a = x.endswith(y)
# ---------- end endswith ----------
dispatch = Dispatch(List=readhvac.comp_values, DispatchPattern=endswith)  # -> ListA, ListB
trim = TrimTree(Tree=dispatch.ListA, Depth=1)

customresult_7 = HBReadCustomResult(sql=sql_filepath, output_names="Baseboard Water Inlet Temperature")  # -> results; plug-in component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
customresult_8 = HBReadCustomResult(sql=sql_filepath, output_names="Baseboard Air Outlet Temperature")  # -> results; plug-in component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
valueor0 = ValueOr0(value=customresult_7)
valueor0_2 = ValueOr0(value=customresult_8)
subtraction = Subtraction(A=valueor0, B=valueor0_2)
multiplication = Multiplication(A=trim, B=subtraction)
expression_14 = Expression(x=multiplication, Expression="x/1000")
avr_7 = Average(Input=expression_14)
ma_6 = MassAddition(Input=expression_14)  # -> Result, PartialResults
cp_20 = ContextPrint(BaseboardCapacityAverage_kW=avr_7)
cp_21 = ContextPrint(BaseboardCapacitySum_kW=ma_6.Result)

panel_14 = Panel("Central Air Source Heat Pump Capacity")
customresult_9 = HBReadCustomResult(sql=sql_filepath, output_names=panel_14)  # -> results; plug-in component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
itemor0_18 = ItemOr0(values=customresult_9, header=panel_14, item=panel_14)
expression_15 = Expression(x=itemor0_18, Expression="x/1000")
cp_22 = ContextPrint(CentralAirSourceHeatPumpCapacity_kW=expression_15)

cp_23 = ContextPrint(ConstructionArea_=expression_13)

readtable_4 = HBReadTabularData(sql=sql_filepath, table_name="Boiler:HotWater")  # -> values, col_names, row_names; plug-in component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
itemor0_19 = ItemOr0(values=readtable_4.values, header=readtable_4.col_names, item="Design Size Nominal Capacity")
expression_16 = Expression(x=itemor0_19, Expression="x/1000")
cp_24 = ContextPrint(BoilerDesignSizeNominalCapacity_kW=expression_16)

panel_15 = Panel("Boiler Heating Energy")  # disabled
getepsqlvalue = NAME(outputVariableName=panel_15)  # -> query, value, unit; disabled
# ---------- getepsqlvalue: Python ----------
import sqlite3

query= ("SELECT KeyValue,MaxValue,MinValue Units "+ 
"FROM ReportVariableWithTime " + 
"WHERE Name = \"" + outputVariableName + "\" " + 
"AND TableName = \"" + tableName + "\" " + 
"AND ColumnName = \"" + columnName + "\" " + 
"AND Rowname = \"" + rowName + "\" ")
 #AND ReportForString='Entire Facility'
conn = sqlite3.connect(path)
c = conn.cursor()
c.execute(query)
results = list(c)
if len(results)!=1:
    print("There was more than 1 value.")
result = results[0]
value = result[0].strip()
unit = result[1]
c.close()
# ---------- end getepsqlvalue ----------

eui = HBEndUseIntensity(sql=sql_filepath, ip=Toggle(False))  # -> eui, eui_end_use, end_uses, gross_floor; plug-in component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
itemor0_20 = ItemOr0(values=eui.eui_end_use, header=eui.end_uses, item="Heating")
itemor0_21 = ItemOr0(values=eui.eui_end_use, header=eui.end_uses, item="Cooling")
itemor0_22 = ItemOr0(values=eui.eui_end_use, header=eui.end_uses, item="Interior Equipment")
itemor0_23 = ItemOr0(values=eui.eui_end_use, header=eui.end_uses, item="Interior Lighting")
itemor0_24 = ItemOr0(values=eui.eui_end_use, header=eui.end_uses, item="Electric Equipment")
itemor0_25 = ItemOr0(values=eui.eui_end_use, header=eui.end_uses, item="Pumps")
cp_25 = ContextPrint(EUIInteriorEquipment_kWh_m²a=itemor0_22)
cp_26 = ContextPrint(EUIHeating_kWh_m²a=itemor0_20)
cp_27 = ContextPrint(EUICooling_kWh_m²a=itemor0_21)
cp_28 = ContextPrint(EUIInteriorLighting_kWh_m²a=itemor0_23)
cp_29 = ContextPrint(EUIElectricEquipment_kWh_m²a=itemor0_24)
cp_30 = ContextPrint(EUIPumps_kWh_m²a=itemor0_25)

panel_16 = Panel(itemor0_20)
panel_17 = Panel("AnnualBuildingUtilityPerformanceSummary")
panel_18 = Panel("AnnualBuildingUtilityPerformanceSummary")
number_slider = Slider(54.41, range=0..100)
expression_17 = Expression(x="627.65", Expression="x*277.8")
getepsqlvalue_2 = NAME(
    path=sql_filepath,
    reportName="AnnualBuildingUtilityPerformanceSummary",
    tableName="Building Area",
    columnName="Area",
    rowName="Total Building Area")  # -> query, value, unit
# ---------- getepsqlvalue_2: Python ----------
import sqlite3

query= ("SELECT Value, Units "+ 
"FROM TabularDataWithStrings " + 
"WHERE ReportName = \"" + reportName + "\" " + 
"AND TableName = \"" + tableName + "\" " + 
"AND ColumnName = \"" + columnName + "\" " + 
"AND Rowname = \"" + rowName + "\" ")
 #AND ReportForString='Entire Facility'
conn = sqlite3.connect(path)
c = conn.cursor()
c.execute(query)
results = list(c)
if len(results)!=1:
    print("There was more than 1 value.")
result = results[0]
value = result[0].strip()
unit = result[1]
c.close()
# ---------- end getepsqlvalue_2 ----------
getepsqlvalue_3 = NAME(
    path=sql_filepath,
    reportName="AnnualBuildingUtilityPerformanceSummary",
    tableName="Site and Source Energy",
    columnName="Energy Per Total Building Area",
    rowName="Total Site Energy")  # -> query, value, unit; same code as getepsqlvalue_2
getepsqlvalue_4 = NAME(path=sql_filepath, reportName=panel_17, tableName="End Uses", columnName="Electricity", rowName="Heating")  # -> query, value, unit; same code as getepsqlvalue_2
getepsqlvalue_5 = NAME(path=sql_filepath, reportName=panel_17, tableName="End Uses", columnName="Natural Gas", rowName="Heating")  # -> query, value, unit; same code as getepsqlvalue_2
getepsqlvalues = NAME(path=sql_filepath, reportName=panel_18, tableName="End Uses", rowName="Heating")  # -> query, columnNames, values, units
# ---------- getepsqlvalues: Python ----------
import sqlite3

query= ("SELECT ColumnName,Value,Units "+ 
"FROM TabularDataWithStrings " + 
"WHERE ReportName = \"" + reportName + "\" " + 
"AND TableName = \"" + tableName + "\" " + 
"AND Rowname = \"" + rowName + "\" ")
 #AND ReportForString='Entire Facility'
conn = sqlite3.connect(path)
c = conn.cursor()
c.execute(query)
results = list(c)
columnNames = []
values = []
units = []
for i,result in enumerate(results):
    columnNames.append(result[0].strip())
    values.append(result[1].strip())
    units.append(result[2].strip())
c.close()
# ---------- end getepsqlvalues ----------
getepsqlvalues_2 = NAME(path=sql_filepath, reportName=panel_18, tableName="End Uses", rowName="Cooling")  # -> query, columnNames, values, units; same code as getepsqlvalues
expression_18 = Expression(x="627.65", Expression="x*0.2778")
division_3 = Division(A=expression_17, B=eui.gross_floor)

# ---- group: MJ to kWh
expression_19 = Expression(x=getepsqlvalue_3.value, Expression="x*0.2778")

# ----
valueor0_3 = ValueOr0(value=getepsqlvalue_2.value)

# ---- group: GJ to kWh
expression_20 = Expression(x=getepsqlvalue_4.value, Expression="x*277.8")

expression_21 = Expression(x=getepsqlvalue_5.value, Expression="x*277.8")

# ----
valueor0_4 = ValueOr0(value=expression_17)
lito3p = ListInto3Parts(ListToSlice=getepsqlvalues.values, StartIndex="0", EndIndex="-1")  # -> FilteredList, ItemsBefore, ItemsAfter; inputs ListToSlice: tree, StartIndex: tree of Int32, EndIndex: tree of Int32
# ---------- lito3p: Python ----------
if ghenv.Component.RunCount<2:
    __author__ = "Ueli Saluz"
    __version__ = "2020.05.28"
    
    ghenv.Component.Name = "ListInto3Parts"
    ghenv.Component.NickName = "LiTo3P"
    ghenv.Component.Description = "Slice list into 3 parts. All lists are sliced with the same indices. End index = 0 = length(list)."
    ghenv.Component.Message = "VER 1.6"

from System import Object
from Grasshopper import DataTree

def filterList(listToFilter,startIndex,endIndex):
    # Return: FilteredList, Before, After
    if (((startIndex == 0) or (startIndex is None)) and ((endIndex == 0) or (endIndex is None))) or (endIndex <= startIndex and endIndex > 0):
        return (listToFilter,None,None)
    elif (startIndex == 0) or (startIndex is None):
        return (listToFilter[:endIndex],None,listToFilter[endIndex:])
    elif (endIndex == 0) or (endIndex is None):
        print 1
        return (listToFilter[:startIndex],listToFilter[startIndex:],None)
    else:
        return (listToFilter[startIndex:endIndex],listToFilter[:startIndex],listToFilter[endIndex:])

if __name__ == "__main__":
    FilteredList = DataTree[Object]()
    ItemsBefore = DataTree[Object]()
    ItemsAfter = DataTree[Object]()
    
    for path in ListToSlice.Paths:
        listBranch = ListToSlice.Branch(path)
        pyList = list(listBranch)   #Convert .Net List to Python
        try: #terrible way of writing code but if I set the list to list access the performance decreases massivly due to many calls
            startIndex = StartIndex.Branch(path)
            startIndex = startIndex[0]
        except Exception:
            try:
                startIndex = StartIndex.Branch(0)
                startIndex = startIndex[0]
            except Exception:
                startIndex = 0
        try:
            endIndex = EndIndex.Branch(path)
            endIndex = endIndex[0]
        except Exception:
            try:
                endIndex = EndIndex.Branch(0)
                endIndex = endIndex[0]
            except Exception:
                endIndex = len(pyList)
        filtList=filterList(pyList,startIndex,endIndex)
        if filtList[0]:
            FilteredList.AddRange(filtList[0],path)
        if filtList[1]:
            ItemsBefore.AddRange(filtList[1],path)
        if filtList[2]:
            ItemsAfter.AddRange(filtList[2],path)
# ---------- end lito3p ----------
lito3p_2 = ListInto3Parts(ListToSlice=getepsqlvalues_2.values, StartIndex="0", EndIndex="-1")  # -> FilteredList, ItemsBefore, ItemsAfter; inputs ListToSlice: tree, StartIndex: tree of Int32, EndIndex: tree of Int32; same code as lito3p
valueor0_5 = ValueOr0(value=expression_19)
division_4 = Division(A=expression_20, B=valueor0_3)
division_5 = Division(A=expression_21, B=valueor0_3)
cp_31 = ContextPrint(GrossFloorArea_m²=valueor0_3)
context_print = ContextPrint(EUIElectricityInteriorEquipment_kWh=valueor0_4)
valueor0_6 = ValueOr0(value=division_5)
valueor0_7 = ValueOr0(value=division_4)
ma_7 = MassAddition(Input=lito3p.FilteredList)  # -> Result, PartialResults
ma_8 = MassAddition(Input=lito3p_2.FilteredList)  # -> Result, PartialResults
cp_32 = ContextPrint(EUI_kWh_m²a=valueor0_5)

# ---- group: GJ to kWh
expression_22 = Expression(x=ma_8.Result, Expression="x*277.8")

expression_23 = Expression(x=ma_7.Result, Expression="x*277.8")

# ----
cp_33 = ContextPrint(EUIHeatingNatrualGas_kWh_m²a=valueor0_6)
cp_34 = ContextPrint(EUIHeatingElectricity_kWh_m²a=valueor0_7)

# ----
# SHW PUMP1-Design Flow Rate [m3/s]
# SHW PUMP1-Design Power Consumption [W]
# SERVICE HOT WATER PUMP-Design Flow Rate [m3/s]
# SERVICE HOT WATER PUMP-Design Power Consumption [W]
panel_19 = Panel("Pump:ConstantSpeed")
readhvac_2 = HBReadHVACSizing(sql=sql_filepath, comp_type=panel_19)  # -> zone_names, zone_peak_cool, zone_peak_heat, comp_types, comp_properties, comp_values; plug-in component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
endswith_2 = NAME(x=readhvac_2.comp_properties, y="Design Power Consumption [W]")  # -> a; same code as endswith
endswith_3 = NAME(x=readhvac_2.comp_properties, y="Design Flow Rate [m3/s]")  # -> a; same code as endswith
dispatch_2 = Dispatch(List=readhvac_2.comp_values, DispatchPattern=endswith_3)  # -> ListA, ListB
dispatch_3 = Dispatch(List=readhvac_2.comp_values, DispatchPattern=endswith_2)  # -> ListA, ListB
trim_2 = TrimTree(Tree=dispatch_3.ListA, Depth=1)
trim_3 = TrimTree(Tree=dispatch_2.ListA, Depth=1)
expression_24 = Expression(x=trim_3, Expression="x*60000")
expression_25 = Expression(x=trim_2, Expression="x/1000")
cp_35 = ContextPrint(HotWaterPumpDesignFlowRate_l_min=expression_24)
cp_36 = ContextPrint(HotWaterPumpDesignPowerConsumption_kW=expression_25)

panel_20 = Panel("Water Heater Source Side Heat Transfer Energy")
customresult_10 = HBReadCustomResult(sql=sql_filepath, output_names=panel_20)  # -> results; plug-in component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
itemor0_26 = ItemOr0(values=customresult_10, header=panel_20, item=panel_20)
expression_26 = Expression(x=itemor0_26, Expression="x/1000000")
cp_37 = ContextPrint(WaterHeaterSourceSideHeatTransferEnergySum_MJ=expression_26)

panel_21 = Panel("Water Heater Source Side Inlet Temperature")
customresult_11 = HBReadCustomResult(sql=sql_filepath, output_names=panel_21)  # -> results; plug-in component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
itemor0_27 = ItemOr0(values=customresult_11, header=panel_21, item=panel_21)
cp_38 = ContextPrint(WaterHeaterSourceSideInletTemperatureAverage_C=itemor0_27)

panel_22 = Panel("Water Heater Heating Rate")
customresult_12 = HBReadCustomResult(sql=sql_filepath, output_names=panel_22)  # -> results; plug-in component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
itemor0_28 = ItemOr0(values=customresult_12, header=panel_22, item=panel_22)
expression_27 = Expression(x=itemor0_28, Expression="x/1000")
cp_39 = ContextPrint(WaterHeaterHeatingRateAverage_kW=expression_27)

panel_23 = Panel("Water Heater Source Side Outlet Temperature")
customresult_13 = HBReadCustomResult(sql=sql_filepath, output_names=panel_23)  # -> results; plug-in component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
itemor0_29 = ItemOr0(values=customresult_13, header=panel_23, item=panel_23)
cp_40 = ContextPrint(WaterHeaterSourceSideOutletTemperatureAverage_C=itemor0_29)

panel_24 = Panel("Water Heater Total Demand Heat Transfer Rate")
customresult_14 = HBReadCustomResult(sql=sql_filepath, output_names=panel_24)  # -> results; plug-in component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
itemor0_30 = ItemOr0(values=customresult_14, header=panel_24, item=panel_24)
expression_28 = Expression(x=itemor0_30, Expression="x/1000")
cp_41 = ContextPrint(WaterHeaterTotalDemandHeatTransferRateAverage_kW=expression_28)

panel_25 = Panel("Water Heater Use Side Heat Transfer Energy")
customresult_15 = HBReadCustomResult(sql=sql_filepath, output_names=panel_25)  # -> results; plug-in component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
itemor0_31 = ItemOr0(values=customresult_15, header=panel_25, item=panel_25)
expression_29 = Expression(x=itemor0_31, Expression="x/1000000")
cp_42 = ContextPrint(WaterHeaterUseSideHeatTransferEnergySum_MJ=expression_29)

panel_26 = Panel("Water Heater Total Demand Energy")
customresult_16 = HBReadCustomResult(sql=sql_filepath, output_names=panel_26)  # -> results; plug-in component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
itemor0_32 = ItemOr0(values=customresult_16, header=panel_26, item=panel_26)
expression_30 = Expression(x=itemor0_32, Expression="x/1000000")
cp_43 = ContextPrint(WaterHeaterTotalDemandEnergySum_MJ=expression_30)

panel_27 = Panel("Water Heater Source Side Heat Transfer Rate")
customresult_17 = HBReadCustomResult(sql=sql_filepath, output_names=panel_27)  # -> results; plug-in component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
itemor0_33 = ItemOr0(values=customresult_17, header=panel_27, item=panel_27)
expression_31 = Expression(x=itemor0_33, Expression="x/1000")
cp_44 = ContextPrint(WaterHeaterSourceSideHeatTransferRateAverage_kW=expression_31)

panel_28 = Panel("Water Heater Electricity Rate")
customresult_18 = HBReadCustomResult(sql=sql_filepath, output_names=panel_28)  # -> results; plug-in component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
itemor0_34 = ItemOr0(values=customresult_18, header=panel_28, item=panel_28)
expression_32 = Expression(x=itemor0_34, Expression="x/1000")
cp_45 = ContextPrint(WaterHeaterElectricityRateAverage_kW=expression_32)

customresult_19 = HBReadCustomResult(sql=sql_filepath, output_names="Water Heater Gas Rate")  # -> results; plug-in component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
itemor0_35 = ItemOr0(values=customresult_19, header="Water Heater Gas Rate", item="Water Heater Gas Rate")
expression_33 = Expression(x=itemor0_35, Expression="x/1000")
cp_46 = ContextPrint(WaterHeaterGasRateAverage_kW=expression_33)

panel_29 = Panel("Water Heater Use Side Inlet Temperature")
customresult_20 = HBReadCustomResult(sql=sql_filepath, output_names=panel_29)  # -> results; plug-in component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
itemor0_36 = ItemOr0(values=customresult_20, header=panel_29, item=panel_29)
cp_47 = ContextPrint(WaterHeaterUseSideInletTemperatureAverage_C=itemor0_36)

panel_30 = Panel("Water Heater Use Side Outlet Temperature")
customresult_21 = HBReadCustomResult(sql=sql_filepath, output_names=panel_30)  # -> results; plug-in component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
itemor0_37 = ItemOr0(values=customresult_21, header=panel_30, item=panel_30)
cp_48 = ContextPrint(WaterHeaterUseSideOutletTemperatureAverage_C=itemor0_37)

panel_31 = Panel("Water Heater Use Source Mass Flow Rate")
customresult_22 = HBReadCustomResult(sql=sql_filepath, output_names=panel_31)  # -> results; plug-in component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
itemor0_38 = ItemOr0(values=customresult_22, header=panel_31, item=panel_31)
cp_49 = ContextPrint(WaterHeaterSourceSideMassFlowRateAverage_kg_s=itemor0_38)

panel_32 = Panel("Water Heater Use Side Heat Transfer Rate")
customresult_23 = HBReadCustomResult(sql=sql_filepath, output_names=panel_32)  # -> results; plug-in component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
itemor0_39 = ItemOr0(values=customresult_23, header=panel_32, item=panel_32)
expression_34 = Expression(x=itemor0_39, Expression="x/1000")
cp_50 = ContextPrint(WaterHeaterUseSideHeatTransferRateAverage_kW=expression_34)

panel_33 = Panel("Water Heater Use Side Mass Flow Rate")
customresult_24 = HBReadCustomResult(sql=sql_filepath, output_names=panel_33)  # -> results; plug-in component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
itemor0_40 = ItemOr0(values=customresult_24, header=panel_33, item=panel_33)
cp_51 = ContextPrint(WaterHeaterUseSideMassFlowRateAverage_kg_s=itemor0_40)

panel_34 = Panel("Water Heater Heat Loss Rate")
customresult_25 = HBReadCustomResult(sql=sql_filepath, output_names=panel_34)  # -> results; plug-in component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
itemor0_41 = ItemOr0(values=customresult_25, header=panel_34, item=panel_34)
expression_35 = Expression(x=itemor0_41, Expression="x/1000")
cp_52 = ContextPrint(WaterHeaterHeatLossRateAverage_kW=expression_35)

panel_35 = Panel("Water Heater Tank Temperature")
customresult_26 = HBReadCustomResult(sql=sql_filepath, output_names=panel_35)  # -> results; plug-in component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
itemor0_42 = ItemOr0(values=customresult_26, header=panel_35, item=panel_35)
cp_53 = ContextPrint(WaterHeaterTankTemperatureAverage_C=itemor0_42)

panel_36 = Panel("Baseboard Hot Water Mass Flow Rate")
customresult_27 = HBReadCustomResult(sql=sql_filepath, output_names=panel_36)  # -> results; plug-in component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

avr_8 = Average(Input=customresult_27)
ma_9 = MassAddition(Input=customresult_27)  # -> Result, PartialResults

itemor0_43 = ItemOr0(values=avr_8, header=panel_36, item=panel_36)
itemor0_44 = ItemOr0(values=ma_9.Result, header=panel_36, item=panel_36)
cp_54 = ContextPrint(BaseboardHotWaterMassFlowRateAverageAverage_kg_s=itemor0_43)
cp_55 = ContextPrint(BaseboardHotWaterMassFlowRateAverageSum_kg_s=itemor0_44)

readhvac_3 = HBReadHVACSizing(sql=sql_filepath, comp_type="WaterHeater:Mixed")  # -> zone_names, zone_peak_cool, zone_peak_heat, comp_types, comp_properties, comp_values; plug-in component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
endswith_4 = NAME(x=readhvac_3.comp_properties, y="Design Flow Rate [m3/s]")  # -> a; same code as endswith
dispatch_4 = Dispatch(List=readhvac_3.comp_values, DispatchPattern=endswith_4)  # -> ListA, ListB
trim_4 = TrimTree(Tree=dispatch_4.ListA, Depth=1)

valueor0_8 = ValueOr0(value=trim_4)

expression_36 = Expression(x=valueor0_8, Expression="x*60000")
cp_56 = ContextPrint(ServiceHotWaterHeaterDesignFlowRate_l_min=expression_36)

panel_37 = Panel("Water Heater Heat Loss Energy")
customresult_28 = HBReadCustomResult(sql=sql_filepath, output_names=panel_37)  # -> results; plug-in component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
itemor0_45 = ItemOr0(values=customresult_28, header=panel_37, item=panel_37)

expression_37 = Expression(x=itemor0_45, Expression="x/1000000")

cp_57 = ContextPrint(WaterHeaterHeatLossEnergySum_MJ=expression_37)

# ==== cluster ItemOr0
item = ClusterInput()
values = ClusterInput()
header = ClusterInput()
header_2 = Text(header)
item_2 = Text(item)
values_2 = Number(values)
itemindex = ItemIndex(L=header_2, I=item_2)  # -> i; inputs L: list
# ---------- itemindex: Python ----------
#Component Information
#--------------------------------------------------------------------------------------------
if ghenv.Component.RunCount<2:
    #General
    #--------------------------------------------------------------------------------------------
    __author__ = "Ueli Saluz"
    __version__ = "2022.11.18"
    
    ghenv.Component.Name = "ItemIndex"
    ghenv.Component.NickName = "ItemIndex"
    ghenv.Component.Description = "A better IdemIndex"
    ghenv.Component.Message = "VER 1.0"
    ghenv.Component.Category = "Set"
    ghenv.Component.SubCategory = "List"
    
     #Inputs
    #--------------------------------------------------------------------------------------------
    inputIndex=0
    
    ghenv.Component.Params.Input[inputIndex].Name = "List"
    ghenv.Component.Params.Input[inputIndex].NickName = "L"
    ghenv.Component.Params.Input[inputIndex].Description = "Input1 is..."
    ghenv.Component.Params.Input[inputIndex].Optional = False
    inputIndex+=1
    
    ghenv.Component.Params.Input[inputIndex].Name = "Item"
    ghenv.Component.Params.Input[inputIndex].NickName = "I"
    ghenv.Component.Params.Input[inputIndex].Description = "Input2 is..."
    ghenv.Component.Params.Input[inputIndex].Optional = False
    inputIndex+=1
    
    #Outputs
    #--------------------------------------------------------------------------------------------
    outputIndex=0
    
    ghenv.Component.Params.Output[outputIndex].Name = "Index"
    ghenv.Component.Params.Output[outputIndex].NickName = "i"
    ghenv.Component.Params.Output[outputIndex].Description = "Output1 is..."
    outputIndex+=1

i = L.index(I)
# ---------- end itemindex ----------
item_3 = ListItem(List=values_2, Index=itemindex, Wrap=True)
null = NullItem(Item=item_3)  # -> NullFlags, InvalidFlags, Description
filter = StreamFilter(Gate=null.NullFlags, Stream0=item_3, Stream1="0")
valueor0 = Number(filter)
valueor0_2 = ClusterOutput(valueor0)

# ==== cluster Correct: Corrects an output file path from a compute component.
computetext = ClusterInput()
computetext_2 = Text(computetext)
strip = NAME(x=computetext_2, y="\"'")  # -> a
# ---------- strip: Python ----------
a = x.strip(y)
# ---------- end strip ----------
# Compute wrapps paths which turn into string literals.
# To undo this, unwrapping is neciassary.
# Assumption no recursion level deeper than 2.
# The wrong wrapping rises with 2^n
panel = Panel("\"E:\\\\\\\\\\\\\\\\Nextcloud\\\\\\\\\\\\\\\\Public\\\\\\\\\\\\\\\\FOR2363\\\\\\\\\\\\\\\\TP4\\\\\\\\\\\\\\\\LUH\\\\\\\\\\\\\\\\HVAC-Systems\\\\\\\\\\\\\\\\BatchCurrent\\\\\\\\\\\\\\\\Data_Source\\\\\\\\\\\\\\\\Simulation-Files\\\\\\\\\\\\\\\\Simulation000\\\\\\\\\\\\\\\\openstudio\\\\\\\\\\\\\\\\run\\\\\\\\\\\\\\\\in.idf\"")
rep = ReplaceText(Text=strip, Find="\\", Replace="\", RecursiveReplace=False)
rep_2 = ReplaceText(Text=rep, Find="\\", Replace="\", RecursiveReplace=False)
rep_3 = ReplaceText(Text=rep_2, Find="\\", Replace="\", RecursiveReplace=False)
rep_4 = ReplaceText(Text=rep_3, Find="\\", Replace="\", RecursiveReplace=False)
rep_5 = ReplaceText(Text=rep_4, Find="\\", Replace="\", RecursiveReplace=False)
rep_6 = ReplaceText(Text=rep_5, Find="\\", Replace="\", RecursiveReplace=False)
rep_7 = ReplaceText(Text=rep_6, Find="\\", Replace="\", RecursiveReplace=False)
rep_8 = ReplaceText(Text=rep_7, Find="\\", Replace="\", RecursiveReplace=False)
rep_9 = ReplaceText(Text=rep_8, Find="%", Replace="\", RecursiveReplace=False)
rep_10 = ReplaceText(Text=rep_9, Find="$", Replace=":", RecursiveReplace=False)
originaltext = Text(rep_10)
originaltext_2 = ClusterOutput(originaltext)

# ==== cluster ValueOr0
value = ClusterInput()
value_2 = Number(value)
null = NullItem(Item=value_2)  # -> NullFlags, InvalidFlags, Description
filter = StreamFilter(Gate=null.NullFlags, Stream0=value_2, Stream1="0")
valueor0 = Number(filter)
valueor0_2 = ClusterOutput(valueor0)

# ==== cluster SelectMatrixValue
values = ClusterInput()
columnnames = ClusterInput()
rownames = ClusterInput()
columnitem = ClusterInput()
rowitem = ClusterInput()
columnnames_2 = Text(columnnames)
columnitem_2 = Text(columnitem)
rowitem_2 = Text(rowitem)
rownames_2 = Text(rownames)
values_2 = Text(values)
tstat = TreeStatistics(Tree=values_2)  # -> Paths, Length, Count
itemindex = ItemIndex(L=rownames_2, I=rowitem_2)  # -> i; inputs L: list; same code as itemindex
itemindex_2 = ItemIndex(L=columnnames_2, I=columnitem_2)  # -> i; inputs L: list; same code as itemindex
item = ListItem(List=tstat.Paths, Index=itemindex, Wrap=True)
panel = Panel(rownames_2)
branch = TreeBranch(Tree=values_2, Path=item, MaintainPaths=True)
item_2 = ListItem(List=branch, Index=itemindex_2, Wrap=True)
valueor0 = ValueOr0(value=item_2)
panel_2 = Panel(values_2)
value = Text(valueor0)
value_2 = ClusterOutput(value)
