# Grasshopper definition ManualAdjusting.ghx (Grasshopper 1.0.7)

panel = Panel("E:\Nextcloud\Public\FOR2363\TP4\LUH\HVAC-Systems\CurrentBatch\Data_Source\Simulation-Files\EnergyModel\openstudio\run\in.idf")  # disabled
idf_filepath = GetString(panel, AtLeast=1, AtMost=1, TreeAccess=False)
correct = Correct(computetext=idf_filepath)
panel_2 = Panel("  100,                                    !- Maximum Number of Warmup Days")
idf_filepath_2 = Text(correct)
read = NAME(path=idf_filepath_2, read=Toggle(True))  # -> content; inputs read: tree
# ---------- read: Python ----------
if read:
    with open(path, "r") as file1:
        content = file1.read()
# ---------- end read ----------
regex = MatchRegularExpression(T=read, rp="Building(.*\n){8}  ;.*")  # -> M, msi, mg, mgsi
regex_2 = MatchRegularExpression(T=regex.M, rp="  ,\s*!- Maximum Number of Warmup Days")  # -> M, msi, mg, mgsi
rep = ReplaceText(Text=regex.M, Find=regex_2.M, Replace=panel_2, RecursiveReplace=False)
rep_2 = ReplaceText(Text=read, Find=regex.M, Replace=rep, RecursiveReplace=False)
nickname = NAME(path=idf_filepath_2, content=rep_2, write=Toggle(True))  # inputs write: tree
# ---------- nickname: Python ----------
if write:
    with open(path, "w") as file1:
        file1.write(content)
# ---------- end nickname ----------

# ==== cluster MatchRegularExpression: This component matches regex expression to text input.
ic = ClusterInput()
T = ClusterInput()
rp = ClusterInput()
ic_2 = IgnoreCase(ic)
rp_2 = RegexPattern(rp)
T_2 = Text(T)
expression = Expression(x=ic_2, y=T_2, Expression="x")
expression_2 = Expression(x=rp_2, y=T_2, Expression="x")
regex = MatchRegularExpressions(T=T_2, RP=expression_2, IC=expression)  # -> M, MSI, MG, MGSI, D; inputs T: tree of String, RP: tree of String, IC: tree of Boolean
# ---------- regex: C# usings ----------
//Imports
//--------------------------------------------------------------------------------------------
using System.Text.RegularExpressions;
# ---------- regex: C# ----------
    //General
    //--------------------------------------------------------------------------------------------
    //Authors: Ueli Saluz
    //Last modified: 2022-05-30
    //Contact: usaluz@posteo.de

    if (Component.RunCount < 2)
    {
      Component.Name = "MatchRegularExpressions";
      Component.NickName = "Regex";
      Component.Description = "This component matches regex expression to text input.";
      Component.Message = "VER 1.0";
      Component.Category = "Sets";
      Component.SubCategory = "Text";
      //Exposure level = 3

      //Inputs
      //--------------------------------------------------------------------------------------------
      int inputIndex = 0;

      Component.Params.Input[inputIndex].Name = "Text";
      Component.Params.Input[inputIndex].NickName = "T";
      Component.Params.Input[inputIndex].Description = "This is the string that should be matched against the regex pattern.";
      Component.Params.Input[inputIndex].Optional = false;
      inputIndex += 1;

      Component.Params.Input[inputIndex].Name = "RegexPattern";
      Component.Params.Input[inputIndex].NickName = "RP";
      Component.Params.Input[inputIndex].Description = "The regex pattern used to match";
      Component.Params.Input[inputIndex].Optional = false;
      inputIndex += 1;

      Component.Params.Input[inputIndex].Name = "IgnoreCase";
      Component.Params.Input[inputIndex].NickName = "IC";
      Component.Params.Input[inputIndex].Description = "Ignore case for the matching";
      Component.Params.Input[inputIndex].Optional = false;
      inputIndex += 1;

      //Outputs
      //--------------------------------------------------------------------------------------------
      int outputIndex = 0;

      Component.Params.Output[outputIndex].Name = "Matches";
      Component.Params.Output[outputIndex].NickName = "M";
      Component.Params.Output[outputIndex].Description = "The matches for the specified text string.";
      outputIndex += 1;

      Component.Params.Output[outputIndex].Name = "MatchStartIndices";
      Component.Params.Output[outputIndex].NickName = "MSI";
      Component.Params.Output[outputIndex].Description = "The start indices of the matches for the specified text string.";
      outputIndex += 1;

      Component.Params.Output[outputIndex].Name = "MatchGroups";
      Component.Params.Output[outputIndex].NickName = "MG";
      Component.Params.Output[outputIndex].Description = "The match groups of the matches for the specified text string.";
      outputIndex += 1;

      Component.Params.Output[outputIndex].Name = "MatchGroupStartIndices";
      Component.Params.Output[outputIndex].NickName = "MGSI";
      Component.Params.Output[outputIndex].Description = "The start indices of the match group of the matches for the specified text string.";
      outputIndex += 1;

      Component.Params.Output[outputIndex].Name = "Debug";
      Component.Params.Output[outputIndex].NickName = "D";
      Component.Params.Output[outputIndex].Description = "Debugging purpose.";
      outputIndex += 1;

    }

    //Initialize trees
    //--------------------------------------------------------------------------------------------
    DataTree<string> MatchesTree = new DataTree<string>();
    DataTree<int> MatchStartIndicesTree = new DataTree<int>();
    DataTree<string> MatchGroupsTree = new DataTree<string>();
    DataTree<int> MatchGroupStartIndicesTree = new DataTree<int>();

    DataTree<string> DebugTree = new DataTree<string>();

    //Data matching
    //--------------------------------------------------------------------------------------------
    foreach (GH_Path path in T.Paths)
    {
      DebugTree.Add("Debuggin panel", path);
      var textBranch = T.Branch(path);
      var regexPatternStringBranch = RP.Branch(path);
      var ignoreCaseBranch = IC.Branch(path);

      for (int i = 0; i < textBranch.Count;i++)
      {
        var text = textBranch[i];
        var regexPatternString = regexPatternStringBranch[i];
        var ignoreCase = ignoreCaseBranch[i];

        var regexSearchOptions = RegexOptions.Compiled;
        if (ignoreCase)
        {
          regexSearchOptions = regexSearchOptions | RegexOptions.IgnoreCase;
        }

        Regex regexPattern = new Regex(regexPatternString, regexSearchOptions);
        MatchCollection matches = regexPattern.Matches(text);
        if(matches.Count > 0){
          foreach (Match match in matches)
          {
            MatchesTree.Add(match.Value, path);
            MatchStartIndicesTree.Add(match.Index, path);
            //Match groups. More information about match groups under:
            //https://docs.microsoft.com/de-de/dotnet/api/system.text.regularexpressions.group?view=net-6.0
            GroupCollection matchGroups = match.Groups;
            int j = 0;
            foreach (Group matchGroup in matchGroups)
            {
              var graftedPath = path.AppendElement(j);
              MatchGroupsTree.Add(matchGroup.Value, graftedPath);
              MatchGroupStartIndicesTree.Add(matchGroup.Index, graftedPath);
              j++;
            }
          }
        }
        else{
          MatchesTree.Add(null, path);
          MatchStartIndicesTree.Add(-1, path);
        }
      }
    }

    //Assign trees to output
    //--------------------------------------------------------------------------------------------
    M = MatchesTree;
    MSI = MatchStartIndicesTree;
    MG = MatchGroupsTree;
    MGSI = MatchGroupStartIndicesTree;
    //Comment this out if done
    D = DebugTree;
# ---------- end regex ----------
panel = Panel(regex.MSI)
M = ClusterOutput(regex.M)
msi = ClusterOutput(regex.MSI)
mgsi = ClusterOutput(regex.MGSI)
mg = ClusterOutput(regex.MG)

# ==== cluster Correct
computetext = ClusterInput()
computetext_2 = Text(computetext)
strip = NAME(x=computetext_2, y="\"'")  # -> a
# ---------- strip: Python ----------
a = x.strip(y)
# ---------- end strip ----------
# Compute wrapps paths which turn into string literals.
# To undo this, unwrapping is neciassary.
# Assumption no recursion level deeper than 2.
# The wrong wrapping rises with 2^n
panel = Panel("\"E:\\\\\\\\\\\\\\\\Nextcloud\\\\\\\\\\\\\\\\Public\\\\\\\\\\\\\\\\FOR2363\\\\\\\\\\\\\\\\TP4\\\\\\\\\\\\\\\\LUH\\\\\\\\\\\\\\\\HVAC-Systems\\\\\\\\\\\\\\\\BatchCurrent\\\\\\\\\\\\\\\\Data_Source\\\\\\\\\\\\\\\\Simulation-Files\\\\\\\\\\\\\\\\Simulation000\\\\\\\\\\\\\\\\openstudio\\\\\\\\\\\\\\\\run\\\\\\\\\\\\\\\\in.idf\"")
rep = ReplaceText(Text=strip, Find="\\", Replace="\", RecursiveReplace=False)
rep_2 = ReplaceText(Text=rep, Find="\\", Replace="\", RecursiveReplace=False)
rep_3 = ReplaceText(Text=rep_2, Find="\\", Replace="\", RecursiveReplace=False)
rep_4 = ReplaceText(Text=rep_3, Find="\\", Replace="\", RecursiveReplace=False)
rep_5 = ReplaceText(Text=rep_4, Find="\\", Replace="\", RecursiveReplace=False)
rep_6 = ReplaceText(Text=rep_5, Find="\\", Replace="\", RecursiveReplace=False)
rep_7 = ReplaceText(Text=rep_6, Find="\\", Replace="\", RecursiveReplace=False)
rep_8 = ReplaceText(Text=rep_7, Find="\\", Replace="\", RecursiveReplace=False)
rep_9 = ReplaceText(Text=rep_8, Find="%", Replace="\", RecursiveReplace=False)
rep_10 = ReplaceText(Text=rep_9, Find="$", Replace=":", RecursiveReplace=False)
originaltext = Text(rep_10)
originaltext_2 = ClusterOutput(originaltext)
