# Grasshopper definition Simulation.ghx (Grasshopper 1.0.7)
# plug-ins: MetaHopper

panel = Panel("E:\Nextcloud\Public\FOR2363\TP4\LUH\HVAC-Systems\BatchCurrent\Data_Source\Simulation-Files\EnergyModel.hbjson")
panel_2 = Panel("E:\Nextcloud\Public\FOR2363\TP4\LUH\HVAC-Systems\BatchCurrent\Data_Source\Simulation-Files")
headless = Boolean(invert(Toggle(True)))
file = ReadFile(File=panel, PerLineParse=False)  # disabled
onoff = EnableDisableObject(Enabled=headless, AllObjects_Object=[file, vizbytype])
honeybeejson = GetString(file, AtLeast=1, AtMost=1, TreeAccess=False)
epw_filepath = GetFilePath("C:\EnergyPlusV9-5-0\WeatherData\DEU_Munich.108660_IWEC.epw", AtLeast=1, AtMost=1, TreeAccess=False)
output_directory = GetFilePath(panel_2, AtLeast=1, AtMost=1, TreeAccess=False)
strtoobj = HBStringToObject(hb_str=honeybeejson)  # -> hb_obj; plug-in component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
epw_filepath_2 = FilePath(epw_filepath)
output_directory_2 = FilePath(output_directory)
hb_model = Data(strtoobj)
vizbytype = HBVisualizeByType(hb_objs=hb_model)  # -> walls, interior_walls, roofs, ceilings, exterior_floors, interior_floors, air_walls, apertures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; disabled; plug-in component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

toggle = BooleanToggle(False)
simoutput = HBSimulationOutput(
    zone_energy_use=toggle,
    hvac_energy_use=toggle,
    gains_and_losses=toggle,
    comfort_metrics=toggle,
    surface_temperature=toggle,
    surface_energy_flow=toggle,
    load_type=toggle)  # -> report, sim_output; plug-in component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
toggle_2 = BooleanToggle(False)
merge = Merge(Data1="Annual Thermal Resilience Summary")
simcontrol = HBSimulationControl(
    do_zone_sizing=toggle_2,
    do_system_sizing=toggle_2,
    do_plant_sizing=toggle_2,
    for_sizing_period=toggle_2,
    for_run_period=Toggle(True))  # -> sim_control; plug-in component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
shadowcalc = HBShadowCalculation(solar_dist=Slider(0, range=0..100), update_method="Timestep", frequency=Slider(1, range=0..1))  # -> shadow_calc; plug-in component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
customoutput = HBCustomSimulationOutput(base_sim_output=simoutput.sim_output, summary_reports=merge)  # -> report, sim_output; plug-in component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
simpar = HBSimulationParameter(output=customoutput.sim_output, timestep=Slider(1, range=0..1), sim_control=simcontrol, shadow_calc=shadowcalc)  # -> sim_par; plug-in component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
modeltoosm = HBModelToOSM(
    model=hb_model,
    epw_file=epw_filepath_2,
    sim_par=simpar,
    folder=output_directory_2,
    write=Toggle(True),
    run=Slider(1, range=0..10))  # -> report, jsons, osw, osm, idf, sql, zsz, rdd, html; plug-in component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
sql_filepath = Text(modeltoosm.sql)

context_print = ContextPrint(SQLFilePath=sql_filepath)
