# Grasshopper definition Director.ghx (Grasshopper 1.0.7)
# plug-ins: Hops, MetaHopper

bldgprograms = HBBuildingPrograms({"LargeOffice", "MediumOffice", "SmallOffice", "MidriseApartment", "HighriseApartment", "Retail", "StripMall", "PrimarySchool", "SecondarySchool", "SmallHotel", "LargeHotel", "Hospital", "Outpatient", "Laboratory", "Warehouse", "SuperMarket", "FullServiceRestaurant", "QuickServiceRestaurant", "Courthouse", "LargeDataCenterHighITE", "LargeDataCenterLowITE", "SmallDataCenterHighITE", "SmallDataCenterLowITE"}, selected="MediumOffice")
searchprog = HBSearchPrograms(bldg_prog=bldgprograms)  # -> room_prog; plug-in component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
deconstrprogram = HBDeconstructProgramType(program=searchprog)  # -> people, lighting, electric_equip, gas_equip, hot_water, infiltration, ventilation, setpoint; plug-in component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
panel = Panel(deconstrprogram.people)
hvac_system_template = ValueList({"IdealAirSystem", "ElectricBaseboard", "BoilerBaseboard", "ASHPBaseboard", "DHWBaseboard", "EvapCoolers_ElectricBaseboard", "EvapCoolers_BoilerBaseboard", "EvapCoolers_ASHPBaseboard", "EvapCoolers_DHWBaseboard", "EvapCoolers_Furnace"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}, selected="ASHPBaseboard")  # disabled
panel_2 = Panel("E:\Nextcloud\Public\FOR2363\TP4\LUH\HVAC-Systems\CurrentBatch\Data_Source\Simulation-Files")  # disabled
bldgvintages = HBBuildingVintages({"ASHRAE 90.1 2019  |  IECC 2021": "2019", "ASHRAE 90.1 2016  |  IECC 2018": "2016", "ASHRAE 90.1 2013  |  IECC 2015": "2013", "ASHRAE 90.1 2010  |  IECC 2012": "2010", "ASHRAE 90.1 2007  |  IECC 2009": "2007", "ASHRAE 90.1 2004  |  IECC 2006": "2004", "1980-2004 (CBECS)": "1980_2004", "Pre-1980 (CBECS)": "pre_1980"}, selected="ASHRAE 90.1 2019  |  IECC 2021")  # disabled
panel_3 = Panel("Required-U-Values.csv")  # disabled
number_slider = Slider(0.145, range=0..1)  # disabled
number_slider_2 = Slider(0.125, range=0..1)  # disabled
number_slider_3 = Slider(4, range=0..10)  # disabled
number_slider_4 = Slider(22, range=0..100)  # disabled
number_slider_5 = Slider(24, range=0..100)  # disabled
number_slider_6 = Slider(6, range=0..10)  # disabled
number_slider_7 = Slider(24, range=0..100)  # disabled
number_slider_8 = Slider(4, range=0..10)  # disabled
number_slider_9 = Slider(22, range=0..100)  # disabled
shw = HBSHWTemplates({"Gas Water Heater": "Gas_WaterHeater", "Electric Water Heater": "Electric_WaterHeater", "Heat Pump Water Heater": "HeatPump_WaterHeater", "Gas Tankless Heater": "Gas_TanklessHeater", "Electric Tankless Heater": "Electric_TanklessHeater"}, selected="Gas Water Heater")  # disabled
number_slider_10 = Slider(3, range=0..10)  # disabled
number_slider_11 = Slider(5, range=0..10)  # disabled
number_slider_12 = Slider(4, range=0..10)  # disabled
number_slider_13 = Slider(3, range=0..10)  # disabled
number_slider_14 = Slider(29.9, range=0..360)  # disabled
fassade = ValueList({"Horizontal-Windows", "Vertical-Windows", "Ribbon-Windows"}, selected="Horizontal-Windows")  # disabled
number_slider_15 = Slider(13, range=0..30)  # disabled
number_slider_16 = Slider(2.5, range=0..10)  # disabled
shading = ValueList({"External-Shading", "Low-SHGC-Value"}, selected="Low-SHGC-Value")  # disabled
list = ValueList({"GEG", "NZEB", "Passive"}, selected="GEG")  # disabled
toggle = BooleanToggle(False)  # disabled
debugmode = Boolean(Toggle(False))
panel_4 = Panel("EnergyModel")  # disabled
onoff = EnableDisableObject(
    Enabled=debugmode,
    AllObjects_Object=[number_slider_11, number_slider_12, number_slider_3, number_slider_13, number_slider_14, number_slider_15, number_slider_10, number_slider_16, fassade, toggle, hvac_system_template, panel_3, list, shading, concat, panel_4, shw, bldgvintages, panel_2, number_slider_2, number_slider_4, number_slider_7, number_slider, number_slider_9, number_slider_5, number_slider_6, number_slider_8])
panel_5 = Panel("C:\Git\Work\FOR2363\Parametric-H-Shape-Office-Building-Model\src\simulation")
orientation = GetNumber(number_slider_14, AtLeast=1, AtMost=1, Maximum=1.797693135e+308, Minimum=-1.797693135e+308, TreeAccess=False)
numberoffloors = GetNumber(number_slider_3, AtLeast=1, AtMost=1, Maximum=1.797693135e+308, Minimum=-1.797693135e+308, TreeAccess=False)
floorheight = GetNumber(number_slider_10, AtLeast=1, AtMost=1, Maximum=1.797693135e+308, Minimum=-1.797693135e+308, TreeAccess=False)
fassade_2 = GetString(fassade, AtLeast=1, AtMost=1, TreeAccess=False)
rasterlength_x = GetNumber(number_slider_16, AtLeast=1, AtMost=1, Maximum=1.797693135e+308, Minimum=-1.797693135e+308, TreeAccess=False)
rasterlength_y = GetNumber(number_slider_16, AtLeast=1, AtMost=1, Maximum=1.797693135e+308, Minimum=-1.797693135e+308, TreeAccess=False)
arm_latitudinal_numberofsegments = GetInteger(number_slider_11, AtLeast=1, AtMost=1, Maximum=2147483647, Minimum=-2147483648, TreeAccess=False)
arm_longitudinal_numberofsegments = GetInteger(number_slider_12, AtLeast=1, AtMost=1, Maximum=2147483647, Minimum=-2147483648, TreeAccess=False)
basebody_inside_latditudinal_numberofseg = GetInteger(number_slider_13, AtLeast=1, AtMost=1, Maximum=2147483647, Minimum=-2147483648, TreeAccess=False)  # "BaseBody-Inside-Latditudinal-NumberOfSegments"
courtyard_segmentcount_rasterlength_y = GetNumber(number_slider_15, AtLeast=1, AtMost=1, Maximum=1.797693135e+308, Minimum=-1.797693135e+308, TreeAccess=False)
has_courtyard_roof = GetBoolean(toggle, AtLeast=1, AtMost=1, FalseValue="False", TreeAccess=False, TrueValue="True")
shading_2 = GetString(shading, AtLeast=1, AtMost=1, TreeAccess=True)
energystandard = GetString(list, AtLeast=1, AtMost=1, TreeAccess=True)
hvac_system = GetString(hvac_system_template, AtLeast=1, AtMost=1, TreeAccess=False)
servicehotwater = GetString(shw, AtLeast=1, AtMost=1, TreeAccess=True)
buildingsystemvintage = GetString(bldgvintages, AtLeast=1, AtMost=1, TreeAccess=True)
open_office_heating_setpoint = GetNumber(number_slider_4, AtLeast=1, AtMost=1, Maximum=1.797693135e+308, Minimum=-1.797693135e+308, TreeAccess=False)
open_office_cooling_setpoint = GetNumber(number_slider_7, AtLeast=1, AtMost=1, Maximum=1.797693135e+308, Minimum=-1.797693135e+308, TreeAccess=False)
open_office_ach = GetNumber(number_slider_8, AtLeast=1, AtMost=1, Maximum=1.797693135e+308, Minimum=-1.797693135e+308, TreeAccess=False)
open_office_ppa = GetNumber(number_slider_2, AtLeast=1, AtMost=1, Maximum=1.797693135e+308, Minimum=-1.797693135e+308, TreeAccess=False)
meeting_heating_setpoint = GetNumber(number_slider_9, AtLeast=1, AtMost=1, Maximum=1.797693135e+308, Minimum=-1.797693135e+308, TreeAccess=False)
meeting_cooling_setpoint = GetNumber(number_slider_5, AtLeast=1, AtMost=1, Maximum=1.797693135e+308, Minimum=-1.797693135e+308, TreeAccess=False)
meeting_ach = GetNumber(number_slider_6, AtLeast=1, AtMost=1, Maximum=1.797693135e+308, Minimum=-1.797693135e+308, TreeAccess=False)
meeting_ppa = GetNumber(number_slider, AtLeast=1, AtMost=1, Maximum=1.797693135e+308, Minimum=-1.797693135e+308, TreeAccess=False)
output_directory = GetString(panel_2, AtLeast=1, AtMost=1, TreeAccess=True)
modelname = GetString(panel_4, AtLeast=1, AtMost=1, TreeAccess=True)
panel_6 = Panel("G:\FOR2363\Scripts")
correct = Correct(computetext=panel_5)
orientation_2 = Number(orientation)
numberoffloors_2 = Number(numberoffloors)
floorheight_2 = Number(floorheight)
fassade_3 = Text(fassade_2)
rasterlength_x_2 = Number(rasterlength_x)
rasterlength_y_2 = Number(rasterlength_y)
arm_latitudinal_numberofsegments_2 = Number(arm_latitudinal_numberofsegments)
arm_longitudinal_numberofsegments_2 = Number(arm_longitudinal_numberofsegments)
basebody_inside_latditudinal_numberofseg_2 = Number(basebody_inside_latditudinal_numberofseg)  # "BaseBody-Inside-Latditudinal-NumberOfSegments"
courtyard_segmentcount_rasterlength_y_2 = Number(courtyard_segmentcount_rasterlength_y)
has_courtyard_roof_2 = Boolean(has_courtyard_roof)
energystandard_2 = Text(energystandard)
correct_2 = Correct(computetext=output_directory)
shading_3 = Text(shading_2)
buildingsystemvintage_2 = Text(buildingsystemvintage)
servicehotwater_2 = Text(servicehotwater)
hvac_system_2 = Text(hvac_system)
modelname_2 = Text(modelname)
scripts_directory = FilePath(correct)
concat = Concatenate(FragmentA=scripts_directory, FragmentB="\", FragmentC=panel_3)  # disabled
required_u_values_path = GetString(concat, AtLeast=1, AtMost=1, TreeAccess=True)
correct_3 = Correct(computetext=required_u_values_path)
concat_2 = Concatenate(FragmentA=scripts_directory, FragmentB="\", FragmentC="Model.ghx")
required_u_values_path_2 = FilePath(correct_3)
output_directory_2 = FilePath(correct_2)
modelhops = Hops(
    _Path=concat_2,
    Orientation=orientation_2,
    NumberOfFloors=numberoffloors_2,
    FloorHeight=floorheight_2,
    Fassade=fassade_3,
    RasterLengthX=rasterlength_x_2,
    RasterLengthY=rasterlength_y_2,
    ArmLatitudinalNumberOfSegments=arm_latitudinal_numberofsegments_2,
    ArmLongitudinalNumberOfSegments=arm_longitudinal_numberofsegments_2,
    BaseBodyInsideLatditudinalNumberOfSegments=basebody_inside_latditudinal_numberofseg_2,
    Courtyard_SegmentCount_RasterLengthY=courtyard_segmentcount_rasterlength_y_2,
    CacheResultsInMemory=False,
    CacheSolveResults=False,
    RemoteDefinitionLocation="C:\Git\Work\FOR2363\Parametric-H-Shape-Office-Building-Model\src\simulation\Model.ghx",
    RemoteSolveVersion=(0, 1, 0),
    ShowInput_Enabled=False,
    ShowInput_Path=True,
    SynchronousSolve=True)  # -> Zones, ZonesName, Windows, WindowsName, Zones_Underground, ZonesUndergroundName, Courtyard_Upper_Volume, Courtyard_Lower_Volume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
building_fassade_left_windowtowallratio = Number(modelhops.FassadeLeftWindowToWallRatio)
windows_name = Text(modelhops.WindowsName)
building_fassade_upper_windowtowallratio = Number(modelhops.FassadeUpperWindowToWallRatio)
windows = Brep(modelhops.Windows)
zones_underground_name = Text(modelhops.ZonesUndergroundName)
courtyard_upper_volume = Brep(modelhops.Courtyard_Upper_Volume)
courtyard_upper_fassade = Surface(modelhops.Courtyard_Upper_Fassade)
courtyard_lower_roof = Surface(modelhops.Courtyard_Lower_Roof)
zones_name = Text(modelhops.ZonesName)
zones_underground = Brep(modelhops.Zones_Underground)
courtyard_lower_volume = Brep(modelhops.Courtyard_Lower_Volume)
courtyard_lower_fassade = Surface(modelhops.Courtyard_Lower_Fassade)
courtyard_upper_roof = Surface(modelhops.Courtyard_Upper_Roof)
building_fassade_windowtowallratio = Number(modelhops.FassadeTotalWindowToWallRatio)
building_fassade_lower_windowtowallratio = Number(modelhops.FassadeLowerWindowToWallRatio)
building_fassade_right_windowtowallratio = Number(modelhops.FassadeRightWindowToWallRatio)
zones = Brep(modelhops.Zones)
concat_3 = Concatenate(FragmentA=scripts_directory, FragmentB="\", FragmentC="EnergyModel.ghx")
merge = Merge(Data1=courtyard_upper_roof, Data2=courtyard_lower_roof)
energymodelhops = Hops(
    _Path=concat_3,
    Zones=zones,
    ZonesName=zones_name,
    Windows=windows,
    WindowsName=windows_name,
    Zones_Underground=zones_underground,
    ZonesUndergroundName=zones_underground_name,
    CourtyardsRoof=merge,
    Has_CourtyardRoof=has_courtyard_roof_2,
    RequiredUValuesPath=required_u_values_path_2,
    EnergyStandard=energystandard_2,
    Shading=shading_3,
    BuildingSystemVintage=buildingsystemvintage_2,
    HVACSystem=hvac_system_2,
    ServiceHotWater=servicehotwater_2,
    OpenOfficeHeatingSetpoint=open_office_heating_setpoint,
    OpenOfficeCoolingSetpoint=open_office_cooling_setpoint,
    OpenOfficeACH=open_office_ach,
    OpenOfficePPA=open_office_ppa,
    MeetingHeatingSetpoint=meeting_heating_setpoint,
    MeetingCoolingSetpoint=meeting_cooling_setpoint,
    MeetingACH=meeting_ach,
    MeetingPPA=meeting_ppa,
    ModelName=modelname_2,
    OutputDirectory=output_directory_2,
    CacheResultsInMemory=False,
    CacheSolveResults=False,
    RemoteDefinitionLocation="C:\Git\Work\FOR2363\Parametric-H-Shape-Office-Building-Model\src\simulation\EnergyModel.ghx",
    RemoteSolveVersion=(0, 1, 0),
    ShowInput_Enabled=False,
    ShowInput_Path=True,
    SynchronousSolve=True)
concat_4 = Concatenate(FragmentA=scripts_directory, FragmentB="\", FragmentC="Simulation.gh")
context_print = ContextPrint(EncryptedHoneybeeFilePath=energymodelhops)
concat_5 = Concatenate(FragmentA=scripts_directory, FragmentB="\", FragmentC="Reporting.ghx")

# ==== cluster Correct: Corrects an output file path from a compute component.
computetext = ClusterInput()
computetext_2 = Text(computetext)
strip = NAME(x=computetext_2, y="\"'")  # -> a
# ---------- strip: Python ----------
a = x.strip(y)
# ---------- end strip ----------
# Compute wrapps paths which turn into string literals.
# To undo this, unwrapping is neciassary.
# Assumption no recursion level deeper than 2.
# The wrong wrapping rises with 2^n
panel = Panel("\"E:\\\\\\\\\\\\\\\\Nextcloud\\\\\\\\\\\\\\\\Public\\\\\\\\\\\\\\\\FOR2363\\\\\\\\\\\\\\\\TP4\\\\\\\\\\\\\\\\LUH\\\\\\\\\\\\\\\\HVAC-Systems\\\\\\\\\\\\\\\\BatchCurrent\\\\\\\\\\\\\\\\Data_Source\\\\\\\\\\\\\\\\Simulation-Files\\\\\\\\\\\\\\\\Simulation000\\\\\\\\\\\\\\\\openstudio\\\\\\\\\\\\\\\\run\\\\\\\\\\\\\\\\in.idf\"")
rep = ReplaceText(Text=strip, Find="\\", Replace="\", RecursiveReplace=False)
rep_2 = ReplaceText(Text=rep, Find="\\", Replace="\", RecursiveReplace=False)
rep_3 = ReplaceText(Text=rep_2, Find="\\", Replace="\", RecursiveReplace=False)
rep_4 = ReplaceText(Text=rep_3, Find="\\", Replace="\", RecursiveReplace=False)
rep_5 = ReplaceText(Text=rep_4, Find="\\", Replace="\", RecursiveReplace=False)
rep_6 = ReplaceText(Text=rep_5, Find="\\", Replace="\", RecursiveReplace=False)
rep_7 = ReplaceText(Text=rep_6, Find="\\", Replace="\", RecursiveReplace=False)
rep_8 = ReplaceText(Text=rep_7, Find="\\", Replace="\", RecursiveReplace=False)
rep_9 = ReplaceText(Text=rep_8, Find="%", Replace="\", RecursiveReplace=False)
rep_10 = ReplaceText(Text=rep_9, Find="$", Replace=":", RecursiveReplace=False)
originaltext = Text(rep_10)
originaltext_2 = ClusterOutput(originaltext)
