# Grasshopper definition Reporting-LCA.ghx (Grasshopper 1.0.7)
# plug-ins: MetaHopper

panel = Panel("E:\Nextcloud\Public\FOR2363\TP4\LUH\HVAC-Systems\BatchCurrent\Data_Source\Simulation-Files")  # disabled
panel_2 = Panel("E:\Nextcloud\Public\FOR2363\TP4\LUH\HVAC-Systems\FirstBatch\Data_Source\Simulation-Files")  # disabled
panel_3 = Panel("Simulation001")  # disabled
panel_4 = Panel("Simulation002")  # disabled
panel_5 = Panel("Simulation000")  # disabled
panel_6 = Panel("Simulation003")  # disabled
panel_7 = Panel("EnergyModel")  # disabled
debugmode = Boolean(Toggle(False))
modelname = GetString(panel_4, AtLeast=1, AtMost=1, TreeAccess=False)
output_directory = GetString(panel_2, AtLeast=1, AtMost=1, TreeAccess=False)
onoff = EnableDisableObject(Enabled=debugmode, AllObjects_Object=[panel, panel_7, panel_4, panel_2, panel_3, panel_6, panel_5])
correct = Correct(computetext=output_directory)
path = FilePath(correct)
concat = Concatenate(FragmentA=path, FragmentB="\", FragmentC=modelname)
concat_2 = Concatenate(FragmentA=concat, FragmentB="\", FragmentC="openstudio")
concat_3 = Concatenate(FragmentA=concat_2, FragmentB="\", FragmentC="run")
panel_8 = Panel("in")
concat_4 = Concatenate(FragmentA=concat_3, FragmentB="\", FragmentC="eplustbl.htm")
concat_5 = Concatenate(FragmentA=concat_3, FragmentB="\", FragmentC="eplusout")
concat_6 = Concatenate(FragmentA=concat_3, FragmentB="\", FragmentC="in")
concat_7 = Concatenate(FragmentA=concat_2, FragmentB="\", FragmentD=modelname, FragmentC=".hbjson")
concat_8 = Concatenate(FragmentA=concat_5, FragmentC=".sql")
concat_9 = Concatenate(FragmentA=concat_6, FragmentB=".idf")
concat_10 = Concatenate(FragmentA=concat_6, FragmentB=".osm")
reports_filepath = FilePath(concat_4)
sql_filepath = FilePath(concat_8)
idf_filepath = FilePath(concat_9)

eui = HBEndUseIntensity(sql=sql_filepath, ip=Toggle(False))  # -> eui, eui_end_use, end_uses, gross_floor; plug-in component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
vor0 = ValueOr0(value=eui.eui)
itemor0 = ItemOr0(values=eui.eui_end_use, header=eui.end_uses, item="Heating")
itemor0_2 = ItemOr0(values=eui.eui_end_use, header=eui.end_uses, item="Cooling")
itemor0_3 = ItemOr0(values=eui.eui_end_use, header=eui.end_uses, item="Interior Lighting")
itemor0_4 = ItemOr0(values=eui.eui_end_use, header=eui.end_uses, item="Exterior Lighting")
itemor0_5 = ItemOr0(values=eui.eui_end_use, header=eui.end_uses, item="Interior Equipment")
itemor0_6 = ItemOr0(values=eui.eui_end_use, header=eui.end_uses, item="Exterior Equipment")
itemor0_7 = ItemOr0(values=eui.eui_end_use, header=eui.end_uses, item="Fans")
itemor0_8 = ItemOr0(values=eui.eui_end_use, header=eui.end_uses, item="Pumps")
itemor0_9 = ItemOr0(values=eui.eui_end_use, header=eui.end_uses, item="Heat Rejection")
itemor0_10 = ItemOr0(values=eui.eui_end_use, header=eui.end_uses, item="Humidification")
itemor0_11 = ItemOr0(values=eui.eui_end_use, header=eui.end_uses, item="Heat Recovery")
itemor0_12 = ItemOr0(values=eui.eui_end_use, header=eui.end_uses, item="Water Systems")
itemor0_13 = ItemOr0(values=eui.eui_end_use, header=eui.end_uses, item="Refrigeration")
itemor0_14 = ItemOr0(values=eui.eui_end_use, header=eui.end_uses, item="Generators")
itemor0_15 = ItemOr0(values=eui.eui_end_use, header=eui.end_uses, item="Electric Equipment")
cp = ContextPrint(EUIExteriorEquipment_kWh_m²a=itemor0_6)
cp_2 = ContextPrint(EUIInteriorEquipment_kWh_m²a=itemor0_5)
cp_3 = ContextPrint(EUIElectricEquipment_kWh_m²a=itemor0_15)
cp_4 = ContextPrint(EUIExteriorLighting_kWh_m²a=itemor0_4)
cp_5 = ContextPrint(EUIInteriorLighting_kWh_m²a=itemor0_3)
cp_6 = ContextPrint(EUIWaterSystems_kWh_m²a=itemor0_12)
cp_7 = ContextPrint(EUIHeatRejection_kWh_m²a=itemor0_9)
cp_8 = ContextPrint(EUIHumidification_kWh_m²a=itemor0_10)
cp_9 = ContextPrint(EUIHeatRecovery_kWh_m²a=itemor0_11)
cp_10 = ContextPrint(EUIRefrigeration_kWh_m²a=itemor0_13)
cp_11 = ContextPrint(EUIGenerators_kWh_m²a=itemor0_14)
cp_12 = ContextPrint(EUIHeating_kWh_m²a=itemor0)
cp_13 = ContextPrint(EUICooling_kWh_m²a=itemor0_2)
cp_14 = ContextPrint(EUIPumps_kWh_m²a=itemor0_8)
cp_15 = ContextPrint(EUIFans_kWh_m²a=itemor0_7)
cp_16 = ContextPrint(EUI_kWh_m²a=vor0)

loadobjects = HBLoadObjects(hb_file=concat_7, load=Toggle(True))  # -> report, hb_objs; plug-in component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
geoprop = HBGeometryProperties(rooms=flatten(loadobjects.hb_objs))  # -> ext_wall_area, ext_win_area, volume, floor_area, floor_ep_constr; plug-in component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
division = Division(A=geoprop.floor_ep_constr, B=geoprop.floor_area)
division_2 = Division(A=geoprop.floor_area, B=geoprop.volume)
division_3 = Division(A=geoprop.ext_win_area, B=geoprop.ext_wall_area)
expression = Expression(x=division, Expression="1-x")
vor0_2 = ValueOr0(value=geoprop.volume)
vor0_3 = ValueOr0(value=geoprop.floor_area)
vor0_4 = ValueOr0(value=division_2)
vor0_5 = ValueOr0(value=division_3)
expression_2 = Expression(x=expression, Expression="x*100")
cp_17 = ContextPrint(WindowToWallRatio_=vor0_5)
vor0_6 = ValueOr0(value=expression_2)
cp_18 = ContextPrint(Volume_m³=vor0_2)
cp_19 = ContextPrint(Area_m²=vor0_3)
cp_20 = ContextPrint(Text=vor0_4)
cp_21 = ContextPrint(ConstructionArea_=vor0_6)

getepsqlvalue = NAME(
    path=sql_filepath,
    reportName="AnnualBuildingUtilityPerformanceSummary",
    tableName="Building Area",
    columnName="Area",
    rowName="Total Building Area")  # -> query, value, unit
# ---------- getepsqlvalue: Python ----------
import sqlite3

query= ("SELECT Value, Units "+ 
"FROM TabularDataWithStrings " + 
"WHERE ReportName = \"" + reportName + "\" " + 
"AND TableName = \"" + tableName + "\" " + 
"AND ColumnName = \"" + columnName + "\" " + 
"AND Rowname = \"" + rowName + "\" ")
 #AND ReportForString='Entire Facility'
conn = sqlite3.connect(path)
c = conn.cursor()
try:
    c.execute(query)
    results = list(c)
    if len(results)!=1:
        print("There was more than 1 value.")
    result = results[0]
    value = result[0].strip()
    unit = result[1]
finally:
    c.close()
# ---------- end getepsqlvalue ----------
valueor0 = ValueOr0(value=getepsqlvalue.value)

panel_9 = Panel("Central Air Source Heat Pump Capacity")
customresult = HBReadCustomResult(sql=sql_filepath, output_names=panel_9)  # -> results; plug-in component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
itemor0_16 = ItemOr0(values=customresult, header=panel_9, item=panel_9)
expression_3 = Expression(x=itemor0_16, Expression="x/1000")
valueor0_2 = ValueOr0(value=expression_3)
cp_22 = ContextPrint(CentralAirSourceHeatPumpCapacity_kW=valueor0_2)

panel_10 = Panel("HYDRONIC BASEBOARD-Design Size U-Factor Times Area Value [W/K]")
readhvac = HBReadHVACSizing(sql=sql_filepath, comp_type="ZoneHVAC:Baseboard:Convective:Water")  # -> zone_names, zone_peak_cool, zone_peak_heat, comp_types, comp_properties, comp_values; plug-in component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
endswith = NAME(x=readhvac.comp_properties, y=panel_10)  # -> a
# ---------- endswith: Python ----------
a = x.endswith(y)
# ---------- end endswith ----------
dispatch = Dispatch(List=readhvac.comp_values, DispatchPattern=endswith)  # -> ListA, ListB
trim = TrimTree(Tree=dispatch.ListA, Depth=1)
valueor0_3 = ValueOr0(value=trim)

panel_11 = Panel("Above Ground Window-Wall Ratio")
panel_12 = Panel("InputVerificationandResultsSummary")
getepsqlvalue_2 = NAME(
    path=sql_filepath,
    reportName=panel_12,
    tableName="Window-Wall Ratio",
    columnName="North (315 to 45 deg)",
    rowName=panel_11)  # -> query, value, unit; same code as getepsqlvalue
getepsqlvalue_3 = NAME(
    path=sql_filepath,
    reportName=panel_12,
    tableName="Window-Wall Ratio",
    columnName="East (45 to 135 deg)",
    rowName=panel_11)  # -> query, value, unit; same code as getepsqlvalue
getepsqlvalue_4 = NAME(
    path=sql_filepath,
    reportName=panel_12,
    tableName="Window-Wall Ratio",
    columnName="South (135 to 225 deg)",
    rowName=panel_11)  # -> query, value, unit; same code as getepsqlvalue
getepsqlvalue_5 = NAME(
    path=sql_filepath,
    reportName=panel_12,
    tableName="Window-Wall Ratio",
    columnName="West (225 to 315 deg)",
    rowName=panel_11)  # -> query, value, unit; same code as getepsqlvalue
valueor0_4 = ValueOr0(value=getepsqlvalue_3.value)
valueor0_5 = ValueOr0(value=getepsqlvalue_2.value)
valueor0_6 = ValueOr0(value=getepsqlvalue_5.value)
valueor0_7 = ValueOr0(value=getepsqlvalue_4.value)
cp_23 = ContextPrint(WindowToWallRatioNorth_=valueor0_5)
cp_24 = ContextPrint(WindowToWallRatioSouth_=valueor0_7)
cp_25 = ContextPrint(WindowToWallRatioWest_=valueor0_6)
cp_26 = ContextPrint(WindowToWallRatioEast_=valueor0_4)

customresult_2 = HBReadCustomResult(sql=sql_filepath, output_names="Baseboard Water Inlet Temperature")  # -> results; plug-in component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
customresult_3 = HBReadCustomResult(sql=sql_filepath, output_names="Baseboard Air Outlet Temperature")  # -> results; plug-in component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
valueor0_8 = ValueOr0(value=customresult_2)
valueor0_9 = ValueOr0(value=customresult_3)
subtraction = Subtraction(A=valueor0_8, B=valueor0_9)
multiplication = Multiplication(A=valueor0_3, B=subtraction)
expression_4 = Expression(x=multiplication, Expression="x/1000")
avr = Average(Input=expression_4)
ma = MassAddition(Input=expression_4)  # -> Result, PartialResults
cp_27 = ContextPrint(BaseboardCapacityAverage_kW=avr)
cp_28 = ContextPrint(BaseboardCapacitySum_kW=ma.Result)

getepsqlvalue_6 = NAME(path=sql_filepath)  # -> errors
# ---------- getepsqlvalue_6: Python ----------
import sqlite3

query="SELECT ErrorMessage FROM Errors WHERE ErrorType = 1"
conn = sqlite3.connect(path)
c = conn.cursor()
try:
    c.execute(query)
    results = list(c)
    errors = []
    for result in results:
        errors.append(result[0].strip())
finally:
    c.close()
# ---------- end getepsqlvalue_6 ----------

readtable = HBReadTabularData(sql=sql_filepath, table_name="Boiler:HotWater")  # -> values, col_names, row_names; plug-in component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
itemor0_17 = ItemOr0(values=readtable.values, header=readtable.col_names, item="Design Size Nominal Capacity")
expression_5 = Expression(x=itemor0_17, Expression="x/1000")
cp_29 = ContextPrint(BoilerDesignSizeNominalCapacity_kW=expression_5)

split = TextSplit(Text=getepsqlvalue_6, Separators=":")
cset = CreateSet(List=split)  # -> Set, Map
join = TextJoin(Text=cset.Set, Join="%")
fragment = TextFragment(Text=join, Start="0", Count="1000")
valueor0_10 = ValueOr0(value=fragment)

panel_13 = Panel("AnnualBuildingUtilityPerformanceSummary")
getepsqlvalues = NAME(path=sql_filepath, reportName=panel_13, tableName="End Uses", rowName="Heating")  # -> query, columnNames, values, units
# ---------- getepsqlvalues: Python ----------
import sqlite3

query= ("SELECT ColumnName,Value,Units "+ 
"FROM TabularDataWithStrings " + 
"WHERE ReportName = \"" + reportName + "\" " + 
"AND TableName = \"" + tableName + "\" " + 
"AND Rowname = \"" + rowName + "\" ")
 #AND ReportForString='Entire Facility'
conn = sqlite3.connect(path)
c = conn.cursor()
try:
    c.execute(query)
    results = list(c)
    columnNames = []
    values = []
    units = []
    for i,result in enumerate(results):
        columnNames.append(result[0].strip())
        values.append(result[1].strip())
        units.append(result[2].strip())
finally:
    c.close()
# ---------- end getepsqlvalues ----------
lito3p = ListInto3Parts(ListToSlice=getepsqlvalues.values, StartIndex="0", EndIndex="-1")  # -> FilteredList, ItemsBefore, ItemsAfter; inputs ListToSlice: tree, StartIndex: tree of Int32, EndIndex: tree of Int32
# ---------- lito3p: Python ----------
if ghenv.Component.RunCount<2:
    __author__ = "Ueli Saluz"
    __version__ = "2020.05.28"
    
    ghenv.Component.Name = "ListInto3Parts"
    ghenv.Component.NickName = "LiTo3P"
    ghenv.Component.Description = "Slice list into 3 parts. All lists are sliced with the same indices. End index = 0 = length(list)."
    ghenv.Component.Message = "VER 1.6"

from System import Object
from Grasshopper import DataTree

def filterList(listToFilter,startIndex,endIndex):
    # Return: FilteredList, Before, After
    if (((startIndex == 0) or (startIndex is None)) and ((endIndex == 0) or (endIndex is None))) or (endIndex <= startIndex and endIndex > 0):
        return (listToFilter,None,None)
    elif (startIndex == 0) or (startIndex is None):
        return (listToFilter[:endIndex],None,listToFilter[endIndex:])
    elif (endIndex == 0) or (endIndex is None):
        print 1
        return (listToFilter[:startIndex],listToFilter[startIndex:],None)
    else:
        return (listToFilter[startIndex:endIndex],listToFilter[:startIndex],listToFilter[endIndex:])

if __name__ == "__main__":
    FilteredList = DataTree[Object]()
    ItemsBefore = DataTree[Object]()
    ItemsAfter = DataTree[Object]()
    
    for path in ListToSlice.Paths:
        listBranch = ListToSlice.Branch(path)
        pyList = list(listBranch)   #Convert .Net List to Python
        try: #terrible way of writing code but if I set the list to list access the performance decreases massivly due to many calls
            startIndex = StartIndex.Branch(path)
            startIndex = startIndex[0]
        except Exception:
            try:
                startIndex = StartIndex.Branch(0)
                startIndex = startIndex[0]
            except Exception:
                startIndex = 0
        try:
            endIndex = EndIndex.Branch(path)
            endIndex = endIndex[0]
        except Exception:
            try:
                endIndex = EndIndex.Branch(0)
                endIndex = endIndex[0]
            except Exception:
                endIndex = len(pyList)
        filtList=filterList(pyList,startIndex,endIndex)
        if filtList[0]:
            FilteredList.AddRange(filtList[0],path)
        if filtList[1]:
            ItemsBefore.AddRange(filtList[1],path)
        if filtList[2]:
            ItemsAfter.AddRange(filtList[2],path)
# ---------- end lito3p ----------
ma_2 = MassAddition(Input=lito3p.FilteredList)  # -> Result, PartialResults

# ---- group: GJ to kWh
expression_6 = Expression(x=ma_2.Result, Expression="x*277.8")

# ----
division_4 = Division(A=expression_6, B=valueor0)
valueor0_11 = ValueOr0(value=division_4)

getepsqlvalue_7 = NAME(
    path=sql_filepath,
    reportName="AnnualBuildingUtilityPerformanceSummary",
    tableName="Site and Source Energy",
    columnName="Energy Per Total Building Area",
    rowName="Total Site Energy")  # -> query, value, unit; same code as getepsqlvalue

# ---- group: MJ to kWh
expression_7 = Expression(x=getepsqlvalue_7.value, Expression="x*0.2778")

# ----
valueor0_12 = ValueOr0(value=expression_7)

panel_14 = Panel("AnnualBuildingUtilityPerformanceSummary")
getepsqlvalue_8 = NAME(path=sql_filepath, reportName=panel_14, tableName="End Uses", columnName="Electricity", rowName="Total End Uses")  # -> query, value, unit; same code as getepsqlvalue

# ---- group: GJ to kWh
expression_8 = Expression(x=getepsqlvalue_8.value, Expression="x*277.8")

# ----
division_5 = Division(A=expression_8, B=valueor0)
valueor0_13 = ValueOr0(value=division_5)
cp_30 = ContextPrint(EUIElectricity_kWh_m²a=valueor0_13)

getepsqlvalue_9 = NAME(
    path=sql_filepath,
    reportName="DemandEndUseComponentsSummary",
    tableName="End Uses",
    columnName="District Heating",
    rowName="Heating")  # -> query, value, unit; same code as getepsqlvalue

# ---- group: W to kW
expression_9 = Expression(x=getepsqlvalue_9.value, Expression="x/1000")

# ----
valueor0_14 = ValueOr0(value=expression_9)
cp_31 = ContextPrint(DistrictHeatingPeak_kW=valueor0_14)

getepsqlvalue_10 = NAME(
    path=sql_filepath,
    reportName="ComponentSizingSummary",
    tableName="WaterHeater:Mixed",
    columnName="Use Side Design Flow Rate",
    rowName="SHW WATERHEATER1")  # -> query, value, unit; same code as getepsqlvalue

# ---- group: m³/s to l/min
expression_10 = Expression(x=getepsqlvalue_10.value, Expression="x*60000")

# ----
valueor0_15 = ValueOr0(value=expression_10)
cp_32 = ContextPrint(ServiceHotWaterDesignFlowRate_l_min=valueor0_15)

getepsqlvalue_11 = NAME(
    path=sql_filepath,
    reportName="EquipmentSummary",
    tableName="Service Water Heating",
    columnName="Storage Volume",
    rowName="SHW WATERHEATER1")  # -> query, value, unit; same code as getepsqlvalue

# ---- group: m³ to l
expression_11 = Expression(x=getepsqlvalue_11.value, Expression="x*1000")

# ----
valueor0_16 = ValueOr0(value=expression_11)
cp_33 = ContextPrint(ServiceHotWaterTankVolume_m=valueor0_16)

getepsqlvalue_12 = NAME(path=sql_filepath, reportName=panel_14, tableName="End Uses", columnName="District Heating", rowName="Total End Uses")  # -> query, value, unit; same code as getepsqlvalue

# ---- group: GJ to kWh
expression_12 = Expression(x=getepsqlvalue_12.value, Expression="x*277.8")

# ----
division_6 = Division(A=expression_12, B=valueor0)
valueor0_17 = ValueOr0(value=division_6)
cp_34 = ContextPrint(EUIDistrictHeating_kWh_m²a=valueor0_17)

getepsqlvalue_13 = NAME(path=sql_filepath, reportName=panel_14, tableName="End Uses", columnName="District Cooling", rowName="Total End Uses")  # -> query, value, unit; same code as getepsqlvalue

# ---- group: GJ to kWh
expression_13 = Expression(x=getepsqlvalue_13.value, Expression="x*277.8")

# ----
division_7 = Division(A=expression_13, B=valueor0)
valueor0_18 = ValueOr0(value=division_7)
cp_35 = ContextPrint(EUIDistrictCooling_kWh_m²a=valueor0_18)

getepsqlvalue_14 = NAME(path=sql_filepath, reportName=panel_14, tableName="End Uses", columnName="Natural Gas", rowName="Total End Uses")  # -> query, value, unit; same code as getepsqlvalue

# ---- group: GJ to kWh
expression_14 = Expression(x=getepsqlvalue_14.value, Expression="x*277.8")

# ----
division_8 = Division(A=expression_14, B=valueor0)
valueor0_19 = ValueOr0(value=division_8)
cp_36 = ContextPrint(EUINatrualGas_kWh_m²a=valueor0_19)

getepsqlvalues_2 = NAME(path=sql_filepath, reportName=panel_13, tableName="End Uses", rowName="Cooling")  # -> query, columnNames, values, units
# ---------- getepsqlvalues_2: Python ----------
import sqlite3

query= ("SELECT ColumnName,Value,Units "+ 
"FROM TabularDataWithStrings " + 
"WHERE ReportName = \"" + reportName + "\" " + 
"AND TableName = \"" + tableName + "\" " + 
"AND Rowname = \"" + rowName + "\" ")
 #AND ReportForString='Entire Facility'
conn = sqlite3.connect(path)
c = conn.cursor()
c.execute(query)
try:
    results = list(c)
    columnNames = []
    values = []
    units = []
    for i,result in enumerate(results):
        columnNames.append(result[0].strip())
        values.append(result[1].strip())
        units.append(result[2].strip())
finally:
    c.close()
# ---------- end getepsqlvalues_2 ----------
lito3p_2 = ListInto3Parts(ListToSlice=getepsqlvalues_2.values, StartIndex="0", EndIndex="-1")  # -> FilteredList, ItemsBefore, ItemsAfter; inputs ListToSlice: tree, StartIndex: tree of Int32, EndIndex: tree of Int32; same code as lito3p
ma_3 = MassAddition(Input=lito3p_2.FilteredList)  # -> Result, PartialResults

# ---- group: GJ to kWh
expression_15 = Expression(x=ma_3.Result, Expression="x*277.8")

# ----
division_9 = Division(A=expression_15, B=valueor0)
valueor0_20 = ValueOr0(value=division_9)

# ==== cluster ItemOr0
item = ClusterInput()
values = ClusterInput()
header = ClusterInput()
header_2 = Text(header)
item_2 = Text(item)
values_2 = Number(values)
itemindex = ItemIndex(L=header_2, I=item_2)  # -> i; inputs L: list
# ---------- itemindex: Python ----------
#Component Information
#--------------------------------------------------------------------------------------------
if ghenv.Component.RunCount<2:
    #General
    #--------------------------------------------------------------------------------------------
    __author__ = "Ueli Saluz"
    __version__ = "2022.11.18"
    
    ghenv.Component.Name = "ItemIndex"
    ghenv.Component.NickName = "ItemIndex"
    ghenv.Component.Description = "A better IdemIndex"
    ghenv.Component.Message = "VER 1.0"
    ghenv.Component.Category = "Set"
    ghenv.Component.SubCategory = "List"
    
     #Inputs
    #--------------------------------------------------------------------------------------------
    inputIndex=0
    
    ghenv.Component.Params.Input[inputIndex].Name = "List"
    ghenv.Component.Params.Input[inputIndex].NickName = "L"
    ghenv.Component.Params.Input[inputIndex].Description = "Input1 is..."
    ghenv.Component.Params.Input[inputIndex].Optional = False
    inputIndex+=1
    
    ghenv.Component.Params.Input[inputIndex].Name = "Item"
    ghenv.Component.Params.Input[inputIndex].NickName = "I"
    ghenv.Component.Params.Input[inputIndex].Description = "Input2 is..."
    ghenv.Component.Params.Input[inputIndex].Optional = False
    inputIndex+=1
    
    #Outputs
    #--------------------------------------------------------------------------------------------
    outputIndex=0
    
    ghenv.Component.Params.Output[outputIndex].Name = "Index"
    ghenv.Component.Params.Output[outputIndex].NickName = "i"
    ghenv.Component.Params.Output[outputIndex].Description = "Output1 is..."
    outputIndex+=1

i = L.index(I)
# ---------- end itemindex ----------
item_3 = ListItem(List=values_2, Index=itemindex, Wrap=True)
null = NullItem(Item=item_3)  # -> NullFlags, InvalidFlags, Description
filter = StreamFilter(Gate=null.NullFlags, Stream0=item_3, Stream1="0")
valueor0 = Number(filter)
valueor0_2 = ClusterOutput(valueor0)

# ==== cluster Correct: Corrects an output file path from a compute component.
computetext = ClusterInput()
computetext_2 = Text(computetext)
strip = NAME(x=computetext_2, y="\"'")  # -> a
# ---------- strip: Python ----------
a = x.strip(y)
# ---------- end strip ----------
# Compute wrapps paths which turn into string literals.
# To undo this, unwrapping is neciassary.
# Assumption no recursion level deeper than 2.
# The wrong wrapping rises with 2^n
panel = Panel("\"E:\\\\\\\\\\\\\\\\Nextcloud\\\\\\\\\\\\\\\\Public\\\\\\\\\\\\\\\\FOR2363\\\\\\\\\\\\\\\\TP4\\\\\\\\\\\\\\\\LUH\\\\\\\\\\\\\\\\HVAC-Systems\\\\\\\\\\\\\\\\BatchCurrent\\\\\\\\\\\\\\\\Data_Source\\\\\\\\\\\\\\\\Simulation-Files\\\\\\\\\\\\\\\\Simulation000\\\\\\\\\\\\\\\\openstudio\\\\\\\\\\\\\\\\run\\\\\\\\\\\\\\\\in.idf\"")
rep = ReplaceText(Text=strip, Find="\\", Replace="\", RecursiveReplace=False)
rep_2 = ReplaceText(Text=rep, Find="\\", Replace="\", RecursiveReplace=False)
rep_3 = ReplaceText(Text=rep_2, Find="\\", Replace="\", RecursiveReplace=False)
rep_4 = ReplaceText(Text=rep_3, Find="\\", Replace="\", RecursiveReplace=False)
rep_5 = ReplaceText(Text=rep_4, Find="\\", Replace="\", RecursiveReplace=False)
rep_6 = ReplaceText(Text=rep_5, Find="\\", Replace="\", RecursiveReplace=False)
rep_7 = ReplaceText(Text=rep_6, Find="\\", Replace="\", RecursiveReplace=False)
rep_8 = ReplaceText(Text=rep_7, Find="\\", Replace="\", RecursiveReplace=False)
rep_9 = ReplaceText(Text=rep_8, Find="%", Replace="\", RecursiveReplace=False)
rep_10 = ReplaceText(Text=rep_9, Find="$", Replace=":", RecursiveReplace=False)
originaltext = Text(rep_10)
originaltext_2 = ClusterOutput(originaltext)

# ==== cluster ValueOr0
value = ClusterInput()
value_2 = Number(value)
null = NullItem(Item=value_2)  # -> NullFlags, InvalidFlags, Description
filter = StreamFilter(Gate=null.NullFlags, Stream0=value_2, Stream1="0")
valueor0 = Number(filter)
valueor0_2 = ClusterOutput(valueor0)
