# Grasshopper definition Simulation.ghx (Grasshopper 1.0.7)
# plug-ins: MetaHopper

azad = Panel("E:\Nextcloud\Public\FOR2363\TP4\LUH\HVAC-Systems\CurrentBatch\Data_Source\Simulation-Files")  # disabled
# Somehow the summaries with empty spaces
# in the name do not work!
# Choose
ueli = Panel("E:\Nextcloud\Public\FOR2363\TP4\LUH\HVAC-Systems\CurrentBatch\Data_Source\Simulation-Files")  # disabled
workstation = Panel("G:\FOR2363\Data\CurrentBatch\Data_Source\Simulation-Files")  # disabled
ueli_2 = Panel("C:\EnergyPlusV22-2-0\WeatherData\DEU_Munich.108660_IWEC.epw")  # disabled
workstation_2 = Panel("C:\EnergyPlusV22-2-0\WeatherData\DEU_Munich.108660_IWEC.epw")  # disabled
azad_2 = Panel("C:\EnergyPlusV22-2-0\WeatherData\DEU_Munich.108660_IWEC.epw")  # disabled
# Annual Thermal Resilience Summary
# EnergyManagementSystem:OutputVariable,
#   Central Air Source Heat Pump Capacity, ! Name
#   Cap, ! EMS Variable Name
#   Averaged, ! Type of Data in Variable
#   SystemTimestep, ! Update Frequency
#   Hot_Water_Loop_Central_Air_Source_Heat_Pump_Init_Pgrm,           ! EMS Program or Subroutine Name
#   W;
panel = Panel("AnnualBuildingUtilityPerformanceSummary")  # disabled
ueli_3 = Panel("'E:\\Nextcloud\\Public\\FOR2363\\TP4\\LUH\\HVAC-Systems\\CurrentBatch\\Data_Source\\Simulation-Files\\EnergyModel.hbjson'")  # disabled
azad_3 = Panel("C:\Git\Work\FOR2363\Parametric-H-Shape-Office-Building-Model\src\simulation")  # disabled
panel_2 = Panel("Central Air Source Heat Pump Capacity")  # disabled
workstation_3 = Panel("G:\FOR2363\Data\CurrentBatch\Data_Source\Simulation-Files\EnergyModel.hbjson")  # disabled
panel_3 = Panel("AllSummaryMonthlyAndSizingPeriod")  # disabled
panel_4 = Panel("AnnualThermalResilienceSummary")  # disabled
panel_5 = Panel("Baseboard Total Heating Rate")  # disabled
panel_6 = Panel("Boiler Heating Rate")  # disabled
panel_7 = Panel("ShadingSummary")  # disabled
panel_8 = Panel("LEEDSummary")  # disabled
# 0:Workstation
# 1:Azad
# 2:Ueli
number_slider = Slider(0, range=0..2)
list = ValueList({"TranslationOnly": 0, "Simulation": 1}, selected="TranslationOnly")  # disabled
debugmode = Boolean(Toggle(False))
run = Boolean(Toggle(False))
panel_9 = Panel("AllSummary")  # disabled
panel_10 = Panel("'!-Dummy'")  # disabled
merge = Merge(Data1=panel, Data2=panel_4, Data3=panel_8, Data4=panel_7)  # disabled
merge_2 = Merge(Data1=panel_2, Data2=panel_5, Data3=panel_6)  # disabled
list_2 = ValueList({"Ocean", "Country", "Suburbs", "Urban", "City"}, selected="City")  # disabled
user = Integer(number_slider)
user_2 = Integer(user)  # disabled
user_3 = Integer(user)  # disabled
filter = StreamFilter(Gate=user_2, Stream0=workstation, Stream1=azad, Stream2=ueli)  # disabled
filter_2 = StreamFilter(Gate=user_3, Stream0=workstation_3, Stream1=azad_3, Stream2=ueli_3)  # disabled
filter_3 = StreamFilter(Gate=user_3, Stream0=workstation_2, Stream1=azad_2, Stream2=ueli_2)  # disabled
int = Integer(list)  # disabled
onoff = EnableDisableObject(Enabled=run, AllObjects_Object=modeltoosm)
onoff_2 = EnableDisableObject(
    Enabled=debugmode,
    AllObjects_Object=[merge, list_2, panel_10, panel_6, list, vizbytype, panel, int, panel_5, merge_2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])
terrain = GetString(list_2, AtLeast=1, AtMost=1, TreeAccess=False)
honeybee_filepath = GetString(filter_2, AtLeast=1, AtMost=1, TreeAccess=False)
epw_filepath = GetString(filter_3, AtLeast=1, AtMost=1, TreeAccess=False)
output_names = GetString(merge_2, AtLeast=1, AtMost=1, TreeAccess=True)
report_names = GetString(panel_9, AtLeast=1, AtMost=1, TreeAccess=True)
simulationmode = GetInteger(int, AtLeast=1, AtMost=1, Maximum=2147483647, Minimum=-2147483648, TreeAccess=False)
additionalidf = GetString(panel_10, AtLeast=1, AtMost=1, TreeAccess=True)
output_directory = GetString(filter, AtLeast=1, AtMost=1, TreeAccess=False)
terrain_2 = Text(terrain)
correct = Correct(computetext=honeybee_filepath)
correct_2 = Correct(computetext=epw_filepath)
correct_3 = Correct(computetext=output_directory)
honeybee_filepath_2 = FilePath(correct)
loadobjects = HBLoadObjects(hb_file=honeybee_filepath_2, load=Toggle(True))  # -> report, hb_objs; plug-in component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
output_names_2 = Text(output_names)
simulationmode_2 = Integer(simulationmode)
report_names_2 = Text(report_names)
epw_filepath_2 = FilePath(correct_2)
output_directory_2 = FilePath(correct_3)
additionalidf_2 = Text(additionalidf)
hb_model = Data(loadobjects.hb_objs)
vizbytype = HBVisualizeByType(hb_objs=hb_model)  # -> walls, interior_walls, roofs, ceilings, exterior_floors, interior_floors, air_walls, apertures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; disabled; plug-in component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

toggle = BooleanToggle(False)
simoutput = HBSimulationOutput(
    zone_energy_use=toggle,
    hvac_energy_use=toggle,
    gains_and_losses=toggle,
    comfort_metrics=toggle,
    surface_temperature=toggle,
    surface_energy_flow=toggle)  # -> report, sim_output; plug-in component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
toggle_2 = BooleanToggle(True)
simcontrol = HBSimulationControl(
    do_zone_sizing=toggle_2,
    do_system_sizing=toggle_2,
    do_plant_sizing=toggle_2,
    for_sizing_period=toggle_2,
    for_run_period=Toggle(True))  # -> sim_control; plug-in component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
shadowcalc = HBShadowCalculation(solar_dist=Slider(0, range=0..100), update_method="Timestep", frequency=Slider(1, range=0..1))  # -> shadow_calc; plug-in component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
customoutput = HBCustomSimulationOutput(
    base_sim_output=simoutput.sim_output,
    output_names=output_names_2,
    report_frequency="Annual",
    summary_reports=report_names_2)  # -> report, sim_output; plug-in component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
expression = Expression(x=simulationmode_2, Expression="if(x=1,3,2)")
simpar = HBSimulationParameter(
    output=customoutput.sim_output,
    timestep=Slider(1, range=0..1),
    terrain=terrain_2,
    sim_control=simcontrol,
    shadow_calc=shadowcalc)  # -> sim_par; plug-in component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
# ADJUSTED: due to bug of FixedIntervalSchedule
# https://discourse.ladybug.tools/t/fixed-interval-schedule-issue/14529
modeltoosm = HBModelToOSM(
    model=hb_model,
    epw_file=epw_filepath_2,
    sim_par=simpar,
    add_str=additionalidf_2,
    folder=output_directory_2,
    write=Toggle(True),
    run=expression)  # -> report, jsons, osw, osm, idf, sql, zsz, rdd, html; disabled; plug-in component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
sql_filepath = Text(modeltoosm.sql)

sizingpar = HBSizingParameter()  # -> sizing; plug-in component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
reportdatadictionary_filepath = Text(modeltoosm.rdd)
item = ListItem(List=modeltoosm.jsons, Index=0, Wrap=True)  # -> Item, Item1
idf_filepath = Text(modeltoosm.idf)
reports_filepath = Text(modeltoosm.html)
zonesizing_filepath = Text(modeltoosm.zsz)
simulationparameters_filepath = Text(item.Item1)
context_print = ContextPrint(Text=modeltoosm.idf)

# ==== cluster Correct
computetext = ClusterInput()
computetext_2 = Text(computetext)
strip = NAME(x=computetext_2, y="\"'")  # -> a
# ---------- strip: Python ----------
a = x.strip(y)
# ---------- end strip ----------
# Compute wrapps paths which turn into string literals.
# To undo this, unwrapping is neciassary.
# Assumption no recursion level deeper than 2.
# The wrong wrapping rises with 2^n
panel = Panel("\"E:\\\\\\\\\\\\\\\\Nextcloud\\\\\\\\\\\\\\\\Public\\\\\\\\\\\\\\\\FOR2363\\\\\\\\\\\\\\\\TP4\\\\\\\\\\\\\\\\LUH\\\\\\\\\\\\\\\\HVAC-Systems\\\\\\\\\\\\\\\\BatchCurrent\\\\\\\\\\\\\\\\Data_Source\\\\\\\\\\\\\\\\Simulation-Files\\\\\\\\\\\\\\\\Simulation000\\\\\\\\\\\\\\\\openstudio\\\\\\\\\\\\\\\\run\\\\\\\\\\\\\\\\in.idf\"")
rep = ReplaceText(Text=strip, Find="\\", Replace="\", RecursiveReplace=False)
rep_2 = ReplaceText(Text=rep, Find="\\", Replace="\", RecursiveReplace=False)
rep_3 = ReplaceText(Text=rep_2, Find="\\", Replace="\", RecursiveReplace=False)
rep_4 = ReplaceText(Text=rep_3, Find="\\", Replace="\", RecursiveReplace=False)
rep_5 = ReplaceText(Text=rep_4, Find="\\", Replace="\", RecursiveReplace=False)
rep_6 = ReplaceText(Text=rep_5, Find="\\", Replace="\", RecursiveReplace=False)
rep_7 = ReplaceText(Text=rep_6, Find="\\", Replace="\", RecursiveReplace=False)
rep_8 = ReplaceText(Text=rep_7, Find="\\", Replace="\", RecursiveReplace=False)
rep_9 = ReplaceText(Text=rep_8, Find="%", Replace="\", RecursiveReplace=False)
rep_10 = ReplaceText(Text=rep_9, Find="$", Replace=":", RecursiveReplace=False)
originaltext = Text(rep_10)
originaltext_2 = ClusterOutput(originaltext)
